# Grasshopper definition 2.JD_setup.gh (Grasshopper 1.0.7)
# plug-ins: EleFront

# Back foundation brep since doing it in GH is time consuming
# Rename the axes
# 
# Send everything to close to local origin 0,0,0
number_slider = Slider(10, range=0..10)
# Update this for Rhino 8!
# You should have saved that
# from 1.JD_SwissALTI3D.gh
pipeline = GeometryPipeline(
    GroupByLayer=False,
    GroupByType=False,
    IncludeHidden=True,
    IncludeLocked=True,
    LayerFilter="Terrain_brep",
    NameFilter="*",
    SublayerFiltering=True,
    TypeFilter=1073741848)
neg = Negative(Value=number_slider)
pt = Point("{0,0,0}")
Z = UnitZ(Factor=neg)
move = Move(Geometry=pipeline, Motion=Z)  # -> Geometry, Transform

# ----
# Transform to send to local 0,0,0
transform = Transform({TransformCount=1, Name="Translation", tx=-2580598.7, ty=-1083020.6, tz=0})

concat = Concatenate(FragmentA="Terrain_brep_offset_", FragmentB=neg)
attributes = DefineObjectAttributes(Layer=concat)
bake = BakeObjects(Geometry=move.Geometry, Attributes=attributes, Bake=False)
attributes_2 = DefineObjectAttributes(Layer="Arch::Axes::BG")
transform_2 = Transform(Transform=transform)
bake_2 = BakeObjects(Geometry=transform_2, Attributes=attributes_2, Bake=False)
srfpt = SurfacePoints(Surface=pipeline)  # -> Points, Weights, Greville, UCount, VCount
pdecon = Deconstruct(Point=srfpt.Points)  # -> XComponent, YComponent, ZComponent
sort = SortList(Keys=pdecon.ZComponent, ValuesA=srfpt.Points)  # -> Keys, ValuesA
xy = XYPlane(Origin=Point(0, 0, 0))
# Highest point in terrain
item = ListItem(List=reverse(sort.ValuesA), Index=0, Wrap=True)
# Lowest point in terrain
item_2 = ListItem(List=sort.ValuesA, Index=0, Wrap=True)
pdecon_2 = Deconstruct(Point=item_2)  # -> XComponent, YComponent, ZComponent
pdecon_3 = Deconstruct(Point=item)  # -> XComponent, YComponent, ZComponent
project = Project(Geometry=pipeline, Plane=xy)  # -> Geometry, Transform
fmerge = MergeFaces(Brep=project.Geometry)  # -> Breps, Before, After
subtraction = Subtraction(A=pdecon_3.ZComponent, B=pdecon_2.ZComponent)
crv = Curve(fmerge.Breps)
crv_2 = Curve(crv)
eval = EvaluateCurve(Curve=crv_2, Parameter="0")  # -> Point, Tangent, Angle
vec2pt = Vector2Pt(PointA=eval.Point, PointB=pt, Unitize=False)  # -> Vector, Length
move_2 = Move(Geometry=crv_2, Motion=vec2pt.Vector)  # -> Geometry, Transform
height_of_the_levels = Slider(10, range=0..100)
integer_division = IntegerDivision(A=subtraction, B=height_of_the_levels)
series = Series(Start=pdecon_2.ZComponent, Step=height_of_the_levels, Count=integer_division)
Z_2 = UnitZ(Factor=series)
xy_2 = XYPlane(Origin=Point(0, 0, 0))
move_3 = Move(Geometry=xy_2, Motion=Z_2)  # -> Geometry, Transform

# ----
# Press here and
# wait patiently.
dam = DataDam(DataA=pipeline, DataB=move_3.Geometry, BufferDelay=10000000, BufferMode=0)  # -> DataA, DataB; disabled
dam_2 = DataDam(DataA=pipeline, DataB=item_2, DataC=height_of_the_levels, BufferDelay=10000000, BufferMode=0)  # -> DataA, DataB, DataC

sec = BrepPlane(Brep=dam.DataA, Plane=dam.DataB)  # -> Curves, Points; disabled
contour = Contour(Shape=dam_2.DataA, Point=dam_2.DataB, Direction=Vector(0, 0, 1), Distance=dam_2.DataC)  # disabled
# Bake this into Rhino!
attributes_3 = DefineObjectAttributes(Layer="Terrain_levels")
attributes_4 = DefineObjectAttributes(Layer="Terrain_base")
attributes_5 = DefineObjectAttributes(Layer="Terrain_base_curve")
bake_3 = BakeObjects(Geometry=contour, Attributes=attributes_3, Bake=False)
bake_4 = BakeObjects(Geometry=fmerge.Breps, Attributes=attributes_4, Bake=False)
bake_5 = BakeObjects(Geometry=crv, Attributes=attributes_5, Bake=False)
