# Grasshopper definition 3.JD_Dams.gh (Grasshopper 1.0.7)
# Copyright: © 2017-2018 Pierre Cuvilliers, Caitlin Mueller, Massachusetts Institute of Technology
# plug-ins: ProvingGround.Conduit, Telepathy, Pufferfish, LunchBox, Heteroptera, Human, Pancake, UiPlus, MetaHopper, EleFront

panel = Panel("C:\Users\Admin\Gruner AG\Jumping dams [EXP] - General\03_Model\Example image.png")

# ----
# Dashboard structure
panel_2 = Panel("Type of Dam (m)")
panel_3 = Panel("""Concrete gravity dam
Arch dam
Embankment dam""")

# ----
# Energy Inputs
# Dashboard structure
# Dashboard - fill in data and listen to outputs
panel_4 = Panel("Ecological discharge [m3/s]")
label = UiLabel(Label=panel_4, Style=3)
slider = UiSlider(Value=0.5, Bounds=Domain(0, 1), Increment=0.1)
label_2 = UiLabel(Label="Powerplant efficiency [%]", Style=3)
label_3 = UiLabel(Label="Head losses (%)", Style=3)
label_4 = UiLabel(Label="Inputs energy", Style=1)
label_5 = UiLabel(Label="Discharge river (m3/s)*", Style=3)
label_6 = UiLabel(Label="Delta T*", Style=3)
label_7 = UiLabel(Label="*Input 12 Months separated with comma without spaces!", Style=4)
label_8 = UiLabel(Label="Design discharge [m3/s]", Style=3)
slider_2 = UiSlider(Value=0.5, Bounds=Domain(0, 1), Increment=0.1)
text_box = UiTextBox(Text="Click here to change text", Wrap=True)
text_box_2 = UiTextBox(Text="Click here to change text", Wrap=True)
slider_3 = UiSlider(Value=0.5, Bounds=Domain(0, 1), Increment=0.1)
slider_4 = UiSlider(Value=0.5, Bounds=Domain(0, 1), Increment=0.1)
merge = Merge(
    Data1=label_4,
    Data2=label_5,
    Data3=text_box,
    Data4=label_6,
    Data5=text_box_2,
    Data6=label_7,
    Data7=label_3,
    Data8=slider_3,
    Data9=label_8,
    Data10=slider_4,
    Data11=label,
    Data12=slider,
    Data13=label_2,
    Data14=slider_2)
wrap = UiWrapLayout(Elements=merge, Horizontal=False, Direction=0)
merge_2 = Merge(Data1=wrap)
panel_5 = Panel("""Inputs energy
Inputs Dam""")
tab = UiTabbedLayout(Elements=merge_2, Names=panel_5)
energy_inputs = Button()
panel_6 = Panel("Ex: 0.56,0.46,0.47,0.85,4.51,8.72,7.77,5.34,3.01,1.99,1.13,0.72")
window = UiWindow(Elements=merge_2, Title="Energy Inputs", Owner=1, Scroll=True, Launch=energy_inputs)
slider_5 = UiSlider(Element=slider, Label="m3/s", Value=".2", Bounds="0 To 5", Increment=".01")
slider_6 = UiSlider(Element=slider_2, Label="%", Value="88", Bounds="0 To 100", Increment=".1")
text_box_3 = UiTextBox(Element=text_box, Text=panel_6, Wrap=True)
text_box_4 = UiTextBox(Element=text_box_2, Text="Ex: 744,672,744,720,744,720,744,744,720,744,720,744", Wrap=True)
slider_7 = UiSlider(Element=slider_3, Label="%", Value="5", Bounds="0 To 10", Increment=0.1)
slider_8 = UiSlider(Element=slider_4, Label="m3/s", Value="5", Bounds="0 To 20", Increment=0.1)
get_values = UiValues(Element=text_box_4)  # -> flatten(Values)
get_values_2 = UiValues(Element=text_box_3)  # -> flatten(Values)
get_values_3 = UiValues(Element=slider_5)  # -> flatten(Values)
get_values_4 = UiValues(Element=slider_6)  # -> flatten(Values)
get_values_5 = UiValues(Element=slider_7)  # -> flatten(Values)
get_values_6 = UiValues(Element=slider_8)  # -> flatten(Values)
split = TextSplit(Text=get_values, Separators=" ")  # -> reverse(flatten(Result))
split_2 = TextSplit(Text=get_values_2, Separators=" ")  # -> reverse(flatten(Result))
item = ListItem(List=split, Index=0, Wrap=True)
item_2 = ListItem(List=split_2, Index=0, Wrap=True)
split_3 = TextSplit(Text=item, Separators=",")  # -> flatten(Result)
split_4 = TextSplit(Text=item_2, Separators=",")  # -> flatten(Result)
ecological_discharge_m3_s_input_from_das = Panel(get_values_3)  # "Ecological discharge [m3/s] - Input from Dashboard"
discharge_in_the_river_m3_s_input_from_d = Panel(split_4)  # "Discharge in the river [m3/s] - Input from Dashboard"
delta_t_input_from_dashboard = Panel(split_3)
powerplant_efficiency_input_from_dashboa = Panel(get_values_4)  # "Powerplant efficiency [%]- Input from Dashboard"
head_losses_input_from_dashboard = Panel(get_values_5)
design_discharge_m3_s_input_from_dashboa = Panel(get_values_6)  # "Design discharge [m3/s] - Input from Dashboard"
discharge_in_the_river_m3_s_madagascar = Panel("""77.73
84.37
67.49
45.11
24.17
16.78
13.85
11.21
8.05
8.89
18.47
39.28""")
i_energy_dir = RemoteSender(discharge_in_the_river_m3_s_input_from_d)
i_energy_dt = RemoteSender(delta_t_input_from_dashboard)
i_energy_design_discharge = RemoteSender(design_discharge_m3_s_input_from_dashboa)
i_energy_ecological_discharge = RemoteSender(ecological_discharge_m3_s_input_from_das)
i_energy_powerplant_efficiency = RemoteSender(powerplant_efficiency_input_from_dashboa)
i_energy_head_losses = RemoteSender(head_losses_input_from_dashboard)
discharge_in_the_river_m3_s_les_toules = Panel("""0.56
0.46
0.47
0.85
4.51
8.72
7.77
5.34
3.01
1.99
1.13
0.72""")

panel_7 = Panel("""False
True
False""")

# ----
# For python remote
# In conda cmd prompt:
# 
# conda activate C:\Users\cna\.conda\envs\rhinoremote
# 
# pip install <package> - for any missing package check the ouput to the right
# 
# For PIL -> pip install pillow
panel_8 = Panel("C:\Users\cna\Anaconda3\envs\rhinoremote")
panel_9 = Panel("""PIL
openpyxl""")
pythonremote = GHPythonRemote(location=panel_8, run=Toggle(False), modules=panel_9)  # -> out, linked_modules, rpy, import_statements
panel_10 = Panel(pythonremote.import_statements)
panel_11 = Panel(pythonremote.out)

radio = UiRadio(Label=panel_3, State=panel_7, Group="Group 1")
label_9 = UiLabel(Label=panel_2, Style=3)
label_10 = UiLabel(Label="Dam height (m)", Style=3)
scroll_integer = UiScrollInteger(SelectedInteger=0, Wrap=False)
image = UiImage(Bitmap=panel, Fitting=1)
label_11 = UiLabel(Label="Freeboard (m)", Style=3)
slider_9 = UiSlider(Value=0.5, Bounds=Domain(0, 1), Increment=0.1)
label_12 = UiLabel(Label="Foundation depth (m)", Style=3)
button = UiButton(Label="Ok")
toggle = UiToggle(State=False)
does_the_old_dam_exist_in_the_variant = BooleanToggle(False)
slider_10 = UiSlider(Value=0.5, Bounds=Domain(0, 1), Increment=0.1)
toggle_2 = UiToggle(State="True")
pipeline = GeometryPipeline(
    GroupByLayer=False,
    GroupByType=False,
    IncludeHidden=True,
    IncludeLocked=True,
    LayerFilter="River",
    NameFilter="*",
    SublayerFiltering=True,
    TypeFilter=4)  # disabled

pipeline_2 = GeometryPipeline(
    GroupByLayer=False,
    GroupByType=False,
    IncludeHidden=True,
    IncludeLocked=True,
    LayerFilter="Upstream_point",
    NameFilter="*",
    SublayerFiltering=True,
    TypeFilter=1)
# Global settings
reference_points_ph = GeometryPipeline(
    GroupByLayer=False,
    GroupByType=False,
    IncludeHidden=True,
    IncludeLocked=True,
    LayerFilter="Power house",
    NameFilter="*",
    SublayerFiltering=True,
    TypeFilter=1)  # disabled
pipeline_3 = GeometryPipeline(
    GroupByLayer=False,
    GroupByType=False,
    IncludeHidden=True,
    IncludeLocked=True,
    LayerFilter="Axes",
    NameFilter="*",
    SublayerFiltering=True,
    TypeFilter=4)

# ----
# Slider dam line
slider_11 = Slider(0, range=0..6)
# _Automotions
slider_12 = Slider(0, range=0..10)
lng = ListLength(List=pipeline_3)
expression = Expression(x=lng, Expression="x-1")
c_script = CSharpScript(name="Axes", min=slider_12, max=expression, decimals=slider_11)  # -> out, A; inputs name: String, min: Double, max: Double, decimals: Int32
# ---------- c_script: C# ----------
    foreach (IGH_DocumentObject obj in owner.OnPingDocument().Objects )
    {
      Grasshopper.Kernel.Special.GH_NumberSlider slider = obj as Grasshopper.Kernel.Special.GH_NumberSlider;
      if (slider == null) { continue; }
      if (slider.NickName.Equals(name, StringComparison.OrdinalIgnoreCase))
      {
        double norm = slider.Slider.NormalizedValue;

        slider.Slider.Minimum = (decimal) min;
        slider.Slider.Maximum = (decimal) max;
        if (decimals <= 0)
        {
          slider.Slider.Type = Grasshopper.GUI.Base.GH_SliderAccuracy.Integer;
        }
        else
        {
          slider.Slider.Type = Grasshopper.GUI.Base.GH_SliderAccuracy.Float;
          slider.Slider.DecimalPlaces = decimals;
        }

        //Must disable events since we are modifying this thing during a solution.
        //This is actually illegal.
        slider.Slider.RaiseEvents = false;
        slider.Slider.NormalizedValue = norm;
        slider.Slider.RaiseEvents = true;
      }
    }
# ---------- end c_script ----------

mesh = GeometryPipeline(
    GroupByLayer=False,
    GroupByType=False,
    IncludeHidden=True,
    IncludeLocked=True,
    LayerFilter="Terrain_mesh",
    NameFilter="*",
    SublayerFiltering=True,
    TypeFilter=32)
pipeline_4 = GeometryPipeline(
    GroupByLayer=False,
    GroupByType=False,
    IncludeHidden=True,
    IncludeLocked=True,
    LayerFilter="Terrain_levels",
    NameFilter="*",
    SublayerFiltering=True,
    TypeFilter=4)
mesh_2 = GeometryPipeline(
    GroupByLayer=False,
    GroupByType=False,
    IncludeHidden=True,
    IncludeLocked=True,
    LayerFilter="Terrain_brep",
    NameFilter="*",
    SublayerFiltering=True,
    TypeFilter=1073741848)
mesh_3 = GeometryPipeline(
    GroupByLayer=False,
    GroupByType=False,
    IncludeHidden=True,
    IncludeLocked=True,
    LayerFilter="Terrain_base",
    NameFilter="*",
    SublayerFiltering=True,
    TypeFilter=1073741848)

# ---- group: an old dam
brep = Brep(<brep referenced from the Rhino model>)

# ----
axes = Slider(0, range=0..4)
merge_3 = Merge(
    Data1=label_9,
    Data2=radio,
    Data3=label_10,
    Data4=scroll_integer,
    Data5=label_11,
    Data6=slider_9,
    Data7=label_12,
    Data8=slider_10,
    Data9=button,
    Data10=toggle,
    Data11=toggle_2)  # -> flatten(Result)
item_3 = ListItem(List=pipeline_3, Index=axes, Wrap=True)
dam_configuration = Button()
bill_of_quantities = Button()
window_2 = UiWindow(Elements=merge_3, Title="Dam Configuration", Owner=1, Scroll=True, Launch=dam_configuration)
list = ValueList({"2050": "2250", "2070": "2270"}, selected="2050")
resize = UiResize(Element=image, Width="200", Height="200")
scroll_integer_2 = UiScrollInteger(Element=scroll_integer, Label="Dam height", SelectedInteger=list, Wrap=False)
window_3 = UiWindow(Title="Bill of Quantities", Owner=1, Scroll=True, Launch=bill_of_quantities)
dam_axes_all = RemoteSender(pipeline_3)
dam_axis = RemoteSender(item_3)
brep_terrain_base = RemoteSender(mesh_3)
slider_13 = UiSlider(Element=slider_9, Label="m", Value="1.5", Bounds="0 To 5", Increment=".1")
button_2 = UiButton(Element=button, Label="Send changes")
brep_terrain = RemoteSender(mesh_2)
mesh_terrain = RemoteSender(mesh)  # disabled
slider_14 = UiSlider(Element=slider_10, Label="m", Value="10", Bounds="0 To 50", Increment=".1")
lines_levels = RemoteSender(pipeline_4)
toggle_3 = UiToggle(Element=toggle, Label="Show direction river flow?", State=False)
toggle_4 = UiToggle(Element=toggle_2, Label="Visualize dimensions?", State=False)
get_values_7 = UiValues(Element=radio)  # -> flatten(Values)
get_values_8 = UiValues(Element=scroll_integer_2)  # -> flatten(Values)
get_values_9 = UiValues(Element=slider_13)  # -> flatten(Values)
get_values_10 = UiValues(Element=slider_14)  # -> flatten(Values)
get_values_11 = UiValues(Element=button_2)  # -> flatten(Values)
get_values_12 = UiValues(Element=toggle_3)  # -> flatten(Values)
get_values_13 = UiValues(Element=toggle_4)  # -> flatten(Values)
dam_type = Panel(get_values_7)
# Dashboard - fill in data and listen to outputs
dam_type_index = Panel("""0
1
2""")
dam_height_m_input_from_dashboard = Panel(get_values_8)
freeboard_m_input_from_dashboard = Panel(get_values_9)
offset_foundation_m_input_from_dashboard = Panel(get_values_10)
panel_12 = Panel(get_values_12)
panel_13 = Panel(get_values_13)
panel_14 = Panel(get_values_11)
panel_15 = Panel("INPUTS")
dispatch = Dispatch(List=dam_type_index, DispatchPattern=dam_type)  # -> ListA, ListB
panel_16 = Panel("PROCESS")
viz_direction_river = RemoteSender(panel_12)
viz_dimensions = RemoteSender(panel_13)
panel_18 = Panel("OUTPUTS")
panel_19 = Panel("VISUALIZATION")

dam = DataDam(
    DataA=dispatch.ListA,
    DataB=dam_height_m_input_from_dashboard,
    DataC=freeboard_m_input_from_dashboard,
    DataD=offset_foundation_m_input_from_dashboard,
    BufferDelay=5000000,
    BufferMode=2)  # -> DataA, DataB, DataC, DataD
objfromgroup = GetObjectsInGroup()

dam_2 = DataDam(DataA=dispatch.ListA, BufferDelay=2500000, BufferMode=2)
dam_3 = DataDam(DataA=dam_height_m_input_from_dashboard, BufferDelay=10000000, BufferMode=0)
dam_4 = DataDam(DataA=freeboard_m_input_from_dashboard, BufferDelay=10000000, BufferMode=0)
dam_5 = DataDam(DataA=offset_foundation_m_input_from_dashboard, BufferDelay=10000000, BufferMode=0)
panel_20 = Panel("CHECK")

lng_2 = ListLength(List=objfromgroup)
dup = DuplicateData(Data=panel_14, Number=lng_2, Order=True)

panel_21 = Panel(panel_14)
subtraction = Subtraction(A=dam.DataB, B=dam.DataC)
inpupt_offset_foundation_m = Panel(dam.DataD)
elevation_water = RemoteSender(subtraction)
offset_foundation = RemoteSender(dam.DataD)
dam_height = RemoteSender(dam.DataB)
dam_type_2 = RemoteSender(dam_2)
freeboard = RemoteSender(dam.DataC)
setobj = SetObjectValue(ObjectToSet=flatten(objfromgroup), ValueToSet=flatten(dup))
panel_22 = Panel(dup)
panel_23 = Panel("Cost rock fill foundation (CHF/m3)")  # disabled
panel_24 = Panel("Cost rock fill(CHF/m3)")  # disabled
label_13 = UiLabel(Label="Cost concrete foundation (CHF/m3)", Style=3)
grid_chart = UiGridChart(Titles=True)
label_14 = UiLabel(Label="Cost concrete(CHF/m3)", Style=3)
label_15 = UiLabel(Label=panel_23, Style=3)  # disabled
label_16 = UiLabel(Label=panel_24, Style=3)  # disabled
scroll_number = UiScrollNumber(Number=0, Wrap=False, Digits=3)
merge_4 = Merge(Data5=grid_chart)  # -> flatten(Result)
scroll_number_2 = UiScrollNumber(Number=0, Wrap=False, Digits=3)
scroll_number_3 = UiScrollNumber(Number=0, Wrap=False, Digits=3)
scroll_number_4 = UiScrollNumber(Number=0, Wrap=False, Digits=3)
merge_5 = Merge(Data1=scroll_number_4, Data2=scroll_number_3, Data3=scroll_number, Data4=scroll_number_2, Data5=grid_chart)  # -> flatten(Result)
dam_configuration_2 = Button()
offset_foundation_2 = RemoteReceiver(offset_foundation)
list_2 = ValueList({"Concrete Dam": "1", "Arch Dam": "2", "Embankment Dam": "3"}, selected=["Concrete Dam", "Arch Dam", "Embankment Dam"])
dam_height_2 = RemoteReceiver(dam_height)
dam_axis_2 = RemoteReceiver(dam_axis)

# ---- group: Topography contour lines
# Technical Memorandum No. EM36-86-68110: Obtain a print of the topography of the proposed dam site at a scale of 1”:100’ with
# 5 or 10-foot contour intervals.
panel_25 = Panel("10")  # disabled
# This changes when the axis line calculate and recalculate the basics again
expression_2 = Expression(ft=panel_25, Expression="ft*0.3048")  # disabled
panel_26 = Panel(expression_2)  # disabled

# ----
scroll_number_5 = UiScrollNumber(Element=scroll_number_4, Label="Cost concrete foundation (CHF/m3)", Number=0, Wrap=False, Digits=2, Bounds="0 To 1000")
scroll_number_6 = UiScrollNumber(Element=scroll_number_3, Label="Cost concrete (CHF/m3)", Number=0, Wrap=False, Digits=2, Bounds="0 To 1000")
scroll_number_7 = UiScrollNumber(Element=scroll_number, Label="Cost rock fill foundation (CHF/m3)", Number=0, Wrap=False, Digits=2, Bounds="0 To 1000")
window_4 = UiWindow(Elements=merge_5, Title="Costs", Owner=1, Scroll=True, Launch=dam_configuration_2)
scroll_number_8 = UiScrollNumber(Element=scroll_number_2, Label="Cost rock fill (CHF/m3)", Number=0, Wrap=False, Digits=2, Bounds="0 To 1000")
# Technical Memorandum No. EM36-86-68110: 2.1.3 Lines of Centers
# 
# The lines of centers define the horizontal shape of the arches in an arch dam. The shape of the arches starts at the crown cantilever and curves horizontally downstream toward the abutments. The line of centers create the geometry of the circular arcs at each elevation of the dam for the upstream and downstream faces by defining the center point of a circle and the radius of the circle. Depending on the shape and number of lines of centers, the arches can be
# 1) uniform thickness from abutment to abutment,
# 2) variable thickness from abutment to abutment,
# 3) different on the left side of the dam compared to the right side of the dam, or
# 4) different in the center of the dam compared to the outer part of the dam.
# Technical Memorandum No. EM36-86-68110: A double curvature arch dam has curvature in the arches and in the crown cantilever.
panel_27 = Panel(list_2)
Z = UnitZ(Factor=dam_height_2)

# ---- group: Selecting dam height level
brep_terrain_2 = RemoteReceiver(brep_terrain)
sec = BrepPlane(Brep=brep_terrain_2, Plane=Z)  # -> Curves, Points

# ----
project = Project(Curve=dam_axis_2, Brep=brep_terrain_2, Direction=Vector(0, 0, 1))
get_values_14 = UiValues(Element=scroll_number_5)  # -> flatten(Values)
get_values_15 = UiValues(Element=scroll_number_6)  # -> flatten(Values)
get_values_16 = UiValues(Element=scroll_number_8)  # -> flatten(Values)
neg = Negative(Value=offset_foundation_2)
get_values_17 = UiValues(Element=scroll_number_7)  # -> flatten(Values)
move = Move(Geometry=dam_axis_2, Motion=Z)  # -> Geometry, Transform
merge_6 = Merge(Data1=get_values_14, Data2=get_values_15, Data3=get_values_17, Data4=get_values_16)
x_tremez = Extremes(Curve=project, Plane=PlaneXY(0, 0, 0))  # -> Highest, Lowest
Z_2 = UnitZ(Factor=neg)
avr = Average(Input=get_values_14)
move_2 = Move(Geometry=brep_terrain_2, Motion=Z_2)  # -> Geometry, Transform
dam_height_m_input_from_dashboard_2 = Panel(get_values_14)

# ---- group: Lowest point in the section
pt = Point(x_tremez.Lowest)

# ----
dam_height_m_input_from_dashboard_3 = Panel(get_values_16)
dam_height_m_input_from_dashboard_4 = Panel(get_values_17)
dam_height_m_input_from_dashboard_5 = Panel(get_values_15)
crv_cp = CurveClosestPoint(Point=pt, Curve=move.Geometry)  # -> Point, Parameter, Distance
brep_terrain_base_foundation = RemoteSender(move_2.Geometry)
ccx = CurveCurve(CurveA=move.Geometry, CurveB=sec.Curves)  # -> flatten(Points), ParamsA, ParamsB

# ---- group: Finding the crest points at bottom EXCAVATION
bcx = BrepCurve(Brep=move_2.Geometry, Curve=move.Geometry)  # -> Curves, flatten(Points)
item_4 = ListItem(List=bcx.Points, Index=0, Wrap=True)  # -> Item, Item1

# ----
list_3 = ValueList({"Default", "JD_AngularCheck"}, selected="Default")
lineardim = DefineLinearDimension(Point1=pt, Point2=crv_cp.Point, Offset=Slider(-3, range=-100..100), DimensionStyle=list_3)

# ---- group: AXIS LINE
ln = Line(StartPoint=item_4.Item, EndPoint=item_4.Item1)

# ---- group: Selecting dam height level / Check if that is working!
levels_at_dam_height = RemoteSender(sec.Curves)

# ----
panel_28 = Panel("""Description
Volume (m3)
Specific costs (CHF/m3)
Total costs (CHF)""")
panel_29 = Panel("""Concrete foundation
Concrete top
Rockfill foundation
Rockfill top""")
lowest_point_dam_section = RemoteSender(pt)
dimensions_check = RemoteSender(lineardim)
# This is just for the concrete dam!!
out_dam_height = RemoteSender(crv_cp.Distance)
axis_line = RemoteSender(ln)
# 1. Determine L1 with section line
axis_line_2 = RemoteReceiver(axis_line)
end = EndPoints(Curve=axis_line_2)  # -> Start, End
# On the formulas it is assumed here
# the lenght to excavated sound rock!
# Check technical memorandum. I have
#  changed the axis line to come from the
#  determined excavation on 06.06.23
dist = Distance(PointA=end.Start, PointB=end.End)
arch_l1 = RemoteSender(dist)
number_slider = Slider(378, range=0..1000)  # disabled

raxis_adjustments = Slider(3, range=3..15)
axis_line_3 = RemoteReceiver(axis_line)
# ARCH DAM
# Steps from the Technical Memorandum
#  No. EM36-86-68110
# Technical Memorandum No. EM36-86-68110: 4.2 Determine an Appraisal Level Arch Dam Layout
# 
# 3 - If the topography map is of the ground surface, change the contours to represent the position of sound rock.
axis_line_4 = RemoteReceiver(axis_line)

expression_3 = Expression(ft="25", Expression="ft*0.3048")
# Isn't this too big right now?
# I guess not...
panel_30 = Panel(expression_3)
dam_crest_width = Slider(6, range=0..100)
panel_31 = Panel("0.5,0.5")  # disabled
brep_terrain_3 = RemoteReceiver(brep_terrain)
# Concrete dam settings
width_crest = RemoteSender(dam_crest_width)
extend_dam_laterally_inside_the_terrain = Slider(2, range=0..5)
downstream_face_angle_ratio_1 = Slider(0.8, range=0..1)
number_slider_2 = Slider(378, range=0..1000)  # disabled
brep_terrain_base_foundation_2 = RemoteReceiver(brep_terrain_base_foundation)  # disabled
width_crest_2 = RemoteReceiver(width_crest)  # disabled
axis_line_5 = RemoteReceiver(axis_line)  # disabled
out_dam_height_2 = RemoteReceiver(out_dam_height)  # disabled
offset_foundation_3 = RemoteReceiver(offset_foundation)  # disabled
dam_type_3 = RemoteReceiver(dam_type_2)  # disabled
# WATER
toggle_5 = BooleanToggle(False)  # disabled

# ---- group: Input (Abutement vectors direction - check)
list_4 = ValueList({"Original": 0, "Flipped": 1}, selected="Flipped")

# ----
brep_terrain_base_foundation_3 = RemoteReceiver(brep_terrain_base_foundation)
brep_terrain_base_foundation_4 = RemoteReceiver(brep_terrain_base_foundation)
levels_at_dam_height_2 = RemoteReceiver(levels_at_dam_height)

# ----
# Visualization
# Terrain
lines_levels_2 = RemoteReceiver(lines_levels)  # disabled
swatch = ColourSwatch(SwatchColor=RGB(107, 107, 107))  # disabled
previewlw = CustomPreviewLineweights(Geometry=lines_levels_2, Shader=swatch, Absolute=False)  # disabled

viz_dimensions_2 = RemoteReceiver(viz_dimensions)
swatch_2 = ColourSwatch(SwatchColor=RGB(255, 174, 0))  # disabled
previewlw_2 = CustomPreviewLineweights(Geometry=levels_at_dam_height_2, Shader=ColourSwatch(SwatchColor=RGB(255, 0, 0)), Absolute=False)
list_5 = ValueList({"Default", "JD_AngularCheck"}, selected="JD_AngularCheck")
number_slider_3 = Slider(57, range=0..100)

number_slider_4 = Slider(5000, range=0..10000)  # disabled
dam_axes_all_2 = RemoteReceiver(dam_axes_all)  # disabled
number_slider_5 = Slider(4, range=0..10)  # disabled
# Visualization top
dam_axis_3 = RemoteReceiver(dam_axis)  # disabled
Z_3 = UnitZ(Factor=number_slider_4)  # disabled
move_3 = Move(Geometry=dam_axes_all_2, Motion=Z_3)  # -> Geometry, Transform; disabled
move_4 = Move(Geometry=dam_axis_3, Motion=Z_3)  # -> Geometry, Transform; disabled
number_slider_6 = Slider(1, range=0..10)  # disabled
swatch_3 = ColourSwatch(SwatchColor=RGB(194, 194, 194))  # disabled
swatch_4 = ColourSwatch(SwatchColor=RGB(47, 255, 0))  # disabled
previewlw_3 = CustomPreviewLineweights(Geometry=move_4.Geometry, Shader=swatch_4, Thickness=number_slider_5, Absolute=False)  # disabled
previewlw_4 = CustomPreviewLineweights(Geometry=move_3.Geometry, Shader=swatch_3, Thickness=number_slider_6, Absolute=False)  # disabled

viz_direction_river_2 = RemoteReceiver(viz_direction_river)  # disabled

end_of_slope_negative_height_from_the_to = Slider(-39, range=-100..-1)  # "End of slope - negative height from the top of dam (m)"
slope_intrados = Panel("1.8")
base_line_of_centers_intrados = Slider(0.52, range=0..1)
slope_extrados = Panel("1.5")
start_of_line_of_center_extrados_in_rela = Slider(0.05, range=0..1)  # "start of line of center - extrados - in relation to start of intrados"

# ----
# x. Elevations
section_height_approx = Slider(15, range=0..100)
dam_height_3 = RemoteReceiver(dam_height)
vertical = Panel("1")
vertical_2 = Panel("1")
horizontal = Panel(slope_extrados)
horizontal_2 = Panel(slope_intrados)
addition = Addition(A=dam_height_3, B=end_of_slope_negative_height_from_the_to)
Z_4 = UnitZ(Factor=vertical)
Z_5 = UnitZ(Factor=vertical_2)
pt_2 = ConstructPoint(XCoordinate=0, YCoordinate=0, ZCoordinate=addition)
rev = Reverse(Vector=Z_4)
rev_2 = Reverse(Vector=Z_5)
addition_2 = Addition(A=base_line_of_centers_intrados, B=start_of_line_of_center_extrados_in_rela)
swatch_5 = ColourSwatch(SwatchColor=RGB(36, 36, 36))

# ---- group: Foundation
# 6. Excavation
# E. Goulas: A reasonable value for the excavation can be from 10 to 30 meters (good rock conditions with minor weathering and a canyon profile ideally suited to an arch dam) in the lateral direction
# Technical Memorandum No. EM36-86-68110: Determine the base elevation of the dam. This location is to sound rock and, if that distance is unknown, can be assumed to be about 25 feet below lowest contour in
# the river bed
panel_32 = Panel("25")
offset_foundation_4 = RemoteReceiver(offset_foundation)
expression_4 = Expression(ft=panel_32, Expression="ft*0.3048")
brep_terrain_4 = RemoteReceiver(brep_terrain)
panel_33 = Panel(expression_4)
bbx = BrepBrep(BrepB=brep_terrain_4)  # -> Curves, Points
division = Division(A=offset_foundation_4, B=Slider(2, range=0..10))
neg_2 = Negative(Value=division)
offcrv = OffsetCurve(Curve=bbx.Curves, Plane=PlaneXY(0, 0, 0), Distance=neg_2, BothSides=0, Kinks=0, CapType=1)
patch = Patch(Curves=offcrv, Spans=20, Flexibility=1, Trim=True)
neg_3 = Negative(Value=offset_foundation_4)
Z_6 = UnitZ(Factor=neg_3)
extr = Extrude(Base=patch, Direction=Z_6)
base_archdam = Geometry(extr)

# ----
# Excavation
geo_archdam_base = RemoteSender(base_archdam)
coords = ImportCoordinates(Separator=",", XIndex=0, YIndex=1, ZIndex=2)
srfgrid = SurfaceFromPoints(Interpolate=False)
i_energy_head_losses_2 = RemoteReceiver(i_energy_head_losses)  # disabled
i_energy_design_discharge_2 = RemoteReceiver(i_energy_design_discharge)  # disabled
i_energy_ecological_discharge_2 = RemoteReceiver(i_energy_ecological_discharge)  # disabled
i_energy_powerplant_efficiency_2 = RemoteReceiver(i_energy_powerplant_efficiency)  # disabled

g_constant = Panel("9.81")  # disabled

i_energy_dir_2 = RemoteReceiver(i_energy_dir)  # disabled
axis_line_6 = RemoteReceiver(axis_line)  # disabled
freeboard_2 = RemoteReceiver(freeboard)  # disabled
midpt = CurveMiddle(Curve=axis_line_6)  # disabled
num = Number(i_energy_design_discharge_2)  # disabled
num_2 = Number(i_energy_ecological_discharge_2)  # disabled
num_3 = Number(i_energy_dir_2)  # disabled
axis_line_7 = RemoteReceiver(axis_line)  # disabled

# ---- group: Is that correct?
division_2 = Division(A=i_energy_powerplant_efficiency_2, B=100000)  # disabled

# ---- group: dam middle point
pt_3 = Point(midpt)  # disabled

# ----
lowest_point_dam_section_2 = RemoteReceiver(lowest_point_dam_section)

# ---- group: Just a random amplitude
number_slider_7 = Slider(50, range=0..100)

# ----
axis_line_8 = RemoteReceiver(axis_line)
pt_4 = Point(lowest_point_dam_section_2)
crv = Curve(axis_line_8)
number_slider_8 = Slider(-20, range=-21..-20)  # disabled
number_slider_9 = Slider(86, range=0..100)  # disabled
Z_7 = UnitZ(Factor=number_slider_8)  # disabled
# Section
move_5 = Move(Geometry=crv, Motion=Z_7)  # -> Geometry, Transform; disabled
Z_8 = UnitZ(Factor=number_slider_9)  # disabled
extr_2 = Extrude(Base=move_5.Geometry, Direction=Z_8)  # disabled
midpt_2 = CurveMiddle(Curve=crv)
number_slider_10 = Slider(3, range=0..10)
button_3 = Button()
axis_line_9 = RemoteReceiver(axis_line)  # disabled
pdecon = Deconstruct(Point=midpt_2)  # -> XComponent, YComponent, ZComponent
data = Data([pdecon.XComponent, pdecon.YComponent, pdecon.ZComponent])
xy = XYPlane(Origin=Point(0, 0, 0))
offset_foundation_5 = RemoteReceiver(offset_foundation)  # disabled
lowest_point_dam_section_3 = RemoteReceiver(lowest_point_dam_section)  # disabled

# ---- group: results / variants / change the number of your variant before sending to Excel!
list_6 = ValueList({"1", "2", "3", "4", "5"}, selected="1")  # disabled

# ----
panel_34 = Panel("1")  # disabled
equals = Equality(FirstNumber=list_6, SecondNumber=panel_34)  # -> Equality, Inequality; disabled

panel_35 = Panel("4")  # disabled
equals_2 = Equality(FirstNumber=list_6, SecondNumber=panel_35)  # -> Equality, Inequality; disabled

panel_36 = Panel("5")  # disabled
equals_3 = Equality(FirstNumber=list_6, SecondNumber=panel_36)  # -> Equality, Inequality; disabled

panel_37 = Panel("2")  # disabled
equals_4 = Equality(FirstNumber=list_6, SecondNumber=panel_37)  # -> Equality, Inequality; disabled

panel_38 = Panel("3")  # disabled
equals_5 = Equality(FirstNumber=list_6, SecondNumber=panel_38)  # -> Equality, Inequality; disabled

# ----
# Dam configuration
dam_axis_4 = RemoteReceiver(dam_axis)

powerhouse_pt = RemoteSender(reference_points_ph)  # disabled
# For optimization: Make perpendicular
# sections on the river line to discover
# best placement for the Dams.
point_upstream = RemoteSender(pipeline_2)
line_river = RemoteSender(pipeline)  # disabled

point_upstream_2 = RemoteReceiver(point_upstream)
crv_cp_2 = CurveClosestPoint(Point=point_upstream_2, Curve=dam_axis_4)  # -> Point, Parameter, Distance
vec2pt = Vector2Pt(PointA=point_upstream_2, PointB=crv_cp_2.Point, Unitize=False)  # -> Vector, Length

vector_waterflow = RemoteSender(vec2pt.Vector)

# ----
# Getting the correct vector of the vertical face with downstream direction
dam_height_4 = RemoteReceiver(dam_height)
axis_line_10 = RemoteReceiver(axis_line)
Z_9 = UnitZ(Factor=dam_height_4)
neg_4 = Negative(Value=Z_9)
extr_3 = Extrude(Base=move.Geometry, Direction=neg_4)
evalsrf = EvaluateSurface(Surface=reparameterize(extr_3), Point="0.5,0.5")  # -> Point, Normal, UDirection, VDirection, Frame; disabled
vector_waterflow_2 = RemoteReceiver(vector_waterflow)  # disabled
dprod = DotProduct(VectorA=evalsrf.Normal, VectorB=vector_waterflow_2, Unitize=False)  # disabled
panel_39 = Panel("0")  # disabled
smaller = SmallerThan(FirstNumber=dprod, SecondNumber=panel_39)  # -> SmallerThan, OrEqualTo; disabled
gate = StreamGate(Stream=extr_3, Gate=smaller.SmallerThan)  # -> Target0, Target1; disabled
flip = Flip(Surface=gate.Target1)  # -> Surface, Result; disabled
filter = StreamFilter(Gate=smaller.SmallerThan, Stream0=gate.Target0, Stream1=flip.Surface)  # disabled
panel_40 = Panel("0.5,0.5")  # disabled
evalsrf_2 = EvaluateSurface(Surface=reparameterize(filter), Point=panel_40)  # -> Point, Normal, UDirection, VDirection, Frame; disabled

amp = Amplitude(Vector=vector_waterflow_2, Amplitude=number_slider)  # disabled
vdisex = VectorDisplayEx(Point=evalsrf_2.Point, Vector=amp, Colour=RGB(0, 0, 0), Width=2)  # disabled

# ---- group: vector vertical face
number_slider_11 = Slider(378, range=0..1000)  # disabled
amp_2 = Amplitude(Vector=evalsrf_2.Normal, Amplitude=number_slider_11)  # disabled
vdisex_2 = VectorDisplayEx(Point=evalsrf_2.Point, Vector=amp_2, Colour=RGB(0, 0, 0), Width=2)  # disabled

# ----
# Technical Memorandum No. EM36-86-68110: 2.1.3.2 Uniform- or Variable Thickness Arch Dams
# 
# The number of lines that define the line-of-centers determines whether the arches are uniform thickness or variable thickness arches.
# The arches have uniform thickness if there is one line defining the extrados and intrados line-of-centers. This means that the radius center for the upstream and downstream faces is the same. The radii lengths are different at each elevation, but since the radius center is the same, the thickness of the arch is uniform.
# The arches vary in thickness if there are two lines defining the extrados and intrados line-of-centers. This means that the radius centers for the upstream and downstream faces are in different positions in space forcing the circular arcs of the arches to diverge.
point_upstream_3 = RemoteReceiver(point_upstream)
# GRAVITY DAM
vector_waterflow_3 = RemoteReceiver(vector_waterflow)  # disabled

# ----
# Top
# Top - A2 Volume
# Top - A1 Volume
ext = ExtendCurve(Curve=axis_line_5, Type=0, Start=extend_dam_laterally_inside_the_terrain, End=extend_dam_laterally_inside_the_terrain)
multiplication = Multiplication(A=out_dam_height_2, B="2")
atan = ArcTangent(Value=downstream_face_angle_ratio_1)
end_2 = EndPoints(Curve=ext)  # -> Start, End
line = LineSDL(Start=end_2.Start, Direction="{0,0,-1}", Length=multiplication)
rotax = RotateAxis(Geometry=line, Angle=atan, Axis=ext)  # -> Geometry, Transform
pt_5 = Point(end_2.Start)
end_3 = EndPoints(Curve=rotax.Geometry)  # -> Start, End
end_4 = EndPoints(Curve=line)  # -> Start, End
amp_3 = Amplitude(Vector=vector_waterflow_3, Amplitude=width_crest_2)
ln_2 = Line(StartPoint=end_4.End, EndPoint=end_3.End)
move_6 = Move(Geometry=pt_5, Motion=amp_3)  # -> Geometry, Transform
join = JoinCurves(Curves=flatten([line, rotax.Geometry, ln_2]), Preserve=False)
swp1 = Sweep1(Rail=ext, Sections=join, Miter=1)
project_2 = ProjectPoint(Point=move_6.Geometry, Direction="0,0,-1", Geometry=join)  # -> Point, Index
cap = CapHoles(Brep=swp1)
pline = PolyLine(Vertices=flatten([pt_5, move_6.Geometry, project_2.Point]), Closed=True)
swp1_2 = Sweep1(Rail=ext, Sections=pline, Miter=1)
splitmul = SplitBrepMultiple(Brep=cap, Cutters=brep_terrain_base_foundation_2)
cap_2 = CapHoles(Brep=swp1_2)
item_5 = ListItem(List=splitmul, Index=0, Wrap=True)
split_5 = SplitBrep(Brep=brep_terrain_base_foundation_2, Cutter=item_5)
item_6 = ListItem(List=split_5, Index=0, Wrap=True)  # -> Item, Item1
geo = Geometry(item_6.Item1)
join_2 = BrepJoin(Breps=flatten([item_5, geo]))  # -> Breps, Closed
top_concretedam = Geometry(join_2.Breps)

# ----
# Excavation
number_slider_12 = Slider(2, range=0..10)  # disabled
division_3 = Division(A=offset_foundation_3, B=number_slider_12)  # disabled
neg_5 = Negative(Value=division_3)  # disabled
offcrv_2 = OffsetCurve(Curve=geo, Plane=PlaneXY(0, 0, 0), Distance=neg_5, BothSides=0, Kinks=3, CapType=1)  # disabled
disc = Discontinuity(Curve=offcrv_2, Level=1)  # -> Points, Parameters; disabled
shatter = Shatter(Curve=offcrv_2, Parameters=disc.Parameters)  # disabled
panel_41 = Panel("Line-like Curve")  # disabled
txt = Text(shatter)  # disabled
mindex = MemberIndex(Set=txt, Member=panel_41)  # -> Index, Count; disabled
cull_i = CullIndex(List=shatter, Indices=mindex.Index, Wrap=True)  # disabled
loft = Loft(Curves=cull_i, Options={Adjust=True, Closed=False, LoftEnds=0, LoftSimp=2, LoftType=0, Rebuild=10, Refit=0.01})  # disabled
Z_10 = UnitZ(Factor=offset_foundation_3)  # disabled
extr_4 = Extrude(Base=loft, Direction=Z_10)  # disabled
excavation_archdam = Geometry(extr_4)  # disabled

geo_concretedam_top = RemoteSender(top_concretedam)
pline_2 = PolyLine(Vertices=disc.Points, Closed=False)  # disabled
fpatch = FragmentPatch(Boundary=offcrv_2)  # disabled

# ----
# Final volume
join_3 = BrepJoin(Breps=flatten([top_concretedam, cap_2]))  # -> Breps, Closed
sunion = SolidUnion(Breps=join_3.Breps)

geo_concretedam_base = RemoteSender(excavation_archdam)  # disabled
geo_concretedam = RemoteSender(sunion)
geo_concretedam_2 = RemoteReceiver(geo_concretedam)  # disabled
geo_concretedam_3 = RemoteReceiver(geo_concretedam)

# ----
# See upstream point
vector_waterflow_4 = RemoteReceiver(vector_waterflow)  # disabled
point_upstream_4 = RemoteReceiver(point_upstream)  # disabled
objfromgroup_2 = GetObjectsInGroup()  # disabled
move_7 = Move(Geometry=point_upstream_4, Motion=Z_3)  # -> Geometry, Transform; disabled
swatch_6 = ColourSwatch(SwatchColor=RGB(68, 57, 102))  # disabled
number_slider_13 = Slider(3, range=0..10)  # disabled
move_8 = Move(Geometry=point_upstream_4, Motion=Z_3)  # -> Geometry, Transform; disabled
number_slider_14 = Slider(227.5, range=0..1000)  # disabled
panel_42 = Panel("Upstream")  # disabled
vdisex_3 = VectorDisplayEx(Point=move_8.Geometry, Vector=vector_waterflow_4, Colour=swatch_6, Width=number_slider_13)  # disabled
tag = TextTag3D(Location=move_7.Geometry, Text=panel_42, Size=number_slider_14, Colour=swatch_6, Justification=7)  # disabled

onoff = EnableDisableObject(Objects=objfromgroup_2, Enabled=viz_direction_river_2)  # disabled

dam_axis_5 = RemoteReceiver(dam_axis)  # disabled
line_river_2 = RemoteReceiver(line_river)  # disabled

powerhouse_pt_2 = RemoteReceiver(powerhouse_pt)  # disabled
powerhouse_pt_3 = RemoteReceiver(powerhouse_pt)  # disabled

# ---- group: defining a power house point from the distance from a dam
Z_11 = UnitZ(Factor=1)  # disabled
extr_5 = Extrude(Base=dam_axis_5, Direction=Z_11)  # disabled
split_6 = SplitWithBrep(Curve=line_river_2, Brep=extr_5)  # -> Curve, Points; disabled
point_upstream_5 = RemoteReceiver(point_upstream)  # disabled
end_5 = EndPoints(Curve=split_6.Curve)  # -> Start, End; disabled
dist_2 = Distance(PointA=end_5.Start, PointB=point_upstream_5)  # disabled
rev_3 = ReverseList(List=dist_2)  # disabled
item_7 = ListItem(List=rev_3, Index=0, Wrap=True)  # disabled
mindex_2 = MemberIndex(Set=dist_2, Member=item_7)  # -> Index, Count; disabled
mesh_terrain_2 = RemoteReceiver(mesh_terrain)  # disabled
toggle_6 = BooleanToggle(True)  # disabled
item_8 = ListItem(List=split_6.Curve, Index=mindex_2.Index, Wrap=True)  # disabled
eval = EvaluateLength(Curve=item_8, Normalized=toggle_6)  # -> Point, Tangent, Parameter; disabled

# ---- group: power house static point
pt_6 = Point(powerhouse_pt_2)  # disabled

# ---- group: distance in straight line (!) between the dam and the PH
midpt_3 = CurveMiddle(Curve=axis_line_7)  # disabled
pln = Plane(midpt_3)  # disabled
project_3 = Project(Geometry=powerhouse_pt_3, Plane=pln)  # -> Geometry, Transform; disabled

# ---- group: distance in straight line (!) between the dam and the PH / L
dist_3 = Distance(PointA=midpt_3, PointB=project_3.Geometry)  # disabled

# ---- group: defining a power house point from the distance from a dam / Power_house_point
python = GhPythonScript(point=eval.Point, mesh=mesh_terrain_2)  # -> out, simplify(a); disabled
# ---------- python: Python ----------
__author__ = "cna"
__version__ = "2022.02.03"

import rhinoscriptsyntax as rs


#Project down...
a = rs.ProjectPointToMesh(point, mesh, (0,0,1))
# ---------- end python ----------

# ---- group: VIZ / house visualisation
number_slider_15 = Slider(20, range=0..100)  # disabled
pdecon_2 = Deconstruct(Point=python.a)  # -> XComponent, YComponent, ZComponent; disabled
addition_3 = Addition(A=pdecon_2.XComponent, B=number_slider_15)  # disabled
addition_4 = Addition(A=pdecon_2.YComponent, B=number_slider_15)  # disabled
addition_5 = Addition(A=pdecon_2.ZComponent, B=number_slider_15)  # disabled
pt_7 = ConstructPoint(XCoordinate=addition_3, YCoordinate=addition_4, ZCoordinate=addition_5)  # disabled
swatch_7 = ColourSwatch(SwatchColor=RGB(255, 242, 99))  # disabled
box = Box2Pt(PointA=pt_7, PointB=python.a, Plane=PlaneXY(0, 0, 0))  # disabled
preview = CustomPreview(Geometry=box, Material=swatch_7)  # disabled

# ----
vector_waterflow_5 = RemoteReceiver(vector_waterflow)
amp_4 = Amplitude(Vector=vector_waterflow_5, Amplitude=number_slider_7)
move_9 = Move(Geometry=pt_4, Motion=amp_4)  # -> Geometry, Transform
ln_3 = Line(StartPoint=pt_4, EndPoint=move_9.Geometry)

# ---- group: View Plane - Check if the direction is correct
# SECTION CUT
crv_2 = Curve(ln_3)
Z_12 = UnitZ(Factor=Slider(-20, range=-21..-20))
move_10 = Move(Geometry=crv_2, Motion=Z_12)  # -> Geometry, Transform
Z_13 = UnitZ(Factor=Slider(86, range=0..100))
extr_6 = Extrude(Base=move_10.Geometry, Direction=Z_13)
midpt_4 = CurveMiddle(Curve=crv_2)
flip_2 = Flip(Surface=extr_6)  # -> Surface, Result

# ----
vector_waterflow_6 = RemoteReceiver(vector_waterflow)

# ----
# Section
number_slider_16 = Slider(2, range=0..10)
number_slider_17 = Slider(4, range=0..10)
offset = OffsetCurve(Curve=crv_2, Distance=Slider(50, range=0..100), Corners=1)
midpt_5 = CurveMiddle(Curve=offset)
camera = CameraCrane(Location=midpt_5, Target=midpt_4, Perspective="0", View=number_slider_16, Refresh=button_3)  # -> Camera, Target, Lens, Up, HorizontalViewAngle, VerticalViewAngle, ScreenRatio, Frame

evalsrf_3 = EvaluateSurface(Surface=reparameterize(flip_2.Surface), Point="0.5,0.5")  # -> Point, Normal, UDirection, VDirection, Frame

rev_4 = Reverse(Vector=vector_waterflow_6)
pl = PlaneNormal(Origin=midpt_2, ZAxis=rev_4)
devec = DeconstructVector(Vector=rev_4)  # -> XComponent, YComponent, ZComponent
amp_5 = Amplitude(Vector=vector_waterflow_6, Amplitude=Slider(50, range=0..100))

pdecon_3 = Deconstruct(Point=evalsrf_3.Normal)  # -> XComponent, YComponent, ZComponent
pdecon_4 = Deconstruct(Point=midpt_4)  # -> XComponent, YComponent, ZComponent
c_script_2 = CSharpScript(polyList=flip_2.Surface)  # -> out, planeList; inputs polyList: list of Polyline
# ---------- c_script_2: C# ----------
    List<Plane> planes = new List<Plane>();
    foreach(Polyline poly in polyList){
      Plane plane = new Plane(poly.ElementAt(0), poly.ElementAt(1), poly.ElementAt(2));
      planes.Add(plane);
    }
    planeList = planes;
# ---------- end c_script_2 ----------
c_script_3 = CSharpScript(
    enable=Toggle(False),
    clipPlaneOrigin=[pdecon_4.XComponent, pdecon_4.YComponent, pdecon_4.ZComponent],
    clipPlaneDir=[pdecon_3.XComponent, pdecon_3.YComponent, pdecon_3.ZComponent],
    userPlanes=c_script_2.planeList,
    moveClipInZAxis=Slider(-7.01, range=-50..10),
    flip=Toggle(True),
    pageViews=Toggle(True),
    index=number_slider_16,
    clipU=Slider(0.5, range=0.5..100),
    clipV=Slider(2.6, range=0.5..100))  # -> out, viewPicked, viewsInDocument, messageOfTheDay; inputs enable: Boolean, clipPlaneOrigin: list of Double, clipPlaneDir: list of Double, void4: list of Plane, useUserPlanes: Boolean, userPlanes: list of Plane, moveClipInZAxis: Double, flip: Boolean, pageViews: Boolean, index: Int32, clipU: Double, clipV: Double
# ---------- c_script_3: C# ----------
    //by The Lord of Darkness due to critical Vodka starvation issues

    Rhino.Display.RhinoView[] viewsList = RhinoDocument.Views.GetViewList(true, pageViews);

    if(index >= viewsList.Length) index = viewsList.Length - 1;
    List<string> availableViews = new List<string>();
    string viewP = "";

    for(int i = 0; i < viewsList.Length;i++){
      Rhino.Display.RhinoView rview = viewsList[i];
      availableViews.Add(rview.ActiveViewport.Name);
      if(i == index){
        rv = rview.ActiveViewport;
        viewP = rv.Name;
        viewPortID = rview.ActiveViewportID;
      }
    }
    viewsInDocument = availableViews; //>>out
    viewPicked = viewP;               //>>out

    int removed = 0;
    PurgeClipPlane(rv, ref removed);
    if(!enable){ Print("Clip(s): {0} removed", removed);return;}

    userPlanes = userPlanes.Where(x => x != Plane.Unset).ToList();
    if(useUserPlanes && userPlanes.Any()){
      for(int i = 0; i < userPlanes.Count;i++){
        Plane p = userPlanes[i];
        if(moveClipInZAxis != 0){
          Vector3d vz = p.ZAxis; vz.Unitize(); vz *= moveClipInZAxis;
          p.Translate(vz);
        }
        if(flip) p.Flip();        
        Guid id = doc.Objects.AddClippingPlane(p, clipU, clipV, viewPortID);
      }
      doc.Views.Redraw();
      Print("Clip(s): {0} active", userPlanes.Count);
    }
    else{
      Point3d orig = new Point3d(clipPlaneOrigin[0], clipPlaneOrigin[1], clipPlaneOrigin[2]);
      Plane plane = new Plane(orig, new Vector3d(clipPlaneDir[0], clipPlaneDir[1], clipPlaneDir[2]));
      if(moveClipInZAxis != 0){
        Vector3d vz = plane.ZAxis; vz.Unitize(); vz *= moveClipInZAxis;
        plane.Translate(vz);
      }
      if(flip)plane.Flip();
      Guid id = doc.Objects.AddClippingPlane(plane, clipU, clipV, viewPortID);
      Print("Clip:  active");
      if (id != Guid.Empty){  doc.Views.Redraw(); }
    }
# ---------- c_script_3: C# additional code ----------
  public Rhino.Display.RhinoViewport rv;
  public Guid viewPortID;

  public void PurgeClipPlane(Rhino.Display.RhinoViewport rv, ref int removed){
    ClippingPlaneObject[] clipObjects = RhinoDoc.ActiveDoc.Objects.FindClippingPlanesForViewport(rv);
    //.FindByObjectType(ObjectType.ClipPlane());
    // ClippingPlaneObject[] clipObjects = RhinoDoc.ActiveDoc.Objects.FindClippingPlanesForViewport(rv);
    //  if(clipObjects.Length < 1 || clipObjects == null)return;
    removed = clipObjects.Length;
    for(int i = 0; i < clipObjects.Length;i++){
      ClippingPlaneObject cpo = clipObjects[i];
      RhinoDoc.ActiveDoc.Objects.Purge(cpo);
    }
  }
# ---------- end c_script_3 ----------
panel_43 = Panel(c_script_3.viewPicked)

move_11 = Move(Geometry=midpt_2, Motion=amp_5)  # -> Geometry, Transform
data_2 = Data([devec.XComponent, devec.YComponent, devec.ZComponent])
c_script_4 = CSharpScript(
    enable=Toggle(True),
    clipPlaneOrigin=data,
    clipPlaneDir=data_2,
    userPlanes=pl,
    moveClipInZAxis=Slider(0, range=-50..10),
    flip=Toggle(True),
    pageViews=Toggle(True),
    index=number_slider_10,
    clipU=Slider(0.5, range=0.5..100),
    clipV=Slider(0.5, range=0.5..100))  # -> out, viewPicked, viewsInDocument, messageOfTheDay; inputs enable: Boolean, clipPlaneOrigin: list of Double, clipPlaneDir: list of Double, void4: list of Plane, useUserPlanes: Boolean, userPlanes: list of Plane, moveClipInZAxis: Double, flip: Boolean, pageViews: Boolean, index: Int32, clipU: Double, clipV: Double; same code as c_script_3
camera_2 = CameraCrane(Location=midpt_2, Target=move_11.Geometry, UPVector=xy, Perspective="0", View=number_slider_10, Refresh=button_3)  # -> Camera, Target, Lens, Up, HorizontalViewAngle, VerticalViewAngle, ScreenRatio, Frame
panel_44 = Panel(c_script_4.viewPicked)
panel_45 = Panel(c_script_4.out)
panel_46 = Panel(c_script_3.out)

# ----
# Preliminary layout of concrete arch dams (USBR)
# Topographic deiminesions necessary to
# compute thicknesses, projections, and
# volume are:
# - structural height (H)
# - horizontal distances between abutments;
#      - including estimated excavation to sound rock at crest elevation (L1)
#      - and 15 % of H above base (L2)
# Definitions: H = structural height
# Tc = thickness at crest
# Tb = thickness at base
# T_0.45H = thickness of crown cantilever at 0.45H above base (T0.45H)
# USP = upstream projection
# DSP = downestream projection
# L1 = straight line distance at crest elevation between abutmenets assumed excavated to sound rock
# L2 = straight line distance, at 0.15H above base, between abutments assumed excavated to sound rock
# V = estimated volume of dam
# Formulas - conservative as compared with values computed more precisely (in feet)
# at crest:
# at  base
# at 0.45H
arch_l1_2 = RemoteReceiver(arch_l1)
arch_l1_current_m = Panel(arch_l1_2)
pctoftinlen = ToFeetInchLength(Quantity=arch_l1_current_m, Precision=64, LastSaveLocalization="neutral,N")
pcdeconfeetinch = DeconstructFeetInchLength(Quantity=pctoftinlen, LastSaveLocalization="neutral,N")  # -> flatten(AmountInFeet), FeetInteger, Inch, InchInteger, InchFractionNumerator, InchFractionDenominator, Error
l1_feet = Panel(pcdeconfeetinch.AmountInFeet)
expression_5 = Expression(L1=l1_feet, Expression="0.6*L1")
panel_47 = Panel("USPcrest = 0.0")
panel_48 = Panel("DSPcrest = Tc")
panel_49 = Panel(" 1 foot = 0.3048 m")

# ---- group: Select water upstream side and put water level
brep_terrain_base_2 = RemoteReceiver(brep_terrain_base)
point_upstream_6 = RemoteReceiver(point_upstream)
out_dam_height_3 = RemoteReceiver(out_dam_height)
dam_height_5 = RemoteReceiver(dam_height)
freeboard_3 = RemoteReceiver(freeboard)
Z_14 = UnitZ(Factor=dam_height_5)
project_4 = Project(Geometry=brep_terrain_base_2, Plane=Z_14)  # -> Geometry, Transform
neg_6 = Negative(Value=freeboard_3)
Z_15 = UnitZ(Factor=neg_6)

# ----
srfsplit = SurfaceSplit(Surface=project_4.Geometry, Curves=move.Geometry)  # -> reparameterize(Fragments)
subtraction_2 = Subtraction(A=out_dam_height_3, B=freeboard_3)

# ---- group: Select water upstream side and put water level (continued)
brep_cp = BrepClosestPoint(Point=point_upstream_6, Brep=srfsplit)  # -> Point, Normal, Distance
sort = SortList(Keys=brep_cp.Distance, ValuesA=srfsplit)  # -> Keys, ValuesA
item_9 = ListItem(List=sort.ValuesA, Index=0, Wrap=True)
neg_7 = Negative(Value=subtraction_2)
move_12 = Move(Geometry=item_9, Motion=Z_15)  # -> Geometry, Transform
Z_16 = UnitZ(Factor=neg_7)
extr_7 = Extrude(Base=move_12.Geometry, Direction=Z_16)  # disabled

# ----
move_13 = Move(Geometry=crv_cp.Point, Motion=Z_15)  # -> Geometry, Transform
evalsrf_4 = EvaluateSurface(Surface=reparameterize(item_9), Point=panel_31)  # -> Point, Normal, UDirection, VDirection, Frame; disabled
split_7 = SplitBrep(Brep=project_4.Geometry, Cutter=extr_3)  # -> simplify(Result); disabled
split_8 = SplitBrep(Brep=move_12.Geometry)  # disabled
pt_8 = Point(evalsrf_4.Point)  # disabled
amp_6 = Amplitude(Vector=evalsrf_4.Normal, Amplitude=number_slider_2)  # disabled

# ----
# Pre-volume Water
split_9 = SplitBrep(Brep=extr_7, Cutter=brep_terrain_3)  # disabled
pt_9 = Point(move_13.Geometry)  # disabled
colom = CollisionOneMany(Collider=pt_9, Obstacles=split_9)  # -> Collision, Index; disabled
item_10 = ListItem(List=split_9, Index=colom.Index, Wrap=True)  # disabled
geo_2 = Geometry(item_10)  # disabled
split_10 = SplitBrep(Brep=brep_terrain_3, Cutter=geo_2)  # disabled
item_11 = ListItem(List=split_10, Index=0, Wrap=True)  # -> Item, Item1, Item2; disabled
geo_3 = Geometry(item_11.Item1)  # disabled
join_4 = BrepJoin(Breps=flatten([geo_2, geo_3]))  # -> Breps, Closed; disabled

# ----
# Rough volume of water according to Dam height and position
vdisex_4 = VectorDisplayEx(Point=pt_8, Vector=amp_6, Colour=RGB(0, 0, 0), Width=2)  # disabled
brep_2 = Brep(join_4.Breps)  # disabled

# ----
# 2. Determine radius according to L1
len = Length(Curve=axis_line_3)
l1_m = Panel(len)

# ----
# Technical Memorandum No. EM36-86-68110: 4.2 Determine an Appraisal Level Arch Dam Layout
# 
# 2 - Determine Raxis= 0.6 L1 and round the value of Raxis up to the nearest 10 to 50 feet.
# This is the initial layout, so no need for decimal accuracy
panel_50 = Panel("50")
expression_6 = Expression(ft=["10", panel_50, "350"], Expression="ft*0.3048")
expression_7 = Expression(L1=l1_m, Expression="0.6*L1")
panel_51 = Panel(expression_6)

addition_6 = Addition(A=expression_7, B=raxis_adjustments)

# ----
# 3. Create arch crest line
end_6 = EndPoints(Curve=axis_line_4)  # -> Start, End
cir = Circle(Plane=end_6.Start, Radius=addition_6)
cir_2 = Circle(Plane=end_6.End, Radius=addition_6)
movetoplane = MoveToPlane(Geometry=point_upstream_3, Plane=end_6.End, Above=True, Below=True)  # -> Geometry, Transform
ccx_2 = CurveCurve(CurveA=cir, CurveB=cir_2)  # -> Points, ParamsA, ParamsB
dist_4 = Distance(PointA=ccx_2.Points, PointB=movetoplane.Geometry)
sort_2 = SortList(Keys=dist_4, ValuesA=ccx_2.Points)  # -> reverse(Keys), reverse(ValuesA)
item_12 = ListItem(List=sort_2.ValuesA, Index=0, Wrap=True)  # -> Item, Item1
circle = CircleCNR(Center=item_12.Item, Normal=Vector(0, 0, 1), Radius=addition_6)
ln_4 = Line(StartPoint=item_12.Item, EndPoint=item_12.Item1)
ccx_3 = CurveCurve(CurveA=axis_line_4, CurveB=circle)  # -> Points, ParamsA, ParamsB
shatter_2 = Shatter(Curve=circle, Parameters=ccx_3.ParamsB)
colom_2 = CollisionOneMany(Collider=ln_4, Obstacles=shatter_2)  # -> Collision, Index
item_13 = ListItem(List=shatter_2, Index=colom_2.Index, Wrap=True)

# ---- group: Axis arch Dam
# Technical Memorandum No. EM36-86-68110: 4.2 Determine an Appraisal Level Arch Dam Layout
# 
# 4 - Position the dam in the canyon. Draw a circular arc with radius Raxis...This arc is the axis of the dam and is the upstream side of the crest. Move the axis around the propose dam location to
# position the top of the dam in the canyon.
# 
# The angle of incidence of the axis into the left and right abutments should be approximately equal to produce a geometrically symmetric dam in the canyon.
geo_4 = Geometry(item_13)

# ----
line_crest_archdam = RemoteSender(geo_4)

# ----
# Abutements angle check
line_crest_archdam_2 = RemoteReceiver(line_crest_archdam)
levels_at_dam_height_3 = RemoteReceiver(levels_at_dam_height)

# ---- group: Vector abutements
crest_line = Geometry(line_crest_archdam_2)
end_7 = EndPoints(Curve=crest_line)  # -> Start, End
pt_10 = Point([end_7.Start, end_7.End])
crv_cp_3 = CurveClosestPoint(Point=pt_10, Curve=crest_line)  # -> Point, Parameter, Distance
eval_2 = EvaluateCurve(Curve=crest_line, Parameter=crv_cp_3.Parameter)  # -> simplify(graft(Point)), Tangent, Angle
dispatch_2 = Dispatch(List=eval_2.Tangent, DispatchPattern=[True, False])  # -> ListA, ListB
gate_2 = StreamGate(Stream=dispatch_2.ListA, Gate=list_4)  # -> Target0, Target1
gate_3 = StreamGate(Stream=dispatch_2.ListB, Gate=list_4)  # -> Target0, Target1
neg_8 = Negative(Value=gate_3.Target0)
neg_9 = Negative(Value=gate_2.Target1)
vec = Vector([gate_2.Target0, neg_8])
vec_2 = Vector([neg_9, gate_3.Target1])
amp_7 = Amplitude(Vector=[vec, vec_2], Amplitude=Slider(47, range=0..100))  # -> simplify(graft(Vector))
vdisex_5 = VectorDisplayEx(Point=eval_2.Point, Vector=amp_7, Colour=RGB(0, 0, 0), Width=2)

# ----
line_crest_archdam_3 = RemoteReceiver(line_crest_archdam)
pt_11 = Point(item_12.Item)

# ---- group: Level vector
geo_5 = Geometry(levels_at_dam_height_3)
pt_12 = Point(graft(pt_10))
number_slider_18 = Slider(75, range=0..100)
crv_cp_4 = CurveClosestPoint(Point=pt_12, Curve=geo_5)  # -> Point, simplify(Parameter), Distance
addition_7 = Addition(A=crv_cp_4.Parameter, B=number_slider_18)
subtraction_3 = Subtraction(A=crv_cp_4.Parameter, B=number_slider_18)
shatter_3 = Shatter(Curve=geo_5, Parameters=[addition_7, subtraction_3])
dispatch_3 = Dispatch(List=shatter_3, DispatchPattern=[True, False])  # -> ListA, ListB
level_at_parameter_75_to_75_from_dam_end = Geometry(dispatch_3.ListB)  # "Level at parameter -75 to +75 from dam endpoints"
end_8 = EndPoints(Curve=level_at_parameter_75_to_75_from_dam_end)  # -> simplify(Start), simplify(End)
pt_13 = Point(simplify(pt_12))
pt_14 = Point([end_8.Start, end_8.End, pt_13])
panel_52 = Panel("""2
2""")

# ---- group: Level vector / Average level line
fline = FitLine(Points=pt_14)

# ---- group: Level vector (continued)
midpt_6 = CurveMiddle(Curve=fline)
vec2pt_2 = Vector2Pt(PointA=midpt_6, PointB=pt_13, Unitize=False)  # -> Vector, Length

# ---- group: Level vector / Average level line aligned with crest
move_14 = Move(Geometry=fline, Motion=vec2pt_2.Vector)  # -> Geometry, Transform

# ---- group: Level vector (continued)
midpt_7 = CurveMiddle(Curve=move_14.Geometry)
end_9 = EndPoints(Curve=move_14.Geometry)  # -> Start, End
geo_6 = Geometry(end_9.Start)
vec2pt_3 = Vector2Pt(PointA=midpt_7, PointB=geo_6, Unitize=False)  # -> Vector, Length
dash = DashPattern(Curve=move_14.Geometry, Pattern=panel_52)  # -> Dashes, Gaps
amp_8 = Amplitude(Vector=vec2pt_3.Vector, Amplitude=Slider(47, range=0..100))
vdisex_6 = VectorDisplayEx(Point=midpt_7, Vector=amp_8, Colour=RGB(0, 0, 0), Width=2)
previewlw_5 = CustomPreviewLineweights(
    Geometry=dash.Dashes,
    Shader=ColourSwatch(SwatchColor=RGB(10, 166, 155)),
    Thickness=Slider(4, range=0..10),
    Absolute=False)

# ----
vec2pt_4 = Vector2Pt(PointA=midpt_7, PointB=end_9.End, Unitize=False)  # -> Vector, Length

# ---- group: Angle visualization
move_15 = Move(Geometry=eval_2.Point, Motion=amp_7)  # -> Geometry, Transform
angle = Angle(VectorA=vec2pt_4.Vector, VectorB=amp_7)  # -> Angle, Reflex
angle_2 = Angle(VectorA=vec2pt_3.Vector, VectorB=amp_7)  # -> Angle, Reflex
deg = Degrees(Radians=angle_2.Angle)
panel_53 = Panel(deg)

# ----
geo_7 = Geometry(end_9.End)
angulardim = DefineAngularDimension(Origin=midpt_7, Point1=geo_6, Point2=move_15.Geometry, Offset=number_slider_3, DimensionStyle=list_5)
angulardim_2 = DefineAngularDimension(Origin=midpt_7, Point1=move_15.Geometry, Point2=geo_7, Offset=number_slider_3, DimensionStyle=list_5)
deg_2 = Degrees(Radians=angle.Angle)
dimensions_check_2 = RemoteSender([angulardim_2, angulardim])

# ----
# Viz dimensions
dimensions_check_3 = RemoteReceiver([dimensions_check_2, dimensions_check])  # disabled
objfromgroup_3 = GetObjectsInGroup()
number_slider_19 = Slider(1, range=0..10)  # disabled
swatch_8 = ColourSwatch(SwatchColor=RGB(0, 0, 0))  # disabled
previewlw_6 = CustomPreviewLineweights(Geometry=dimensions_check_3, Shader=swatch_8, Thickness=number_slider_19, Absolute=False)  # disabled

onoff_2 = EnableDisableObject(
    Objects=objfromgroup_3,
    Enabled=viz_dimensions_2,
    AllObjects_Object=[dimensions_check_3, previewlw_6, number_slider_19, swatch_8])
panel_54 = Panel(deg_2)

# ----
# Excavation volume
geo_concretedam_base_2 = RemoteReceiver(geo_concretedam_base)  # disabled
geo_archdam_base_2 = RemoteReceiver(geo_archdam_base)  # disabled
swatch_9 = ColourSwatch(SwatchColor=RGB(164, 161, 212))  # disabled

# ----
# Dam top
dam_type_4 = RemoteReceiver(dam_type_2)

filter_2 = StreamFilter(Gate=dam_type_4, Stream0=geo_concretedam_base_2, Stream1=geo_archdam_base_2)  # disabled
volume = Volume(Geometry=filter_2, UseTasks=False)  # -> Volume, Centroid; disabled
round = Round(Number=volume.Volume)  # -> Nearest, Floor, Ceiling; disabled
dam_volume_base = RemoteSender(round.Nearest)  # disabled
preview_2 = CustomPreview(Geometry=filter_2, Material=swatch_9)  # disabled

dam_volume_base_2 = RemoteReceiver(dam_volume_base)

# ----
# 4. Figure L2
darc = DeconstructArc(Arc=line_crest_archdam_3)  # -> flatten(BasePlane), Radius, Angle

# ---- group: Lowest point (Base - middle section)
project_5 = Project(Curve=line_crest_archdam_3, Brep=brep_terrain_base_foundation_4, Direction=Vector(0, 0, 1))

# ----
x_tremez_2 = Extremes(Curve=project_5, Plane=PlaneXY(0, 0, 0))  # -> Highest, Lowest

# ---- group: Lowest point (Base - middle section) (continued)
# Technical Memorandum No. EM36-86-68110: 4.2 Determine an Appraisal Level Arch Dam Layout
# 
# 5 - On the axis, locate a point about midway between the abutments and in the riverbed. This is the location of the crown cantilever...
pt_15 = Point(x_tremez_2.Lowest)

# ----
project_6 = Project(Geometry=pt_15, Plane=darc.BasePlane)  # -> Geometry, Transform
ln_5 = Line(StartPoint=pt_15, EndPoint=project_6.Geometry)
eval_3 = EvaluateCurve(Height=reparameterize(ln_5), Point_at_015H="0.15")  # -> Point, Tangent, Angle
len_2 = Length(Curve=ln_5)

# ---- group: Centrifugal vector
pt_16 = Point(project_6.Geometry)
pt_17 = Point(darc.BasePlane)
vec2pt_5 = Vector2Pt(PointA=pt_16, PointB=pt_17, Unitize=True)  # -> Vector, Length

# ----
vec2pt_6 = Vector2Pt(PointA=pt_16, PointB=eval_3.Point, Unitize=False)  # -> Vector, Length
move_16 = Move(Geometry=line_crest_archdam_3, Motion=vec2pt_6.Vector)  # -> Geometry, Transform
bcx_2 = BrepCurve(Brep=brep_terrain_base_foundation_3, Curve=move_16.Geometry)  # -> Curves, flatten(Points)
crv_cp_5 = CurveClosestPoint(Point=bcx_2.Points, Curve=move_16.Geometry)  # -> Point, Parameter, Distance
shatter_4 = Shatter(Curve=move_16.Geometry, Parameters=crv_cp_5.Parameter)
colom_3 = CollisionOneMany(Collider=eval_3.Point, Obstacles=shatter_4)  # -> Collision, Index
item_14 = ListItem(List=shatter_4, Index=colom_3.Index, Wrap=True)
end_10 = EndPoints(Curve=item_14)  # -> Start, End
dist_5 = Distance(PointA=end_10.Start, PointB=end_10.End)

# ----
# Technical Memorandum No. EM36-86-68110: 4.2 Determine an Appraisal Level Arch Dam Layout
# 
# 5 - ...The radius of the axis at this point is the orientation of the reference plane and the line of centers. The reference plane is a vertical plane through the crown cantilever and generally parallel to the stream bank.
ln_6 = Line(StartPoint=pt_16, EndPoint=pt_17)

project_7 = Project(Geometry=ln_6, Plane=pt_15)  # -> Geometry, Transform
centrifugal_vector = RemoteSender(vec2pt_5.Vector)
arch_dam_height = RemoteSender(len_2)
arch_l2 = RemoteSender(dist_5)

arch_dam_height_2 = RemoteReceiver(arch_dam_height)
# Do concrete formula estimation to check
# how different they are from the volume in gh
# check memoradum
arch_l2_2 = RemoteReceiver(arch_l2)
arch_l2_current_m = Panel(arch_l2_2)
meter = Panel(arch_dam_height_2)
pctoftinlen_2 = ToFeetInchLength(Quantity=arch_l2_current_m, Precision=64, LastSaveLocalization="neutral,N")
pctoftinlen_3 = ToFeetInchLength(Quantity=meter, Precision=64, LastSaveLocalization="neutral,N")
pcdeconfeetinch_2 = DeconstructFeetInchLength(Quantity=pctoftinlen_2, LastSaveLocalization="neutral,N")  # -> flatten(AmountInFeet), FeetInteger, Inch, InchInteger, InchFractionNumerator, InchFractionDenominator, Error
pcdeconfeetinch_3 = DeconstructFeetInchLength(Quantity=pctoftinlen_3, LastSaveLocalization="neutral,N")  # -> flatten(AmountInFeet), FeetInteger, Inch, InchInteger, InchFractionNumerator, InchFractionDenominator, Error
l2_feet = Panel(pcdeconfeetinch_2.AmountInFeet)
feet = Panel(pcdeconfeetinch_3.AmountInFeet)
expression_8 = Expression(H=feet, L1=l1_feet, L2=l2_feet, Expression="0.000002*(H²)*L2*(((H+0.8*L1)²)/(L1-L2))+0.0004*H*L1*(H+1.1*L1)")
# Technical Memorandum No. EM36-86-68110: 2.1.3.1 Single-, Two-, or Three- Centered Arch Dams
# 
# The number of lines-of-centers determines whether the arches are the same on the left and right side of the dam, are different on the left and right sides of the dam, or different on the inner and outer parts of the dam.
# 
# A single centered arch dam has a single line-of-centers that results in the same circular arcs from the left to the right abutment.
# 
# A 2-centered arch dam has two lines-of-centers that result in different circular arcs for the left side and right sides of the dam.
# 
# A 3-centered arch dam has two lines-of-centers that result in different circular arcs near the crown cantilever (inner) and near the abutments (outer). The radii for the inner arcs are shorter than the outer arcs.
expression_9 = Expression(H=feet, L1=l1_feet, Expression="0.01*(H + 1.2*L1)")
expression_10 = Expression(H=feet, L1=l1_feet, L2=l2_feet, Expression="(0.0012*H*L1*L2*((H/400)^(H/400)))^(⅓)")
expression_11 = Expression(Tb=expression_10, Expression="0.95*Tb")
expression_12 = Expression(Tb=expression_10, Expression="0.33*Tb")
expression_13 = Expression(Tb=expression_10, Expression="0.67*Tb")
expression_14 = Expression(ft=expression_9, Expression="ft*0.3048")
expression_15 = Expression(ft=expression_13, Expression="ft*0.3048")
expression_16 = Expression(ft=expression_12, Expression="ft*0.3048")
expression_17 = Expression(ft=expression_11, Expression="ft*0.3048")
arch_usp_at_045h = RemoteSender(expression_17)
arch_usp_base = RemoteSender(expression_15)
arch_dsp_base = RemoteSender(expression_16)
arch_tc = RemoteSender(expression_14)

arch_usp_at_045h_2 = RemoteReceiver(arch_usp_at_045h)
arch_dsp_base_2 = RemoteReceiver(arch_dsp_base)
arch_usp_base_2 = RemoteReceiver(arch_usp_base)
arch_tc_2 = RemoteReceiver(arch_tc)
centrifugal_vector_2 = RemoteReceiver(centrifugal_vector)
centrifugal_vector_3 = RemoteReceiver(centrifugal_vector)

# ---- group: Crown Cantilever
# Technical Memorandum No. EM36-86-68110: Select the lowest arch elevation starting at about 15% H. Then between 15% H and the crest, try to select 6 to 8 arches evenly spaced vertically and rounded to nearest contour
# elevation. Even spacing arches permit best evaluation of the ADSAS results.
# E. Goulas: According to the Engineer Manual [1], the dam is divided into 5 to 10 evenly spaced horizontal arches and their respective parabolas are computed. They should be spaced not less than 3.048 meters (10 feet) nor more than 30.48 meters (100 feet) apart. The lowest parabola should be 0.15H to 0.20H above the base.
# 5. Section points - based on the equations
# At Base
# At Crest:
# At 0.45H
# Technical Memorandum No. EM36-86-68110: 4.2 Determine an Appraisal Level Arch Dam Layout
# 
# 10. On the topography map, draw the upstream and downstream projections of the crown cantilever and downstream arc at the crest on the reference plane. Using the same radius center as the axis, draw the circular arc for the downstream side of the crest using the radius (Raxis – Tc). On the reference plane draw points at each arch elevation on the upstream and downstream faces.
panel_55 = Panel("0.45")
eval_4 = EvaluateCurve(Height=reparameterize(ln_5), Point_at_015H=panel_55)  # -> Point, Tangent, Angle
neg_10 = Negative(Value=centrifugal_vector_2)
neg_11 = Negative(Value=centrifugal_vector_2)
amp_9 = Amplitude(Vector=centrifugal_vector_2, Amplitude=arch_tc_2)
amp_10 = Amplitude(Vector=neg_11, Amplitude=arch_usp_base_2)
amp_11 = Amplitude(Vector=neg_10, Amplitude=arch_usp_at_045h_2)
amp_12 = Amplitude(Vector=centrifugal_vector_2, Amplitude=arch_dsp_base_2)
move_17 = Move(Geometry=pt_15, Motion=amp_12)  # -> Geometry, Transform
move_18 = Move(Geometry=pt_15, Motion=amp_10)  # -> Geometry, Transform
move_19 = Move(Geometry=project_6.Geometry, Motion=amp_9)  # -> Geometry, Transform
move_20 = Move(Geometry=eval_4.Point, Motion=amp_11)  # -> Geometry, Transform
pt_at_0_45h = Point(move_20.Geometry)
pt_at_crest = Point(project_6.Geometry)
pt_at_base = Point(move_18.Geometry)
pt_at_0_45h_2 = Point(eval_4.Point)
# Technical Memorandum No. EM36-86-68110: 4.2 Determine an Appraisal Level Arch Dam Layout
# 
# 6 - Determine the shape of the crown cantilever. From the equations provided,
# compute TC, TB, T0.45H, USPC, USP0.45H, USPB, DSPC, DSP0.45H, and DSPB.
pt_at_crest_2 = Point(move_19.Geometry)
pt_at_base_2 = Point(move_17.Geometry)
arc = Arc3Pt(PointA=pt_at_crest, PointB=pt_at_0_45h, PointC=pt_at_base)  # -> UpstreamArc, CenterP, RadiusM
# Technical Memorandum No. EM36-86-68110: 4.2 Determine an Appraisal Level Arch Dam Layout
# 
# 7 - Determine the geometry of the upstream and downstream face along the crown cantilever. A circle can be drawn through the 3 points computed for the upstream face in Step 6. Likewise, a circle can be drawn through the 3 points computed for the
# downstream face.
# 
# 8. Draw the upstream and downstream face along the crown cantilever.
arc_2 = Arc3Pt(PointA=pt_at_crest_2, PointB=pt_at_0_45h_2, PointC=pt_at_base_2)  # -> DownstreamArc, CenterP, RadiusM

# ----
centrifugal_vector_4 = RemoteReceiver(centrifugal_vector)
flip_3 = FlipCurve(Curve=ln_5)  # -> Curve, Flag
len_3 = Length(Curve=ln_5)
rev_5 = Reverse(Vector=centrifugal_vector_3)
# x. Line of centers
rev_6 = Reverse(Vector=centrifugal_vector_4)
expression_18 = Expression(section_heights=section_height_approx, dam_height=len_3, Expression="dam_height/section_heights")
axis_at_crown_cantilever_line_height = Panel(len_3)
amp_13 = Amplitude(Vector=rev_5, Amplitude=horizontal)
amp_14 = Amplitude(Vector=rev_6, Amplitude=horizontal_2)
move_21 = Move(Geometry=pt_11, Motion=amp_13)  # -> Geometry, Transform
move_22 = Move(Geometry=pt_11, Motion=amp_14)  # -> Geometry, Transform
move_23 = Move(Geometry=move_21.Geometry, Motion=rev)  # -> Geometry, Transform
round_2 = Round(Number=expression_18)  # -> Nearest, Floor, Ceiling
move_24 = Move(Geometry=move_22.Geometry, Motion=rev_2)  # -> Geometry, Transform
divide = DivideCurve(Curve=flip_3.Curve, Count=round_2.Nearest, Kinks=False)  # -> Points, Tangents, Parameters
vec2pt_7 = Vector2Pt(PointA=pt_11, PointB=move_23.Geometry, Unitize=False)  # -> Vector, Length
vec2pt_8 = Vector2Pt(PointA=pt_11, PointB=move_24.Geometry, Unitize=False)  # -> Vector, Length
pt_18 = Point(flatten(divide.Points))
projecta = ProjectAlong(Geometry=pt_11, Plane=pt_2, Direction=vec2pt_7.Vector)  # -> Geometry, Transform
projecta_2 = ProjectAlong(Geometry=pt_11, Plane=pt_2, Direction=vec2pt_8.Vector)  # -> Geometry, Transform
pdecon_5 = Deconstruct(Point=pt_18)  # -> XComponent, YComponent, ZComponent
ln_7 = Line(StartPoint=pt_11, EndPoint=projecta.Geometry)
us_arc = RemoteSender(arc.UpstreamArc)
ds_arc = RemoteSender(arc_2.DownstreamArc)
ln_8 = Line(StartPoint=pt_11, EndPoint=projecta_2.Geometry)
sort_3 = SortList(Keys=pdecon_5.ZComponent, ValuesA=pt_18)  # -> reverse(Keys), reverse(ValuesA)
# Technical Memorandum No. EM36-86-68110: 4.2 Determine an Appraisal Level Arch Dam Layout
# 
# 9. Select 6 to 8 arch elevations on the crown cantilever to define the 3D dam. Select the lowest arch elevation starting at about 15% H. Then between 15% H and the crest, try to select 6 to 8 arches evenly spaced vertically and rounded to nearest contour elevation.
result_arch_dam_height = RemoteSender(axis_at_crown_cantilever_line_height)
eval_5 = EvaluateCurve(Curve=reparameterize(project_7.Geometry), Parameter=addition_2)  # -> Point, Tangent, Angle
eval_6 = EvaluateCurve(Curve=reparameterize(ln_7), Parameter="1")  # -> Point, Tangent, Angle
eval_7 = EvaluateCurve(Curve=reparameterize(ln_8), Parameter="1")  # -> Point, Tangent, Angle
eval_8 = EvaluateCurve(Curve=reparameterize(project_7.Geometry), Parameter=base_line_of_centers_intrados)  # -> Point, Tangent, Angle
plane_elevations = RemoteSender(sort_3.ValuesA)
arc_3 = ArcSED(Start=eval_7.Point, End=eval_8.Point, Direction=eval_7.Tangent)  # -> Arc, Plane, Radius
arc_4 = ArcSED(Start=eval_6.Point, End=eval_5.Point, Direction=eval_6.Tangent)  # -> Arc, Plane, Radius
join_5 = JoinCurves(Curves=[ln_8, arc_3.Arc], Preserve=False)
join_6 = JoinCurves(Curves=[ln_7, arc_4.Arc], Preserve=False)
line_of_centers_intrados = RemoteSender(join_5)
line_of_centers_extrados = RemoteSender(join_6)
line_of_centers_extrados_2 = RemoteReceiver(line_of_centers_extrados)
line_of_centers_intrados_2 = RemoteReceiver(line_of_centers_intrados)
plane_elevations_2 = RemoteReceiver(plane_elevations)
ds_arc_2 = RemoteReceiver(ds_arc)
us_arc_2 = RemoteReceiver(us_arc)
pcx = CurvePlane(DownstreamArc=ds_arc_2, Plane=plane_elevations_2)  # -> simplify(Points), ParamsC, ParamsP
pcx_2 = CurvePlane(LineOfCentersIntrados=line_of_centers_intrados_2, Plane=plane_elevations_2)  # -> simplify(CenterPoints), ParamsC, ParamsP
# Technical Memorandum No. EM36-86-68110: 4.2 Determine an Appraisal Level Arch Dam Layout
# 
# 12.a. Draw the upstream face arch starting with the first arch below the crest. Use an initial guess for the line of centers as a 0.2:1 sloping line.
pcx_3 = CurvePlane(UpstreamArc=us_arc_2, Plane=plane_elevations_2)  # -> simplify(Points), ParamsC, ParamsP
pcx_4 = CurvePlane(LineOfCentersExtrados=line_of_centers_extrados_2, Plane=plane_elevations_2)  # -> simplify(CenterPoints), ParamsC, ParamsP
pt_19 = Point([projecta_2.Geometry, projecta.Geometry, eval_8.Point, eval_5.Point])
dots = DotDisplay(Point=pt_19, Colour=swatch_5, Size=Slider(1.5, range=0..10))
ln_9 = Line(StartPoint=pcx.Points, EndPoint=pcx_2.CenterPoints)
ln_10 = Line(StartPoint=pcx_3.Points, EndPoint=pcx_4.CenterPoints)
len_4 = Length(Curve=ln_9)
len_5 = Length(Curve=ln_10)
cir_3 = Circle(DSCenters=pcx_2.CenterPoints, Radius=len_4)  # -> simplify(Circle)
cir_4 = Circle(USCenters=pcx_4.CenterPoints, Radius=len_5)
path_mapper = PathMapper(ln_10, source="{A}", target="{0;A}")
path_mapper_2 = PathMapper(cir_3, source="{A}", target="{1;A}")
path_mapper_3 = PathMapper(cir_4, source="{A}", target="{0;A}")
path_mapper_4 = PathMapper(ln_9, source="{A}", target="{1;A}")

# ---- group: Finding the intersection with sound rock
brep_terrain_base_foundation_5 = RemoteReceiver(brep_terrain_base_foundation)
relay = Relay([path_mapper_3, path_mapper_2])
relay_2 = Relay([path_mapper, path_mapper_4])
scx = SurfaceCurve(Surface=brep_terrain_base_foundation_5, Curve=relay)  # -> Curves, simplify(Points), UVPoints, Normals, Parameters, Tangents

# ---- group: Filter away last circle - touching sound rock
geo_8 = Geometry(relay)
tstat = TreeStatistics(Tree=geo_8)  # -> Paths, Length, Count
division_4 = Division(A=tstat.Count, B="2")
x_minus_one = XMinusOne(NumberX=division_4)
item_15 = ListItem(List=tstat.Paths, Index=["-1", x_minus_one], Wrap=True)
split_11 = SplitTree(Data=geo_8, Masks=flatten(item_15))  # -> Positive, Negative
geo_9 = Geometry(split_11.Positive)

# ---- group: Adjusting the bottom so there is something to connect with the bottom circle
centrifugal_vector_5 = RemoteReceiver(centrifugal_vector)
number_slider_20 = Slider(1, range=0..10)
neg_12 = Negative(Value=number_slider_20)
rev_7 = Reverse(Vector=centrifugal_vector_5)
rad = Radians(Degrees=[number_slider_20, neg_12])
rotate = Rotate(Geometry=rev_7, Angle=rad, Plane=PlaneXY(0, 0, 0))  # -> flatten(Geometry), Transform
center = Center(Geometric=geo_9)  # -> Center, Dimension
darc_2 = DeconstructArc(Arc=geo_9)  # -> BasePlane, Radius, Angle
line_2 = LineSDL(Start=center.Center, Direction=rotate.Geometry, Length=darc_2.Radius)
ccx_4 = CurveCurve(CurveA=geo_9, CurveB=line_2)  # -> Points, ParamsA, ParamsB
pshift = ShiftPaths(Data=ccx_4.ParamsA, Offset="-1")
shatter_5 = Shatter(Curve=geo_9, Parameters=pshift)
pshift_2 = ShiftPaths(Data=shatter_5, Offset="-1")
item_16 = ListItem(List=pshift_2, Index=0, Wrap=True)

# ---- group: Cutting and selecting curves for dam
shatter_6 = Shatter(Curve=relay, Parameters=scx.Parameters)  # -> simplify(Segments)
colom_4 = CollisionOneMany(Collider=shatter_6, Obstacles=relay_2)  # -> Collision, Index
dispatch_4 = Dispatch(List=shatter_6, DispatchPattern=colom_4.Collision)  # -> ListA, ListB

# ----
split_12 = SplitTree(Data=dispatch_4.ListA, Masks=flatten(item_15))  # -> Positive, Negative

# ---- group: Filter away last circle - touching sound rock
geo_10 = Geometry(split_12.Negative)
tstat_2 = TreeStatistics(Tree=geo_10)  # -> Paths, Length, Count
division_5 = Division(A=tstat_2.Count, B="2")
x_minus_one_2 = XMinusOne(NumberX=division_5)
item_17 = ListItem(List=tstat_2.Paths, Index=["-1", x_minus_one_2], Wrap=True)
split_13 = SplitTree(Data=geo_10, Masks=flatten(item_17))  # -> Positive, Negative
geo_11 = Geometry([split_13.Negative, item_16])

# ----
crv_3 = Curve([join_6, join_5, geo_11])
previewlw_7 = CustomPreviewLineweights(Geometry=crv_3, Shader=swatch_5, Absolute=False)
previewlw_8 = CustomPreviewLineweights(Geometry=crv_3, Shader=swatch_5, Absolute=False)
pshift_3 = ShiftPaths(Data=geo_11, Offset="-1")
loft_2 = Loft(Curves=pshift_3, Options={Adjust=True, Closed=False, LoftEnds=0, LoftSimp=0, LoftType=5, Rebuild=10, Refit=0.01})  # -> flatten(Loft)
loft_3 = Loft(Curves=loft_2, Options={Adjust=False, Closed=False, LoftEnds=0, LoftSimp=0, LoftType=5, Rebuild=10, Refit=0.01})
join_7 = BrepJoin(Breps=[loft_2, loft_3])  # -> Breps, Closed
volume_2 = Volume(Geometry=join_7.Breps)  # -> Volume, Centroid
geo_archdam = RemoteSender(join_7.Breps)
geo_archdam_2 = RemoteReceiver(geo_archdam)  # disabled
filter_3 = StreamFilter(Gate=dam_type_3, Stream0=geo_concretedam_2, Stream1=geo_archdam_2)  # disabled
brep_3 = Brep(filter_3)  # disabled
c_script_5 = CSharpScript(bListFrom=brep_2, flip=toggle_5, bListTo=brep_3)  # -> out, solidDifferenceBrepList; inputs bListFrom: list of Brep, flip: Boolean, bListTo: list of Brep; disabled
# ---------- c_script_5: C# ----------
    bListFrom = bListFrom.Where(x => x != null && x.IsValid && x.IsSolid).ToList();
    if(!bListFrom.Any()) return;

    bListTo = bListTo.Where(x => x != null && x.IsValid && x.IsSolid).ToList();
    if(!bListTo.Any()) return;
    double tol = RhinoDoc.ActiveDoc.ModelAbsoluteTolerance;

    List<Brep> bDiffList = new List<Brep>();
    Print(" ");
    Print("Working: {0} From against: {1} To breps", bListFrom.Count, bListTo.Count);
    Print(" ");

    for(int j = 0; j < bListFrom.Count;j++){
      Brep brep = bListFrom[j];
      if(flip)brep.Flip();
      for(int i = 0; i < bListTo.Count;i++){
        Brep b = bListTo[i];
        try{
          brep = Brep.CreateBooleanDifference(brep, b, tol)[0];
          Print("Diff at: {0}, {1} is OK", j, i);
        }
        catch{Print("Diff at: {0}, {1} failed (or breps are apart)", j, i);}
      }
      bDiffList.Add(brep);
    }
    solidDifferenceBrepList = bDiffList;

    Print(" ");
    for(int i = 0; i < bDiffList.Count;i++){
      Brep b = bDiffList[i];
      Print("Result at: {0} has: {1} faces", i, b.Faces.Count);
    }
# ---------- end c_script_5 ----------
geo_archdam_3 = RemoteReceiver(geo_archdam)
volume_3 = Volume(Geometry=c_script_5.solidDifferenceBrepList)  # -> Volume, Centroid; disabled
nullrep = ReplaceNulls(Items=volume_3.Volume, Replacements=0)  # -> Items, Count; disabled
ma = MassAddition(Input=flatten(nullrep.Items))  # -> Result, PartialResults; disabled

# ---- group: VIZ
geo_12 = Geometry(c_script_5.solidDifferenceBrepList)  # disabled
swatch_10 = ColourSwatch(SwatchColor=RGBA(196, 213, 255, 194))  # disabled
preview_3 = CustomPreview(Geometry=geo_12, Material=swatch_10)  # disabled

# ----
panel_56 = Panel(ma.Result)  # disabled

filter_4 = StreamFilter(Gate=dam_type_4, Stream0=geo_concretedam_3, Stream1=geo_archdam_3)
volume_4 = Volume(Geometry=filter_4, UseTasks=False)  # -> Volume, Centroid; disabled
round_3 = Round(Number=volume_4.Centroid)  # -> Nearest, Floor, Ceiling; disabled
dam_volume_top = RemoteSender(round_3.Nearest)  # disabled
preview_4 = CustomPreview(Geometry=filter_4, Material=ColourSwatch(SwatchColor=RGB(115, 109, 209)))

dam_volume_top_2 = RemoteReceiver(dam_volume_top)
merge_7 = Merge(Data1=flatten(dam_volume_base_2), Data2=flatten(dam_volume_top_2), Data3=flatten("0"), Data4=flatten("0"))
multiplication_2 = Multiplication(A=merge_7, B=merge_6)
entwine = Entwine(Branch00=panel_29, Branch01=merge_7, Branch02=merge_6, Branch03=multiplication_2, FlattenInputs=True)
data_series = UIDataSeries(Label=graft(panel_28), Data=entwine, Type=5)  # -> flatten(DataSeries)
grid_chart_2 = UiGridChart(Element=grid_chart, DataSeries=data_series, Titles=True)
preview_5 = CustomPreview(Geometry=filter_4, Material=ColourSwatch(SwatchColor=RGB(115, 109, 209)))
preview_6 = CustomPreview(Geometry=filter_4, Material=ColourSwatch(SwatchColor=RGB(115, 109, 209)))
addition_8 = Addition(A=volume_4.Volume, B=volume.Volume)  # disabled
dam_volume = RemoteSender(addition_8)  # disabled
panel_57 = Panel(volume_2.Volume)
dam_volume_2 = RemoteReceiver(dam_volume)  # disabled

# ---- group: results / data in right formatting
num_4 = Number(panel_56)  # disabled
division_6 = Division(A=num_4, B=1000000)  # disabled
roundd = RoundToDecimalPlace(NumberX=division_6, DecimalPlace=1, RoundType=0)  # -> Rounded, Difference; disabled

num_5 = Number(dam_volume_2)  # disabled
division_7 = Division(A=num_5, B=1000000)  # disabled
roundd_2 = RoundToDecimalPlace(NumberX=division_7, DecimalPlace=1, RoundType=0)  # -> Rounded, Difference; disabled

# ----
python_2 = GhPythonScript(river_discharge=num_3, eco_discharge=num_2, design_discharge=num)  # -> out, a; inputs river_discharge: list; disabled
# ---------- python_2: Python ----------
__author__ = "Kona"
__version__ = "2022.03.25"

import rhinoscriptsyntax as rs

e = eco_discharge
a1 = []

for i in range (len(river_discharge)):
    print i
    if float(river_discharge[i]) > e:
        print river_discharge[i],e,True
        result = float(river_discharge[i]) - e
        a1.append(result)
    else:
        a1.append("0")

d = design_discharge
a = []

for i in range (len(a1)):
    if float(a1[i]) > d:
        result = d
        a.append(result)
    else:
        a.append(a1[i])
# ---------- end python_2 ----------
discharge_used_m3_s = Panel(python_2.a)  # disabled
i_energy_dt_2 = RemoteReceiver(i_energy_dt)  # disabled

# ----
# ENERGY CALCULATION
pdecon_6 = Deconstruct(Point=pt_3)  # -> XComponent, YComponent, flatten(ZComponent); disabled
pdecon_7 = Deconstruct(Point=pt_6)  # -> XComponent, YComponent, flatten(ZComponent); disabled
round_4 = Round(Number=pdecon_6.ZComponent)  # -> Nearest, Floor, Ceiling; disabled
subtraction_4 = Subtraction(A=pdecon_6.ZComponent, B=freeboard_2)  # disabled
round_5 = Round(Number=pdecon_7.ZComponent)  # -> Nearest, Floor, Ceiling; disabled
ph_elevation = RemoteSender(round_5.Nearest)  # disabled
crest_elevation = RemoteSender(round_4.Nearest)  # disabled
panel_58 = Panel("1")  # disabled

upstream_waterlevel = Panel(subtraction_4)  # disabled
downstream_waterlevel = Panel(pdecon_7.ZComponent)  # disabled

B = B(100)  # disabled

division_8 = Division(A=i_energy_head_losses_2, B=B)  # disabled
subtraction_5 = Subtraction(A=upstream_waterlevel, B=downstream_waterlevel)  # disabled
subtraction_6 = Subtraction(A=panel_58, B=division_8)  # disabled
multiplication_3 = Multiplication(
    LevelDifference=subtraction_5,
    _1HeadLosses=subtraction_6,
    DesignDischarge=i_energy_design_discharge_2,
    GConstant=g_constant,
    PlantEfficiency=division_2)  # disabled
roundd_3 = RoundToDecimalPlace(NumberX=multiplication_3, DecimalPlace=1, RoundType=0)  # -> Rounded, Difference; disabled
installed_capacity_mw = Panel(roundd_3.Rounded)  # disabled

# ---- group: results / data in right formatting
num_6 = Number(installed_capacity_mw)  # disabled
roundf = RoundToFactor(NumberX=num_6, Factor=1, RoundType=0)  # -> Rounded, Difference, MultiplierR, MultiplierX; disabled

# ----
gross_head_m = Panel(subtraction_5)  # disabled
multiplication_4 = Multiplication(A=gross_head_m, B=subtraction_6)  # disabled
net_head_m = Panel(multiplication_4)  # disabled

multiplication_5 = Multiplication(DischargeUsed=discharge_used_m3_s, GConstant=g_constant, PlantEfficiency=division_2, NetHead=net_head_m)  # disabled
generated_power_mw = Panel(multiplication_5)  # disabled
multiplication_6 = Multiplication(A=generated_power_mw, B=i_energy_dt_2)  # disabled
division_9 = Division(A=multiplication_6, B=1000)  # -> flatten(Result); disabled
energy_production_gwh = Panel(division_9)  # disabled
ma_2 = MassAddition(Input=energy_production_gwh)  # -> Result, PartialResults; disabled
roundd_4 = RoundToDecimalPlace(NumberX=ma_2.Result, DecimalPlace=1, RoundType=0)  # -> Rounded, Difference; disabled
energy_production_gwh_2 = Panel(roundd_4.Rounded)  # disabled

python_3 = GhPythonScript(x=energy_production_gwh_2, y=installed_capacity_mw)  # -> out, a; disabled
# ---------- python_3: Python ----------
__author__ = "Kona"
__version__ = "2022.03.25"

import rhinoscriptsyntax as rs

a = round(((x*1000)/y/8760*100),1)
# ---------- end python_3 ----------
plant_factor = Panel(python_3.a)  # disabled

# ---- group: results / data in right formatting
num_7 = Number(energy_production_gwh_2)  # disabled
roundf_2 = RoundToFactor(NumberX=num_7, Factor=1, RoundType=0)  # -> Rounded, Difference, MultiplierR, MultiplierX; disabled

roundf_3 = RoundToFactor(NumberX=dist_3, Factor=100, RoundType=0)  # -> Rounded, Difference, MultiplierR, MultiplierX; disabled
round_6 = Round(Number=net_head_m)  # -> Nearest, Floor, Ceiling; disabled

len_6 = Length(Curve=axis_line_9)  # disabled
num_8 = Number(len_6)  # disabled
roundf_4 = RoundToFactor(NumberX=num_8, Factor=10, RoundType=0)  # -> Rounded, Difference, MultiplierR, MultiplierX; disabled
crest_elevation_2 = RemoteReceiver(crest_elevation)  # disabled
ph_elevation_2 = RemoteReceiver(ph_elevation)  # disabled
panel_59 = Panel("1:")  # disabled
concat = Concatenate(FragmentA=panel_59, FragmentB=downstream_face_angle_ratio_1)  # disabled
dam_height_6 = RemoteReceiver(dam_height)  # disabled
width_crest_3 = RemoteReceiver(width_crest)  # disabled
freeboard_4 = RemoteReceiver(freeboard)  # disabled
panel_60 = Panel(concat)  # disabled
num_9 = Number(plant_factor)  # disabled
merge_8 = Merge(
    Data1=dam_height_6,
    Data2=freeboard_4,
    Data3=offset_foundation_5,
    Data4=width_crest_3,
    Data5=flatten(roundf_4.Rounded),
    Data6=panel_60,
    Data7=i_energy_head_losses_2,
    Data8=i_energy_design_discharge_2,
    Data9=i_energy_ecological_discharge_2,
    Data10=flatten(i_energy_powerplant_efficiency_2),
    Data11=flatten(roundf_3.Rounded),
    Data12=flatten(roundd.Rounded),
    Data13=flatten(roundd_2.Rounded),
    Data14=flatten(round_6.Nearest),
    Data15=flatten(crest_elevation_2),
    Data16=flatten(ph_elevation_2),
    Data17=flatten(roundf.Rounded),
    Data18=flatten(roundf_2.Rounded),
    Data19=flatten(num_9))  # -> graft(Result); disabled

# ---- group: results / conduit
panel_61 = Panel("""Dam height = {1} m
Freeboard = {2}  m
Depth of foundation = {3} m
Crest width = {4} m
Crest length = {5} m
Downstream face slope = {6}
Head losses = {7} %
Design discharge = {8} m3/s
Ecological discharge = {9} m3/s
Plant efficiency = {10} %
Distance to the power house = {11} m
Volume water = {12} Mio m3
Volume dam = {13} Mio m3
Hn = {14} m
Crest elevation = {15} m asl
Power house elevation = {16} m asl
Installed capacity = {17} MW
Yearly production = {18} GWh
Plant Factor = {19} %""")  # disabled
button_4 = Button()  # disabled
number_slider_21 = Slider(3, range=0..10)  # disabled
bounds = GetViewportBoundaryDimensions(Refresh=button_4, Origin=lowest_point_dam_section_3, Scale=0.25, xDim=1019, yDim=761)  # disabled
grid_tiles = GridTiles(Boundary=bounds, Columns=5, Rows=number_slider_21, InteriorPadding=0.02, ExteriorPadding=0.02, PaddingAxis=0)  # disabled
format = Format(
    Format=panel_61,
    Culture=127,
    Data0=roundf_4.Rounded,
    Data1=dam_height_6,
    Data2=freeboard_4,
    Data3=offset_foundation_5,
    Data4=width_crest_3,
    Data5=roundf_4.Rounded,
    Data6=panel_60,
    Data7=i_energy_head_losses_2,
    Data8=i_energy_design_discharge_2,
    Data9=i_energy_ecological_discharge_2,
    Data10=i_energy_powerplant_efficiency_2,
    Data11=roundf_3.Rounded,
    Data12=roundd.Rounded,
    Data13=roundd_2.Rounded,
    Data14=round_6.Nearest,
    Data15=crest_elevation_2,
    Data16=ph_elevation_2,
    Data17=roundf.Rounded,
    Data18=roundf_2.Rounded,
    Data19=num_9)  # disabled
number_slider_22 = Slider(14, range=0..100)  # disabled
number_slider_23 = Slider(100, range=0..100)  # disabled
item_18 = ListItem(List=grid_tiles, Index=0, Wrap=True)  # disabled
Y = UnitY(Factor=number_slider_23)  # disabled
panel_62 = Panel(",")  # disabled
font = ConduitFont(
    Font="Arial",
    TextHeight=number_slider_22,
    AdaptiveHeight=False,
    TextSpacing=1.15,
    Alignment=0,
    Bold=False,
    Italic=False,
    Color=RGB(0, 0, 0))  # disabled
panel_63 = Panel("'")  # disabled
move_25 = Move(Geometry=item_18, Motion=Y)  # -> Geometry, Transform; disabled
rep = ReplaceText(Text=format, Find=panel_62, Replace=panel_63, RecursiveReplace=False)  # disabled
hud_text = DrawText(Boundary=move_25.Geometry, Text=rep, TextOrdering=1, TextDistribution=0, OrientVertically=False, CustomFont=font)  # disabled
toggle_7 = BooleanToggle(False)  # disabled
hud = HeadsUpDisplayHUD(
    ShowHUD=toggle_7,
    DrawingObjects=hud_text,
    DrawingBoundary=bounds,
    ConduitStyleSheet="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")  # disabled

# ----
panel_64 = Panel("0.5,0.5")  # disabled
evalsrf_5 = EvaluateSurface(Surface=reparameterize(extr_2), Point=panel_64)  # -> Point, Normal, UDirection, VDirection, Frame; disabled
vector_waterflow_7 = RemoteReceiver(vector_waterflow)  # disabled
dprod_2 = DotProduct(VectorA=evalsrf_5.Normal, VectorB=vector_waterflow_7, Unitize=False)  # disabled
panel_65 = Panel("0")  # disabled
larger = LargerThan(FirstNumber=dprod_2, SecondNumber=panel_65)  # -> LargerThan, OrEqualTo; disabled

smaller_2 = SmallerThan(FirstNumber=dprod_2, SecondNumber=panel_65)  # -> SmallerThan, OrEqualTo; disabled

gate_4 = StreamGate(Stream=extr_2, Gate=smaller_2.SmallerThan)  # -> Target0, Target1; disabled
flip_4 = Flip(Surface=gate_4.Target1)  # -> Surface, Result; disabled
filter_5 = StreamFilter(Gate=smaller_2.SmallerThan, Stream0=gate_4.Target0, Stream1=flip_4.Surface)  # disabled

c_script_6 = CSharpScript(polyList=filter_5)  # -> out, planeList; inputs polyList: list of Polyline; disabled; same code as c_script_2
pln_2 = Plane(c_script_6.planeList)  # disabled

# ---- group: results
panel_66 = Panel("""Dam height [m]
Freeboard [m]
Depth of foundation [m]
Crest width [m]
Crest length [m]
Downstream face slope [-]
Head losses [%]
Design discharge [m3/s]
Ecological discharge [m3/s]
Plant efficiency [%]
Distance to the power house [m]
Volume water [Mio m3]
Volume dam [Mio m3]
Hn [m] 
Crest elevation [m asl]
Power house elevation [m asl]
Installed capacity [MW]
Yearly production [GWh]
Plant Factor [%]""")  # disabled
panel_67 = Panel(merge_8)  # disabled
toggle_8 = BooleanToggle(False)  # disabled

# ---- group: results / variants / chooses correct variables
index = Panel("""0
4
14
11
12
10
13
16
17
18""")  # disabled
data_3 = Data(flatten(panel_67))  # disabled
item_19 = ListItem(List=data_3, Index=index, Wrap=True)  # disabled

# ----
lng_3 = ListLength(List=index)  # disabled
series = Series(Start=0, Step=1, Count=lng_3)  # disabled
null = NullPlaceholder()  # disabled
ins = InsertItems(List=null, Item=null, Indices=series, Wrap=True)  # -> simplify(List); disabled

# ---- group: results / variants
data_4 = Data(panel_66)  # disabled
item_20 = ListItem(List=data_4, Index=index, Wrap=True)  # disabled
panel_68 = Panel("VARIANT ")  # disabled

# ---- group: results / variants / heading
merge_9 = Merge(Data1=panel_68, Data2=item_20)  # -> flatten(Result); disabled

# ---- group: results / INPUT_values
index_2 = Panel("""1
2
3
5
6
7
8
9
15""")  # disabled
data_5 = Data(flatten(panel_67))  # disabled
data_6 = Data(panel_66)  # disabled
item_21 = ListItem(List=data_6, Index=index_2, Wrap=True)  # disabled
item_22 = ListItem(List=data_5, Index=index_2, Wrap=True)  # -> graft(Item); disabled
headings = Panel(item_21)  # disabled
panel_69 = Panel("INPUT_values")  # disabled
toggle_9 = BooleanToggle(False)  # disabled

# ---- group: results / variants
panel_70 = Panel("V ")  # disabled
concat_2 = Concatenate(FragmentA=panel_70, FragmentB=list_6)  # disabled
merge_10 = Merge(Data1=concat_2, Data2=item_19)  # -> flatten(Result); disabled
panel_71 = Panel("RESULTS")  # disabled
toggle_10 = BooleanToggle(False)  # disabled
panel_72 = Panel("1")  # disabled

# ----
merge_11 = Merge(Data1=concat_2, Data2=item_19)  # -> flatten(Result); disabled
merge_12 = Merge(Data1=concat_2, Data2=item_19)  # -> flatten(Result); disabled
merge_13 = Merge(Data1=concat_2, Data2=item_19)  # -> flatten(Result); disabled
merge_14 = Merge(Data1=concat_2, Data2=item_19)  # -> flatten(Result); disabled
filter_6 = StreamFilter(Gate=equals.Equality, Stream1=merge_10)  # disabled
filter_7 = StreamFilter(Gate=equals_4.Equality, Stream1=merge_11)  # disabled
filter_8 = StreamFilter(Gate=equals_5.Equality, Stream1=merge_12)  # disabled
filter_9 = StreamFilter(Gate=equals_2.Equality, Stream1=merge_13)  # disabled
filter_10 = StreamFilter(Gate=equals_3.Equality, Stream1=merge_14)  # disabled

# ---- group: results / variants / allows to compare up to 5 Variants
entwine_2 = Entwine(
    Branch00=merge_9,
    Branch01=filter_6,
    Branch02=filter_7,
    Branch03=filter_8,
    Branch04=filter_9,
    Branch05=filter_10,
    FlattenInputs=True)  # disabled

# ---- group: results / INPUT_tabelle
headers = Panel("""Month
Discharge in the river [m3/s]
Delta T [h] """)  # disabled
panel_73 = Panel("""Jan
Feb
Mär
Apr
Mai
Jun
Jul
Aug
Sep
Okt
Nov
Dez""")  # disabled
i_energy_dir_3 = RemoteReceiver(i_energy_dir)  # disabled
i_energy_dt_3 = RemoteReceiver(i_energy_dt)  # disabled
entwine_3 = Entwine(Branch00=panel_73, Branch01=i_energy_dir_3, Branch02=i_energy_dt_3, FlattenInputs=True)  # -> simplify(Result); disabled
toggle_11 = BooleanToggle(False)  # disabled
path = FilePath("C:\Users\KONA\Desktop\dam_input_values.xlsx")  # disabled
panel_74 = Panel("INPUT_tabelle")  # disabled

# ---- group: results / INPUT_values (continued)
excelwrite = ExcelWrite(
    WriteExcelData=toggle_9,
    WorkbookPath=path,
    WorksheetName=panel_69,
    ColumnHeadings=headings,
    Data=item_22,
    ClearSheet=toggle_8)  # disabled
panel_75 = Panel(excelwrite)  # disabled

# ---- group: results (continued)
excelwrite_2 = ExcelWrite(
    WriteExcelData=toggle_11,
    WorkbookPath=path,
    WorksheetName=panel_74,
    ColumnHeadings=headers,
    Data=entwine_3,
    ClearSheet=toggle_8)  # disabled

# ---- group: results / INPUT_tabelle (continued)
panel_76 = Panel(excelwrite_2)  # disabled

# ---- group: results / variants (continued)
insert_data = GhPythonScript(
    run=toggle_10,
    xlsx_filepath=path,
    xlsx_worksheet=panel_71,
    data=entwine_2,
    rel_position_x=panel_72,
    rel_position_y=panel_72,
    variant_position=list_6)  # -> out, a; inputs run: Boolean, data: tree, rel_position_x: Int32, rel_position_y: Int32; disabled
# ---------- insert_data: Python ----------
__author__ = "KONA"
__version__ = "2022.04.14"

import rhinoscriptsyntax as rs
import scriptcontext as sc
import string
import ghpythonlib.treehelpers as th

a = th.tree_to_list(data)

openpyxl = sc.sticky['openpyxl']
PIL = sc.sticky['PIL']

if _run == True:
    #load workbook and worksheet
    workbook = openpyxl.load_workbook(filename=xlsx_filepath, read_only=False)
    worksheet = workbook[xlsx_worksheet]
    
    #write Data to column (at defined position)
    for list_count, list in enumerate(a):
        for count, data_item in enumerate(list):
            print list_count
            print count
            print data_item
            cellref = worksheet.cell(row = rel_position_y + list_count,column = rel_position_x + count)
            print (cellref)
            cellref.value = data_item
        list_count += variant_position
        
        workbook.save(xlsx_filepath)
    else:
        pass
# ---------- end insert_data ----------
panel_77 = Panel(insert_data.a)  # disabled

# ==== cluster GHPythonRemote: Connects the Grasshopper Python component to an external Python instance.
python = PythonScript()  # -> gh_parent_doc_dir
# ---------- python: Python ----------
from os import path

gh_parent_doc_dir = path.abspath(path.dirname(ghenv.Component.OnPingDocument().Owner.OnPingDocument().FilePath))
# ---------- end python ----------
# GH to python remote example.
# Pierre Cuvilliers, 2017-2018
# Released under the MIT license
# github.com/pilcru/ghpythonremote
# Runs and connects to an external python engine, and
# assigns imported modules to scriptcontext.sticky variables.
# 
# Arguments:
#       code (str): Path to the GH_to_python_sticky.py code file.
#       location (str): Path to a python executable, or to a folder
#             containing `python.exe`, or the name of a conda-created
#             virtual environment prefixed by `conda://` (`conda://env_name`).
#             If empty, finds python from your windows %PATH%.
#       run (boolean): Creates the connection, and imports new
#             modules, when turned to True. Kills the connection,
#             and deletes the references to the imports, when turned
#             to False.
#       modules (str list): List of module names to import in the
#             remote python. They will be added to the
#             scriptcontext.sticky dictionary, allowing them to be
#             reused from other python components in the same
#             Grasshopper document. Submodules (for example
#             `numpy.linalg` have to be added explicitly to this list
#             to be available later.
#       log_level (str from ['NOTSET', 'DEBUG', 'INFO', 'WARNING', 'ERROR', 'CRITICAL']):
#             Logging level to use for the local IronPython and the
#             remote python instance.
#       working_dir (str): Working directory for the remote python
#             instance.
# 
# Returns:
#       out (str): Console output with DEBUG information.
#       linked_modules (str list): list of imported module names.
#       rpy (rpyc connection object): The object representing the
#             remote Python interpreter.
location = ClusterInput()  # location (str): Path to a python executable, or to a folder containing `python.exe`, or the name of a conda-created virtual environment prefixed by `conda://` (`conda://env_name`). If empty, finds python from your windows %PATH%.
run = ClusterInput()  # run (boolean): Creates the connection, and imports new modules, when turned to True. Kills the connection,and deletes the references to the imports, when turned to False.
modules = ClusterInput()  # modules (str list): List of module names to import in the remote python. They will be added to the scriptcontext.sticky dictionary, allowing them to be reused from other python components in the same Grasshopper document. Submodules (for example `numpy.linalg` have to be added explicitly to this list to be available later.
list = ValueList({"CRITICAL", "ERROR", "WARNING", "INFO", "DEBUG", "NOTSET"}, selected="DEBUG")
panel = Panel(python)
ghpythonremote = GHPythonRemote(location=location, run=run, modules=modules, log_level=list, working_dir=panel)  # -> out, linked_modules, rpy; inputs run: Boolean, modules: list
# ---------- ghpythonremote: Python ----------
import inspect
import logging
from os import path
import sys
from time import sleep

import scriptcontext

import ghpythonremote
from ghpythonremote.connectors import GrasshopperToPythonRemote

local_log_level = getattr(logging, log_level, logging.WARNING)
logger = logging.getLogger("ghpythonremote")
logger.setLevel(local_log_level)
ch = logging.StreamHandler()
ch.setLevel(local_log_level)
formatter = logging.Formatter("%(levelname)s: %(name)s:\n%(message)s")
ch.setFormatter(formatter)
logger.handlers = []
logger.addHandler(ch)
logger = logging.getLogger("ghpythonremote.GH_to_python")

ROOT = path.abspath(path.dirname(inspect.getfile(ghpythonremote)))
rpyc_server_py = path.join(ROOT, "pythonservice.py")

# Set connection to CLOSED if this is the first run
# and initialize set of linked modules
try:
    remote_python_status
except NameError:
    remote_python_status = "CLOSED"
    lkd_modules = set()

# Wait for connection to connect or terminate
timer = 0
while remote_python_status == "CONNECTING" or remote_python_status == "CLOSING":
    sleep(1)
    timer += 1
    if timer == 10:
        try:
            gh2py_manager.__exit__(*sys.exc_info())
        except Exception:
            pass
        remote_python_status = "CLOSED"
        lkd_modules = set()
        raise RuntimeError(
            "Connection left in an inconsistent state and not returning. Reset "
            "everything."
        )

if run:
    if not remote_python_status == "OPEN":
        remote_python_status = "CONNECTING"
        gh2py_manager = GrasshopperToPythonRemote(
            rpyc_server_py,
            location=location,
            timeout=10,
            port=None,
            log_level=log_level,
            working_dir=working_dir,
        )
        gh2py = gh2py_manager.__enter__()
        remote_python_status = "OPEN"

    # Stuff that we can reach
    rpymod = gh2py.py_remote_modules  # A getter function for a named python module
    rpy = gh2py.connection  # Represents the remote instance root object
    scriptcontext.sticky["rpy"] = rpy
    # Add modules
    for mod in modules:
        try:
            scriptcontext.sticky[mod] = rpymod(mod)
            lkd_modules.add(mod)
        except ImportError:
            gh2py_manager.__exit__(*sys.exc_info())
            raise

elif not remote_python_status == "CLOSED":
    remote_python_status = "CLOSING"
    # Remove linked modules
    for mod in lkd_modules:
        del scriptcontext.sticky[mod]
    del scriptcontext.sticky["rpy"]
    gh2py_manager.__exit__(*sys.exc_info())
    lkd_modules = set()
    remote_python_status = "CLOSED"

# Change variable name because ghpython resets outputs to None before each run
linked_modules = lkd_modules

logger.info("GH to python connection is {}".format(remote_python_status))
# ---------- end ghpythonremote ----------
out = ClusterOutput(ghpythonremote.out)  # Console output.
linked_modules = ClusterOutput(ghpythonremote.linked_modules)  # Names of modules that were successfully added to the scriptcontext.sticky dictionary.
rpy = ClusterOutput(ghpythonremote.rpy)  # The object representing the remote python instance
python_2 = PythonScript(module_names=ghpythonremote.linked_modules)  # -> import_statements; inputs module_names: list
# ---------- python_2: Python ----------
import_statements = ["import scriptcontext as sc"]
for module_name in module_names:
    import_statements.append("{0} = sc.sticky['{0}']".format(module_name))

if len(module_names) == 0:
    import_statements = []
# ---------- end python_2 ----------
import_statements = ClusterOutput(python_2)  # Useful import statements to use the imported modules in your scripts.
