# Grasshopper definition 3.JD_Dams4.gh (Grasshopper 1.0.7)
# Copyright: © 2017-2018 Pierre Cuvilliers, Caitlin Mueller, Massachusetts Institute of Technology
# plug-ins: ProvingGround.Conduit, Telepathy, Pufferfish, LunchBox, Heteroptera, Human, UiPlus, MetaHopper, EleFront, CORE.Toolbox.Grasshopper, TT Toolbox, Pancake, Kangaroo2 Components

heights = Panel("""1826
1827
1844
1845""")

# ---- group: INFO
# _________________________________
# 
# This file is done based on the rhino file:
# _________________________________
# "C:\Users\Admin\Gruner AG\BSBE [ORG] - Digitale Anwendungen ESD\04_Projekte\2023\CH_VS_Barrage Les Toules_SensitivityAnalysis_JD\Model\231708_Le toules-WSCH00320.3dm"
# Images folder - saved where the gh file is
# Image size settings
number_slider = Slider(700, range=0..1000)
# Infos & Settings
panel = Panel("231708_Le toules.3dm")
viewport_1_for_images = Panel("Perspektive")
viewport_2_for_images = Panel("Drauf")
viewport_3_for_images = Panel("Detail")
relpath = RelativePath(Path="Bilder")
multiplication = Multiplication(A=number_slider, B="7")
multiplication_2 = Multiplication(A=number_slider, B="5")
viewport_name_3 = RemoteSender(viewport_3_for_images)
viewport_name_1 = RemoteSender(viewport_1_for_images)
viewport_name_2 = RemoteSender(viewport_2_for_images)
panel_2 = Panel(relpath)
panel_3 = Panel("1446")
panel_4 = Panel(multiplication)
panel_5 = Panel("883")
panel_6 = Panel(multiplication_2)

# ----
num = Number(heights)
sort = SortList(Keys=heights, ValuesA=num)  # -> Keys, ValuesA
list_of_heights = RemoteSender(sort.ValuesA)

# ---- group: GEN_SET
# Inputs
# EPW
# Geometry
# North
# Project location
epw = Panel("C:\Users\cna\Gruner AG\BSBE [ORG] - Digitale Anwendungen ESD\04_Projekte\2023\DE_Rastatt_Kombibad_BKL\Schattenstudie\DEU_BW_Karlsruhe-Baden-Baden.AP.107275_TMYx\DEU_BW_Karlsruhe-Baden-Baden.AP.107275_TMYx.epw")
context_surfaces_openings = Geometry(<brep referenced from the Rhino model>)
context_surfaces_opaque = Geometry([<brep referenced from the Rhino model> x95, <mesh referenced from the Rhino model>, <brep referenced from the Rhino model> x2])
context_surfaces_terrain = Geometry([<brep referenced from the Rhino model> x8, <mesh referenced from the Rhino model>, <brep referenced from the Rhino model> x10])
context_objects_trees = Geometry()
context_objects_water = Geometry()
context_objects_streets = Geometry()
north_direction = Slider(246, range=0..360)
center_point_for_norh_symbol = Point(Point(-36.56310628, 15.02784233, 0))
project_name = Panel("Rastatt")
analysis_surfaces = Geometry([<brep referenced from the Rhino model> x5])
planesrf = PlaneSurface(Plane=PlaneXY(0, 0, 0), XSize=Domain(-10, 10), YSize=Domain(-10, 10))
flip = Flip(Surface=analysis_surfaces, Guide=planesrf)  # -> Surface, Result
context_openings = RemoteSender(context_surfaces_openings)
context_opaque = RemoteSender(context_surfaces_opaque)
analysis_surface = RemoteSender(flip.Surface)
project_location = RemoteSender("48.85441745071704, 8.214564907424585")
context_terrain = RemoteSender(context_surfaces_terrain)
context_water = RemoteSender(context_objects_water)
context_street = RemoteSender(context_objects_streets)
context_trees = RemoteSender(context_objects_trees)

# ----
project_name_2 = RemoteSender(project_name)
epw_2 = RemoteSender(epw)
panel_7 = Panel("C:\Users\Admin\Gruner AG\Jumping dams [EXP] - General\03_Model\Example image.png")
run_pre_geometry_of_water = Button()
# Run Dam
# Select dam type
list = ValueList({"Concrete gravity dam": "0", "Arch dam": "1", "Embankment dam": "2"}, selected="Concrete gravity dam")
run_arch_dam = Button()

panel_8 = Panel("""Concrete gravity dam
Arch dam
Embankment dam""")
# Dashboard structure
panel_9 = Panel("Type of Dam (m)")

# ----
# Energy Inputs
# Dashboard structure
# Dashboard - fill in data and listen to outputs
panel_10 = Panel("Ecological discharge [m3/s]")
label = UiLabel(Label=panel_10, Style=3)
slider = UiSlider(Value=0.5, Bounds=Domain(0, 1), Increment=0.1)
label_2 = UiLabel(Label="Powerplant efficiency [%]", Style=3)
label_3 = UiLabel(Label="Head losses (%)", Style=3)
label_4 = UiLabel(Label="Inputs energy", Style=1)
label_5 = UiLabel(Label="Discharge river (m3/s)*", Style=3)
label_6 = UiLabel(Label="Delta T*", Style=3)
label_7 = UiLabel(Label="*Input 12 Months separated with comma without spaces!", Style=4)
label_8 = UiLabel(Label="Design discharge [m3/s]", Style=3)
slider_2 = UiSlider(Value=0.5, Bounds=Domain(0, 1), Increment=0.1)
text_box = UiTextBox(Text="Click here to change text", Wrap=True)
text_box_2 = UiTextBox(Text="Click here to change text", Wrap=True)
slider_3 = UiSlider(Value=0.5, Bounds=Domain(0, 1), Increment=0.1)
slider_4 = UiSlider(Value=0.5, Bounds=Domain(0, 1), Increment=0.1)
merge = Merge(
    Data1=label_4,
    Data2=label_5,
    Data3=text_box,
    Data4=label_6,
    Data5=text_box_2,
    Data6=label_7,
    Data7=label_3,
    Data8=slider_3,
    Data9=label_8,
    Data10=slider_4,
    Data11=label,
    Data12=slider,
    Data13=label_2,
    Data14=slider_2)
wrap = UiWrapLayout(Elements=merge, Horizontal=False, Direction=0)
merge_2 = Merge(Data1=wrap)
panel_11 = Panel("""Inputs energy
Inputs Dam""")
tab = UiTabbedLayout(Elements=merge_2, Names=panel_11)
energy_inputs = Button()
panel_12 = Panel("Ex: 0.56,0.46,0.47,0.85,4.51,8.72,7.77,5.34,3.01,1.99,1.13,0.72")
window = UiWindow(Elements=merge_2, Title="Energy Inputs", Owner=1, Scroll=True, Launch=energy_inputs)
slider_5 = UiSlider(Element=slider, Label="m3/s", Value=".2", Bounds="0 To 5", Increment=".01")
slider_6 = UiSlider(Element=slider_2, Label="%", Value="88", Bounds="0 To 100", Increment=".1")
text_box_3 = UiTextBox(Element=text_box, Text=panel_12, Wrap=True)
text_box_4 = UiTextBox(Element=text_box_2, Text="Ex: 744,672,744,720,744,720,744,744,720,744,720,744", Wrap=True)
slider_7 = UiSlider(Element=slider_3, Label="%", Value="5", Bounds="0 To 10", Increment=0.1)
slider_8 = UiSlider(Element=slider_4, Label="m3/s", Value="5", Bounds="0 To 20", Increment=0.1)
get_values = UiValues(Element=text_box_4)  # -> flatten(Values)
get_values_2 = UiValues(Element=text_box_3)  # -> flatten(Values)
get_values_3 = UiValues(Element=slider_5)  # -> flatten(Values)
get_values_4 = UiValues(Element=slider_6)  # -> flatten(Values)
get_values_5 = UiValues(Element=slider_7)  # -> flatten(Values)
get_values_6 = UiValues(Element=slider_8)  # -> flatten(Values)
split = TextSplit(Text=get_values, Separators=" ")  # -> reverse(flatten(Result))
split_2 = TextSplit(Text=get_values_2, Separators=" ")  # -> reverse(flatten(Result))
item = ListItem(List=split, Index=0, Wrap=True)
item_2 = ListItem(List=split_2, Index=0, Wrap=True)
split_3 = TextSplit(Text=item, Separators=",")  # -> flatten(Result)
split_4 = TextSplit(Text=item_2, Separators=",")  # -> flatten(Result)
ecological_discharge_m3_s_input_from_das = Panel(get_values_3)  # "Ecological discharge [m3/s] - Input from Dashboard"
discharge_in_the_river_m3_s_input_from_d = Panel(split_4)  # "Discharge in the river [m3/s] - Input from Dashboard"
delta_t_input_from_dashboard = Panel(split_3)
powerplant_efficiency_input_from_dashboa = Panel(get_values_4)  # "Powerplant efficiency [%]- Input from Dashboard"
head_losses_input_from_dashboard = Panel(get_values_5)
design_discharge_m3_s_input_from_dashboa = Panel(get_values_6)  # "Design discharge [m3/s] - Input from Dashboard"
discharge_in_the_river_m3_s_madagascar = Panel("""77.73
84.37
67.49
45.11
24.17
16.78
13.85
11.21
8.05
8.89
18.47
39.28""")
i_energy_dt = RemoteSender(delta_t_input_from_dashboard)
i_energy_dir = RemoteSender(discharge_in_the_river_m3_s_input_from_d)
i_energy_head_losses = RemoteSender(head_losses_input_from_dashboard)
i_energy_design_discharge = RemoteSender(design_discharge_m3_s_input_from_dashboa)
i_energy_ecological_discharge = RemoteSender(ecological_discharge_m3_s_input_from_das)
i_energy_powerplant_efficiency = RemoteSender(powerplant_efficiency_input_from_dashboa)
discharge_in_the_river_m3_s_les_toules = Panel("""0.56
0.46
0.47
0.85
4.51
8.72
7.77
5.34
3.01
1.99
1.13
0.72""")

panel_13 = Panel("""False
False
False""")
replace = ReplaceItems(List=panel_13, Item="True", Indices=list, Wrap=False)
label_9 = UiLabel(Label=panel_9, Style=3)
label_10 = UiLabel(Label="Water level (m)", Style=3)
scroll_integer = UiScrollInteger(SelectedInteger=0, Wrap=False)
image = UiImage(Bitmap=panel_7, Fitting=1)
label_11 = UiLabel(Label="Freeboard (m)", Style=3)
slider_9 = UiSlider(Value=0.5, Bounds=Domain(0, 1), Increment=0.1)
# For python remote
dam_selection = RemoteSender(replace)
dam_selection_2 = RemoteReceiver(dam_selection)
panel_14 = Panel(dam_selection_2)
radio = UiRadio(Label=panel_8, State=panel_14, Group="Group 1")
label_12 = UiLabel(Label="Foundation depth (m)", Style=3)
button = UiButton(Label="Ok")
toggle = UiToggle(State=False)
does_the_old_dam_exist_in_the_variant = BooleanToggle(False)
slider_10 = UiSlider(Value=0.5, Bounds=Domain(0, 1), Increment=0.1)
toggle_2 = UiToggle(State="True")
pipeline = GeometryPipeline(
    GroupByLayer=False,
    GroupByType=False,
    IncludeHidden=True,
    IncludeLocked=True,
    LayerFilter="River",
    NameFilter="*",
    SublayerFiltering=True,
    TypeFilter=4)  # disabled

pipeline_2 = GeometryPipeline(
    GroupByLayer=False,
    GroupByType=False,
    IncludeHidden=True,
    IncludeLocked=True,
    LayerFilter="Upstream_point",
    NameFilter="*",
    SublayerFiltering=True,
    TypeFilter=1)
# Global settings
reference_points_ph = GeometryPipeline(
    GroupByLayer=False,
    GroupByType=False,
    IncludeHidden=True,
    IncludeLocked=True,
    LayerFilter="Power house",
    NameFilter="*",
    SublayerFiltering=True,
    TypeFilter=1)  # disabled
pipeline_3 = GeometryPipeline(
    GroupByLayer=False,
    GroupByType=False,
    IncludeHidden=True,
    IncludeLocked=True,
    LayerFilter="Axes",
    NameFilter="*",
    SublayerFiltering=True,
    TypeFilter=4)

# ----
# Slider dam line
slider_11 = Slider(0, range=0..6)
# _Automotions
slider_12 = Slider(0, range=0..10)
lng = ListLength(List=pipeline_3)
expression = Expression(x=lng, Expression="x-1")
c_script = CSharpScript(name="Axes", min=slider_12, max=expression, decimals=slider_11)  # -> out, A; inputs name: String, min: Double, max: Double, decimals: Int32
# ---------- c_script: C# ----------
    foreach (IGH_DocumentObject obj in owner.OnPingDocument().Objects )
    {
      Grasshopper.Kernel.Special.GH_NumberSlider slider = obj as Grasshopper.Kernel.Special.GH_NumberSlider;
      if (slider == null) { continue; }
      if (slider.NickName.Equals(name, StringComparison.OrdinalIgnoreCase))
      {
        double norm = slider.Slider.NormalizedValue;

        slider.Slider.Minimum = (decimal) min;
        slider.Slider.Maximum = (decimal) max;
        if (decimals <= 0)
        {
          slider.Slider.Type = Grasshopper.GUI.Base.GH_SliderAccuracy.Integer;
        }
        else
        {
          slider.Slider.Type = Grasshopper.GUI.Base.GH_SliderAccuracy.Float;
          slider.Slider.DecimalPlaces = decimals;
        }

        //Must disable events since we are modifying this thing during a solution.
        //This is actually illegal.
        slider.Slider.RaiseEvents = false;
        slider.Slider.NormalizedValue = norm;
        slider.Slider.RaiseEvents = true;
      }
    }
# ---------- end c_script ----------

mesh = GeometryPipeline(
    GroupByLayer=False,
    GroupByType=False,
    IncludeHidden=True,
    IncludeLocked=True,
    LayerFilter="Terrain_mesh",
    NameFilter="*",
    SublayerFiltering=True,
    TypeFilter=32)  # disabled
pipeline_4 = GeometryPipeline(
    GroupByLayer=False,
    GroupByType=False,
    IncludeHidden=True,
    IncludeLocked=True,
    LayerFilter="Terrain_levels",
    NameFilter="*",
    SublayerFiltering=True,
    TypeFilter=4)
mesh_2 = GeometryPipeline(
    GroupByLayer=False,
    GroupByType=False,
    IncludeHidden=True,
    IncludeLocked=True,
    LayerFilter="Terrain_brep",
    NameFilter="*",
    SublayerFiltering=True,
    TypeFilter=1073741848)
mesh_3 = GeometryPipeline(
    GroupByLayer=False,
    GroupByType=False,
    IncludeHidden=True,
    IncludeLocked=True,
    LayerFilter="Terrain_base_curve",
    NameFilter="*",
    SublayerFiltering=True,
    TypeFilter=4)

# ---- group: an old dam
brep = Brep(<brep referenced from the Rhino model>)

# ----
xy = XYPlane(Origin=Point(0, 0, 0))
vec2pt = Vector2Pt(PointA=pipeline_2, PointB=xy, Unitize=False)  # -> Vector, Length

# ----
# In conda cmd prompt:
# 
# conda activate C:\Users\cna\.conda\envs\rhinoremote
# 
# pip install <package> - for any missing package check the ouput to the right
# 
# For PIL -> pip install pillow
panel_15 = Panel("C:\Users\cna\Anaconda3\envs\rhinoremote")
panel_16 = Panel("""PIL
openpyxl""")
pythonremote = GHPythonRemote(location=panel_15, run=Toggle(False), modules=panel_16)  # -> out, linked_modules, rpy, import_statements
panel_17 = Panel(pythonremote.import_statements)
panel_18 = Panel(pythonremote.out)

merge_3 = Merge(
    Data1=label_9,
    Data2=radio,
    Data3=label_10,
    Data4=scroll_integer,
    Data5=label_11,
    Data6=slider_9,
    Data7=label_12,
    Data8=slider_10,
    Data9=button,
    Data10=toggle,
    Data11=toggle_2)  # -> flatten(Result)
axes = Slider(0, range=0..4)
list_of_heights_2 = RemoteReceiver(list_of_heights)
dam_configuration = Button()
list_2 = ItemSelector(list_of_heights_2, {"1826", "1827", "1844", "1845"}, selected="1826")
list_3 = ValueList({"2250", "2270"}, selected="2250")
bill_of_quantities = Button()
window_2 = UiWindow(Elements=merge_3, Title="Dam Configuration", Owner=1, Scroll=True, Launch=dam_configuration)
move = Move(Geometry=mesh_3, Motion=vec2pt.Vector)  # -> Geometry, Transform
# For optimization: Make perpendicular
# sections on the river line to discover
# best placement for the Dams.
move_2 = Move(Geometry=pipeline_2, Motion=vec2pt.Vector)  # -> Geometry, Transform
resize = UiResize(Element=image, Width="200", Height="200")
item_3 = ListItem(List=pipeline_3, Index=axes, Wrap=True)
scroll_integer_2 = UiScrollInteger(Element=scroll_integer, Label="Dam height", SelectedInteger=list_2, Wrap=False)
move_3 = Move(Geometry=mesh_2, Motion=vec2pt.Vector)  # -> Geometry, Transform
brep_2 = Brep(move.Geometry)
move_4 = Move(Geometry=pipeline_4, Motion=vec2pt.Vector)  # -> Geometry, Transform
window_3 = UiWindow(Title="Bill of Quantities", Owner=1, Scroll=True, Launch=bill_of_quantities)
move_5 = Move(Geometry=pipeline_3, Motion=vec2pt.Vector)  # -> Geometry, Transform
slider_13 = UiSlider(Element=slider_9, Label="m", Value="1.5", Bounds="0 To 5", Increment=".1")
button_2 = UiButton(Element=button, Label="Send changes")
slider_14 = UiSlider(Element=slider_10, Label="m", Value="10", Bounds="0 To 50", Increment=".1")
toggle_3 = UiToggle(Element=toggle, Label="Show direction river flow?", State=False)
toggle_4 = UiToggle(Element=toggle_2, Label="Visualize dimensions?", State=False)
move_6 = Move(Geometry=item_3, Motion=vec2pt.Vector)  # -> Geometry, Transform
brep_terrain_base = RemoteSender(brep_2)
get_values_7 = UiValues(Element=radio)  # -> flatten(Values)
mesh_terrain = RemoteSender(mesh)  # disabled
lines_levels = RemoteSender(move_4.Geometry)
brep_terrain = RemoteSender(move_3.Geometry)
get_values_8 = UiValues(Element=scroll_integer_2)  # -> flatten(Values)
get_values_9 = UiValues(Element=slider_13)  # -> flatten(Values)
get_values_10 = UiValues(Element=slider_14)  # -> flatten(Values)
get_values_11 = UiValues(Element=button_2)  # -> flatten(Values)
get_values_12 = UiValues(Element=toggle_3)  # -> flatten(Values)
dam_axes_all = RemoteSender(move_5.Geometry)
get_values_13 = UiValues(Element=toggle_4)  # -> flatten(Values)
dam_axis = RemoteSender(move_6.Geometry)
dam_type = Panel(get_values_7)
# Dashboard - fill in data and listen to outputs
dam_type_index = Panel("""0
1
2""")
geo = Geometry(pipeline_2)  # disabled
water_level_m_input_from_dashboard = Panel(get_values_8)
freeboard_m_input_from_dashboard = Panel(get_values_9)
offset_foundation_m_input_from_dashboard = Panel(get_values_10)
panel_19 = Panel(get_values_12)
panel_20 = Panel(get_values_13)
panel_21 = Panel(get_values_11)
crv_cp = CurveClosestPoint(Point=pipeline_2, Curve=item_3)  # -> Point, Parameter, Distance; disabled
dispatch = Dispatch(List=dam_type_index, DispatchPattern=dam_type)  # -> ListA, ListB
vec2pt_2 = Vector2Pt(PointA=pipeline_2, PointB=crv_cp.Point, Unitize=False)  # -> Vector, Length; disabled
vdisex = VectorDisplayEx(Point=geo, Vector=vec2pt_2.Vector, Colour=RGB(0, 0, 0), Width=2)  # disabled
viz_dimensions = RemoteSender(panel_20)
viz_direction_river = RemoteSender(panel_19)

dam = DataDam(
    DataA=dispatch.ListA,
    DataB=water_level_m_input_from_dashboard,
    DataC=freeboard_m_input_from_dashboard,
    DataD=offset_foundation_m_input_from_dashboard,
    BufferDelay=5000000,
    BufferMode=2)  # -> DataA, DataB, DataC, DataD
objfromgroup = GetObjectsInGroup()

dam_2 = DataDam(DataA=dispatch.ListA, BufferDelay=2500000, BufferMode=2)
dam_3 = DataDam(DataA=water_level_m_input_from_dashboard, BufferDelay=10000000, BufferMode=0)  # disabled
dam_4 = DataDam(DataA=freeboard_m_input_from_dashboard, BufferDelay=10000000, BufferMode=0)  # disabled
dam_5 = DataDam(DataA=offset_foundation_m_input_from_dashboard, BufferDelay=10000000, BufferMode=0)  # disabled
panel_22 = Panel("INPUTS")
panel_23 = Panel("PROCESS")

lng_2 = ListLength(List=objfromgroup)
dup = DuplicateData(Data=panel_21, Number=lng_2, Order=True)

panel_25 = Panel("OUTPUTS")
panel_26 = Panel("VISUALIZATION")
inpupt_offset_foundation_m = Panel(dam.DataD)
addition = Addition(A=dam.DataB, B=dam.DataC)
panel_27 = Panel("CHECK")
dam_level = RemoteSender(addition)
water_level = RemoteSender(dam.DataB)
dam_type_2 = RemoteSender(dam_2)
freeboard = RemoteSender(dam.DataC)
offset_foundation = RemoteSender(dam.DataD)
setobj = SetObjectValue(ObjectToSet=flatten(objfromgroup), ValueToSet=flatten(dup))
panel_28 = Panel(lng_2)
panel_29 = Panel(dup)
panel_30 = Panel("Cost rock fill foundation (CHF/m3)")  # disabled
panel_31 = Panel("Cost rock fill(CHF/m3)")  # disabled
label_13 = UiLabel(Label="Cost concrete foundation (CHF/m3)", Style=3)
grid_chart = UiGridChart(Titles=True)
label_14 = UiLabel(Label="Cost concrete(CHF/m3)", Style=3)
label_15 = UiLabel(Label=panel_30, Style=3)  # disabled
label_16 = UiLabel(Label=panel_31, Style=3)  # disabled
scroll_number = UiScrollNumber(Number=0, Wrap=False, Digits=3)
merge_4 = Merge(Data5=grid_chart)  # -> flatten(Result)
scroll_number_2 = UiScrollNumber(Number=0, Wrap=False, Digits=3)
scroll_number_3 = UiScrollNumber(Number=0, Wrap=False, Digits=3)
scroll_number_4 = UiScrollNumber(Number=0, Wrap=False, Digits=3)
merge_5 = Merge(Data1=scroll_number_4, Data2=scroll_number_3, Data3=scroll_number, Data4=scroll_number_2, Data5=grid_chart)  # -> flatten(Result)
dam_configuration_2 = Button()
list_4 = ValueList({"Concrete Dam": "1", "Arch Dam": "2", "Embankment Dam": "3"}, selected=["Concrete Dam", "Arch Dam", "Embankment Dam"])
offset_foundation_2 = RemoteReceiver(offset_foundation)

# ---- group: Topography contour lines
# Technical Memorandum No. EM36-86-68110: Obtain a print of the topography of the proposed dam site at a scale of 1”:100’ with
# 5 or 10-foot contour intervals.
panel_32 = Panel("10")  # disabled
# This changes when the axis line calculate and recalculate the basics again
expression_2 = Expression(ft=panel_32, Expression="ft*0.3048")  # disabled
panel_33 = Panel(expression_2)  # disabled

# ----
dam_axis_2 = RemoteReceiver(dam_axis)
dam_level_2 = RemoteReceiver(dam_level)
scroll_number_5 = UiScrollNumber(Element=scroll_number_4, Label="Cost concrete foundation (CHF/m3)", Number=0, Wrap=False, Digits=2, Bounds="0 To 1000")
scroll_number_6 = UiScrollNumber(Element=scroll_number_3, Label="Cost concrete (CHF/m3)", Number=0, Wrap=False, Digits=2, Bounds="0 To 1000")
scroll_number_7 = UiScrollNumber(Element=scroll_number, Label="Cost rock fill foundation (CHF/m3)", Number=0, Wrap=False, Digits=2, Bounds="0 To 1000")
window_4 = UiWindow(Elements=merge_5, Title="Costs", Owner=1, Scroll=True, Launch=dam_configuration_2)
scroll_number_8 = UiScrollNumber(Element=scroll_number_2, Label="Cost rock fill (CHF/m3)", Number=0, Wrap=False, Digits=2, Bounds="0 To 1000")
# Technical Memorandum No. EM36-86-68110: 2.1.3 Lines of Centers
# 
# The lines of centers define the horizontal shape of the arches in an arch dam. The shape of the arches starts at the crown cantilever and curves horizontally downstream toward the abutments. The line of centers create the geometry of the circular arcs at each elevation of the dam for the upstream and downstream faces by defining the center point of a circle and the radius of the circle. Depending on the shape and number of lines of centers, the arches can be
# 1) uniform thickness from abutment to abutment,
# 2) variable thickness from abutment to abutment,
# 3) different on the left side of the dam compared to the right side of the dam, or
# 4) different in the center of the dam compared to the outer part of the dam.
# Technical Memorandum No. EM36-86-68110: A double curvature arch dam has curvature in the arches and in the crown cantilever.
panel_34 = Panel(list_4)
Z = UnitZ(Factor=dam_level_2)
get_values_14 = UiValues(Element=scroll_number_5)  # -> flatten(Values)
get_values_15 = UiValues(Element=scroll_number_6)  # -> flatten(Values)
get_values_16 = UiValues(Element=scroll_number_8)  # -> flatten(Values)
neg = Negative(Value=offset_foundation_2)
get_values_17 = UiValues(Element=scroll_number_7)  # -> flatten(Values)
merge_6 = Merge(Data1=get_values_14, Data2=get_values_15, Data3=get_values_17, Data4=get_values_16)
move_7 = Move(Geometry=dam_axis_2, Motion=Z)  # -> Geometry, Transform

# ---- group: Selecting dam height level
brep_terrain_2 = RemoteReceiver(brep_terrain)
sec = BrepPlane(Brep=brep_terrain_2, Plane=Z)  # -> Curves, Points; disabled
colom = CollisionOneMany(Collider=sec.Curves, Obstacles=move_7.Geometry)  # -> Collision, Index; disabled
dispatch_2 = Dispatch(List=sec.Curves, DispatchPattern=colom.Collision)  # -> ListA, ListB; disabled
geo_2 = Geometry(dispatch_2.ListA)  # disabled

# ----
project = Project(Curve=dam_axis_2, Brep=brep_terrain_2, Direction=Vector(0, 0, 1))  # disabled
x_tremez = Extremes(Curve=project, Plane=PlaneXY(0, 0, 0))  # -> Highest, Lowest; disabled

# ---- group: Lowest point in the section
pt = Point(x_tremez.Lowest)  # disabled

# ----
Z_2 = UnitZ(Factor=neg)
list_5 = ValueList({"Default", "JD_AngularCheck"}, selected="Default")  # disabled
avr = Average(Input=get_values_14)
move_8 = Move(Geometry=brep_terrain_2, Motion=Z_2)  # -> Geometry, Transform
dam_height_m_input_from_dashboard = Panel(get_values_14)
dam_height_m_input_from_dashboard_2 = Panel(get_values_16)
dam_height_m_input_from_dashboard_3 = Panel(get_values_17)
number_slider_2 = Slider(-3, range=-100..100)  # disabled
dam_height_m_input_from_dashboard_4 = Panel(get_values_15)
crv_cp_2 = CurveClosestPoint(Point=pt, Curve=move_7.Geometry)  # -> Point, Parameter, Distance; disabled
lineardim = DefineLinearDimension(Point1=pt, Point2=crv_cp_2.Point, Offset=number_slider_2, DimensionStyle=list_5)  # disabled
dimensions_check = RemoteSender(lineardim)  # disabled
scx = SurfaceCurve(Surface=brep_terrain_2, Curve=move_7.Geometry)  # -> Curves, flatten(Points), UVPoints, Normals, Parameters, Tangents

# ---- group: Finding the crest points at bottom EXCAVATION
scx_2 = SurfaceCurve(Surface=move_8.Geometry, Curve=move_7.Geometry)  # -> Curves, flatten(Points), UVPoints, Normals, Parameters, Tangents
item_4 = ListItem(List=scx_2.Points, Index=0, Wrap=True)  # -> Item, Item1

# ----
water_level_2 = RemoteReceiver(water_level)
item_5 = ListItem(List=scx.Points, Index=0, Wrap=True)  # -> Item, Item1
out_dam_height = RemoteSender(crv_cp_2.Distance)  # disabled
Z_3 = UnitZ(Factor=water_level_2)
ln = Line(StartPoint=item_5.Item, EndPoint=item_5.Item1)

# ---- group: AXIS LINE
ln_2 = Line(StartPoint=item_4.Item, EndPoint=item_4.Item1)

# ----
len = Length(Curve=ln)
panel_35 = Panel("""Description
Volume (m3)
Specific costs (CHF/m3)
Total costs (CHF)""")
panel_36 = Panel("""Concrete foundation
Concrete top
Rockfill foundation
Rockfill top""")
brep_terrain_base_foundation = RemoteSender(move_8.Geometry)
chord_dam = RemoteSender(ln_2)
# 1. Determine L1 with section line
chord_dam_2 = RemoteReceiver(chord_dam)
end = EndPoints(Curve=chord_dam_2)  # -> Start, End
# On the formulas it is assumed here
# the lenght to excavated sound rock!
# Check technical memorandum. I have
#  changed the axis line to come from the
#  determined excavation on 06.06.23
dist = Distance(PointA=end.Start, PointB=end.End)
arch_l1 = RemoteSender(dist)
movetoplane = MoveToPlane(Geometry=ln_2, Plane=Z_3, Above=True, Below=True)  # -> Geometry, Transform
sec_2 = BrepPlane(Brep=brep_terrain_2, Plane=Z_3)  # -> Curves, Points
# This is just for the concrete dam!!
lowest_point_dam_section = RemoteSender(pt)  # disabled
null = NullItem(Item=sec_2.Points)  # -> NullFlags, InvalidFlags, Description
gate = StreamGate(Stream=sec_2.Curves, Gate=null.NullFlags)  # -> Target0, Target1
number_slider_3 = Slider(378, range=0..1000)  # disabled
colom_2 = CollisionOneMany(Collider=gate.Target0, Obstacles=movetoplane.Geometry)  # -> Collision, Index
# Pre-volume Water
brep_terrain_base_2 = RemoteReceiver(brep_terrain_base)
brep_terrain_3 = RemoteReceiver(brep_terrain)
chord_dam_3 = RemoteReceiver(chord_dam)
water_level_3 = RemoteReceiver(water_level)
freeboard_2 = RemoteReceiver(freeboard)
dispatch_3 = Dispatch(List=gate.Target0, DispatchPattern=colom_2.Collision)  # -> ListA, ListB
explode = Explode(Curve=dispatch_3.ListA, Recursive=True)  # -> Segments, flatten(Vertices)
pline = PolyLine(Vertices=explode.Vertices, Closed=False)
filter = StreamFilter(Gate=null.NullFlags, Stream0=pline, Stream1=gate.Target1)
levels_at_water_height = RemoteSender(filter)
levels_at_water_height_2 = RemoteReceiver(levels_at_water_height)

dam_6 = DataDam(
    DataFlatBase=brep_terrain_base_2,
    DataWaterLevel=water_level_3,
    DataFreeBoard=freeboard_2,
    DataChordDam=chord_dam_3,
    DataBrepTerrain=brep_terrain_3,
    DataLevelsAtWaterHeight=levels_at_water_height_2,
    BufferDelay=10000000,
    BufferMode=0)  # -> DataFlatBase, DataWaterLevel, DataFreeBoard, DataChordDam, DataBrepTerrain, DataLevelsAtWaterHeight
objfromgroup_2 = GetObjectsInGroup()

setobj_2 = SetObjectValue(ObjectToSet=objfromgroup_2, ValueToSet=run_pre_geometry_of_water)
Z_4 = UnitZ(Factor=dam_6.DataWaterLevel)

# ---- group: Water volume cutter
project_2 = Project(Curve=dam_6.DataChordDam, Brep=dam_6.DataBrepTerrain, Direction=Vector(0, 0, 1))
ccx = CurveCurve(CurveA=project_2, CurveB=dam_6.DataLevelsAtWaterHeight)  # -> Points, ParamsA, ParamsB
shatter = Shatter(Curve=project_2, Parameters=ccx.ParamsA)
shatter_2 = Shatter(Curve=dam_6.DataLevelsAtWaterHeight, Parameters=ccx.ParamsB)
dispatch_4 = Dispatch(List=shatter, DispatchPattern=[True, False])  # -> ListA, ListB
dispatch_5 = Dispatch(List=shatter_2, DispatchPattern=[True, False])  # -> ListA, ListB
join = JoinCurves(Curves=flatten([dispatch_4.ListB, dispatch_5.ListB]), Preserve=False)

# ---- group: Water_Lateral part
neg_2 = Negative(Value=dam_6.DataFreeBoard)
Z_5 = UnitZ(Factor=neg_2)
move_9 = Move(Geometry=dam_6.DataChordDam, Motion=Z_5)  # -> Geometry, Transform
neg_3 = Negative(Value=Z_4)
extr = Extrude(Base=move_9.Geometry, Direction=neg_3)
srfsplit = SurfaceSplit(Surface=extr, Curves=project_2)
center = Center(Geometric=srfsplit, referenceAll=2)  # -> Center, Dimension
sort_2 = SortList(Keys=center.Center, ValuesA=srfsplit)  # -> Keys, ValuesA
item_6 = ListItem(List=reverse(sort_2.ValuesA), Index=0, Wrap=True)

# ----
brep_terrain_base_foundation_2 = RemoteReceiver(brep_terrain_base_foundation)
# ARCH DAM
levels_at_water_height_3 = RemoteReceiver(levels_at_water_height)
chord_dam_4 = RemoteReceiver(chord_dam)

raxis_adjustments = Slider(0, range=-30..15)

# ---- group: Water_top part
move_10 = Move(Geometry=dam_6.DataFlatBase, Motion=Z_4)  # -> Geometry, Transform
srfsplit_2 = SurfaceSplit(Surface=move_10.Geometry, Curves=join)
center_2 = Center(Geometric=srfsplit_2, referenceAll=2)  # -> Center, Dimension
sort_3 = SortList(Keys=center_2.Dimension, ValuesB=srfsplit_2, ValuesA=center_2.Center)  # -> Keys, ValuesB, ValuesA
item_7 = ListItem(List=sort_3.ValuesB, Index=0, Wrap=True)

# ----
objfromgroup_3 = GetObjectsInGroup()
onoff = EnableDisableObject(
    Objects=objfromgroup_3,
    Enabled=Toggle(False),
    AllObjects_Object=[brep_terrain_base_2, Z_4, freeboard_2, water_level_3, dam_6, chord_dam_3])
panel_37 = Panel("0.5,0.5")  # disabled

# ---- group: Water_bottom part
srfsplit_3 = SurfaceSplit(Surface=dam_6.DataBrepTerrain, Curves=join)  # -> flatten(Fragments)
item_8 = ListItem(List=sort_3.ValuesA, Index=0, Wrap=True)
flatten = FlattenTree(Tree=srfsplit_3, Path="{0}")
project_3 = ProjectPoint(Point=item_8, Direction=Vector(0, 0, -1), Geometry=flatten)  # -> Point, Index
item_9 = ListItem(List=flatten, Index=project_3.Index, Wrap=True)

# ----
evalsrf = EvaluateSurface(Point=panel_37)  # -> Point, Normal, UDirection, VDirection, Frame; disabled
number_slider_4 = Slider(378, range=0..1000)  # disabled
pt_2 = Point(evalsrf.Point)  # disabled
amp = Amplitude(Vector=evalsrf.Normal, Amplitude=number_slider_4)  # disabled
# Rough volume of water according to Dam height and position
vdisex_2 = VectorDisplayEx(Point=pt_2, Vector=amp, Colour=RGB(0, 0, 0), Width=2)  # disabled
brep_3 = Brep(flatten([item_6, item_7, item_9]))
join_2 = BrepJoin(Breps=flatten(brep_3))  # -> Breps, Closed

# ---- group: Input (Abutement vectors direction - check)
list_6 = ValueList({"Original": 0, "Flipped": 1}, selected="Flipped")  # disabled

# ----
Z_6 = UnitZ(Factor=Slider(20, range=0..100))
dam_type_3 = RemoteReceiver(dam_type_2)
# WATER
toggle_5 = BooleanToggle(False)
list_7 = ValueList({"Default", "JD_AngularCheck"}, selected="JD_AngularCheck")  # disabled
number_slider_5 = Slider(57, range=0..100)  # disabled
list_8 = ValueList({"Concrete gravity dam": 0, "Arch dam": 1, "Embankment dam": 2}, selected="Concrete gravity dam")
dam_type_4 = RemoteReceiver(dam_type_2)
equals = Equality(FirstNumber=dam_type_4, SecondNumber=list_8)  # -> Equality, Inequality
c_emitter = CurveEmitter(Radius=Domain(2, 10), Number=24)  # disabled
dexpand = DomainExpand()  # disabled
bias = NumbersBias(BiasNumber=0.1)  # disabled
number_slider_6 = Slider(0.45, range=0..1)  # disabled
levels_at_water_height_4 = RemoteReceiver(levels_at_water_height)

# ----
# Visualization
# Terrain
lines_levels_2 = RemoteReceiver(lines_levels)
previewlw = CustomPreviewLineweights(Geometry=lines_levels_2, Shader=ColourSwatch(SwatchColor=RGB(107, 107, 107)), Absolute=False)

viz_dimensions_2 = RemoteReceiver(viz_dimensions)
swatch = ColourSwatch(SwatchColor=RGB(255, 174, 0))  # disabled
previewlw_2 = CustomPreviewLineweights(
    Geometry=levels_at_water_height_4,
    Shader=ColourSwatch(SwatchColor=RGB(255, 0, 0)),
    Thickness=Slider(4, range=0..10),
    Absolute=False)
viz_direction_river_2 = RemoteReceiver(viz_direction_river)  # disabled
load = Load(ForceVector=Vector(0, 0, 1), Weighting=1)
i_energy_head_losses_2 = RemoteReceiver(i_energy_head_losses)  # disabled
i_energy_design_discharge_2 = RemoteReceiver(i_energy_design_discharge)  # disabled
i_energy_ecological_discharge_2 = RemoteReceiver(i_energy_ecological_discharge)  # disabled
i_energy_powerplant_efficiency_2 = RemoteReceiver(i_energy_powerplant_efficiency)  # disabled
developablize = Developablize(Strength=1)  # disabled

g_constant = Panel("9.81")  # disabled

i_energy_dir_2 = RemoteReceiver(i_energy_dir)  # disabled
chord_dam_5 = RemoteReceiver(chord_dam)  # disabled
midpt = CurveMiddle(Curve=chord_dam_5)  # disabled
freeboard_3 = RemoteReceiver(freeboard)  # disabled
num_2 = Number(i_energy_design_discharge_2)  # disabled
num_3 = Number(i_energy_ecological_discharge_2)  # disabled
num_4 = Number(i_energy_dir_2)  # disabled
chord_dam_6 = RemoteReceiver(chord_dam)  # disabled

# ---- group: Is that correct?
division = Division(A=i_energy_powerplant_efficiency_2, B=100000)  # disabled

# ---- group: dam middle point
pt_3 = Point(midpt)  # disabled

# ----
number_slider_7 = Slider(50, range=0..100)
brep_terrain_base_foundation_3 = RemoteReceiver(brep_terrain_base_foundation)  # disabled
number_slider_8 = Slider(1, range=0..10)  # disabled
panel_38 = Panel("2")  # disabled
neg_4 = Negative(Value=number_slider_8)  # disabled
panel_39 = Panel("-1")  # disabled
rad = Radians(Degrees=[number_slider_8, neg_4])  # disabled
lowest_point_dam_section_2 = RemoteReceiver(lowest_point_dam_section)
panel_40 = Panel("-1")  # disabled

# ---- group: Just a random amplitude
number_slider_9 = Slider(50, range=0..100)

# ----
chord_dam_7 = RemoteReceiver(chord_dam)
pt_4 = Point(lowest_point_dam_section_2)
panel_41 = Panel("-1")  # disabled
crv = Curve(chord_dam_7)
number_slider_10 = Slider(-20, range=-21..-20)  # disabled
number_slider_11 = Slider(86, range=0..100)  # disabled
Z_7 = UnitZ(Factor=number_slider_10)  # disabled
# Section
move_11 = Move(Geometry=crv, Motion=Z_7)  # -> Geometry, Transform; disabled
Z_8 = UnitZ(Factor=number_slider_11)  # disabled
extr_2 = Extrude(Base=move_11.Geometry, Direction=Z_8)  # disabled
midpt_2 = CurveMiddle(Curve=crv)
number_slider_12 = Slider(3, range=0..10)
button_3 = Button()
pdecon = Deconstruct(Point=midpt_2)  # -> XComponent, YComponent, ZComponent
chord_dam_8 = RemoteReceiver(chord_dam)  # disabled
number_slider_13 = Slider(10, range=0..10)  # disabled
data = Data([pdecon.XComponent, pdecon.YComponent, pdecon.ZComponent])
xy_2 = XYPlane(Origin=Point(0, 0, 0))
number_slider_14 = Slider(10, range=0..10)  # disabled
panel_42 = Panel("0.5,0.5")  # disabled
netsurf = NetworkSurface(Continuity=2)  # disabled
offset_foundation_3 = RemoteReceiver(offset_foundation)  # disabled
panel_43 = Panel("{0,0,1}")  # disabled
lowest_point_dam_section_3 = RemoteReceiver(lowest_point_dam_section)  # disabled
vec = Vector(panel_43)  # disabled
offset_foundation_4 = RemoteReceiver(offset_foundation)  # disabled
number_slider_15 = Slider(2, range=0..10)  # disabled
Z_9 = UnitZ(Factor=offset_foundation_4)  # disabled
xy_3 = XYPlane(Origin=Point(0, 0, 0))  # disabled
division_2 = Division(A=Z_9, B=number_slider_15)  # disabled
number_slider_16 = Slider(7, range=0..10)  # disabled

# ---- group: results / variants / change the number of your variant before sending to Excel!
list_9 = ValueList({"1", "2", "3", "4", "5"}, selected="1")  # disabled

# ----
number_slider_17 = Slider(10, range=0..10)  # disabled
number_slider_18 = Slider(4.4, range=0..10)  # disabled
swatch_2 = ColourSwatch(SwatchColor=RGB(36, 36, 36))  # disabled
neg_5 = Negative(Value=number_slider_17)  # disabled

panel_44 = Panel("1")  # disabled
equals_2 = Equality(FirstNumber=list_9, SecondNumber=panel_44)  # -> Equality, Inequality; disabled

panel_45 = Panel("4")  # disabled
equals_3 = Equality(FirstNumber=list_9, SecondNumber=panel_45)  # -> Equality, Inequality; disabled

panel_46 = Panel("5")  # disabled
equals_4 = Equality(FirstNumber=list_9, SecondNumber=panel_46)  # -> Equality, Inequality; disabled

panel_47 = Panel("2")  # disabled
equals_5 = Equality(FirstNumber=list_9, SecondNumber=panel_47)  # -> Equality, Inequality; disabled

panel_48 = Panel("3")  # disabled
equals_6 = Equality(FirstNumber=list_9, SecondNumber=panel_48)  # -> Equality, Inequality; disabled

number_slider_19 = Slider(3, range=0..10)
swatch_3 = ColourSwatch(SwatchColor=RGB(36, 36, 36))
bvol = BoundaryVolume()  # disabled
panel_49 = Panel("C:\Users\cna\Gruner AG\Jumping dams [EXP] - General\04_Images\230724 - Tourtmagne")
panel_50 = Panel("""Water level:
{0}
Dam level: 
{1}
Level foundation:
{2}
Arch dam height:
{3}
Straight axis lenght - to terrain:
{4}
Straight axis lenght - to bottom foundation:
{5}
Arch dam axis length - to bottom foundation:
{6}
Volume arch dam:
{7}""")
panel_51 = Panel("""Top
Front
Right
Perspective
Top_detail""")
panel_52 = Panel("C:\Users\admin\Gruner AG\Jumping dams [EXP] - General\04_Images\230724 - Tourtmagne")
water_level_4 = RemoteReceiver(water_level)
dam_level_3 = RemoteReceiver(dam_level)
panel_53 = Panel("Water level:")
pcecdwg = AutoCADExportOption(Scheme="Default", LastSaveLocalization="neutral,N")
nickname = HttpRequest(Deliminator=":", Type=0)
captureview = LBCaptureView(file_name="Axis1_2270_2", folder=panel_49, viewport=panel_51, width="3840", height="2160", capture=Button())  # -> file; disabled; plug-in component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
saveview = SaveViewportToFile(Run=False, Render=False, ScaleFactor=1)  # disabled
capture = Capture(Path=panel_52, Filename="lala", Ext=2, XSize="3840", YSize="2160", locker=False)  # disabled
cadexporter = CADExporter(Export=False, ExportType="dwg")
sporph = Sporph(R=False)

# ----
# Dam configuration
dam_axis_3 = RemoteReceiver(dam_axis)

point_upstream = RemoteSender(move_2.Geometry)
powerhouse_pt = RemoteSender(reference_points_ph)  # disabled
line_river = RemoteSender(pipeline)  # disabled

point_upstream_2 = RemoteReceiver(point_upstream)
crv_cp_3 = CurveClosestPoint(Point=point_upstream_2, Curve=dam_axis_3)  # -> Point, Parameter, Distance
vec2pt_3 = Vector2Pt(PointA=point_upstream_2, PointB=crv_cp_3.Point, Unitize=False)  # -> Vector, Length

vdisex_3 = VectorDisplayEx(Point=point_upstream_2, Vector=vec2pt_3.Vector, Colour=RGB(0, 0, 0), Width=2)  # disabled
panel_54 = Panel(vec2pt_3.Vector)

vector_waterflow = RemoteSender(vec2pt_3.Vector)

# ----
# Getting the correct vector of the vertical face with downstream direction
chord_dam_9 = RemoteReceiver(chord_dam)  # disabled
dam_level_4 = RemoteReceiver(dam_level)  # disabled
Z_10 = UnitZ(Factor=dam_level_4)  # disabled
neg_6 = Negative(Value=Z_10)  # disabled
extr_3 = Extrude(Base=move_7.Geometry, Direction=neg_6)  # disabled
evalsrf_2 = EvaluateSurface(Surface=reparameterize(extr_3), Point="0.5,0.5")  # -> Point, Normal, UDirection, VDirection, Frame; disabled
vector_waterflow_2 = RemoteReceiver(vector_waterflow)  # disabled
dprod = DotProduct(VectorA=evalsrf_2.Normal, VectorB=vector_waterflow_2, Unitize=False)  # disabled
panel_55 = Panel("0")  # disabled
smaller = SmallerThan(FirstNumber=dprod, SecondNumber=panel_55)  # -> SmallerThan, OrEqualTo; disabled
gate_2 = StreamGate(Stream=extr_3, Gate=smaller.SmallerThan)  # -> Target0, Target1; disabled
flip_2 = Flip(Surface=gate_2.Target1)  # -> Surface, Result; disabled
filter_2 = StreamFilter(Gate=smaller.SmallerThan, Stream0=gate_2.Target0, Stream1=flip_2.Surface)  # disabled
panel_56 = Panel("0.5,0.5")  # disabled
evalsrf_3 = EvaluateSurface(Surface=reparameterize(filter_2), Point=panel_56)  # -> Point, Normal, UDirection, VDirection, Frame; disabled

amp_2 = Amplitude(Vector=vector_waterflow_2, Amplitude=number_slider_3)  # disabled
vdisex_4 = VectorDisplayEx(Point=evalsrf_3.Point, Vector=amp_2, Colour=RGB(0, 0, 0), Width=2)  # disabled

# ---- group: vector vertical face
number_slider_20 = Slider(378, range=0..1000)  # disabled
amp_3 = Amplitude(Vector=evalsrf_3.Normal, Amplitude=number_slider_20)  # disabled
vdisex_5 = VectorDisplayEx(Point=evalsrf_3.Point, Vector=amp_3, Colour=RGB(0, 0, 0), Width=2)  # disabled

# ----
point_upstream_3 = RemoteReceiver(point_upstream)

# ----
# Steps from the Technical Memorandum
#  No. EM36-86-68110
dam_7 = DataDam(
    DataChordToBaseFoundation=chord_dam_4,
    DataBaseFoundationTerrain=brep_terrain_base_foundation_2,
    DataPointUpstream=point_upstream_3,
    DataLevelsAtWaterHeight=levels_at_water_height_3,
    BufferDelay=10000000,
    BufferMode=0)  # -> DataChordToBaseFoundation, DataBaseFoundationTerrain, DataPointUpstream, DataLevelsAtWaterHeight
objfromgroup_4 = GetObjectsInGroup()

setobj_3 = SetObjectValue(ObjectToSet=objfromgroup_4, ValueToSet=run_arch_dam)
arch_dam_base_foundation_terrain = RemoteSender(dam_7.DataBaseFoundationTerrain)
arch_dam_base_foundation_terrain_2 = RemoteReceiver(arch_dam_base_foundation_terrain)
arch_dam_base_foundation_terrain_3 = RemoteReceiver(arch_dam_base_foundation_terrain)
arch_dam_base_foundation_terrain_4 = RemoteReceiver(arch_dam_base_foundation_terrain)

dam_axis_4 = RemoteReceiver(dam_axis)  # disabled
line_river_2 = RemoteReceiver(line_river)  # disabled

powerhouse_pt_2 = RemoteReceiver(powerhouse_pt)  # disabled

# ---- group: defining a power house point from the distance from a dam
Z_11 = UnitZ(Factor=1)  # disabled
extr_4 = Extrude(Base=dam_axis_4, Direction=Z_11)  # disabled
split_5 = SplitWithBrep(Curve=line_river_2, Brep=extr_4)  # -> Curve, Points; disabled
point_upstream_4 = RemoteReceiver(point_upstream)  # disabled
end_2 = EndPoints(Curve=split_5.Curve)  # -> Start, End; disabled
dist_2 = Distance(PointA=end_2.Start, PointB=point_upstream_4)  # disabled
rev = ReverseList(List=dist_2)  # disabled
item_10 = ListItem(List=rev, Index=0, Wrap=True)  # disabled
mindex = MemberIndex(Set=dist_2, Member=item_10)  # -> Index, Count; disabled
toggle_6 = BooleanToggle(True)  # disabled
item_11 = ListItem(List=split_5.Curve, Index=mindex.Index, Wrap=True)  # disabled
mesh_terrain_2 = RemoteReceiver(mesh_terrain)  # disabled
eval = EvaluateLength(Curve=item_11, Normalized=toggle_6)  # -> Point, Tangent, Parameter; disabled

# ----
powerhouse_pt_3 = RemoteReceiver(powerhouse_pt)  # disabled

# ---- group: power house static point
pt_5 = Point(powerhouse_pt_2)  # disabled

# ---- group: distance in straight line (!) between the dam and the PH
midpt_3 = CurveMiddle(Curve=chord_dam_6)  # disabled
pln = Plane(midpt_3)  # disabled
project_4 = Project(Geometry=powerhouse_pt_3, Plane=pln)  # -> Geometry, Transform; disabled

# ---- group: distance in straight line (!) between the dam and the PH / L
dist_3 = Distance(PointA=midpt_3, PointB=project_4.Geometry)  # disabled

# ---- group: defining a power house point from the distance from a dam / Power_house_point
python = GhPythonScript(point=eval.Point, mesh=mesh_terrain_2)  # -> out, simplify(a); disabled
# ---------- python: Python ----------
__author__ = "cna"
__version__ = "2022.02.03"

import rhinoscriptsyntax as rs


#Project down...
a = rs.ProjectPointToMesh(point, mesh, (0,0,1))
# ---------- end python ----------

# ---- group: VIZ / house visualisation
number_slider_21 = Slider(20, range=0..100)  # disabled
pdecon_2 = Deconstruct(Point=python.a)  # -> XComponent, YComponent, ZComponent; disabled
addition_2 = Addition(A=pdecon_2.XComponent, B=number_slider_21)  # disabled
addition_3 = Addition(A=pdecon_2.YComponent, B=number_slider_21)  # disabled
addition_4 = Addition(A=pdecon_2.ZComponent, B=number_slider_21)  # disabled
pt_6 = ConstructPoint(XCoordinate=addition_2, YCoordinate=addition_3, ZCoordinate=addition_4)  # disabled
swatch_4 = ColourSwatch(SwatchColor=RGB(255, 242, 99))  # disabled
box = Box2Pt(PointA=pt_6, PointB=python.a, Plane=PlaneXY(0, 0, 0))  # disabled
preview = CustomPreview(Geometry=box, Material=swatch_4)  # disabled

# ----
vector_waterflow_3 = RemoteReceiver(vector_waterflow)
amp_4 = Amplitude(Vector=vector_waterflow_3, Amplitude=number_slider_9)
move_12 = Move(Geometry=pt_4, Motion=amp_4)  # -> Geometry, Transform
ln_3 = Line(StartPoint=pt_4, EndPoint=move_12.Geometry)

# ---- group: View Plane - Check if the direction is correct
# SECTION CUT
crv_2 = Curve(ln_3)
Z_12 = UnitZ(Factor=Slider(-20, range=-21..-20))
move_13 = Move(Geometry=crv_2, Motion=Z_12)  # -> Geometry, Transform
Z_13 = UnitZ(Factor=Slider(86, range=0..100))
extr_5 = Extrude(Base=move_13.Geometry, Direction=Z_13)
midpt_4 = CurveMiddle(Curve=crv_2)
flip_3 = Flip(Surface=extr_5)  # -> Surface, Result

# ----
# Section
number_slider_22 = Slider(2, range=0..10)
number_slider_23 = Slider(4, range=0..10)
offset = OffsetCurve(Curve=crv_2, Distance=Slider(50, range=0..100), Corners=1)
midpt_5 = CurveMiddle(Curve=offset)
camera = CameraCrane(Location=midpt_5, Target=midpt_4, Perspective="0", View=number_slider_22, Refresh=button_3)  # -> Camera, Target, Lens, Up, HorizontalViewAngle, VerticalViewAngle, ScreenRatio, Frame

vector_waterflow_4 = RemoteReceiver(vector_waterflow)

evalsrf_4 = EvaluateSurface(Surface=reparameterize(flip_3.Surface), Point="0.5,0.5")  # -> Point, Normal, UDirection, VDirection, Frame

rev_2 = Reverse(Vector=vector_waterflow_4)
pl = PlaneNormal(Origin=midpt_2, ZAxis=rev_2)
devec = DeconstructVector(Vector=rev_2)  # -> XComponent, YComponent, ZComponent
amp_5 = Amplitude(Vector=vector_waterflow_4, Amplitude=Slider(50, range=0..100))

pdecon_3 = Deconstruct(Point=evalsrf_4.Normal)  # -> XComponent, YComponent, ZComponent
pdecon_4 = Deconstruct(Point=midpt_4)  # -> XComponent, YComponent, ZComponent
c_script_2 = CSharpScript(polyList=flip_3.Surface)  # -> out, planeList; inputs polyList: list of Polyline
# ---------- c_script_2: C# ----------
    List<Plane> planes = new List<Plane>();
    foreach(Polyline poly in polyList){
      Plane plane = new Plane(poly.ElementAt(0), poly.ElementAt(1), poly.ElementAt(2));
      planes.Add(plane);
    }
    planeList = planes;
# ---------- end c_script_2 ----------
c_script_3 = CSharpScript(
    enable=Toggle(False),
    clipPlaneOrigin=[pdecon_4.XComponent, pdecon_4.YComponent, pdecon_4.ZComponent],
    clipPlaneDir=[pdecon_3.XComponent, pdecon_3.YComponent, pdecon_3.ZComponent],
    userPlanes=c_script_2.planeList,
    moveClipInZAxis=Slider(-7.01, range=-50..10),
    flip=Toggle(True),
    pageViews=Toggle(True),
    index=number_slider_22,
    clipU=Slider(0.5, range=0.5..100),
    clipV=Slider(2.6, range=0.5..100))  # -> out, viewPicked, viewsInDocument, messageOfTheDay; inputs enable: Boolean, clipPlaneOrigin: list of Double, clipPlaneDir: list of Double, void4: list of Plane, useUserPlanes: Boolean, userPlanes: list of Plane, moveClipInZAxis: Double, flip: Boolean, pageViews: Boolean, index: Int32, clipU: Double, clipV: Double
# ---------- c_script_3: C# ----------
    //by The Lord of Darkness due to critical Vodka starvation issues

    Rhino.Display.RhinoView[] viewsList = RhinoDocument.Views.GetViewList(true, pageViews);

    if(index >= viewsList.Length) index = viewsList.Length - 1;
    List<string> availableViews = new List<string>();
    string viewP = "";

    for(int i = 0; i < viewsList.Length;i++){
      Rhino.Display.RhinoView rview = viewsList[i];
      availableViews.Add(rview.ActiveViewport.Name);
      if(i == index){
        rv = rview.ActiveViewport;
        viewP = rv.Name;
        viewPortID = rview.ActiveViewportID;
      }
    }
    viewsInDocument = availableViews; //>>out
    viewPicked = viewP;               //>>out

    int removed = 0;
    PurgeClipPlane(rv, ref removed);
    if(!enable){ Print("Clip(s): {0} removed", removed);return;}

    userPlanes = userPlanes.Where(x => x != Plane.Unset).ToList();
    if(useUserPlanes && userPlanes.Any()){
      for(int i = 0; i < userPlanes.Count;i++){
        Plane p = userPlanes[i];
        if(moveClipInZAxis != 0){
          Vector3d vz = p.ZAxis; vz.Unitize(); vz *= moveClipInZAxis;
          p.Translate(vz);
        }
        if(flip) p.Flip();        
        Guid id = doc.Objects.AddClippingPlane(p, clipU, clipV, viewPortID);
      }
      doc.Views.Redraw();
      Print("Clip(s): {0} active", userPlanes.Count);
    }
    else{
      Point3d orig = new Point3d(clipPlaneOrigin[0], clipPlaneOrigin[1], clipPlaneOrigin[2]);
      Plane plane = new Plane(orig, new Vector3d(clipPlaneDir[0], clipPlaneDir[1], clipPlaneDir[2]));
      if(moveClipInZAxis != 0){
        Vector3d vz = plane.ZAxis; vz.Unitize(); vz *= moveClipInZAxis;
        plane.Translate(vz);
      }
      if(flip)plane.Flip();
      Guid id = doc.Objects.AddClippingPlane(plane, clipU, clipV, viewPortID);
      Print("Clip:  active");
      if (id != Guid.Empty){  doc.Views.Redraw(); }
    }
# ---------- c_script_3: C# additional code ----------
  public Rhino.Display.RhinoViewport rv;
  public Guid viewPortID;

  public void PurgeClipPlane(Rhino.Display.RhinoViewport rv, ref int removed){
    ClippingPlaneObject[] clipObjects = RhinoDoc.ActiveDoc.Objects.FindClippingPlanesForViewport(rv);
    //.FindByObjectType(ObjectType.ClipPlane());
    // ClippingPlaneObject[] clipObjects = RhinoDoc.ActiveDoc.Objects.FindClippingPlanesForViewport(rv);
    //  if(clipObjects.Length < 1 || clipObjects == null)return;
    removed = clipObjects.Length;
    for(int i = 0; i < clipObjects.Length;i++){
      ClippingPlaneObject cpo = clipObjects[i];
      RhinoDoc.ActiveDoc.Objects.Purge(cpo);
    }
  }
# ---------- end c_script_3 ----------
panel_57 = Panel(c_script_3.viewPicked)

move_14 = Move(Geometry=midpt_2, Motion=amp_5)  # -> Geometry, Transform
data_2 = Data([devec.XComponent, devec.YComponent, devec.ZComponent])
c_script_4 = CSharpScript(
    enable=Toggle(True),
    clipPlaneOrigin=data,
    clipPlaneDir=data_2,
    userPlanes=pl,
    moveClipInZAxis=Slider(0, range=-50..10),
    flip=Toggle(True),
    pageViews=Toggle(True),
    index=number_slider_12,
    clipU=Slider(0.5, range=0.5..100),
    clipV=Slider(0.5, range=0.5..100))  # -> out, viewPicked, viewsInDocument, messageOfTheDay; inputs enable: Boolean, clipPlaneOrigin: list of Double, clipPlaneDir: list of Double, void4: list of Plane, useUserPlanes: Boolean, userPlanes: list of Plane, moveClipInZAxis: Double, flip: Boolean, pageViews: Boolean, index: Int32, clipU: Double, clipV: Double; same code as c_script_3
camera_2 = CameraCrane(Location=midpt_2, Target=move_14.Geometry, UPVector=xy_2, Perspective="0", View=number_slider_12, Refresh=button_3)  # -> Camera, Target, Lens, Up, HorizontalViewAngle, VerticalViewAngle, ScreenRatio, Frame
panel_58 = Panel(c_script_4.viewPicked)
panel_59 = Panel(c_script_4.out)
panel_60 = Panel(c_script_3.out)

# ----
# Preliminary layout of concrete arch dams (USBR)
# Topographic deiminesions necessary to
# compute thicknesses, projections, and
# volume are:
# - structural height (H)
# - horizontal distances between abutments;
#      - including estimated excavation to sound rock at crest elevation (L1)
#      - and 15 % of H above base (L2)
# Definitions: H = structural height
# Tc = thickness at crest
# Tb = thickness at base
# T_0.45H = thickness of crown cantilever at 0.45H above base (T0.45H)
# USP = upstream projection
# DSP = downestream projection
# L1 = straight line distance at crest elevation between abutmenets assumed excavated to sound rock
# L2 = straight line distance, at 0.15H above base, between abutments assumed excavated to sound rock
# V = estimated volume of dam
# Formulas - conservative as compared with values computed more precisely (in feet)
# at crest:
# at  base
# at 0.45H
arch_l1_2 = RemoteReceiver(arch_l1)
arch_l1_current_m = Panel(arch_l1_2)
units = ConvertUnits(Value=arch_l1_current_m, Source=2, Target=4, Exponent=1)  # -> Result, Factor
l1_feet = Panel(units.Result)
panel_61 = Panel("USPcrest = 0.0")
panel_62 = Panel("DSPcrest = Tc")
expression_3 = Expression(L1=l1_feet, Expression="0.6*L1")
# Technical Memorandum No. EM36-86-68110: 2.1.3.1 Single-, Two-, or Three- Centered Arch Dams
# 
# The number of lines-of-centers determines whether the arches are the same on the left and right side of the dam, are different on the left and right sides of the dam, or different on the inner and outer parts of the dam.
# 
# A single centered arch dam has a single line-of-centers that results in the same circular arcs from the left to the right abutment.
# 
# A 2-centered arch dam has two lines-of-centers that result in different circular arcs for the left side and right sides of the dam.
# 
# A 3-centered arch dam has two lines-of-centers that result in different circular arcs near the crown cantilever (inner) and near the abutments (outer). The radii for the inner arcs are shorter than the outer arcs.
# Technical Memorandum No. EM36-86-68110: 2.1.3.2 Uniform- or Variable Thickness Arch Dams
# 
# The number of lines that define the line-of-centers determines whether the arches are uniform thickness or variable thickness arches.
# The arches have uniform thickness if there is one line defining the extrados and intrados line-of-centers. This means that the radius center for the upstream and downstream faces is the same. The radii lengths are different at each elevation, but since the radius center is the same, the thickness of the arch is uniform.
# The arches vary in thickness if there are two lines defining the extrados and intrados line-of-centers. This means that the radius centers for the upstream and downstream faces are in different positions in space forcing the circular arcs of the arches to diverge.
panel_63 = Panel(" 1 foot = 0.3048 m")
r_axis_feet = Panel(expression_3)
units_2 = ConvertUnits(Value=r_axis_feet, Source=4, Target=2, Exponent=1)  # -> Result, Factor
r_axis_m = Panel(units_2.Result)
crest_radius = RemoteSender(r_axis_m)

# ----
# Technical Memorandum No. EM36-86-68110: 4.2 Determine an Appraisal Level Arch Dam Layout
# 
# 3 - If the topography map is of the ground surface, change the contours to represent the position of sound rock.
crest_radius_2 = RemoteReceiver(crest_radius)

# ----
# Technical Memorandum No. EM36-86-68110: 4.2 Determine an Appraisal Level Arch Dam Layout
# 
# 2 - Determine Raxis= 0.6 L1 and round the value of Raxis up to the nearest 10 to 50 feet.
# This is the initial layout, so no need for decimal accuracy
r_crest_usp = Panel(crest_radius_2)

# ----
# 2. Determine radius according to L1
addition_5 = Addition(A=r_crest_usp, B=raxis_adjustments)

# ----
# 3. Create crest curve
end_3 = EndPoints(Curve=dam_7.DataChordToBaseFoundation)  # -> Start, End
cir = Circle(Plane=end_3.Start, Radius=addition_5)
cir_2 = Circle(Plane=end_3.End, Radius=addition_5)
ccx_2 = CurveCurve(CurveA=cir, CurveB=cir_2)  # -> Points, ParamsA, ParamsB
dist_4 = Distance(PointA=ccx_2.Points, PointB=dam_7.DataPointUpstream)
sort_4 = SortList(Keys=dist_4, ValuesA=ccx_2.Points)  # -> reverse(Keys), reverse(ValuesA)
item_12 = ListItem(List=sort_4.ValuesA, Index=0, Wrap=True)  # -> Item, Item1
circle = CircleCNR(Center=item_12.Item, Normal=Vector(0, 0, 1), Radius=addition_5)
ln_4 = Line(StartPoint=item_12.Item, EndPoint=item_12.Item1)
ccx_3 = CurveCurve(CurveA=dam_7.DataChordToBaseFoundation, CurveB=circle)  # -> Points, ParamsA, ParamsB
shatter_3 = Shatter(Curve=circle, Parameters=ccx_3.ParamsB)
colom_3 = CollisionOneMany(Collider=ln_4, Obstacles=shatter_3)  # -> Collision, Index
item_13 = ListItem(List=shatter_3, Index=colom_3.Index, Wrap=True)

# ---- group: Axis arch Dam
# Technical Memorandum No. EM36-86-68110: 4.2 Determine an Appraisal Level Arch Dam Layout
# 
# 4 - Position the dam in the canyon. Draw a circular arc with radius Raxis...This arc is the axis of the dam and is the upstream side of the crest. Move the axis around the propose dam location to
# position the top of the dam in the canyon.
# 
# The angle of incidence of the axis into the left and right abutments should be approximately equal to produce a geometrically symmetric dam in the canyon.
geo_3 = Geometry(item_13)

# ----
usp_arch_crest = RemoteSender(geo_3)

# ----
# Abutements angle check
usp_arch_crest_2 = RemoteReceiver(usp_arch_crest)  # disabled

# ---- group: Vector abutements
crest_line = Geometry(usp_arch_crest_2)  # disabled
end_4 = EndPoints(Curve=crest_line)  # -> Start, End; disabled
pt_7 = Point([end_4.Start, end_4.End])  # disabled
crv_cp_4 = CurveClosestPoint(Point=pt_7, Curve=crest_line)  # -> Point, Parameter, Distance; disabled
eval_2 = EvaluateCurve(Curve=crest_line, Parameter=crv_cp_4.Parameter)  # -> simplify(graft(Point)), Tangent, Angle; disabled
dispatch_6 = Dispatch(List=eval_2.Tangent, DispatchPattern=[True, False])  # -> ListA, ListB; disabled
gate_3 = StreamGate(Stream=dispatch_6.ListA, Gate=list_6)  # -> Target0, Target1; disabled
gate_4 = StreamGate(Stream=dispatch_6.ListB, Gate=list_6)  # -> Target0, Target1; disabled
neg_7 = Negative(Value=gate_4.Target0)  # disabled
neg_8 = Negative(Value=gate_3.Target1)  # disabled
vec_2 = Vector([gate_3.Target0, neg_7])  # disabled
vec_3 = Vector([neg_8, gate_4.Target1])  # disabled
number_slider_24 = Slider(47, range=0..100)  # disabled
amp_6 = Amplitude(Vector=[vec_2, vec_3], Amplitude=number_slider_24)  # -> simplify(graft(Vector)); disabled
vdisex_6 = VectorDisplayEx(Point=eval_2.Point, Vector=amp_6, Colour=RGB(0, 0, 0), Width=2)  # disabled

# ----
usp_arch_crest_3 = RemoteReceiver(usp_arch_crest)
usp_arch_crest_4 = RemoteReceiver(usp_arch_crest)
usp_arch_crest_5 = RemoteReceiver(flatten(usp_arch_crest))
path_mapper = PathMapper(usp_arch_crest_5, source="{A}", target="{0;A}")
usp_arch_crest_6 = RemoteReceiver(usp_arch_crest)  # disabled
usp_arch_crest_7 = RemoteReceiver(flatten(usp_arch_crest))  # disabled
path_mapper_2 = PathMapper(usp_arch_crest_7, source="{A}", target="{0;A}")  # disabled
usp_arch_crest_8 = RemoteReceiver(usp_arch_crest)
geo_4 = Geometry(usp_arch_crest_8)
len_2 = Length(Curve=usp_arch_crest_8)

# ----
# Concrete dam settings
# GRAVITY DAM
downstream_face_angle_ratio_1 = Slider(0.8, range=0..1)
dam_crest_width = Slider(6, range=0..100)
width_crest = RemoteSender(dam_crest_width)
extend_dam_laterally_inside_the_terrain = Slider(2, range=0..5)
brep_terrain_base_foundation_4 = RemoteReceiver(brep_terrain_base_foundation)
chord_dam_10 = RemoteReceiver(chord_dam)
vector_waterflow_5 = RemoteReceiver(vector_waterflow)
width_crest_2 = RemoteReceiver(width_crest)
offset_foundation_5 = RemoteReceiver(offset_foundation)  # disabled
objfromgroup_5 = GetObjectsInGroup()

project_5 = Project(Curve=chord_dam_10, Brep=brep_terrain_base_foundation_4, Direction=Vector(0, 0, 1))
x_tremez_2 = Extremes(Curve=project_5, Plane=PlaneXY(0, 0, 0))  # -> Highest, Lowest
pdecon_5 = Deconstruct(Point=x_tremez_2.Lowest)  # -> XComponent, YComponent, ZComponent
onoff_2 = EnableDisableObject(
    Objects=objfromgroup_5,
    Enabled=equals.Equality,
    AllObjects_Object=[dam_crest_width, width_crest, offcrv, extr_7, Z_14, excavation_archdam, offset_foundation_5, division_3, number_slider_28, line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])

# ---- group: Level vector
geo_5 = Geometry(dam_7.DataLevelsAtWaterHeight)  # disabled
pt_8 = Point(graft(pt_7))  # disabled
number_slider_25 = Slider(75, range=0..100)  # disabled
crv_cp_5 = CurveClosestPoint(Point=pt_8, Curve=geo_5)  # -> Point, simplify(Parameter), Distance; disabled
addition_6 = Addition(A=crv_cp_5.Parameter, B=number_slider_25)  # disabled
subtraction = Subtraction(A=crv_cp_5.Parameter, B=number_slider_25)  # disabled
shatter_4 = Shatter(Curve=geo_5, Parameters=[addition_6, subtraction])  # disabled
dispatch_7 = Dispatch(List=shatter_4, DispatchPattern=[True, False])  # -> ListA, ListB; disabled
level_at_parameter_75_to_75_from_dam_end = Geometry(dispatch_7.ListB)  # "Level at parameter -75 to +75 from dam endpoints"; disabled
end_5 = EndPoints(Curve=level_at_parameter_75_to_75_from_dam_end)  # -> simplify(Start), simplify(End); disabled
pt_9 = Point(simplify(pt_8))  # disabled
pt_10 = Point([end_5.Start, end_5.End, pt_9])  # disabled
number_slider_26 = Slider(4, range=0..10)  # disabled
panel_64 = Panel("""2
2""")  # disabled
number_slider_27 = Slider(47, range=0..100)  # disabled
swatch_5 = ColourSwatch(SwatchColor=RGB(10, 166, 155))  # disabled

# ---- group: Level vector / Average level line
fline = FitLine(Points=pt_10)  # disabled

# ----
# Top
# Top - A2 Volume
# Top - A1 Volume
ext = ExtendCurve(Curve=chord_dam_10, Type=0, Start=extend_dam_laterally_inside_the_terrain, End=extend_dam_laterally_inside_the_terrain)
end_6 = EndPoints(Curve=chord_dam_10)  # -> Start, End
panel_65 = Panel("{0,0,-1}")
atan = ArcTangent(Value=downstream_face_angle_ratio_1)
pt_11 = Point(end_6.Start)
amp_7 = Amplitude(Vector=vector_waterflow_5, Amplitude=width_crest_2)
move_15 = Move(Geometry=pt_11, Motion=amp_7)  # -> Geometry, Transform
panel_66 = Panel("0,0,-1")

pdecon_6 = Deconstruct(Point=end_6.Start)  # -> XComponent, YComponent, ZComponent
subtraction_2 = Subtraction(A=pdecon_6.ZComponent, B=pdecon_5.ZComponent)
multiplication_3 = Multiplication(A=subtraction_2, B=1.5)
pline_2 = PolyLine(Vertices=flatten([move_15.Geometry, pt_11]), Closed=False)
swp1 = Sweep1(Rail=chord_dam_10, Sections=pline_2, Miter=1)

line = LineSDL(Start=end_6.Start, Direction=panel_65, Length=multiplication_3)
rotax = RotateAxis(Geometry=line, Angle=atan, Axis=chord_dam_10)  # -> Geometry, Transform
end_7 = EndPoints(Curve=rotax.Geometry)  # -> Start, End
end_8 = EndPoints(Curve=line)  # -> Start, End
ln_5 = Line(StartPoint=end_8.End, EndPoint=end_7.End)
join_3 = JoinCurves(Curves=flatten([line, rotax.Geometry, ln_5]), Preserve=False)
swp1_2 = Sweep1(Rail=chord_dam_10, Sections=join_3, Miter=1)  # disabled
cap = CapHoles(Brep=swp1_2)
splitmul = SplitBrepMultiple(Brep=cap, Cutters=brep_terrain_base_foundation_4)  # disabled
item_14 = ListItem(List=splitmul, Index=0, Wrap=True)
split_6 = SplitBrep(Brep=brep_terrain_base_foundation_4, Cutter=item_14)
item_15 = ListItem(List=split_6, Index=0, Wrap=True)  # -> Item, Item1
geo_6 = Geometry(item_15.Item1)  # disabled
join_4 = BrepJoin(Breps=flatten([item_14, geo_6]))  # -> Breps, Closed
top_concretedam = Geometry(join_4.Breps)
project_6 = ProjectPoint(Point=move_15.Geometry, Direction=panel_66, Geometry=join_3)  # -> Point, Index
pline_3 = PolyLine(Vertices=flatten([pt_11, move_15.Geometry, project_6.Point]), Closed=True)

swp1_3 = Sweep1(Rail=chord_dam_10, Sections=rotax.Geometry, Miter=1)
bbx = BrepBrep(BrepA=swp1_3, BrepB=brep_terrain_base_foundation_4)  # -> Curves, Points
swp1_4 = Sweep1(Rail=chord_dam_10, Sections=line, Miter=1)
srfsplit_4 = SurfaceSplit(Surface=swp1_3, Curves=bbx.Curves)
bbx_2 = BrepBrep(BrepA=swp1_4, BrepB=brep_terrain_base_foundation_4)  # -> Curves, Points
center_3 = Center(Geometric=srfsplit_4, referenceAll=2)  # -> Center, Dimension
srfsplit_5 = SurfaceSplit(Surface=swp1_4, Curves=bbx_2.Curves)
sort_5 = SortList(Keys=center_3.Dimension, ValuesA=srfsplit_4)  # -> Keys, ValuesA
join_5 = JoinCurves(Curves=[bbx_2.Curves, bbx.Curves], Preserve=False)
center_4 = Center(Geometric=srfsplit_5, referenceAll=2)  # -> Center, Dimension
srfsplit_6 = SurfaceSplit(Surface=brep_terrain_base_foundation_4, Curves=join_5)
pline_4 = PolyLine(Vertices=flatten([pt_11, project_6.Point]), Closed=False)
center_5 = Center(Geometric=srfsplit_6, referenceAll=2)  # -> Center, Dimension
sort_6 = SortList(Keys=center_4.Dimension, ValuesA=srfsplit_5)  # -> Keys, ValuesA
sort_7 = SortList(Keys=center_5.Dimension, ValuesA=srfsplit_6)  # -> Keys, ValuesA

swp1_5 = Sweep1(Rail=chord_dam_10, Sections=pline_4, Miter=1)
cap_2 = CapHoles(Brep=swp1_5)  # disabled

swp1_6 = Sweep1(Rail=chord_dam_10, Sections=pline_3, Miter=1)
item_16 = ListItem(List=sort_5.ValuesA, Index=0, Wrap=True)
item_17 = ListItem(List=sort_7.ValuesA, Index=0, Wrap=True)
item_18 = ListItem(List=sort_6.ValuesA, Index=0, Wrap=True)
join_6 = BrepJoin(Breps=flatten([item_18, item_17, item_16]))  # -> Breps, Closed
extr_6 = Extrude(Base=bbx.Curves, Direction=Z_6)

# ----
# Excavation
number_slider_28 = Slider(2, range=0..10)  # disabled
division_3 = Division(A=offset_foundation_5, B=number_slider_28)  # disabled
neg_9 = Negative(Value=division_3)  # disabled
offcrv = OffsetCurve(Curve=geo_6, Plane=PlaneXY(0, 0, 0), Distance=neg_9, BothSides=0, Kinks=3, CapType=1)  # disabled
disc = Discontinuity(Curve=offcrv, Level=1)  # -> Points, Parameters; disabled
shatter_5 = Shatter(Curve=offcrv, Parameters=disc.Parameters)  # disabled
panel_67 = Panel("Line-like Curve")  # disabled
txt = Text(shatter_5)  # disabled
mindex_2 = MemberIndex(Set=txt, Member=panel_67)  # -> Index, Count; disabled
cull_i = CullIndex(List=shatter_5, Indices=mindex_2.Index, Wrap=True)  # disabled
loft = Loft(Curves=cull_i, Options={Adjust=True, Closed=False, LoftEnds=0, LoftSimp=2, LoftType=0, Rebuild=10, Refit=0.01})  # disabled
Z_14 = UnitZ(Factor=offset_foundation_5)  # disabled
extr_7 = Extrude(Base=loft, Direction=Z_14)  # disabled
excavation_archdam = Geometry(extr_7)  # disabled

split_7 = SplitBrep(Brep=extr_6, Cutter=swp1_6)
split_8 = SplitBrep(Brep=swp1_6, Cutter=extr_6)
center_6 = Center(Geometric=split_7, referenceAll=2)  # -> Center, Dimension
center_7 = Center(Geometric=split_8, referenceAll=2)  # -> Center, Dimension
sort_8 = SortList(Keys=center_6.Dimension, ValuesA=split_7)  # -> Keys, reverse(ValuesA)
sort_9 = SortList(Keys=center_7.Dimension, ValuesA=split_8)  # -> Keys, reverse(ValuesA)
cull_i_2 = CullIndex(List=sort_8.ValuesA, Indices=0, Wrap=True)
item_19 = ListItem(List=sort_9.ValuesA, Index=0, Wrap=True)
join_7 = BrepJoin(Breps=flatten([cull_i_2, item_19]))  # -> Breps, Closed

# ----
# Final volume
join_8 = BrepJoin(Breps=flatten([top_concretedam, cap_2]))  # -> Breps, Closed
sunion = SolidUnion(Breps=join_8.Breps)  # disabled

geo_concretedam_top = RemoteSender(top_concretedam)
pline_5 = PolyLine(Vertices=disc.Points, Closed=False)  # disabled
fpatch = FragmentPatch(Boundary=offcrv)  # disabled
geo_concretedam_base = RemoteSender(excavation_archdam)  # disabled
geo_concretedam = RemoteSender(sunion)

geo_concretedam_2 = RemoteReceiver(geo_concretedam)
geo_concretedam_3 = RemoteReceiver(geo_concretedam)

# ---- group: Level vector (continued)
midpt_6 = CurveMiddle(Curve=fline)  # disabled
vec2pt_4 = Vector2Pt(PointA=midpt_6, PointB=pt_9, Unitize=False)  # -> Vector, Length; disabled

# ---- group: Level vector / Average level line aligned with crest
move_16 = Move(Geometry=fline, Motion=vec2pt_4.Vector)  # -> Geometry, Transform; disabled

# ---- group: Level vector (continued)
midpt_7 = CurveMiddle(Curve=move_16.Geometry)  # disabled
end_9 = EndPoints(Curve=move_16.Geometry)  # -> Start, End; disabled
geo_7 = Geometry(end_9.Start)  # disabled
vec2pt_5 = Vector2Pt(PointA=midpt_7, PointB=geo_7, Unitize=False)  # -> Vector, Length; disabled
dash = DashPattern(Curve=move_16.Geometry, Pattern=panel_64)  # -> Dashes, Gaps; disabled
amp_8 = Amplitude(Vector=vec2pt_5.Vector, Amplitude=number_slider_27)  # disabled
vdisex_7 = VectorDisplayEx(Point=midpt_7, Vector=amp_8, Colour=RGB(0, 0, 0), Width=2)  # disabled
previewlw_3 = CustomPreviewLineweights(Geometry=dash.Dashes, Shader=swatch_5, Thickness=number_slider_26, Absolute=False)  # disabled

# ----
vec2pt_6 = Vector2Pt(PointA=midpt_7, PointB=end_9.End, Unitize=False)  # -> Vector, Length; disabled

# ---- group: Angle visualization
move_17 = Move(Geometry=eval_2.Point, Motion=amp_6)  # -> Geometry, Transform; disabled
angle = Angle(VectorA=vec2pt_6.Vector, VectorB=amp_6)  # -> Angle, Reflex; disabled
angle_2 = Angle(VectorA=vec2pt_5.Vector, VectorB=amp_6)  # -> Angle, Reflex; disabled
deg = Degrees(Radians=angle_2.Angle)  # disabled
panel_68 = Panel(deg)  # disabled

# ----
geo_8 = Geometry(end_9.End)  # disabled
# DESIGN MANUAL FOR CONCRETE ARCH DAMS, 1977: Owing to
# limitations imposed by topographic conditions
#  and foundation requirements, it will be found
#  that, for most layouts, the largest practicable
# central angle for the top arch varies between 90° and 110°.
angulardim = DefineAngularDimension(Origin=midpt_7, Point1=geo_7, Point2=move_17.Geometry, Offset=number_slider_5, DimensionStyle=list_7)  # disabled
angulardim_2 = DefineAngularDimension(Origin=midpt_7, Point1=move_17.Geometry, Point2=geo_8, Offset=number_slider_5, DimensionStyle=list_7)  # disabled
deg_2 = Degrees(Radians=angle.Angle)  # disabled
panel_69 = Panel(deg_2)  # disabled
dimensions_check_2 = RemoteSender([angulardim_2, angulardim])  # disabled

# ----
# Viz dimensions
objfromgroup_6 = GetObjectsInGroup()
dimensions_check_3 = RemoteReceiver([dimensions_check_2, dimensions_check])  # disabled
number_slider_29 = Slider(1, range=0..10)  # disabled
swatch_6 = ColourSwatch(SwatchColor=RGB(0, 0, 0))  # disabled
previewlw_4 = CustomPreviewLineweights(Geometry=dimensions_check_3, Shader=swatch_6, Thickness=number_slider_29, Absolute=False)  # disabled

onoff_3 = EnableDisableObject(
    Objects=objfromgroup_6,
    Enabled=viz_dimensions_2,
    AllObjects_Object=[dimensions_check_3, previewlw_4, number_slider_29, swatch_6])

# ----
# Excavation volume
geo_concretedam_excavation = RemoteReceiver()  # disabled
swatch_7 = ColourSwatch(SwatchColor=RGB(164, 161, 212))  # disabled

# ----
# Dam top
dam_type_5 = RemoteReceiver(dam_type_2)

# ---- group: Lowest point (Base - middle section)
project_7 = Project(Curve=usp_arch_crest_3, Brep=arch_dam_base_foundation_terrain_3, Direction=Vector(0, 0, 1))

# ----
eval_3 = EvaluateCurve(Curve=reparameterize(project_7), Parameter=number_slider_6)  # -> Point, Tangent, Angle; disabled

# ----
# 4. Figure L2
darc = DeconstructArc(Arc=usp_arch_crest_3)  # -> flatten(BasePlane), Radius, Angle
x_tremez_3 = Extremes(Curve=project_7, Plane=PlaneXY(0, 0, 0))  # -> Highest, Lowest

# ---- group: Lowest point (Base - middle section) (continued)
# Technical Memorandum No. EM36-86-68110: 4.2 Determine an Appraisal Level Arch Dam Layout
# 
# 5 - On the axis, locate a point about midway between the abutments and in the riverbed. This is the location of the crown cantilever...
pt_12 = Point(x_tremez_3.Lowest)

# ----
pdecon_7 = Deconstruct(PointAtBase=pt_12)  # -> XComponent, YComponent, ZComponent

project_8 = Project(Geometry=pt_12, Plane=darc.BasePlane)  # -> Geometry, Transform
ln_6 = Line(StartPoint=pt_12, EndPoint=project_8.Geometry)
eval_4 = EvaluateCurve(Height=reparameterize(ln_6), Point_at_015H="0.15")  # -> Point, Tangent, Angle
len_3 = Length(Curve=ln_6)

# ---- group: Centrifugal vector
pt_13 = Point(darc.BasePlane)
pt_14 = Point(project_8.Geometry)
vec2pt_7 = Vector2Pt(PointA=pt_14, PointB=pt_13, Unitize=True)  # -> Vector, Length

# ----
vec2pt_8 = Vector2Pt(PointA=pt_14, PointB=eval_4.Point, Unitize=False)  # -> Vector, Length
move_18 = Move(Geometry=usp_arch_crest_3, Motion=vec2pt_8.Vector)  # -> Geometry, Transform
bcx = BrepCurve(Brep=arch_dam_base_foundation_terrain_3, Curve=move_18.Geometry)  # -> Curves, flatten(Points)
crv_cp_6 = CurveClosestPoint(Point=bcx.Points, Curve=move_18.Geometry)  # -> Point, Parameter, Distance
shatter_6 = Shatter(Curve=move_18.Geometry, Parameters=crv_cp_6.Parameter)
colom_4 = CollisionOneMany(Collider=eval_4.Point, Obstacles=shatter_6)  # -> Collision, Index
item_20 = ListItem(List=shatter_6, Index=colom_4.Index, Wrap=True)
end_10 = EndPoints(Curve=item_20)  # -> Start, End
dist_5 = Distance(PointA=end_10.Start, PointB=end_10.End)

# ----
# Technical Memorandum No. EM36-86-68110: 4.2 Determine an Appraisal Level Arch Dam Layout
# 
# 5 - ...The radius of the axis at this point is the orientation of the reference plane and the line of centers. The reference plane is a vertical plane through the crown cantilever and generally parallel to the stream bank.
ln_7 = Line(StartPoint=pt_14, EndPoint=pt_13)

project_9 = Project(Geometry=ln_7, Plane=pt_12)  # -> Geometry, Transform
rulesrf = RuledSurface(CurveA=project_9.Geometry, CurveB=ln_7)

srf = Surface(rulesrf)
evalsrf_5 = EvaluateSurface(Surface=reparameterize(srf), Point="0.5,0.5")  # -> Point, Normal, UDirection, VDirection, Frame
amp_9 = Amplitude(Vector=evalsrf_5.Normal, Amplitude=Slider(50, range=0..100))
vdisex_8 = VectorDisplayEx(Point=evalsrf_5.Point, Vector=amp_9, Colour=RGB(0, 0, 0), Width=2)

pl_2 = PlaneNormal(Origin=evalsrf_5.Point, ZAxis=evalsrf_5.Normal)
ext_2 = ExtendCurve(Curve=project_9.Geometry, Type=0, Start=500, End=500)
crv_3 = Curve(ext_2)
geo_9 = Geometry(ln_6)
abiscissa_dam_axis = RemoteSender(crv_3)
centrifugal_vector = RemoteSender(vec2pt_7.Vector)
center_crest = RemoteSender(pt_13)
arch_dam_height = RemoteSender(len_3)
arch_l2 = RemoteSender(dist_5)

arch_dam_height_2 = RemoteReceiver(arch_dam_height)
# Do concrete formula estimation to check
# how different they are from the volume in gh
# check memoradum
arch_l2_2 = RemoteReceiver(arch_l2)
arch_l2_current_m = Panel(arch_l2_2)
meter = Panel(arch_dam_height_2)
units_3 = ConvertUnits(Value=meter, Source=2, Target=4, Exponent=1)  # -> Result, Factor
units_4 = ConvertUnits(Value=arch_l2_current_m, Source=2, Target=4, Exponent=1)  # -> Result, Factor
l2_feet = Panel(units_4.Result)
feet = Panel(units_3.Result)
expression_4 = Expression(H=feet, L1=l1_feet, Expression="0.01*(H + 1.2*L1)")
expression_5 = Expression(H=feet, L1=l1_feet, L2=l2_feet, Expression="(0.0012*H*L1*L2*((H/400)^(H/400)))^(⅓)")
expression_6 = Expression(Tb=expression_5, Expression="0.67*Tb")
expression_7 = Expression(Tb=expression_5, Expression="0.33*Tb")
expression_8 = Expression(Tb=expression_5, Expression="0.95*Tb")
expression_9 = Expression(H=feet, L1=l1_feet, L2=l2_feet, Expression="0.000002*(H²)*L2*(((H+0.8*L1)²)/(L1-L2))+0.0004*H*L1*(H+1.1*L1)")
tc_feet = Panel(expression_4)
usp_base_feet = Panel(expression_6)
dsp_base_feet = Panel(expression_7)
tb_0_45h_feet = Panel(expression_8)
units_5 = ConvertUnits(Value=tc_feet, Source=4, Target=2, Exponent=1)  # -> Result, Factor
units_6 = ConvertUnits(Value=usp_base_feet, Source=4, Target=2, Exponent=1)  # -> Result, Factor
units_7 = ConvertUnits(Value=dsp_base_feet, Source=4, Target=2, Exponent=1)  # -> Result, Factor
units_8 = ConvertUnits(Value=tb_0_45h_feet, Source=4, Target=2, Exponent=1)  # -> Result, Factor
tc_m = Panel(units_5.Result)
usp_base_m = Panel(units_6.Result)
dsp_base_m = Panel(units_7.Result)
tb_0_45h_m = Panel(units_8.Result)
arch_usp_at_045h = RemoteSender(tb_0_45h_m)
arch_usp_base = RemoteSender(usp_base_m)
arch_dsp_base = RemoteSender(dsp_base_m)
arch_tc = RemoteSender(tc_m)

arch_tc_2 = RemoteReceiver(arch_tc)
subtraction_3 = Subtraction(A=addition_5, B=arch_tc_2)
r_crest_dsp = Panel(subtraction_3)
cir_3 = Circle(Plane=item_12.Item, Radius=r_crest_dsp)
scx_3 = SurfaceCurve(Surface=arch_dam_base_foundation_terrain_2, Curve=cir_3)  # -> Curves, Points, UVPoints, Normals, Parameters, Tangents
shatter_7 = Shatter(Curve=cir_3, Parameters=scx_3.Parameters)
colom_5 = CollisionOneMany(Collider=ln_4, Obstacles=shatter_7)  # -> Collision, Index
item_21 = ListItem(List=shatter_7, Index=colom_5.Index, Wrap=True)
dsp_arch_crest = RemoteSender(item_21)
reference_centers_plane = RemoteSender(pl_2)
refecenre_centers_vector = RemoteSender(evalsrf_5.Normal)
arch_usp_at_045h_2 = RemoteReceiver(arch_usp_at_045h)
arch_tc_3 = RemoteReceiver(arch_tc)
arch_dsp_base_2 = RemoteReceiver(arch_dsp_base)
arch_usp_base_2 = RemoteReceiver(arch_usp_base)
centrifugal_vector_2 = RemoteReceiver(centrifugal_vector)

# ---- group: Crown Cantilever
# 5. Section points - based on the equations
# At Base
# At Crest:
# At 0.45H
panel_70 = Panel("0.45")
eval_5 = EvaluateCurve(Height=reparameterize(ln_6), Point_at_045H=panel_70)  # -> Point, Tangent, Angle
neg_10 = Negative(Value=centrifugal_vector_2)
neg_11 = Negative(Value=centrifugal_vector_2)
amp_10 = Amplitude(Vector=centrifugal_vector_2, Amplitude=arch_tc_3)
amp_11 = Amplitude(Vector=neg_11, Amplitude=arch_usp_base_2)
amp_12 = Amplitude(Vector=neg_10, Amplitude=arch_usp_at_045h_2)
amp_13 = Amplitude(Vector=centrifugal_vector_2, Amplitude=arch_dsp_base_2)
move_19 = Move(Geometry=pt_12, Motion=amp_13)  # -> Geometry, Transform
move_20 = Move(Geometry=pt_12, Motion=amp_11)  # -> Geometry, Transform
move_21 = Move(Geometry=project_8.Geometry, Motion=amp_10)  # -> Geometry, Transform
move_22 = Move(Geometry=eval_5.Point, Motion=amp_12)  # -> Geometry, Transform
usp_pt_at_base = Point(move_20.Geometry)
pt_at_crest = Point(project_8.Geometry)
pt_at_0_45h = Point(move_22.Geometry)
pt_at_0_45h_2 = Point(eval_5.Point)
# Technical Memorandum No. EM36-86-68110: 4.2 Determine an Appraisal Level Arch Dam Layout
# 
# 6 - Determine the shape of the crown cantilever. From the equations provided,
# compute TC, TB, T0.45H, USPC, USP0.45H, USPB, DSPC, DSP0.45H, and DSPB.
pt_at_crest_2 = Point(move_21.Geometry)
pt_at_base = Point(move_19.Geometry)
# Technical Memorandum No. EM36-86-68110: 4.2 Determine an Appraisal Level Arch Dam Layout
# 
# 7 - Determine the geometry of the upstream and downstream face along the crown cantilever. A circle can be drawn through the 3 points computed for the upstream face in Step 6. Likewise, a circle can be drawn through the 3 points computed for the
# downstream face.
# 
# 8. Draw the upstream and downstream face along the crown cantilever.
arc = Arc3Pt(PointA=pt_at_crest_2, PointB=pt_at_0_45h_2, PointC=pt_at_base)  # -> DownstreamArc, CenterP, RadiusM
arc_2 = Arc3Pt(PointA=pt_at_crest, PointB=pt_at_0_45h, PointC=usp_pt_at_base)  # -> UpstreamArc, CenterP, RadiusM
us_arc = RemoteSender(arc_2.UpstreamArc)
ds_arc = RemoteSender(arc.DownstreamArc)

# ----
# x. Elevations
# Technical Memorandum No. EM36-86-68110: 4.2 Determine an Appraisal Level Arch Dam Layout
# 
# 9. Select 6 to 8 arch elevations on the crown cantilever to define the 3D dam. Select the lowest arch elevation starting at about 15% H. Then between 15% H and the crest, try to select 6 to 8 arches evenly spaced vertically and rounded to nearest contour elevation.
# E. Goulas: According to the Engineer Manual [1], the dam is divided into 5 to 10 evenly spaced horizontal arches and their respective parabolas are computed. They should be spaced not less than 3.048 meters (10 feet) nor more than 30.48 meters (100 feet) apart. The lowest parabola should be 0.15H to 0.20H above the base.
# DESIGN MANUAL FOR CONCRETE ARCH DAMS, 1977: Usually 5 to 10 arch elevations are selected such that the  entire dam is represented by a system of horizontal elements evenly spaced over the
# height of the structure.
# Usually the intervals are not greater than 100 (30.5m) feet nor less than 20 feet (6.1m).
# Technical Memorandum No. EM36-86-68110: Select the lowest arch elevation starting at about 15% H. Then between 15% H and the crest, try to select 6 to 8 arches evenly spaced vertically and rounded to nearest contour
# elevation. Even spacing arches permit best evaluation of the ADSAS results.
# EM_1110-2-2201_ARCH_DAM_DESIGN: The
# lowest arch should be 0.15H to 0.20H above the base of the crown cantilever.
section_height_approx = Slider(11, range=6..30)
arch_dam_height_3 = RemoteReceiver(arch_dam_height)  # disabled
eval_6 = EvaluateCurve(Height=reparameterize(ln_6), Point_at_015H="0.2")  # -> Point, Tangent, Angle
flip_4 = FlipCurve(Curve=ln_6)  # -> Curve, Flag; disabled
expression_10 = Expression(section_heights=section_height_approx, height=arch_dam_height_3, Expression="height/section_heights")  # disabled
shatter_8 = Shatter(Curve=reparameterize(ln_6), Parameters="0.2")
item_22 = ListItem(List=shatter_8, Index="1", Wrap=True)
len_4 = Length(Curve=item_22)
expression_11 = Expression(section_heights=section_height_approx, height=len_4, Expression="height/section_heights")
round = Round(Number=expression_10)  # -> Nearest, Floor, Ceiling; disabled
eval_7 = EvaluateCurve(Height=reparameterize(ln_6), PointAt0="0")  # -> Point, Tangent, Angle
divide = DivideCurve(Curve=flip_4.Curve, Count=round.Nearest, Kinks=False)  # -> Points, Tangents, Parameters; disabled
pt_15 = Point(flatten(divide.Points))  # disabled
pdecon_8 = Deconstruct(Point=pt_15)  # -> XComponent, YComponent, ZComponent; disabled
round_2 = Round(Number=expression_11)  # -> Nearest, Floor, Ceiling
divide_2 = DivideCurve(Curve=item_22, Count=round_2.Nearest, Kinks=False)  # -> Points, Tangents, Parameters
division_4 = Division(A=len_4, B=round_2.Nearest)  # -> flatten(Result)
pt_16 = Point(flatten([divide_2.Points, eval_7.Point]))
pdecon_9 = Deconstruct(Point=pt_16)  # -> XComponent, YComponent, ZComponent
section_height_actual = Panel(division_4)
sort_10 = SortList(Keys=pdecon_8.ZComponent, ValuesA=pt_15)  # -> reverse(Keys), reverse(ValuesA); disabled
sort_11 = SortList(Keys=pdecon_9.ZComponent, ValuesA=pt_16)  # -> reverse(Keys), reverse(ValuesA)
cull_i_3 = CullIndex(List=sort_11.ValuesA, Indices=0, Wrap=True)
pln_2 = Plane(simplify(graft(cull_i_3)))

us_arc_2 = RemoteReceiver(us_arc)
dsp_arch_crest_2 = RemoteReceiver(dsp_arch_crest)
ds_arc_2 = RemoteReceiver(ds_arc)
item_23 = ListItem(List=sort_11.ValuesA, Index=0, Wrap=True)

# ----
# x. Dam Footprint
end_11 = EndPoints(Curve=ds_arc_2)  # -> Start, End
end_12 = EndPoints(Curve=us_arc_2)  # -> Start, End
dsp_point_bottom_foundation = Point(end_11.End)
usp_point_bottom_foundation = Point(end_12.End)
end_13 = EndPoints(Curve=dsp_arch_crest_2)  # -> Start, End
end_14 = EndPoints(Curve=usp_arch_crest_4)  # -> Start, End
# Technical Memorandum No. EM36-86-68110: 4.2 Determine an Appraisal Level Arch Dam Layout
# 
# 10. On the topography map, draw the upstream and downstream projections of the crown cantilever and downstream arc at the crest on the reference plane. Using the same radius center as the axis, draw the circular arc for the downstream side of the crest using the radius (Raxis – Tc). On the reference plane draw points at each arch elevation on the upstream and downstream faces.
project_10 = Project(Geometry=dsp_point_bottom_foundation, Plane=end_13.Start)  # -> Geometry, Transform
project_11 = Project(Geometry=usp_point_bottom_foundation, Plane=end_14.Start)  # -> Geometry, Transform
arc_3 = Arc3Pt(PointA=end_13.Start, PointB=project_10.Geometry, PointC=end_13.End)  # -> UpstreamArc, CenterP, RadiusM
arc_4 = Arc3Pt(PointA=end_14.Start, PointB=project_11.Geometry, PointC=end_14.End)  # -> UpstreamArc, CenterP, RadiusM
project_12 = Project(Curve=arc_4.UpstreamArc, Brep=arch_dam_base_foundation_terrain_4, Direction=Vector(0, 0, 1))
project_13 = Project(Curve=arc_3.UpstreamArc, Brep=arch_dam_base_foundation_terrain_4, Direction=Vector(0, 0, 1))
explode_2 = Explode(Curve=project_12, Recursive=False)  # -> Segments, Vertices
explode_3 = Explode(Curve=project_13, Recursive=False)  # -> Segments, Vertices
pline_6 = PolyLine(Vertices=explode_2.Vertices, Closed=False)
pline_7 = PolyLine(Vertices=explode_3.Vertices, Closed=False)
lng_3 = ListLength(List=explode_2.Vertices)
lng_4 = ListLength(List=explode_3.Vertices)
smoothpline = SmoothPolyline(Polyline=pline_6, Strength=Slider(0.5, range=0..1), Times=lng_3)
smoothpline_2 = SmoothPolyline(Polyline=pline_7, Strength=Slider(0.5, range=0..1), Times=lng_4)
dsp_footprint = Curve(smoothpline_2)
usp_footprint = Curve(smoothpline)

pln_3 = Plane(simplify(graft(item_23)))
plane_elevations = RemoteSender(pln_2)
usp_prefootprint = RemoteSender(usp_footprint)
dsp_prefootprint = RemoteSender(dsp_footprint)
usp_prefootprint_2 = RemoteReceiver(usp_prefootprint)
dsp_prefootprint_2 = RemoteReceiver(dsp_prefootprint)
plane_elevations_2 = RemoteReceiver(plane_elevations)
us_arc_3 = RemoteReceiver(us_arc)
refecenre_centers_vector_2 = RemoteReceiver(refecenre_centers_vector)
reference_centers_plane_2 = RemoteReceiver(reference_centers_plane)
center_crest_2 = RemoteReceiver(center_crest)
plane_elevations_3 = RemoteReceiver(plane_elevations)
ds_arc_3 = RemoteReceiver(ds_arc)
refecenre_centers_vector_3 = RemoteReceiver(refecenre_centers_vector)
reference_centers_plane_3 = RemoteReceiver(reference_centers_plane)

# ----
# Technical Memorandum No. EM36-86-68110: 4.2 Determine an Appraisal Level Arch Dam Layout
# 
# 12.a. Draw the upstream face arch starting with the first arch below the crest. Use an initial guess for the line of centers as a 0.2:1 sloping line.
# x. Line of centers
flatten_2 = FlattenTree(Tree=plane_elevations_2, Path="{0}")
flatten_3 = FlattenTree(Tree=plane_elevations_3, Path="{0}")
cull_i_4 = CullIndex(List=flatten_2, Indices=-1, Wrap=True)  # -> simplify(graft(List))
cull_i_5 = CullIndex(List=flatten_3, Indices=-1, Wrap=True)  # -> simplify(graft(List))
pcx = CurvePlane(DownstreamArc=ds_arc_3, Plane=cull_i_5)  # -> simplify(Points), ParamsC, ParamsP
pcx_2 = CurvePlane(DSPFootprint=dsp_prefootprint_2, Plane=cull_i_5)  # -> simplify(Points), ParamsC, ParamsP
pcx_3 = CurvePlane(USPFootprint=usp_prefootprint_2, Plane=cull_i_4)  # -> simplify(Points), ParamsC, ParamsP
pcx_4 = CurvePlane(UpstreamArc=us_arc_3, Plane=cull_i_4)  # -> simplify(Points), ParamsC, ParamsP
dispatch_8 = Dispatch(List=pcx_2.Points, DispatchPattern=[True, False])  # -> ListA, ListB
dispatch_9 = Dispatch(List=pcx_3.Points, DispatchPattern=[True, False])  # -> ListA, ListB
arc_5 = Arc3Pt(PointA=dispatch_8.ListA, PointB=pcx.Points, PointC=dispatch_8.ListB)  # -> Arc, Plane, Radius
arc_6 = Arc3Pt(PointA=dispatch_9.ListA, PointB=pcx_4.Points, PointC=dispatch_9.ListB)  # -> Arc, Plane, Radius
darc_2 = DeconstructArc(Arc=arc_5.Arc)  # -> BasePlane, Radius, Angle
darc_3 = DeconstructArc(Arc=arc_6.Arc)  # -> BasePlane, Radius, Angle
rev_3 = Reverse(Vector=refecenre_centers_vector_3)
project_14 = ProjectPoint(Point=darc_2.BasePlane, Direction=[refecenre_centers_vector_3, rev_3], Geometry=reference_centers_plane_3)  # -> Point, Index
rev_4 = Reverse(Vector=refecenre_centers_vector_2)
clean = CleanTree(RemoveNulls=True, RemoveInvalid=True, RemoveEmpty=False, Tree=project_14.Point)  # -> flatten(Tree)
project_15 = ProjectPoint(Point=darc_3.BasePlane, Direction=[refecenre_centers_vector_2, rev_4], Geometry=reference_centers_plane_2)  # -> Point, Index
center_at_crest = Point(center_crest_2)
clean_2 = CleanTree(RemoveNulls=True, RemoveInvalid=True, RemoveEmpty=False, Tree=project_15.Point)  # -> flatten(Tree)
abiscissa_dam_axis_2 = RemoteReceiver(abiscissa_dam_axis)

centers_extrados_not_normalized = Point([center_at_crest, clean_2])
pline_8 = PolyLine(Vertices=centers_extrados_not_normalized, Closed=False)
lng_5 = ListLength(List=centers_extrados_not_normalized)
smoothpline_3 = SmoothPolyline(Polyline=pline_8, Strength=1, Times=lng_5)
ext_3 = ExtendCurve(Curve=smoothpline_3, Type=2, Start=0, End=500)
ccx_4 = CurveCurve(CurveA=ext_3, CurveB=abiscissa_dam_axis_2)  # -> Points, ParamsA, ParamsB
shatter_9 = Shatter(Curve=ext_3, Parameters=flatten(ccx_4.ParamsA))
sort_12 = SortList(Keys=shatter_9, ValuesA=shatter_9)  # -> Keys, ValuesA
item_24 = ListItem(List=sort_12.ValuesA, Index=0, Wrap=True)
geo_10 = Geometry(item_24)

centers_extrados_not_normalized_2 = Point([center_at_crest, clean])
pline_9 = PolyLine(Vertices=centers_extrados_not_normalized_2, Closed=False)
lng_6 = ListLength(List=centers_extrados_not_normalized_2)
smoothpline_4 = SmoothPolyline(Polyline=pline_9, Strength=1, Times=lng_6)
ext_4 = ExtendCurve(Curve=smoothpline_4, Type=2, Start=0, End=500)
ccx_5 = CurveCurve(CurveA=ext_4, CurveB=abiscissa_dam_axis_2)  # -> Points, ParamsA, ParamsB
shatter_10 = Shatter(Curve=ext_4, Parameters=flatten(ccx_5.ParamsA))
sort_13 = SortList(Keys=shatter_10, ValuesA=shatter_10)  # -> Keys, ValuesA
item_25 = ListItem(List=sort_13.ValuesA, Index=0, Wrap=True)
geo_11 = Geometry(item_25)

line_of_centers_intrados = RemoteSender(geo_10)
line_of_centers_extrados = RemoteSender(geo_11)
us_arc_4 = RemoteReceiver(us_arc)
plane_elevations_4 = RemoteReceiver(plane_elevations)
line_of_centers_extrados_2 = RemoteReceiver(line_of_centers_extrados)
ds_arc_4 = RemoteReceiver(ds_arc)
line_of_centers_intrados_2 = RemoteReceiver(line_of_centers_intrados)
pcx_5 = CurvePlane(DownstreamArc=ds_arc_4, Plane=plane_elevations_4)  # -> simplify(Points), ParamsC, ParamsP
pcx_6 = CurvePlane(LineOfCentersIntrados=line_of_centers_intrados_2, Plane=plane_elevations_4)  # -> simplify(CenterPoints), ParamsC, ParamsP
pcx_7 = CurvePlane(UpstreamArc=us_arc_4, Plane=plane_elevations_4)  # -> simplify(Points), ParamsC, ParamsP
pcx_8 = CurvePlane(LineOfCentersExtrados=line_of_centers_extrados_2, Plane=plane_elevations_4)  # -> simplify(CenterPoints), ParamsC, ParamsP
ln_8 = Line(StartPoint=pcx_5.Points, EndPoint=pcx_6.CenterPoints)
ln_9 = Line(StartPoint=pcx_7.Points, EndPoint=pcx_8.CenterPoints)
len_5 = Length(Curve=ln_8)
len_6 = Length(Curve=ln_9)
cir_4 = Circle(DSCenters=pcx_6.CenterPoints, Radius=len_5)  # -> simplify(Circle)
cir_5 = Circle(USCenters=pcx_8.CenterPoints, Radius=len_6)
path_mapper_3 = PathMapper(ln_9, source="{A}", target="{0;A}")
path_mapper_4 = PathMapper(cir_4, source="{A}", target="{1;A}")
path_mapper_5 = PathMapper(cir_5, source="{A}", target="{0;A}")
path_mapper_6 = PathMapper(ln_8, source="{A}", target="{1;A}")

# ---- group: Finding the intersection with sound rock
brep_terrain_base_foundation_5 = RemoteReceiver(brep_terrain_base_foundation)
relay = Relay([path_mapper_5, path_mapper_4])
relay_2 = Relay([path_mapper_3, path_mapper_6])
scx_4 = SurfaceCurve(Surface=brep_terrain_base_foundation_5, Curve=relay)  # -> Curves, simplify(Points), UVPoints, Normals, Parameters, Tangents

# ---- group: Filter away last circle - touching sound rock
geo_12 = Geometry(relay)
tstat = TreeStatistics(Tree=geo_12)  # -> Paths, Length, Count
division_5 = Division(A=tstat.Count, B="2")
x_minus_one = XMinusOne(NumberX=division_5)
item_26 = ListItem(List=tstat.Paths, Index=flatten(["-1", x_minus_one]), Wrap=True)
split_9 = SplitTree(Data=geo_12, Masks=flatten(item_26))  # -> Positive, Negative
geo_13 = Geometry(split_9.Positive)

# ---- group: Adjusting the bottom so there is something to connect with the bottom circle
number_slider_30 = Slider(1, range=0..10)
centrifugal_vector_3 = RemoteReceiver(centrifugal_vector)
neg_12 = Negative(Value=number_slider_30)
rev_5 = Reverse(Vector=centrifugal_vector_3)
rad_2 = Radians(Degrees=[number_slider_30, neg_12])
rotate = Rotate(Geometry=rev_5, Angle=rad_2, Plane=PlaneXY(0, 0, 0))  # -> flatten(Geometry), Transform
center_8 = Center(Geometric=geo_13)  # -> Center, Dimension
darc_4 = DeconstructArc(Arc=geo_13)  # -> BasePlane, Radius, Angle
line_2 = LineSDL(Start=center_8.Center, Direction=rotate.Geometry, Length=darc_4.Radius)
ccx_6 = CurveCurve(CurveA=geo_13, CurveB=line_2)  # -> Points, ParamsA, ParamsB
pshift = ShiftPaths(Data=ccx_6.ParamsA, Offset="-1")
shatter_11 = Shatter(Curve=geo_13, Parameters=pshift)
pshift_2 = ShiftPaths(Data=shatter_11, Offset="-1")
item_27 = ListItem(List=pshift_2, Index=0, Wrap=True)

# ---- group: Cutting and selecting curves for dam
shatter_12 = Shatter(Curve=relay, Parameters=scx_4.Parameters)  # -> simplify(Segments)
colom_6 = CollisionOneMany(Collider=shatter_12, Obstacles=relay_2)  # -> Collision, Index
dispatch_10 = Dispatch(List=shatter_12, DispatchPattern=colom_6.Collision)  # -> ListA, ListB

# ----
split_10 = SplitTree(Data=dispatch_10.ListA, Masks=flatten(item_26))  # -> Positive, Negative
ds_arc_5 = RemoteReceiver(ds_arc)  # disabled
us_arc_5 = RemoteReceiver(us_arc)  # disabled
end_15 = EndPoints(Curve=ds_arc_5)  # -> Start, End; disabled
end_16 = EndPoints(Curve=us_arc_5)  # -> Start, End; disabled
dsp_point_bottom_foundation_2 = Point(end_15.End)  # disabled
usp_point_bottom_foundation_2 = Point(end_16.End)  # disabled
dispatch_11 = Dispatch(List=item_26, DispatchPattern=[True, False])  # -> ListA, ListB; disabled
tstat_2 = TreeStatistics(Tree=dsp_point_bottom_foundation_2)  # -> Paths, Length, Count; disabled
tstat_3 = TreeStatistics(Tree=usp_point_bottom_foundation_2)  # -> Paths, Length, Count; disabled
replace_2 = ReplacePaths(Data=dsp_point_bottom_foundation_2, Search=tstat_2.Paths, Replace=dispatch_11.ListA)  # disabled
replace_3 = ReplacePaths(Data=usp_point_bottom_foundation_2, Search=tstat_3.Paths, Replace=dispatch_11.ListB)  # disabled
dsp_arch_crest_3 = RemoteReceiver(flatten(dsp_arch_crest))
geo_14 = Geometry(split_10.Negative)
path_mapper_7 = PathMapper(split_10.Negative, source="{A;B}", target="{A;B+1}")  # disabled
path_mapper_8 = PathMapper([replace_2, replace_3], source="{A;B}", target="{A;B+1}")  # disabled
geo_15 = Geometry([split_10.Negative, item_27])  # disabled
path_mapper_9 = PathMapper(item_27, source="{A;B}", target="{A;B+1}")
path_mapper_10 = PathMapper(dsp_arch_crest_3, source="{A}", target="{1;A}")
path_mapper_11 = PathMapper(geo_14, source="{A;B}", target="{A;B+1}")
path_mapper_12 = PathMapper(geo_15, source="{A;B}", target="{A;B+1}")  # disabled
geo_16 = Geometry([path_mapper_7, path_mapper, path_mapper_10, path_mapper_8])  # disabled
end_17 = EndPoints(Curve=path_mapper_9)  # -> Start, End
path_mapper_13 = PathMapper(geo_16, source="{A;B}", target="{A}")  # disabled
geo_17 = Geometry([end_17.Start, end_17.End])
loft_2 = Loft(Curves=path_mapper_13, Options={Adjust=True, Closed=False, LoftEnds=0, LoftSimp=0, LoftType=5, Rebuild=10, Refit=0.01})  # disabled
us_arc_6 = RemoteReceiver(us_arc)  # disabled
plane_elevations_5 = RemoteReceiver(plane_elevations)  # disabled
line_of_centers_extrados_3 = RemoteReceiver(line_of_centers_extrados)  # disabled
line_of_centers_intrados_3 = RemoteReceiver(line_of_centers_intrados)  # disabled
geo_18 = Geometry([path_mapper, path_mapper_10, path_mapper_11])
ds_arc_6 = RemoteReceiver(ds_arc)  # disabled
end_18 = EndPoints(Curve=geo_18)  # -> Start, End
pcx_9 = CurvePlane(DownstreamArc=ds_arc_6, Plane=plane_elevations_5)  # -> simplify(Points), ParamsC, ParamsP; disabled
pcx_10 = CurvePlane(LineOfCentersIntrados=line_of_centers_intrados_3, Plane=plane_elevations_5)  # -> simplify(CenterPoints), ParamsC, ParamsP; disabled
pcx_11 = CurvePlane(UpstreamArc=us_arc_6, Plane=plane_elevations_5)  # -> simplify(Points), ParamsC, ParamsP; disabled
pcx_12 = CurvePlane(LineOfCentersExtrados=line_of_centers_extrados_3, Plane=plane_elevations_5)  # -> simplify(CenterPoints), ParamsC, ParamsP; disabled
geo_19 = Geometry([end_18.Start, end_18.End])
path_mapper_14 = PathMapper(geo_19, source="{A;B}", target="{A}")
item_28 = ListItem(List=path_mapper_14, Index=0, Wrap=True)
ln_10 = Line(StartPoint=pcx_9.Points, EndPoint=pcx_10.CenterPoints)  # disabled
ln_11 = Line(StartPoint=pcx_11.Points, EndPoint=pcx_12.CenterPoints)  # disabled
len_7 = Length(Curve=ln_10)  # disabled
dsp_arch_crest_4 = RemoteReceiver(dsp_arch_crest)  # disabled
len_8 = Length(Curve=ln_11)  # disabled
geo_20 = Geometry(path_mapper_14)
cir_6 = Circle(DSCenters=pcx_10.CenterPoints, Radius=len_7)  # -> simplify(Circle); disabled
cir_7 = Circle(USCenters=pcx_12.CenterPoints, Radius=len_8)  # disabled
ptsortitems = PointSortItems(Start=item_28, Points=geo_20)  # -> SortedItems, SortedIndices, simplify(SortedPoints)
intcrv = Interpolate(Vertices=ptsortitems.SortedPoints, Degree=3, Periodic=False, KnotStyle=1)  # -> Curve, Length, Domain
lng_7 = ListLength(List=ptsortitems.SortedPoints)
path_mapper_15 = PathMapper(ln_11, source="{A}", target="{0;A}")  # disabled
path_mapper_16 = PathMapper(cir_6, source="{A}", target="{1;A}")  # disabled
path_mapper_17 = PathMapper(cir_7, source="{A}", target="{0;A}")  # disabled
path_mapper_18 = PathMapper(ln_10, source="{A}", target="{1;A}")  # disabled
plane_elevations_6 = RemoteReceiver(plane_elevations)
smocrv = SmoothCurve(Curve=intcrv.Curve, Steps=lng_7, StartType=0, EndType=0, DeviationTolerance=Slider(5, range=0..50), AngleTolerance=0.05)
merge_7 = Merge(Data1=flatten(pln_3), Data2=flatten(plane_elevations_6))
ext_5 = ExtendCurve(Curve=geo_18, Type=1, Start=number_slider_7, End=number_slider_7)
relay_3 = Relay([path_mapper_17, path_mapper_16])  # disabled
geo_21 = Geometry(relay_3)  # disabled
relay_4 = Relay([path_mapper_15, path_mapper_18])  # disabled
tstat_4 = TreeStatistics(Tree=geo_21)  # -> Paths, Length, Count; disabled
centrifugal_vector_4 = RemoteReceiver(centrifugal_vector)  # disabled
cull_i_6 = CullIndex(List=merge_7, Indices=-1, Wrap=True)
division_6 = Division(A=tstat_4.Count, B=panel_38)  # disabled
scx_5 = SurfaceCurve(Surface=brep_terrain_base_foundation_3, Curve=relay_3)  # -> Curves, simplify(Points), UVPoints, Normals, Parameters, Tangents; disabled
x_minus_one_2 = XMinusOne(NumberX=division_6)  # disabled
pcx_13 = CurvePlane(Curve=smocrv, Plane=cull_i_6)  # -> simplify(Points), ParamsC, ParamsP
rev_6 = Reverse(Vector=centrifugal_vector_4)  # disabled
item_29 = ListItem(List=tstat_4.Paths, Index=flatten([panel_39, x_minus_one_2]), Wrap=True)  # disabled
shatter_13 = Shatter(Curve=relay_3, Parameters=scx_5.Parameters)  # -> simplify(Segments); disabled
rotate_2 = Rotate(Geometry=rev_6, Angle=rad, Plane=PlaneXY(0, 0, 0))  # -> flatten(Geometry), Transform; disabled
split_11 = SplitTree(Data=geo_21, Masks=flatten(item_29))  # -> Positive, Negative; disabled
colom_7 = CollisionOneMany(Collider=shatter_13, Obstacles=relay_4)  # -> Collision, Index; disabled
crv_cp_7 = CurveClosestPoint(Point=pcx_13.Points, Curve=ext_5)  # -> Point, Parameter, Distance
geo_22 = Geometry(split_11.Positive)  # disabled
dispatch_12 = Dispatch(List=shatter_13, DispatchPattern=colom_7.Collision)  # -> ListA, ListB; disabled
panel_71 = Panel(crv_cp_7.Point)
center_9 = Center(Geometric=geo_22)  # -> Center, Dimension; disabled
cull_i_7 = CullIndex(List=reverse(crv_cp_7.Point), Indices="2", Wrap=False)
darc_5 = DeconstructArc(Arc=geo_22)  # -> BasePlane, Radius, Angle; disabled
split_12 = SplitTree(Data=dispatch_12.ListA, Masks=flatten(item_29))  # -> Positive, Negative; disabled
pshift_3 = ShiftPaths(Data=cull_i_7, Offset=-1)
line_3 = LineSDL(Start=center_9.Center, Direction=rotate_2.Geometry, Length=darc_5.Radius)  # disabled
ccx_7 = CurveCurve(CurveA=geo_22, CurveB=line_3)  # -> Points, ParamsA, ParamsB; disabled
geo_23 = Geometry(split_12.Negative)  # disabled
split_13 = SplitTree(Data=pshift_3, Masks=flatten("{?;0}"))  # -> Positive, Negative
unflatten = UnflattenTree(Tree=pshift_3, Guide=geo_19)
filter_3 = StreamFilter(Gate=0, Stream0=geo_17)
pshift_4 = ShiftPaths(Data=ccx_7.ParamsA, Offset=panel_40)  # disabled
shatter_14 = Shatter(Curve=geo_22, Parameters=pshift_4)  # disabled
panel_72 = Panel(cull_i_7)
pshift_5 = ShiftPaths(Data=shatter_14, Offset=panel_41)  # disabled
item_30 = ListItem(List=pshift_5, Index=0, Wrap=True)  # disabled
pshift_6 = ShiftPaths(Data=[unflatten, filter_3], Offset=-1)
dsp_arch_crest_5 = RemoteReceiver(flatten(dsp_arch_crest))  # disabled
geo_24 = Geometry([split_12.Negative, item_30])  # disabled
item_31 = ListItem(List=pshift_6, Index=0, Wrap=True)
path_mapper_19 = PathMapper(dsp_arch_crest_5, source="{A}", target="{1;A}")  # disabled
path_mapper_20 = PathMapper(geo_24, source="{A;B}", target="{A;B+1}")  # disabled
ptsortitems_2 = PointSortItems(Start=item_31, Points=pshift_6)  # -> SortedItems, SortedIndices, SortedPoints
geo_25 = Geometry([path_mapper_20, path_mapper_2, path_mapper_19])  # disabled
path_mapper_21 = PathMapper(ext_5, source="{A;B}", target="{A}")
intcrv_2 = Interpolate(Vertices=ptsortitems_2.SortedPoints, Degree=Slider(3, range=0..10), Periodic=False, KnotStyle=1)  # -> simplify(Curve), Length, Domain
end_19 = EndPoints(Curve=geo_25)  # -> Start, End; disabled
ccx_8 = CurveCurve(CurveA=path_mapper_21, CurveB=intcrv_2.Curve)  # -> Points, ParamsA, ParamsB
geo_26 = Geometry([end_19.Start, end_19.End])  # disabled
path_mapper_22 = PathMapper(geo_26, source="{A;B}", target="{A}")  # disabled
shatter_15 = Shatter(Curve=ext_5, Parameters=ccx_8.ParamsA)  # -> simplify(Segments)
item_32 = ListItem(List=path_mapper_22, Index=0, Wrap=True)  # disabled
dispatch_13 = Dispatch(List=shatter_15, DispatchPattern=[True, False])  # -> ListA, ListB
geo_27 = Geometry(path_mapper_22)  # disabled
geo_28 = Geometry(dispatch_13.ListB)
tstat_5 = TreeStatistics(Tree=geo_28)  # -> Paths, Length, Count
path_mapper_23 = PathMapper(geo_28, source="{A;B}", target="{A}")  # disabled
ptsortitems_3 = PointSortItems(Start=item_32, Points=geo_27)  # -> SortedItems, SortedIndices, SortedPoints; disabled
lng_8 = ListLength(List=ptsortitems_2.SortedPoints)  # disabled
division_7 = Division(A=tstat_5.Count, B="2")
intcrv_3 = Interpolate(Vertices=ptsortitems_3.SortedPoints, Degree=3, Periodic=False, KnotStyle=1)  # -> Curve, Length, Domain; disabled
lng_9 = ListLength(List=ptsortitems_3.SortedPoints)  # disabled
split_14 = SplitList(List=tstat_5.Paths, Index=division_7)  # -> ListA, ListB
patch = Patch(Curves=[path_mapper_23, intcrv_2.Curve], Spans=lng_8, Flexibility=1, Trim=True)  # disabled
panel_73 = Panel(patch)
item_33 = ListItem(List=split_14.ListA, Index=-1, Wrap=True)
item_34 = ListItem(List=split_14.ListB, Index=-1, Wrap=True)
plane_elevations_7 = RemoteReceiver(plane_elevations)  # disabled
patch_2 = Patch(Curves=patch, Spans=20, Flexibility=1, Trim=True)  # disabled
crv_4 = Curve(patch)  # disabled
intcrv_4 = Interpolate(Vertices=ptsortitems_3.SortedPoints, Degree=3, Periodic=False, KnotStyle=1)  # -> Curve, Length, Domain; disabled
lng_10 = ListLength(List=ptsortitems_3.SortedPoints)  # disabled
cull_i_8 = CullIndex(List=split_14.ListA, Indices=-1, Wrap=True)  # -> flatten(List)
cull_i_9 = CullIndex(List=split_14.ListB, Indices=-1, Wrap=True)  # -> flatten(List)
loft_3 = Loft(Curves=flatten(patch), Options={Adjust=True, Closed=True, LoftEnds=0, LoftSimp=0, LoftType=5, Rebuild=10, Refit=0.01})  # disabled
explode_4 = Explode(Curve=crv_4, Recursive=True)  # -> Segments, Vertices; disabled
loft_4 = Loft(Curves=flatten(patch), Options={Adjust=True, Closed=False, LoftEnds=0, LoftSimp=0, LoftType=5, Rebuild=10, Refit=0.01})  # disabled
smocrv_2 = SmoothCurve(Curve=intcrv_3.Curve, Steps=lng_9, StartType=0, EndType=0, DeviationTolerance=number_slider_13, AngleTolerance=0.05)  # disabled
planar = Planar(Curve=explode_4.Segments)  # -> Planar, Plane, Deviation; disabled
path = DataPath(flatten([cull_i_8, cull_i_9]))
join_9 = BrepJoin(Breps=flatten([patch, loft_4]))  # -> Breps, Closed; disabled
pcx_14 = CurvePlane(Curve=smocrv_2, Plane=flatten(plane_elevations_7))  # -> simplify(Points), ParamsC, ParamsP; disabled
path_mapper_24 = PathMapper([smocrv_2, geo_25], source="{A;B}", target="{A}")  # disabled
path_mapper_25 = PathMapper(pcx_14.Points, source="{A;B}", target="{A}")  # disabled
smocrv_3 = SmoothCurve(Curve=intcrv_4.Curve, Steps=lng_10, StartType=0, EndType=0, DeviationTolerance=number_slider_14, AngleTolerance=0.05)  # disabled
split_15 = SplitTree(Data=geo_28, Masks=flatten(path))  # -> Positive, Negative
split_16 = SplitTree(Data=geo_28, Masks=flatten("{?;0}"))  # -> Positive, Negative
panel_74 = Panel(planar.Planar)  # disabled
viewer = ParamViewer(path_mapper_25)  # disabled
debrep = DeconstructBrep(Brep=loft_4)  # -> Faces, Edges, Vertices; disabled
patch_3 = Patch(Curves=path_mapper_24, Points=path_mapper_25, Spans=lng_9, Flexibility=1, Trim=True)  # disabled
unflatten_2 = UnflattenTree(Tree=split_16.Negative, Guide=split_15.Positive)
evalsrf_6 = EvaluateSurface(Surface=reparameterize(debrep.Faces), Point=panel_42)  # -> Point, Normal, UDirection, VDirection, Frame; disabled
geo_29 = Geometry([split_15.Positive, unflatten_2])
plane_elevations_8 = RemoteReceiver(plane_elevations)  # disabled
path_mapper_26 = PathMapper(unflatten_2, source="{A;B}", target="{A}")
lng_11 = ListLength(List=path_mapper_26)
sec_3 = BrepPlane(Brep=patch_3, Plane=plane_elevations_8)  # -> Curves, Points; disabled
mindex_3 = MemberIndex(Set=evalsrf_6.Normal, Member=vec)  # -> Index, Count; disabled
repeat = RepeatData(Data=intcrv_2.Curve, Length=lng_11)
cull_i_10 = CullIndex(List=debrep.Faces, Indices=mindex_3.Index, Wrap=True)  # disabled
unflatten_3 = UnflattenTree(Tree=repeat, Guide=unflatten_2)
usp_prefootprint_3 = RemoteReceiver(usp_prefootprint)
dsp_prefootprint_3 = RemoteReceiver(dsp_prefootprint)
unflatten_4 = UnflattenTree(Tree=intcrv_2.Curve, Guide=split_15.Negative)
join_10 = BrepJoin(Breps=cull_i_10)  # -> Breps, Closed; disabled
ccx_9 = CurveCurve(CurveA=unflatten_3, CurveB=geo_29)  # -> Points, simplify(ParamsA), ParamsB
crv_5 = Curve(join_10.Breps)  # disabled
patch_4 = Patch(Curves=crv_5, Spans=20, Flexibility=1, Trim=True)  # disabled
geo_30 = Geometry(split_15.Negative)
dam_footprint = Curve([usp_prefootprint_3, dsp_prefootprint_3])
geo_31 = Geometry(unflatten_4)
pshift_7 = ShiftPaths(Data=ccx_9.ParamsA, Offset=-1)
crv_6 = Curve([geo_28, intcrv_2.Curve])
shatter_16 = Shatter(Curve=unflatten_3, Parameters=pshift_7)  # -> simplify(Segments)
lng_12 = ListLength(List=shatter_16)
python_2 = GhPythonScript(x=lng_12, y=shatter_16)  # -> out, a, b
# ---------- python_2: Python ----------
__author__ = "Admin"
__version__ = "2023.08.14"

import rhinoscriptsyntax as rs

if x == 3:
    a = y
elif x == 5:
    b = y
# ---------- end python_2 ----------
geo_32 = Geometry(python_2.b)
clean_3 = CleanTree(RemoveNulls=True, RemoveInvalid=True, RemoveEmpty=False, Tree=python_2.a)
clean_4 = CleanTree(RemoveNulls=True, RemoveInvalid=True, RemoveEmpty=False, Tree=geo_32)
geo_33 = Geometry(clean_3)
ccx_10 = CurveCurve(CurveA=geo_31, CurveB=geo_30)  # -> Points, ParamsA, ParamsB
flip_5 = Flip(Surface=patch_4, Guide=xy_3)  # -> Surface, Result; disabled
dispatch_14 = Dispatch(List=clean_4, DispatchPattern=[True, False])  # -> ListA, ListB
shatter_17 = Shatter(Curve=geo_31, Parameters=ccx_10.ParamsA)
cull_i_11 = CullIndex(List=geo_33, Indices="1", Wrap=True)  # -> simplify(List)
geo_34 = Geometry(dispatch_14.ListB)
offset_l = OffsetSurfaceLoose(Surface=flip_5.Surface, Distance=Z_9, Retrim=True)  # disabled
extr_8 = Extrude(Base=patch_4, Direction=division_2)  # disabled
pshift_8 = ShiftPaths(Data=shatter_17, Offset=-1)
geo_35 = Geometry([geo_29, geo_34, cull_i_11])
move_23 = Move(Geometry=extr_8, Motion=division_2)  # -> Geometry, Transform; disabled
item_35 = ListItem(List=geo_35, Index=0, Wrap=True)  # -> Item, Item1, Item2, Item3
item_36 = ListItem(List=pshift_8, Index="1", Wrap=True)
crv_7 = Curve(offset_l)  # disabled
loft_5 = Loft(
    Curves=[item_36, geo_30],
    Options={Adjust=True, Closed=False, LoftEnds=0, LoftSimp=0, LoftType=5, Rebuild=10, Refit=0.01})
netsurf_2 = NetworkSurface(CurvesU=[item_35.Item, item_35.Item1], CurvesV=[item_35.Item2, item_35.Item3], Continuity=3)
offset_l_2 = OffsetSurfaceLoose(Surface=flip_5.Surface, Distance=division_2, Retrim=True)  # disabled
geo_36 = Geometry(flatten([crv_6, join_9.Breps]))
sporph_2 = Sporph(G=move_23.Geometry, R=False)  # disabled
path_mapper_27 = PathMapper([loft_5, netsurf_2], source="{A;B}", target="{A}")
join_11 = BrepJoin(Breps=flatten(path_mapper_27))  # -> Breps, Closed
loft_6 = Loft(
    Curves=flatten(split_16.Positive),
    Options={Adjust=True, Closed=False, LoftEnds=0, LoftSimp=2, LoftType=0, Rebuild=10, Refit=0.01})  # disabled
loft_7 = Loft(
    Curves=flatten(intcrv_2.Curve),
    Options={Adjust=True, Closed=False, LoftEnds=0, LoftSimp=2, LoftType=5, Rebuild=10, Refit=0.01})  # disabled
offcrv_2 = OffsetCurve(Curve=crv_7, Plane=PlaneXY(0, 0, 0), Distance=neg_5, BothSides=0, Kinks=0, CapType=1)  # disabled
crv_8 = Curve(offset_l_2)  # disabled
item_37 = ListItem(List=join_11.Breps, Index=0, Wrap=True)  # -> Item, Item1
previewlw_5 = CustomPreviewLineweights(Geometry=crv_6, Shader=swatch_2, Thickness=number_slider_18, Absolute=False)  # disabled
previewlw_6 = CustomPreviewLineweights(Geometry=crv_6, Shader=swatch_2, Thickness=number_slider_18, Absolute=False)  # disabled
cad_out = ExportCAD(Geometries=geo_36, DirectoryPath="C:\Users\Admin\Downloads", FileName="Test", Extension=0, Save=Button())
loft_8 = Loft(Curves=offcrv_2, Options={Adjust=False, Closed=False, LoftEnds=0, LoftSimp=0, LoftType=0, Rebuild=10, Refit=0.01})  # disabled
join_12 = BrepJoin(Breps=flatten([path_mapper_27, loft_7, loft_6]))  # -> Breps, Closed
loft_9 = Loft(
    Curves=flatten([item_37.Item, item_37.Item1]),
    Options={Adjust=True, Closed=False, LoftEnds=0, LoftSimp=0, LoftType=5, Rebuild=10, Refit=0.01})
join_13 = BrepJoin(Breps=flatten([join_11.Breps, loft_9]))  # -> Breps, Closed
# must be a closed volume!
psrfclsd = IsPolysurfaceClosed(Polysurface=join_13.Breps)
panel_75 = Panel(psrfclsd)
wires = BrepWireframe(Brep=join_13.Breps, Density=-1)
join_14 = BrepJoin(Breps=flatten([join_12.Breps, loft_7, loft_6]))  # -> Breps, Closed; disabled
sunion_2 = SolidUnion(Breps=join_12.Breps)  # -> flatten(Result); disabled
join_15 = BrepJoin(Breps=flatten([sunion_2, loft_7]))  # -> Breps, Closed; disabled
capex = CapHolesEx(Brep=join_15.Breps)  # -> Brep, Caps, Solid; disabled
bvol_2 = BoundaryVolume(Boundaries=[join_15.Breps, loft_6])  # disabled
sunion_3 = SolidUnion(Breps=[capex.Brep, loft_6])  # disabled
join_16 = BrepJoin(Breps=flatten([loft_6, capex.Brep]))  # -> Breps, Closed; disabled
previewlw_7 = CustomPreviewLineweights(Geometry=wires, Shader=swatch_3, Thickness=number_slider_19, Absolute=False)
previewlw_8 = CustomPreviewLineweights(Geometry=wires, Shader=swatch_3, Thickness=number_slider_19, Absolute=False)
geo_archdam = RemoteSender(join_13.Breps)
geo_archdam_2 = RemoteReceiver(geo_archdam)
filter_4 = StreamFilter(Gate=dam_type_3, Stream0=geo_concretedam_2, Stream1=geo_archdam_2)
dam_8 = DataDam(DataA=join_2.Breps, DataB=filter_4, BufferDelay=10000000, BufferMode=0)  # -> DataA, DataB
brep_4 = Brep(dam_8.DataA)
brep_5 = Brep(dam_8.DataB)
c_script_5 = CSharpScript(bListFrom=brep_4, flip=toggle_5, bListTo=brep_5)  # -> out, solidDifferenceBrepList; inputs bListFrom: list of Brep, flip: Boolean, bListTo: list of Brep
# ---------- c_script_5: C# ----------
    bListFrom = bListFrom.Where(x => x != null && x.IsValid && x.IsSolid).ToList();
    if(!bListFrom.Any()) return;

    bListTo = bListTo.Where(x => x != null && x.IsValid && x.IsSolid).ToList();
    if(!bListTo.Any()) return;
    double tol = RhinoDoc.ActiveDoc.ModelAbsoluteTolerance;

    List<Brep> bDiffList = new List<Brep>();
    Print(" ");
    Print("Working: {0} From against: {1} To breps", bListFrom.Count, bListTo.Count);
    Print(" ");

    for(int j = 0; j < bListFrom.Count;j++){
      Brep brep = bListFrom[j];
      if(flip)brep.Flip();
      for(int i = 0; i < bListTo.Count;i++){
        Brep b = bListTo[i];
        try{
          brep = Brep.CreateBooleanDifference(brep, b, tol)[0];
          Print("Diff at: {0}, {1} is OK", j, i);
        }
        catch{Print("Diff at: {0}, {1} failed (or breps are apart)", j, i);}
      }
      bDiffList.Add(brep);
    }
    solidDifferenceBrepList = bDiffList;

    Print(" ");
    for(int i = 0; i < bDiffList.Count;i++){
      Brep b = bDiffList[i];
      Print("Result at: {0} has: {1} faces", i, b.Faces.Count);
    }
# ---------- end c_script_5 ----------
geo_archdam_3 = RemoteReceiver(geo_archdam)
volume = Volume(Geometry=c_script_5.solidDifferenceBrepList)  # -> Volume, Centroid; disabled
nullrep = ReplaceNulls(Items=volume.Volume, Replacements=0)  # -> Items, Count; disabled
ma = MassAddition(Input=flatten(nullrep.Items))  # -> Result, PartialResults; disabled

# ---- group: VIZ
geo_37 = Geometry(c_script_5.solidDifferenceBrepList)
preview_2 = CustomPreview(Geometry=geo_37, Material=ColourSwatch(SwatchColor=RGBA(196, 213, 255, 194)))

# ----
panel_76 = Panel(ma.Result)  # disabled

filter_5 = StreamFilter(Gate=dam_type_5, Stream0=geo_concretedam_3, Stream1=geo_archdam_3)
volume_2 = Volume(Geometry=filter_5, UseTasks=False)  # -> Volume, Centroid; disabled
round_3 = Round(Number=volume_2.Centroid)  # -> Nearest, Floor, Ceiling; disabled
dam_volume_top = RemoteSender(round_3.Nearest)  # disabled
preview_3 = CustomPreview(Geometry=filter_5, Material=ColourSwatch(SwatchColor=RGB(115, 109, 209)))  # disabled

dam_volume_top_2 = RemoteReceiver(dam_volume_top)
preview_4 = CustomPreview(Geometry=filter_5, Material=ColourSwatch(SwatchColor=RGB(115, 109, 209)))  # disabled

# ---- group: results / data in right formatting
num_5 = Number(panel_76)  # disabled
division_8 = Division(A=num_5, B=1000000)  # disabled
roundd = RoundToDecimalPlace(NumberX=division_8, DecimalPlace=1, RoundType=0)  # -> Rounded, Difference; disabled

# ----
volume_3 = Volume(Geometry=join_12.Breps)  # -> Volume, Centroid
format = Format(Format="{0}", Culture=127, Data0=volume_3.Volume)
arch_dam_height_4 = RemoteReceiver(arch_dam_height)
panel_77 = Panel(format)
format_2 = Format(
    Format=panel_50,
    Culture=127,
    Data0=water_level_4,
    Data1=dam_level_3,
    Data2=pdecon_7.ZComponent,
    Data3=arch_dam_height_4,
    Data4=len,
    Data6=len_2,
    Data7=volume_3.Volume)
panel_78 = Panel(format_2)
geo_archdam_4 = RemoteReceiver(geo_archdam)

# ---- group: Foundation
# 6. Excavation
# E. Goulas: A reasonable value for the excavation can be from 10 to 30 meters (good rock conditions with minor weathering and a canyon profile ideally suited to an arch dam) in the lateral direction
# Technical Memorandum No. EM36-86-68110: Determine the base elevation of the dam. This location is to sound rock and, if that distance is unknown, can be assumed to be about 25 feet below lowest contour in
# the river bed
panel_79 = Panel("25")
expression_12 = Expression(ft=panel_79, Expression="ft*0.3048")
offset_foundation_6 = RemoteReceiver(offset_foundation)
brep_terrain_4 = RemoteReceiver(brep_terrain)
panel_80 = Panel(expression_12)
bbx_3 = BrepBrep(BrepA=geo_archdam_4, BrepB=brep_terrain_4)  # -> Curves, Points
division_9 = Division(A=offset_foundation_6, B=Slider(2, range=0..10))
neg_13 = Negative(Value=division_9)
offcrv_3 = OffsetCurve(Curve=bbx_3.Curves, Plane=PlaneXY(0, 0, 0), Distance=neg_13, BothSides=0, Kinks=0, CapType=1)
patch_5 = Patch(Curves=offcrv_3, Spans=20, Flexibility=1, Trim=True)
neg_14 = Negative(Value=offset_foundation_6)
Z_15 = UnitZ(Factor=neg_14)
extr_9 = Extrude(Base=patch_5, Direction=Z_15)
base_archdam = Geometry(extr_9)

# ----
division_10 = Division(A=offset_foundation_6, B=number_slider_16)  # disabled
# Excavation
geo_archdam_excavation = RemoteSender(base_archdam)  # disabled

geo_archdam_excavation_2 = RemoteReceiver(geo_archdam_excavation)  # disabled
filter_6 = StreamFilter(Gate=dam_type_5, Stream0=geo_concretedam_excavation, Stream1=geo_archdam_excavation_2)  # disabled
volume_4 = Volume(Geometry=filter_6, UseTasks=False)  # -> Volume, Centroid; disabled
round_4 = Round(Number=volume_4.Volume)  # -> Nearest, Floor, Ceiling; disabled
preview_5 = CustomPreview(Geometry=filter_6, Material=swatch_7)  # disabled
dam_volume_base = RemoteSender(round_4.Nearest)  # disabled

dam_volume_base_2 = RemoteReceiver(dam_volume_base)
merge_8 = Merge(Data1=flatten(dam_volume_base_2), Data2=flatten(dam_volume_top_2), Data3=flatten("0"), Data4=flatten("0"))
multiplication_4 = Multiplication(A=merge_8, B=merge_6)
entwine = Entwine(Branch00=panel_36, Branch01=merge_8, Branch02=merge_6, Branch03=multiplication_4, FlattenInputs=True)
data_series = UIDataSeries(Label=graft(panel_35), Data=entwine, Type=5)  # -> flatten(DataSeries)
grid_chart_2 = UiGridChart(Element=grid_chart, DataSeries=data_series, Titles=True)
addition_7 = Addition(A=volume_2.Volume, B=volume_4.Volume)  # disabled
dam_volume = RemoteSender(addition_7)  # disabled
dam_volume_2 = RemoteReceiver(dam_volume)  # disabled

# ---- group: results / data in right formatting
num_6 = Number(dam_volume_2)  # disabled
division_11 = Division(A=num_6, B=1000000)  # disabled
roundd_2 = RoundToDecimalPlace(NumberX=division_11, DecimalPlace=1, RoundType=0)  # -> Rounded, Difference; disabled

# ----
number_slider_31 = Slider(5000, range=0..10000)
dam_axes_all_2 = RemoteReceiver(dam_axes_all)
# Visualization top
dam_axis_5 = RemoteReceiver(dam_axis)
Z_16 = UnitZ(Factor=number_slider_31)
move_24 = Move(Geometry=dam_axes_all_2, Motion=Z_16)  # -> Geometry, Transform
previewlw_9 = CustomPreviewLineweights(
    Geometry=move_24.Geometry,
    Shader=ColourSwatch(SwatchColor=RGB(60, 76, 222)),
    Thickness=Slider(4, range=0..10),
    Absolute=False)

# ----
# See upstream point
vector_waterflow_6 = RemoteReceiver(vector_waterflow)  # disabled
point_upstream_5 = RemoteReceiver(point_upstream)  # disabled
objfromgroup_7 = GetObjectsInGroup()  # disabled
move_25 = Move(Geometry=point_upstream_5, Motion=Z_16)  # -> Geometry, Transform; disabled
swatch_8 = ColourSwatch(SwatchColor=RGB(68, 57, 102))  # disabled
number_slider_32 = Slider(3, range=0..10)  # disabled
move_26 = Move(Geometry=point_upstream_5, Motion=Z_16)  # -> Geometry, Transform; disabled
number_slider_33 = Slider(227.5, range=0..1000)  # disabled
panel_81 = Panel("Upstream")  # disabled
vdisex_9 = VectorDisplayEx(Point=move_26.Geometry, Vector=vector_waterflow_6, Colour=swatch_8, Width=number_slider_32)  # disabled
tag = TextTag3D(Location=move_25.Geometry, Text=panel_81, Size=number_slider_33, Colour=swatch_8, Justification=7)  # disabled

addition_8 = Addition(A=number_slider_31, B=1)
Z_17 = UnitZ(Factor=addition_8)

move_27 = Move(Geometry=dam_axis_5, Motion=Z_17)  # -> Geometry, Transform
previewlw_10 = CustomPreviewLineweights(
    Geometry=move_27.Geometry,
    Shader=ColourSwatch(SwatchColor=RGB(29, 191, 161)),
    Thickness=Slider(4, range=0..10),
    Absolute=False)

onoff_4 = EnableDisableObject(Objects=objfromgroup_7, Enabled=viz_direction_river_2)  # disabled

python_3 = GhPythonScript(river_discharge=num_4, eco_discharge=num_3, design_discharge=num_2)  # -> out, a; inputs river_discharge: list; disabled
# ---------- python_3: Python ----------
__author__ = "Kona"
__version__ = "2022.03.25"

import rhinoscriptsyntax as rs

e = eco_discharge
a1 = []

for i in range (len(river_discharge)):
    print i
    if float(river_discharge[i]) > e:
        print river_discharge[i],e,True
        result = float(river_discharge[i]) - e
        a1.append(result)
    else:
        a1.append("0")

d = design_discharge
a = []

for i in range (len(a1)):
    if float(a1[i]) > d:
        result = d
        a.append(result)
    else:
        a.append(a1[i])
# ---------- end python_3 ----------
discharge_used_m3_s = Panel(python_3.a)  # disabled
i_energy_dt_2 = RemoteReceiver(i_energy_dt)  # disabled

# ----
# ENERGY CALCULATION
pdecon_10 = Deconstruct(Point=pt_3)  # -> XComponent, YComponent, flatten(ZComponent); disabled
pdecon_11 = Deconstruct(Point=pt_5)  # -> XComponent, YComponent, flatten(ZComponent); disabled
round_5 = Round(Number=pdecon_10.ZComponent)  # -> Nearest, Floor, Ceiling; disabled
subtraction_4 = Subtraction(A=pdecon_10.ZComponent, B=freeboard_3)  # disabled
round_6 = Round(Number=pdecon_11.ZComponent)  # -> Nearest, Floor, Ceiling; disabled
ph_elevation = RemoteSender(round_6.Nearest)  # disabled
crest_elevation = RemoteSender(round_5.Nearest)  # disabled
panel_82 = Panel("1")  # disabled

upstream_waterlevel = Panel(subtraction_4)  # disabled
downstream_waterlevel = Panel(pdecon_11.ZComponent)  # disabled

B = B(100)  # disabled

division_12 = Division(A=i_energy_head_losses_2, B=B)  # disabled
subtraction_5 = Subtraction(A=upstream_waterlevel, B=downstream_waterlevel)  # disabled
subtraction_6 = Subtraction(A=panel_82, B=division_12)  # disabled
multiplication_5 = Multiplication(
    LevelDifference=subtraction_5,
    _1HeadLosses=subtraction_6,
    DesignDischarge=i_energy_design_discharge_2,
    GConstant=g_constant,
    PlantEfficiency=division)  # disabled
roundd_3 = RoundToDecimalPlace(NumberX=multiplication_5, DecimalPlace=1, RoundType=0)  # -> Rounded, Difference; disabled
installed_capacity_mw = Panel(roundd_3.Rounded)  # disabled

# ---- group: results / data in right formatting
num_7 = Number(installed_capacity_mw)  # disabled
roundf = RoundToFactor(NumberX=num_7, Factor=1, RoundType=0)  # -> Rounded, Difference, MultiplierR, MultiplierX; disabled

# ----
gross_head_m = Panel(subtraction_5)  # disabled
multiplication_6 = Multiplication(A=gross_head_m, B=subtraction_6)  # disabled
net_head_m = Panel(multiplication_6)  # disabled

multiplication_7 = Multiplication(DischargeUsed=discharge_used_m3_s, GConstant=g_constant, PlantEfficiency=division, NetHead=net_head_m)  # disabled
generated_power_mw = Panel(multiplication_7)  # disabled
multiplication_8 = Multiplication(A=generated_power_mw, B=i_energy_dt_2)  # disabled
division_13 = Division(A=multiplication_8, B=1000)  # -> flatten(Result); disabled
energy_production_gwh = Panel(division_13)  # disabled
ma_2 = MassAddition(Input=energy_production_gwh)  # -> Result, PartialResults; disabled
roundd_4 = RoundToDecimalPlace(NumberX=ma_2.Result, DecimalPlace=1, RoundType=0)  # -> Rounded, Difference; disabled
energy_production_gwh_2 = Panel(roundd_4.Rounded)  # disabled

python_4 = GhPythonScript(x=energy_production_gwh_2, y=installed_capacity_mw)  # -> out, a; disabled
# ---------- python_4: Python ----------
__author__ = "Kona"
__version__ = "2022.03.25"

import rhinoscriptsyntax as rs

a = round(((x*1000)/y/8760*100),1)
# ---------- end python_4 ----------
plant_factor = Panel(python_4.a)  # disabled

# ---- group: results / data in right formatting
num_8 = Number(energy_production_gwh_2)  # disabled
roundf_2 = RoundToFactor(NumberX=num_8, Factor=1, RoundType=0)  # -> Rounded, Difference, MultiplierR, MultiplierX; disabled

roundf_3 = RoundToFactor(NumberX=dist_3, Factor=100, RoundType=0)  # -> Rounded, Difference, MultiplierR, MultiplierX; disabled
round_7 = Round(Number=net_head_m)  # -> Nearest, Floor, Ceiling; disabled

len_9 = Length(Curve=chord_dam_8)  # disabled
num_9 = Number(len_9)  # disabled
roundf_4 = RoundToFactor(NumberX=num_9, Factor=10, RoundType=0)  # -> Rounded, Difference, MultiplierR, MultiplierX; disabled
crest_elevation_2 = RemoteReceiver(crest_elevation)  # disabled
panel_83 = Panel("1:")  # disabled
ph_elevation_2 = RemoteReceiver(ph_elevation)  # disabled
concat = Concatenate(FragmentA=panel_83, FragmentB=downstream_face_angle_ratio_1)  # disabled
dam_level_5 = RemoteReceiver(dam_level)  # disabled
width_crest_3 = RemoteReceiver(width_crest)  # disabled
freeboard_4 = RemoteReceiver(freeboard)  # disabled
panel_84 = Panel(concat)  # disabled
num_10 = Number(plant_factor)  # disabled
merge_9 = Merge(
    Data1=dam_level_5,
    Data2=freeboard_4,
    Data3=offset_foundation_3,
    Data4=width_crest_3,
    Data5=flatten(roundf_4.Rounded),
    Data6=panel_84,
    Data7=i_energy_head_losses_2,
    Data8=i_energy_design_discharge_2,
    Data9=i_energy_ecological_discharge_2,
    Data10=flatten(i_energy_powerplant_efficiency_2),
    Data11=flatten(roundf_3.Rounded),
    Data12=flatten(roundd.Rounded),
    Data13=flatten(roundd_2.Rounded),
    Data14=flatten(round_7.Nearest),
    Data15=flatten(crest_elevation_2),
    Data16=flatten(ph_elevation_2),
    Data17=flatten(roundf.Rounded),
    Data18=flatten(roundf_2.Rounded),
    Data19=flatten(num_10))  # -> graft(Result); disabled

# ---- group: results / conduit
panel_85 = Panel("""Dam height = {1} m
Freeboard = {2}  m
Depth of foundation = {3} m
Crest width = {4} m
Crest length = {5} m
Downstream face slope = {6}
Head losses = {7} %
Design discharge = {8} m3/s
Ecological discharge = {9} m3/s
Plant efficiency = {10} %
Distance to the power house = {11} m
Volume water = {12} Mio m3
Volume dam = {13} Mio m3
Hn = {14} m
Crest elevation = {15} m asl
Power house elevation = {16} m asl
Installed capacity = {17} MW
Yearly production = {18} GWh
Plant Factor = {19} %""")  # disabled
button_4 = Button()  # disabled
number_slider_34 = Slider(3, range=0..10)  # disabled
bounds = GetViewportBoundaryDimensions(Refresh=button_4, Origin=lowest_point_dam_section_3, Scale=0.25, xDim=1019, yDim=761)  # disabled
grid_tiles = GridTiles(Boundary=bounds, Columns=5, Rows=number_slider_34, InteriorPadding=0.02, ExteriorPadding=0.02, PaddingAxis=0)  # disabled
format_3 = Format(
    Format=panel_85,
    Culture=127,
    Data0=roundf_4.Rounded,
    Data1=dam_level_5,
    Data2=freeboard_4,
    Data3=offset_foundation_3,
    Data4=width_crest_3,
    Data5=roundf_4.Rounded,
    Data6=panel_84,
    Data7=i_energy_head_losses_2,
    Data8=i_energy_design_discharge_2,
    Data9=i_energy_ecological_discharge_2,
    Data10=i_energy_powerplant_efficiency_2,
    Data11=roundf_3.Rounded,
    Data12=roundd.Rounded,
    Data13=roundd_2.Rounded,
    Data14=round_7.Nearest,
    Data15=crest_elevation_2,
    Data16=ph_elevation_2,
    Data17=roundf.Rounded,
    Data18=roundf_2.Rounded,
    Data19=num_10)  # disabled
number_slider_35 = Slider(14, range=0..100)  # disabled
number_slider_36 = Slider(100, range=0..100)  # disabled
item_38 = ListItem(List=grid_tiles, Index=0, Wrap=True)  # disabled
Y = UnitY(Factor=number_slider_36)  # disabled
panel_86 = Panel(",")  # disabled
font = ConduitFont(
    Font="Arial",
    TextHeight=number_slider_35,
    AdaptiveHeight=False,
    TextSpacing=1.15,
    Alignment=0,
    Bold=False,
    Italic=False,
    Color=RGB(0, 0, 0))  # disabled
panel_87 = Panel("'")  # disabled
move_28 = Move(Geometry=item_38, Motion=Y)  # -> Geometry, Transform; disabled
rep = ReplaceText(Text=format_3, Find=panel_86, Replace=panel_87, RecursiveReplace=False)  # disabled
hud_text = DrawText(Boundary=move_28.Geometry, Text=rep, TextOrdering=1, TextDistribution=0, OrientVertically=False, CustomFont=font)  # disabled
toggle_7 = BooleanToggle(False)  # disabled
hud = HeadsUpDisplayHUD(
    ShowHUD=toggle_7,
    DrawingObjects=hud_text,
    DrawingBoundary=bounds,
    ConduitStyleSheet="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")  # disabled

# ----
panel_88 = Panel("0.5,0.5")  # disabled
evalsrf_7 = EvaluateSurface(Surface=reparameterize(extr_2), Point=panel_88)  # -> Point, Normal, UDirection, VDirection, Frame; disabled
vector_waterflow_7 = RemoteReceiver(vector_waterflow)  # disabled
dprod_2 = DotProduct(VectorA=evalsrf_7.Normal, VectorB=vector_waterflow_7, Unitize=False)  # disabled
panel_89 = Panel("0")  # disabled
larger = LargerThan(FirstNumber=dprod_2, SecondNumber=panel_89)  # -> LargerThan, OrEqualTo; disabled

smaller_2 = SmallerThan(FirstNumber=dprod_2, SecondNumber=panel_89)  # -> SmallerThan, OrEqualTo; disabled

gate_5 = StreamGate(Stream=extr_2, Gate=smaller_2.SmallerThan)  # -> Target0, Target1; disabled
flip_6 = Flip(Surface=gate_5.Target1)  # -> Surface, Result; disabled
filter_7 = StreamFilter(Gate=smaller_2.SmallerThan, Stream0=gate_5.Target0, Stream1=flip_6.Surface)  # disabled

c_script_6 = CSharpScript(polyList=filter_7)  # -> out, planeList; inputs polyList: list of Polyline; disabled; same code as c_script_2
pln_4 = Plane(c_script_6.planeList)  # disabled

# ---- group: results
panel_90 = Panel("""Dam height [m]
Freeboard [m]
Depth of foundation [m]
Crest width [m]
Crest length [m]
Downstream face slope [-]
Head losses [%]
Design discharge [m3/s]
Ecological discharge [m3/s]
Plant efficiency [%]
Distance to the power house [m]
Volume water [Mio m3]
Volume dam [Mio m3]
Hn [m] 
Crest elevation [m asl]
Power house elevation [m asl]
Installed capacity [MW]
Yearly production [GWh]
Plant Factor [%]""")  # disabled
panel_91 = Panel(merge_9)  # disabled
toggle_8 = BooleanToggle(False)  # disabled

# ---- group: results / variants / chooses correct variables
index = Panel("""0
4
14
11
12
10
13
16
17
18""")  # disabled
data_3 = Data(flatten(panel_91))  # disabled
item_39 = ListItem(List=data_3, Index=index, Wrap=True)  # disabled

# ----
lng_13 = ListLength(List=index)  # disabled
series = Series(Start=0, Step=1, Count=lng_13)  # disabled
null_2 = NullPlaceholder()  # disabled
ins = InsertItems(List=null_2, Item=null_2, Indices=series, Wrap=True)  # -> simplify(List); disabled

# ---- group: results / variants
data_4 = Data(panel_90)  # disabled
item_40 = ListItem(List=data_4, Index=index, Wrap=True)  # disabled
panel_92 = Panel("VARIANT ")  # disabled

# ---- group: results / variants / heading
merge_10 = Merge(Data1=panel_92, Data2=item_40)  # -> flatten(Result); disabled

# ---- group: results / INPUT_values
index_2 = Panel("""1
2
3
5
6
7
8
9
15""")  # disabled
data_5 = Data(flatten(panel_91))  # disabled
data_6 = Data(panel_90)  # disabled
item_41 = ListItem(List=data_6, Index=index_2, Wrap=True)  # disabled
item_42 = ListItem(List=data_5, Index=index_2, Wrap=True)  # -> graft(Item); disabled
headings = Panel(item_41)  # disabled
panel_93 = Panel("INPUT_values")  # disabled
toggle_9 = BooleanToggle(False)  # disabled

# ---- group: results / variants
panel_94 = Panel("V ")  # disabled
concat_2 = Concatenate(FragmentA=panel_94, FragmentB=list_9)  # disabled
merge_11 = Merge(Data1=concat_2, Data2=item_39)  # -> flatten(Result); disabled
panel_95 = Panel("RESULTS")  # disabled
toggle_10 = BooleanToggle(False)  # disabled
panel_96 = Panel("1")  # disabled

# ----
merge_12 = Merge(Data1=concat_2, Data2=item_39)  # -> flatten(Result); disabled
merge_13 = Merge(Data1=concat_2, Data2=item_39)  # -> flatten(Result); disabled
merge_14 = Merge(Data1=concat_2, Data2=item_39)  # -> flatten(Result); disabled
merge_15 = Merge(Data1=concat_2, Data2=item_39)  # -> flatten(Result); disabled
filter_8 = StreamFilter(Gate=equals_2.Equality, Stream1=merge_11)  # disabled
filter_9 = StreamFilter(Gate=equals_5.Equality, Stream1=merge_12)  # disabled
filter_10 = StreamFilter(Gate=equals_6.Equality, Stream1=merge_13)  # disabled
filter_11 = StreamFilter(Gate=equals_3.Equality, Stream1=merge_14)  # disabled
filter_12 = StreamFilter(Gate=equals_4.Equality, Stream1=merge_15)  # disabled

# ---- group: results / variants / allows to compare up to 5 Variants
entwine_2 = Entwine(
    Branch00=merge_10,
    Branch01=filter_8,
    Branch02=filter_9,
    Branch03=filter_10,
    Branch04=filter_11,
    Branch05=filter_12,
    FlattenInputs=True)  # disabled

# ---- group: results / INPUT_tabelle
headers = Panel("""Month
Discharge in the river [m3/s]
Delta T [h] """)  # disabled
panel_97 = Panel("""Jan
Feb
Mär
Apr
Mai
Jun
Jul
Aug
Sep
Okt
Nov
Dez""")  # disabled
i_energy_dir_3 = RemoteReceiver(i_energy_dir)  # disabled
i_energy_dt_3 = RemoteReceiver(i_energy_dt)  # disabled
entwine_3 = Entwine(Branch00=panel_97, Branch01=i_energy_dir_3, Branch02=i_energy_dt_3, FlattenInputs=True)  # -> simplify(Result); disabled
toggle_11 = BooleanToggle(False)  # disabled
path_2 = FilePath("C:\Users\KONA\Desktop\dam_input_values.xlsx")  # disabled
panel_98 = Panel("INPUT_tabelle")  # disabled

# ---- group: results / INPUT_values (continued)
excelwrite = ExcelWrite(
    WriteExcelData=toggle_9,
    WorkbookPath=path_2,
    WorksheetName=panel_93,
    ColumnHeadings=headings,
    Data=item_42,
    ClearSheet=toggle_8)  # disabled
panel_99 = Panel(excelwrite)  # disabled

# ---- group: results (continued)
excelwrite_2 = ExcelWrite(
    WriteExcelData=toggle_11,
    WorkbookPath=path_2,
    WorksheetName=panel_98,
    ColumnHeadings=headers,
    Data=entwine_3,
    ClearSheet=toggle_8)  # disabled

# ---- group: results / INPUT_tabelle (continued)
panel_100 = Panel(excelwrite_2)  # disabled

# ---- group: results / variants (continued)
insert_data = GhPythonScript(
    run=toggle_10,
    xlsx_filepath=path_2,
    xlsx_worksheet=panel_95,
    data=entwine_2,
    rel_position_x=panel_96,
    rel_position_y=panel_96,
    variant_position=list_9)  # -> out, a; inputs run: Boolean, data: tree, rel_position_x: Int32, rel_position_y: Int32; disabled
# ---------- insert_data: Python ----------
__author__ = "KONA"
__version__ = "2022.04.14"

import rhinoscriptsyntax as rs
import scriptcontext as sc
import string
import ghpythonlib.treehelpers as th

a = th.tree_to_list(data)

openpyxl = sc.sticky['openpyxl']
PIL = sc.sticky['PIL']

if _run == True:
    #load workbook and worksheet
    workbook = openpyxl.load_workbook(filename=xlsx_filepath, read_only=False)
    worksheet = workbook[xlsx_worksheet]
    
    #write Data to column (at defined position)
    for list_count, list in enumerate(a):
        for count, data_item in enumerate(list):
            print list_count
            print count
            print data_item
            cellref = worksheet.cell(row = rel_position_y + list_count,column = rel_position_x + count)
            print (cellref)
            cellref.value = data_item
        list_count += variant_position
        
        workbook.save(xlsx_filepath)
    else:
        pass
# ---------- end insert_data ----------
panel_101 = Panel(insert_data.a)  # disabled

# ==== cluster GHPythonRemote: Connects the Grasshopper Python component to an external Python instance.
python = PythonScript()  # -> gh_parent_doc_dir
# ---------- python: Python ----------
from os import path

gh_parent_doc_dir = path.abspath(path.dirname(ghenv.Component.OnPingDocument().Owner.OnPingDocument().FilePath))
# ---------- end python ----------
# GH to python remote example.
# Pierre Cuvilliers, 2017-2018
# Released under the MIT license
# github.com/pilcru/ghpythonremote
# Runs and connects to an external python engine, and
# assigns imported modules to scriptcontext.sticky variables.
# 
# Arguments:
#       code (str): Path to the GH_to_python_sticky.py code file.
#       location (str): Path to a python executable, or to a folder
#             containing `python.exe`, or the name of a conda-created
#             virtual environment prefixed by `conda://` (`conda://env_name`).
#             If empty, finds python from your windows %PATH%.
#       run (boolean): Creates the connection, and imports new
#             modules, when turned to True. Kills the connection,
#             and deletes the references to the imports, when turned
#             to False.
#       modules (str list): List of module names to import in the
#             remote python. They will be added to the
#             scriptcontext.sticky dictionary, allowing them to be
#             reused from other python components in the same
#             Grasshopper document. Submodules (for example
#             `numpy.linalg` have to be added explicitly to this list
#             to be available later.
#       log_level (str from ['NOTSET', 'DEBUG', 'INFO', 'WARNING', 'ERROR', 'CRITICAL']):
#             Logging level to use for the local IronPython and the
#             remote python instance.
#       working_dir (str): Working directory for the remote python
#             instance.
# 
# Returns:
#       out (str): Console output with DEBUG information.
#       linked_modules (str list): list of imported module names.
#       rpy (rpyc connection object): The object representing the
#             remote Python interpreter.
location = ClusterInput()  # location (str): Path to a python executable, or to a folder containing `python.exe`, or the name of a conda-created virtual environment prefixed by `conda://` (`conda://env_name`). If empty, finds python from your windows %PATH%.
run = ClusterInput()  # run (boolean): Creates the connection, and imports new modules, when turned to True. Kills the connection,and deletes the references to the imports, when turned to False.
modules = ClusterInput()  # modules (str list): List of module names to import in the remote python. They will be added to the scriptcontext.sticky dictionary, allowing them to be reused from other python components in the same Grasshopper document. Submodules (for example `numpy.linalg` have to be added explicitly to this list to be available later.
list = ValueList({"CRITICAL", "ERROR", "WARNING", "INFO", "DEBUG", "NOTSET"}, selected="DEBUG")
panel = Panel(python)
ghpythonremote = GHPythonRemote(location=location, run=run, modules=modules, log_level=list, working_dir=panel)  # -> out, linked_modules, rpy; inputs run: Boolean, modules: list
# ---------- ghpythonremote: Python ----------
import inspect
import logging
from os import path
import sys
from time import sleep

import scriptcontext

import ghpythonremote
from ghpythonremote.connectors import GrasshopperToPythonRemote

local_log_level = getattr(logging, log_level, logging.WARNING)
logger = logging.getLogger("ghpythonremote")
logger.setLevel(local_log_level)
ch = logging.StreamHandler()
ch.setLevel(local_log_level)
formatter = logging.Formatter("%(levelname)s: %(name)s:\n%(message)s")
ch.setFormatter(formatter)
logger.handlers = []
logger.addHandler(ch)
logger = logging.getLogger("ghpythonremote.GH_to_python")

ROOT = path.abspath(path.dirname(inspect.getfile(ghpythonremote)))
rpyc_server_py = path.join(ROOT, "pythonservice.py")

# Set connection to CLOSED if this is the first run
# and initialize set of linked modules
try:
    remote_python_status
except NameError:
    remote_python_status = "CLOSED"
    lkd_modules = set()

# Wait for connection to connect or terminate
timer = 0
while remote_python_status == "CONNECTING" or remote_python_status == "CLOSING":
    sleep(1)
    timer += 1
    if timer == 10:
        try:
            gh2py_manager.__exit__(*sys.exc_info())
        except Exception:
            pass
        remote_python_status = "CLOSED"
        lkd_modules = set()
        raise RuntimeError(
            "Connection left in an inconsistent state and not returning. Reset "
            "everything."
        )

if run:
    if not remote_python_status == "OPEN":
        remote_python_status = "CONNECTING"
        gh2py_manager = GrasshopperToPythonRemote(
            rpyc_server_py,
            location=location,
            timeout=10,
            port=None,
            log_level=log_level,
            working_dir=working_dir,
        )
        gh2py = gh2py_manager.__enter__()
        remote_python_status = "OPEN"

    # Stuff that we can reach
    rpymod = gh2py.py_remote_modules  # A getter function for a named python module
    rpy = gh2py.connection  # Represents the remote instance root object
    scriptcontext.sticky["rpy"] = rpy
    # Add modules
    for mod in modules:
        try:
            scriptcontext.sticky[mod] = rpymod(mod)
            lkd_modules.add(mod)
        except ImportError:
            gh2py_manager.__exit__(*sys.exc_info())
            raise

elif not remote_python_status == "CLOSED":
    remote_python_status = "CLOSING"
    # Remove linked modules
    for mod in lkd_modules:
        del scriptcontext.sticky[mod]
    del scriptcontext.sticky["rpy"]
    gh2py_manager.__exit__(*sys.exc_info())
    lkd_modules = set()
    remote_python_status = "CLOSED"

# Change variable name because ghpython resets outputs to None before each run
linked_modules = lkd_modules

logger.info("GH to python connection is {}".format(remote_python_status))
# ---------- end ghpythonremote ----------
out = ClusterOutput(ghpythonremote.out)  # Console output.
linked_modules = ClusterOutput(ghpythonremote.linked_modules)  # Names of modules that were successfully added to the scriptcontext.sticky dictionary.
rpy = ClusterOutput(ghpythonremote.rpy)  # The object representing the remote python instance
python_2 = PythonScript(module_names=ghpythonremote.linked_modules)  # -> import_statements; inputs module_names: list
# ---------- python_2: Python ----------
import_statements = ["import scriptcontext as sc"]
for module_name in module_names:
    import_statements.append("{0} = sc.sticky['{0}']".format(module_name))

if len(module_names) == 0:
    import_statements = []
# ---------- end python_2 ----------
import_statements = ClusterOutput(python_2)  # Useful import statements to use the imported modules in your scripts.
