# Grasshopper definition 231005_JD_Beta_close origin.gh (Grasshopper 1.0.7)
# Copyright: © 2017-2018 Pierre Cuvilliers, Caitlin Mueller, Massachusetts Institute of Technology
# plug-ins: Telepathy, MetaHopper, UiPlus, Heteroptera, Pufferfish, MeshEdit Components, Hops, Kangaroo2 Components, Heron, EleFront, RhinoCodePluginGH

panel = Panel("C:\Users\Admin\Gruner AG\Jumping dams [EXP] - General\03_Model\Example image.png")

panel_2 = Panel("""Concrete gravity dam
Arch dam
Embankment dam""")
# Dam configuration
# Dashboard structure
panel_3 = Panel("Type of Dam (m)")

# ----
# In conda cmd prompt:
# 
# conda activate C:\Users\cna\.conda\envs\rhinoremote
# 
# pip install <package> - for any missing package check the ouput to the right
# 
# For PIL -> pip install pillow
panel_4 = Panel("C:\Users\cna\Anaconda3\envs\rhinoremote")
panel_5 = Panel("""PIL
openpyxl""")
# Requirements hops scripts
panel_6 = Panel("Modules\Gravity.gh")
# Requirements plugins
# Python remote
panel_7 = Panel("""UI+
Metahopper""")

# ---- group: INFO
# _________________________________
# 
# This file is done based on the rhino file:
# _________________________________
# "C:\Users\Admin\Gruner AG\BSBE [ORG] - Digitale Anwendungen ESD\04_Projekte\2023\CH_VS_Barrage Les Toules_SensitivityAnalysis_JD\Model\231708_Le toules-WSCH00320.3dm"
# Images folder - saved where the gh file is
# Image size settings
number_slider = Slider(700, range=0..1000)
# Infos & Settings
panel_8 = Panel("231708_Le toules.3dm")
viewport_1_for_images = Panel("Perspektive")
viewport_2_for_images = Panel("Drauf")
viewport_3_for_images = Panel("Detail")
relpath = RelativePath(Path="Bilder")
multiplication = Multiplication(A=number_slider, B="7")
multiplication_2 = Multiplication(A=number_slider, B="5")
panel_9 = Panel(relpath)
viewport_name_3 = RemoteSender(viewport_3_for_images)
viewport_name_1 = RemoteSender(viewport_1_for_images)
viewport_name_2 = RemoteSender(viewport_2_for_images)
panel_10 = Panel("1446")
panel_11 = Panel(multiplication)
panel_12 = Panel("883")
panel_13 = Panel(multiplication_2)

# ----
# Language translation
list = ValueList({"English": 0, "French": 1, "German": 2}, selected="French")
panel_14 = Panel("C:\Users\Admin\Gruner AG\Jumping dams [EXP] - General\03_Model\Les Toules")
relpath_2 = RelativePath(Path="Resources\Translations\Water_en.txt")
relpath_3 = RelativePath(Path="Resources\Translations\Water_fr.txt")
relpath_4 = RelativePath(Path="Resources\Translations\Water_en.txt")
label = UiLabel(Label="Freeboard (m)", Style=3)
slider = UiSlider(Value=0.5, Bounds=Domain(0, 1), Increment=0.1)
label_2 = UiLabel(Label="Foundation depth (m)", Style=3)
image = UiImage(Bitmap=panel, Fitting=1)
button = UiButton(Label="Ok")
label_3 = UiLabel(Label=panel_3, Style=3)
toggle = UiToggle(State=False)
label_4 = UiLabel(Label="Minimum water level", Style=3)
scroll_number = UiScrollNumber(Label="(m.asl)", Number=0, Wrap=False, Digits=3)
slider_2 = UiSlider(Value=0.5, Bounds=Domain(0, 1), Increment=0.1)
file = ReadFile(File=relpath_2, PerLineParse=True)
label_5 = UiLabel(Label="Normal water level (m.asl)", Style=3)
toggle_2 = UiToggle(State="True")
file_2 = ReadFile(File=relpath_3, PerLineParse=True)
file_3 = ReadFile(File=relpath_4, PerLineParse=True)
relpath_5 = RelativePath(Path="Modules\Dashboard_damConfiguration")
relpath_6 = RelativePath(Path="Modules\Embankment.gh")
relpath_7 = RelativePath(Path="Modules\Arch.gh")
relpath_8 = RelativePath(Path=panel_6)
english = Panel(file)
french = Panel(file_2)
german = Panel(file_3)
pythonremote = GHPythonRemote(location=panel_4, run=Toggle(False), modules=panel_5)  # -> out, linked_modules, rpy, import_statements
merge = Merge(Data1=relpath_8, Data2=relpath_7, Data3=relpath_6, Data4=relpath_5)
merge_2 = Merge(Data1=label_4, Data2=scroll_number)
path_save = RemoteSender(panel_14)
panel_15 = Panel(merge)
filepath_hops = RemoteSender(merge)
panel_16 = Panel(pythonremote.out)
filter = StreamFilter(Gate=list, Stream0=english, Stream1=french, Stream2=german)
fields_water = RemoteSender(filter)
resize = UiResize(Element=image, Width="200", Height="200")
slider_3 = UiSlider(Element=slider, Label="m", Value="3", Bounds="0 To 5", Increment=".1")
button_2 = UiButton(Element=button, Label="Send changes")
slider_4 = UiSlider(Element=slider_2, Label="m", Value="10", Bounds="0 To 50", Increment=".1")
toggle_3 = UiToggle(Element=toggle, Label="Show direction river flow?", State=False)
toggle_4 = UiToggle(Element=toggle_2, Label="Visualize dimensions?", State=False)
heights = Panel("1747.5")
# Select dam type
heights_2 = Panel("""1836
1839
1842
1844""")
# Run Dam
# Select dam type
list_2 = ValueList({"Concrete gravity dam": "0", "Arch dam": "1", "Embankment dam": "2"}, selected="Arch dam")
dam_configuration = Button()
run_arch_dam = Button()
run_pre_geometry_of_water = Button()
get_values = UiValues(Element=slider_3)  # -> flatten(Values)
get_values_2 = UiValues(Element=slider_4)  # -> flatten(Values)
get_values_3 = UiValues(Element=button_2)  # -> flatten(Values)
get_values_4 = UiValues(Element=toggle_3)  # -> flatten(Values)
get_values_5 = UiValues(Element=toggle_4)  # -> flatten(Values)
# Dashboard - fill in data and listen to outputs
dam_type_index = Panel("""0
1
2""")
num = Number(heights_2)
minimum_water_level_preset = RemoteSender(heights)
minimum_water_level_preset_2 = RemoteReceiver(minimum_water_level_preset)
scroll_number_2 = UiScrollNumber(Element=scroll_number, Number=minimum_water_level_preset_2, Wrap=False, Digits=Slider(1, range=0..1))
get_values_6 = UiValues(Element=scroll_number_2)  # -> flatten(Values)
minimum_water_level_m_input_from_dashboa = Panel(get_values_6)  # "Minimum water level (m) - Input from Dashboard"
freeboard_m_input_from_dashboard = Panel(get_values)
# must be a closed volume!
run_archdam = RemoteSender(run_arch_dam)
sort = SortList(Keys=heights_2, ValuesA=num)  # -> Keys, ValuesA
panel_17 = Panel(get_values_4)
offset_foundation_m_input_from_dashboard = Panel(get_values_2)
run_water_pre = RemoteSender(run_pre_geometry_of_water)
panel_18 = Panel(get_values_5)
panel_19 = Panel(get_values_3)
panel_20 = Panel("""False
False
False""")
list_of_heights = RemoteSender(sort.ValuesA)
list_of_heights_2 = RemoteReceiver(list_of_heights)
dropdown_list = UiDropdownList(Values=list_of_heights_2)
list_of_heights_3 = RemoteReceiver(list_of_heights)
dropdown_list_2 = UiDropdownList(Element=dropdown_list, Values=list_of_heights_3, Index=Slider(3, range=0..10))
get_values_7 = UiValues(Element=dropdown_list_2)  # -> flatten(Values)
item = ListItem(List=list_of_heights_3, Index=get_values_7, Wrap=True)
water_level_m_input_from_dashboard = Panel(item)
replace = ReplaceItems(List=panel_20, Item="True", Indices=list_2, Wrap=False)
dam_selection = RemoteSender(replace)
dam_selection_2 = RemoteReceiver(dam_selection)
panel_21 = Panel(dam_selection_2)
radio = UiRadio(Label=panel_2, State=panel_21, Group="Group 1")
merge_3 = Merge(
    Data1=label_3,
    Data2=radio,
    Data3=label_5,
    Data4=dropdown_list,
    Data5=merge_2,
    Data6=label,
    Data7=slider,
    Data8=label_2,
    Data9=slider_2,
    Data10=button,
    Data11=toggle,
    Data12=toggle_2)  # -> flatten(Result)
window = UiWindow(Elements=merge_3, Title="Dam Configuration", Owner=1, Scroll=True, Launch=Button())
get_values_8 = UiValues(Element=radio)  # -> flatten(Values)
dam_type = Panel(get_values_8)
dispatch = Dispatch(List=dam_type_index, DispatchPattern=dam_type)  # -> ListA, ListB
viz_dimensions = RemoteSender(panel_18)
viz_direction_river = RemoteSender(panel_17)
dashboard_damconfiguration = RemoteSender(dam_configuration)
dashboard_damconfiguration_2 = RemoteReceiver(dashboard_damconfiguration)
minimum_water_level = RemoteSender(minimum_water_level_m_input_from_dashboa)
dam = DataDam(DataA=freeboard_m_input_from_dashboard, BufferDelay=10000000, BufferMode=0)  # disabled
dam_2 = DataDam(DataA=offset_foundation_m_input_from_dashboard, BufferDelay=10000000, BufferMode=0)  # disabled

dam_3 = DataDam(
    DataA=dispatch.ListA,
    DataB=water_level_m_input_from_dashboard,
    DataC=freeboard_m_input_from_dashboard,
    DataD=offset_foundation_m_input_from_dashboard,
    BufferDelay=5000000,
    BufferMode=0)  # -> DataA, DataB, DataC, DataD
dam_4 = DataDam(DataA=dispatch.ListA, BufferDelay=2500000, BufferMode=0)
objfromgroup = GetObjectsInGroup()

lng = ListLength(List=objfromgroup)
dup = DuplicateData(Data=panel_19, Number=lng, Order=True)

inpupt_offset_foundation_m = Panel(dam_3.DataD)
addition = Addition(A=dam_3.DataB, B=dam_3.DataC)
bool = Boolean(dup)
water_level = RemoteSender(dam_3.DataB)
dam_type_2 = RemoteSender(dam_4)
dam_type_3 = RemoteReceiver(dam_type_2)
num_2 = Number(dam_type_3)
S = Script(Language=list, Dam_index=num_2)  # -> out, a
# ---------- S: Python ----------
"""05.10.2023 - CNA"""

if l == 0:
    if i == 0:
        a = "Gravity"
    elif i == 1:
        a = "Arch" 
    elif i == 2:
        a = "Embankment"

if l == 1:
    if i == 0:
        a = "Poids"
    elif i == 1:
        a = "Voûtes" 
    elif i == 2:
        a = "Digue"
# ---------- end S ----------
panel_22 = Panel(S.a)
dam_name_translation = RemoteSender(S.a)
dam_name_translation_2 = RemoteReceiver(dam_name_translation)
dam_level = RemoteSender(addition)
freeboard = RemoteSender(dam_3.DataC)
offset_foundation = RemoteSender(dam_3.DataD)
setobj = SetObjectValue(ObjectToSet=flatten(objfromgroup), ValueToSet=flatten(bool))
panel_23 = Panel(lng)
panel_24 = Panel(dup)
vector_back_to_lv95 = Panel("{2.5815e+6,1.083e+6,0}")
vector_send_to_local_0 = Panel("{-2.5815e+6,-1.083e+6,0}")

pipeline = GeometryPipeline(
    GroupByLayer=False,
    GroupByType=False,
    IncludeHidden=True,
    IncludeLocked=True,
    LayerFilter="Upstream_point",
    NameFilter="*",
    SublayerFiltering=True,
    TypeFilter=1)
pipeline_2 = GeometryPipeline(
    GroupByLayer=False,
    GroupByType=False,
    IncludeHidden=True,
    IncludeLocked=True,
    LayerFilter="Arch::Axes::*",
    NameFilter="*",
    SublayerFiltering=True,
    TypeFilter=4)
pipeline_3 = GeometryPipeline(
    GroupByLayer=False,
    GroupByType=False,
    IncludeHidden=True,
    IncludeLocked=True,
    LayerFilter="Embankment::Axes::*",
    NameFilter="*",
    SublayerFiltering=True,
    TypeFilter=4)
pipeline_4 = GeometryPipeline(
    GroupByLayer=False,
    GroupByType=False,
    IncludeHidden=True,
    IncludeLocked=True,
    LayerFilter="Gravity::Axes::*",
    NameFilter="*",
    SublayerFiltering=True,
    TypeFilter=4)

mesh = GeometryPipeline(
    GroupByLayer=False,
    GroupByType=False,
    IncludeHidden=True,
    IncludeLocked=True,
    LayerFilter="Terrain_base_curve",
    NameFilter="*",
    SublayerFiltering=True,
    TypeFilter=4)
pipeline_5 = GeometryPipeline(
    GroupByLayer=False,
    GroupByType=False,
    IncludeHidden=True,
    IncludeLocked=True,
    LayerFilter="Terrain_levels",
    NameFilter="*",
    SublayerFiltering=True,
    TypeFilter=4)
mesh_2 = GeometryPipeline(
    GroupByLayer=False,
    GroupByType=False,
    IncludeHidden=True,
    IncludeLocked=True,
    LayerFilter="Terrain_brep_offset_-10",
    NameFilter="*",
    SublayerFiltering=True,
    TypeFilter=1073741848)
mesh_3 = GeometryPipeline(
    GroupByLayer=False,
    GroupByType=False,
    IncludeHidden=True,
    IncludeLocked=True,
    LayerFilter="Terrain_brep",
    NameFilter="*",
    SublayerFiltering=True,
    TypeFilter=1073741848)
xy = XYPlane(Origin=Point(0, 0, 0))  # disabled
vec2pt = Vector2Pt(PointA=pipeline, PointB=xy, Unitize=False)  # -> Vector, Length; disabled
rev = Reverse(Vector=vec2pt.Vector)  # disabled
item_2 = ListItem(List=pipeline_3, Index=Slider(1, range=0..10), Wrap=False)
item_3 = ListItem(List=pipeline_4, Index=Slider(1, range=0..1), Wrap=True)
item_4 = ListItem(List=pipeline_2, Index=Slider(5, range=0..10), Wrap=False)
transform = Transform({TransformCount=1, Name="Translation", tx=-2580598.7, ty=-1083020.6, tz=0})
inverse = InverseTransform(Transform=transform)
vector_to_origin = RemoteSender(inverse)
dam_type_4 = RemoteReceiver(dam_type_2)
filter_2 = StreamFilter(Gate=dam_type_4, Stream0=item_3, Stream1=item_4, Stream2=item_2)
explode = Explode(Curve=mesh, Recursive=True)  # -> Segments, Vertices
brep = Brep(mesh)
conmesh = ConstructMesh(Vertices=explode.Vertices, Faces={A=0, B=1, C=2, D=3})
brep_terrain_base_foundation = RemoteSender(mesh_2)
brep_terrain_base = RemoteSender(brep)
mesh_terrain_flattened = RemoteSender(conmesh)
dam_axis = RemoteSender(filter_2)
brep_terrain = RemoteSender(mesh_3)
lines_levels = RemoteSender(pipeline_5)

# ---- group: Selecting dam height level
# This changes when the axis line calculate and recalculate the basics again
brep_terrain_2 = RemoteReceiver(brep_terrain)

# ----
brep_terrain_base_foundation_2 = RemoteReceiver(brep_terrain_base_foundation)
dam_level_2 = RemoteReceiver(dam_level)
dam_axis_2 = RemoteReceiver(dam_axis)
Z = UnitZ(Factor=dam_level_2)
move = Move(Geometry=dam_axis_2, Motion=Z)  # -> Geometry, Transform
# Technical Memorandum No. EM36-86-68110: 2.1.3 Lines of Centers
# 
# The lines of centers define the horizontal shape of the arches in an arch dam. The shape of the arches starts at the crown cantilever and curves horizontally downstream toward the abutments. The line of centers create the geometry of the circular arcs at each elevation of the dam for the upstream and downstream faces by defining the center point of a circle and the radius of the circle. Depending on the shape and number of lines of centers, the arches can be
# 1) uniform thickness from abutment to abutment,
# 2) variable thickness from abutment to abutment,
# 3) different on the left side of the dam compared to the right side of the dam, or
# 4) different in the center of the dam compared to the outer part of the dam.
# Technical Memorandum No. EM36-86-68110: A double curvature arch dam has curvature in the arches and in the crown cantilever.
panel_25 = Panel(" 1 meter = 3.28084 feet")
water_level_2 = RemoteReceiver(water_level)
Z_2 = UnitZ(Factor=water_level_2)
scx = SurfaceCurve(Surface=brep_terrain_2, Curve=move.Geometry)  # -> Curves, flatten(Points), UVPoints, Normals, Parameters, Tangents

# ---- group: Finding the crest points at bottom EXCAVATION
scx_2 = SurfaceCurve(Surface=brep_terrain_base_foundation_2, Curve=move.Geometry)  # -> Curves, flatten(Points), UVPoints, Normals, Parameters, Tangents
item_5 = ListItem(List=scx_2.Points, Index=0, Wrap=True)  # -> Item, Item1

# ----
item_6 = ListItem(List=scx.Points, Index=0, Wrap=True)  # -> Item, Item1
sec = BrepPlane(Brep=brep_terrain_2, Plane=Z_2)  # -> Curves, Points
ln = Line(StartPoint=item_6.Item, EndPoint=item_6.Item1)

# ---- group: AXIS LINE
ln_2 = Line(StartPoint=item_5.Item, EndPoint=item_5.Item1)

# ----
join = JoinCurves(Curves=sec.Curves, Preserve=False)
len = Length(Curve=ln)
txt = Text(join)
chord_dam = RemoteSender(ln_2)
axis_straight_terrain = RemoteSender(len)
downstream_face_angle_ratio_1 = Slider(0.8, range=0..1)
downstream_face_angle_ratio_1_2 = Slider(0.8, range=0..1)
dam_crest_width = Slider(20, range=0..100)
dam_crest_width_2 = Slider(6, range=0..100)
mindex = MemberIndex(Set=txt, Member="Closed Planar Curve")  # -> Index, Count
cull_i = CullIndex(List=join, Indices=mindex.Index, Wrap=True)
embankment_width_crest = RemoteSender(dam_crest_width)
gravity_width_crest = RemoteSender(dam_crest_width_2)
embankment_ds_ration = RemoteSender(downstream_face_angle_ratio_1)
geo = Geometry(cull_i)
gravity_ds_ration = RemoteSender(downstream_face_angle_ratio_1_2)
explode_2 = Explode(Curve=cull_i, Recursive=True)  # -> Segments, flatten(Vertices); disabled
item_7 = ListItem(List=explode_2.Vertices, Index=0, Wrap=True)  # disabled
pln = Plane(item_7)  # disabled
project = Project(Geometry=explode_2.Vertices, Plane=pln)  # -> Geometry, Transform; disabled
# surface
brep_terrain_base_foundation_3 = RemoteReceiver(brep_terrain_base_foundation)
# surface
brep_terrain_base_foundation_4 = RemoteReceiver(brep_terrain_base_foundation)
levels_at_water_height = RemoteSender(geo)
# number
embankment_ds_ration_2 = RemoteReceiver(embankment_ds_ration)
# number
embankment_width_crest_2 = RemoteReceiver(embankment_width_crest)
# line
chord_dam_2 = RemoteReceiver(chord_dam)
# number
gravity_ds_ration_2 = RemoteReceiver(gravity_ds_ration)
# number
gravity_width_crest_2 = RemoteReceiver(gravity_width_crest)
# line
chord_dam_3 = RemoteReceiver(chord_dam)
pline = PolyLine(Vertices=project.Geometry, Closed=False)  # disabled
# Technical Memorandum No. EM36-86-68110: 2.1.3.2 Uniform- or Variable Thickness Arch Dams
# 
# The number of lines that define the line-of-centers determines whether the arches are uniform thickness or variable thickness arches.
# The arches have uniform thickness if there is one line defining the extrados and intrados line-of-centers. This means that the radius center for the upstream and downstream faces is the same. The radii lengths are different at each elevation, but since the radius center is the same, the thickness of the arch is uniform.
# The arches vary in thickness if there are two lines defining the extrados and intrados line-of-centers. This means that the radius centers for the upstream and downstream faces are in different positions in space forcing the circular arcs of the arches to diverge.
panel_26 = Panel("""All in meters

Dam height: {3}
Radius = 0.6xL1 + Adjustment = {0} + {8} : {9}
L1: {1}
tc: {2}
USP base: {4}
DSP base: {5}
USP @ 0.45H: {6}
Volume if calculated with the equations: {7}
Free board: {10}
Offset foundation: {11}""")
panel_27 = Panel("""Radius: {9}
L1: {1}
tc: {2}
USP base: {4}
DSP base: {5}
USP at 45%H: {6}
Volume if calculated with the equations: {7}
Free board: {10}
Offset foundation: {11}""")
list_3 = ValueList({"Concrete gravity dam": 0, "Arch dam": 1, "Embankment dam": 2}, selected="Concrete gravity dam")  # disabled
offset_foundation_2 = RemoteReceiver(offset_foundation)
filepath_hops_2 = RemoteReceiver(filepath_hops)  # disabled
freeboard_2 = RemoteReceiver(freeboard)
offset_foundation_3 = RemoteReceiver(offset_foundation)
freeboard_3 = RemoteReceiver(freeboard)
item_8 = ListItem(List=filepath_hops_2, Index=list_3, Wrap=True)  # disabled
brep_terrain_base_foundation_5 = RemoteReceiver(brep_terrain_base_foundation)  # disabled
brep_terrain_base_foundation_6 = RemoteReceiver(brep_terrain_base_foundation)
panel_28 = Panel(item_8)  # disabled
levels_at_water_height_2 = RemoteReceiver(levels_at_water_height)
gravity_ds_ration_3 = RemoteReceiver(gravity_ds_ration)  # disabled
chord_dam_4 = RemoteReceiver(chord_dam)  # disabled
width_crest = RemoteReceiver()  # disabled
chord_dam_5 = RemoteReceiver(chord_dam)
# ARCH DAM
chord_dam_6 = RemoteReceiver(chord_dam)
path = FilePath(panel_28)  # disabled

raxis_adjustments = Slider(20, range=-30..30)

hops = Hops(
    _Path=path,
    CacheResultsInMemory=True,
    CacheSolveResults=True,
    RemoteDefinitionLocation="C:\Users\Admin\Documents\Github\EarlyStageDesign\JD\Skripts\Modules\Gravity.gh",
    RemoteSolveVersion=(0, 1, 0),
    ShowInput_Enabled=False,
    ShowInput_Path=True,
    SynchronousSolve=True)  # disabled
run_archdam_2 = RemoteReceiver(run_archdam)
mesh_terrain_flattened_2 = RemoteReceiver(mesh_terrain_flattened)
brep_terrain_base_2 = RemoteReceiver(brep_terrain_base)
lines_levels_2 = RemoteReceiver(lines_levels)
brep_terrain_3 = RemoteReceiver(brep_terrain)
dam_axis_3 = RemoteReceiver(dam_axis)
water_level_3 = RemoteReceiver(water_level)
end = EndPoints(Curve=lines_levels_2)  # -> Start, End
pdecon = Deconstruct(Point=[end.Start, end.End])  # -> XComponent, YComponent, ZComponent
minimum_water_level_2 = RemoteReceiver(minimum_water_level)
sort_2 = SortList(Keys=pdecon.ZComponent, ValuesA=[end.Start, end.End])  # -> Keys, ValuesA
jagged = SettingsSpeed()
bbox = BoundingBox(Content=brep_terrain_3, Plane=PlaneXY(0, 0, 0))  # -> Box, Box_2
Z_3 = UnitZ(Factor=minimum_water_level_2)
item_9 = ListItem(List=sort_2.ValuesA, Index=0, Wrap=True)
pt = ConstructPoint(XCoordinate=0, YCoordinate=0, ZCoordinate=water_level_3)
mesh_4 = MeshBrep(Brep=brep_terrain_base_2, Settings=jagged)
pln_2 = Plane(pt)
pln_3 = Plane(item_9)
pln_4 = Plane(Z_3)
movetoplane = MoveToPlane(Geometry=mesh_4, Plane=pln_3, Above=True, Below=True)  # -> Geometry, Transform
movetoplane_2 = MoveToPlane(Geometry=mesh_4, Plane=pln_4, Above=True, Below=True)  # -> Geometry, Transform
movetoplane_3 = MoveToPlane(Geometry=mesh_4, Plane=pln_2, Above=True, Below=True)  # -> Geometry, Transform
project_2 = Project(Curve=dam_axis_3, Brep=bbox.Box, Direction=Vector(0, 0, 1))
bbox_2 = BoundingBox(Content=[movetoplane_3.Geometry, movetoplane.Geometry], Plane=PlaneXY(0, 0, 0), UnionBox=True)  # -> Box, Box_2
project_3 = Project(Curve=dam_axis_3, Brep=bbox_2.Box, Direction=Vector(0, 0, 1))
jagged_2 = SettingsSpeed()
list_4 = ValueList({"Concrete gravity dam": 0, "Arch dam": 1, "Embankment dam": 2}, selected="Embankment dam")
list_5 = ValueList({"Concrete gravity dam": 0, "Arch dam": 1, "Embankment dam": 2}, selected="Concrete gravity dam")
dam_type_5 = RemoteReceiver(dam_type_2)
mesh_5 = Mesh(project_3)
mesh_6 = MeshBrep(Brep=bbox.Box, Settings=jagged_2)
mesh_7 = MeshBrep(Brep=brep_terrain_3, Settings=jagged_2)
dam_type_6 = RemoteReceiver(dam_type_2)
mesh_8 = Mesh(project_2)
msplit = MeshSplit(Mesh=mesh_6, Splitters=mesh_7)
equals = Equality(FirstNumber=dam_type_5, SecondNumber=list_4)  # -> Equality, Inequality
equals_2 = Equality(FirstNumber=dam_type_6, SecondNumber=list_5)  # -> Equality, Inequality
item_10 = ListItem(List=msplit, Index=0, Wrap=True)  # -> Item, Item1
geo_2 = Geometry(item_10.Item)
geo_3 = Geometry(item_10.Item1)
mjoin = MeshJoin(Meshes=flatten([geo_3, mesh_7]))
weldvertices = MeshWeldVertices(Mesh=mjoin, Tolerance=0.01)  # -> RuntimeMessage, Mesh
clsmsh = CloseMesh(Mesh=weldvertices.Mesh, Quadrangulate=False)  # -> Closed, Amount, Openings, R

# ---- group: Divide on axis
msplit_2 = MeshSplit(Mesh=clsmsh.Closed, Splitters=mesh_8)
item_11 = ListItem(List=msplit_2, Index=0, Wrap=True)
clsmsh_2 = CloseMesh(Mesh=item_11, Quadrangulate=False)  # -> Closed, Amount, Openings, R

# ---- group: Divide dead storage capacity from the rest
msplit_3 = MeshSplit(Mesh=clsmsh_2.Closed, Splitters=movetoplane_2.Geometry)
clean = CleanTree(RemoveNulls=True, RemoveInvalid=True, RemoveEmpty=False, Tree=msplit_3)
cull_i_2 = CullIndex(List=clean, Indices="0", Wrap=True)
item_12 = ListItem(List=clean, Index=0, Wrap=True)
clsmsh_3 = CloseMesh(Mesh=cull_i_2, Quadrangulate=False)  # -> Closed, Amount, Openings, R
clsmsh_4 = CloseMesh(Mesh=item_12, Quadrangulate=False)  # -> Closed, Amount, Openings, R

# ----
dead_storage = Mesh(flatten(clsmsh_3.Closed))
rest = Mesh(clsmsh_4.Closed)
graft = GraftTree(Tree=dead_storage, IncludeEmptyLists=True, IncludeNullItems=True)

# ---- group: Splitting the rest to the normal water level
msplit_4 = MeshSplit(Mesh=rest, Splitters=movetoplane_3.Geometry)
clean_2 = CleanTree(RemoveNulls=True, RemoveInvalid=True, RemoveEmpty=False, Tree=msplit_4)
cull_i_3 = CullIndex(List=clean_2, Indices="0", Wrap=True)
item_13 = ListItem(List=cull_i_3, Index=0, Wrap=True)  # -> Item, Item1
geo_4 = Geometry(item_13.Item)

# ----
volume = Volume(Geometry=graft)  # -> Volume, Centroid
u_text = UserText(Content=graft, Keys="Volume", Values=volume.Volume, UserTextMode=0)  # -> Content, Keys, Values
msplit_5 = MeshSplit(Mesh=clsmsh.Closed, Splitters=movetoplane_3.Geometry)
clean_3 = CleanTree(RemoveNulls=True, RemoveInvalid=True, RemoveEmpty=False, Tree=msplit_5)
cull_i_4 = CullIndex(List=clean_3, Indices="0", Wrap=True)
item_14 = ListItem(List=cull_i_4, Index=0, Wrap=True)  # -> Item, Item1
geo_5 = Geometry(item_14.Item)
msplit_6 = MeshSplit(Mesh=geo_5, Splitters=mesh_8)
msplit_7 = MeshSplit(Mesh=mesh_5, Splitters=geo_5)
cull_i_5 = CullIndex(List=msplit_7, Indices=0, Wrap=True)
item_15 = ListItem(List=msplit_6, Index=0, Wrap=True)
bbox_3 = BoundingBox(Content=geo_4, Plane=PlaneXY(0, 0, 0), UnionBox=True)  # -> Box, Box_2
mjoin_2 = MeshJoin(Meshes=flatten([item_15, cull_i_5]))
contour = Contour(Shape=bbox_3.Box, Point=Point(0, 0, 0), Direction=Vector(0, 0, 1), Distance=Slider(10, range=0..100))  # -> flatten(Contours)
bbox_4 = BoundingBox(Content=item_15, Plane=PlaneXY(0, 0, 0), UnionBox=True)  # -> Box, Box_2
weldvertices_2 = MeshWeldVertices(Mesh=mjoin_2, Tolerance=0.01)  # -> RuntimeMessage, Mesh
mesh_9 = Mesh(contour)
contour_2 = Contour(Shape=bbox_4.Box, Point=Point(0, 0, 0), Direction=Vector(0, 0, 1), Distance=Slider(10, range=0..100))  # -> flatten(Contours)
mesh_10 = Mesh(contour_2)
msplit_8 = MeshSplit(Mesh=geo_4, Splitters=mesh_9)
Z_4 = UnitZ(Factor=1)
msplit_9 = MeshSplit(Mesh=weldvertices_2.Mesh, Splitters=mesh_10)
Z_5 = UnitZ(Factor=Slider(0.1, range=0..0.1))
clsmsh_5 = CloseMesh(Mesh=weldvertices_2.Mesh, Quadrangulate=False)  # -> Closed, Amount, Openings, R
move_2 = Move(Geometry=mesh_10, Motion=Z_4)  # -> Geometry, Transform
move_3 = Move(Geometry=mesh_9, Motion=Z_5)  # -> Geometry, Transform
clean_4 = CleanTree(RemoveNulls=True, RemoveInvalid=True, RemoveEmpty=False, Tree=flatten(msplit_9))
geo_6 = Geometry(clsmsh_5.Openings)
graft_2 = GraftTree(Tree=move_2.Geometry, IncludeEmptyLists=True, IncludeNullItems=True)
clean_5 = CleanTree(RemoveNulls=True, RemoveInvalid=True, RemoveEmpty=False, Tree=flatten(msplit_8))
graft_3 = GraftTree(Tree=move_3.Geometry, IncludeEmptyLists=True, IncludeNullItems=True)
mshclsd = IsMeshClosed(Mesh=clsmsh_5.Closed)
volume_2 = MeshVolume(Mesh=clsmsh_5.Closed)  # -> Volume, Centroid
clash = Clash(FirstSet=clean_4, SecondSet=graft_2, Distance=0, L=100)  # -> ClashCount, ClashPoints, ClashRadii, FirstIndex, SecondIndex
clash_2 = Clash(FirstSet=clean_5, SecondSet=graft_3, Distance=0, L=100)  # -> ClashCount, ClashPoints, ClashRadii, FirstIndex, SecondIndex
item_16 = ListItem(List=clean_4, Index=clash.FirstIndex, Wrap=True)
item_17 = ListItem(List=clean_5, Index=clash_2.FirstIndex, Wrap=True)
mjoin_3 = MeshJoin(Meshes=item_16)
clean_6 = CleanTree(RemoveNulls=True, RemoveInvalid=True, RemoveEmpty=True, Tree=item_17)
disjoint = DisjointMesh(Mesh=mjoin_3)
mjoin_4 = MeshJoin(Meshes=clean_6)
clsmsh_6 = CloseMesh(Mesh=disjoint, Quadrangulate=True)  # -> Closed, Amount, Openings, R
disjoint_2 = DisjointMesh(Mesh=mjoin_4)
levels_at_water_height_3 = RemoteReceiver(levels_at_water_height)  # disabled
brep_terrain_base_3 = RemoteReceiver(brep_terrain_base)  # disabled
clsmsh_7 = CloseMesh(Mesh=disjoint_2, Quadrangulate=True)  # -> Closed, Amount, Openings, R
volume_3 = MeshVolume(Mesh=clsmsh_6.Closed)  # -> Volume, Centroid
brep_terrain_4 = RemoteReceiver(brep_terrain)  # disabled
chord_dam_7 = RemoteReceiver(chord_dam)  # disabled
water_level_4 = RemoteReceiver(water_level)  # disabled
freeboard_4 = RemoteReceiver(freeboard)  # disabled
path_mapper = PathMapper(clsmsh_7.Closed, source="{A;B;C;D}", target="{path_index}")
number_slider_2 = Slider(10, range=0..10)  # disabled
volume_4 = MeshVolume(Mesh=clsmsh_7.Closed)  # -> Volume, Centroid
ma = MassAddition(Input=flatten(volume_4.Volume))  # -> Result, PartialResults
larger = LargerThan(FirstNumber=volume_3.Volume, SecondNumber=Slider(150, range=0..150))  # -> LargerThan, OrEqualTo

dam_5 = DataDam(
    DataFlatBase=brep_terrain_base_3,
    DataWaterLevel=water_level_4,
    DataFreeBoard=freeboard_4,
    DataChordDam=chord_dam_7,
    DataBrepTerrain=brep_terrain_4,
    DataLevelsAtWaterHeight=levels_at_water_height_3,
    BufferDelay=10000000,
    BufferMode=0)  # -> DataFlatBase, DataWaterLevel, DataFreeBoard, DataChordDam, DataBrepTerrain, DataLevelsAtWaterHeight; disabled
objfromgroup_2 = GetObjectsInGroup()  # disabled

larger_2 = LargerThan(FirstNumber=volume_4.Volume, SecondNumber=Slider(150, range=0..150))  # -> LargerThan, OrEqualTo
# Pre-volume Water
run_water_pre_2 = RemoteReceiver(run_water_pre)  # disabled
dispatch_2 = Dispatch(List=volume_3.Volume, DispatchPattern=larger.LargerThan)  # -> simplify(ListA), ListB
dispatch_3 = Dispatch(List=clsmsh_6.Closed, DispatchPattern=larger.LargerThan)  # -> ListA, ListB
Z_6 = UnitZ(Factor=number_slider_2)  # disabled
ma_2 = MassAddition(Input=flatten(volume_3.Volume))  # -> Result, PartialResults
panel_29 = Panel(ma.Result)
dispatch_4 = Dispatch(List=volume_4.Volume, DispatchPattern=larger_2.LargerThan)  # -> simplify(ListA), ListB
dispatch_5 = Dispatch(List=clsmsh_7.Closed, DispatchPattern=larger_2.LargerThan)  # -> ListA, ListB
mjoin_5 = MeshJoin(Meshes=dispatch_3.ListA)  # -> simplify(Mesh)
setobj_2 = SetObjectValue(ObjectToSet=objfromgroup_2, ValueToSet=run_water_pre_2)  # disabled
panel_30 = Panel(ma_2.Result)
geo_7 = Geometry(dispatch_5.ListB)
mjoin_6 = MeshJoin(Meshes=dispatch_5.ListA)  # -> simplify(Mesh)
ma_3 = MassAddition(Input=flatten(dispatch_4.ListA))  # -> Result, PartialResults
Z_7 = UnitZ(Factor=dam_5.DataWaterLevel)  # disabled
ma_4 = MassAddition(Input=flatten(dispatch_2.ListA))  # -> Result, PartialResults

# ---- group: Water volume cutter
project_4 = Project(Curve=dam_5.DataChordDam, Brep=dam_5.DataBrepTerrain, Direction=Vector(0, 0, 1))  # disabled
ccx = CurveCurve(CurveA=project_4, CurveB=dam_5.DataLevelsAtWaterHeight)  # -> Points, ParamsA, ParamsB; disabled
shatter = Shatter(Curve=project_4, Parameters=ccx.ParamsA)  # disabled
shatter_2 = Shatter(Curve=dam_5.DataLevelsAtWaterHeight, Parameters=ccx.ParamsB)  # disabled
dispatch_6 = Dispatch(List=shatter, DispatchPattern=[True, False])  # -> ListA, ListB; disabled
dispatch_7 = Dispatch(List=shatter_2, DispatchPattern=[True, False])  # -> ListA, ListB; disabled
join_2 = JoinCurves(Curves=flatten([dispatch_6.ListB, dispatch_7.ListB]), Preserve=False)  # disabled

# ----
panel_31 = Panel(ma_4.Result)
dam_type_7 = RemoteReceiver(dam_type_2)
null = NullPlaceholder()

# ---- group: Water_Lateral part
neg = Negative(Value=dam_5.DataFreeBoard)  # disabled
Z_8 = UnitZ(Factor=neg)  # disabled
move_4 = Move(Geometry=dam_5.DataChordDam, Motion=Z_8)  # -> Geometry, Transform; disabled
neg_2 = Negative(Value=Z_7)  # disabled
extr = Extrude(Base=move_4.Geometry, Direction=neg_2)  # disabled
srfsplit = SurfaceSplit(Surface=extr, Curves=project_4)  # disabled
center = Center(Geometric=srfsplit, referenceAll=2)  # -> Center, Dimension; disabled
sort_3 = SortList(Keys=center.Center, ValuesA=srfsplit)  # -> Keys, ValuesA; disabled
item_18 = ListItem(List=reverse(sort_3.ValuesA), Index=0, Wrap=True)  # disabled

# ----
dam_type_8 = RemoteReceiver(dam_type_2)
c_script = CSharpScript()  # -> out, solidDifferenceBrepList; inputs bListFrom: list of Brep, flip: Boolean, bListTo: list of Brep; disabled
# ---------- c_script: C# ----------
    bListFrom = bListFrom.Where(x => x != null && x.IsValid && x.IsSolid).ToList();
    if(!bListFrom.Any()) return;

    bListTo = bListTo.Where(x => x != null && x.IsValid && x.IsSolid).ToList();
    if(!bListTo.Any()) return;
    double tol = RhinoDoc.ActiveDoc.ModelAbsoluteTolerance;

    List<Brep> bDiffList = new List<Brep>();
    Print(" ");
    Print("Working: {0} From against: {1} To breps", bListFrom.Count, bListTo.Count);
    Print(" ");

    for(int j = 0; j < bListFrom.Count;j++){
      Brep brep = bListFrom[j];
      if(flip)brep.Flip();
      for(int i = 0; i < bListTo.Count;i++){
        Brep b = bListTo[i];
        try{
          brep = Brep.CreateBooleanDifference(brep, b, tol)[0];
          Print("Diff at: {0}, {1} is OK", j, i);
        }
        catch{Print("Diff at: {0}, {1} failed (or breps are apart)", j, i);}
      }
      bDiffList.Add(brep);
    }
    solidDifferenceBrepList = bDiffList;

    Print(" ");
    for(int i = 0; i < bDiffList.Count;i++){
      Brep b = bDiffList[i];
      Print("Result at: {0} has: {1} faces", i, b.Faces.Count);
    }
# ---------- end c_script ----------
dam_type_9 = RemoteReceiver(dam_type_2)
dam_type_10 = RemoteReceiver(dam_type_2)
dam_axis_4 = RemoteReceiver(dam_axis)
details = ContentDetails(Content=dam_axis_4)  # -> Content, Id, Path, Attributes
water_level_5 = RemoteReceiver(water_level)
vector_to_origin_2 = RemoteReceiver(vector_to_origin)
concat = Concatenate(FragmentA="Water", FragmentB=water_level_5, FragmentC=dam_name_translation_2, FragmentD=details.Path, JoinSeparator="_")
num_3 = Number()
panel_32 = Panel(concat)
dam_axis_5 = RemoteReceiver(dam_axis)
# Fields
water_level_6 = RemoteReceiver(water_level)
details_2 = ContentDetails(Content=dam_axis_5)  # -> Content, Id, Path, Attributes
fields_water_2 = RemoteReceiver(fields_water)
load = Load(ForceVector=Vector(0, 0, 1), Weighting=1)
jagged_3 = SettingsSpeed()
dam_axis_6 = RemoteReceiver(dam_axis)
panel_33 = Panel("""Water level:
{0}
Dam crest level: 
{1}
Level foundation:
{2}
Arch dam height:
{3}
Straight axis lenght - to terrain:
{4}
Straight axis lenght - to bottom foundation:
{5}
Arch dam axis length - to bottom foundation:
{6}
Volume arch dam:
{7}""")
water_level_7 = RemoteReceiver(water_level)
information = ContentInformation(Content=dam_axis_6)  # -> Content, Parent, Name, Notes
concat_2 = Concatenate(FragmentA="BG + 20m for radius", FragmentB=water_level_7, JoinSeparator="-")
panel_34 = Panel(information.Name)
axis_straight_terrain_2 = RemoteReceiver(axis_straight_terrain)
pdecon_2 = Deconstruct()  # -> XComponent, YComponent, ZComponent
path_save_2 = RemoteReceiver(path_save)
vector_to_origin_3 = RemoteReceiver(vector_to_origin)
panel_35 = Panel("""Top
Perspective
Front
Right""")
geo_8 = Geometry()
water_level_8 = RemoteReceiver(water_level)
dam_level_3 = RemoteReceiver(dam_level)
len_2 = Length(Curve=geo_8)
water_level_9 = RemoteReceiver(water_level)
dam_level_4 = RemoteReceiver(dam_level)
captureview = LBCaptureView(
    file_name=concat_2,
    folder=path_save_2,
    viewport=panel_35,
    width="3840",
    height="2160",
    mode="Wireframe",
    capture=Button())  # -> file; plug-in component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
panel_36 = Panel("""Water level
Dam crest level 
Level foundation
Dam height
Straight axis lenght - to terrain
Straight axis lenght - to bottom foundation
Arch dam axis length - to bottom foundation
Volume arch dam""")
panel_37 = Panel("""Field's names
Values""")
path_save_3 = RemoteReceiver(path_save)
vector_to_origin_4 = RemoteReceiver(vector_to_origin)
concat_3 = Concatenate(FragmentA=concat_2, FragmentB="_water")
panel_38 = Panel(path_save_3)
num_4 = Number()
concat_4 = Concatenate(FragmentA=panel_38, FragmentB="ArcGIS", JoinSeparator="\")
panel_39 = Panel("https://epsg.io/2056")
srs = SetSpatialReferenceSystem(SRS="EPSG:2056")
panel_40 = Panel(concat_3)

dam_axis_7 = RemoteReceiver(dam_axis)

point_upstream = RemoteSender(pipeline)

point_upstream_2 = RemoteReceiver(point_upstream)
crv_cp = CurveClosestPoint(Point=point_upstream_2, Curve=dam_axis_7)  # -> Point, Parameter, Distance
vec2pt_2 = Vector2Pt(PointA=point_upstream_2, PointB=crv_cp.Point, Unitize=False)  # -> Vector, Length

vdisex = VectorDisplayEx(Point=point_upstream_2, Vector=vec2pt_2.Vector, Colour=RGB(0, 0, 0), Width=2)  # disabled
# For optimization: Make perpendicular
# sections on the river line to discover
# best placement for the Dams.
panel_41 = Panel(vec2pt_2.Vector)

vector_waterflow = RemoteSender(vec2pt_2.Vector)

# ----
# vector
vector_waterflow_2 = RemoteReceiver(vector_waterflow)
# vector
vector_waterflow_3 = RemoteReceiver(vector_waterflow)

# ----
# EMBANKMENT DAM
# Top
# Concrete dam settings
# Final volume
midpt = CurveMiddle(Curve=chord_dam_2)  # disabled
project_5 = Project(Curve=chord_dam_2, Brep=brep_terrain_base_foundation_3, Direction=Vector(0, 0, 1))  # disabled
end_2 = EndPoints(Curve=chord_dam_2)  # -> Start, End; disabled
x_tremez = Extremes(Curve=project_5, Plane=PlaneXY(0, 0, 0))  # -> Highest, Lowest; disabled
pdecon_3 = Deconstruct(Point=x_tremez.Lowest)  # -> XComponent, YComponent, ZComponent; disabled
pdecon_4 = Deconstruct(Point=midpt)  # -> XComponent, YComponent, ZComponent; disabled
subtraction = Subtraction(A=pdecon_4.ZComponent, B=pdecon_3.ZComponent)  # disabled
multiplication_3 = Multiplication(A=subtraction, B=1.5)  # disabled
panel_42 = Panel("{0,0,-1}")  # disabled
atan = ArcTangent(Value=embankment_ds_ration_2)  # disabled
line = LineSDL(Start=end_2.Start, Direction=panel_42, Length=multiplication_3)  # disabled
rotax = RotateAxis(Geometry=line, Angle=atan, Axis=chord_dam_2)  # -> Geometry, Transform; disabled
neg_3 = Negative(Value=atan)  # disabled
rotax_2 = RotateAxis(Geometry=line, Angle=neg_3, Axis=chord_dam_2)  # -> Geometry, Transform; disabled
swp1 = Sweep1(Rail=chord_dam_2, Sections=rotax_2.Geometry, Miter=1)  # -> flatten(Brep); disabled
swp1_2 = Sweep1(Rail=chord_dam_2, Sections=rotax.Geometry, Miter=1)  # -> flatten(Brep); disabled
swp1_3 = Sweep1(Rail=chord_dam_2, Sections=line, Miter=1)  # -> flatten(Brep); disabled
embankment_face_collision = RemoteSender(swp1)  # disabled
entwine = Entwine(Branch00=swp1, Branch01=swp1_3, Branch02=swp1_2, FlattenInputs=True)  # -> simplify(Result); disabled
bbx = BrepBrep(BrepA=entwine, BrepB=brep_terrain_base_foundation_3)  # -> Curves, Points; disabled
geo_9 = Geometry(bbx.Curves)  # disabled
explode_3 = Explode(Curve=geo_9, Recursive=False)  # -> Segments, Vertices; disabled
pline_2 = PolyLine(Vertices=explode_3.Vertices, Closed=False)  # disabled
lng_2 = ListLength(List=explode_3.Vertices)  # disabled
number_slider_3 = Slider(0.1, range=0..1)  # disabled
panel_43 = Panel("2")  # disabled
division = Division(A=embankment_width_crest_2, B=panel_43)  # disabled
smoothpline = SmoothPolyline(Polyline=pline_2, Strength=number_slider_3, Times=lng_2)  # disabled
amp = Amplitude(Vector=vector_waterflow_2, Amplitude=division)  # disabled
srfsplit_2 = SurfaceSplit(Surface=entwine, Curves=smoothpline)  # disabled
neg_4 = Negative(Value=amp)  # disabled
center_2 = Center(Geometric=srfsplit_2, referenceAll=2)  # -> Center, Dimension; disabled
merge_4 = Merge(Data1=neg_4, Data2=amp)  # -> flatten(Result); disabled
pt_2 = Point(midpt)  # disabled
sort_4 = SortList(Keys=center_2.Dimension, ValuesA=srfsplit_2)  # -> Keys, ValuesA; disabled
move_5 = Move(Geometry=pt_2, Motion=merge_4)  # -> Geometry, Transform; disabled
item_19 = ListItem(List=sort_4.ValuesA, Index=0, Wrap=True)  # -> simplify(Item); disabled
loft = Loft(
    Curves=flatten(smoothpline),
    Options={Adjust=True, Closed=False, LoftEnds=0, LoftSimp=2, LoftType=5, Rebuild=10, Refit=0.01})  # disabled
simplify = SimplifyTree(Tree=smoothpline, Front=False)  # disabled
bang = ExplodeTree(Data=item_19)  # -> Branch0, Branch1, Branch2; disabled
geo_10 = Geometry([bang.Branch0, bang.Branch2])  # disabled
unflatten = UnflattenTree(Tree=move_5.Geometry, Guide=geo_10)  # disabled
tstat = TreeStatistics(Tree=geo_10)  # -> Paths, Length, Count; disabled
dup_2 = DuplicateDataMatch(SourceDataTree=pt_2, SecondaryData1=unflatten)  # -> SourceData, SecondaryData1; disabled
panel_44 = Panel("0,0,-1")  # disabled
branch = TreeBranch(Tree=simplify, Path=tstat.Paths, MaintainPaths=True)  # disabled
join_3 = BrepJoin(Breps=flatten([geo_10, loft]))  # -> Breps, Closed; disabled
project_6 = ProjectPoint(Point=unflatten, Direction=panel_44, Geometry=geo_10)  # -> Point, Index; disabled
pline_3 = PolyLine(Vertices=[unflatten, project_6.Point, dup_2.SourceData], Closed=True)  # disabled
number_slider_4 = Slider(100, range=0..100)  # disabled
dup_3 = DuplicateDataMatch(SourceDataTree=chord_dam_2, SecondaryData1=pline_3, Clean_Tree=True)  # -> SourceData, SecondaryData1; disabled
move2pt = MoveToPoint(Geometry=pline_3, PointA=pt_2, PointB=end_2.Start)  # -> Moved, Vector, Transform; disabled
Z_9 = UnitZ(Factor=number_slider_4)  # disabled
swp1_4 = Sweep1(Rail=dup_3.SourceData, Sections=move2pt.Moved, Miter=1)  # disabled
extr_2 = Extrude(Base=branch, Direction=Z_9)  # disabled
split = SplitBrep(Brep=swp1_4, Cutter=extr_2)  # disabled
center_3 = Center(Geometric=split, referenceAll=2)  # -> Center, Dimension; disabled
sort_5 = SortList(Keys=center_3.Dimension, ValuesA=split)  # -> Keys, reverse(ValuesA); disabled
item_20 = ListItem(List=sort_5.ValuesA, Index=0, Wrap=True)  # disabled
capex = CapHolesEx(Brep=item_20)  # -> Brep, Caps, Solid; disabled
sunion = SolidUnion(Breps=flatten([capex.Brep, join_3.Breps]))  # disabled
jagged_4 = SettingsSpeed()  # disabled
mesh_11 = MeshBrep(Brep=sunion, Settings=jagged_4)  # disabled
objfromgroup_3 = GetObjectsInGroup()

# ----
# GRAVITY DAM
# Top
# Concrete dam settings
# Final volume
midpt_2 = CurveMiddle(Curve=chord_dam_3)  # disabled
project_7 = Project(Curve=chord_dam_3, Brep=brep_terrain_base_foundation_4, Direction=Vector(0, 0, 1))  # disabled
end_3 = EndPoints(Curve=chord_dam_3)  # -> Start, End; disabled
x_tremez_2 = Extremes(Curve=project_7, Plane=PlaneXY(0, 0, 0))  # -> Highest, Lowest; disabled
pdecon_5 = Deconstruct(Point=x_tremez_2.Lowest)  # -> XComponent, YComponent, ZComponent; disabled
pdecon_6 = Deconstruct(Point=midpt_2)  # -> XComponent, YComponent, ZComponent; disabled
subtraction_2 = Subtraction(A=pdecon_6.ZComponent, B=pdecon_5.ZComponent)  # disabled
multiplication_4 = Multiplication(A=subtraction_2, B=1.5)  # disabled
panel_45 = Panel("{0,0,-1}")  # disabled
line_2 = LineSDL(Start=end_3.Start, Direction=panel_45, Length=multiplication_4)  # disabled
atan_2 = ArcTangent(Value=gravity_ds_ration_2)  # disabled
rotax_3 = RotateAxis(Geometry=line_2, Angle=atan_2, Axis=chord_dam_3)  # -> Geometry, Transform; disabled
swp1_5 = Sweep1(Rail=chord_dam_3, Sections=line_2, Miter=1)  # -> flatten(Brep); disabled
swp1_6 = Sweep1(Rail=chord_dam_3, Sections=rotax_3.Geometry, Miter=1)  # -> flatten(Brep); disabled
entwine_2 = Entwine(Branch00=swp1_5, Branch01=swp1_6, FlattenInputs=True)  # -> simplify(Result); disabled
bbx_2 = BrepBrep(BrepA=entwine_2, BrepB=brep_terrain_base_foundation_4)  # -> Curves, Points; disabled
geo_11 = Geometry(bbx_2.Curves)  # disabled
explode_4 = Explode(Curve=geo_11, Recursive=False)  # -> Segments, Vertices; disabled
pline_4 = PolyLine(Vertices=explode_4.Vertices, Closed=False)  # disabled
lng_3 = ListLength(List=explode_4.Vertices)  # disabled
number_slider_5 = Slider(0.2, range=0..1)  # disabled
smoothpline_2 = SmoothPolyline(Polyline=pline_4, Strength=number_slider_5, Times=lng_3)  # disabled
srfsplit_3 = SurfaceSplit(Surface=entwine_2, Curves=smoothpline_2)  # disabled
center_4 = Center(Geometric=srfsplit_3, referenceAll=2)  # -> Center, Dimension; disabled
sort_6 = SortList(Keys=center_4.Dimension, ValuesA=srfsplit_3)  # -> Keys, ValuesA; disabled
amp_2 = Amplitude(Vector=vector_waterflow_3, Amplitude=gravity_width_crest_2)  # disabled
pt_3 = Point(midpt_2)  # disabled
item_21 = ListItem(List=sort_6.ValuesA, Index=0, Wrap=True)  # -> simplify(Item); disabled
loft_2 = Loft(
    Curves=flatten(smoothpline_2),
    Options={Adjust=True, Closed=False, LoftEnds=0, LoftSimp=0, LoftType=5, Rebuild=10, Refit=0.01})  # disabled
simplify_2 = SimplifyTree(Tree=smoothpline_2, Front=False)  # disabled
move_6 = Move(Geometry=pt_3, Motion=amp_2)  # -> Geometry, Transform; disabled
panel_46 = Panel("{1}")  # disabled
join_4 = BrepJoin(Breps=flatten([loft_2, item_21]))  # -> Breps, Closed; disabled
branch_2 = TreeBranch(Tree=simplify_2, Path=panel_46, MaintainPaths=True)  # disabled
branch_3 = TreeBranch(Tree=item_21, Path=panel_46, MaintainPaths=True)  # disabled
panel_47 = Panel("0,0,-1")  # disabled
project_8 = ProjectPoint(Point=move_6.Geometry, Direction=panel_47, Geometry=flatten(branch_3))  # -> Point, Index; disabled
number_slider_6 = Slider(100, range=0..100)  # disabled
pline_5 = PolyLine(Vertices=flatten([pt_3, move_6.Geometry, project_8.Point]), Closed=True)  # disabled
move2pt_2 = MoveToPoint(Geometry=pline_5, PointA=pt_3, PointB=end_3.Start)  # -> Moved, Vector, Transform; disabled
Z_10 = UnitZ(Factor=number_slider_6)  # disabled
swp1_7 = Sweep1(Rail=chord_dam_3, Sections=move2pt_2.Moved, Miter=1)  # disabled
extr_3 = Extrude(Base=branch_2, Direction=Z_10)  # disabled
split_2 = SplitBrep(Brep=extr_3, Cutter=swp1_7)  # disabled
split_3 = SplitBrep(Brep=swp1_7, Cutter=extr_3)  # disabled
center_5 = Center(Geometric=split_2, referenceAll=2)  # -> Center, Dimension; disabled
center_6 = Center(Geometric=split_3, referenceAll=2)  # -> Center, Dimension; disabled
sort_7 = SortList(Keys=center_5.Dimension, ValuesA=split_2)  # -> Keys, reverse(ValuesA); disabled
sort_8 = SortList(Keys=center_6.Dimension, ValuesA=split_3)  # -> Keys, reverse(ValuesA); disabled
cull_i_6 = CullIndex(List=sort_7.ValuesA, Indices=0, Wrap=True)  # disabled
item_22 = ListItem(List=sort_8.ValuesA, Index=0, Wrap=True)  # disabled
join_5 = BrepJoin(Breps=flatten([cull_i_6, item_22]))  # -> Breps, Closed; disabled
sunion_2 = SolidUnion(Breps=[join_4.Breps, join_5.Breps])  # disabled
jagged_5 = SettingsSpeed()  # disabled
mesh_12 = MeshBrep(Brep=sunion_2, Settings=jagged_5)  # disabled
objfromgroup_4 = GetObjectsInGroup()

vector_waterflow_4 = RemoteReceiver(vector_waterflow)  # disabled
point_upstream_3 = RemoteReceiver(point_upstream)
hops_2 = Hops(
    BrepTerrain=brep_terrain_base_foundation_5,
    ChordDam=chord_dam_4,
    DSRatio=gravity_ds_ration_3,
    VectorWaterflow=vector_waterflow_4,
    WidthCrest=width_crest,
    CacheResultsInMemory=False,
    CacheSolveResults=False,
    RemoteDefinitionLocation="C:\Users\Admin\Documents\Github\EarlyStageDesign\JD\Skripts\Modules\Gravity.gh",
    RemoteSolveVersion=(0, 1, 0),
    ShowInput_Enabled=False,
    ShowInput_Path=True,
    SynchronousSolve=True)  # -> Geo, Volume; disabled

# ----
# Steps from the Technical Memorandum
#  No. EM36-86-68110
dam_6 = DataDam(
    DataChordToBaseFoundation=chord_dam_5,
    DataBaseFoundationTerrain=brep_terrain_base_foundation_6,
    DataPointUpstream=point_upstream_3,
    DataChord_dam=chord_dam_6,
    BufferDelay=10000000,
    BufferMode=0)  # -> DataChordToBaseFoundation, DataBaseFoundationTerrain, DataPointUpstream, DataChord_dam
objfromgroup_5 = GetObjectsInGroup()

setobj_3 = SetObjectValue(ObjectToSet=objfromgroup_5, ValueToSet=run_archdam_2)
arch_dam_base_foundation_terrain = RemoteSender(dam_6.DataBaseFoundationTerrain)
chord_l1 = RemoteSender(dam_6.DataChord_dam)
chord_l1_2 = RemoteReceiver(chord_l1)
# 1. Determine L1 with section line
end_4 = EndPoints(Curve=chord_l1_2)  # -> Start, End
# On the formulas it is assumed here
# the lenght to excavated sound rock!
# Check technical memorandum. I have
#  changed the axis line to come from the
#  determined excavation on 06.06.23
dist = Distance(PointA=end_4.Start, PointB=end_4.End)
arch_l1 = RemoteSender(dist)
arch_l1_2 = RemoteReceiver(arch_l1)
arch_l1_3 = RemoteReceiver(arch_l1)
arch_dam_base_foundation_terrain_2 = RemoteReceiver(arch_dam_base_foundation_terrain)
arch_dam_base_foundation_terrain_3 = RemoteReceiver(arch_dam_base_foundation_terrain)
volume_5 = MeshVolume(Mesh=mesh_11)  # -> Volume, Centroid
volume_6 = MeshVolume(Mesh=mesh_12)  # -> Volume, Centroid
onoff = EnableDisableObject(
    Objects=objfromgroup_3,
    Enabled=equals.Equality,
    AllObjects_Object=[line, panel_42, end_2, rotax, atan, x_tremez, project_5, pdecon_4, pdecon_3, subtraction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])
onoff_2 = EnableDisableObject(
    Objects=objfromgroup_4,
    Enabled=equals_2.Equality,
    AllObjects_Object=[line_2, panel_45, end_3, rotax_3, atan_2, x_tremez_2, project_7, pdecon_6, pdecon_5, subtraction_2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])
geo_enbankmentdam = RemoteSender(mesh_11)
geo_concretedam = RemoteSender(mesh_12)
round = Round(Number=volume_5.Volume)  # -> Nearest, Floor, Ceiling
format = Format(Format="{0:#0,000}", Culture=2055, Data0=volume_5.Volume)
round_2 = Round(Number=volume_6.Volume)  # -> Nearest, Floor, Ceiling
format_2 = Format(Format="{0:#0,000}", Culture=2055, Data0=volume_6.Volume)
num_5 = Number(format_2)
panel_48 = Panel(round.Nearest)
panel_49 = Panel(format)
panel_50 = Panel(round_2.Nearest)
panel_51 = Panel(format_2)
move_7 = Move(Geometry=project_7, Motion=Z_6)  # -> Geometry, Transform; disabled
crv = Curve(move_7.Geometry)  # disabled
ccx_2 = CurveCurve(CurveA=crv, CurveB=dam_5.DataLevelsAtWaterHeight)  # -> Points, ParamsA, ParamsB; disabled
geo_enbankmentdam_2 = RemoteReceiver(geo_enbankmentdam)
geo_concretedam_2 = RemoteReceiver(geo_concretedam)
shatter_3 = Shatter(Curve=crv, Parameters=ccx_2.ParamsA)  # disabled
dispatch_8 = Dispatch(List=shatter_3, DispatchPattern=[True, False])  # -> ListA, ListB; disabled
join_6 = JoinCurves(Curves=flatten([dispatch_8.ListB, dispatch_7.ListB]), Preserve=False)  # disabled

# ---- group: Water_top part
move_8 = Move(Geometry=dam_5.DataFlatBase, Motion=Z_7)  # -> Geometry, Transform; disabled
srfsplit_4 = SurfaceSplit(Surface=move_8.Geometry, Curves=join_6)  # disabled
center_7 = Center(Geometric=srfsplit_4, referenceAll=2)  # -> Center, Dimension; disabled
sort_9 = SortList(Keys=center_7.Dimension, ValuesB=srfsplit_4, ValuesA=center_7.Center)  # -> Keys, ValuesB, ValuesA; disabled
item_23 = ListItem(List=sort_9.ValuesB, Index=0, Wrap=True)  # disabled

# ----
arch_dam_base_foundation_terrain_4 = RemoteReceiver(arch_dam_base_foundation_terrain)

# ---- group: Water_bottom part
srfsplit_5 = SurfaceSplit(Surface=dam_5.DataBrepTerrain, Curves=join_6)  # -> flatten(Fragments); disabled
item_24 = ListItem(List=sort_9.ValuesA, Index=0, Wrap=True)  # disabled
flatten = FlattenTree(Tree=srfsplit_5, Path="{0}")  # disabled
project_9 = ProjectPoint(Point=item_24, Direction=Vector(0, 0, -1), Geometry=flatten)  # -> Point, Index; disabled
item_25 = ListItem(List=flatten, Index=project_9.Index, Wrap=True)  # disabled

# ----
brep_2 = Brep(flatten([item_18, item_23, item_25]))  # disabled
join_7 = BrepJoin(Breps=flatten(brep_2))  # -> Breps, Closed; disabled

# ----
# Preliminary layout of concrete arch dams (USBR)
# Topographic deiminesions necessary to
# compute thicknesses, projections, and
# volume are:
# - structural height (H)
# - horizontal distances between abutments;
#      - including estimated excavation to sound rock at crest elevation (L1)
#      - and 15 % of H above base (L2)
# Definitions: H = structural height
# Tc = thickness at crest
# Tb = thickness at base
# T_0.45H = thickness of crown cantilever at 0.45H above base (T0.45H)
# USP = upstream projection
# DSP = downestream projection
# L1 = straight line distance at crest elevation between abutmenets assumed excavated to sound rock
# L2 = straight line distance, at 0.15H above base, between abutments assumed excavated to sound rock
# V = estimated volume of dam
# Formulas - conservative as compared with values computed more precisely (in feet)
# at crest:
# at  base
# at 0.45H
arch_l1_4 = RemoteReceiver(arch_l1)
arch_l1_current_m = Panel(arch_l1_4)
panel_52 = Panel("USPcrest = 0.0")
panel_53 = Panel("DSPcrest = Tc")
# Technical Memorandum No. EM36-86-68110: 2.1.3.1 Single-, Two-, or Three- Centered Arch Dams
# 
# The number of lines-of-centers determines whether the arches are the same on the left and right side of the dam, are different on the left and right sides of the dam, or different on the inner and outer parts of the dam.
# 
# A single centered arch dam has a single line-of-centers that results in the same circular arcs from the left to the right abutment.
# 
# A 2-centered arch dam has two lines-of-centers that result in different circular arcs for the left side and right sides of the dam.
# 
# A 3-centered arch dam has two lines-of-centers that result in different circular arcs near the crown cantilever (inner) and near the abutments (outer). The radii for the inner arcs are shorter than the outer arcs.
panel_54 = Panel(" 1 foot = 0.3048 m")

expression = Expression(m=arch_l1_current_m, Expression="m*3.28084")

l1_feet = Panel(expression)
expression_2 = Expression(L1=l1_feet, Expression="0.6*L1")
r_axis_feet = Panel(expression_2)

expression_3 = Expression(ft=r_axis_feet, Expression="ft*0.3048")

r_axis_m = Panel(expression_3)
crest_radius = RemoteSender(r_axis_m)

crest_radius_2 = RemoteReceiver(crest_radius)
crest_radius_3 = RemoteReceiver(crest_radius)
# Technical Memorandum No. EM36-86-68110: 4.2 Determine an Appraisal Level Arch Dam Layout
# 
# 3 - If the topography map is of the ground surface, change the contours to represent the position of sound rock.
crest_radius_4 = RemoteReceiver(crest_radius)

# ----
# Technical Memorandum No. EM36-86-68110: 4.2 Determine an Appraisal Level Arch Dam Layout
# 
# 2 - Determine Raxis= 0.6 L1 and round the value of Raxis up to the nearest 10 to 50 feet.
# This is the initial layout, so no need for decimal accuracy
r_crest_usp = Panel(crest_radius_4)

# ----
# 2. Determine radius according to L1
addition_2 = Addition(A=r_crest_usp, B=raxis_adjustments)

# ----
# 3. Create crest curve
end_5 = EndPoints(Curve=dam_6.DataChordToBaseFoundation)  # -> Start, End
cir = Circle(Plane=end_5.Start, Radius=addition_2)
cir_2 = Circle(Plane=end_5.End, Radius=addition_2)
ccx_3 = CurveCurve(CurveA=cir, CurveB=cir_2)  # -> Points, ParamsA, ParamsB
dist_2 = Distance(PointA=ccx_3.Points, PointB=dam_6.DataPointUpstream)
sort_10 = SortList(Keys=dist_2, ValuesA=ccx_3.Points)  # -> reverse(Keys), reverse(ValuesA)
item_26 = ListItem(List=sort_10.ValuesA, Index=0, Wrap=True)  # -> Item, Item1
circle = CircleCNR(Center=item_26.Item, Normal=Vector(0, 0, 1), Radius=addition_2)
ln_3 = Line(StartPoint=item_26.Item, EndPoint=item_26.Item1)
ccx_4 = CurveCurve(CurveA=dam_6.DataChordToBaseFoundation, CurveB=circle)  # -> Points, ParamsA, ParamsB
shatter_4 = Shatter(Curve=circle, Parameters=ccx_4.ParamsB)
colom = CollisionOneMany(Collider=ln_3, Obstacles=shatter_4)  # -> Collision, Index
item_27 = ListItem(List=shatter_4, Index=colom.Index, Wrap=True)

# ---- group: Axis arch Dam
# Technical Memorandum No. EM36-86-68110: 4.2 Determine an Appraisal Level Arch Dam Layout
# 
# 4 - Position the dam in the canyon. Draw a circular arc with radius Raxis...This arc is the axis of the dam and is the upstream side of the crest. Move the axis around the propose dam location to
# position the top of the dam in the canyon.
# 
# The angle of incidence of the axis into the left and right abutments should be approximately equal to produce a geometrically symmetric dam in the canyon.
geo_12 = Geometry(item_27)

# ----
usp_arch_crest = RemoteSender(geo_12)
usp_arch_crest_2 = RemoteReceiver(usp_arch_crest)
usp_arch_crest_3 = RemoteReceiver(usp_arch_crest)
usp_arch_crest_4 = RemoteReceiver(flatten(usp_arch_crest))
path_mapper_2 = PathMapper(usp_arch_crest_4, source="{A}", target="{0;A}")
usp_arch_crest_5 = RemoteReceiver(usp_arch_crest)
len_3 = Length(Curve=usp_arch_crest_5)

# ---- group: Lowest point (Base - middle section)
project_10 = Project(Curve=usp_arch_crest_2, Brep=arch_dam_base_foundation_terrain_3, Direction=Vector(0, 0, 1))

# ----
eval = EvaluateCurve(Curve=reparameterize(project_10), Parameter=Slider(0.58, range=0..1))  # -> Point, Tangent, Angle

# ----
# 4. Figure L2
darc = DeconstructArc(Arc=usp_arch_crest_2)  # -> flatten(BasePlane), Radius, Angle
x_tremez_3 = Extremes(Curve=project_10, Plane=PlaneXY(0, 0, 0))  # -> Highest, Lowest

# ---- group: Lowest point (Base - middle section) (continued)
# Technical Memorandum No. EM36-86-68110: 4.2 Determine an Appraisal Level Arch Dam Layout
# 
# 5 - On the axis, locate a point about midway between the abutments and in the riverbed. This is the location of the crown cantilever...
pt_4 = Point(x_tremez_3.Lowest)

# ----
project_11 = Project(Geometry=pt_4, Plane=darc.BasePlane)  # -> Geometry, Transform
ln_4 = Line(StartPoint=pt_4, EndPoint=project_11.Geometry)
eval_2 = EvaluateCurve(Height=reparameterize(ln_4), Point_at_015H="0.15")  # -> Point, Tangent, Angle
len_4 = Length(Curve=ln_4)

# ---- group: Centrifugal vector
pt_5 = Point(darc.BasePlane)
pt_6 = Point(project_11.Geometry)
vec2pt_3 = Vector2Pt(PointA=pt_6, PointB=pt_5, Unitize=True)  # -> Vector, Length

# ----
vec2pt_4 = Vector2Pt(PointA=pt_6, PointB=eval_2.Point, Unitize=False)  # -> Vector, Length
move_9 = Move(Geometry=usp_arch_crest_2, Motion=vec2pt_4.Vector)  # -> Geometry, Transform
bcx = BrepCurve(Brep=arch_dam_base_foundation_terrain_3, Curve=move_9.Geometry)  # -> Curves, flatten(Points)
crv_cp_2 = CurveClosestPoint(Point=bcx.Points, Curve=move_9.Geometry)  # -> Point, Parameter, Distance
shatter_5 = Shatter(Curve=move_9.Geometry, Parameters=crv_cp_2.Parameter)
colom_2 = CollisionOneMany(Collider=eval_2.Point, Obstacles=shatter_5)  # -> Collision, Index
item_28 = ListItem(List=shatter_5, Index=colom_2.Index, Wrap=True)
end_6 = EndPoints(Curve=item_28)  # -> Start, End
dist_3 = Distance(PointA=end_6.Start, PointB=end_6.End)

# ----
# Technical Memorandum No. EM36-86-68110: 4.2 Determine an Appraisal Level Arch Dam Layout
# 
# 5 - ...The radius of the axis at this point is the orientation of the reference plane and the line of centers. The reference plane is a vertical plane through the crown cantilever and generally parallel to the stream bank.
ln_5 = Line(StartPoint=pt_6, EndPoint=pt_5)

project_12 = Project(Geometry=ln_5, Plane=pt_4)  # -> Geometry, Transform
rulesrf = RuledSurface(CurveA=project_12.Geometry, CurveB=ln_5)

srf = Surface(rulesrf)
evalsrf = EvaluateSurface(Surface=reparameterize(srf), Point="0.5,0.5")  # -> Point, Normal, UDirection, VDirection, Frame
amp_3 = Amplitude(Vector=evalsrf.Normal, Amplitude=Slider(50, range=0..100))
vdisex_2 = VectorDisplayEx(Point=evalsrf.Point, Vector=amp_3, Colour=RGB(0, 0, 0), Width=2)

pl = PlaneNormal(Origin=evalsrf.Point, ZAxis=evalsrf.Normal)
ext = ExtendCurve(Curve=project_12.Geometry, Type=0, Start=500, End=500)
crv_2 = Curve(ext)
geo_13 = Geometry(ln_4)
abiscissa_dam_axis = RemoteSender(crv_2)
center_crest = RemoteSender(pt_5)
arch_dam_height = RemoteSender(len_4)
arch_dam_height_2 = RemoteReceiver(arch_dam_height)
arch_dam_height_3 = RemoteReceiver(arch_dam_height)
arch_l2 = RemoteSender(dist_3)
reference_centers_plane = RemoteSender(pl)
refecenre_centers_vector = RemoteSender(evalsrf.Normal)
centrifugal_vector = RemoteSender(vec2pt_3.Vector)
centrifugal_vector_2 = RemoteReceiver(centrifugal_vector)

# ----
# x. Elevations
# Technical Memorandum No. EM36-86-68110: 4.2 Determine an Appraisal Level Arch Dam Layout
# 
# 9. Select 6 to 8 arch elevations on the crown cantilever to define the 3D dam. Select the lowest arch elevation starting at about 15% H. Then between 15% H and the crest, try to select 6 to 8 arches evenly spaced vertically and rounded to nearest contour elevation.
# E. Goulas: According to the Engineer Manual [1], the dam is divided into 5 to 10 evenly spaced horizontal arches and their respective parabolas are computed. They should be spaced not less than 3.048 meters (10 feet) nor more than 30.48 meters (100 feet) apart. The lowest parabola should be 0.15H to 0.20H above the base.
# DESIGN MANUAL FOR CONCRETE ARCH DAMS, 1977: Usually 5 to 10 arch elevations are selected such that the  entire dam is represented by a system of horizontal elements evenly spaced over the
# height of the structure.
# Usually the intervals are not greater than 100 (30.5m) feet nor less than 20 feet (6.1m).
# Technical Memorandum No. EM36-86-68110: Select the lowest arch elevation starting at about 15% H. Then between 15% H and the crest, try to select 6 to 8 arches evenly spaced vertically and rounded to nearest contour
# elevation. Even spacing arches permit best evaluation of the ADSAS results.
# EM_1110-2-2201_ARCH_DAM_DESIGN: The
# lowest arch should be 0.15H to 0.20H above the base of the crown cantilever.
section_height_approx = Slider(11, range=6..30)
arch_dam_height_4 = RemoteReceiver(arch_dam_height)
eval_3 = EvaluateCurve(Height=reparameterize(ln_4), Point_at_015H="0.2")  # -> Point, Tangent, Angle
flip = FlipCurve(Curve=ln_4)  # -> Curve, Flag
expression_4 = Expression(section_heights=section_height_approx, height=arch_dam_height_4, Expression="height/section_heights")
shatter_6 = Shatter(Curve=reparameterize(ln_4), Parameters="0.2")
item_29 = ListItem(List=shatter_6, Index="1", Wrap=True)
len_5 = Length(Curve=item_29)
expression_5 = Expression(section_heights=section_height_approx, height=len_5, Expression="height/section_heights")
round_3 = Round(Number=expression_4)  # -> Nearest, Floor, Ceiling
eval_4 = EvaluateCurve(Height=reparameterize(ln_4), PointAt0="0")  # -> Point, Tangent, Angle
divide = DivideCurve(Curve=flip.Curve, Count=round_3.Nearest, Kinks=False)  # -> Points, Tangents, Parameters
pt_7 = Point(flatten(divide.Points))
pdecon_7 = Deconstruct(Point=pt_7)  # -> XComponent, YComponent, ZComponent
round_4 = Round(Number=expression_5)  # -> Nearest, Floor, Ceiling
divide_2 = DivideCurve(Curve=item_29, Count=round_4.Nearest, Kinks=False)  # -> Points, Tangents, Parameters
division_2 = Division(A=len_5, B=round_4.Nearest)  # -> flatten(Result)
pt_8 = Point(flatten([divide_2.Points, eval_4.Point]))
pdecon_8 = Deconstruct(Point=pt_8)  # -> XComponent, YComponent, ZComponent
section_height_actual = Panel(division_2)
sort_11 = SortList(Keys=pdecon_7.ZComponent, ValuesA=pt_7)  # -> reverse(Keys), reverse(ValuesA)
sort_12 = SortList(Keys=pdecon_8.ZComponent, ValuesA=pt_8)  # -> reverse(Keys), reverse(ValuesA)
cull_i_7 = CullIndex(List=sort_12.ValuesA, Indices=0, Wrap=True)
pln_5 = Plane(simplify(graft(cull_i_7)))

item_30 = ListItem(List=sort_12.ValuesA, Index=0, Wrap=True)
pln_6 = Plane(simplify(graft(item_30)))
crest_plane_elevation = RemoteSender(pln_6)
plane_elevations = RemoteSender(pln_5)
refecenre_centers_vector_2 = RemoteReceiver(refecenre_centers_vector)
reference_centers_plane_2 = RemoteReceiver(reference_centers_plane)
center_crest_2 = RemoteReceiver(center_crest)
plane_elevations_2 = RemoteReceiver(plane_elevations)
refecenre_centers_vector_3 = RemoteReceiver(refecenre_centers_vector)
plane_elevations_3 = RemoteReceiver(plane_elevations)
reference_centers_plane_3 = RemoteReceiver(reference_centers_plane)
plane_elevations_4 = RemoteReceiver(plane_elevations)
arch_dam_height_5 = RemoteReceiver(arch_dam_height)
arch_dam_height_6 = RemoteReceiver(arch_dam_height)

# ----
# Formulas - conservative as compared with values computed more precisely (in feet)
arch_dam_height_7 = RemoteReceiver(arch_dam_height)
# Do concrete formula estimation to check
# how different they are from the volume in gh
# check memoradum
arch_l2_2 = RemoteReceiver(arch_l2)
arch_l2_current_m = Panel(arch_l2_2)
meter = Panel(arch_dam_height_7)

expression_6 = Expression(m=meter, Expression="m*3.28084")
expression_7 = Expression(m=arch_l2_current_m, Expression="m*3.28084")

l2_feet = Panel(expression_7)
feet = Panel(expression_6)
expression_8 = Expression(H=feet, L1=l1_feet, Expression="0.01*(H + 1.2*L1)")
expression_9 = Expression(H=feet, L1=l1_feet, L2=l2_feet, Expression="(0.0012*H*L1*L2*((H/400)^(H/400)))^(⅓)")
expression_10 = Expression(Tb=expression_9, Expression="0.67*Tb")
expression_11 = Expression(Tb=expression_9, Expression="0.33*Tb")
expression_12 = Expression(Tb=expression_9, Expression="0.95*Tb")
expression_13 = Expression(H=feet, L1=l1_feet, L2=l2_feet, Expression="0.000002*(H²)*L2*(((H+0.8*L1)²)/(L1-L2))+0.0004*H*L1*(H+1.1*L1)")
tc_feet = Panel(expression_8)
usp_base_feet = Panel(expression_10)
dsp_base_feet = Panel(expression_11)
tb_0_45h_feet = Panel(expression_12)

expression_14 = Expression(ft=usp_base_feet, Expression="ft*0.3048")
expression_15 = Expression(ft=tc_feet, Expression="ft*0.3048")
expression_16 = Expression(ft=dsp_base_feet, Expression="ft*0.3048")
expression_17 = Expression(ft=tb_0_45h_feet, Expression="ft*0.3048")

usp_base_m = Panel(expression_14)
dsp_base_m = Panel(expression_16)
tb_0_45h_m = Panel(expression_17)
tc_m = Panel(expression_15)
arch_usp_at_045h = RemoteSender(tb_0_45h_m)
arch_usp_base = RemoteSender(usp_base_m)
arch_dsp_base = RemoteSender(dsp_base_m)
arch_tc = RemoteSender(tc_m)

arch_usp_at_045h_2 = RemoteReceiver(arch_usp_at_045h)
arch_usp_base_2 = RemoteReceiver(arch_usp_base)
arch_dsp_base_2 = RemoteReceiver(arch_dsp_base)
arch_tc_2 = RemoteReceiver(arch_tc)
arch_usp_at_045h_3 = RemoteReceiver(arch_usp_at_045h)
arch_usp_base_3 = RemoteReceiver(arch_usp_base)
arch_dsp_base_3 = RemoteReceiver(arch_dsp_base)
arch_tc_3 = RemoteReceiver(arch_tc)
format_3 = Format(
    Format=panel_26,
    Culture=127,
    Data0=crest_radius_2,
    Data1=arch_l1_2,
    Data2=arch_tc_2,
    Data3=arch_dam_height_2,
    Data4=arch_usp_base_2,
    Data5=arch_dsp_base_2,
    Data6=arch_usp_at_045h_2,
    Data7=expression_13,
    Data8=raxis_adjustments,
    Data9=addition_2,
    Data10=freeboard_2,
    Data11=offset_foundation_2)
format_4 = Format(
    Format=panel_27,
    Culture=127,
    Data0=crest_radius_3,
    Data1=arch_l1_3,
    Data2=arch_tc_3,
    Data3=arch_dam_height_3,
    Data4=arch_usp_base_3,
    Data5=arch_dsp_base_3,
    Data6=arch_usp_at_045h_3,
    Data7=expression_13,
    Data8=raxis_adjustments,
    Data9=addition_2,
    Data10=freeboard_3,
    Data11=offset_foundation_3)
panel_55 = Panel(format_3)
panel_56 = Panel(format_4)
assumptions = RemoteSender(panel_56)
arch_tc_4 = RemoteReceiver(arch_tc)
subtraction_3 = Subtraction(A=addition_2, B=arch_tc_4)
r_crest_dsp = Panel(subtraction_3)
cir_3 = Circle(Plane=item_26.Item, Radius=r_crest_dsp)
scx_3 = SurfaceCurve(Surface=arch_dam_base_foundation_terrain_2, Curve=cir_3)  # -> Curves, Points, UVPoints, Normals, Parameters, Tangents
shatter_7 = Shatter(Curve=cir_3, Parameters=scx_3.Parameters)
colom_3 = CollisionOneMany(Collider=ln_3, Obstacles=shatter_7)  # -> Collision, Index
item_31 = ListItem(List=shatter_7, Index=colom_3.Index, Wrap=True)
dsp_arch_crest = RemoteSender(item_31)
arch_usp_at_045h_4 = RemoteReceiver(arch_usp_at_045h)
arch_tc_5 = RemoteReceiver(arch_tc)
arch_dsp_base_4 = RemoteReceiver(arch_dsp_base)
arch_usp_base_4 = RemoteReceiver(arch_usp_base)

# ---- group: Crown Cantilever
# 5. Section points - based on the equations
# At Base
# At Crest:
# At 0.45H
panel_57 = Panel("0.45")
eval_5 = EvaluateCurve(Height=reparameterize(ln_4), Point_at_045H=panel_57)  # -> Point, Tangent, Angle
neg_5 = Negative(Value=centrifugal_vector_2)
neg_6 = Negative(Value=centrifugal_vector_2)
amp_4 = Amplitude(Vector=centrifugal_vector_2, Amplitude=arch_tc_5)
amp_5 = Amplitude(Vector=neg_6, Amplitude=arch_usp_base_4)
amp_6 = Amplitude(Vector=neg_5, Amplitude=arch_usp_at_045h_4)
amp_7 = Amplitude(Vector=centrifugal_vector_2, Amplitude=arch_dsp_base_4)
move_10 = Move(Geometry=pt_4, Motion=amp_7)  # -> Geometry, Transform
move_11 = Move(Geometry=pt_4, Motion=amp_5)  # -> Geometry, Transform
move_12 = Move(Geometry=project_11.Geometry, Motion=amp_4)  # -> Geometry, Transform
move_13 = Move(Geometry=eval_5.Point, Motion=amp_6)  # -> Geometry, Transform
usp_pt_at_base = Point(move_11.Geometry)
pt_at_crest = Point(project_11.Geometry)
pt_at_0_45h = Point(move_13.Geometry)
pt_at_0_45h_2 = Point(eval_5.Point)
# Technical Memorandum No. EM36-86-68110: 4.2 Determine an Appraisal Level Arch Dam Layout
# 
# 6 - Determine the shape of the crown cantilever. From the equations provided,
# compute TC, TB, T0.45H, USPC, USP0.45H, USPB, DSPC, DSP0.45H, and DSPB.
pt_at_crest_2 = Point(move_12.Geometry)
pt_at_base = Point(move_10.Geometry)
# Technical Memorandum No. EM36-86-68110: 4.2 Determine an Appraisal Level Arch Dam Layout
# 
# 7 - Determine the geometry of the upstream and downstream face along the crown cantilever. A circle can be drawn through the 3 points computed for the upstream face in Step 6. Likewise, a circle can be drawn through the 3 points computed for the
# downstream face.
# 
# 8. Draw the upstream and downstream face along the crown cantilever.
arc = Arc3Pt(PointA=pt_at_crest_2, PointB=pt_at_0_45h_2, PointC=pt_at_base)  # -> DownstreamArc, CenterP, RadiusM
arc_2 = Arc3Pt(PointA=pt_at_crest, PointB=pt_at_0_45h, PointC=usp_pt_at_base)  # -> UpstreamArc, CenterP, RadiusM
us_arc = RemoteSender(arc_2.UpstreamArc)
ds_arc = RemoteSender(arc.DownstreamArc)

# ----
dsp_arch_crest_2 = RemoteReceiver(dsp_arch_crest)
ds_arc_2 = RemoteReceiver(ds_arc)
us_arc_2 = RemoteReceiver(us_arc)

# ----
# x. Dam Footprint
end_7 = EndPoints(Curve=ds_arc_2)  # -> Start, End
end_8 = EndPoints(Curve=us_arc_2)  # -> Start, End
dsp_point_bottom_foundation = Point(end_7.End)
usp_point_bottom_foundation = Point(end_8.End)
end_9 = EndPoints(Curve=dsp_arch_crest_2)  # -> Start, End
end_10 = EndPoints(Curve=usp_arch_crest_3)  # -> Start, End
# Technical Memorandum No. EM36-86-68110: 4.2 Determine an Appraisal Level Arch Dam Layout
# 
# 10. On the topography map, draw the upstream and downstream projections of the crown cantilever and downstream arc at the crest on the reference plane. Using the same radius center as the axis, draw the circular arc for the downstream side of the crest using the radius (Raxis – Tc). On the reference plane draw points at each arch elevation on the upstream and downstream faces.
project_13 = Project(Geometry=dsp_point_bottom_foundation, Plane=end_9.Start)  # -> Geometry, Transform
project_14 = Project(Geometry=usp_point_bottom_foundation, Plane=end_10.Start)  # -> Geometry, Transform
arc_3 = Arc3Pt(PointA=end_9.Start, PointB=project_13.Geometry, PointC=end_9.End)  # -> UpstreamArc, CenterP, RadiusM
arc_4 = Arc3Pt(PointA=end_10.Start, PointB=project_14.Geometry, PointC=end_10.End)  # -> UpstreamArc, CenterP, RadiusM
project_15 = Project(Curve=arc_4.UpstreamArc, Brep=arch_dam_base_foundation_terrain_4, Direction=Vector(0, 0, 1))
project_16 = Project(Curve=arc_3.UpstreamArc, Brep=arch_dam_base_foundation_terrain_4, Direction=Vector(0, 0, 1))
explode_5 = Explode(Curve=project_15, Recursive=False)  # -> Segments, Vertices
explode_6 = Explode(Curve=project_16, Recursive=False)  # -> Segments, Vertices
pline_6 = PolyLine(Vertices=explode_5.Vertices, Closed=False)
pline_7 = PolyLine(Vertices=explode_6.Vertices, Closed=False)
lng_4 = ListLength(List=explode_5.Vertices)
lng_5 = ListLength(List=explode_6.Vertices)
smoothpline_3 = SmoothPolyline(Polyline=pline_6, Strength=Slider(0.5, range=0..1), Times=lng_4)
smoothpline_4 = SmoothPolyline(Polyline=pline_7, Strength=Slider(0.5, range=0..1), Times=lng_5)
dsp_footprint = Curve(smoothpline_4)
usp_footprint = Curve(smoothpline_3)

usp_prefootprint = RemoteSender(usp_footprint)
dsp_prefootprint = RemoteSender(dsp_footprint)
usp_prefootprint_2 = RemoteReceiver(usp_prefootprint)
dsp_prefootprint_2 = RemoteReceiver(dsp_prefootprint)
us_arc_3 = RemoteReceiver(us_arc)
ds_arc_3 = RemoteReceiver(ds_arc)
us_arc_4 = RemoteReceiver(us_arc)
ds_arc_4 = RemoteReceiver(ds_arc)
pcx = CurvePlane(DownstreamArc=ds_arc_4, Plane=plane_elevations_4)  # -> simplify(Points), ParamsC, ParamsP
pcx_2 = CurvePlane(UpstreamArc=us_arc_4, Plane=plane_elevations_4)  # -> simplify(Points), ParamsC, ParamsP
dsp_arch_crest_3 = RemoteReceiver(flatten(dsp_arch_crest))
path_mapper_3 = PathMapper(dsp_arch_crest_3, source="{A}", target="{1;A}")
usp_prefootprint_3 = RemoteReceiver(usp_prefootprint)
dsp_prefootprint_3 = RemoteReceiver(dsp_prefootprint)
dam_pre_footprint = Curve([usp_prefootprint_3, dsp_prefootprint_3])
assumptions_2 = RemoteReceiver(assumptions)
split_4 = TextSplit(Text=flatten(assumptions_2), Separators=":")
dispatch_9 = Dispatch(List=split_4, DispatchPattern=[True, False])  # -> flatten(ListA), flatten(ListB)
trim = TextTrim(Text=dispatch_9.ListB, Start=True, End=True)
merge_5 = Merge(Data1=panel_36, Data2=dispatch_9.ListA)
join_8 = TextJoin(Text=merge_5, Join="|")
panel_58 = Panel(merge_5)

# ---- group: Rounding to 0.1
number_slider_7 = Slider(1, range=0..10)

# ----
# Technical Memorandum No. EM36-86-68110: 4.2 Determine an Appraisal Level Arch Dam Layout
# 
# 12.a. Draw the upstream face arch starting with the first arch below the crest. Use an initial guess for the line of centers as a 0.2:1 sloping line.
# x. Line of centers
flatten_2 = FlattenTree(Tree=plane_elevations_3, Path="{0}")
flatten_3 = FlattenTree(Tree=plane_elevations_2, Path="{0}")
cull_i_8 = CullIndex(List=flatten_2, Indices=-1, Wrap=True)  # -> simplify(graft(List))
cull_i_9 = CullIndex(List=flatten_3, Indices=-1, Wrap=True)  # -> simplify(graft(List))
pcx_3 = CurvePlane(DownstreamArc=ds_arc_3, Plane=cull_i_9)  # -> simplify(Points), ParamsC, ParamsP
pcx_4 = CurvePlane(DSPFootprint=dsp_prefootprint_2, Plane=cull_i_9)  # -> simplify(Points), ParamsC, ParamsP
pcx_5 = CurvePlane(USPFootprint=usp_prefootprint_2, Plane=cull_i_8)  # -> simplify(Points), ParamsC, ParamsP
pcx_6 = CurvePlane(UpstreamArc=us_arc_3, Plane=cull_i_8)  # -> simplify(Points), ParamsC, ParamsP
item_32 = ListItem(List=pcx_4.Points, Index=0, Wrap=True)  # -> Item, Item1
arc_5 = Arc3Pt(PointA=item_32.Item, PointB=pcx_3.Points, PointC=item_32.Item1)  # -> Arc, Plane, Radius
darc_2 = DeconstructArc(Arc=arc_5.Arc)  # -> BasePlane, Radius, Angle
rev_2 = Reverse(Vector=refecenre_centers_vector_3)
project_17 = ProjectPoint(Point=darc_2.BasePlane, Direction=[refecenre_centers_vector_3, rev_2], Geometry=reference_centers_plane_3)  # -> Point, Index
rev_3 = Reverse(Vector=refecenre_centers_vector_2)
clean_7 = CleanTree(RemoveNulls=True, RemoveInvalid=True, RemoveEmpty=False, Tree=project_17.Point)  # -> flatten(Tree)
center_at_crest = Point(center_crest_2)
abiscissa_dam_axis_2 = RemoteReceiver(abiscissa_dam_axis)

item_33 = ListItem(List=pcx_5.Points, Index=0, Wrap=True)  # -> Item, Item1

arc_6 = Arc3Pt(PointA=item_33.Item, PointB=pcx_6.Points, PointC=item_33.Item1)  # -> Arc, Plane, Radius
darc_3 = DeconstructArc(Arc=arc_6.Arc)  # -> BasePlane, Radius, Angle
project_18 = ProjectPoint(Point=darc_3.BasePlane, Direction=[refecenre_centers_vector_2, rev_3], Geometry=reference_centers_plane_2)  # -> Point, Index
clean_8 = CleanTree(RemoveNulls=True, RemoveInvalid=True, RemoveEmpty=False, Tree=project_18.Point)  # -> flatten(Tree)

centers_extrados_not_normalized = Point([center_at_crest, clean_8])
pline_8 = PolyLine(Vertices=centers_extrados_not_normalized, Closed=False)
lng_6 = ListLength(List=centers_extrados_not_normalized)
smoothpline_5 = SmoothPolyline(Polyline=pline_8, Strength=1, Times=lng_6)
ext_2 = ExtendCurve(Curve=smoothpline_5, Type=2, Start=0, End=500)
ccx_5 = CurveCurve(CurveA=ext_2, CurveB=abiscissa_dam_axis_2)  # -> Points, ParamsA, ParamsB
shatter_8 = Shatter(Curve=ext_2, Parameters=flatten(ccx_5.ParamsA))
sort_13 = SortList(Keys=shatter_8, ValuesA=shatter_8)  # -> Keys, ValuesA
item_34 = ListItem(List=sort_13.ValuesA, Index=0, Wrap=True)
geo_14 = Geometry(item_34)

centers_extrados_not_normalized_2 = Point([center_at_crest, clean_7])
pline_9 = PolyLine(Vertices=centers_extrados_not_normalized_2, Closed=False)
lng_7 = ListLength(List=centers_extrados_not_normalized_2)
smoothpline_6 = SmoothPolyline(Polyline=pline_9, Strength=1, Times=lng_7)
ext_3 = ExtendCurve(Curve=smoothpline_6, Type=2, Start=0, End=500)
ccx_6 = CurveCurve(CurveA=ext_3, CurveB=abiscissa_dam_axis_2)  # -> Points, ParamsA, ParamsB
shatter_9 = Shatter(Curve=ext_3, Parameters=flatten(ccx_6.ParamsA))
sort_14 = SortList(Keys=shatter_9, ValuesA=shatter_9)  # -> Keys, ValuesA
item_35 = ListItem(List=sort_14.ValuesA, Index=0, Wrap=True)
geo_15 = Geometry(item_35)

line_of_centers_intrados = RemoteSender(geo_14)
line_of_centers_extrados = RemoteSender(geo_15)
line_of_centers_extrados_2 = RemoteReceiver(line_of_centers_extrados)
line_of_centers_intrados_2 = RemoteReceiver(line_of_centers_intrados)
pcx_7 = CurvePlane(LineOfCentersIntrados=line_of_centers_intrados_2, Plane=plane_elevations_4)  # -> simplify(CenterPoints), ParamsC, ParamsP
pcx_8 = CurvePlane(LineOfCentersExtrados=line_of_centers_extrados_2, Plane=plane_elevations_4)  # -> simplify(CenterPoints), ParamsC, ParamsP
ln_6 = Line(StartPoint=pcx.Points, EndPoint=pcx_7.CenterPoints)
ln_7 = Line(StartPoint=pcx_2.Points, EndPoint=pcx_8.CenterPoints)
len_6 = Length(Curve=ln_6)
len_7 = Length(Curve=ln_7)
cir_4 = Circle(DSCenters=pcx_7.CenterPoints, Radius=len_6)  # -> simplify(Circle)
cir_5 = Circle(USCenters=pcx_8.CenterPoints, Radius=len_7)
path_mapper_4 = PathMapper(ln_7, source="{A}", target="{0;A}")
path_mapper_5 = PathMapper(cir_4, source="{A}", target="{1;A}")
path_mapper_6 = PathMapper(cir_5, source="{A}", target="{0;A}")
path_mapper_7 = PathMapper(ln_6, source="{A}", target="{1;A}")

# ---- group: Finding the intersection with sound rock
brep_terrain_base_foundation_7 = RemoteReceiver(brep_terrain_base_foundation)
relay = Relay([path_mapper_6, path_mapper_5])
relay_2 = Relay([path_mapper_4, path_mapper_7])
scx_4 = SurfaceCurve(Surface=brep_terrain_base_foundation_7, Curve=relay)  # -> Curves, simplify(Points), UVPoints, Normals, Parameters, Tangents

# ---- group: Filter away last circle - touching sound rock
geo_16 = Geometry(relay)
tstat_2 = TreeStatistics(Tree=geo_16)  # -> Paths, Length, Count
division_3 = Division(A=tstat_2.Count, B="2")
x_minus_one = XMinusOne(NumberX=division_3)
item_36 = ListItem(List=tstat_2.Paths, Index=flatten(["-1", x_minus_one]), Wrap=True)
split_5 = SplitTree(Data=geo_16, Masks=flatten(item_36))  # -> Positive, Negative
geo_17 = Geometry(split_5.Positive)

# ---- group: Adjusting the bottom so there is something to connect with the bottom circle
number_slider_8 = Slider(1, range=0..10)
centrifugal_vector_3 = RemoteReceiver(centrifugal_vector)
neg_7 = Negative(Value=number_slider_8)
rev_4 = Reverse(Vector=centrifugal_vector_3)
rad = Radians(Degrees=[number_slider_8, neg_7])
rotate = Rotate(Geometry=rev_4, Angle=rad, Plane=PlaneXY(0, 0, 0))  # -> flatten(Geometry), Transform
center_8 = Center(Geometric=geo_17)  # -> Center, Dimension
darc_4 = DeconstructArc(Arc=geo_17)  # -> BasePlane, Radius, Angle
line_3 = LineSDL(Start=center_8.Center, Direction=rotate.Geometry, Length=darc_4.Radius)
ccx_7 = CurveCurve(CurveA=geo_17, CurveB=line_3)  # -> Points, ParamsA, ParamsB
pshift = ShiftPaths(Data=ccx_7.ParamsA, Offset="-1")
shatter_10 = Shatter(Curve=geo_17, Parameters=pshift)
pshift_2 = ShiftPaths(Data=shatter_10, Offset="-1")
item_37 = ListItem(List=pshift_2, Index=0, Wrap=True)

# ---- group: Cutting and selecting curves for dam
shatter_11 = Shatter(Curve=relay, Parameters=scx_4.Parameters)  # -> simplify(Segments)
colom_4 = CollisionOneMany(Collider=shatter_11, Obstacles=relay_2)  # -> Collision, Index
dispatch_10 = Dispatch(List=shatter_11, DispatchPattern=colom_4.Collision)  # -> ListA, ListB

# ----
split_6 = SplitTree(Data=dispatch_10.ListA, Masks=flatten(item_36))  # -> Positive, Negative
geo_18 = Geometry(split_6.Negative)
path_mapper_8 = PathMapper(geo_18, source="{A;B}", target="{A;B+1}")
path_mapper_9 = PathMapper(item_37, source="{A;B}", target="{A;B+1}")

end_11 = EndPoints(Curve=path_mapper_9)  # -> Start, End
geo_19 = Geometry([path_mapper_2, path_mapper_3, path_mapper_8])
end_12 = EndPoints(Curve=geo_19)  # -> Start, End
geo_20 = Geometry([end_11.Start, end_11.End])
geo_21 = Geometry([end_12.Start, end_12.End])
path_mapper_10 = PathMapper(geo_21, source="{A;B}", target="{A}")
item_38 = ListItem(List=path_mapper_10, Index=0, Wrap=True)
geo_22 = Geometry(path_mapper_10)
ptsortitems = PointSortItems(Start=item_38, Points=geo_22)  # -> SortedItems, SortedIndices, simplify(SortedPoints)
intcrv = Interpolate(Vertices=ptsortitems.SortedPoints, Degree=3, Periodic=False, KnotStyle=1)  # -> Curve, Length, Domain
lng_8 = ListLength(List=ptsortitems.SortedPoints)
crest_plane_elevation_2 = RemoteReceiver(crest_plane_elevation)
plane_elevations_5 = RemoteReceiver(plane_elevations)
number_slider_9 = Slider(50, range=0..100)
smocrv = SmoothCurve(Curve=intcrv.Curve, Steps=lng_8, StartType=0, EndType=0, DeviationTolerance=Slider(5, range=0..50), AngleTolerance=0.05)
merge_6 = Merge(Data1=flatten(crest_plane_elevation_2), Data2=flatten(plane_elevations_5))
ext_4 = ExtendCurve(Curve=geo_19, Type=1, Start=number_slider_9, End=number_slider_9)
cull_i_10 = CullIndex(List=merge_6, Indices=-1, Wrap=True)
pcx_9 = CurvePlane(Curve=smocrv, Plane=cull_i_10)  # -> simplify(Points), ParamsC, ParamsP
crv_cp_3 = CurveClosestPoint(Point=pcx_9.Points, Curve=ext_4)  # -> Point, Parameter, Distance
dispatch_11 = Dispatch(List=crv_cp_3.Point, DispatchPattern=[True, False])  # -> ListA, ListB
item_39 = ListItem(List=dispatch_11.ListA, Index=0, Wrap=True)
item_40 = ListItem(List=dispatch_11.ListB, Index=0, Wrap=True)
geo_23 = Geometry(geo_20)
geo_24 = Geometry([item_39, item_40, geo_23])

pshift_3 = ShiftPaths(Data=geo_24, Offset=-1)
item_41 = ListItem(List=pshift_3, Index=0, Wrap=True)
ptsortitems_2 = PointSortItems(Start=item_41, Points=pshift_3)  # -> SortedItems, SortedIndices, SortedPoints
path_mapper_11 = PathMapper(ext_4, source="{A;B}", target="{A}")
intcrv_2 = Interpolate(Vertices=ptsortitems_2.SortedPoints, Degree=Slider(3, range=0..10), Periodic=False, KnotStyle=1)  # -> simplify(Curve), Length, Domain
ccx_8 = CurveCurve(CurveA=path_mapper_11, CurveB=intcrv_2.Curve)  # -> Points, ParamsA, ParamsB
shatter_12 = Shatter(Curve=ext_4, Parameters=ccx_8.ParamsA)  # -> simplify(Segments)
dispatch_12 = Dispatch(List=shatter_12, DispatchPattern=[True, False])  # -> ListA, ListB
geo_25 = Geometry(dispatch_12.ListB)

geo_26 = Geometry(geo_25)
tstat_3 = TreeStatistics(Tree=geo_26)  # -> Paths, Length, Count
division_4 = Division(A=tstat_3.Count, B="2")
split_7 = SplitList(List=tstat_3.Paths, Index=division_4)  # -> ListA, ListB
item_42 = ListItem(List=split_7.ListA, Index=-1, Wrap=True)
item_43 = ListItem(List=split_7.ListB, Index=-1, Wrap=True)
cull_i_11 = CullIndex(List=split_7.ListA, Indices=-1, Wrap=True)  # -> flatten(List)
cull_i_12 = CullIndex(List=split_7.ListB, Indices=-1, Wrap=True)  # -> flatten(List)
path_2 = DataPath(flatten([cull_i_11, cull_i_12]))
split_8 = SplitTree(Data=geo_26, Masks=flatten(path_2))  # -> Positive, Negative
split_9 = SplitTree(Data=geo_26, Masks=flatten("{?;0}"))  # -> Positive, Negative
unflatten_2 = UnflattenTree(Tree=intcrv_2.Curve, Guide=split_8.Negative)
unflatten_3 = UnflattenTree(Tree=split_9.Negative, Guide=split_8.Positive)
geo_27 = Geometry([split_8.Positive, unflatten_3])
path_mapper_12 = PathMapper(unflatten_3, source="{A;B}", target="{A}")
lng_9 = ListLength(List=path_mapper_12)
repeat = RepeatData(Data=intcrv_2.Curve, Length=lng_9)
unflatten_4 = UnflattenTree(Tree=repeat, Guide=unflatten_3)
ccx_9 = CurveCurve(CurveA=unflatten_4, CurveB=geo_27)  # -> Points, simplify(ParamsA), ParamsB
pshift_4 = ShiftPaths(Data=ccx_9.ParamsA, Offset=-1)
shatter_13 = Shatter(Curve=unflatten_4, Parameters=pshift_4)  # -> simplify(Segments)
lng_10 = ListLength(List=shatter_13)
python = GhPythonScript(x=lng_10, y=shatter_13)  # -> out, a, b
# ---------- python: Python ----------
__author__ = "Admin"
__version__ = "2023.08.14"

import rhinoscriptsyntax as rs

if x == 3:
    a = y
elif x == 5:
    b = y
# ---------- end python ----------
clean_9 = CleanTree(RemoveNulls=True, RemoveInvalid=True, RemoveEmpty=False, Tree=python.b)
clean_10 = CleanTree(RemoveNulls=True, RemoveInvalid=True, RemoveEmpty=False, Tree=python.a)
geo_28 = Geometry(unflatten_2)
geo_29 = Geometry(split_8.Negative)

dispatch_13 = Dispatch(List=clean_9, DispatchPattern=[True, False])  # -> ListA, ListB
geo_30 = Geometry(clean_10)
cull_i_13 = CullIndex(List=geo_30, Indices="1", Wrap=True)  # -> simplify(List)
geo_31 = Geometry(dispatch_13.ListB)
geo_32 = Geometry([geo_27, geo_31, cull_i_13])
item_44 = ListItem(List=geo_32, Index=0, Wrap=True)  # -> Item, Item1, Item2, Item3
netsurf = NetworkSurface(CurvesU=[item_44.Item, item_44.Item1], CurvesV=[item_44.Item2, item_44.Item3], Continuity=3)

ccx_10 = CurveCurve(CurveA=geo_28, CurveB=geo_29)  # -> Points, ParamsA, ParamsB
shatter_14 = Shatter(Curve=geo_28, Parameters=ccx_10.ParamsA)
pshift_5 = ShiftPaths(Data=shatter_14, Offset=-1)
item_45 = ListItem(List=pshift_5, Index="1", Wrap=True)
loft_3 = Loft(
    Curves=[item_45, geo_29],
    Options={Adjust=True, Closed=False, LoftEnds=0, LoftSimp=0, LoftType=5, Rebuild=10, Refit=0.01})

dam_7 = DataDam(DataA=loft_3, DataB=netsurf, BufferDelay=10000000, BufferMode=1)  # -> DataA, DataB
path_mapper_13 = PathMapper([dam_7.DataA, dam_7.DataB], source="{A;B}", target="{A}")
join_9 = BrepJoin(Breps=flatten(path_mapper_13))  # -> Breps, Closed
item_46 = ListItem(List=join_9.Breps, Index=0, Wrap=True)  # -> Item, Item1
item_47 = ListItem(List=join_9.Breps, Index=1, Wrap=True)
loft_4 = Loft(
    Curves=flatten([item_46.Item, item_46.Item1]),
    Options={Adjust=True, Closed=False, LoftEnds=0, LoftSimp=0, LoftType=5, Rebuild=10, Refit=0.01})
arch_face_collision = RemoteSender(item_47)
arch_face_collision_2 = RemoteReceiver(arch_face_collision)
mesh_13 = Mesh(arch_face_collision_2)
filter_3 = StreamFilter(Gate=dam_type_7, Stream0=null, Stream1=mesh_13, Stream2=null)
join_10 = BrepJoin(Breps=flatten([join_9.Breps, loft_4]))  # -> Breps, Closed
mesh_14 = MeshBrep(Brep=join_10.Breps, Settings=jagged_3)
geo_archdam = RemoteSender(mesh_14)
geo_archdam_2 = RemoteReceiver(geo_archdam)
mshclsd_2 = IsMeshClosed(Mesh=geo_archdam_2)
panel_59 = Panel(mshclsd_2)
geo_archdam_3 = RemoteReceiver(geo_archdam)
filter_4 = StreamFilter(Gate=dam_type_7, Stream0=geo_concretedam_2, Stream1=geo_archdam_3, Stream2=geo_enbankmentdam_2)
dam_8 = DataDam(DataD=dispatch_4.ListA, DataA=mjoin_6, DataB=filter_4, DataC=filter_3, BufferDelay=10000000, BufferMode=0)  # -> DataD, DataA, DataB, DataC
gate = StreamGate(Stream=dam_8.DataA, Gate=dam_type_8)  # -> Target0, Target1, Target2
gate_2 = StreamGate(Stream=dam_8.DataB, Gate=dam_type_8)  # -> Target0, Target1, Target2
filter_5 = StreamFilter(Gate=dam_type_8, Stream1=gate.Target1, Stream2=gate.Target2)
filter_6 = StreamFilter(Gate=dam_type_8, Stream0=gate_2.Target0, Stream1=gate_2.Target1, Stream2=gate_2.Target2)
mdif = MeshDifference(MeshesA=filter_5, MeshesB=filter_6)
disjoint_3 = DisjointMesh(Mesh=mdif)
path_mapper_14 = PathMapper(disjoint_3, source="{A;B}", target="{A}")
colom_5 = CollisionOneMany(Collider=path_mapper_14, Obstacles=dam_8.DataC)  # -> Collision, Index
dispatch_14 = Dispatch(List=path_mapper_14, DispatchPattern=colom_5.Index)  # -> ListA, ListB
geo_33 = Geometry(simplify(gate.Target0))
geo_34 = Geometry(dispatch_14.ListA)
# Parametric name
gate_3 = StreamGate(Stream=geo_34, Gate=dam_type_9)  # -> Target0, Target1, Target2
filter_7 = StreamFilter(Gate=dam_type_10, Stream0=geo_33, Stream1=gate_3.Target1, Stream2=gate_3.Target2)
geo_35 = Geometry(filter_7)
flatten_4 = FlattenTree(Tree=geo_35, Path="{0}")  # -> simplify(graft(Tree))
debox = DeconstructBox(Box=flatten_4)  # -> Plane, X, Y, Z
volume_7 = Volume(Geometry=flatten_4)  # -> Volume, Centroid
ma_5 = MassAddition(Input=flatten(volume_7.Volume))  # -> Result, PartialResults

volume_8 = Volume(Geometry=dispatch_14.ListB)  # -> Volume, Centroid
ma_6 = MassAddition(Input=flatten(volume_8.Volume))  # -> Result, PartialResults
subtraction_4 = Subtraction(A=ma_2.Result, B=ma_6.Result)
panel_60 = Panel(subtraction_4)
panel_61 = Panel(ma_5.Result)

dedomain = DeconstructDomain(Domain=debox.Z)  # -> Start, End
m3_to_hm3 = Expression(x=volume_7.Volume, Expression="x/1000000")

# ---- group: Rounding to 0.1 (continued)
roundd = RoundToDecimalPlace(NumberX=dedomain.Start, DecimalPlace=number_slider_7, RoundType=0)  # -> Rounded, Difference
roundd_2 = RoundToDecimalPlace(NumberX=dedomain.End, DecimalPlace=number_slider_7, RoundType=0)  # -> Rounded, Difference

# ----
roundd_3 = RoundToDecimalPlace(NumberX=m3_to_hm3, DecimalPlace=Slider(2, range=0..10), RoundType=0)  # -> Rounded, Difference
dup_4 = DuplicateDataMatch(SourceDataTree=roundd_3.Rounded, SecondaryData1=water_level_6)  # -> SourceData, SecondaryData1
dup_5 = DuplicateDataMatch(SourceDataTree=roundd_3.Rounded, SecondaryData1=dam_name_translation_2)  # -> SourceData, SecondaryData1
dup_6 = DuplicateDataMatch(SourceDataTree=roundd_3.Rounded, SecondaryData1=details_2.Path)  # -> SourceData, SecondaryData1
num_6 = Number(roundd_2.Rounded)
num_7 = Number(roundd.Rounded)
merge_7 = Merge(
    Data1=dup_6.SecondaryData1,
    Data2=dup_5.SecondaryData1,
    Data3=dup_4.SecondaryData1,
    Data4=num_7,
    Data5=num_6,
    Data6=roundd_3.Rounded)
dup_7 = DuplicateDataMatch(SourceDataTree=roundd_3.Rounded, SecondaryData1=fields_water_2)  # -> SourceData, SecondaryData1
# Fields
panel_62 = Panel(dup_7.SecondaryData1)
# Values
panel_63 = Panel(merge_7)
geo_archdam_4 = RemoteReceiver(geo_archdam)
move_14 = Move(Geometry=geo_archdam_4, Motion=vector_to_origin_2)  # -> Geometry, Transform
exportvector = ExportVector(
    VectorDataFilename=concat,
    VectorDataFolder=concat_4,
    Values=num_3,
    FeatureGeometry=move_14.Geometry,
    Export=Button(),
    DriverExtension=".shp",
    DriverType="ESRI Shapefile")
panel_64 = Panel(exportvector)
volume_9 = MeshVolume(Mesh=geo_archdam_4)  # -> Volume, Centroid
move_15 = Move(Geometry=geo_archdam_4, Motion=vector_to_origin_3)  # -> Geometry, Transform
panel_65 = Panel(volume_9.Volume)
geo_36 = Geometry(flatten(move_15.Geometry))
format_5 = Format(
    Format=panel_33,
    Culture=127,
    Data0=water_level_8,
    Data1=dam_level_3,
    Data2=pdecon_2.ZComponent,
    Data3=arch_dam_height_5,
    Data4=axis_straight_terrain_2,
    Data5=len_2,
    Data6=len_3,
    Data7=volume_9.Volume)
entwine_3 = Entwine(
    Branch00=water_level_9,
    Branch01=dam_level_4,
    Branch02=pdecon_2.ZComponent,
    Branch03=arch_dam_height_6,
    Branch04=axis_straight_terrain_2,
    Branch05=len_2,
    Branch06=len_3,
    Branch07=volume_9.Volume,
    FlattenInputs=True)  # -> flatten(Result)
panel_66 = Panel(entwine_3)
merge_8 = Merge(Data1=panel_66, Data2=trim)
join_11 = TextJoin(Text=merge_8, Join="|")
panel_67 = Panel([join_8, join_11])
panel_68 = Panel(merge_8)
num_8 = Number(panel_68)
move_16 = Move(Geometry=geo_archdam_4, Motion=vector_to_origin_4)  # -> Geometry, Transform
exportvector_2 = ExportVector(
    VectorDataFilename=concat_3,
    VectorDataFolder=concat_4,
    Fields="Volume",
    Values=num_4,
    FeatureGeometry=move_16.Geometry,
    Export=Button(),
    DriverExtension=".shp",
    DriverType="ESRI Shapefile")
exportvector_3 = ExportVector(
    VectorDataFilename=concat_2,
    VectorDataFolder=concat_4,
    Fields=panel_58,
    Values=num_8,
    FeatureGeometry=geo_36,
    Export=Button(),
    DriverExtension=".shp",
    DriverType="ESRI Shapefile")
panel_69 = Panel(exportvector_2)

# ==== cluster GHPythonRemote: Connects the Grasshopper Python component to an external Python instance.
python = PythonScript()  # -> gh_parent_doc_dir
# ---------- python: Python ----------
from os import path

gh_parent_doc_dir = path.abspath(path.dirname(ghenv.Component.OnPingDocument().Owner.OnPingDocument().FilePath))
# ---------- end python ----------
# GH to python remote example.
# Pierre Cuvilliers, 2017-2018
# Released under the MIT license
# github.com/pilcru/ghpythonremote
# Runs and connects to an external python engine, and
# assigns imported modules to scriptcontext.sticky variables.
# 
# Arguments:
#       code (str): Path to the GH_to_python_sticky.py code file.
#       location (str): Path to a python executable, or to a folder
#             containing `python.exe`, or the name of a conda-created
#             virtual environment prefixed by `conda://` (`conda://env_name`).
#             If empty, finds python from your windows %PATH%.
#       run (boolean): Creates the connection, and imports new
#             modules, when turned to True. Kills the connection,
#             and deletes the references to the imports, when turned
#             to False.
#       modules (str list): List of module names to import in the
#             remote python. They will be added to the
#             scriptcontext.sticky dictionary, allowing them to be
#             reused from other python components in the same
#             Grasshopper document. Submodules (for example
#             `numpy.linalg` have to be added explicitly to this list
#             to be available later.
#       log_level (str from ['NOTSET', 'DEBUG', 'INFO', 'WARNING', 'ERROR', 'CRITICAL']):
#             Logging level to use for the local IronPython and the
#             remote python instance.
#       working_dir (str): Working directory for the remote python
#             instance.
# 
# Returns:
#       out (str): Console output with DEBUG information.
#       linked_modules (str list): list of imported module names.
#       rpy (rpyc connection object): The object representing the
#             remote Python interpreter.
location = ClusterInput()  # location (str): Path to a python executable, or to a folder containing `python.exe`, or the name of a conda-created virtual environment prefixed by `conda://` (`conda://env_name`). If empty, finds python from your windows %PATH%.
run = ClusterInput()  # run (boolean): Creates the connection, and imports new modules, when turned to True. Kills the connection,and deletes the references to the imports, when turned to False.
modules = ClusterInput()  # modules (str list): List of module names to import in the remote python. They will be added to the scriptcontext.sticky dictionary, allowing them to be reused from other python components in the same Grasshopper document. Submodules (for example `numpy.linalg` have to be added explicitly to this list to be available later.
list = ValueList({"CRITICAL", "ERROR", "WARNING", "INFO", "DEBUG", "NOTSET"}, selected="DEBUG")
panel = Panel(python)
ghpythonremote = GHPythonRemote(location=location, run=run, modules=modules, log_level=list, working_dir=panel)  # -> out, linked_modules, rpy; inputs run: Boolean, modules: list
# ---------- ghpythonremote: Python ----------
import inspect
import logging
from os import path
import sys
from time import sleep

import scriptcontext

import ghpythonremote
from ghpythonremote.connectors import GrasshopperToPythonRemote

local_log_level = getattr(logging, log_level, logging.WARNING)
logger = logging.getLogger("ghpythonremote")
logger.setLevel(local_log_level)
ch = logging.StreamHandler()
ch.setLevel(local_log_level)
formatter = logging.Formatter("%(levelname)s: %(name)s:\n%(message)s")
ch.setFormatter(formatter)
logger.handlers = []
logger.addHandler(ch)
logger = logging.getLogger("ghpythonremote.GH_to_python")

ROOT = path.abspath(path.dirname(inspect.getfile(ghpythonremote)))
rpyc_server_py = path.join(ROOT, "pythonservice.py")

# Set connection to CLOSED if this is the first run
# and initialize set of linked modules
try:
    remote_python_status
except NameError:
    remote_python_status = "CLOSED"
    lkd_modules = set()

# Wait for connection to connect or terminate
timer = 0
while remote_python_status == "CONNECTING" or remote_python_status == "CLOSING":
    sleep(1)
    timer += 1
    if timer == 10:
        try:
            gh2py_manager.__exit__(*sys.exc_info())
        except Exception:
            pass
        remote_python_status = "CLOSED"
        lkd_modules = set()
        raise RuntimeError(
            "Connection left in an inconsistent state and not returning. Reset "
            "everything."
        )

if run:
    if not remote_python_status == "OPEN":
        remote_python_status = "CONNECTING"
        gh2py_manager = GrasshopperToPythonRemote(
            rpyc_server_py,
            location=location,
            timeout=10,
            port=None,
            log_level=log_level,
            working_dir=working_dir,
        )
        gh2py = gh2py_manager.__enter__()
        remote_python_status = "OPEN"

    # Stuff that we can reach
    rpymod = gh2py.py_remote_modules  # A getter function for a named python module
    rpy = gh2py.connection  # Represents the remote instance root object
    scriptcontext.sticky["rpy"] = rpy
    # Add modules
    for mod in modules:
        try:
            scriptcontext.sticky[mod] = rpymod(mod)
            lkd_modules.add(mod)
        except ImportError:
            gh2py_manager.__exit__(*sys.exc_info())
            raise

elif not remote_python_status == "CLOSED":
    remote_python_status = "CLOSING"
    # Remove linked modules
    for mod in lkd_modules:
        del scriptcontext.sticky[mod]
    del scriptcontext.sticky["rpy"]
    gh2py_manager.__exit__(*sys.exc_info())
    lkd_modules = set()
    remote_python_status = "CLOSED"

# Change variable name because ghpython resets outputs to None before each run
linked_modules = lkd_modules

logger.info("GH to python connection is {}".format(remote_python_status))
# ---------- end ghpythonremote ----------
out = ClusterOutput(ghpythonremote.out)  # Console output.
linked_modules = ClusterOutput(ghpythonremote.linked_modules)  # Names of modules that were successfully added to the scriptcontext.sticky dictionary.
rpy = ClusterOutput(ghpythonremote.rpy)  # The object representing the remote python instance
python_2 = PythonScript(module_names=ghpythonremote.linked_modules)  # -> import_statements; inputs module_names: list
# ---------- python_2: Python ----------
import_statements = ["import scriptcontext as sc"]
for module_name in module_names:
    import_statements.append("{0} = sc.sticky['{0}']".format(module_name))

if len(module_names) == 0:
    import_statements = []
# ---------- end python_2 ----------
import_statements = ClusterOutput(python_2)  # Useful import statements to use the imported modules in your scripts.
