# Grasshopper definition 3.JD_Dams5.gh (Grasshopper 1.0.7)
# Copyright: © 2017-2018 Pierre Cuvilliers, Caitlin Mueller, Massachusetts Institute of Technology
# plug-ins: ProvingGround.Conduit, Telepathy, Pufferfish, LunchBox, Heteroptera, Human, UiPlus, MetaHopper, EleFront, CORE.Toolbox.Grasshopper, Kangaroo2 Components, Speckle 2, Heron, MeshEdit Components, Hops

heights = Panel("""1826
1827
1836
1844
1845""")
heights_2 = Panel("""1836
1839
1842
1844""")
# Requirements hops scripts
panel = Panel("Modules\Gravity.gh")
# Requirements plugins
panel_2 = Panel("Modules\Embankment.gh")

# ---- group: INFO
# _________________________________
# 
# This file is done based on the rhino file:
# _________________________________
# "C:\Users\Admin\Gruner AG\BSBE [ORG] - Digitale Anwendungen ESD\04_Projekte\2023\CH_VS_Barrage Les Toules_SensitivityAnalysis_JD\Model\231708_Le toules-WSCH00320.3dm"
# Images folder - saved where the gh file is
# Image size settings
number_slider = Slider(700, range=0..1000)
# Infos & Settings
panel_3 = Panel("231708_Le toules.3dm")
viewport_1_for_images = Panel("Perspektive")
viewport_2_for_images = Panel("Drauf")
viewport_3_for_images = Panel("Detail")
relpath = RelativePath(Path="Bilder")
multiplication = Multiplication(A=number_slider, B="7")
multiplication_2 = Multiplication(A=number_slider, B="5")
panel_4 = Panel(relpath)
viewport_name_3 = RemoteSender(viewport_3_for_images)
viewport_name_1 = RemoteSender(viewport_1_for_images)
viewport_name_2 = RemoteSender(viewport_2_for_images)
panel_5 = Panel("1446")
panel_6 = Panel(multiplication)
panel_7 = Panel("883")
panel_8 = Panel(multiplication_2)

# ----
panel_9 = Panel("C:\Users\Admin\Gruner AG\Jumping dams [EXP] - General\03_Model\Les Toules")
num = Number(heights_2)
sort = SortList(Keys=heights_2, ValuesA=num)  # -> Keys, ValuesA
relpath_2 = RelativePath(Path=panel_2)
relpath_3 = RelativePath(Path="Modules\Arch.gh")
relpath_4 = RelativePath(Path=panel)
list_of_heights = RemoteSender(sort.ValuesA)
merge = Merge(Data1=relpath_4, Data2=relpath_3, Data3=relpath_2)
path_save = RemoteSender(panel_9)
panel_10 = Panel(merge)
filepath_hops = RemoteSender(merge)

# ---- group: GEN_SET
# Inputs
# EPW
# Geometry
# North
# Project location
epw = Panel("C:\Users\cna\Gruner AG\BSBE [ORG] - Digitale Anwendungen ESD\04_Projekte\2023\DE_Rastatt_Kombibad_BKL\Schattenstudie\DEU_BW_Karlsruhe-Baden-Baden.AP.107275_TMYx\DEU_BW_Karlsruhe-Baden-Baden.AP.107275_TMYx.epw")
context_surfaces_openings = Geometry(<brep referenced from the Rhino model>)
context_surfaces_opaque = Geometry([<brep referenced from the Rhino model> x95, <mesh referenced from the Rhino model>, <brep referenced from the Rhino model> x2])
context_surfaces_terrain = Geometry([<brep referenced from the Rhino model> x8, <mesh referenced from the Rhino model>, <brep referenced from the Rhino model> x10])
context_objects_trees = Geometry()
context_objects_water = Geometry()
context_objects_streets = Geometry()
north_direction = Slider(246, range=0..360)
center_point_for_norh_symbol = Point(Point(-36.56310628, 15.02784233, 0))
project_name = Panel("Rastatt")
analysis_surfaces = Geometry([<brep referenced from the Rhino model> x5])
planesrf = PlaneSurface(Plane=PlaneXY(0, 0, 0), XSize=Domain(-10, 10), YSize=Domain(-10, 10))
flip = Flip(Surface=analysis_surfaces, Guide=planesrf)  # -> Surface, Result
context_openings = RemoteSender(context_surfaces_openings)
context_opaque = RemoteSender(context_surfaces_opaque)
analysis_surface = RemoteSender(flip.Surface)
project_location = RemoteSender("48.85441745071704, 8.214564907424585")
context_terrain = RemoteSender(context_surfaces_terrain)
context_water = RemoteSender(context_objects_water)
context_street = RemoteSender(context_objects_streets)
context_trees = RemoteSender(context_objects_trees)

# ----
project_name_2 = RemoteSender(project_name)
epw_2 = RemoteSender(epw)
panel_11 = Panel("C:\Users\Admin\Gruner AG\Jumping dams [EXP] - General\03_Model\Example image.png")
# Run Dam
# Select dam type
list = ValueList({"Concrete gravity dam": "0", "Arch dam": "1", "Embankment dam": "2"}, selected="Arch dam")
run_pre_geometry_of_water = Button()
run_arch_dam = Button()
run_volume_arch_dam = Button()

panel_12 = Panel("""Concrete gravity dam
Arch dam
Embankment dam""")
# Dam configuration
# Dashboard structure
panel_13 = Panel("Type of Dam (m)")

# ----
# Energy Inputs
# Dashboard structure
# Dashboard - fill in data and listen to outputs
panel_14 = Panel("Ecological discharge [m3/s]")
label = UiLabel(Label=panel_14, Style=3)
slider = UiSlider(Value=0.5, Bounds=Domain(0, 1), Increment=0.1)
label_2 = UiLabel(Label="Powerplant efficiency [%]", Style=3)
label_3 = UiLabel(Label="Head losses (%)", Style=3)
label_4 = UiLabel(Label="Inputs energy", Style=1)
label_5 = UiLabel(Label="Discharge river (m3/s)*", Style=3)
label_6 = UiLabel(Label="Delta T*", Style=3)
label_7 = UiLabel(Label="*Input 12 Months separated with comma without spaces!", Style=4)
label_8 = UiLabel(Label="Design discharge [m3/s]", Style=3)
slider_2 = UiSlider(Value=0.5, Bounds=Domain(0, 1), Increment=0.1)
text_box = UiTextBox(Text="Click here to change text", Wrap=True)
text_box_2 = UiTextBox(Text="Click here to change text", Wrap=True)
slider_3 = UiSlider(Value=0.5, Bounds=Domain(0, 1), Increment=0.1)
slider_4 = UiSlider(Value=0.5, Bounds=Domain(0, 1), Increment=0.1)
merge_2 = Merge(
    Data1=label_4,
    Data2=label_5,
    Data3=text_box,
    Data4=label_6,
    Data5=text_box_2,
    Data6=label_7,
    Data7=label_3,
    Data8=slider_3,
    Data9=label_8,
    Data10=slider_4,
    Data11=label,
    Data12=slider,
    Data13=label_2,
    Data14=slider_2)
wrap = UiWrapLayout(Elements=merge_2, Horizontal=False, Direction=0)
merge_3 = Merge(Data1=wrap)
panel_15 = Panel("""Inputs energy
Inputs Dam""")
tab = UiTabbedLayout(Elements=merge_3, Names=panel_15)
energy_inputs = Button()
panel_16 = Panel("Ex: 0.56,0.46,0.47,0.85,4.51,8.72,7.77,5.34,3.01,1.99,1.13,0.72")
window = UiWindow(Elements=merge_3, Title="Energy Inputs", Owner=1, Scroll=True, Launch=energy_inputs)
slider_5 = UiSlider(Element=slider, Label="m3/s", Value=".2", Bounds="0 To 5", Increment=".01")
slider_6 = UiSlider(Element=slider_2, Label="%", Value="88", Bounds="0 To 100", Increment=".1")
text_box_3 = UiTextBox(Element=text_box, Text=panel_16, Wrap=True)
text_box_4 = UiTextBox(Element=text_box_2, Text="Ex: 744,672,744,720,744,720,744,744,720,744,720,744", Wrap=True)
slider_7 = UiSlider(Element=slider_3, Label="%", Value="5", Bounds="0 To 10", Increment=0.1)
slider_8 = UiSlider(Element=slider_4, Label="m3/s", Value="5", Bounds="0 To 20", Increment=0.1)
get_values = UiValues(Element=text_box_4)  # -> flatten(Values)
get_values_2 = UiValues(Element=text_box_3)  # -> flatten(Values)
get_values_3 = UiValues(Element=slider_5)  # -> flatten(Values)
get_values_4 = UiValues(Element=slider_6)  # -> flatten(Values)
get_values_5 = UiValues(Element=slider_7)  # -> flatten(Values)
get_values_6 = UiValues(Element=slider_8)  # -> flatten(Values)
split = TextSplit(Text=get_values, Separators=" ")  # -> reverse(flatten(Result))
split_2 = TextSplit(Text=get_values_2, Separators=" ")  # -> reverse(flatten(Result))
item = ListItem(List=split, Index=0, Wrap=True)
item_2 = ListItem(List=split_2, Index=0, Wrap=True)
split_3 = TextSplit(Text=item, Separators=",")  # -> flatten(Result)
split_4 = TextSplit(Text=item_2, Separators=",")  # -> flatten(Result)
ecological_discharge_m3_s_input_from_das = Panel(get_values_3)  # "Ecological discharge [m3/s] - Input from Dashboard"
discharge_in_the_river_m3_s_input_from_d = Panel(split_4)  # "Discharge in the river [m3/s] - Input from Dashboard"
delta_t_input_from_dashboard = Panel(split_3)
powerplant_efficiency_input_from_dashboa = Panel(get_values_4)  # "Powerplant efficiency [%]- Input from Dashboard"
head_losses_input_from_dashboard = Panel(get_values_5)
design_discharge_m3_s_input_from_dashboa = Panel(get_values_6)  # "Design discharge [m3/s] - Input from Dashboard"
discharge_in_the_river_m3_s_madagascar = Panel("""77.73
84.37
67.49
45.11
24.17
16.78
13.85
11.21
8.05
8.89
18.47
39.28""")
i_energy_dt = RemoteSender(delta_t_input_from_dashboard)
i_energy_dir = RemoteSender(discharge_in_the_river_m3_s_input_from_d)
i_energy_head_losses = RemoteSender(head_losses_input_from_dashboard)
i_energy_design_discharge = RemoteSender(design_discharge_m3_s_input_from_dashboa)
i_energy_ecological_discharge = RemoteSender(ecological_discharge_m3_s_input_from_das)
i_energy_powerplant_efficiency = RemoteSender(powerplant_efficiency_input_from_dashboa)
discharge_in_the_river_m3_s_les_toules = Panel("""0.56
0.46
0.47
0.85
4.51
8.72
7.77
5.34
3.01
1.99
1.13
0.72""")

panel_17 = Panel("""False
False
False""")
list_of_heights_2 = RemoteReceiver(list_of_heights)
replace = ReplaceItems(List=panel_17, Item="True", Indices=list, Wrap=False)
label_9 = UiLabel(Label=panel_13, Style=3)
dropdown_list = UiDropdownList(Values=list_of_heights_2)
label_10 = UiLabel(Label="Water level (m)", Style=3)
image = UiImage(Bitmap=panel_11, Fitting=1)
label_11 = UiLabel(Label="Freeboard (m)", Style=3)
slider_9 = UiSlider(Value=0.5, Bounds=Domain(0, 1), Increment=0.1)
# For python remote
dam_selection = RemoteSender(replace)
dam_selection_2 = RemoteReceiver(dam_selection)
panel_18 = Panel(dam_selection_2)
radio = UiRadio(Label=panel_12, State=panel_18, Group="Group 1")
label_12 = UiLabel(Label="Foundation depth (m)", Style=3)
button = UiButton(Label="Ok")
toggle = UiToggle(State=False)
slider_10 = UiSlider(Value=0.5, Bounds=Domain(0, 1), Increment=0.1)
toggle_2 = UiToggle(State="True")

pipeline = GeometryPipeline(
    GroupByLayer=False,
    GroupByType=False,
    IncludeHidden=True,
    IncludeLocked=True,
    LayerFilter="Upstream_point",
    NameFilter="*",
    SublayerFiltering=True,
    TypeFilter=1)
pipeline_2 = GeometryPipeline(
    GroupByLayer=False,
    GroupByType=False,
    IncludeHidden=True,
    IncludeLocked=True,
    LayerFilter="Axes",
    NameFilter="*",
    SublayerFiltering=True,
    TypeFilter=4)

# ----
# Slider dam line
slider_11 = Slider(0, range=0..6)
# _Automotions
slider_12 = Slider(0, range=0..10)
lng = ListLength(List=pipeline_2)
expression = Expression(x=lng, Expression="x-1")
c_script = CSharpScript(name="Axes", min=slider_12, max=expression, decimals=slider_11)  # -> out, A; inputs name: String, min: Double, max: Double, decimals: Int32
# ---------- c_script: C# ----------
    foreach (IGH_DocumentObject obj in owner.OnPingDocument().Objects )
    {
      Grasshopper.Kernel.Special.GH_NumberSlider slider = obj as Grasshopper.Kernel.Special.GH_NumberSlider;
      if (slider == null) { continue; }
      if (slider.NickName.Equals(name, StringComparison.OrdinalIgnoreCase))
      {
        double norm = slider.Slider.NormalizedValue;

        slider.Slider.Minimum = (decimal) min;
        slider.Slider.Maximum = (decimal) max;
        if (decimals <= 0)
        {
          slider.Slider.Type = Grasshopper.GUI.Base.GH_SliderAccuracy.Integer;
        }
        else
        {
          slider.Slider.Type = Grasshopper.GUI.Base.GH_SliderAccuracy.Float;
          slider.Slider.DecimalPlaces = decimals;
        }

        //Must disable events since we are modifying this thing during a solution.
        //This is actually illegal.
        slider.Slider.RaiseEvents = false;
        slider.Slider.NormalizedValue = norm;
        slider.Slider.RaiseEvents = true;
      }
    }
# ---------- end c_script ----------

pipeline_3 = GeometryPipeline(
    GroupByLayer=False,
    GroupByType=False,
    IncludeHidden=True,
    IncludeLocked=True,
    LayerFilter="Terrain_levels",
    NameFilter="*",
    SublayerFiltering=True,
    TypeFilter=4)
mesh = GeometryPipeline(
    GroupByLayer=False,
    GroupByType=False,
    IncludeHidden=True,
    IncludeLocked=True,
    LayerFilter="Terrain_brep",
    NameFilter="*",
    SublayerFiltering=True,
    TypeFilter=1073741848)
mesh_2 = GeometryPipeline(
    GroupByLayer=False,
    GroupByType=False,
    IncludeHidden=True,
    IncludeLocked=True,
    LayerFilter="Terrain_base_curve",
    NameFilter="*",
    SublayerFiltering=True,
    TypeFilter=4)
pipeline_4 = GeometryPipeline(
    GroupByLayer=False,
    GroupByType=False,
    IncludeHidden=True,
    IncludeLocked=True,
    LayerFilter="Gravity_axes::1",
    NameFilter="*",
    SublayerFiltering=True,
    TypeFilter=4)
pipeline_5 = GeometryPipeline(
    GroupByLayer=False,
    GroupByType=False,
    IncludeHidden=True,
    IncludeLocked=True,
    LayerFilter="Axes::BG",
    NameFilter="*",
    SublayerFiltering=True,
    TypeFilter=4)
xy = XYPlane(Origin=Point(0, 0, 0))
vec2pt = Vector2Pt(PointA=pipeline, PointB=xy, Unitize=False)  # -> Vector, Length

# ----
# In conda cmd prompt:
# 
# conda activate C:\Users\cna\.conda\envs\rhinoremote
# 
# pip install <package> - for any missing package check the ouput to the right
# 
# For PIL -> pip install pillow
panel_19 = Panel("C:\Users\cna\Anaconda3\envs\rhinoremote")
panel_20 = Panel("""PIL
openpyxl""")
pythonremote = GHPythonRemote(location=panel_19, run=Toggle(False), modules=panel_20)  # -> out, linked_modules, rpy, import_statements
panel_21 = Panel(pythonremote.import_statements)
panel_22 = Panel(pythonremote.out)

rev = Reverse(Vector=vec2pt.Vector)
vector_to_origin = RemoteSender(rev)
merge_4 = Merge(
    Data1=label_9,
    Data2=radio,
    Data3=label_10,
    Data4=dropdown_list,
    Data5=label_11,
    Data6=slider_9,
    Data7=label_12,
    Data8=slider_10,
    Data9=button,
    Data10=toggle,
    Data11=toggle_2)  # -> flatten(Result)
item_3 = ListItem(List=pipeline_2, Index=Slider(4, range=0..10), Wrap=True)
dam_configuration = Button()
list_of_heights_3 = RemoteReceiver(list_of_heights)
move = Move(Geometry=pipeline_2, Motion=vec2pt.Vector)  # -> Geometry, Transform
item_4 = ListItem(List=move.Geometry, Index=Slider(4, range=0..10), Wrap=True)
bill_of_quantities = Button()
window_2 = UiWindow(Elements=merge_4, Title="Dam Configuration", Owner=1, Scroll=True, Launch=dam_configuration)
move_2 = Move(Geometry=mesh_2, Motion=vec2pt.Vector)  # -> Geometry, Transform
dropdown_list_2 = UiDropdownList(Element=dropdown_list, Values=list_of_heights_3, Index=Slider(3, range=0..10))
move_3 = Move(Geometry=pipeline_5, Motion=vec2pt.Vector)  # -> Geometry, Transform
resize = UiResize(Element=image, Width="200", Height="200")
get_values_7 = UiValues(Element=dropdown_list_2)  # -> flatten(Values)
window_3 = UiWindow(Title="Bill of Quantities", Owner=1, Scroll=True, Launch=bill_of_quantities)
move_4 = Move(Geometry=pipeline, Motion=vec2pt.Vector)  # -> Geometry, Transform
slider_13 = UiSlider(Element=slider_9, Label="m", Value="3", Bounds="0 To 5", Increment=".1")
button_2 = UiButton(Element=button, Label="Send changes")
slider_14 = UiSlider(Element=slider_10, Label="m", Value="10", Bounds="0 To 50", Increment=".1")
toggle_3 = UiToggle(Element=toggle, Label="Show direction river flow?", State=False)
toggle_4 = UiToggle(Element=toggle_2, Label="Visualize dimensions?", State=False)
move_5 = Move(Geometry=mesh, Motion=vec2pt.Vector)  # -> Geometry, Transform
move_6 = Move(Geometry=pipeline_3, Motion=vec2pt.Vector)  # -> Geometry, Transform
brep = Brep(move_2.Geometry)
item_5 = ListItem(List=list_of_heights_3, Index=get_values_7, Wrap=True)
get_values_8 = UiValues(Element=radio)  # -> flatten(Values)
get_values_9 = UiValues(Element=slider_13)  # -> flatten(Values)
get_values_10 = UiValues(Element=slider_14)  # -> flatten(Values)
get_values_11 = UiValues(Element=button_2)  # -> flatten(Values)
get_values_12 = UiValues(Element=toggle_3)  # -> flatten(Values)
get_values_13 = UiValues(Element=toggle_4)  # -> flatten(Values)
water_level_m_input_from_dashboard = Panel(item_5)
brep_terrain_base = RemoteSender(brep)
dam_type = Panel(get_values_8)
# Dashboard - fill in data and listen to outputs
dam_type_index = Panel("""0
1
2""")
dam_axes_all = RemoteSender(move.Geometry)
brep_terrain = RemoteSender(move_5.Geometry)
lines_levels = RemoteSender(move_6.Geometry)
dam_axis = RemoteSender(move_3.Geometry)
freeboard_m_input_from_dashboard = Panel(get_values_9)
offset_foundation_m_input_from_dashboard = Panel(get_values_10)
panel_23 = Panel(get_values_12)
panel_24 = Panel(get_values_13)
panel_25 = Panel(get_values_11)
dispatch = Dispatch(List=dam_type_index, DispatchPattern=dam_type)  # -> ListA, ListB
viz_dimensions = RemoteSender(panel_24)
viz_direction_river = RemoteSender(panel_23)

dam = DataDam(
    DataA=dispatch.ListA,
    DataB=water_level_m_input_from_dashboard,
    DataC=freeboard_m_input_from_dashboard,
    DataD=offset_foundation_m_input_from_dashboard,
    BufferDelay=5000000,
    BufferMode=2)  # -> DataA, DataB, DataC, DataD
objfromgroup = GetObjectsInGroup()

dam_2 = DataDam(DataA=dispatch.ListA, BufferDelay=2500000, BufferMode=2)
dam_3 = DataDam(DataA=freeboard_m_input_from_dashboard, BufferDelay=10000000, BufferMode=0)  # disabled
dam_4 = DataDam(DataA=offset_foundation_m_input_from_dashboard, BufferDelay=10000000, BufferMode=0)  # disabled
panel_26 = Panel("INPUTS")
panel_27 = Panel("PROCESS")

lng_2 = ListLength(List=objfromgroup)
dup = DuplicateData(Data=panel_25, Number=lng_2, Order=True)

panel_29 = Panel("OUTPUTS")
panel_30 = Panel("VISUALIZATION")
inpupt_offset_foundation_m = Panel(dam.DataD)
addition = Addition(A=dam.DataB, B=dam.DataC)
mesh_3 = GeometryPipeline(
    GroupByLayer=False,
    GroupByType=False,
    IncludeHidden=True,
    IncludeLocked=True,
    LayerFilter="Terrain_mesh",
    NameFilter="*",
    SublayerFiltering=True,
    TypeFilter=32)  # disabled
pipeline_6 = GeometryPipeline(
    GroupByLayer=False,
    GroupByType=False,
    IncludeHidden=True,
    IncludeLocked=True,
    LayerFilter="River",
    NameFilter="*",
    SublayerFiltering=True,
    TypeFilter=4)  # disabled
reference_points_ph = GeometryPipeline(
    GroupByLayer=False,
    GroupByType=False,
    IncludeHidden=True,
    IncludeLocked=True,
    LayerFilter="Power house",
    NameFilter="*",
    SublayerFiltering=True,
    TypeFilter=1)  # disabled
panel_31 = Panel("CHECK")
water_level = RemoteSender(dam.DataB)
dam_type_2 = RemoteSender(dam_2)
dam_level = RemoteSender(addition)
freeboard = RemoteSender(dam.DataC)
offset_foundation = RemoteSender(dam.DataD)
setobj = SetObjectValue(ObjectToSet=flatten(objfromgroup), ValueToSet=flatten(dup))
panel_32 = Panel(lng_2)
panel_33 = Panel(dup)
panel_34 = Panel("Cost rock fill foundation (CHF/m3)")  # disabled
panel_35 = Panel("Cost rock fill(CHF/m3)")  # disabled
powerhouse_pt = RemoteSender(reference_points_ph)  # disabled
line_river = RemoteSender(pipeline_6)  # disabled
mesh_terrain = RemoteSender(mesh_3)  # disabled
label_13 = UiLabel(Label="Cost concrete foundation (CHF/m3)", Style=3)
grid_chart = UiGridChart(Titles=True)
label_14 = UiLabel(Label="Cost concrete(CHF/m3)", Style=3)
label_15 = UiLabel(Label=panel_34, Style=3)  # disabled
label_16 = UiLabel(Label=panel_35, Style=3)  # disabled
scroll_number = UiScrollNumber(Number=0, Wrap=False, Digits=3)
merge_5 = Merge(Data5=grid_chart)  # -> flatten(Result)
scroll_number_2 = UiScrollNumber(Number=0, Wrap=False, Digits=3)
scroll_number_3 = UiScrollNumber(Number=0, Wrap=False, Digits=3)
scroll_number_4 = UiScrollNumber(Number=0, Wrap=False, Digits=3)
merge_6 = Merge(Data1=scroll_number_4, Data2=scroll_number_3, Data3=scroll_number, Data4=scroll_number_2, Data5=grid_chart)  # -> flatten(Result)
dam_configuration_2 = Button()
list_2 = ValueList({"Concrete Dam": "1", "Arch Dam": "2", "Embankment Dam": "3"}, selected=["Concrete Dam", "Arch Dam", "Embankment Dam"])
offset_foundation_2 = RemoteReceiver(offset_foundation)

# ---- group: Topography contour lines
# Technical Memorandum No. EM36-86-68110: Obtain a print of the topography of the proposed dam site at a scale of 1”:100’ with
# 5 or 10-foot contour intervals.
panel_36 = Panel("10")  # disabled
# This changes when the axis line calculate and recalculate the basics again
expression_2 = Expression(ft=panel_36, Expression="ft*0.3048")  # disabled
panel_37 = Panel(expression_2)  # disabled

# ----
dam_axis_2 = RemoteReceiver(dam_axis)
dam_level_2 = RemoteReceiver(dam_level)
scroll_number_5 = UiScrollNumber(Element=scroll_number_4, Label="Cost concrete foundation (CHF/m3)", Number=0, Wrap=False, Digits=2, Bounds="0 To 1000")
scroll_number_6 = UiScrollNumber(Element=scroll_number_3, Label="Cost concrete (CHF/m3)", Number=0, Wrap=False, Digits=2, Bounds="0 To 1000")
scroll_number_7 = UiScrollNumber(Element=scroll_number, Label="Cost rock fill foundation (CHF/m3)", Number=0, Wrap=False, Digits=2, Bounds="0 To 1000")
window_4 = UiWindow(Elements=merge_6, Title="Costs", Owner=1, Scroll=True, Launch=dam_configuration_2)
scroll_number_8 = UiScrollNumber(Element=scroll_number_2, Label="Cost rock fill (CHF/m3)", Number=0, Wrap=False, Digits=2, Bounds="0 To 1000")
# Technical Memorandum No. EM36-86-68110: 2.1.3 Lines of Centers
# 
# The lines of centers define the horizontal shape of the arches in an arch dam. The shape of the arches starts at the crown cantilever and curves horizontally downstream toward the abutments. The line of centers create the geometry of the circular arcs at each elevation of the dam for the upstream and downstream faces by defining the center point of a circle and the radius of the circle. Depending on the shape and number of lines of centers, the arches can be
# 1) uniform thickness from abutment to abutment,
# 2) variable thickness from abutment to abutment,
# 3) different on the left side of the dam compared to the right side of the dam, or
# 4) different in the center of the dam compared to the outer part of the dam.
# Technical Memorandum No. EM36-86-68110: A double curvature arch dam has curvature in the arches and in the crown cantilever.
panel_38 = Panel(list_2)
Z = UnitZ(Factor=dam_level_2)
get_values_14 = UiValues(Element=scroll_number_5)  # -> flatten(Values)
get_values_15 = UiValues(Element=scroll_number_6)  # -> flatten(Values)
get_values_16 = UiValues(Element=scroll_number_8)  # -> flatten(Values)
neg = Negative(Value=offset_foundation_2)
get_values_17 = UiValues(Element=scroll_number_7)  # -> flatten(Values)
merge_7 = Merge(Data1=get_values_14, Data2=get_values_15, Data3=get_values_17, Data4=get_values_16)
move_7 = Move(Geometry=dam_axis_2, Motion=Z)  # -> Geometry, Transform

# ---- group: Selecting dam height level
brep_terrain_2 = RemoteReceiver(brep_terrain)
sec = BrepPlane(Brep=brep_terrain_2, Plane=Z)  # -> Curves, Points; disabled
colom = CollisionOneMany(Collider=sec.Curves, Obstacles=move_7.Geometry)  # -> Collision, Index; disabled
dispatch_2 = Dispatch(List=sec.Curves, DispatchPattern=colom.Collision)  # -> ListA, ListB; disabled
geo = Geometry(dispatch_2.ListA)  # disabled

# ----
project = Project(Curve=dam_axis_2, Brep=brep_terrain_2, Direction=Vector(0, 0, 1))
x_tremez = Extremes(Curve=project, Plane=PlaneXY(0, 0, 0))  # -> Highest, Lowest

# ---- group: Lowest point in the section
pt = Point(x_tremez.Lowest)

# ----
Z_2 = UnitZ(Factor=neg)
avr = Average(Input=get_values_14)
move_8 = Move(Geometry=brep_terrain_2, Motion=Z_2)  # -> Geometry, Transform
dam_height_m_input_from_dashboard = Panel(get_values_14)
dam_height_m_input_from_dashboard_2 = Panel(get_values_16)
dam_height_m_input_from_dashboard_3 = Panel(get_values_17)
dam_height_m_input_from_dashboard_4 = Panel(get_values_15)
list_3 = ValueList({"Default", "JD_AngularCheck"}, selected="Default")  # disabled
number_slider_2 = Slider(-3, range=-100..100)  # disabled
scx = SurfaceCurve(Surface=brep_terrain_2, Curve=move_7.Geometry)  # -> Curves, flatten(Points), UVPoints, Normals, Parameters, Tangents

# ---- group: Finding the crest points at bottom EXCAVATION
scx_2 = SurfaceCurve(Surface=move_8.Geometry, Curve=move_7.Geometry)  # -> Curves, flatten(Points), UVPoints, Normals, Parameters, Tangents
item_6 = ListItem(List=scx_2.Points, Index=0, Wrap=True)  # -> Item, Item1

# ----
water_level_2 = RemoteReceiver(water_level)
item_7 = ListItem(List=scx.Points, Index=0, Wrap=True)  # -> Item, Item1
crv_cp = CurveClosestPoint(Point=pt, Curve=move_7.Geometry)  # -> Point, Parameter, Distance; disabled
lineardim = DefineLinearDimension(Point1=pt, Point2=crv_cp.Point, Offset=number_slider_2, DimensionStyle=list_3)  # disabled
dimensions_check = RemoteSender(lineardim)  # disabled
Z_3 = UnitZ(Factor=water_level_2)
ln = Line(StartPoint=item_7.Item, EndPoint=item_7.Item1)

# ---- group: AXIS LINE
ln_2 = Line(StartPoint=item_6.Item, EndPoint=item_6.Item1)

# ----
len = Length(Curve=ln)
panel_39 = Panel("""Description
Volume (m3)
Specific costs (CHF/m3)
Total costs (CHF)""")
panel_40 = Panel("""Concrete foundation
Concrete top
Rockfill foundation
Rockfill top""")
brep_terrain_base_foundation = RemoteSender(move_8.Geometry)
chord_dam = RemoteSender(ln_2)
movetoplane = MoveToPlane(Geometry=ln_2, Plane=Z_3, Above=True, Below=True)  # -> Geometry, Transform
sec_2 = BrepPlane(Brep=brep_terrain_2, Plane=Z_3)  # -> Curves, Points
# This is just for the concrete dam!!
lowest_point_dam_section = RemoteSender(pt)
out_dam_height = RemoteSender(crv_cp.Distance)  # disabled
colom_2 = CollisionOneMany(Collider=sec_2.Curves, Obstacles=movetoplane.Geometry)  # -> Collision, Index
null = NullItem(Item=sec_2.Points)  # -> NullFlags, InvalidFlags, Description; disabled
dispatch_3 = Dispatch(List=sec_2.Curves, DispatchPattern=colom_2.Collision)  # -> ListA, ListB
number_slider_3 = Slider(378, range=0..1000)  # disabled
gate = StreamGate(Stream=sec_2.Curves, Gate=null.NullFlags)  # -> Target0, Target1; disabled
brep_terrain_base_2 = RemoteReceiver(brep_terrain_base)
brep_terrain_3 = RemoteReceiver(brep_terrain)
chord_dam_2 = RemoteReceiver(chord_dam)
water_level_3 = RemoteReceiver(water_level)
freeboard_2 = RemoteReceiver(freeboard)
explode = Explode(Curve=dispatch_3.ListA, Recursive=True)  # -> Segments, flatten(Vertices)
item_8 = ListItem(List=explode.Vertices, Index=0, Wrap=True)
geo_2 = Geometry(dispatch_3.ListA)
pln = Plane(item_8)
project_2 = Project(Geometry=explode.Vertices, Plane=pln)  # -> Geometry, Transform
pline = PolyLine(Vertices=project_2.Geometry, Closed=False)
filter = StreamFilter(Gate=null.NullFlags, Stream0=pline, Stream1=gate.Target1)  # disabled
levels_at_water_height = RemoteSender(geo_2)
levels_at_water_height_2 = RemoteReceiver(levels_at_water_height)

# ----
# Pre-volume Water
dam_5 = DataDam(
    DataFlatBase=brep_terrain_base_2,
    DataWaterLevel=water_level_3,
    DataFreeBoard=freeboard_2,
    DataChordDam=chord_dam_2,
    DataBrepTerrain=brep_terrain_3,
    DataLevelsAtWaterHeight=levels_at_water_height_2,
    BufferDelay=10000000,
    BufferMode=0)  # -> DataFlatBase, DataWaterLevel, DataFreeBoard, DataChordDam, DataBrepTerrain, DataLevelsAtWaterHeight
objfromgroup_2 = GetObjectsInGroup()

setobj_2 = SetObjectValue(ObjectToSet=objfromgroup_2, ValueToSet=run_pre_geometry_of_water)
Z_4 = UnitZ(Factor=dam_5.DataWaterLevel)

# ---- group: Water volume cutter
project_3 = Project(Curve=dam_5.DataChordDam, Brep=dam_5.DataBrepTerrain, Direction=Vector(0, 0, 1))
ccx = CurveCurve(CurveA=project_3, CurveB=dam_5.DataLevelsAtWaterHeight)  # -> Points, ParamsA, ParamsB
shatter = Shatter(Curve=project_3, Parameters=ccx.ParamsA)
shatter_2 = Shatter(Curve=dam_5.DataLevelsAtWaterHeight, Parameters=ccx.ParamsB)
dispatch_4 = Dispatch(List=shatter, DispatchPattern=[True, False])  # -> ListA, ListB
dispatch_5 = Dispatch(List=shatter_2, DispatchPattern=[True, False])  # -> ListA, ListB
join = JoinCurves(Curves=flatten([dispatch_4.ListB, dispatch_5.ListB]), Preserve=False)

# ----
# Technical Memorandum No. EM36-86-68110: 2.1.3.2 Uniform- or Variable Thickness Arch Dams
# 
# The number of lines that define the line-of-centers determines whether the arches are uniform thickness or variable thickness arches.
# The arches have uniform thickness if there is one line defining the extrados and intrados line-of-centers. This means that the radius center for the upstream and downstream faces is the same. The radii lengths are different at each elevation, but since the radius center is the same, the thickness of the arch is uniform.
# The arches vary in thickness if there are two lines defining the extrados and intrados line-of-centers. This means that the radius centers for the upstream and downstream faces are in different positions in space forcing the circular arcs of the arches to diverge.
panel_41 = Panel("""All in meters

Dam height: {3}
Radius = 0.6xL1 + Adjustment = {0} + {8} : {9}
L1: {1}
tc: {2}
USP base: {4}
DSP base: {5}
USP @ 0.45H: {6}
Volume if calculated with the equations: {7}
Free board: {10}
Offset foundation: {11}""")
panel_42 = Panel("""Radius: {9}
L1: {1}
tc: {2}
USP base: {4}
DSP base: {5}
USP at 45%H: {6}
Volume if calculated with the equations: {7}
Free board: {10}
Offset foundation: {11}""")
offset_foundation_3 = RemoteReceiver(offset_foundation)
freeboard_3 = RemoteReceiver(freeboard)
offset_foundation_4 = RemoteReceiver(offset_foundation)
downstream_face_angle_ratio_1 = Slider(0.8, range=0..1)
freeboard_4 = RemoteReceiver(freeboard)
dam_crest_width = Slider(6, range=0..100)
brep_terrain_base_foundation_2 = RemoteReceiver(brep_terrain_base_foundation)
levels_at_water_height_3 = RemoteReceiver(levels_at_water_height)

# ---- group: Water_Lateral part
neg_2 = Negative(Value=dam_5.DataFreeBoard)
Z_5 = UnitZ(Factor=neg_2)
move_9 = Move(Geometry=dam_5.DataChordDam, Motion=Z_5)  # -> Geometry, Transform
neg_3 = Negative(Value=Z_4)
extr = Extrude(Base=move_9.Geometry, Direction=neg_3)
srfsplit = SurfaceSplit(Surface=extr, Curves=project_3)
center = Center(Geometric=srfsplit, referenceAll=2)  # -> Center, Dimension
sort_2 = SortList(Keys=center.Center, ValuesA=srfsplit)  # -> Keys, ValuesA
item_9 = ListItem(List=reverse(sort_2.ValuesA), Index=0, Wrap=True)

# ----
chord_dam_3 = RemoteReceiver(chord_dam)
# ARCH DAM
chord_dam_4 = RemoteReceiver(chord_dam)
width_crest = RemoteSender(dam_crest_width)
gravity_ds_ration = RemoteSender(downstream_face_angle_ratio_1)

raxis_adjustments = Slider(20, range=-30..30)

# ---- group: Water_top part
move_10 = Move(Geometry=dam_5.DataFlatBase, Motion=Z_4)  # -> Geometry, Transform
srfsplit_2 = SurfaceSplit(Surface=move_10.Geometry, Curves=join)
center_2 = Center(Geometric=srfsplit_2, referenceAll=2)  # -> Center, Dimension
sort_3 = SortList(Keys=center_2.Dimension, ValuesB=srfsplit_2, ValuesA=center_2.Center)  # -> Keys, ValuesB, ValuesA
item_10 = ListItem(List=sort_3.ValuesB, Index=0, Wrap=True)

# ----
# surface
brep_terrain_base_foundation_3 = RemoteReceiver(brep_terrain_base_foundation)
list_4 = ValueList({"Concrete gravity dam": 0, "Arch dam": 1, "Embankment dam": 2}, selected="Concrete gravity dam")
# number
gravity_ds_ration_2 = RemoteReceiver(gravity_ds_ration)
filepath_hops_2 = RemoteReceiver(filepath_hops)
# line
chord_dam_5 = RemoteReceiver(chord_dam)
# number
width_crest_2 = RemoteReceiver(width_crest)
objfromgroup_3 = GetObjectsInGroup()
item_11 = ListItem(List=filepath_hops_2, Index=list_4, Wrap=True)
onoff = EnableDisableObject(Objects=objfromgroup_3, Enabled=Toggle(False))
brep_terrain_base_foundation_4 = RemoteReceiver(brep_terrain_base_foundation)
panel_43 = Panel("0.5,0.5")  # disabled
panel_44 = Panel(item_11)
gravity_ds_ration_3 = RemoteReceiver(gravity_ds_ration)

# ---- group: Water_bottom part
srfsplit_3 = SurfaceSplit(Surface=dam_5.DataBrepTerrain, Curves=join)  # -> flatten(Fragments)
item_12 = ListItem(List=sort_3.ValuesA, Index=0, Wrap=True)
flatten = FlattenTree(Tree=srfsplit_3, Path="{0}")
project_4 = ProjectPoint(Point=item_12, Direction=Vector(0, 0, -1), Geometry=flatten)  # -> Point, Index
item_13 = ListItem(List=flatten, Index=project_4.Index, Wrap=True)

# ----
chord_dam_6 = RemoteReceiver(chord_dam)
width_crest_3 = RemoteReceiver(width_crest)
evalsrf = EvaluateSurface(Point=panel_43)  # -> Point, Normal, UDirection, VDirection, Frame; disabled
number_slider_4 = Slider(378, range=0..1000)  # disabled
pt_2 = Point(evalsrf.Point)  # disabled
amp = Amplitude(Vector=evalsrf.Normal, Amplitude=number_slider_4)  # disabled
# Rough volume of water according to Dam height and position
vdisex = VectorDisplayEx(Point=pt_2, Vector=amp, Colour=RGB(0, 0, 0), Width=2)  # disabled
brep_2 = Brep(flatten([item_9, item_10, item_13]))
join_2 = BrepJoin(Breps=flatten(brep_2))  # -> Breps, Closed
offset_foundation_5 = RemoteReceiver(offset_foundation)  # disabled

# ----
# Excavation
number_slider_5 = Slider(2, range=0..10)  # disabled
division = Division(A=offset_foundation_5, B=number_slider_5)  # disabled
neg_4 = Negative(Value=division)  # disabled
offcrv = OffsetCurve(Plane=PlaneXY(0, 0, 0), Distance=neg_4, BothSides=0, Kinks=3, CapType=1)  # disabled
disc = Discontinuity(Curve=offcrv, Level=1)  # -> Points, Parameters; disabled
shatter_3 = Shatter(Curve=offcrv, Parameters=disc.Parameters)  # disabled
panel_45 = Panel("Line-like Curve")  # disabled
txt = Text(shatter_3)  # disabled
mindex = MemberIndex(Set=txt, Member=panel_45)  # -> Index, Count; disabled
cull_i = CullIndex(List=shatter_3, Indices=mindex.Index, Wrap=True)  # disabled
loft = Loft(Curves=cull_i, Options={Adjust=True, Closed=False, LoftEnds=0, LoftSimp=2, LoftType=0, Rebuild=10, Refit=0.01})  # disabled
Z_6 = UnitZ(Factor=offset_foundation_5)  # disabled
extr_2 = Extrude(Base=loft, Direction=Z_6)  # disabled
excavation_archdam = Geometry(extr_2)  # disabled

# ---- group: Input (Abutement vectors direction - check)
list_5 = ValueList({"Original": 0, "Flipped": 1}, selected="Flipped")  # disabled

# ----
dam_type_3 = RemoteReceiver(dam_type_2)
pline_2 = PolyLine(Vertices=disc.Points, Closed=False)  # disabled
fpatch = FragmentPatch(Boundary=offcrv)  # disabled
jagged = SettingsSpeed()
jagged_2 = SettingsSpeed()
# WATER
toggle_5 = BooleanToggle(True)
panel_46 = Panel("1")  # disabled
jagged_3 = SettingsSpeed()  # disabled
geo_concretedam_base = RemoteSender(excavation_archdam)  # disabled
list_6 = ValueList({"Default", "JD_AngularCheck"}, selected="JD_AngularCheck")  # disabled
number_slider_6 = Slider(57, range=0..100)  # disabled
list_7 = ValueList({"Concrete gravity dam": 0, "Arch dam": 1, "Embankment dam": 2}, selected="Concrete gravity dam")
dam_type_4 = RemoteReceiver(dam_type_2)
c_emitter = CurveEmitter(Radius=Domain(2, 10), Number=24)
dexpand = DomainExpand()
equals = Equality(FirstNumber=list_7, SecondNumber=list_7)  # -> Equality, Inequality
bias = NumbersBias(BiasNumber=0.1)
levels_at_water_height_4 = RemoteReceiver(levels_at_water_height)
vector_to_origin_2 = RemoteReceiver(vector_to_origin)
move_11 = Move(Geometry=levels_at_water_height_4, Motion=vector_to_origin_2)  # -> Geometry, Transform

# ----
# Visualization
# Terrain
lines_levels_2 = RemoteReceiver(lines_levels)
previewlw = CustomPreviewLineweights(Geometry=lines_levels_2, Shader=ColourSwatch(SwatchColor=RGB(107, 107, 107)), Absolute=False)

viz_dimensions_2 = RemoteReceiver(viz_dimensions)
swatch = ColourSwatch(SwatchColor=RGB(255, 174, 0))  # disabled
previewlw_2 = CustomPreviewLineweights(
    Geometry=levels_at_water_height_4,
    Shader=ColourSwatch(SwatchColor=RGB(255, 0, 0)),
    Thickness=Slider(4, range=0..10),
    Absolute=False)
viz_direction_river_2 = RemoteReceiver(viz_direction_river)  # disabled
save = ObjectSave(
    BakeToggle=False,
    FileName="GH_Obj.3dm",
    Layer="GH_Export",
    ObjectName="GH_Obj",
    ObjectColor=RGB(255, 255, 255),
    LayerColor=RGB(255, 255, 255))
load = Load(ForceVector=Vector(0, 0, 1), Weighting=1)
i_energy_head_losses_2 = RemoteReceiver(i_energy_head_losses)  # disabled
i_energy_design_discharge_2 = RemoteReceiver(i_energy_design_discharge)  # disabled
i_energy_ecological_discharge_2 = RemoteReceiver(i_energy_ecological_discharge)  # disabled
i_energy_powerplant_efficiency_2 = RemoteReceiver(i_energy_powerplant_efficiency)  # disabled
gravity_ds_ration_4 = RemoteReceiver(gravity_ds_ration)  # disabled

g_constant = Panel("9.81")  # disabled

i_energy_dir_2 = RemoteReceiver(i_energy_dir)  # disabled
chord_dam_7 = RemoteReceiver(chord_dam)  # disabled

dam_axis_3 = RemoteReceiver(dam_axis)  # disabled
line_river_2 = RemoteReceiver(line_river)  # disabled

powerhouse_pt_2 = RemoteReceiver(powerhouse_pt)  # disabled
midpt = CurveMiddle(Curve=chord_dam_7)  # disabled
freeboard_5 = RemoteReceiver(freeboard)  # disabled
num_2 = Number(i_energy_design_discharge_2)  # disabled
num_3 = Number(i_energy_ecological_discharge_2)  # disabled
num_4 = Number(i_energy_dir_2)  # disabled
powerhouse_pt_3 = RemoteReceiver(powerhouse_pt)  # disabled
chord_dam_8 = RemoteReceiver(chord_dam)  # disabled

# ---- group: Is that correct?
division_2 = Division(A=i_energy_powerplant_efficiency_2, B=100000)  # disabled

# ---- group: dam middle point
pt_3 = Point(midpt)  # disabled

# ---- group: power house static point
pt_4 = Point(powerhouse_pt_2)  # disabled

# ---- group: distance in straight line (!) between the dam and the PH
midpt_2 = CurveMiddle(Curve=chord_dam_8)  # disabled
pln_2 = Plane(midpt_2)  # disabled
project_5 = Project(Geometry=powerhouse_pt_3, Plane=pln_2)  # -> Geometry, Transform; disabled

# ----
brep_terrain_base_foundation_5 = RemoteReceiver(brep_terrain_base_foundation)  # disabled
number_slider_7 = Slider(1, range=0..10)  # disabled
panel_47 = Panel("2")  # disabled
neg_5 = Negative(Value=number_slider_7)  # disabled

# ---- group: distance in straight line (!) between the dam and the PH / L
dist = Distance(PointA=midpt_2, PointB=project_5.Geometry)  # disabled

# ----
panel_48 = Panel("-1")  # disabled
rad = Radians(Degrees=[number_slider_7, neg_5])  # disabled
lowest_point_dam_section_2 = RemoteReceiver(lowest_point_dam_section)
vector_to_origin_3 = RemoteReceiver(vector_to_origin)
panel_49 = Panel("2")  # disabled
panel_50 = Panel("-1")  # disabled

# ---- group: Just a random amplitude
number_slider_8 = Slider(50, range=0..100)

# ----
move_12 = Move(Geometry=lowest_point_dam_section_2, Motion=vector_to_origin_3)  # -> Geometry, Transform
chord_dam_9 = RemoteReceiver(chord_dam)
vector_to_origin_4 = RemoteReceiver(vector_to_origin)
panel_51 = Panel("-1")  # disabled
move_13 = Move(Geometry=chord_dam_9, Motion=vector_to_origin_4)  # -> Geometry, Transform
crv = Curve(move_13.Geometry)
Z_7 = UnitZ(Factor=Slider(-20, range=-21..-20))
midpt_3 = CurveMiddle(Curve=move_13.Geometry)
# Section
move_14 = Move(Geometry=crv, Motion=Z_7)  # -> Geometry, Transform
Z_8 = UnitZ(Factor=Slider(86, range=0..100))
extr_3 = Extrude(Base=move_14.Geometry, Direction=Z_8)
number_slider_9 = Slider(3, range=0..10)
chord_dam_10 = RemoteReceiver(chord_dam)  # disabled
number_slider_10 = Slider(10, range=0..10)  # disabled
xy_2 = XYPlane(Origin=Point(0, 0, 0))
number_slider_11 = Slider(10, range=0..10)  # disabled
netsurf = NetworkSurface(Continuity=2)  # disabled
offset_foundation_6 = RemoteReceiver(offset_foundation)  # disabled
lowest_point_dam_section_3 = RemoteReceiver(lowest_point_dam_section)  # disabled

# ---- group: results / variants / change the number of your variant before sending to Excel!
list_8 = ValueList({"1", "2", "3", "4", "5"}, selected="1")  # disabled

# ----
panel_52 = Panel("1")  # disabled
equals_2 = Equality(FirstNumber=list_8, SecondNumber=panel_52)  # -> Equality, Inequality; disabled

panel_53 = Panel("4")  # disabled
equals_3 = Equality(FirstNumber=list_8, SecondNumber=panel_53)  # -> Equality, Inequality; disabled

panel_54 = Panel("5")  # disabled
equals_4 = Equality(FirstNumber=list_8, SecondNumber=panel_54)  # -> Equality, Inequality; disabled

panel_55 = Panel("2")  # disabled
equals_5 = Equality(FirstNumber=list_8, SecondNumber=panel_55)  # -> Equality, Inequality; disabled

panel_56 = Panel("3")  # disabled
equals_6 = Equality(FirstNumber=list_8, SecondNumber=panel_56)  # -> Equality, Inequality; disabled

panel_57 = Panel("0.5,0.5")  # disabled
panel_58 = Panel("{0,0,1}")  # disabled
vec = Vector(panel_58)  # disabled
offset_foundation_7 = RemoteReceiver(offset_foundation)  # disabled
number_slider_12 = Slider(2, range=0..10)  # disabled
Z_9 = UnitZ(Factor=offset_foundation_7)  # disabled
xy_3 = XYPlane(Origin=Point(0, 0, 0))  # disabled
division_3 = Division(A=Z_9, B=number_slider_12)  # disabled
number_slider_13 = Slider(7, range=0..10)  # disabled
number_slider_14 = Slider(10, range=0..10)  # disabled
panel_59 = Panel("""Water level:
{0}
Dam crest level: 
{1}
Level foundation:
{2}
Arch dam height:
{3}
Straight axis lenght - to terrain:
{4}
Straight axis lenght - to bottom foundation:
{5}
Arch dam axis length - to bottom foundation:
{6}
Volume arch dam:
{7}""")
water_level_4 = RemoteReceiver(water_level)
jagged_4 = SettingsSpeed()
concat = Concatenate(FragmentA="BG + 20m for radius", FragmentB=water_level_4, JoinSeparator="-")
neg_6 = Negative(Value=number_slider_14)  # disabled
vector_to_origin_5 = RemoteReceiver(vector_to_origin)
path_save_2 = RemoteReceiver(path_save)
panel_60 = Panel("""Top
Perspective
Front
Right""")
water_level_5 = RemoteReceiver(water_level)
dam_level_3 = RemoteReceiver(dam_level)
path_save_3 = RemoteReceiver(path_save)
number_slider_15 = Slider(3, range=0..10)
water_level_6 = RemoteReceiver(water_level)
dam_level_4 = RemoteReceiver(dam_level)
captureview = LBCaptureView(file_name=concat, folder=path_save_2, viewport=panel_60, width="3840", height="2160", mode="Wireframe", capture=Button())  # -> file; plug-in component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
swatch_2 = ColourSwatch(SwatchColor=RGB(36, 36, 36))
panel_61 = Panel("""Water level
Dam crest level 
Level foundation
Dam height
Straight axis lenght - to terrain
Straight axis lenght - to bottom foundation
Arch dam axis length - to bottom foundation
Volume arch dam""")
list_9 = Accounts(
    {"No account selected": , "Account (natasha.catunda@gruner.ch | https://speckle.xyz)": "a5ede63e97"}, selected="Account (natasha.catunda@gruner.ch | https://speckle.xyz)",
    selectedId="a5ede63e97",
    selectedServer="https://speckle.xyz")
panel_62 = Panel("""Field's names
Values""")
sget = StreamGet(StreamIDURL="https://speckle.xyz/streams/acce82a2a9", SpeckleAccount=list_9)
vector_to_origin_6 = RemoteReceiver(vector_to_origin)
path_save_4 = RemoteReceiver(path_save)
panel_63 = Panel(path_save_4)
concat_2 = Concatenate(FragmentA=concat, FragmentB="_water")
concat_3 = Concatenate(FragmentA=panel_63, FragmentB="ArcGIS", JoinSeparator="\")
panel_64 = Panel("https://epsg.io/2056")
srs = SetSpatialReferenceSystem(SRS="EPSG:2056")
panel_65 = Panel(concat_2)

dam_axis_4 = RemoteReceiver(dam_axis)

point_upstream = RemoteSender(move_4.Geometry)

# ----
# Global settings
point_upstream_2 = RemoteReceiver(point_upstream)
crv_cp_2 = CurveClosestPoint(Point=point_upstream_2, Curve=dam_axis_4)  # -> Point, Parameter, Distance
vec2pt_2 = Vector2Pt(PointA=point_upstream_2, PointB=crv_cp_2.Point, Unitize=False)  # -> Vector, Length

vdisex_2 = VectorDisplayEx(Point=point_upstream_2, Vector=vec2pt_2.Vector, Colour=RGB(0, 0, 0), Width=2)  # disabled
# For optimization: Make perpendicular
# sections on the river line to discover
# best placement for the Dams.
panel_66 = Panel(vec2pt_2.Vector)

vector_waterflow = RemoteSender(vec2pt_2.Vector)

# ----
# Getting the correct vector of the vertical face with downstream direction
chord_dam_11 = RemoteReceiver(chord_dam)  # disabled
dam_level_5 = RemoteReceiver(dam_level)  # disabled
Z_10 = UnitZ(Factor=dam_level_5)  # disabled
neg_7 = Negative(Value=Z_10)  # disabled
extr_4 = Extrude(Base=move_7.Geometry, Direction=neg_7)  # disabled
evalsrf_2 = EvaluateSurface(Surface=reparameterize(extr_4), Point="0.5,0.5")  # -> Point, Normal, UDirection, VDirection, Frame; disabled
vector_waterflow_2 = RemoteReceiver(vector_waterflow)  # disabled
dprod = DotProduct(VectorA=evalsrf_2.Normal, VectorB=vector_waterflow_2, Unitize=False)  # disabled
panel_67 = Panel("0")  # disabled
smaller = SmallerThan(FirstNumber=dprod, SecondNumber=panel_67)  # -> SmallerThan, OrEqualTo; disabled
gate_2 = StreamGate(Stream=extr_4, Gate=smaller.SmallerThan)  # -> Target0, Target1; disabled
flip_2 = Flip(Surface=gate_2.Target1)  # -> Surface, Result; disabled
filter_2 = StreamFilter(Gate=smaller.SmallerThan, Stream0=gate_2.Target0, Stream1=flip_2.Surface)  # disabled
panel_68 = Panel("0.5,0.5")  # disabled
evalsrf_3 = EvaluateSurface(Surface=reparameterize(filter_2), Point=panel_68)  # -> Point, Normal, UDirection, VDirection, Frame; disabled

amp_2 = Amplitude(Vector=vector_waterflow_2, Amplitude=number_slider_3)  # disabled
vdisex_3 = VectorDisplayEx(Point=evalsrf_3.Point, Vector=amp_2, Colour=RGB(0, 0, 0), Width=2)  # disabled

# ---- group: vector vertical face
number_slider_16 = Slider(378, range=0..1000)  # disabled
amp_3 = Amplitude(Vector=evalsrf_3.Normal, Amplitude=number_slider_16)  # disabled
vdisex_4 = VectorDisplayEx(Point=evalsrf_3.Point, Vector=amp_3, Colour=RGB(0, 0, 0), Width=2)  # disabled

# ----
point_upstream_3 = RemoteReceiver(point_upstream)

# ----
# Steps from the Technical Memorandum
#  No. EM36-86-68110
dam_6 = DataDam(
    DataChordToBaseFoundation=chord_dam_3,
    DataBaseFoundationTerrain=brep_terrain_base_foundation_2,
    DataPointUpstream=point_upstream_3,
    DataLevelsAtWaterHeight=levels_at_water_height_3,
    DataChord_dam=chord_dam_4,
    BufferDelay=10000000,
    BufferMode=0)  # -> DataChordToBaseFoundation, DataBaseFoundationTerrain, DataPointUpstream, DataLevelsAtWaterHeight, DataChord_dam
objfromgroup_4 = GetObjectsInGroup()

# ----
# vector
vector_waterflow_3 = RemoteReceiver(vector_waterflow)
setobj_3 = SetObjectValue(ObjectToSet=objfromgroup_4, ValueToSet=run_arch_dam)
arch_dam_base_foundation_terrain = RemoteSender(dam_6.DataBaseFoundationTerrain)
chord_l1 = RemoteSender(dam_6.DataChord_dam)
# 1. Determine L1 with section line
chord_l1_2 = RemoteReceiver(chord_l1)
end = EndPoints(Curve=chord_l1_2)  # -> Start, End
# On the formulas it is assumed here
# the lenght to excavated sound rock!
# Check technical memorandum. I have
#  changed the axis line to come from the
#  determined excavation on 06.06.23
dist_2 = Distance(PointA=end.Start, PointB=end.End)
arch_l1 = RemoteSender(dist_2)
arch_l1_2 = RemoteReceiver(arch_l1)
arch_l1_3 = RemoteReceiver(arch_l1)
arch_dam_base_foundation_terrain_2 = RemoteReceiver(arch_dam_base_foundation_terrain)
vector_waterflow_4 = RemoteReceiver(vector_waterflow)

# ----
# GRAVITY DAM
# Top
# Concrete dam settings
# Final volume
midpt_4 = CurveMiddle(Curve=chord_dam_5)
project_6 = Project(Curve=chord_dam_5, Brep=brep_terrain_base_foundation_3, Direction=Vector(0, 0, 1))
end_2 = EndPoints(Curve=chord_dam_5)  # -> Start, End
x_tremez_2 = Extremes(Curve=project_6, Plane=PlaneXY(0, 0, 0))  # -> Highest, Lowest
pdecon = Deconstruct(Point=x_tremez_2.Lowest)  # -> XComponent, YComponent, ZComponent
pdecon_2 = Deconstruct(Point=midpt_4)  # -> XComponent, YComponent, ZComponent
subtraction = Subtraction(A=pdecon_2.ZComponent, B=pdecon.ZComponent)
multiplication_3 = Multiplication(A=subtraction, B=1.5)
panel_69 = Panel("{0,0,-1}")
line = LineSDL(Start=end_2.Start, Direction=panel_69, Length=multiplication_3)
atan = ArcTangent(Value=gravity_ds_ration_2)
rotax = RotateAxis(Geometry=line, Angle=atan, Axis=chord_dam_5)  # -> Geometry, Transform
swp1 = Sweep1(Rail=chord_dam_5, Sections=line, Miter=1)  # -> flatten(Brep)
swp1_2 = Sweep1(Rail=chord_dam_5, Sections=rotax.Geometry, Miter=1)  # -> flatten(Brep)
entwine = Entwine(Branch00=swp1, Branch01=swp1_2, FlattenInputs=True)  # -> simplify(Result)
bbx = BrepBrep(BrepA=entwine, BrepB=brep_terrain_base_foundation_3)  # -> Curves, Points
geo_3 = Geometry(bbx.Curves)
explode_2 = Explode(Curve=geo_3, Recursive=False)  # -> Segments, Vertices
pline_3 = PolyLine(Vertices=explode_2.Vertices, Closed=False)
lng_3 = ListLength(List=explode_2.Vertices)
number_slider_17 = Slider(0.5, range=0..1)
smoothpline = SmoothPolyline(Polyline=pline_3, Strength=number_slider_17, Times=lng_3)
srfsplit_4 = SurfaceSplit(Surface=entwine, Curves=smoothpline)
center_3 = Center(Geometric=srfsplit_4, referenceAll=2)  # -> Center, Dimension
sort_4 = SortList(Keys=center_3.Dimension, ValuesA=srfsplit_4)  # -> Keys, ValuesA
pt_5 = Point(midpt_4)
amp_4 = Amplitude(Vector=vector_waterflow_3, Amplitude=width_crest_2)
item_14 = ListItem(List=sort_4.ValuesA, Index=0, Wrap=True)  # -> simplify(Item)
loft_2 = Loft(
    Curves=flatten(smoothpline),
    Options={Adjust=True, Closed=False, LoftEnds=0, LoftSimp=0, LoftType=5, Rebuild=10, Refit=0.01})
simplify = SimplifyTree(Tree=smoothpline, Front=False)
move_15 = Move(Geometry=pt_5, Motion=amp_4)  # -> Geometry, Transform
panel_70 = Panel("{1}")
join_3 = BrepJoin(Breps=flatten([loft_2, item_14]))  # -> Breps, Closed
branch = TreeBranch(Tree=simplify, Path=panel_70, MaintainPaths=True)
branch_2 = TreeBranch(Tree=item_14, Path=panel_70, MaintainPaths=True)
panel_71 = Panel("0,0,-1")
project_7 = ProjectPoint(Point=move_15.Geometry, Direction=panel_71, Geometry=flatten(branch_2))  # -> Point, Index
number_slider_18 = Slider(20, range=0..100)
pline_4 = PolyLine(Vertices=flatten([pt_5, move_15.Geometry, project_7.Point]), Closed=True)
move2pt = MoveToPoint(Geometry=pline_4, PointA=pt_5, PointB=end_2.Start)  # -> Moved, Vector, Transform
Z_11 = UnitZ(Factor=number_slider_18)
swp1_3 = Sweep1(Rail=chord_dam_5, Sections=move2pt.Moved, Miter=1)
extr_5 = Extrude(Base=branch, Direction=Z_11)
split_5 = SplitBrep(Brep=extr_5, Cutter=swp1_3)
split_6 = SplitBrep(Brep=swp1_3, Cutter=extr_5)
center_4 = Center(Geometric=split_5, referenceAll=2)  # -> Center, Dimension
center_5 = Center(Geometric=split_6, referenceAll=2)  # -> Center, Dimension
sort_5 = SortList(Keys=center_4.Dimension, ValuesA=split_5)  # -> Keys, reverse(ValuesA)
sort_6 = SortList(Keys=center_5.Dimension, ValuesA=split_6)  # -> Keys, reverse(ValuesA)
cull_i_2 = CullIndex(List=sort_5.ValuesA, Indices=0, Wrap=True)
item_15 = ListItem(List=sort_6.ValuesA, Index=0, Wrap=True)
join_4 = BrepJoin(Breps=flatten([cull_i_2, item_15]))  # -> Breps, Closed
sunion = SolidUnion(Breps=[join_3.Breps, join_4.Breps])
jagged_5 = SettingsSpeed()
mesh_4 = MeshBrep(Brep=sunion, Settings=jagged_5)
objfromgroup_5 = GetObjectsInGroup()

hops = Hops(
    BrepTerrain=brep_terrain_base_foundation_4,
    ChordDam=chord_dam_6,
    DSRatio=gravity_ds_ration_3,
    VectorWaterflow=vector_waterflow_4,
    WidthCrest=width_crest_3,
    CacheResultsInMemory=False,
    CacheSolveResults=False,
    RemoteDefinitionLocation="C:\Users\Admin\Documents\Github\EarlyStageDesign\JD\Skripts\Modules\Gravity.gh",
    RemoteSolveVersion=(0, 1, 0),
    ShowInput_Enabled=False,
    ShowInput_Path=False,
    SynchronousSolve=True)  # -> Geo, Volume; disabled
arch_dam_base_foundation_terrain_3 = RemoteReceiver(arch_dam_base_foundation_terrain)
onoff_2 = EnableDisableObject(
    Objects=objfromgroup_5,
    Enabled=equals.Equality,
    AllObjects_Object=[line, panel_69, end_2, rotax, atan, x_tremez_2, project_6, pdecon_2, pdecon, subtraction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])
volume = MeshVolume(Mesh=mesh_4)  # -> Volume, Centroid
# geometry
geo_concretedam = RemoteSender(mesh_4)
geo_concretedam_2 = RemoteReceiver(geo_concretedam)
geo_concretedam_3 = RemoteReceiver(geo_concretedam)
arch_dam_base_foundation_terrain_4 = RemoteReceiver(arch_dam_base_foundation_terrain)

# ---- group: defining a power house point from the distance from a dam
Z_12 = UnitZ(Factor=1)  # disabled
extr_6 = Extrude(Base=dam_axis_3, Direction=Z_12)  # disabled
split_7 = SplitWithBrep(Curve=line_river_2, Brep=extr_6)  # -> Curve, Points; disabled
point_upstream_4 = RemoteReceiver(point_upstream)  # disabled
end_3 = EndPoints(Curve=split_7.Curve)  # -> Start, End; disabled
dist_3 = Distance(PointA=end_3.Start, PointB=point_upstream_4)  # disabled
rev_2 = ReverseList(List=dist_3)  # disabled
item_16 = ListItem(List=rev_2, Index=0, Wrap=True)  # disabled
mindex_2 = MemberIndex(Set=dist_3, Member=item_16)  # -> Index, Count; disabled
toggle_6 = BooleanToggle(True)  # disabled
item_17 = ListItem(List=split_7.Curve, Index=mindex_2.Index, Wrap=True)  # disabled
mesh_terrain_2 = RemoteReceiver(mesh_terrain)  # disabled
eval = EvaluateLength(Curve=item_17, Normalized=toggle_6)  # -> Point, Tangent, Parameter; disabled

# ---- group: defining a power house point from the distance from a dam / Power_house_point
python = GhPythonScript(point=eval.Point, mesh=mesh_terrain_2)  # -> out, simplify(a); disabled
# ---------- python: Python ----------
__author__ = "cna"
__version__ = "2022.02.03"

import rhinoscriptsyntax as rs


#Project down...
a = rs.ProjectPointToMesh(point, mesh, (0,0,1))
# ---------- end python ----------

# ---- group: VIZ / house visualisation
number_slider_19 = Slider(20, range=0..100)  # disabled
pdecon_3 = Deconstruct(Point=python.a)  # -> XComponent, YComponent, ZComponent; disabled
addition_2 = Addition(A=pdecon_3.XComponent, B=number_slider_19)  # disabled
addition_3 = Addition(A=pdecon_3.YComponent, B=number_slider_19)  # disabled
addition_4 = Addition(A=pdecon_3.ZComponent, B=number_slider_19)  # disabled
pt_6 = ConstructPoint(XCoordinate=addition_2, YCoordinate=addition_3, ZCoordinate=addition_4)  # disabled
swatch_3 = ColourSwatch(SwatchColor=RGB(255, 242, 99))  # disabled
box = Box2Pt(PointA=pt_6, PointB=python.a, Plane=PlaneXY(0, 0, 0))  # disabled
preview = CustomPreview(Geometry=box, Material=swatch_3)  # disabled

# ----
vector_waterflow_5 = RemoteReceiver(vector_waterflow)
amp_5 = Amplitude(Vector=vector_waterflow_5, Amplitude=number_slider_8)
vector_waterflow_6 = RemoteReceiver(vector_waterflow)
rev_3 = Reverse(Vector=vector_waterflow_6)
amp_6 = Amplitude(Vector=rev_3, Amplitude=Slider(5, range=0..100))
devec = DeconstructVector(Vector=rev_3)  # -> XComponent, YComponent, ZComponent
data = Data([devec.XComponent, devec.YComponent, devec.ZComponent])
geo_4 = Geometry(dam_6.DataChordToBaseFoundation)
len_2 = Length(Curve=geo_4)

# ----
# Preliminary layout of concrete arch dams (USBR)
# Topographic deiminesions necessary to
# compute thicknesses, projections, and
# volume are:
# - structural height (H)
# - horizontal distances between abutments;
#      - including estimated excavation to sound rock at crest elevation (L1)
#      - and 15 % of H above base (L2)
# Definitions: H = structural height
# Tc = thickness at crest
# Tb = thickness at base
# T_0.45H = thickness of crown cantilever at 0.45H above base (T0.45H)
# USP = upstream projection
# DSP = downestream projection
# L1 = straight line distance at crest elevation between abutmenets assumed excavated to sound rock
# L2 = straight line distance, at 0.15H above base, between abutments assumed excavated to sound rock
# V = estimated volume of dam
# Formulas - conservative as compared with values computed more precisely (in feet)
# at crest:
# at  base
# at 0.45H
arch_l1_4 = RemoteReceiver(arch_l1)
arch_l1_current_m = Panel(arch_l1_4)
units = ConvertUnits(Value=arch_l1_current_m, Source=2, Target=4, Exponent=1)  # -> Result, Factor
l1_feet = Panel(units.Result)
panel_72 = Panel("USPcrest = 0.0")
panel_73 = Panel("DSPcrest = Tc")
expression_3 = Expression(L1=l1_feet, Expression="0.6*L1")
# Technical Memorandum No. EM36-86-68110: 2.1.3.1 Single-, Two-, or Three- Centered Arch Dams
# 
# The number of lines-of-centers determines whether the arches are the same on the left and right side of the dam, are different on the left and right sides of the dam, or different on the inner and outer parts of the dam.
# 
# A single centered arch dam has a single line-of-centers that results in the same circular arcs from the left to the right abutment.
# 
# A 2-centered arch dam has two lines-of-centers that result in different circular arcs for the left side and right sides of the dam.
# 
# A 3-centered arch dam has two lines-of-centers that result in different circular arcs near the crown cantilever (inner) and near the abutments (outer). The radii for the inner arcs are shorter than the outer arcs.
panel_74 = Panel(" 1 foot = 0.3048 m")
r_axis_feet = Panel(expression_3)
units_2 = ConvertUnits(Value=r_axis_feet, Source=4, Target=2, Exponent=1)  # -> Result, Factor
r_axis_m = Panel(units_2.Result)
crest_radius = RemoteSender(r_axis_m)

crest_radius_2 = RemoteReceiver(crest_radius)
crest_radius_3 = RemoteReceiver(crest_radius)
# Technical Memorandum No. EM36-86-68110: 4.2 Determine an Appraisal Level Arch Dam Layout
# 
# 3 - If the topography map is of the ground surface, change the contours to represent the position of sound rock.
crest_radius_4 = RemoteReceiver(crest_radius)

# ----
# Technical Memorandum No. EM36-86-68110: 4.2 Determine an Appraisal Level Arch Dam Layout
# 
# 2 - Determine Raxis= 0.6 L1 and round the value of Raxis up to the nearest 10 to 50 feet.
# This is the initial layout, so no need for decimal accuracy
r_crest_usp = Panel(crest_radius_4)

# ----
# 2. Determine radius according to L1
addition_5 = Addition(A=r_crest_usp, B=raxis_adjustments)

# ----
# 3. Create crest curve
end_4 = EndPoints(Curve=dam_6.DataChordToBaseFoundation)  # -> Start, End
cir = Circle(Plane=end_4.Start, Radius=addition_5)
cir_2 = Circle(Plane=end_4.End, Radius=addition_5)
ccx_2 = CurveCurve(CurveA=cir, CurveB=cir_2)  # -> Points, ParamsA, ParamsB
dist_4 = Distance(PointA=ccx_2.Points, PointB=dam_6.DataPointUpstream)
sort_7 = SortList(Keys=dist_4, ValuesA=ccx_2.Points)  # -> reverse(Keys), reverse(ValuesA)
item_18 = ListItem(List=sort_7.ValuesA, Index=0, Wrap=True)  # -> Item, Item1
circle = CircleCNR(Center=item_18.Item, Normal=Vector(0, 0, 1), Radius=addition_5)
ln_3 = Line(StartPoint=item_18.Item, EndPoint=item_18.Item1)
ccx_3 = CurveCurve(CurveA=dam_6.DataChordToBaseFoundation, CurveB=circle)  # -> Points, ParamsA, ParamsB
shatter_4 = Shatter(Curve=circle, Parameters=ccx_3.ParamsB)
colom_3 = CollisionOneMany(Collider=ln_3, Obstacles=shatter_4)  # -> Collision, Index
item_19 = ListItem(List=shatter_4, Index=colom_3.Index, Wrap=True)

# ---- group: Axis arch Dam
# Technical Memorandum No. EM36-86-68110: 4.2 Determine an Appraisal Level Arch Dam Layout
# 
# 4 - Position the dam in the canyon. Draw a circular arc with radius Raxis...This arc is the axis of the dam and is the upstream side of the crest. Move the axis around the propose dam location to
# position the top of the dam in the canyon.
# 
# The angle of incidence of the axis into the left and right abutments should be approximately equal to produce a geometrically symmetric dam in the canyon.
geo_5 = Geometry(item_19)

# ----
usp_arch_crest = RemoteSender(geo_5)

# ----
# Abutements angle check
usp_arch_crest_2 = RemoteReceiver(usp_arch_crest)  # disabled

# ---- group: Vector abutements
crest_line = Geometry(usp_arch_crest_2)  # disabled
end_5 = EndPoints(Curve=crest_line)  # -> Start, End; disabled
pt_7 = Point([end_5.Start, end_5.End])  # disabled
crv_cp_3 = CurveClosestPoint(Point=pt_7, Curve=crest_line)  # -> Point, Parameter, Distance; disabled
eval_2 = EvaluateCurve(Curve=crest_line, Parameter=crv_cp_3.Parameter)  # -> simplify(graft(Point)), Tangent, Angle; disabled
dispatch_6 = Dispatch(List=eval_2.Tangent, DispatchPattern=[True, False])  # -> ListA, ListB; disabled
gate_3 = StreamGate(Stream=dispatch_6.ListA, Gate=list_5)  # -> Target0, Target1; disabled
gate_4 = StreamGate(Stream=dispatch_6.ListB, Gate=list_5)  # -> Target0, Target1; disabled
neg_8 = Negative(Value=gate_4.Target0)  # disabled
neg_9 = Negative(Value=gate_3.Target1)  # disabled
vec_2 = Vector([gate_3.Target0, neg_8])  # disabled
vec_3 = Vector([neg_9, gate_4.Target1])  # disabled
number_slider_20 = Slider(47, range=0..100)  # disabled
amp_7 = Amplitude(Vector=[vec_2, vec_3], Amplitude=number_slider_20)  # -> simplify(graft(Vector)); disabled
vdisex_5 = VectorDisplayEx(Point=eval_2.Point, Vector=amp_7, Colour=RGB(0, 0, 0), Width=2)  # disabled

# ----
usp_arch_crest_3 = RemoteReceiver(usp_arch_crest)
usp_arch_crest_4 = RemoteReceiver(usp_arch_crest)
usp_arch_crest_5 = RemoteReceiver(flatten(usp_arch_crest))
path_mapper = PathMapper(usp_arch_crest_5, source="{A}", target="{0;A}")
usp_arch_crest_6 = RemoteReceiver(usp_arch_crest)  # disabled
usp_arch_crest_7 = RemoteReceiver(flatten(usp_arch_crest))  # disabled
path_mapper_2 = PathMapper(usp_arch_crest_7, source="{A}", target="{0;A}")  # disabled
usp_arch_crest_8 = RemoteReceiver(usp_arch_crest)
len_3 = Length(Curve=usp_arch_crest_8)

# ---- group: Level vector
geo_6 = Geometry(dam_6.DataLevelsAtWaterHeight)  # disabled
pt_8 = Point(graft(pt_7))  # disabled
number_slider_21 = Slider(75, range=0..100)  # disabled
crv_cp_4 = CurveClosestPoint(Point=pt_8, Curve=geo_6)  # -> Point, simplify(Parameter), Distance; disabled
addition_6 = Addition(A=crv_cp_4.Parameter, B=number_slider_21)  # disabled
subtraction_2 = Subtraction(A=crv_cp_4.Parameter, B=number_slider_21)  # disabled
shatter_5 = Shatter(Curve=geo_6, Parameters=[addition_6, subtraction_2])  # disabled
dispatch_7 = Dispatch(List=shatter_5, DispatchPattern=[True, False])  # -> ListA, ListB; disabled
level_at_parameter_75_to_75_from_dam_end = Geometry(dispatch_7.ListB)  # "Level at parameter -75 to +75 from dam endpoints"; disabled
end_6 = EndPoints(Curve=level_at_parameter_75_to_75_from_dam_end)  # -> simplify(Start), simplify(End); disabled
pt_9 = Point(simplify(pt_8))  # disabled
pt_10 = Point([end_6.Start, end_6.End, pt_9])  # disabled
number_slider_22 = Slider(4, range=0..10)  # disabled
panel_75 = Panel("""2
2""")  # disabled
number_slider_23 = Slider(47, range=0..100)  # disabled
swatch_4 = ColourSwatch(SwatchColor=RGB(10, 166, 155))  # disabled

# ---- group: Level vector / Average level line
fline = FitLine(Points=pt_10)  # disabled

# ---- group: Level vector (continued)
midpt_5 = CurveMiddle(Curve=fline)  # disabled
vec2pt_3 = Vector2Pt(PointA=midpt_5, PointB=pt_9, Unitize=False)  # -> Vector, Length; disabled

# ---- group: Level vector / Average level line aligned with crest
move_16 = Move(Geometry=fline, Motion=vec2pt_3.Vector)  # -> Geometry, Transform; disabled

# ---- group: Level vector (continued)
midpt_6 = CurveMiddle(Curve=move_16.Geometry)  # disabled
end_7 = EndPoints(Curve=move_16.Geometry)  # -> Start, End; disabled
geo_7 = Geometry(end_7.Start)  # disabled
vec2pt_4 = Vector2Pt(PointA=midpt_6, PointB=geo_7, Unitize=False)  # -> Vector, Length; disabled
dash = DashPattern(Curve=move_16.Geometry, Pattern=panel_75)  # -> Dashes, Gaps; disabled
amp_8 = Amplitude(Vector=vec2pt_4.Vector, Amplitude=number_slider_23)  # disabled
vdisex_6 = VectorDisplayEx(Point=midpt_6, Vector=amp_8, Colour=RGB(0, 0, 0), Width=2)  # disabled
previewlw_3 = CustomPreviewLineweights(Geometry=dash.Dashes, Shader=swatch_4, Thickness=number_slider_22, Absolute=False)  # disabled

# ----
vec2pt_5 = Vector2Pt(PointA=midpt_6, PointB=end_7.End, Unitize=False)  # -> Vector, Length; disabled

# ---- group: Angle visualization
move_17 = Move(Geometry=eval_2.Point, Motion=amp_7)  # -> Geometry, Transform; disabled
angle = Angle(VectorA=vec2pt_5.Vector, VectorB=amp_7)  # -> Angle, Reflex; disabled
angle_2 = Angle(VectorA=vec2pt_4.Vector, VectorB=amp_7)  # -> Angle, Reflex; disabled
deg = Degrees(Radians=angle_2.Angle)  # disabled
panel_76 = Panel(deg)  # disabled

# ----
geo_8 = Geometry(end_7.End)  # disabled
# DESIGN MANUAL FOR CONCRETE ARCH DAMS, 1977: Owing to
# limitations imposed by topographic conditions
#  and foundation requirements, it will be found
#  that, for most layouts, the largest practicable
# central angle for the top arch varies between 90° and 110°.
angulardim = DefineAngularDimension(Origin=midpt_6, Point1=geo_7, Point2=move_17.Geometry, Offset=number_slider_6, DimensionStyle=list_6)  # disabled
angulardim_2 = DefineAngularDimension(Origin=midpt_6, Point1=move_17.Geometry, Point2=geo_8, Offset=number_slider_6, DimensionStyle=list_6)  # disabled
deg_2 = Degrees(Radians=angle.Angle)  # disabled
panel_77 = Panel(deg_2)  # disabled
dimensions_check_2 = RemoteSender([angulardim_2, angulardim])  # disabled

# ----
# Viz dimensions
objfromgroup_6 = GetObjectsInGroup()
dimensions_check_3 = RemoteReceiver([dimensions_check_2, dimensions_check])  # disabled
number_slider_24 = Slider(1, range=0..10)  # disabled
swatch_5 = ColourSwatch(SwatchColor=RGB(0, 0, 0))  # disabled
previewlw_4 = CustomPreviewLineweights(Geometry=dimensions_check_3, Shader=swatch_5, Thickness=number_slider_24, Absolute=False)  # disabled

onoff_3 = EnableDisableObject(
    Objects=objfromgroup_6,
    Enabled=viz_dimensions_2,
    AllObjects_Object=[dimensions_check_3, previewlw_4, number_slider_24, swatch_5])

# ----
# Excavation volume
geo_concretedam_excavation = RemoteReceiver()  # disabled
swatch_6 = ColourSwatch(SwatchColor=RGB(164, 161, 212))  # disabled

# ----
# Dam top
dam_type_5 = RemoteReceiver(dam_type_2)

# ---- group: Lowest point (Base - middle section)
project_8 = Project(Curve=usp_arch_crest_3, Brep=arch_dam_base_foundation_terrain_3, Direction=Vector(0, 0, 1))

# ----
eval_3 = EvaluateCurve(Curve=reparameterize(project_8), Parameter=Slider(0.58, range=0..1))  # -> Point, Tangent, Angle

# ----
# 4. Figure L2
darc = DeconstructArc(Arc=usp_arch_crest_3)  # -> flatten(BasePlane), Radius, Angle
x_tremez_3 = Extremes(Curve=project_8, Plane=PlaneXY(0, 0, 0))  # -> Highest, Lowest

# ---- group: Lowest point (Base - middle section) (continued)
# Technical Memorandum No. EM36-86-68110: 4.2 Determine an Appraisal Level Arch Dam Layout
# 
# 5 - On the axis, locate a point about midway between the abutments and in the riverbed. This is the location of the crown cantilever...
pt_11 = Point(x_tremez_3.Lowest)

# ----
move_18 = Move(Geometry=pt_11, Motion=vector_to_origin_4)  # -> Geometry, Transform
pt_12 = Point(move_18.Geometry)
move_19 = Move(Geometry=pt_12, Motion=amp_5)  # -> Geometry, Transform
ln_4 = Line(StartPoint=pt_12, EndPoint=move_19.Geometry)

# ---- group: View Plane - Check if the direction is correct
# SECTION CUT
crv_2 = Curve(ln_4)
Z_13 = UnitZ(Factor=Slider(-20, range=-21..-20))
move_20 = Move(Geometry=crv_2, Motion=Z_13)  # -> Geometry, Transform
Z_14 = UnitZ(Factor=Slider(86, range=0..100))
extr_7 = Extrude(Base=move_20.Geometry, Direction=Z_14)
midpt_7 = CurveMiddle(Curve=crv_2)
flip_3 = Flip(Surface=extr_7)  # -> Surface, Result

# ----
# Section
number_slider_25 = Slider(2, range=0..10)
number_slider_26 = Slider(4, range=0..10)
offset = OffsetCurve(Curve=crv_2, Distance=Slider(50, range=0..100), Corners=1)
midpt_8 = CurveMiddle(Curve=offset)
camera = CameraCrane(Location=midpt_8, Target=midpt_7, Perspective="0", View=number_slider_25, Refresh=Button())  # -> Camera, Target, Lens, Up, HorizontalViewAngle, VerticalViewAngle, ScreenRatio, Frame

evalsrf_4 = EvaluateSurface(Surface=reparameterize(flip_3.Surface), Point="0.5,0.5")  # -> Point, Normal, UDirection, VDirection, Frame

pl = PlaneNormal(Origin=move_18.Geometry, ZAxis=rev_3)
pdecon_4 = Deconstruct(Point=move_18.Geometry)  # -> XComponent, YComponent, ZComponent

pdecon_5 = Deconstruct(Point=evalsrf_4.Normal)  # -> XComponent, YComponent, ZComponent
pdecon_6 = Deconstruct(Point=midpt_7)  # -> XComponent, YComponent, ZComponent
c_script_2 = CSharpScript(polyList=flip_3.Surface)  # -> out, planeList; inputs polyList: list of Polyline
# ---------- c_script_2: C# ----------
    List<Plane> planes = new List<Plane>();
    foreach(Polyline poly in polyList){
      Plane plane = new Plane(poly.ElementAt(0), poly.ElementAt(1), poly.ElementAt(2));
      planes.Add(plane);
    }
    planeList = planes;
# ---------- end c_script_2 ----------
c_script_3 = CSharpScript(
    enable=Toggle(True),
    clipPlaneOrigin=[pdecon_6.XComponent, pdecon_6.YComponent, pdecon_6.ZComponent],
    clipPlaneDir=[pdecon_5.XComponent, pdecon_5.YComponent, pdecon_5.ZComponent],
    userPlanes=c_script_2.planeList,
    moveClipInZAxis=Slider(-7.01, range=-50..10),
    flip=Toggle(True),
    pageViews=Toggle(True),
    index=number_slider_25,
    clipU=Slider(0.5, range=0.5..100),
    clipV=Slider(2.6, range=0.5..100))  # -> out, viewPicked, viewsInDocument, messageOfTheDay; inputs enable: Boolean, clipPlaneOrigin: list of Double, clipPlaneDir: list of Double, void4: list of Plane, useUserPlanes: Boolean, userPlanes: list of Plane, moveClipInZAxis: Double, flip: Boolean, pageViews: Boolean, index: Int32, clipU: Double, clipV: Double
# ---------- c_script_3: C# ----------
    //by The Lord of Darkness due to critical Vodka starvation issues

    Rhino.Display.RhinoView[] viewsList = RhinoDocument.Views.GetViewList(true, pageViews);

    if(index >= viewsList.Length) index = viewsList.Length - 1;
    List<string> availableViews = new List<string>();
    string viewP = "";

    for(int i = 0; i < viewsList.Length;i++){
      Rhino.Display.RhinoView rview = viewsList[i];
      availableViews.Add(rview.ActiveViewport.Name);
      if(i == index){
        rv = rview.ActiveViewport;
        viewP = rv.Name;
        viewPortID = rview.ActiveViewportID;
      }
    }
    viewsInDocument = availableViews; //>>out
    viewPicked = viewP;               //>>out

    int removed = 0;
    PurgeClipPlane(rv, ref removed);
    if(!enable){ Print("Clip(s): {0} removed", removed);return;}

    userPlanes = userPlanes.Where(x => x != Plane.Unset).ToList();
    if(useUserPlanes && userPlanes.Any()){
      for(int i = 0; i < userPlanes.Count;i++){
        Plane p = userPlanes[i];
        if(moveClipInZAxis != 0){
          Vector3d vz = p.ZAxis; vz.Unitize(); vz *= moveClipInZAxis;
          p.Translate(vz);
        }
        if(flip) p.Flip();        
        Guid id = doc.Objects.AddClippingPlane(p, clipU, clipV, viewPortID);
      }
      doc.Views.Redraw();
      Print("Clip(s): {0} active", userPlanes.Count);
    }
    else{
      Point3d orig = new Point3d(clipPlaneOrigin[0], clipPlaneOrigin[1], clipPlaneOrigin[2]);
      Plane plane = new Plane(orig, new Vector3d(clipPlaneDir[0], clipPlaneDir[1], clipPlaneDir[2]));
      if(moveClipInZAxis != 0){
        Vector3d vz = plane.ZAxis; vz.Unitize(); vz *= moveClipInZAxis;
        plane.Translate(vz);
      }
      if(flip)plane.Flip();
      Guid id = doc.Objects.AddClippingPlane(plane, clipU, clipV, viewPortID);
      Print("Clip:  active");
      if (id != Guid.Empty){  doc.Views.Redraw(); }
    }
# ---------- c_script_3: C# additional code ----------
  public Rhino.Display.RhinoViewport rv;
  public Guid viewPortID;

  public void PurgeClipPlane(Rhino.Display.RhinoViewport rv, ref int removed){
    ClippingPlaneObject[] clipObjects = RhinoDoc.ActiveDoc.Objects.FindClippingPlanesForViewport(rv);
    //.FindByObjectType(ObjectType.ClipPlane());
    // ClippingPlaneObject[] clipObjects = RhinoDoc.ActiveDoc.Objects.FindClippingPlanesForViewport(rv);
    //  if(clipObjects.Length < 1 || clipObjects == null)return;
    removed = clipObjects.Length;
    for(int i = 0; i < clipObjects.Length;i++){
      ClippingPlaneObject cpo = clipObjects[i];
      RhinoDoc.ActiveDoc.Objects.Purge(cpo);
    }
  }
# ---------- end c_script_3 ----------
panel_78 = Panel(c_script_3.viewPicked)

move_21 = Move(Geometry=move_18.Geometry, Motion=amp_6)  # -> Geometry, Transform
data_2 = Data([pdecon_4.XComponent, pdecon_4.YComponent, pdecon_4.ZComponent])
c_script_4 = CSharpScript(
    enable=Toggle(False),
    clipPlaneOrigin=data_2,
    clipPlaneDir=data,
    userPlanes=pl,
    moveClipInZAxis=Slider(0, range=-50..10),
    flip=Toggle(True),
    pageViews=Toggle(True),
    index=number_slider_9,
    clipU=Slider(0.5, range=0.5..100),
    clipV=Slider(0.5, range=0.5..100))  # -> out, viewPicked, viewsInDocument, messageOfTheDay; inputs enable: Boolean, clipPlaneOrigin: list of Double, clipPlaneDir: list of Double, void4: list of Plane, useUserPlanes: Boolean, userPlanes: list of Plane, moveClipInZAxis: Double, flip: Boolean, pageViews: Boolean, index: Int32, clipU: Double, clipV: Double; same code as c_script_3
camera_2 = CameraCrane(
    Location=move_18.Geometry,
    Target=move_21.Geometry,
    UPVector=xy_2,
    Perspective="0",
    View=number_slider_9,
    Refresh=Button())  # -> Camera, Target, Lens, Up, HorizontalViewAngle, VerticalViewAngle, ScreenRatio, Frame
panel_79 = Panel(c_script_4.viewPicked)
pt_13 = Point(camera_2.Camera)
panel_80 = Panel(c_script_4.out)
panel_81 = Panel(c_script_3.out)
pdecon_7 = Deconstruct(PointAtBase=pt_11)  # -> XComponent, YComponent, ZComponent

project_9 = Project(Geometry=pt_11, Plane=darc.BasePlane)  # -> Geometry, Transform
ln_5 = Line(StartPoint=pt_11, EndPoint=project_9.Geometry)
eval_4 = EvaluateCurve(Height=reparameterize(ln_5), Point_at_015H="0.15")  # -> Point, Tangent, Angle
len_4 = Length(Curve=ln_5)

# ---- group: Centrifugal vector
pt_14 = Point(darc.BasePlane)
pt_15 = Point(project_9.Geometry)
vec2pt_6 = Vector2Pt(PointA=pt_15, PointB=pt_14, Unitize=True)  # -> Vector, Length

# ----
vec2pt_7 = Vector2Pt(PointA=pt_15, PointB=eval_4.Point, Unitize=False)  # -> Vector, Length
move_22 = Move(Geometry=usp_arch_crest_3, Motion=vec2pt_7.Vector)  # -> Geometry, Transform
bcx = BrepCurve(Brep=arch_dam_base_foundation_terrain_3, Curve=move_22.Geometry)  # -> Curves, flatten(Points)
crv_cp_5 = CurveClosestPoint(Point=bcx.Points, Curve=move_22.Geometry)  # -> Point, Parameter, Distance
shatter_6 = Shatter(Curve=move_22.Geometry, Parameters=crv_cp_5.Parameter)
colom_4 = CollisionOneMany(Collider=eval_4.Point, Obstacles=shatter_6)  # -> Collision, Index
item_20 = ListItem(List=shatter_6, Index=colom_4.Index, Wrap=True)
end_8 = EndPoints(Curve=item_20)  # -> Start, End
dist_5 = Distance(PointA=end_8.Start, PointB=end_8.End)

# ----
# Technical Memorandum No. EM36-86-68110: 4.2 Determine an Appraisal Level Arch Dam Layout
# 
# 5 - ...The radius of the axis at this point is the orientation of the reference plane and the line of centers. The reference plane is a vertical plane through the crown cantilever and generally parallel to the stream bank.
ln_6 = Line(StartPoint=pt_15, EndPoint=pt_14)

project_10 = Project(Geometry=ln_6, Plane=pt_11)  # -> Geometry, Transform
rulesrf = RuledSurface(CurveA=project_10.Geometry, CurveB=ln_6)

srf = Surface(rulesrf)
evalsrf_5 = EvaluateSurface(Surface=reparameterize(srf), Point="0.5,0.5")  # -> Point, Normal, UDirection, VDirection, Frame
amp_9 = Amplitude(Vector=evalsrf_5.Normal, Amplitude=Slider(50, range=0..100))
vdisex_7 = VectorDisplayEx(Point=evalsrf_5.Point, Vector=amp_9, Colour=RGB(0, 0, 0), Width=2)

pl_2 = PlaneNormal(Origin=evalsrf_5.Point, ZAxis=evalsrf_5.Normal)
ext = ExtendCurve(Curve=project_10.Geometry, Type=0, Start=500, End=500)
crv_3 = Curve(ext)
geo_9 = Geometry(ln_5)
abiscissa_dam_axis = RemoteSender(crv_3)
centrifugal_vector = RemoteSender(vec2pt_6.Vector)
center_crest = RemoteSender(pt_14)
arch_dam_height = RemoteSender(len_4)
arch_dam_height_2 = RemoteReceiver(arch_dam_height)
arch_dam_height_3 = RemoteReceiver(arch_dam_height)
arch_l2 = RemoteSender(dist_5)

arch_dam_height_4 = RemoteReceiver(arch_dam_height)
# Do concrete formula estimation to check
# how different they are from the volume in gh
# check memoradum
arch_l2_2 = RemoteReceiver(arch_l2)
arch_l2_current_m = Panel(arch_l2_2)
meter = Panel(arch_dam_height_4)
units_3 = ConvertUnits(Value=meter, Source=2, Target=4, Exponent=1)  # -> Result, Factor
units_4 = ConvertUnits(Value=arch_l2_current_m, Source=2, Target=4, Exponent=1)  # -> Result, Factor
l2_feet = Panel(units_4.Result)
feet = Panel(units_3.Result)
expression_4 = Expression(H=feet, L1=l1_feet, Expression="0.01*(H + 1.2*L1)")
expression_5 = Expression(H=feet, L1=l1_feet, L2=l2_feet, Expression="(0.0012*H*L1*L2*((H/400)^(H/400)))^(⅓)")
expression_6 = Expression(Tb=expression_5, Expression="0.67*Tb")
expression_7 = Expression(Tb=expression_5, Expression="0.33*Tb")
expression_8 = Expression(Tb=expression_5, Expression="0.95*Tb")
expression_9 = Expression(H=feet, L1=l1_feet, L2=l2_feet, Expression="0.000002*(H²)*L2*(((H+0.8*L1)²)/(L1-L2))+0.0004*H*L1*(H+1.1*L1)")
tc_feet = Panel(expression_4)
usp_base_feet = Panel(expression_6)
dsp_base_feet = Panel(expression_7)
tb_0_45h_feet = Panel(expression_8)
units_5 = ConvertUnits(Value=tc_feet, Source=4, Target=2, Exponent=1)  # -> Result, Factor
units_6 = ConvertUnits(Value=usp_base_feet, Source=4, Target=2, Exponent=1)  # -> Result, Factor
units_7 = ConvertUnits(Value=dsp_base_feet, Source=4, Target=2, Exponent=1)  # -> Result, Factor
units_8 = ConvertUnits(Value=tb_0_45h_feet, Source=4, Target=2, Exponent=1)  # -> Result, Factor
tc_m = Panel(units_5.Result)
usp_base_m = Panel(units_6.Result)
dsp_base_m = Panel(units_7.Result)
tb_0_45h_m = Panel(units_8.Result)
arch_usp_at_045h = RemoteSender(tb_0_45h_m)
arch_usp_base = RemoteSender(usp_base_m)
arch_dsp_base = RemoteSender(dsp_base_m)
arch_tc = RemoteSender(tc_m)

arch_usp_at_045h_2 = RemoteReceiver(arch_usp_at_045h)
arch_usp_base_2 = RemoteReceiver(arch_usp_base)
arch_dsp_base_2 = RemoteReceiver(arch_dsp_base)
arch_tc_2 = RemoteReceiver(arch_tc)
arch_usp_at_045h_3 = RemoteReceiver(arch_usp_at_045h)
arch_usp_base_3 = RemoteReceiver(arch_usp_base)
arch_dsp_base_3 = RemoteReceiver(arch_dsp_base)
arch_tc_3 = RemoteReceiver(arch_tc)
format = Format(
    Format=panel_41,
    Culture=127,
    Data0=crest_radius_2,
    Data1=arch_l1_2,
    Data2=arch_tc_2,
    Data3=arch_dam_height_2,
    Data4=arch_usp_base_2,
    Data5=arch_dsp_base_2,
    Data6=arch_usp_at_045h_2,
    Data7=expression_9,
    Data8=raxis_adjustments,
    Data9=addition_5,
    Data10=freeboard_3,
    Data11=offset_foundation_3)
format_2 = Format(
    Format=panel_42,
    Culture=127,
    Data0=crest_radius_3,
    Data1=arch_l1_3,
    Data2=arch_tc_3,
    Data3=arch_dam_height_3,
    Data4=arch_usp_base_3,
    Data5=arch_dsp_base_3,
    Data6=arch_usp_at_045h_3,
    Data7=expression_9,
    Data8=raxis_adjustments,
    Data9=addition_5,
    Data10=freeboard_4,
    Data11=offset_foundation_4)
panel_82 = Panel(format)
panel_83 = Panel(format_2)
assumptions = RemoteSender(panel_83)
arch_tc_4 = RemoteReceiver(arch_tc)
subtraction_3 = Subtraction(A=addition_5, B=arch_tc_4)
r_crest_dsp = Panel(subtraction_3)
cir_3 = Circle(Plane=item_18.Item, Radius=r_crest_dsp)
scx_3 = SurfaceCurve(Surface=arch_dam_base_foundation_terrain_2, Curve=cir_3)  # -> Curves, Points, UVPoints, Normals, Parameters, Tangents
shatter_7 = Shatter(Curve=cir_3, Parameters=scx_3.Parameters)
colom_5 = CollisionOneMany(Collider=ln_3, Obstacles=shatter_7)  # -> Collision, Index
item_21 = ListItem(List=shatter_7, Index=colom_5.Index, Wrap=True)
dsp_arch_crest = RemoteSender(item_21)
reference_centers_plane = RemoteSender(pl_2)
refecenre_centers_vector = RemoteSender(evalsrf_5.Normal)
arch_usp_at_045h_4 = RemoteReceiver(arch_usp_at_045h)
arch_tc_5 = RemoteReceiver(arch_tc)
arch_dsp_base_4 = RemoteReceiver(arch_dsp_base)
arch_usp_base_4 = RemoteReceiver(arch_usp_base)
centrifugal_vector_2 = RemoteReceiver(centrifugal_vector)

# ---- group: Crown Cantilever
# 5. Section points - based on the equations
# At Base
# At Crest:
# At 0.45H
panel_84 = Panel("0.45")
eval_5 = EvaluateCurve(Height=reparameterize(ln_5), Point_at_045H=panel_84)  # -> Point, Tangent, Angle
neg_10 = Negative(Value=centrifugal_vector_2)
neg_11 = Negative(Value=centrifugal_vector_2)
amp_10 = Amplitude(Vector=centrifugal_vector_2, Amplitude=arch_tc_5)
amp_11 = Amplitude(Vector=neg_11, Amplitude=arch_usp_base_4)
amp_12 = Amplitude(Vector=neg_10, Amplitude=arch_usp_at_045h_4)
amp_13 = Amplitude(Vector=centrifugal_vector_2, Amplitude=arch_dsp_base_4)
move_23 = Move(Geometry=pt_11, Motion=amp_13)  # -> Geometry, Transform
move_24 = Move(Geometry=pt_11, Motion=amp_11)  # -> Geometry, Transform
move_25 = Move(Geometry=project_9.Geometry, Motion=amp_10)  # -> Geometry, Transform
move_26 = Move(Geometry=eval_5.Point, Motion=amp_12)  # -> Geometry, Transform
usp_pt_at_base = Point(move_24.Geometry)
pt_at_crest = Point(project_9.Geometry)
pt_at_0_45h = Point(move_26.Geometry)
pt_at_0_45h_2 = Point(eval_5.Point)
# Technical Memorandum No. EM36-86-68110: 4.2 Determine an Appraisal Level Arch Dam Layout
# 
# 6 - Determine the shape of the crown cantilever. From the equations provided,
# compute TC, TB, T0.45H, USPC, USP0.45H, USPB, DSPC, DSP0.45H, and DSPB.
pt_at_crest_2 = Point(move_25.Geometry)
pt_at_base = Point(move_23.Geometry)
# Technical Memorandum No. EM36-86-68110: 4.2 Determine an Appraisal Level Arch Dam Layout
# 
# 7 - Determine the geometry of the upstream and downstream face along the crown cantilever. A circle can be drawn through the 3 points computed for the upstream face in Step 6. Likewise, a circle can be drawn through the 3 points computed for the
# downstream face.
# 
# 8. Draw the upstream and downstream face along the crown cantilever.
arc = Arc3Pt(PointA=pt_at_crest_2, PointB=pt_at_0_45h_2, PointC=pt_at_base)  # -> DownstreamArc, CenterP, RadiusM
arc_2 = Arc3Pt(PointA=pt_at_crest, PointB=pt_at_0_45h, PointC=usp_pt_at_base)  # -> UpstreamArc, CenterP, RadiusM
us_arc = RemoteSender(arc_2.UpstreamArc)
ds_arc = RemoteSender(arc.DownstreamArc)

# ----
# x. Elevations
# Technical Memorandum No. EM36-86-68110: 4.2 Determine an Appraisal Level Arch Dam Layout
# 
# 9. Select 6 to 8 arch elevations on the crown cantilever to define the 3D dam. Select the lowest arch elevation starting at about 15% H. Then between 15% H and the crest, try to select 6 to 8 arches evenly spaced vertically and rounded to nearest contour elevation.
# E. Goulas: According to the Engineer Manual [1], the dam is divided into 5 to 10 evenly spaced horizontal arches and their respective parabolas are computed. They should be spaced not less than 3.048 meters (10 feet) nor more than 30.48 meters (100 feet) apart. The lowest parabola should be 0.15H to 0.20H above the base.
# DESIGN MANUAL FOR CONCRETE ARCH DAMS, 1977: Usually 5 to 10 arch elevations are selected such that the  entire dam is represented by a system of horizontal elements evenly spaced over the
# height of the structure.
# Usually the intervals are not greater than 100 (30.5m) feet nor less than 20 feet (6.1m).
# Technical Memorandum No. EM36-86-68110: Select the lowest arch elevation starting at about 15% H. Then between 15% H and the crest, try to select 6 to 8 arches evenly spaced vertically and rounded to nearest contour
# elevation. Even spacing arches permit best evaluation of the ADSAS results.
# EM_1110-2-2201_ARCH_DAM_DESIGN: The
# lowest arch should be 0.15H to 0.20H above the base of the crown cantilever.
section_height_approx = Slider(11, range=6..30)
arch_dam_height_5 = RemoteReceiver(arch_dam_height)
eval_6 = EvaluateCurve(Height=reparameterize(ln_5), Point_at_015H="0.2")  # -> Point, Tangent, Angle
flip_4 = FlipCurve(Curve=ln_5)  # -> Curve, Flag
expression_10 = Expression(section_heights=section_height_approx, height=arch_dam_height_5, Expression="height/section_heights")
shatter_8 = Shatter(Curve=reparameterize(ln_5), Parameters="0.2")
item_22 = ListItem(List=shatter_8, Index="1", Wrap=True)
len_5 = Length(Curve=item_22)
expression_11 = Expression(section_heights=section_height_approx, height=len_5, Expression="height/section_heights")
round = Round(Number=expression_10)  # -> Nearest, Floor, Ceiling
eval_7 = EvaluateCurve(Height=reparameterize(ln_5), PointAt0="0")  # -> Point, Tangent, Angle
divide = DivideCurve(Curve=flip_4.Curve, Count=round.Nearest, Kinks=False)  # -> Points, Tangents, Parameters
pt_16 = Point(flatten(divide.Points))
pdecon_8 = Deconstruct(Point=pt_16)  # -> XComponent, YComponent, ZComponent
round_2 = Round(Number=expression_11)  # -> Nearest, Floor, Ceiling
divide_2 = DivideCurve(Curve=item_22, Count=round_2.Nearest, Kinks=False)  # -> Points, Tangents, Parameters
division_4 = Division(A=len_5, B=round_2.Nearest)  # -> flatten(Result)
pt_17 = Point(flatten([divide_2.Points, eval_7.Point]))
pdecon_9 = Deconstruct(Point=pt_17)  # -> XComponent, YComponent, ZComponent
section_height_actual = Panel(division_4)
sort_8 = SortList(Keys=pdecon_8.ZComponent, ValuesA=pt_16)  # -> reverse(Keys), reverse(ValuesA)
sort_9 = SortList(Keys=pdecon_9.ZComponent, ValuesA=pt_17)  # -> reverse(Keys), reverse(ValuesA)
cull_i_3 = CullIndex(List=sort_9.ValuesA, Indices=0, Wrap=True)
pln_3 = Plane(simplify(graft(cull_i_3)))

us_arc_2 = RemoteReceiver(us_arc)
dsp_arch_crest_2 = RemoteReceiver(dsp_arch_crest)
ds_arc_2 = RemoteReceiver(ds_arc)
item_23 = ListItem(List=sort_9.ValuesA, Index=0, Wrap=True)

# ----
# x. Dam Footprint
end_9 = EndPoints(Curve=ds_arc_2)  # -> Start, End
end_10 = EndPoints(Curve=us_arc_2)  # -> Start, End
dsp_point_bottom_foundation = Point(end_9.End)
usp_point_bottom_foundation = Point(end_10.End)
end_11 = EndPoints(Curve=dsp_arch_crest_2)  # -> Start, End
end_12 = EndPoints(Curve=usp_arch_crest_4)  # -> Start, End
# Technical Memorandum No. EM36-86-68110: 4.2 Determine an Appraisal Level Arch Dam Layout
# 
# 10. On the topography map, draw the upstream and downstream projections of the crown cantilever and downstream arc at the crest on the reference plane. Using the same radius center as the axis, draw the circular arc for the downstream side of the crest using the radius (Raxis – Tc). On the reference plane draw points at each arch elevation on the upstream and downstream faces.
project_11 = Project(Geometry=dsp_point_bottom_foundation, Plane=end_11.Start)  # -> Geometry, Transform
project_12 = Project(Geometry=usp_point_bottom_foundation, Plane=end_12.Start)  # -> Geometry, Transform
arc_3 = Arc3Pt(PointA=end_11.Start, PointB=project_11.Geometry, PointC=end_11.End)  # -> UpstreamArc, CenterP, RadiusM
arc_4 = Arc3Pt(PointA=end_12.Start, PointB=project_12.Geometry, PointC=end_12.End)  # -> UpstreamArc, CenterP, RadiusM
project_13 = Project(Curve=arc_4.UpstreamArc, Brep=arch_dam_base_foundation_terrain_4, Direction=Vector(0, 0, 1))
project_14 = Project(Curve=arc_3.UpstreamArc, Brep=arch_dam_base_foundation_terrain_4, Direction=Vector(0, 0, 1))
explode_3 = Explode(Curve=project_13, Recursive=False)  # -> Segments, Vertices
explode_4 = Explode(Curve=project_14, Recursive=False)  # -> Segments, Vertices
pline_5 = PolyLine(Vertices=explode_3.Vertices, Closed=False)
pline_6 = PolyLine(Vertices=explode_4.Vertices, Closed=False)
lng_4 = ListLength(List=explode_3.Vertices)
lng_5 = ListLength(List=explode_4.Vertices)
smoothpline_2 = SmoothPolyline(Polyline=pline_5, Strength=Slider(0.5, range=0..1), Times=lng_4)
smoothpline_3 = SmoothPolyline(Polyline=pline_6, Strength=Slider(0.5, range=0..1), Times=lng_5)
dsp_footprint = Curve(smoothpline_3)
usp_footprint = Curve(smoothpline_2)

pln_4 = Plane(simplify(graft(item_23)))
plane_elevations = RemoteSender(pln_3)
usp_prefootprint = RemoteSender(usp_footprint)
dsp_prefootprint = RemoteSender(dsp_footprint)
usp_prefootprint_2 = RemoteReceiver(usp_prefootprint)
dsp_prefootprint_2 = RemoteReceiver(dsp_prefootprint)
plane_elevations_2 = RemoteReceiver(plane_elevations)
us_arc_3 = RemoteReceiver(us_arc)
refecenre_centers_vector_2 = RemoteReceiver(refecenre_centers_vector)
reference_centers_plane_2 = RemoteReceiver(reference_centers_plane)
center_crest_2 = RemoteReceiver(center_crest)
plane_elevations_3 = RemoteReceiver(plane_elevations)
ds_arc_3 = RemoteReceiver(ds_arc)
refecenre_centers_vector_3 = RemoteReceiver(refecenre_centers_vector)
reference_centers_plane_3 = RemoteReceiver(reference_centers_plane)
us_arc_4 = RemoteReceiver(us_arc)
plane_elevations_4 = RemoteReceiver(plane_elevations)
ds_arc_4 = RemoteReceiver(ds_arc)
pcx = CurvePlane(DownstreamArc=ds_arc_4, Plane=plane_elevations_4)  # -> simplify(Points), ParamsC, ParamsP
pcx_2 = CurvePlane(UpstreamArc=us_arc_4, Plane=plane_elevations_4)  # -> simplify(Points), ParamsC, ParamsP
dsp_arch_crest_3 = RemoteReceiver(flatten(dsp_arch_crest))
path_mapper_3 = PathMapper(dsp_arch_crest_3, source="{A}", target="{1;A}")
us_arc_5 = RemoteReceiver(us_arc)  # disabled
plane_elevations_5 = RemoteReceiver(plane_elevations)  # disabled
ds_arc_5 = RemoteReceiver(ds_arc)  # disabled
pcx_3 = CurvePlane(DownstreamArc=ds_arc_5, Plane=plane_elevations_5)  # -> simplify(Points), ParamsC, ParamsP; disabled
pcx_4 = CurvePlane(UpstreamArc=us_arc_5, Plane=plane_elevations_5)  # -> simplify(Points), ParamsC, ParamsP; disabled
dsp_arch_crest_4 = RemoteReceiver(dsp_arch_crest)  # disabled
centrifugal_vector_3 = RemoteReceiver(centrifugal_vector)  # disabled
rev_4 = Reverse(Vector=centrifugal_vector_3)  # disabled
rotate = Rotate(Geometry=rev_4, Angle=rad, Plane=PlaneXY(0, 0, 0))  # -> flatten(Geometry), Transform; disabled
dsp_arch_crest_5 = RemoteReceiver(flatten(dsp_arch_crest))  # disabled
path_mapper_4 = PathMapper(dsp_arch_crest_5, source="{A}", target="{1;A}")  # disabled
plane_elevations_6 = RemoteReceiver(plane_elevations)  # disabled
plane_elevations_7 = RemoteReceiver(plane_elevations)  # disabled
arch_dam_height_6 = RemoteReceiver(arch_dam_height)
usp_prefootprint_3 = RemoteReceiver(usp_prefootprint)
dsp_prefootprint_3 = RemoteReceiver(dsp_prefootprint)
arch_dam_height_7 = RemoteReceiver(arch_dam_height)
dam_pre_footprint = Curve([usp_prefootprint_3, dsp_prefootprint_3])
assumptions_2 = RemoteReceiver(assumptions)
split_8 = TextSplit(Text=flatten(assumptions_2), Separators=":")
dispatch_8 = Dispatch(List=split_8, DispatchPattern=[True, False])  # -> flatten(ListA), flatten(ListB)
trim = TextTrim(Text=dispatch_8.ListB, Start=True, End=True)
merge_8 = Merge(Data1=panel_61, Data2=dispatch_8.ListA)
join_5 = TextJoin(Text=merge_8, Join="|")
panel_85 = Panel(merge_8)

number_slider_27 = Slider(5000, range=0..10000)
dam_axes_all_2 = RemoteReceiver(dam_axes_all)
# Visualization top
dam_axis_5 = RemoteReceiver(dam_axis)
Z_15 = UnitZ(Factor=number_slider_27)
move_27 = Move(Geometry=dam_axes_all_2, Motion=Z_15)  # -> Geometry, Transform
previewlw_5 = CustomPreviewLineweights(
    Geometry=move_27.Geometry,
    Shader=ColourSwatch(SwatchColor=RGB(60, 76, 222)),
    Thickness=Slider(4, range=0..10),
    Absolute=False)

# ----
# See upstream point
vector_waterflow_7 = RemoteReceiver(vector_waterflow)  # disabled
point_upstream_5 = RemoteReceiver(point_upstream)  # disabled
objfromgroup_7 = GetObjectsInGroup()  # disabled
move_28 = Move(Geometry=point_upstream_5, Motion=Z_15)  # -> Geometry, Transform; disabled
swatch_7 = ColourSwatch(SwatchColor=RGB(68, 57, 102))  # disabled
number_slider_28 = Slider(3, range=0..10)  # disabled
move_29 = Move(Geometry=point_upstream_5, Motion=Z_15)  # -> Geometry, Transform; disabled
number_slider_29 = Slider(227.5, range=0..1000)  # disabled
panel_86 = Panel("Upstream")  # disabled
vdisex_8 = VectorDisplayEx(Point=move_29.Geometry, Vector=vector_waterflow_7, Colour=swatch_7, Width=number_slider_28)  # disabled
tag = TextTag3D(Location=move_28.Geometry, Text=panel_86, Size=number_slider_29, Colour=swatch_7, Justification=7)  # disabled

addition_7 = Addition(A=number_slider_27, B=1)
Z_16 = UnitZ(Factor=addition_7)

move_30 = Move(Geometry=dam_axis_5, Motion=Z_16)  # -> Geometry, Transform
previewlw_6 = CustomPreviewLineweights(
    Geometry=move_30.Geometry,
    Shader=ColourSwatch(SwatchColor=RGB(29, 191, 161)),
    Thickness=Slider(4, range=0..10),
    Absolute=False)

onoff_4 = EnableDisableObject(Objects=objfromgroup_7, Enabled=viz_direction_river_2)  # disabled

# ----
# Technical Memorandum No. EM36-86-68110: 4.2 Determine an Appraisal Level Arch Dam Layout
# 
# 12.a. Draw the upstream face arch starting with the first arch below the crest. Use an initial guess for the line of centers as a 0.2:1 sloping line.
# x. Line of centers
flatten_2 = FlattenTree(Tree=plane_elevations_2, Path="{0}")
flatten_3 = FlattenTree(Tree=plane_elevations_3, Path="{0}")
cull_i_4 = CullIndex(List=flatten_2, Indices=-1, Wrap=True)  # -> simplify(graft(List))
cull_i_5 = CullIndex(List=flatten_3, Indices=-1, Wrap=True)  # -> simplify(graft(List))
pcx_5 = CurvePlane(DownstreamArc=ds_arc_3, Plane=cull_i_5)  # -> simplify(Points), ParamsC, ParamsP
pcx_6 = CurvePlane(DSPFootprint=dsp_prefootprint_2, Plane=cull_i_5)  # -> simplify(Points), ParamsC, ParamsP
pcx_7 = CurvePlane(USPFootprint=usp_prefootprint_2, Plane=cull_i_4)  # -> simplify(Points), ParamsC, ParamsP
pcx_8 = CurvePlane(UpstreamArc=us_arc_3, Plane=cull_i_4)  # -> simplify(Points), ParamsC, ParamsP
item_24 = ListItem(List=pcx_6.Points, Index=0, Wrap=True)  # -> Item, Item1
arc_5 = Arc3Pt(PointA=item_24.Item, PointB=pcx_5.Points, PointC=item_24.Item1)  # -> Arc, Plane, Radius
darc_2 = DeconstructArc(Arc=arc_5.Arc)  # -> BasePlane, Radius, Angle
rev_5 = Reverse(Vector=refecenre_centers_vector_3)
project_15 = ProjectPoint(Point=darc_2.BasePlane, Direction=[refecenre_centers_vector_3, rev_5], Geometry=reference_centers_plane_3)  # -> Point, Index
rev_6 = Reverse(Vector=refecenre_centers_vector_2)
clean = CleanTree(RemoveNulls=True, RemoveInvalid=True, RemoveEmpty=False, Tree=project_15.Point)  # -> flatten(Tree)
center_at_crest = Point(center_crest_2)
abiscissa_dam_axis_2 = RemoteReceiver(abiscissa_dam_axis)

item_25 = ListItem(List=pcx_7.Points, Index=0, Wrap=True)  # -> Item, Item1

arc_6 = Arc3Pt(PointA=item_25.Item, PointB=pcx_8.Points, PointC=item_25.Item1)  # -> Arc, Plane, Radius
darc_3 = DeconstructArc(Arc=arc_6.Arc)  # -> BasePlane, Radius, Angle
project_16 = ProjectPoint(Point=darc_3.BasePlane, Direction=[refecenre_centers_vector_2, rev_6], Geometry=reference_centers_plane_2)  # -> Point, Index
clean_2 = CleanTree(RemoveNulls=True, RemoveInvalid=True, RemoveEmpty=False, Tree=project_16.Point)  # -> flatten(Tree)

centers_extrados_not_normalized = Point([center_at_crest, clean_2])
pline_7 = PolyLine(Vertices=centers_extrados_not_normalized, Closed=False)
lng_6 = ListLength(List=centers_extrados_not_normalized)
smoothpline_4 = SmoothPolyline(Polyline=pline_7, Strength=1, Times=lng_6)
ext_2 = ExtendCurve(Curve=smoothpline_4, Type=2, Start=0, End=500)
ccx_4 = CurveCurve(CurveA=ext_2, CurveB=abiscissa_dam_axis_2)  # -> Points, ParamsA, ParamsB
shatter_9 = Shatter(Curve=ext_2, Parameters=flatten(ccx_4.ParamsA))
sort_10 = SortList(Keys=shatter_9, ValuesA=shatter_9)  # -> Keys, ValuesA
item_26 = ListItem(List=sort_10.ValuesA, Index=0, Wrap=True)
geo_10 = Geometry(item_26)

centers_extrados_not_normalized_2 = Point([center_at_crest, clean])
pline_8 = PolyLine(Vertices=centers_extrados_not_normalized_2, Closed=False)
lng_7 = ListLength(List=centers_extrados_not_normalized_2)
smoothpline_5 = SmoothPolyline(Polyline=pline_8, Strength=1, Times=lng_7)
ext_3 = ExtendCurve(Curve=smoothpline_5, Type=2, Start=0, End=500)
ccx_5 = CurveCurve(CurveA=ext_3, CurveB=abiscissa_dam_axis_2)  # -> Points, ParamsA, ParamsB
shatter_10 = Shatter(Curve=ext_3, Parameters=flatten(ccx_5.ParamsA))
sort_11 = SortList(Keys=shatter_10, ValuesA=shatter_10)  # -> Keys, ValuesA
item_27 = ListItem(List=sort_11.ValuesA, Index=0, Wrap=True)
geo_11 = Geometry(item_27)

line_of_centers_intrados = RemoteSender(geo_10)
line_of_centers_extrados = RemoteSender(geo_11)
line_of_centers_extrados_2 = RemoteReceiver(line_of_centers_extrados)
line_of_centers_intrados_2 = RemoteReceiver(line_of_centers_intrados)
pcx_9 = CurvePlane(LineOfCentersIntrados=line_of_centers_intrados_2, Plane=plane_elevations_4)  # -> simplify(CenterPoints), ParamsC, ParamsP
pcx_10 = CurvePlane(LineOfCentersExtrados=line_of_centers_extrados_2, Plane=plane_elevations_4)  # -> simplify(CenterPoints), ParamsC, ParamsP
ln_7 = Line(StartPoint=pcx.Points, EndPoint=pcx_9.CenterPoints)
ln_8 = Line(StartPoint=pcx_2.Points, EndPoint=pcx_10.CenterPoints)
len_6 = Length(Curve=ln_7)
len_7 = Length(Curve=ln_8)
cir_4 = Circle(DSCenters=pcx_9.CenterPoints, Radius=len_6)  # -> simplify(Circle)
cir_5 = Circle(USCenters=pcx_10.CenterPoints, Radius=len_7)
path_mapper_5 = PathMapper(ln_8, source="{A}", target="{0;A}")
path_mapper_6 = PathMapper(cir_4, source="{A}", target="{1;A}")
path_mapper_7 = PathMapper(cir_5, source="{A}", target="{0;A}")
path_mapper_8 = PathMapper(ln_7, source="{A}", target="{1;A}")

# ---- group: Finding the intersection with sound rock
brep_terrain_base_foundation_6 = RemoteReceiver(brep_terrain_base_foundation)
relay = Relay([path_mapper_7, path_mapper_6])
relay_2 = Relay([path_mapper_5, path_mapper_8])
scx_4 = SurfaceCurve(Surface=brep_terrain_base_foundation_6, Curve=relay)  # -> Curves, simplify(Points), UVPoints, Normals, Parameters, Tangents

# ---- group: Filter away last circle - touching sound rock
geo_12 = Geometry(relay)
tstat = TreeStatistics(Tree=geo_12)  # -> Paths, Length, Count
division_5 = Division(A=tstat.Count, B="2")
x_minus_one = XMinusOne(NumberX=division_5)
item_28 = ListItem(List=tstat.Paths, Index=flatten(["-1", x_minus_one]), Wrap=True)
split_9 = SplitTree(Data=geo_12, Masks=flatten(item_28))  # -> Positive, Negative
geo_13 = Geometry(split_9.Positive)

# ---- group: Adjusting the bottom so there is something to connect with the bottom circle
number_slider_30 = Slider(1, range=0..10)
centrifugal_vector_4 = RemoteReceiver(centrifugal_vector)
neg_12 = Negative(Value=number_slider_30)
rev_7 = Reverse(Vector=centrifugal_vector_4)
rad_2 = Radians(Degrees=[number_slider_30, neg_12])
rotate_2 = Rotate(Geometry=rev_7, Angle=rad_2, Plane=PlaneXY(0, 0, 0))  # -> flatten(Geometry), Transform
center_6 = Center(Geometric=geo_13)  # -> Center, Dimension
darc_4 = DeconstructArc(Arc=geo_13)  # -> BasePlane, Radius, Angle
line_2 = LineSDL(Start=center_6.Center, Direction=rotate_2.Geometry, Length=darc_4.Radius)
ccx_6 = CurveCurve(CurveA=geo_13, CurveB=line_2)  # -> Points, ParamsA, ParamsB
pshift = ShiftPaths(Data=ccx_6.ParamsA, Offset="-1")
shatter_11 = Shatter(Curve=geo_13, Parameters=pshift)
pshift_2 = ShiftPaths(Data=shatter_11, Offset="-1")
item_29 = ListItem(List=pshift_2, Index=0, Wrap=True)

# ---- group: Cutting and selecting curves for dam
shatter_12 = Shatter(Curve=relay, Parameters=scx_4.Parameters)  # -> simplify(Segments)
colom_6 = CollisionOneMany(Collider=shatter_12, Obstacles=relay_2)  # -> Collision, Index
dispatch_9 = Dispatch(List=shatter_12, DispatchPattern=colom_6.Collision)  # -> ListA, ListB

# ----
split_10 = SplitTree(Data=dispatch_9.ListA, Masks=flatten(item_28))  # -> Positive, Negative
geo_14 = Geometry(split_10.Negative)
path_mapper_9 = PathMapper(geo_14, source="{A;B}", target="{A;B+1}")
path_mapper_10 = PathMapper(item_29, source="{A;B}", target="{A;B+1}")
line_of_centers_extrados_3 = RemoteReceiver(line_of_centers_extrados)  # disabled
line_of_centers_intrados_3 = RemoteReceiver(line_of_centers_intrados)  # disabled

geo_15 = Geometry([path_mapper, path_mapper_3, path_mapper_9])
end_13 = EndPoints(Curve=path_mapper_10)  # -> Start, End
end_14 = EndPoints(Curve=geo_15)  # -> Start, End
geo_16 = Geometry([end_13.Start, end_13.End])
geo_17 = Geometry([end_14.Start, end_14.End])
path_mapper_11 = PathMapper(geo_17, source="{A;B}", target="{A}")
item_30 = ListItem(List=path_mapper_11, Index=0, Wrap=True)
geo_18 = Geometry(path_mapper_11)
ptsortitems = PointSortItems(Start=item_30, Points=geo_18)  # -> SortedItems, SortedIndices, simplify(SortedPoints)
intcrv = Interpolate(Vertices=ptsortitems.SortedPoints, Degree=3, Periodic=False, KnotStyle=1)  # -> Curve, Length, Domain
lng_8 = ListLength(List=ptsortitems.SortedPoints)
plane_elevations_8 = RemoteReceiver(plane_elevations)
number_slider_31 = Slider(50, range=0..100)
smocrv = SmoothCurve(Curve=intcrv.Curve, Steps=lng_8, StartType=0, EndType=0, DeviationTolerance=Slider(5, range=0..50), AngleTolerance=0.05)
merge_9 = Merge(Data1=flatten(pln_4), Data2=flatten(plane_elevations_8))
ext_4 = ExtendCurve(Curve=geo_15, Type=1, Start=number_slider_31, End=number_slider_31)
cull_i_6 = CullIndex(List=merge_9, Indices=-1, Wrap=True)
pcx_11 = CurvePlane(Curve=smocrv, Plane=cull_i_6)  # -> simplify(Points), ParamsC, ParamsP
crv_cp_6 = CurveClosestPoint(Point=pcx_11.Points, Curve=ext_4)  # -> Point, Parameter, Distance
dispatch_10 = Dispatch(List=crv_cp_6.Point, DispatchPattern=[True, False])  # -> ListA, ListB
item_31 = ListItem(List=dispatch_10.ListA, Index=0, Wrap=True)
item_32 = ListItem(List=dispatch_10.ListB, Index=0, Wrap=True)
geo_19 = Geometry(geo_16)
geo_20 = Geometry([item_31, item_32, geo_19])

pcx_12 = CurvePlane(LineOfCentersIntrados=line_of_centers_intrados_3, Plane=plane_elevations_5)  # -> simplify(CenterPoints), ParamsC, ParamsP; disabled
pcx_13 = CurvePlane(LineOfCentersExtrados=line_of_centers_extrados_3, Plane=plane_elevations_5)  # -> simplify(CenterPoints), ParamsC, ParamsP; disabled
ln_9 = Line(StartPoint=pcx_3.Points, EndPoint=pcx_12.CenterPoints)  # disabled
ln_10 = Line(StartPoint=pcx_4.Points, EndPoint=pcx_13.CenterPoints)  # disabled
len_8 = Length(Curve=ln_9)  # disabled
len_9 = Length(Curve=ln_10)  # disabled
cir_6 = Circle(DSCenters=pcx_12.CenterPoints, Radius=len_8)  # -> simplify(Circle); disabled
cir_7 = Circle(USCenters=pcx_13.CenterPoints, Radius=len_9)  # disabled
path_mapper_12 = PathMapper(ln_10, source="{A}", target="{0;A}")  # disabled
path_mapper_13 = PathMapper(cir_6, source="{A}", target="{1;A}")  # disabled
path_mapper_14 = PathMapper(cir_7, source="{A}", target="{0;A}")  # disabled
path_mapper_15 = PathMapper(ln_9, source="{A}", target="{1;A}")  # disabled
relay_3 = Relay([path_mapper_14, path_mapper_13])  # disabled
geo_21 = Geometry(relay_3)  # disabled
relay_4 = Relay([path_mapper_12, path_mapper_15])  # disabled
tstat_2 = TreeStatistics(Tree=geo_21)  # -> Paths, Length, Count; disabled
division_6 = Division(A=tstat_2.Count, B=panel_47)  # disabled
scx_5 = SurfaceCurve(Surface=brep_terrain_base_foundation_5, Curve=relay_3)  # -> Curves, simplify(Points), UVPoints, Normals, Parameters, Tangents; disabled
x_minus_one_2 = XMinusOne(NumberX=division_6)  # disabled
item_33 = ListItem(List=tstat_2.Paths, Index=flatten([panel_48, x_minus_one_2]), Wrap=True)  # disabled
shatter_13 = Shatter(Curve=relay_3, Parameters=scx_5.Parameters)  # -> simplify(Segments); disabled
split_11 = SplitTree(Data=geo_21, Masks=flatten(item_33))  # -> Positive, Negative; disabled
colom_7 = CollisionOneMany(Collider=shatter_13, Obstacles=relay_4)  # -> Collision, Index; disabled
geo_22 = Geometry(split_11.Positive)  # disabled
dispatch_11 = Dispatch(List=shatter_13, DispatchPattern=colom_7.Collision)  # -> ListA, ListB; disabled
center_7 = Center(Geometric=geo_22)  # -> Center, Dimension; disabled
darc_5 = DeconstructArc(Arc=geo_22)  # -> BasePlane, Radius, Angle; disabled
split_12 = SplitTree(Data=dispatch_11.ListA, Masks=flatten(item_33))  # -> Positive, Negative; disabled
line_3 = LineSDL(Start=center_7.Center, Direction=rotate.Geometry, Length=darc_5.Radius)  # disabled
ccx_7 = CurveCurve(CurveA=geo_22, CurveB=line_3)  # -> Points, ParamsA, ParamsB; disabled
geo_23 = Geometry(split_12.Negative)  # disabled
cull_i_7 = CullIndex(List=reverse(crv_cp_6.Point), Indices=panel_49, Wrap=False)  # disabled
pshift_3 = ShiftPaths(Data=ccx_7.ParamsA, Offset=panel_50)  # disabled

pshift_4 = ShiftPaths(Data=geo_20, Offset=-1)
item_34 = ListItem(List=pshift_4, Index=0, Wrap=True)
ptsortitems_2 = PointSortItems(Start=item_34, Points=pshift_4)  # -> SortedItems, SortedIndices, SortedPoints
path_mapper_16 = PathMapper(ext_4, source="{A;B}", target="{A}")
intcrv_2 = Interpolate(Vertices=ptsortitems_2.SortedPoints, Degree=Slider(3, range=0..10), Periodic=False, KnotStyle=1)  # -> simplify(Curve), Length, Domain
ccx_8 = CurveCurve(CurveA=path_mapper_16, CurveB=intcrv_2.Curve)  # -> Points, ParamsA, ParamsB
shatter_14 = Shatter(Curve=ext_4, Parameters=ccx_8.ParamsA)  # -> simplify(Segments)
dispatch_12 = Dispatch(List=shatter_14, DispatchPattern=[True, False])  # -> ListA, ListB
geo_24 = Geometry(dispatch_12.ListB)

shatter_15 = Shatter(Curve=geo_22, Parameters=pshift_3)  # disabled
pshift_5 = ShiftPaths(Data=cull_i_7, Offset=-1)  # disabled
pshift_6 = ShiftPaths(Data=shatter_15, Offset=panel_51)  # disabled
item_35 = ListItem(List=pshift_6, Index=0, Wrap=True)  # disabled
geo_25 = Geometry([split_12.Negative, item_35])  # disabled
path_mapper_17 = PathMapper(geo_25, source="{A;B}", target="{A;B+1}")  # disabled
geo_26 = Geometry([path_mapper_17, path_mapper_2, path_mapper_4])  # disabled
end_15 = EndPoints(Curve=geo_26)  # -> Start, End; disabled
geo_27 = Geometry([end_15.Start, end_15.End])  # disabled
path_mapper_18 = PathMapper(geo_27, source="{A;B}", target="{A}")  # disabled
item_36 = ListItem(List=path_mapper_18, Index=0, Wrap=True)  # disabled

geo_28 = Geometry(geo_24)
tstat_3 = TreeStatistics(Tree=geo_28)  # -> Paths, Length, Count
division_7 = Division(A=tstat_3.Count, B="2")
split_13 = SplitList(List=tstat_3.Paths, Index=division_7)  # -> ListA, ListB
item_37 = ListItem(List=split_13.ListA, Index=-1, Wrap=True)
item_38 = ListItem(List=split_13.ListB, Index=-1, Wrap=True)
cull_i_8 = CullIndex(List=split_13.ListA, Indices=-1, Wrap=True)  # -> flatten(List)
cull_i_9 = CullIndex(List=split_13.ListB, Indices=-1, Wrap=True)  # -> flatten(List)
path = DataPath(flatten([cull_i_8, cull_i_9]))
split_14 = SplitTree(Data=geo_28, Masks=flatten(path))  # -> Positive, Negative
split_15 = SplitTree(Data=geo_28, Masks=flatten("{?;0}"))  # -> Positive, Negative
unflatten = UnflattenTree(Tree=intcrv_2.Curve, Guide=split_14.Negative)
unflatten_2 = UnflattenTree(Tree=split_15.Negative, Guide=split_14.Positive)
geo_29 = Geometry([split_14.Positive, unflatten_2])
path_mapper_19 = PathMapper(unflatten_2, source="{A;B}", target="{A}")
lng_9 = ListLength(List=path_mapper_19)
repeat = RepeatData(Data=intcrv_2.Curve, Length=lng_9)
unflatten_3 = UnflattenTree(Tree=repeat, Guide=unflatten_2)
ccx_9 = CurveCurve(CurveA=unflatten_3, CurveB=geo_29)  # -> Points, simplify(ParamsA), ParamsB
pshift_7 = ShiftPaths(Data=ccx_9.ParamsA, Offset=-1)
shatter_16 = Shatter(Curve=unflatten_3, Parameters=pshift_7)  # -> simplify(Segments)
lng_10 = ListLength(List=shatter_16)
python_2 = GhPythonScript(x=lng_10, y=shatter_16)  # -> out, a, b
# ---------- python_2: Python ----------
__author__ = "Admin"
__version__ = "2023.08.14"

import rhinoscriptsyntax as rs

if x == 3:
    a = y
elif x == 5:
    b = y
# ---------- end python_2 ----------
clean_3 = CleanTree(RemoveNulls=True, RemoveInvalid=True, RemoveEmpty=False, Tree=python_2.b)
clean_4 = CleanTree(RemoveNulls=True, RemoveInvalid=True, RemoveEmpty=False, Tree=python_2.a)
geo_30 = Geometry(unflatten)
geo_31 = Geometry(split_14.Negative)

geo_32 = Geometry(path_mapper_18)  # disabled
ptsortitems_3 = PointSortItems(Start=item_36, Points=geo_32)  # -> SortedItems, SortedIndices, SortedPoints; disabled
intcrv_3 = Interpolate(Vertices=ptsortitems_3.SortedPoints, Degree=3, Periodic=False, KnotStyle=1)  # -> Curve, Length, Domain; disabled
lng_11 = ListLength(List=ptsortitems_3.SortedPoints)  # disabled
intcrv_4 = Interpolate(Vertices=ptsortitems_3.SortedPoints, Degree=3, Periodic=False, KnotStyle=1)  # -> Curve, Length, Domain; disabled
lng_12 = ListLength(List=ptsortitems_3.SortedPoints)  # disabled
smocrv_2 = SmoothCurve(Curve=intcrv_3.Curve, Steps=lng_11, StartType=0, EndType=0, DeviationTolerance=number_slider_10, AngleTolerance=0.05)  # disabled
pcx_14 = CurvePlane(Curve=smocrv_2, Plane=flatten(plane_elevations_6))  # -> simplify(Points), ParamsC, ParamsP; disabled
path_mapper_20 = PathMapper([smocrv_2, geo_26], source="{A;B}", target="{A}")  # disabled
path_mapper_21 = PathMapper(pcx_14.Points, source="{A;B}", target="{A}")  # disabled
smocrv_3 = SmoothCurve(Curve=intcrv_4.Curve, Steps=lng_12, StartType=0, EndType=0, DeviationTolerance=number_slider_11, AngleTolerance=0.05)  # disabled
viewer = ParamViewer(path_mapper_21)  # disabled
patch = Patch(Curves=path_mapper_20, Points=path_mapper_21, Spans=lng_11, Flexibility=1, Trim=True)  # disabled
sec_3 = BrepPlane(Brep=patch, Plane=plane_elevations_7)  # -> Curves, Points; disabled
path_mapper_22 = PathMapper(geo_28, source="{A;B}", target="{A}")  # disabled
lng_13 = ListLength(List=ptsortitems_2.SortedPoints)  # disabled
patch_2 = Patch(Curves=[path_mapper_22, intcrv_2.Curve], Spans=lng_13, Flexibility=1, Trim=True)  # disabled
panel_87 = Panel(patch_2)
patch_3 = Patch(Curves=patch_2, Spans=20, Flexibility=1, Trim=True)  # disabled

dispatch_13 = Dispatch(List=clean_3, DispatchPattern=[True, False])  # -> ListA, ListB
geo_33 = Geometry(clean_4)
cull_i_10 = CullIndex(List=geo_33, Indices="1", Wrap=True)  # -> simplify(List)
geo_34 = Geometry(dispatch_13.ListB)
geo_35 = Geometry([geo_29, geo_34, cull_i_10])
item_39 = ListItem(List=geo_35, Index=0, Wrap=True)  # -> Item, Item1, Item2, Item3
netsurf_2 = NetworkSurface(CurvesU=[item_39.Item, item_39.Item1], CurvesV=[item_39.Item2, item_39.Item3], Continuity=3)

ccx_10 = CurveCurve(CurveA=geo_30, CurveB=geo_31)  # -> Points, ParamsA, ParamsB
shatter_17 = Shatter(Curve=geo_30, Parameters=ccx_10.ParamsA)
pshift_8 = ShiftPaths(Data=shatter_17, Offset=-1)
item_40 = ListItem(List=pshift_8, Index="1", Wrap=True)
loft_3 = Loft(
    Curves=[item_40, geo_31],
    Options={Adjust=True, Closed=False, LoftEnds=0, LoftSimp=0, LoftType=5, Rebuild=10, Refit=0.01})

crv_4 = Curve(patch_2)  # disabled
loft_4 = Loft(Curves=flatten(patch_2), Options={Adjust=True, Closed=True, LoftEnds=0, LoftSimp=0, LoftType=5, Rebuild=10, Refit=0.01})  # disabled
explode_5 = Explode(Curve=crv_4, Recursive=True)  # -> Segments, Vertices; disabled
loft_5 = Loft(Curves=flatten(patch_2), Options={Adjust=True, Closed=False, LoftEnds=0, LoftSimp=0, LoftType=5, Rebuild=10, Refit=0.01})  # disabled
planar = Planar(Curve=explode_5.Segments)  # -> Planar, Plane, Deviation; disabled
panel_88 = Panel(planar.Planar)  # disabled
debrep = DeconstructBrep(Brep=loft_5)  # -> Faces, Edges, Vertices; disabled
evalsrf_6 = EvaluateSurface(Surface=reparameterize(debrep.Faces), Point=panel_57)  # -> Point, Normal, UDirection, VDirection, Frame; disabled

dam_7 = DataDam(DataA=loft_3, DataB=netsurf_2, BufferDelay=10000000, BufferMode=0)  # -> DataA, DataB
objfromgroup_8 = GetObjectsInGroup()

setobj_4 = SetObjectValue(ObjectToSet=objfromgroup_8, ValueToSet=run_volume_arch_dam)
mindex_3 = MemberIndex(Set=evalsrf_6.Normal, Member=vec)  # -> Index, Count; disabled
path_mapper_23 = PathMapper([dam_7.DataA, dam_7.DataB], source="{A;B}", target="{A}")
cull_i_11 = CullIndex(List=debrep.Faces, Indices=mindex_3.Index, Wrap=True)  # disabled
join_6 = BrepJoin(Breps=cull_i_11)  # -> Breps, Closed; disabled
join_7 = BrepJoin(Breps=flatten(path_mapper_23))  # -> Breps, Closed
item_41 = ListItem(List=join_7.Breps, Index=0, Wrap=True)
crv_5 = Curve(join_6.Breps)  # disabled
patch_4 = Patch(Curves=crv_5, Spans=20, Flexibility=1, Trim=True)  # disabled
item_42 = ListItem(List=join_7.Breps, Index=0, Wrap=True)  # -> Item, Item1
flip_5 = Flip(Surface=patch_4, Guide=xy_3)  # -> Surface, Result; disabled
loft_6 = Loft(
    Curves=flatten([item_42.Item, item_42.Item1]),
    Options={Adjust=True, Closed=False, LoftEnds=0, LoftSimp=0, LoftType=5, Rebuild=10, Refit=0.01})
offset_l = OffsetSurfaceLoose(Surface=flip_5.Surface, Distance=Z_9, Retrim=True)  # disabled
extr_8 = Extrude(Base=patch_4, Direction=division_3)  # disabled
join_8 = BrepJoin(Breps=flatten([join_7.Breps, loft_6]))  # -> Breps, Closed
move_31 = Move(Geometry=extr_8, Motion=division_3)  # -> Geometry, Transform; disabled
crv_6 = Curve(offset_l)  # disabled
geo_archdam = RemoteSender(join_8.Breps)
# must be a closed volume!
geo_archdam_2 = RemoteReceiver(geo_archdam)
psrfclsd = IsPolysurfaceClosed(Polysurface=geo_archdam_2)
panel_89 = Panel(psrfclsd)
geo_archdam_3 = RemoteReceiver(geo_archdam)
filter_3 = StreamFilter(Gate=dam_type_3, Stream0=geo_concretedam_2, Stream1=geo_archdam_3)
dam_8 = DataDam(DataA=join_2.Breps, DataB=filter_3, BufferDelay=10000000, BufferMode=0)  # -> DataA, DataB
split_16 = SplitBrep(Brep=dam_8.DataA)
mesh_5 = MeshBrep(Brep=dam_8.DataA, Settings=jagged)
mesh_6 = MeshBrep(Brep=dam_8.DataB, Settings=jagged_2)
brep_3 = Brep(dam_8.DataB)
brep_4 = Brep(dam_8.DataA)
bvol = BoundaryVolume(Boundaries=brep_3)  # disabled
msplit = MeshSplit(Mesh=mesh_5, Splitters=mesh_6)
sdiff = SolidDifference(BrepsA=brep_4, BrepsB=bvol)  # disabled
item_43 = ListItem(List=msplit, Index="3", Wrap=True)
item_44 = ListItem(List=msplit, Index="1", Wrap=True)
item_45 = ListItem(List=sdiff, Index=panel_46, Wrap=True)  # disabled
sdiff_2 = SolidDifference(BrepsA=item_45, BrepsB=bvol)  # disabled
c_script_5 = CSharpScript(bListFrom=brep_4, flip=toggle_5, bListTo=brep_3)  # -> out, solidDifferenceBrepList; inputs bListFrom: list of Brep, flip: Boolean, bListTo: list of Brep
# ---------- c_script_5: C# ----------
    bListFrom = bListFrom.Where(x => x != null && x.IsValid && x.IsSolid).ToList();
    if(!bListFrom.Any()) return;

    bListTo = bListTo.Where(x => x != null && x.IsValid && x.IsSolid).ToList();
    if(!bListTo.Any()) return;
    double tol = RhinoDoc.ActiveDoc.ModelAbsoluteTolerance;

    List<Brep> bDiffList = new List<Brep>();
    Print(" ");
    Print("Working: {0} From against: {1} To breps", bListFrom.Count, bListTo.Count);
    Print(" ");

    for(int j = 0; j < bListFrom.Count;j++){
      Brep brep = bListFrom[j];
      if(flip)brep.Flip();
      for(int i = 0; i < bListTo.Count;i++){
        Brep b = bListTo[i];
        try{
          brep = Brep.CreateBooleanDifference(brep, b, tol)[0];
          Print("Diff at: {0}, {1} is OK", j, i);
        }
        catch{Print("Diff at: {0}, {1} failed (or breps are apart)", j, i);}
      }
      bDiffList.Add(brep);
    }
    solidDifferenceBrepList = bDiffList;

    Print(" ");
    for(int i = 0; i < bDiffList.Count;i++){
      Brep b = bDiffList[i];
      Print("Result at: {0} has: {1} faces", i, b.Faces.Count);
    }
# ---------- end c_script_5 ----------
mesh_7 = MeshBrep(Brep=item_45, Settings=jagged_3)  # disabled
mshclsd = IsMeshClosed(Mesh=mesh_7)
volume_2 = MeshVolume(Mesh=mesh_7)  # -> Volume, Centroid
geo_water = RemoteSender(item_45)
geo_archdam_4 = RemoteReceiver(geo_archdam)
volume_3 = Volume(Geometry=item_45)  # -> Volume, Centroid; disabled
nullrep = ReplaceNulls(Items=volume_3.Volume, Replacements=0)  # -> Items, Count; disabled
ma = MassAddition(Input=flatten(nullrep.Items))  # -> Result, PartialResults; disabled

# ---- group: VIZ
geo_36 = Geometry(item_45)
preview_2 = CustomPreview(Geometry=geo_36, Material=ColourSwatch(SwatchColor=RGBA(196, 213, 255, 194)))

# ----
panel_90 = Panel(ma.Result)  # disabled

filter_4 = StreamFilter(Gate=dam_type_5, Stream0=geo_concretedam_3, Stream1=geo_archdam_4)
volume_4 = Volume(Geometry=filter_4, UseTasks=False)  # -> Volume, Centroid; disabled
round_3 = Round(Number=volume_4.Centroid)  # -> Nearest, Floor, Ceiling; disabled
dam_volume_top = RemoteSender(round_3.Nearest)  # disabled
preview_3 = CustomPreview(Geometry=filter_4, Material=ColourSwatch(SwatchColor=RGB(115, 109, 209)))  # disabled

dam_volume_top_2 = RemoteReceiver(dam_volume_top)
preview_4 = CustomPreview(Geometry=filter_4, Material=ColourSwatch(SwatchColor=RGB(115, 109, 209)))  # disabled

# ---- group: results / data in right formatting
num_5 = Number(panel_90)  # disabled
division_8 = Division(A=num_5, B=1000000)  # disabled
roundd = RoundToDecimalPlace(NumberX=division_8, DecimalPlace=1, RoundType=0)  # -> Rounded, Difference; disabled

# ----
offset_l_2 = OffsetSurfaceLoose(Surface=flip_5.Surface, Distance=division_3, Retrim=True)  # disabled
mesh_8 = MeshBrep(Brep=join_8.Breps, Settings=jagged_4)
sporph = Sporph(G=move_31.Geometry, R=False)  # disabled
offcrv_2 = OffsetCurve(Curve=crv_6, Plane=PlaneXY(0, 0, 0), Distance=neg_6, BothSides=0, Kinks=0, CapType=1)  # disabled
crv_7 = Curve(offset_l_2)  # disabled
loft_7 = Loft(Curves=offcrv_2, Options={Adjust=False, Closed=False, LoftEnds=0, LoftSimp=0, LoftType=0, Rebuild=10, Refit=0.01})  # disabled
move_32 = Move(Geometry=mesh_8, Motion=vector_to_origin_5)  # -> Geometry, Transform
volume_5 = MeshVolume(Mesh=mesh_8)  # -> Volume, Centroid
geo_37 = Geometry(flatten(move_32.Geometry))
wires = BrepWireframe(Brep=join_8.Breps, Density=-1)
cad_out = ExportCAD(Geometries=geo_37, DirectoryPath=path_save_3, FileName=concat, Extension=0, Save=Button())
format_3 = Format(
    Format=panel_59,
    Culture=127,
    Data0=water_level_5,
    Data1=dam_level_3,
    Data2=pdecon_7.ZComponent,
    Data3=arch_dam_height_6,
    Data4=len,
    Data5=len_2,
    Data6=len_3,
    Data7=volume_5.Volume)
geo_archdam_5 = RemoteReceiver(geo_archdam)  # disabled

# ---- group: Foundation
# 6. Excavation
# E. Goulas: A reasonable value for the excavation can be from 10 to 30 meters (good rock conditions with minor weathering and a canyon profile ideally suited to an arch dam) in the lateral direction
# Technical Memorandum No. EM36-86-68110: Determine the base elevation of the dam. This location is to sound rock and, if that distance is unknown, can be assumed to be about 25 feet below lowest contour in
# the river bed
panel_91 = Panel("25")  # disabled
expression_12 = Expression(ft=panel_91, Expression="ft*0.3048")  # disabled
offset_foundation_8 = RemoteReceiver(offset_foundation)  # disabled
brep_terrain_4 = RemoteReceiver(brep_terrain)  # disabled
panel_92 = Panel(expression_12)  # disabled
bbx_2 = BrepBrep(BrepA=geo_archdam_5, BrepB=brep_terrain_4)  # -> Curves, Points; disabled
number_slider_32 = Slider(2, range=0..10)  # disabled
division_9 = Division(A=offset_foundation_8, B=number_slider_32)  # disabled
neg_13 = Negative(Value=division_9)  # disabled
offcrv_3 = OffsetCurve(Curve=bbx_2.Curves, Plane=PlaneXY(0, 0, 0), Distance=neg_13, BothSides=0, Kinks=0, CapType=1)  # disabled
patch_5 = Patch(Curves=offcrv_3, Spans=20, Flexibility=1, Trim=True)  # disabled
neg_14 = Negative(Value=offset_foundation_8)  # disabled
Z_17 = UnitZ(Factor=neg_14)  # disabled
extr_9 = Extrude(Base=patch_5, Direction=Z_17)  # disabled
base_archdam = Geometry(extr_9)  # disabled

# ----
division_10 = Division(A=offset_foundation_8, B=number_slider_13)  # disabled
previewlw_7 = CustomPreviewLineweights(Geometry=wires, Shader=swatch_2, Thickness=number_slider_15, Absolute=False)
previewlw_8 = CustomPreviewLineweights(Geometry=wires, Shader=swatch_2, Thickness=number_slider_15, Absolute=False)
entwine_2 = Entwine(
    Branch00=water_level_6,
    Branch01=dam_level_4,
    Branch02=pdecon_7.ZComponent,
    Branch03=arch_dam_height_7,
    Branch04=len,
    Branch05=len_2,
    Branch06=len_3,
    Branch07=volume_5.Volume,
    FlattenInputs=True)  # -> flatten(Result)
panel_93 = Panel(format_3)
panel_94 = Panel(entwine_2)
merge_10 = Merge(Data1=panel_94, Data2=trim)
join_9 = TextJoin(Text=merge_10, Join="|")
panel_95 = Panel([join_5, join_9])
panel_96 = Panel(merge_10)
cso = CreateSpeckleObject(A=geo_37, selectedKitName="Objects")
esokv = ExtendSpeckleObjectByKeyValue(SpeckleObject=cso, Keys=merge_8, Values=merge_10, selectedKitName="Objects")
send = Send(
    Stream=sget,
    Message=concat,
    Data=esokv,
    AutoSend=False,
    BaseId="ebf7db41fc341d3b415785b3736fc1b5",
    CurrentComponentState="expired",
    KitName="Objects",
    OutputWrappers="https://speckle.xyz\tacce82a2a9\t7f7b0a260a",
    UseDefaultCache=True,
    selectedKitName="Objects")
num_6 = Number(panel_96)
move_33 = Move(Geometry=[mesh_8, mesh_7], Motion=vector_to_origin_6)  # -> Geometry, Transform
# Excavation
geo_archdam_excavation = RemoteSender(base_archdam)  # disabled

geo_archdam_excavation_2 = RemoteReceiver(geo_archdam_excavation)  # disabled
filter_5 = StreamFilter(Gate=dam_type_5, Stream0=geo_concretedam_excavation, Stream1=geo_archdam_excavation_2)  # disabled
volume_6 = Volume(Geometry=filter_5, UseTasks=False)  # -> Volume, Centroid; disabled
round_4 = Round(Number=volume_6.Volume)  # -> Nearest, Floor, Ceiling; disabled
preview_5 = CustomPreview(Geometry=filter_5, Material=swatch_6)  # disabled
dam_volume_base = RemoteSender(round_4.Nearest)  # disabled

dam_volume_base_2 = RemoteReceiver(dam_volume_base)
merge_11 = Merge(Data1=flatten(dam_volume_base_2), Data2=flatten(dam_volume_top_2), Data3=flatten("0"), Data4=flatten("0"))
multiplication_4 = Multiplication(A=merge_11, B=merge_7)
entwine_3 = Entwine(Branch00=panel_40, Branch01=merge_11, Branch02=merge_7, Branch03=multiplication_4, FlattenInputs=True)
data_series = UIDataSeries(Label=graft(panel_39), Data=entwine_3, Type=5)  # -> flatten(DataSeries)
grid_chart_2 = UiGridChart(Element=grid_chart, DataSeries=data_series, Titles=True)
addition_8 = Addition(A=volume_4.Volume, B=volume_6.Volume)  # disabled
dam_volume = RemoteSender(addition_8)  # disabled
dam_volume_2 = RemoteReceiver(dam_volume)  # disabled

# ---- group: results / data in right formatting
num_7 = Number(dam_volume_2)  # disabled
division_11 = Division(A=num_7, B=1000000)  # disabled
roundd_2 = RoundToDecimalPlace(NumberX=division_11, DecimalPlace=1, RoundType=0)  # -> Rounded, Difference; disabled

# ----
num_8 = Number(volume_2.Volume)
exportvector = ExportVector(
    VectorDataFilename=concat_2,
    VectorDataFolder=concat_3,
    Fields="Volume",
    Values=num_8,
    FeatureGeometry=move_33.Geometry,
    Export=Button(),
    DriverExtension=".shp",
    DriverType="ESRI Shapefile")
exportvector_2 = ExportVector(
    VectorDataFilename=concat,
    VectorDataFolder=concat_3,
    Fields=panel_85,
    Values=num_6,
    FeatureGeometry=geo_37,
    Export=Button(),
    DriverExtension=".shp",
    DriverType="ESRI Shapefile")
panel_97 = Panel(exportvector)

python_3 = GhPythonScript(river_discharge=num_4, eco_discharge=num_3, design_discharge=num_2)  # -> out, a; inputs river_discharge: list; disabled
# ---------- python_3: Python ----------
__author__ = "Kona"
__version__ = "2022.03.25"

import rhinoscriptsyntax as rs

e = eco_discharge
a1 = []

for i in range (len(river_discharge)):
    print i
    if float(river_discharge[i]) > e:
        print river_discharge[i],e,True
        result = float(river_discharge[i]) - e
        a1.append(result)
    else:
        a1.append("0")

d = design_discharge
a = []

for i in range (len(a1)):
    if float(a1[i]) > d:
        result = d
        a.append(result)
    else:
        a.append(a1[i])
# ---------- end python_3 ----------
discharge_used_m3_s = Panel(python_3.a)  # disabled
i_energy_dt_2 = RemoteReceiver(i_energy_dt)  # disabled

# ----
# ENERGY CALCULATION
pdecon_10 = Deconstruct(Point=pt_3)  # -> XComponent, YComponent, flatten(ZComponent); disabled
pdecon_11 = Deconstruct(Point=pt_4)  # -> XComponent, YComponent, flatten(ZComponent); disabled
round_5 = Round(Number=pdecon_10.ZComponent)  # -> Nearest, Floor, Ceiling; disabled
subtraction_4 = Subtraction(A=pdecon_10.ZComponent, B=freeboard_5)  # disabled
round_6 = Round(Number=pdecon_11.ZComponent)  # -> Nearest, Floor, Ceiling; disabled
ph_elevation = RemoteSender(round_6.Nearest)  # disabled
crest_elevation = RemoteSender(round_5.Nearest)  # disabled
panel_98 = Panel("1")  # disabled

upstream_waterlevel = Panel(subtraction_4)  # disabled
downstream_waterlevel = Panel(pdecon_11.ZComponent)  # disabled

B = B(100)  # disabled

division_12 = Division(A=i_energy_head_losses_2, B=B)  # disabled
subtraction_5 = Subtraction(A=upstream_waterlevel, B=downstream_waterlevel)  # disabled
subtraction_6 = Subtraction(A=panel_98, B=division_12)  # disabled
multiplication_5 = Multiplication(
    LevelDifference=subtraction_5,
    _1HeadLosses=subtraction_6,
    DesignDischarge=i_energy_design_discharge_2,
    GConstant=g_constant,
    PlantEfficiency=division_2)  # disabled
roundd_3 = RoundToDecimalPlace(NumberX=multiplication_5, DecimalPlace=1, RoundType=0)  # -> Rounded, Difference; disabled
installed_capacity_mw = Panel(roundd_3.Rounded)  # disabled

# ---- group: results / data in right formatting
num_9 = Number(installed_capacity_mw)  # disabled
roundf = RoundToFactor(NumberX=num_9, Factor=1, RoundType=0)  # -> Rounded, Difference, MultiplierR, MultiplierX; disabled

# ----
gross_head_m = Panel(subtraction_5)  # disabled
multiplication_6 = Multiplication(A=gross_head_m, B=subtraction_6)  # disabled
net_head_m = Panel(multiplication_6)  # disabled

multiplication_7 = Multiplication(DischargeUsed=discharge_used_m3_s, GConstant=g_constant, PlantEfficiency=division_2, NetHead=net_head_m)  # disabled
generated_power_mw = Panel(multiplication_7)  # disabled
multiplication_8 = Multiplication(A=generated_power_mw, B=i_energy_dt_2)  # disabled
division_13 = Division(A=multiplication_8, B=1000)  # -> flatten(Result); disabled
energy_production_gwh = Panel(division_13)  # disabled
ma_2 = MassAddition(Input=energy_production_gwh)  # -> Result, PartialResults; disabled
roundd_4 = RoundToDecimalPlace(NumberX=ma_2.Result, DecimalPlace=1, RoundType=0)  # -> Rounded, Difference; disabled
energy_production_gwh_2 = Panel(roundd_4.Rounded)  # disabled

python_4 = GhPythonScript(x=energy_production_gwh_2, y=installed_capacity_mw)  # -> out, a; disabled
# ---------- python_4: Python ----------
__author__ = "Kona"
__version__ = "2022.03.25"

import rhinoscriptsyntax as rs

a = round(((x*1000)/y/8760*100),1)
# ---------- end python_4 ----------
plant_factor = Panel(python_4.a)  # disabled

# ---- group: results / data in right formatting
num_10 = Number(energy_production_gwh_2)  # disabled
roundf_2 = RoundToFactor(NumberX=num_10, Factor=1, RoundType=0)  # -> Rounded, Difference, MultiplierR, MultiplierX; disabled

roundf_3 = RoundToFactor(NumberX=dist, Factor=100, RoundType=0)  # -> Rounded, Difference, MultiplierR, MultiplierX; disabled
round_7 = Round(Number=net_head_m)  # -> Nearest, Floor, Ceiling; disabled

len_10 = Length(Curve=chord_dam_10)  # disabled
num_11 = Number(len_10)  # disabled
roundf_4 = RoundToFactor(NumberX=num_11, Factor=10, RoundType=0)  # -> Rounded, Difference, MultiplierR, MultiplierX; disabled
crest_elevation_2 = RemoteReceiver(crest_elevation)  # disabled
panel_99 = Panel("1:")  # disabled
ph_elevation_2 = RemoteReceiver(ph_elevation)  # disabled
concat_4 = Concatenate(FragmentA=panel_99, FragmentB=gravity_ds_ration_4)  # disabled
dam_level_6 = RemoteReceiver(dam_level)  # disabled
width_crest_4 = RemoteReceiver(width_crest)  # disabled
freeboard_6 = RemoteReceiver(freeboard)  # disabled
panel_100 = Panel(concat_4)  # disabled
num_12 = Number(plant_factor)  # disabled
merge_12 = Merge(
    Data1=dam_level_6,
    Data2=freeboard_6,
    Data3=offset_foundation_6,
    Data4=width_crest_4,
    Data5=flatten(roundf_4.Rounded),
    Data6=panel_100,
    Data7=i_energy_head_losses_2,
    Data8=i_energy_design_discharge_2,
    Data9=i_energy_ecological_discharge_2,
    Data10=flatten(i_energy_powerplant_efficiency_2),
    Data11=flatten(roundf_3.Rounded),
    Data12=flatten(roundd.Rounded),
    Data13=flatten(roundd_2.Rounded),
    Data14=flatten(round_7.Nearest),
    Data15=flatten(crest_elevation_2),
    Data16=flatten(ph_elevation_2),
    Data17=flatten(roundf.Rounded),
    Data18=flatten(roundf_2.Rounded),
    Data19=flatten(num_12))  # -> graft(Result); disabled

# ---- group: results / conduit
panel_101 = Panel("""Dam height = {1} m
Freeboard = {2}  m
Depth of foundation = {3} m
Crest width = {4} m
Crest length = {5} m
Downstream face slope = {6}
Head losses = {7} %
Design discharge = {8} m3/s
Ecological discharge = {9} m3/s
Plant efficiency = {10} %
Distance to the power house = {11} m
Volume water = {12} Mio m3
Volume dam = {13} Mio m3
Hn = {14} m
Crest elevation = {15} m asl
Power house elevation = {16} m asl
Installed capacity = {17} MW
Yearly production = {18} GWh
Plant Factor = {19} %""")  # disabled
button_3 = Button()  # disabled
number_slider_33 = Slider(3, range=0..10)  # disabled
bounds = GetViewportBoundaryDimensions(Refresh=button_3, Origin=lowest_point_dam_section_3, Scale=0.25, xDim=1019, yDim=761)  # disabled
grid_tiles = GridTiles(Boundary=bounds, Columns=5, Rows=number_slider_33, InteriorPadding=0.02, ExteriorPadding=0.02, PaddingAxis=0)  # disabled
format_4 = Format(
    Format=panel_101,
    Culture=127,
    Data0=roundf_4.Rounded,
    Data1=dam_level_6,
    Data2=freeboard_6,
    Data3=offset_foundation_6,
    Data4=width_crest_4,
    Data5=roundf_4.Rounded,
    Data6=panel_100,
    Data7=i_energy_head_losses_2,
    Data8=i_energy_design_discharge_2,
    Data9=i_energy_ecological_discharge_2,
    Data10=i_energy_powerplant_efficiency_2,
    Data11=roundf_3.Rounded,
    Data12=roundd.Rounded,
    Data13=roundd_2.Rounded,
    Data14=round_7.Nearest,
    Data15=crest_elevation_2,
    Data16=ph_elevation_2,
    Data17=roundf.Rounded,
    Data18=roundf_2.Rounded,
    Data19=num_12)  # disabled
number_slider_34 = Slider(14, range=0..100)  # disabled
number_slider_35 = Slider(100, range=0..100)  # disabled
item_46 = ListItem(List=grid_tiles, Index=0, Wrap=True)  # disabled
Y = UnitY(Factor=number_slider_35)  # disabled
panel_102 = Panel(",")  # disabled
font = ConduitFont(
    Font="Arial",
    TextHeight=number_slider_34,
    AdaptiveHeight=False,
    TextSpacing=1.15,
    Alignment=0,
    Bold=False,
    Italic=False,
    Color=RGB(0, 0, 0))  # disabled
panel_103 = Panel("'")  # disabled
move_34 = Move(Geometry=item_46, Motion=Y)  # -> Geometry, Transform; disabled
rep = ReplaceText(Text=format_4, Find=panel_102, Replace=panel_103, RecursiveReplace=False)  # disabled
hud_text = DrawText(Boundary=move_34.Geometry, Text=rep, TextOrdering=1, TextDistribution=0, OrientVertically=False, CustomFont=font)  # disabled
toggle_7 = BooleanToggle(False)  # disabled
hud = HeadsUpDisplayHUD(
    ShowHUD=toggle_7,
    DrawingObjects=hud_text,
    DrawingBoundary=bounds,
    ConduitStyleSheet="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")  # disabled

# ----
evalsrf_7 = EvaluateSurface(Surface=reparameterize(extr_3), Point="0.5,0.5")  # -> Point, Normal, UDirection, VDirection, Frame
vector_waterflow_8 = RemoteReceiver(vector_waterflow)
dprod_2 = DotProduct(VectorA=evalsrf_7.Normal, VectorB=vector_waterflow_8, Unitize=False)
larger = LargerThan(FirstNumber=dprod_2, SecondNumber="0")  # -> LargerThan, OrEqualTo

smaller_2 = SmallerThan(FirstNumber=dprod_2, SecondNumber="0")  # -> SmallerThan, OrEqualTo

gate_5 = StreamGate(Stream=extr_3, Gate=smaller_2.SmallerThan)  # -> Target0, Target1
flip_6 = Flip(Surface=gate_5.Target1)  # -> Surface, Result
filter_6 = StreamFilter(Gate=smaller_2.SmallerThan, Stream0=gate_5.Target0, Stream1=flip_6.Surface)

c_script_6 = CSharpScript(polyList=filter_6)  # -> out, planeList; inputs polyList: list of Polyline; same code as c_script_2
pln_5 = Plane(c_script_6.planeList)

# ---- group: results
panel_104 = Panel("""Dam height [m]
Freeboard [m]
Depth of foundation [m]
Crest width [m]
Crest length [m]
Downstream face slope [-]
Head losses [%]
Design discharge [m3/s]
Ecological discharge [m3/s]
Plant efficiency [%]
Distance to the power house [m]
Volume water [Mio m3]
Volume dam [Mio m3]
Hn [m] 
Crest elevation [m asl]
Power house elevation [m asl]
Installed capacity [MW]
Yearly production [GWh]
Plant Factor [%]""")  # disabled
panel_105 = Panel(merge_12)  # disabled
toggle_8 = BooleanToggle(False)  # disabled

# ---- group: results / variants / chooses correct variables
index = Panel("""0
4
14
11
12
10
13
16
17
18""")  # disabled
data_3 = Data(flatten(panel_105))  # disabled
item_47 = ListItem(List=data_3, Index=index, Wrap=True)  # disabled

# ----
lng_14 = ListLength(List=index)  # disabled
series = Series(Start=0, Step=1, Count=lng_14)  # disabled
null_2 = NullPlaceholder()  # disabled
ins = InsertItems(List=null_2, Item=null_2, Indices=series, Wrap=True)  # -> simplify(List); disabled

# ---- group: results / variants
data_4 = Data(panel_104)  # disabled
item_48 = ListItem(List=data_4, Index=index, Wrap=True)  # disabled
panel_106 = Panel("VARIANT ")  # disabled

# ---- group: results / variants / heading
merge_13 = Merge(Data1=panel_106, Data2=item_48)  # -> flatten(Result); disabled

# ---- group: results / INPUT_values
index_2 = Panel("""1
2
3
5
6
7
8
9
15""")  # disabled
data_5 = Data(flatten(panel_105))  # disabled
data_6 = Data(panel_104)  # disabled
item_49 = ListItem(List=data_6, Index=index_2, Wrap=True)  # disabled
item_50 = ListItem(List=data_5, Index=index_2, Wrap=True)  # -> graft(Item); disabled
headings = Panel(item_49)  # disabled
panel_107 = Panel("INPUT_values")  # disabled
toggle_9 = BooleanToggle(False)  # disabled

# ---- group: results / variants
panel_108 = Panel("V ")  # disabled
concat_5 = Concatenate(FragmentA=panel_108, FragmentB=list_8)  # disabled
merge_14 = Merge(Data1=concat_5, Data2=item_47)  # -> flatten(Result); disabled
panel_109 = Panel("RESULTS")  # disabled
toggle_10 = BooleanToggle(False)  # disabled
panel_110 = Panel("1")  # disabled

# ----
merge_15 = Merge(Data1=concat_5, Data2=item_47)  # -> flatten(Result); disabled
merge_16 = Merge(Data1=concat_5, Data2=item_47)  # -> flatten(Result); disabled
merge_17 = Merge(Data1=concat_5, Data2=item_47)  # -> flatten(Result); disabled
merge_18 = Merge(Data1=concat_5, Data2=item_47)  # -> flatten(Result); disabled
filter_7 = StreamFilter(Gate=equals_2.Equality, Stream1=merge_14)  # disabled
filter_8 = StreamFilter(Gate=equals_5.Equality, Stream1=merge_15)  # disabled
filter_9 = StreamFilter(Gate=equals_6.Equality, Stream1=merge_16)  # disabled
filter_10 = StreamFilter(Gate=equals_3.Equality, Stream1=merge_17)  # disabled
filter_11 = StreamFilter(Gate=equals_4.Equality, Stream1=merge_18)  # disabled

# ---- group: results / variants / allows to compare up to 5 Variants
entwine_4 = Entwine(
    Branch00=merge_13,
    Branch01=filter_7,
    Branch02=filter_8,
    Branch03=filter_9,
    Branch04=filter_10,
    Branch05=filter_11,
    FlattenInputs=True)  # disabled

# ---- group: results / INPUT_tabelle
headers = Panel("""Month
Discharge in the river [m3/s]
Delta T [h] """)  # disabled
panel_111 = Panel("""Jan
Feb
Mär
Apr
Mai
Jun
Jul
Aug
Sep
Okt
Nov
Dez""")  # disabled
i_energy_dir_3 = RemoteReceiver(i_energy_dir)  # disabled
i_energy_dt_3 = RemoteReceiver(i_energy_dt)  # disabled
entwine_5 = Entwine(Branch00=panel_111, Branch01=i_energy_dir_3, Branch02=i_energy_dt_3, FlattenInputs=True)  # -> simplify(Result); disabled
toggle_11 = BooleanToggle(False)  # disabled
path_2 = FilePath("C:\Users\KONA\Desktop\dam_input_values.xlsx")  # disabled
panel_112 = Panel("INPUT_tabelle")  # disabled

# ---- group: results / INPUT_values (continued)
excelwrite = ExcelWrite(
    WriteExcelData=toggle_9,
    WorkbookPath=path_2,
    WorksheetName=panel_107,
    ColumnHeadings=headings,
    Data=item_50,
    ClearSheet=toggle_8)  # disabled
panel_113 = Panel(excelwrite)  # disabled

# ---- group: results (continued)
excelwrite_2 = ExcelWrite(
    WriteExcelData=toggle_11,
    WorkbookPath=path_2,
    WorksheetName=panel_112,
    ColumnHeadings=headers,
    Data=entwine_5,
    ClearSheet=toggle_8)  # disabled

# ---- group: results / INPUT_tabelle (continued)
panel_114 = Panel(excelwrite_2)  # disabled

# ---- group: results / variants (continued)
insert_data = GhPythonScript(
    run=toggle_10,
    xlsx_filepath=path_2,
    xlsx_worksheet=panel_109,
    data=entwine_4,
    rel_position_x=panel_110,
    rel_position_y=panel_110,
    variant_position=list_8)  # -> out, a; inputs run: Boolean, data: tree, rel_position_x: Int32, rel_position_y: Int32; disabled
# ---------- insert_data: Python ----------
__author__ = "KONA"
__version__ = "2022.04.14"

import rhinoscriptsyntax as rs
import scriptcontext as sc
import string
import ghpythonlib.treehelpers as th

a = th.tree_to_list(data)

openpyxl = sc.sticky['openpyxl']
PIL = sc.sticky['PIL']

if _run == True:
    #load workbook and worksheet
    workbook = openpyxl.load_workbook(filename=xlsx_filepath, read_only=False)
    worksheet = workbook[xlsx_worksheet]
    
    #write Data to column (at defined position)
    for list_count, list in enumerate(a):
        for count, data_item in enumerate(list):
            print list_count
            print count
            print data_item
            cellref = worksheet.cell(row = rel_position_y + list_count,column = rel_position_x + count)
            print (cellref)
            cellref.value = data_item
        list_count += variant_position
        
        workbook.save(xlsx_filepath)
    else:
        pass
# ---------- end insert_data ----------
panel_115 = Panel(insert_data.a)  # disabled

# ==== cluster GHPythonRemote: Connects the Grasshopper Python component to an external Python instance.
python = PythonScript()  # -> gh_parent_doc_dir
# ---------- python: Python ----------
from os import path

gh_parent_doc_dir = path.abspath(path.dirname(ghenv.Component.OnPingDocument().Owner.OnPingDocument().FilePath))
# ---------- end python ----------
# GH to python remote example.
# Pierre Cuvilliers, 2017-2018
# Released under the MIT license
# github.com/pilcru/ghpythonremote
# Runs and connects to an external python engine, and
# assigns imported modules to scriptcontext.sticky variables.
# 
# Arguments:
#       code (str): Path to the GH_to_python_sticky.py code file.
#       location (str): Path to a python executable, or to a folder
#             containing `python.exe`, or the name of a conda-created
#             virtual environment prefixed by `conda://` (`conda://env_name`).
#             If empty, finds python from your windows %PATH%.
#       run (boolean): Creates the connection, and imports new
#             modules, when turned to True. Kills the connection,
#             and deletes the references to the imports, when turned
#             to False.
#       modules (str list): List of module names to import in the
#             remote python. They will be added to the
#             scriptcontext.sticky dictionary, allowing them to be
#             reused from other python components in the same
#             Grasshopper document. Submodules (for example
#             `numpy.linalg` have to be added explicitly to this list
#             to be available later.
#       log_level (str from ['NOTSET', 'DEBUG', 'INFO', 'WARNING', 'ERROR', 'CRITICAL']):
#             Logging level to use for the local IronPython and the
#             remote python instance.
#       working_dir (str): Working directory for the remote python
#             instance.
# 
# Returns:
#       out (str): Console output with DEBUG information.
#       linked_modules (str list): list of imported module names.
#       rpy (rpyc connection object): The object representing the
#             remote Python interpreter.
location = ClusterInput()  # location (str): Path to a python executable, or to a folder containing `python.exe`, or the name of a conda-created virtual environment prefixed by `conda://` (`conda://env_name`). If empty, finds python from your windows %PATH%.
run = ClusterInput()  # run (boolean): Creates the connection, and imports new modules, when turned to True. Kills the connection,and deletes the references to the imports, when turned to False.
modules = ClusterInput()  # modules (str list): List of module names to import in the remote python. They will be added to the scriptcontext.sticky dictionary, allowing them to be reused from other python components in the same Grasshopper document. Submodules (for example `numpy.linalg` have to be added explicitly to this list to be available later.
list = ValueList({"CRITICAL", "ERROR", "WARNING", "INFO", "DEBUG", "NOTSET"}, selected="DEBUG")
panel = Panel(python)
ghpythonremote = GHPythonRemote(location=location, run=run, modules=modules, log_level=list, working_dir=panel)  # -> out, linked_modules, rpy; inputs run: Boolean, modules: list
# ---------- ghpythonremote: Python ----------
import inspect
import logging
from os import path
import sys
from time import sleep

import scriptcontext

import ghpythonremote
from ghpythonremote.connectors import GrasshopperToPythonRemote

local_log_level = getattr(logging, log_level, logging.WARNING)
logger = logging.getLogger("ghpythonremote")
logger.setLevel(local_log_level)
ch = logging.StreamHandler()
ch.setLevel(local_log_level)
formatter = logging.Formatter("%(levelname)s: %(name)s:\n%(message)s")
ch.setFormatter(formatter)
logger.handlers = []
logger.addHandler(ch)
logger = logging.getLogger("ghpythonremote.GH_to_python")

ROOT = path.abspath(path.dirname(inspect.getfile(ghpythonremote)))
rpyc_server_py = path.join(ROOT, "pythonservice.py")

# Set connection to CLOSED if this is the first run
# and initialize set of linked modules
try:
    remote_python_status
except NameError:
    remote_python_status = "CLOSED"
    lkd_modules = set()

# Wait for connection to connect or terminate
timer = 0
while remote_python_status == "CONNECTING" or remote_python_status == "CLOSING":
    sleep(1)
    timer += 1
    if timer == 10:
        try:
            gh2py_manager.__exit__(*sys.exc_info())
        except Exception:
            pass
        remote_python_status = "CLOSED"
        lkd_modules = set()
        raise RuntimeError(
            "Connection left in an inconsistent state and not returning. Reset "
            "everything."
        )

if run:
    if not remote_python_status == "OPEN":
        remote_python_status = "CONNECTING"
        gh2py_manager = GrasshopperToPythonRemote(
            rpyc_server_py,
            location=location,
            timeout=10,
            port=None,
            log_level=log_level,
            working_dir=working_dir,
        )
        gh2py = gh2py_manager.__enter__()
        remote_python_status = "OPEN"

    # Stuff that we can reach
    rpymod = gh2py.py_remote_modules  # A getter function for a named python module
    rpy = gh2py.connection  # Represents the remote instance root object
    scriptcontext.sticky["rpy"] = rpy
    # Add modules
    for mod in modules:
        try:
            scriptcontext.sticky[mod] = rpymod(mod)
            lkd_modules.add(mod)
        except ImportError:
            gh2py_manager.__exit__(*sys.exc_info())
            raise

elif not remote_python_status == "CLOSED":
    remote_python_status = "CLOSING"
    # Remove linked modules
    for mod in lkd_modules:
        del scriptcontext.sticky[mod]
    del scriptcontext.sticky["rpy"]
    gh2py_manager.__exit__(*sys.exc_info())
    lkd_modules = set()
    remote_python_status = "CLOSED"

# Change variable name because ghpython resets outputs to None before each run
linked_modules = lkd_modules

logger.info("GH to python connection is {}".format(remote_python_status))
# ---------- end ghpythonremote ----------
out = ClusterOutput(ghpythonremote.out)  # Console output.
linked_modules = ClusterOutput(ghpythonremote.linked_modules)  # Names of modules that were successfully added to the scriptcontext.sticky dictionary.
rpy = ClusterOutput(ghpythonremote.rpy)  # The object representing the remote python instance
python_2 = PythonScript(module_names=ghpythonremote.linked_modules)  # -> import_statements; inputs module_names: list
# ---------- python_2: Python ----------
import_statements = ["import scriptcontext as sc"]
for module_name in module_names:
    import_statements.append("{0} = sc.sticky['{0}']".format(module_name))

if len(module_names) == 0:
    import_statements = []
# ---------- end python_2 ----------
import_statements = ClusterOutput(python_2)  # Useful import statements to use the imported modules in your scripts.
