# Grasshopper definition JD_Beta.gh (Grasshopper 1.0.7)
# Copyright: © 2017-2018 Pierre Cuvilliers, Caitlin Mueller, Massachusetts Institute of Technology
# plug-ins: Telepathy, MetaHopper, Pufferfish, UiPlus

heights = Panel("""1826
1827
1836
1844
1845""")
panel = Panel("C:\Users\Admin\Gruner AG\Jumping dams [EXP] - General\03_Model\Example image.png")

panel_2 = Panel("""Concrete gravity dam
Arch dam
Embankment dam""")
# Dam configuration
# Dashboard structure
panel_3 = Panel("Type of Dam (m)")

heights_2 = Panel("""1836
1839
1842
1844""")
# Python remote
# In conda cmd prompt:
# 
# conda activate C:\Users\cna\.conda\envs\rhinoremote
# 
# pip install <package> - for any missing package check the ouput to the right
# 
# For PIL -> pip install pillow
panel_4 = Panel("C:\Users\cna\Anaconda3\envs\rhinoremote")
panel_5 = Panel("""PIL
openpyxl""")
# Requirements hops scripts
panel_6 = Panel("Modules\Gravity.gh")
# Requirements plugins
panel_7 = Panel("""UI+
Metahopper""")

# ---- group: INFO
# _________________________________
# 
# This file is done based on the rhino file:
# _________________________________
# "C:\Users\Admin\Gruner AG\BSBE [ORG] - Digitale Anwendungen ESD\04_Projekte\2023\CH_VS_Barrage Les Toules_SensitivityAnalysis_JD\Model\231708_Le toules-WSCH00320.3dm"
# Images folder - saved where the gh file is
# Image size settings
number_slider = Slider(700, range=0..1000)
# Infos & Settings
panel_8 = Panel("231708_Le toules.3dm")
viewport_1_for_images = Panel("Perspektive")
viewport_2_for_images = Panel("Drauf")
viewport_3_for_images = Panel("Detail")
relpath = RelativePath(Path="Bilder")
multiplication = Multiplication(A=number_slider, B="7")
multiplication_2 = Multiplication(A=number_slider, B="5")
panel_9 = Panel(relpath)
viewport_name_3 = RemoteSender(viewport_3_for_images)
viewport_name_1 = RemoteSender(viewport_1_for_images)
viewport_name_2 = RemoteSender(viewport_2_for_images)
panel_10 = Panel("1446")
panel_11 = Panel(multiplication)
panel_12 = Panel("883")
panel_13 = Panel(multiplication_2)

# ----
panel_14 = Panel("C:\Users\Admin\Gruner AG\Jumping dams [EXP] - General\03_Model\Les Toules")
num = Number(heights_2)
sort = SortList(Keys=heights_2, ValuesA=num)  # -> Keys, ValuesA
label = UiLabel(Label=panel_3, Style=3)
label_2 = UiLabel(Label="Water level (m)", Style=3)
image = UiImage(Bitmap=panel, Fitting=1)
label_3 = UiLabel(Label="Freeboard (m)", Style=3)
slider = UiSlider(Value=0.5, Bounds=Domain(0, 1), Increment=0.1)
relpath_2 = RelativePath(Path="Modules\Dashboard_damConfiguration")
relpath_3 = RelativePath(Path="Modules\Embankment.gh")
relpath_4 = RelativePath(Path="Modules\Arch.gh")
label_4 = UiLabel(Label="Foundation depth (m)", Style=3)
relpath_5 = RelativePath(Path=panel_6)
button = UiButton(Label="Ok")
toggle = UiToggle(State=False)
slider_2 = UiSlider(Value=0.5, Bounds=Domain(0, 1), Increment=0.1)
toggle_2 = UiToggle(State="True")
list_of_heights = RemoteSender(sort.ValuesA)
list_of_heights_2 = RemoteReceiver(list_of_heights)
dropdown_list = UiDropdownList(Values=list_of_heights_2)
pythonremote = GHPythonRemote(location=panel_4, run=Toggle(False), modules=panel_5)  # -> out, linked_modules, rpy, import_statements
merge = Merge(Data1=relpath_5, Data2=relpath_4, Data3=relpath_3, Data4=relpath_2)
path_save = RemoteSender(panel_14)
panel_15 = Panel(merge)
filepath_hops = RemoteSender(merge)
panel_16 = Panel(pythonremote.out)
list_of_heights_3 = RemoteReceiver(list_of_heights)
dropdown_list_2 = UiDropdownList(Element=dropdown_list, Values=list_of_heights_3, Index=Slider(3, range=0..10))
resize = UiResize(Element=image, Width="200", Height="200")
get_values = UiValues(Element=dropdown_list_2)  # -> flatten(Values)
slider_3 = UiSlider(Element=slider, Label="m", Value="3", Bounds="0 To 5", Increment=".1")
button_2 = UiButton(Element=button, Label="Send changes")
slider_4 = UiSlider(Element=slider_2, Label="m", Value="10", Bounds="0 To 50", Increment=".1")
toggle_3 = UiToggle(Element=toggle, Label="Show direction river flow?", State=False)
toggle_4 = UiToggle(Element=toggle_2, Label="Visualize dimensions?", State=False)
dam_configuration = Button()
item = ListItem(List=list_of_heights_3, Index=get_values, Wrap=True)
# Run Dam
# Select dam type
list = ValueList({"Concrete gravity dam": "0", "Arch dam": "1", "Embankment dam": "2"}, selected="Arch dam")
run_pre_geometry_of_water = Button()
run_arch_dam = Button()
run_volume_arch_dam = Button()
get_values_2 = UiValues(Element=slider_3)  # -> flatten(Values)
get_values_3 = UiValues(Element=slider_4)  # -> flatten(Values)
get_values_4 = UiValues(Element=button_2)  # -> flatten(Values)
get_values_5 = UiValues(Element=toggle_3)  # -> flatten(Values)
get_values_6 = UiValues(Element=toggle_4)  # -> flatten(Values)
water_level_m_input_from_dashboard = Panel(item)
# Dashboard - fill in data and listen to outputs
dam_type_index = Panel("""0
1
2""")
panel_17 = Panel("""False
False
False""")
freeboard_m_input_from_dashboard = Panel(get_values_2)
# must be a closed volume!
geo_archdam = RemoteReceiver()
panel_18 = Panel(get_values_5)
offset_foundation_m_input_from_dashboard = Panel(get_values_3)
panel_19 = Panel(get_values_6)
panel_20 = Panel(get_values_4)
replace = ReplaceItems(List=panel_17, Item="True", Indices=list, Wrap=False)
psrfclsd = IsPolysurfaceClosed(Polysurface=geo_archdam)
dam_selection = RemoteSender(replace)
dam_selection_2 = RemoteReceiver(dam_selection)
panel_21 = Panel(dam_selection_2)
radio = UiRadio(Label=panel_2, State=panel_21, Group="Group 1")
merge_2 = Merge(
    Data1=label,
    Data2=radio,
    Data3=label_2,
    Data4=dropdown_list,
    Data5=label_3,
    Data6=slider,
    Data7=label_4,
    Data8=slider_2,
    Data9=button,
    Data10=toggle,
    Data11=toggle_2)  # -> flatten(Result)
get_values_7 = UiValues(Element=radio)  # -> flatten(Values)
dam_type = Panel(get_values_7)
dispatch = Dispatch(List=dam_type_index, DispatchPattern=dam_type)  # -> ListA, ListB
dashboard_damconfiguration = RemoteSender(dam_configuration)
dashboard_damconfiguration_2 = RemoteReceiver(dashboard_damconfiguration)
window = UiWindow(Elements=merge_2, Title="Dam Configuration", Owner=1, Scroll=True, Launch=dashboard_damconfiguration_2)
panel_22 = Panel(psrfclsd)
viz_dimensions = RemoteSender(panel_19)
viz_direction_river = RemoteSender(panel_18)

dam = DataDam(DataA=dispatch.ListA, BufferDelay=2500000, BufferMode=0)
dam_2 = DataDam(
    DataA=dispatch.ListA,
    DataB=water_level_m_input_from_dashboard,
    DataC=freeboard_m_input_from_dashboard,
    DataD=offset_foundation_m_input_from_dashboard,
    BufferDelay=5000000,
    BufferMode=0)  # -> DataA, DataB, DataC, DataD
objfromgroup = GetObjectsInGroup()

dam_3 = DataDam(DataA=freeboard_m_input_from_dashboard, BufferDelay=10000000, BufferMode=0)  # disabled
dam_4 = DataDam(DataA=offset_foundation_m_input_from_dashboard, BufferDelay=10000000, BufferMode=0)  # disabled

lng = ListLength(List=objfromgroup)
dup = DuplicateData(Data=panel_20, Number=lng, Order=True)

inpupt_offset_foundation_m = Panel(dam_2.DataD)
addition = Addition(A=dam_2.DataB, B=dam_2.DataC)
bool = Boolean(dup)
water_level = RemoteSender(dam_2.DataB)
dam_type_2 = RemoteSender(dam)
dam_level = RemoteSender(addition)
freeboard = RemoteSender(dam_2.DataC)
offset_foundation = RemoteSender(dam_2.DataD)
setobj = SetObjectValue(ObjectToSet=flatten(objfromgroup), ValueToSet=flatten(bool))
panel_23 = Panel(lng)
panel_24 = Panel(dup)

pipeline = GeometryPipeline(
    GroupByLayer=False,
    GroupByType=False,
    IncludeHidden=True,
    IncludeLocked=True,
    LayerFilter="Upstream_point",
    NameFilter="*",
    SublayerFiltering=True,
    TypeFilter=1)
pipeline_2 = GeometryPipeline(
    GroupByLayer=False,
    GroupByType=False,
    IncludeHidden=True,
    IncludeLocked=True,
    LayerFilter="Axes",
    NameFilter="*",
    SublayerFiltering=True,
    TypeFilter=4)

pipeline_3 = GeometryPipeline(
    GroupByLayer=False,
    GroupByType=False,
    IncludeHidden=True,
    IncludeLocked=True,
    LayerFilter="Terrain_levels",
    NameFilter="*",
    SublayerFiltering=True,
    TypeFilter=4)
mesh = GeometryPipeline(
    GroupByLayer=False,
    GroupByType=False,
    IncludeHidden=True,
    IncludeLocked=True,
    LayerFilter="Terrain_brep_offset_-10",
    NameFilter="*",
    SublayerFiltering=True,
    TypeFilter=1073741848)
mesh_2 = GeometryPipeline(
    GroupByLayer=False,
    GroupByType=False,
    IncludeHidden=True,
    IncludeLocked=True,
    LayerFilter="Terrain_brep",
    NameFilter="*",
    SublayerFiltering=True,
    TypeFilter=1073741848)
mesh_3 = GeometryPipeline(
    GroupByLayer=False,
    GroupByType=False,
    IncludeHidden=True,
    IncludeLocked=True,
    LayerFilter="Terrain_base_curve",
    NameFilter="*",
    SublayerFiltering=True,
    TypeFilter=4)
pipeline_4 = GeometryPipeline(
    GroupByLayer=False,
    GroupByType=False,
    IncludeHidden=True,
    IncludeLocked=True,
    LayerFilter="Gravity_axes::1",
    NameFilter="*",
    SublayerFiltering=True,
    TypeFilter=4)
pipeline_5 = GeometryPipeline(
    GroupByLayer=False,
    GroupByType=False,
    IncludeHidden=True,
    IncludeLocked=True,
    LayerFilter="Axes::BG",
    NameFilter="*",
    SublayerFiltering=True,
    TypeFilter=4)
xy = XYPlane(Origin=Point(0, 0, 0))
vec2pt = Vector2Pt(PointA=pipeline, PointB=xy, Unitize=False)  # -> Vector, Length
rev = Reverse(Vector=vec2pt.Vector)
vector_to_origin = RemoteSender(rev)
item_2 = ListItem(List=pipeline_2, Index=Slider(4, range=0..10), Wrap=True)
move = Move(Geometry=pipeline_2, Motion=vec2pt.Vector)  # -> Geometry, Transform
item_3 = ListItem(List=move.Geometry, Index=Slider(4, range=0..10), Wrap=True)
move_2 = Move(Geometry=pipeline_5, Motion=vec2pt.Vector)  # -> Geometry, Transform; disabled
move_3 = Move(Geometry=pipeline, Motion=vec2pt.Vector)  # -> Geometry, Transform; disabled
move_4 = Move(Geometry=pipeline_3, Motion=vec2pt.Vector)  # -> Geometry, Transform; disabled
move_5 = Move(Geometry=mesh_2, Motion=vec2pt.Vector)  # -> Geometry, Transform; disabled
move_6 = Move(Geometry=mesh, Motion=vec2pt.Vector)  # -> Geometry, Transform; disabled
move_7 = Move(Geometry=mesh_3, Motion=vec2pt.Vector)  # -> Geometry, Transform; disabled
brep = Brep(mesh_3)
brep_terrain_base_foundation = RemoteSender(mesh)
brep_terrain_base = RemoteSender(brep)
brep_terrain = RemoteSender(mesh_2)
dam_axes_all = RemoteSender(pipeline_2)
lines_levels = RemoteSender(pipeline_3)
dam_axis = RemoteSender(pipeline_5)
brep_terrain_base_foundation_2 = RemoteReceiver(brep_terrain_base_foundation)
dam_level_2 = RemoteReceiver(dam_level)
dam_axis_2 = RemoteReceiver(dam_axis)

# ---- group: Selecting dam height level
# This changes when the axis line calculate and recalculate the basics again
brep_terrain_2 = RemoteReceiver(brep_terrain)

# ----
dam_level_3 = RemoteReceiver(dam_level)  # disabled
geo = Geometry(pipeline_5)  # disabled
geo_2 = Geometry(mesh)  # disabled
Z = UnitZ(Factor=dam_level_2)
Z_2 = UnitZ(Factor=dam_level_3)  # disabled
move_8 = Move(Geometry=geo, Motion=Z_2)  # -> Geometry, Transform; disabled
move_9 = Move(Geometry=dam_axis_2, Motion=Z)  # -> Geometry, Transform
scx = SurfaceCurve(Surface=geo_2, Curve=move_8.Geometry)  # -> Curves, flatten(Points), UVPoints, Normals, Parameters, Tangents; disabled
item_4 = ListItem(List=scx.Points, Index=0, Wrap=True)  # -> Item, Item1; disabled
ln = Line(StartPoint=item_4.Item, EndPoint=item_4.Item1)  # disabled
scx_2 = SurfaceCurve(Surface=brep_terrain_2, Curve=move_9.Geometry)  # -> Curves, flatten(Points), UVPoints, Normals, Parameters, Tangents

# ---- group: Finding the crest points at bottom EXCAVATION
scx_3 = SurfaceCurve(Surface=brep_terrain_base_foundation_2, Curve=move_9.Geometry)  # -> Curves, flatten(Points), UVPoints, Normals, Parameters, Tangents
item_5 = ListItem(List=scx_3.Points, Index=0, Wrap=True)  # -> Item, Item1

# ----
water_level_2 = RemoteReceiver(water_level)
item_6 = ListItem(List=scx_2.Points, Index=0, Wrap=True)  # -> Item, Item1
Z_3 = UnitZ(Factor=water_level_2)
ln_2 = Line(StartPoint=item_6.Item, EndPoint=item_6.Item1)

# ---- group: AXIS LINE
ln_3 = Line(StartPoint=item_5.Item, EndPoint=item_5.Item1)

# ----
len = Length(Curve=ln_2)
sec = BrepPlane(Brep=brep_terrain_2, Plane=Z_3)  # -> Curves, Points
join = JoinCurves(Curves=sec.Curves, Preserve=False)
chord_dam = RemoteSender(ln_3)
movetoplane = MoveToPlane(Geometry=ln_3, Plane=Z_3, Above=True, Below=True)  # -> Geometry, Transform
axis_straight_terrain = RemoteSender(len)
txt = Text(join)
colom = CollisionOneMany(Collider=sec.Curves, Obstacles=movetoplane.Geometry)  # -> Collision, Index
mindex = MemberIndex(Set=txt, Member="Closed Planar Curve")  # -> Index, Count
dispatch_2 = Dispatch(List=sec.Curves, DispatchPattern=colom.Collision)  # -> ListA, ListB
cull_i = CullIndex(List=join, Indices=mindex.Index, Wrap=True)
join_2 = JoinCurves(Curves=cull_i, Preserve=False)
geo_3 = Geometry(dispatch_2.ListA)
explode = Explode(Curve=cull_i, Recursive=True)  # -> Segments, flatten(Vertices)
item_7 = ListItem(List=explode.Vertices, Index=0, Wrap=True)
pln = Plane(item_7)
project = Project(Geometry=explode.Vertices, Plane=pln)  # -> Geometry, Transform
levels_at_water_height = RemoteSender(geo_3)
pline = PolyLine(Vertices=project.Geometry, Closed=False)

dam_axis_3 = RemoteReceiver(dam_axis)

point_upstream = RemoteSender(pipeline)

point_upstream_2 = RemoteReceiver(point_upstream)
crv_cp = CurveClosestPoint(Point=point_upstream_2, Curve=dam_axis_3)  # -> Point, Parameter, Distance
vec2pt_2 = Vector2Pt(PointA=point_upstream_2, PointB=crv_cp.Point, Unitize=False)  # -> Vector, Length

vdisex = VectorDisplayEx(Point=point_upstream_2, Vector=vec2pt_2.Vector, Colour=RGB(0, 0, 0), Width=2)  # disabled
# For optimization: Make perpendicular
# sections on the river line to discover
# best placement for the Dams.
panel_25 = Panel(vec2pt_2.Vector)

vector_waterflow = RemoteSender(vec2pt_2.Vector)

# ==== cluster GHPythonRemote: Connects the Grasshopper Python component to an external Python instance.
python = PythonScript()  # -> gh_parent_doc_dir
# ---------- python: Python ----------
from os import path

gh_parent_doc_dir = path.abspath(path.dirname(ghenv.Component.OnPingDocument().Owner.OnPingDocument().FilePath))
# ---------- end python ----------
# GH to python remote example.
# Pierre Cuvilliers, 2017-2018
# Released under the MIT license
# github.com/pilcru/ghpythonremote
# Runs and connects to an external python engine, and
# assigns imported modules to scriptcontext.sticky variables.
# 
# Arguments:
#       code (str): Path to the GH_to_python_sticky.py code file.
#       location (str): Path to a python executable, or to a folder
#             containing `python.exe`, or the name of a conda-created
#             virtual environment prefixed by `conda://` (`conda://env_name`).
#             If empty, finds python from your windows %PATH%.
#       run (boolean): Creates the connection, and imports new
#             modules, when turned to True. Kills the connection,
#             and deletes the references to the imports, when turned
#             to False.
#       modules (str list): List of module names to import in the
#             remote python. They will be added to the
#             scriptcontext.sticky dictionary, allowing them to be
#             reused from other python components in the same
#             Grasshopper document. Submodules (for example
#             `numpy.linalg` have to be added explicitly to this list
#             to be available later.
#       log_level (str from ['NOTSET', 'DEBUG', 'INFO', 'WARNING', 'ERROR', 'CRITICAL']):
#             Logging level to use for the local IronPython and the
#             remote python instance.
#       working_dir (str): Working directory for the remote python
#             instance.
# 
# Returns:
#       out (str): Console output with DEBUG information.
#       linked_modules (str list): list of imported module names.
#       rpy (rpyc connection object): The object representing the
#             remote Python interpreter.
location = ClusterInput()  # location (str): Path to a python executable, or to a folder containing `python.exe`, or the name of a conda-created virtual environment prefixed by `conda://` (`conda://env_name`). If empty, finds python from your windows %PATH%.
run = ClusterInput()  # run (boolean): Creates the connection, and imports new modules, when turned to True. Kills the connection,and deletes the references to the imports, when turned to False.
modules = ClusterInput()  # modules (str list): List of module names to import in the remote python. They will be added to the scriptcontext.sticky dictionary, allowing them to be reused from other python components in the same Grasshopper document. Submodules (for example `numpy.linalg` have to be added explicitly to this list to be available later.
list = ValueList({"CRITICAL", "ERROR", "WARNING", "INFO", "DEBUG", "NOTSET"}, selected="DEBUG")
panel = Panel(python)
ghpythonremote = GHPythonRemote(location=location, run=run, modules=modules, log_level=list, working_dir=panel)  # -> out, linked_modules, rpy; inputs run: Boolean, modules: list
# ---------- ghpythonremote: Python ----------
import inspect
import logging
from os import path
import sys
from time import sleep

import scriptcontext

import ghpythonremote
from ghpythonremote.connectors import GrasshopperToPythonRemote

local_log_level = getattr(logging, log_level, logging.WARNING)
logger = logging.getLogger("ghpythonremote")
logger.setLevel(local_log_level)
ch = logging.StreamHandler()
ch.setLevel(local_log_level)
formatter = logging.Formatter("%(levelname)s: %(name)s:\n%(message)s")
ch.setFormatter(formatter)
logger.handlers = []
logger.addHandler(ch)
logger = logging.getLogger("ghpythonremote.GH_to_python")

ROOT = path.abspath(path.dirname(inspect.getfile(ghpythonremote)))
rpyc_server_py = path.join(ROOT, "pythonservice.py")

# Set connection to CLOSED if this is the first run
# and initialize set of linked modules
try:
    remote_python_status
except NameError:
    remote_python_status = "CLOSED"
    lkd_modules = set()

# Wait for connection to connect or terminate
timer = 0
while remote_python_status == "CONNECTING" or remote_python_status == "CLOSING":
    sleep(1)
    timer += 1
    if timer == 10:
        try:
            gh2py_manager.__exit__(*sys.exc_info())
        except Exception:
            pass
        remote_python_status = "CLOSED"
        lkd_modules = set()
        raise RuntimeError(
            "Connection left in an inconsistent state and not returning. Reset "
            "everything."
        )

if run:
    if not remote_python_status == "OPEN":
        remote_python_status = "CONNECTING"
        gh2py_manager = GrasshopperToPythonRemote(
            rpyc_server_py,
            location=location,
            timeout=10,
            port=None,
            log_level=log_level,
            working_dir=working_dir,
        )
        gh2py = gh2py_manager.__enter__()
        remote_python_status = "OPEN"

    # Stuff that we can reach
    rpymod = gh2py.py_remote_modules  # A getter function for a named python module
    rpy = gh2py.connection  # Represents the remote instance root object
    scriptcontext.sticky["rpy"] = rpy
    # Add modules
    for mod in modules:
        try:
            scriptcontext.sticky[mod] = rpymod(mod)
            lkd_modules.add(mod)
        except ImportError:
            gh2py_manager.__exit__(*sys.exc_info())
            raise

elif not remote_python_status == "CLOSED":
    remote_python_status = "CLOSING"
    # Remove linked modules
    for mod in lkd_modules:
        del scriptcontext.sticky[mod]
    del scriptcontext.sticky["rpy"]
    gh2py_manager.__exit__(*sys.exc_info())
    lkd_modules = set()
    remote_python_status = "CLOSED"

# Change variable name because ghpython resets outputs to None before each run
linked_modules = lkd_modules

logger.info("GH to python connection is {}".format(remote_python_status))
# ---------- end ghpythonremote ----------
out = ClusterOutput(ghpythonremote.out)  # Console output.
linked_modules = ClusterOutput(ghpythonremote.linked_modules)  # Names of modules that were successfully added to the scriptcontext.sticky dictionary.
rpy = ClusterOutput(ghpythonremote.rpy)  # The object representing the remote python instance
python_2 = PythonScript(module_names=ghpythonremote.linked_modules)  # -> import_statements; inputs module_names: list
# ---------- python_2: Python ----------
import_statements = ["import scriptcontext as sc"]
for module_name in module_names:
    import_statements.append("{0} = sc.sticky['{0}']".format(module_name))

if len(module_names) == 0:
    import_statements = []
# ---------- end python_2 ----------
import_statements = ClusterOutput(python_2)  # Useful import statements to use the imported modules in your scripts.
