# Grasshopper definition JD_Beta_close origin.gh (Grasshopper 1.0.7)
# Copyright: © 2017-2018 Pierre Cuvilliers, Caitlin Mueller, Massachusetts Institute of Technology
# plug-ins: Telepathy, MetaHopper, UiPlus, Heteroptera, Pufferfish, MeshEdit Components, Hops, Heron, EleFront, RhinoCodePluginGH

# Water fields
panel = Panel("Resources\Translations\Water_en.txt")
# Arch Dam fields
panel_2 = Panel("Resources\Translations\ArchDam_en.txt")

panel_3 = Panel("""Concrete gravity dam
Arch dam
Embankment dam""")
# Dam configuration
# Dashboard structure
panel_4 = Panel("Type of Dam (m)")

# ----
# In conda cmd prompt:
# 
# conda activate C:\Users\cna\.conda\envs\rhinoremote
# 
# pip install <package> - for any missing package check the ouput to the right
# 
# For PIL -> pip install pillow
panel_5 = Panel("C:\Users\cna\Anaconda3\envs\rhinoremote")
panel_6 = Panel("""PIL
openpyxl""")
# Requirements hops scripts
panel_7 = Panel("Modules\Gravity.gh")
# Requirements plugins
# Python remote
panel_8 = Panel("""UI+
Metahopper""")

# ---- group: INFO
# _________________________________
# 
# This file is done based on the rhino file:
# _________________________________
# "C:\Users\Admin\Gruner AG\BSBE [ORG] - Digitale Anwendungen ESD\04_Projekte\2023\CH_VS_Barrage Les Toules_SensitivityAnalysis_JD\Model\231708_Le toules-WSCH00320.3dm"
# Images folder - saved where the gh file is
# Image size settings
number_slider = Slider(700, range=0..1000)
# Infos & Settings
panel_9 = Panel("231708_Le toules.3dm")
viewport_1_for_images = Panel("Perspektive")
viewport_2_for_images = Panel("Drauf")
viewport_3_for_images = Panel("Detail")
relpath = RelativePath(Path="Bilder")
multiplication = Multiplication(A=number_slider, B="7")
multiplication_2 = Multiplication(A=number_slider, B="5")
panel_10 = Panel(relpath)
viewport_name_3 = RemoteSender(viewport_3_for_images)
viewport_name_1 = RemoteSender(viewport_1_for_images)
viewport_name_2 = RemoteSender(viewport_2_for_images)
panel_11 = Panel("1446")
panel_12 = Panel(multiplication)
panel_13 = Panel("883")
panel_14 = Panel(multiplication_2)

# ----
# Language translation
list = ValueList({"English": 0, "French": 1, "German": 2}, selected="English")
panel_15 = Panel("C:\Users\Admin\Gruner AG\Jumping dams [EXP] - General\03_Model\Les Toules")
relpath_2 = RelativePath(Path=panel)
relpath_3 = RelativePath(Path="Resources\Translations\Water_fr.txt")
relpath_4 = RelativePath(Path="Resources\Translations\Water_en.txt")
relpath_5 = RelativePath(Path=panel_2)
relpath_6 = RelativePath(Path="Resources\Translations\ArchDam_fr.txt")
relpath_7 = RelativePath(Path="Resources\Translations\ArchDam_en.txt")
label = UiLabel(Label="Freeboard (m)", Style=3)
label_2 = UiLabel(Label=panel_4, Style=3)
label_3 = UiLabel(Label="Minimum water level", Style=3)
scroll_number = UiScrollNumber(Label="(m.asl)", Number=0, Wrap=False, Digits=3)
label_4 = UiLabel(Label="Normal water level (m.asl)", Style=3)
slider = UiSlider(Value=0.5, Bounds=Domain(0, 1), Increment=0.1)
srs = SetSpatialReferenceSystem(SRS="EPSG:2056")
label_5 = UiLabel(Label="Foundation depth (m)", Style=3)
button = UiButton(Label="Ok")
slider_2 = UiSlider(Value=0.5, Bounds=Domain(0, 1), Increment=0.1)
file = ReadFile(File=relpath_2, PerLineParse=True)
file_2 = ReadFile(File=relpath_3, PerLineParse=True)
file_3 = ReadFile(File=relpath_4, PerLineParse=True)
file_4 = ReadFile(File=relpath_5, PerLineParse=True)
file_5 = ReadFile(File=relpath_6, PerLineParse=True)
relpath_8 = RelativePath(Path="Modules\Dashboard_damConfiguration")
relpath_9 = RelativePath(Path="Modules\Embankment.gh")
relpath_10 = RelativePath(Path="Modules\Arch.gh")
relpath_11 = RelativePath(Path=panel_7)
file_6 = ReadFile(File=relpath_7, PerLineParse=True)
english = Panel(file)
french = Panel(file_2)
german = Panel(file_3)
pythonremote = GHPythonRemote(location=panel_5, run=Toggle(False), modules=panel_6)  # -> out, linked_modules, rpy, import_statements
english_2 = Panel(file_4)
french_2 = Panel(file_5)
german_2 = Panel(file_6)
merge = Merge(Data1=label_5, Data2=slider_2)
merge_2 = Merge(Data1=label, Data2=slider)
merge_3 = Merge(Data1=relpath_11, Data2=relpath_10, Data3=relpath_9, Data4=relpath_8)
merge_4 = Merge(Data1=label_3, Data2=scroll_number)
path_save = RemoteSender(panel_15)
panel_16 = Panel(merge_3)
filepath_hops = RemoteSender(merge_3)
panel_17 = Panel(pythonremote.out)
filter = StreamFilter(Gate=list, Stream0=english, Stream1=french, Stream2=german)  # -> flatten(Stream)
filter_2 = StreamFilter(Gate=list, Stream0=english_2, Stream1=french_2, Stream2=german_2)  # -> flatten(Stream)
fields_water = RemoteSender(filter)
fields_archdam = RemoteSender(filter_2)
slider_3 = UiSlider(Element=slider, Label="m", Value="3", Bounds="0 To 5", Increment=".1")
button_2 = UiButton(Element=button, Label="Send changes")
slider_4 = UiSlider(Element=slider_2, Label="m", Value="10", Bounds="0 To 50", Increment=".1")
heights = Panel("1747.5")
# Select dam type
heights_2 = Panel("""1836
1839
1842
1844""")
run_pre_geometry_of_water = Button()
adjust_reservoir_to_dam = Button()
# Run Dam
# Select dam type
list_2 = ValueList({"Concrete gravity dam": "0", "Arch dam": "1", "Embankment dam": "2"}, selected="Arch dam")
dam_configuration = Button()
run_arch_dam = Button()
get_values = UiValues(Element=slider_3)  # -> flatten(Values)
get_values_2 = UiValues(Element=slider_4)  # -> flatten(Values)
get_values_3 = UiValues(Element=button_2)  # -> flatten(Values)
# Dashboard - fill in data and listen to outputs
dam_type_index = Panel("""0
1
2""")
num = Number(heights_2)
minimum_normal_water_level_preset = RemoteSender(heights)
minimum_normal_water_level_preset_2 = RemoteReceiver(minimum_normal_water_level_preset)
scroll_number_2 = UiScrollNumber(Element=scroll_number, Number=minimum_normal_water_level_preset_2, Wrap=False, Digits=Slider(1, range=0..1))
get_values_4 = UiValues(Element=scroll_number_2)  # -> flatten(Values)
minimum_water_level_m_input_from_dashboa = Panel(get_values_4)  # "Minimum water level (m) - Input from Dashboard"
freeboard_m_input_from_dashboard = Panel(get_values)
run_water_final = RemoteSender(adjust_reservoir_to_dam)
run_water_pre = RemoteSender(run_pre_geometry_of_water)
offset_foundation_m_input_from_dashboard = Panel(get_values_2)
panel_18 = Panel(get_values_3)
# must be a closed volume!
run_archdam = RemoteSender(run_arch_dam)
sort = SortList(Keys=heights_2, ValuesA=num)  # -> Keys, ValuesA
panel_19 = Panel("""False
False
False""")
list_of_heights = RemoteSender(sort.ValuesA)
list_of_heights_2 = RemoteReceiver(list_of_heights)
dropdown_list = UiDropdownList(Values=list_of_heights_2)
merge_5 = Merge(Data1=label_4, Data2=dropdown_list)
list_of_heights_3 = RemoteReceiver(list_of_heights)
dropdown_list_2 = UiDropdownList(Element=dropdown_list, Values=list_of_heights_3, Index=Slider(3, range=0..10))
get_values_5 = UiValues(Element=dropdown_list_2)  # -> flatten(Values)
item = ListItem(List=list_of_heights_3, Index=get_values_5, Wrap=True)
water_level_m_input_from_dashboard = Panel(item)
replace = ReplaceItems(List=panel_19, Item="True", Indices=list_2, Wrap=False)
dam_selection = RemoteSender(replace)
dam_selection_2 = RemoteReceiver(dam_selection)
panel_20 = Panel(dam_selection_2)
radio = UiRadio(Label=panel_3, State=panel_20, Group="Group 1")
merge_6 = Merge(Data1=label_2, Data2=radio)  # -> flatten(Result)
merge_7 = Merge(Data1=merge_6, Data2=merge_5, Data3=merge_4, Data4=merge_2, Data5=merge, Data6=button)
get_values_6 = UiValues(Element=radio)  # -> flatten(Values)
dam_type = Panel(get_values_6)
dispatch = Dispatch(List=dam_type_index, DispatchPattern=dam_type)  # -> ListA, ListB
dashboard_damconfiguration = RemoteSender(dam_configuration)
dashboard_damconfiguration_2 = RemoteReceiver(dashboard_damconfiguration)
window = UiWindow(Elements=merge_7, Title="Dam Configuration", Owner=1, Scroll=True, Launch=dashboard_damconfiguration_2)
minimum_water_level = RemoteSender(minimum_water_level_m_input_from_dashboa)

dam = DataDam(
    DataA=dispatch.ListA,
    DataB=water_level_m_input_from_dashboard,
    DataC=freeboard_m_input_from_dashboard,
    DataD=offset_foundation_m_input_from_dashboard,
    BufferDelay=5000000,
    BufferMode=0)  # -> DataA, DataB, DataC, DataD
dam_2 = DataDam(DataA=dispatch.ListA, BufferDelay=2500000, BufferMode=0)
objfromgroup = GetObjectsInGroup()

dam_3 = DataDam(DataA=freeboard_m_input_from_dashboard, BufferDelay=10000000, BufferMode=0)  # disabled
dam_4 = DataDam(DataA=offset_foundation_m_input_from_dashboard, BufferDelay=10000000, BufferMode=0)  # disabled

lng = ListLength(List=objfromgroup)
dup = DuplicateData(Data=panel_18, Number=lng, Order=True)

inpupt_offset_foundation_m = Panel(dam.DataD)
addition = Addition(A=dam.DataB, B=dam.DataC)
bool = Boolean(dup)
normal_water_level = RemoteSender(dam.DataB)
dam_type_2 = RemoteSender(dam_2)
dam_type_3 = RemoteReceiver(dam_type_2)
num_2 = Number(dam_type_3)
S = Script(Language=list, Dam_index=num_2)  # -> out, a
# ---------- S: Python ----------
"""05.10.2023 - CNA"""

if l == 0:
    if i == 0:
        a = "Gravity"
    elif i == 1:
        a = "Arch" 
    elif i == 2:
        a = "Embankment"

if l == 1:
    if i == 0:
        a = "Poids"
    elif i == 1:
        a = "Voûtes" 
    elif i == 2:
        a = "Digue"
# ---------- end S ----------
panel_21 = Panel(S.a)
dam_name_translation = RemoteSender(S.a)
dam_level = RemoteSender(addition)
freeboard = RemoteSender(dam.DataC)
offset_foundation = RemoteSender(dam.DataD)
setobj = SetObjectValue(ObjectToSet=flatten(objfromgroup), ValueToSet=flatten(bool))
panel_22 = Panel(lng)
# Formulas - conservative as compared with values computed more precisely (in feet)
panel_23 = Panel(dup)
vector_back_to_lv95 = Panel("{2.5815e+6,1.083e+6,0}")
vector_send_to_local_0 = Panel("{-2.5815e+6,-1.083e+6,0}")

pipeline = GeometryPipeline(
    GroupByLayer=False,
    GroupByType=False,
    IncludeHidden=True,
    IncludeLocked=True,
    LayerFilter="Upstream_point",
    NameFilter="*",
    SublayerFiltering=True,
    TypeFilter=1)
pipeline_2 = GeometryPipeline(
    GroupByLayer=False,
    GroupByType=False,
    IncludeHidden=True,
    IncludeLocked=True,
    LayerFilter="Gravity::Axes::*",
    NameFilter="*",
    SublayerFiltering=True,
    TypeFilter=4)
pipeline_3 = GeometryPipeline(
    GroupByLayer=False,
    GroupByType=False,
    IncludeHidden=True,
    IncludeLocked=True,
    LayerFilter="Arch::Axes::*",
    NameFilter="*",
    SublayerFiltering=True,
    TypeFilter=4)
pipeline_4 = GeometryPipeline(
    GroupByLayer=False,
    GroupByType=False,
    IncludeHidden=True,
    IncludeLocked=True,
    LayerFilter="Embankment::Axes::*",
    NameFilter="*",
    SublayerFiltering=True,
    TypeFilter=4)

mesh = GeometryPipeline(
    GroupByLayer=False,
    GroupByType=False,
    IncludeHidden=True,
    IncludeLocked=True,
    LayerFilter="Terrain_brep_offset_-10",
    NameFilter="*",
    SublayerFiltering=True,
    TypeFilter=1073741848)
pipeline_5 = GeometryPipeline(
    GroupByLayer=False,
    GroupByType=False,
    IncludeHidden=True,
    IncludeLocked=True,
    LayerFilter="Terrain_levels",
    NameFilter="*",
    SublayerFiltering=True,
    TypeFilter=4)
mesh_2 = GeometryPipeline(
    GroupByLayer=False,
    GroupByType=False,
    IncludeHidden=True,
    IncludeLocked=True,
    LayerFilter="Terrain_brep",
    NameFilter="*",
    SublayerFiltering=True,
    TypeFilter=1073741848)
pipeline_6 = GeometryPipeline(
    GroupByLayer=False,
    GroupByType=False,
    IncludeHidden=True,
    IncludeLocked=True,
    LayerFilter="New designs",
    NameFilter="*",
    SublayerFiltering=True,
    TypeFilter=4)
mesh_3 = GeometryPipeline(
    GroupByLayer=False,
    GroupByType=False,
    IncludeHidden=True,
    IncludeLocked=True,
    LayerFilter="Terrain_base_curve",
    NameFilter="*",
    SublayerFiltering=True,
    TypeFilter=4)
xy = XYPlane(Origin=Point(0, 0, 0))  # disabled
dam_type_4 = RemoteReceiver(dam_type_2)
vec2pt = Vector2Pt(PointA=pipeline, PointB=xy, Unitize=False)  # -> Vector, Length; disabled
filter_3 = StreamFilter(Gate=dam_type_4, Stream0=pipeline_2, Stream1=pipeline_3, Stream2=pipeline_4)
rev = Reverse(Vector=vec2pt.Vector)  # disabled
item_2 = ListItem(List=pipeline_4, Index=Slider(1, range=0..10), Wrap=False)
item_3 = ListItem(List=pipeline_2, Index=Slider(1, range=0..1), Wrap=True)
item_4 = ListItem(List=pipeline_3, Index=Slider(5, range=0..10), Wrap=False)
merge_8 = Merge(Data1=filter_3, Data2=pipeline_6)
dam_type_5 = RemoteReceiver(dam_type_2)
details = ContentDetails(Content=merge_8)  # -> Content, Id, Path, Attributes
panel_24 = Panel(details.Path)
project = Project(Geometry=merge_8, Plane=PlaneXY(0, 0, 0))  # -> Geometry, Transform
filter_4 = StreamFilter(Gate=dam_type_5, Stream0=item_3, Stream1=item_4, Stream2=item_2)
axis_selection = Slider(3, range=0..7)

# ---- group: Automation slider
connected = GetConnectedObjects(Objects=axis_selection)
lng_2 = ListLength(List=merge_8)
x_minus_one = XMinusOne(NumberX=lng_2)
set_slider = SetSliderProperties(Slider=connected, Range=x_minus_one, Type=1)

# ----
dam_5 = DataDam(DataA=filter_4, BufferDelay=10000000, BufferMode=0)
transform = Transform({TransformCount=1, Name="Translation", tx=-2580598.7, ty=-1083020.6, tz=0})
item_5 = ListItem(List=project.Geometry, Index=axis_selection, Wrap=True)
item_6 = ListItem(List=details.Path, Index=axis_selection, Wrap=True)
details_2 = ContentDetails(Content=dam_5)  # -> Content, Id, Path, Attributes
explode = Explode(Curve=mesh_3, Recursive=True)  # -> Segments, Vertices
brep = Brep(mesh_3)  # disabled
inverse = InverseTransform(Transform=transform)
panel_25 = Panel(item_6)
conmesh = ConstructMesh(Vertices=explode.Vertices, Faces={A=0, B=1, C=2, D=3})
dam_6 = DataDam(DataAxis=item_5, DataA=item_6, BufferDelay=10000000, BufferMode=0)  # -> DataAxis, DataName
transform_origin = RemoteSender(inverse)
brep_terrain_base_foundation = RemoteSender(mesh)
mesh_terrain_flattened = RemoteSender(conmesh)
brep_terrain_base = RemoteSender(brep)  # disabled
brep_terrain = RemoteSender(mesh_2)
lines_levels = RemoteSender(pipeline_5)
dam_axis = RemoteSender(dam_6.DataAxis)
dam_axis_name = RemoteSender(dam_6.DataName)
dam_level_2 = RemoteReceiver(dam_level)
brep_terrain_base_foundation_2 = RemoteReceiver(brep_terrain_base_foundation)
dam_axis_2 = RemoteReceiver(dam_axis)

# ---- group: Selecting dam height level
# This changes when the axis line calculate and recalculate the basics again
brep_terrain_2 = RemoteReceiver(brep_terrain)

# ----
Z = UnitZ(Factor=dam_level_2)
move = Move(Geometry=dam_axis_2, Motion=Z)  # -> Geometry, Transform
# Technical Memorandum No. EM36-86-68110: 2.1.3 Lines of Centers
# 
# The lines of centers define the horizontal shape of the arches in an arch dam. The shape of the arches starts at the crown cantilever and curves horizontally downstream toward the abutments. The line of centers create the geometry of the circular arcs at each elevation of the dam for the upstream and downstream faces by defining the center point of a circle and the radius of the circle. Depending on the shape and number of lines of centers, the arches can be
# 1) uniform thickness from abutment to abutment,
# 2) variable thickness from abutment to abutment,
# 3) different on the left side of the dam compared to the right side of the dam, or
# 4) different in the center of the dam compared to the outer part of the dam.
# Technical Memorandum No. EM36-86-68110: A double curvature arch dam has curvature in the arches and in the crown cantilever.
panel_26 = Panel(" 1 meter = 3.28084 feet")
normal_water_level_2 = RemoteReceiver(normal_water_level)
Z_2 = UnitZ(Factor=normal_water_level_2)
scx = SurfaceCurve(Surface=brep_terrain_2, Curve=move.Geometry)  # -> Curves, flatten(Points), UVPoints, Normals, Parameters, Tangents

# ---- group: Finding the crest points at bottom EXCAVATION
scx_2 = SurfaceCurve(Surface=brep_terrain_base_foundation_2, Curve=move.Geometry)  # -> Curves, flatten(Points), UVPoints, Normals, Parameters, Tangents
item_7 = ListItem(List=scx_2.Points, Index=0, Wrap=True)  # -> Item, Item1

# ----
item_8 = ListItem(List=scx.Points, Index=0, Wrap=True)  # -> Item, Item1
sec = BrepPlane(Brep=brep_terrain_2, Plane=Z_2)  # -> Curves, Points
ln = Line(StartPoint=item_8.Item, EndPoint=item_8.Item1)

# ---- group: AXIS LINE
ln_2 = Line(StartPoint=item_7.Item, EndPoint=item_7.Item1)

# ----
join = JoinCurves(Curves=sec.Curves, Preserve=False)
len = Length(Curve=ln)
chord_dam = RemoteSender(ln_2)
txt = Text(join)
axis_straight_terrain = RemoteSender(len)
downstream_face_angle_ratio_1 = Slider(0.8, range=0..1)
downstream_face_angle_ratio_1_2 = Slider(0.8, range=0..1)
dam_crest_width = Slider(20, range=0..100)
dam_crest_width_2 = Slider(6, range=0..100)
mindex = MemberIndex(Set=txt, Member="Closed Planar Curve")  # -> Index, Count
cull_i = CullIndex(List=join, Indices=mindex.Index, Wrap=True)
embankment_width_crest = RemoteSender(dam_crest_width)
gravity_width_crest = RemoteSender(dam_crest_width_2)
embankment_ds_ration = RemoteSender(downstream_face_angle_ratio_1)
gravity_ds_ration = RemoteSender(downstream_face_angle_ratio_1_2)
geo = Geometry(cull_i)
explode_2 = Explode(Curve=cull_i, Recursive=True)  # -> Segments, flatten(Vertices); disabled
item_9 = ListItem(List=explode_2.Vertices, Index=0, Wrap=True)  # disabled
pln = Plane(item_9)  # disabled
project_2 = Project(Geometry=explode_2.Vertices, Plane=pln)  # -> Geometry, Transform; disabled
# surface
brep_terrain_base_foundation_3 = RemoteReceiver(brep_terrain_base_foundation)
levels_at_water_height = RemoteSender(geo)
# surface
brep_terrain_base_foundation_4 = RemoteReceiver(brep_terrain_base_foundation)
# number
embankment_ds_ration_2 = RemoteReceiver(embankment_ds_ration)
# number
embankment_width_crest_2 = RemoteReceiver(embankment_width_crest)
# line
chord_dam_2 = RemoteReceiver(chord_dam)
# number
gravity_ds_ration_2 = RemoteReceiver(gravity_ds_ration)
# number
gravity_width_crest_2 = RemoteReceiver(gravity_width_crest)
# line
chord_dam_3 = RemoteReceiver(chord_dam)
pline = PolyLine(Vertices=project_2.Geometry, Closed=False)  # disabled
# Technical Memorandum No. EM36-86-68110: 2.1.3.2 Uniform- or Variable Thickness Arch Dams
# 
# The number of lines that define the line-of-centers determines whether the arches are uniform thickness or variable thickness arches.
# The arches have uniform thickness if there is one line defining the extrados and intrados line-of-centers. This means that the radius center for the upstream and downstream faces is the same. The radii lengths are different at each elevation, but since the radius center is the same, the thickness of the arch is uniform.
# The arches vary in thickness if there are two lines defining the extrados and intrados line-of-centers. This means that the radius centers for the upstream and downstream faces are in different positions in space forcing the circular arcs of the arches to diverge.
panel_27 = Panel("""All in meters

Dam height: {3}
Radius = 0.6xL1 + Adjustment = {0} + {8} : {9}
L1: {1}
tc: {2}
USP base: {4}
DSP base: {5}
USP @ 0.45H: {6}
Volume if calculated with the equations: {7}
Free board: {10}
Offset foundation: {11}""")
panel_28 = Panel("""Radius: {9}
L1: {1}
tc: {2}
USP base: {4}
DSP base: {5}
USP at 45%H: {6}
Volume if calculated with the equations: {7}
Free board: {10}
Offset foundation: {11}""")
list_3 = ValueList({"Concrete gravity dam": 0, "Arch dam": 1, "Embankment dam": 2}, selected="Concrete gravity dam")  # disabled
offset_foundation_2 = RemoteReceiver(offset_foundation)
filepath_hops_2 = RemoteReceiver(filepath_hops)  # disabled
freeboard_2 = RemoteReceiver(freeboard)
offset_foundation_3 = RemoteReceiver(offset_foundation)
freeboard_3 = RemoteReceiver(freeboard)
item_10 = ListItem(List=filepath_hops_2, Index=list_3, Wrap=True)  # disabled
brep_terrain_base_foundation_5 = RemoteReceiver(brep_terrain_base_foundation)  # disabled
brep_terrain_base_foundation_6 = RemoteReceiver(brep_terrain_base_foundation)
panel_29 = Panel(item_10)  # disabled
levels_at_water_height_2 = RemoteReceiver(levels_at_water_height)
gravity_ds_ration_3 = RemoteReceiver(gravity_ds_ration)  # disabled
chord_dam_4 = RemoteReceiver(chord_dam)  # disabled
width_crest = RemoteReceiver()  # disabled
# ARCH DAM
chord_dam_5 = RemoteReceiver(chord_dam)
chord_dam_6 = RemoteReceiver(chord_dam)
path = FilePath(panel_29)  # disabled

raxis_adjustments = Slider(20, range=-30..30)

hops = Hops(
    _Path=path,
    CacheResultsInMemory=True,
    CacheSolveResults=True,
    RemoteDefinitionLocation="C:\Users\Admin\Documents\Github\EarlyStageDesign\JD\Skripts\Modules\Gravity.gh",
    RemoteSolveVersion=(0, 1, 0),
    ShowInput_Enabled=False,
    ShowInput_Path=True,
    SynchronousSolve=True)  # disabled
list_4 = ValueList({"Concrete gravity dam": 0, "Arch dam": 1, "Embankment dam": 2}, selected="Arch dam")
dam_type_6 = RemoteReceiver(dam_type_2)
equals = Equality(FirstNumber=dam_type_6, SecondNumber=list_4)  # -> Equality, Inequality
normal_water_level_3 = RemoteReceiver(normal_water_level)

# ---- group: Split what is undergound and above ground - Runs once that the file opens
# Split what is undergound and above ground - Runs once that the file opens
brep_terrain_3 = RemoteReceiver(brep_terrain)
bbox = BoundingBox(Content=brep_terrain_3, Plane=PlaneXY(0, 0, 0))  # -> Box, Box_2
jagged = SettingsSpeed()
mesh_4 = MeshBrep(Brep=bbox.Box, Settings=jagged)
mesh_5 = MeshBrep(Brep=brep_terrain_3, Settings=jagged)
msplit = MeshSplit(Mesh=mesh_4, Splitters=mesh_5)
item_11 = ListItem(List=msplit, Index=0, Wrap=True)  # -> Item, Item1
bottom_part = Geometry(item_11.Item)
uper_part = Geometry(item_11.Item1)
mjoin = MeshJoin(Meshes=flatten([uper_part, mesh_5]))
weldvertices = MeshWeldVertices(Mesh=mjoin, Tolerance=0.01)  # -> RuntimeMessage, Mesh
clsmsh = CloseMesh(Mesh=weldvertices.Mesh, Quadrangulate=False)  # -> Closed, Amount, Openings, R

# ----
mesh_terrain_flattened_2 = RemoteReceiver(mesh_terrain_flattened)
minimum_water_level_2 = RemoteReceiver(minimum_water_level)
dam_axis_3 = RemoteReceiver(dam_axis)
# Runs the volume of the water for the normal water level height, splits the dead storage and split the water in 10 m levels
# 
# It takes a couple of minutes to run (tested 05.10.23 - 1.1 m)
run_water_pre_2 = RemoteReceiver(run_water_pre)

dam_7 = DataDam(
    DataAxisDam=dam_axis_3,
    DataMeshTerrainFlattened=mesh_terrain_flattened_2,
    DataNormalWaterLevel=normal_water_level_3,
    DataMinimumStorageLevel=minimum_water_level_2,
    BufferDelay=10000000,
    BufferMode=0)  # -> DataAxisDam, DataMeshTerrainFlattened, DataNormalWaterLevel, DataMinimumStorageLevel
objfromgroup_2 = GetObjectsInGroup()

setobj_2 = SetObjectValue(ObjectToSet=objfromgroup_2, ValueToSet=run_water_pre_2)
Z_3 = UnitZ(Factor=dam_7.DataNormalWaterLevel)
Z_4 = UnitZ(Factor=dam_7.DataMinimumStorageLevel)
mesh_6 = Mesh(dam_7.DataMeshTerrainFlattened)
pln_2 = Plane(Z_3)
pln_3 = Plane(Z_4)
panel_30 = Panel(Z_4)
movetoplane = MoveToPlane(Geometry=mesh_6, Plane=pln_2, Above=True, Below=True)  # -> Geometry, Transform
movetoplane_2 = MoveToPlane(Geometry=mesh_6, Plane=pln_3, Above=True, Below=True)  # -> Geometry, Transform
project_3 = Project(Curve=dam_7.DataAxisDam, Brep=bbox.Box, Direction=Vector(0, 0, 1))
mesh_7 = Mesh(project_3)
list_5 = ValueList({"Concrete gravity dam": 0, "Arch dam": 1, "Embankment dam": 2}, selected="Embankment dam")
list_6 = ValueList({"Concrete gravity dam": 0, "Arch dam": 1, "Embankment dam": 2}, selected="Concrete gravity dam")
dam_type_7 = RemoteReceiver(dam_type_2)
dam_type_8 = RemoteReceiver(dam_type_2)
equals_2 = Equality(FirstNumber=dam_type_7, SecondNumber=list_5)  # -> Equality, Inequality
equals_3 = Equality(FirstNumber=dam_type_8, SecondNumber=list_6)  # -> Equality, Inequality

# ---- group: Divide on axis
msplit_2 = MeshSplit(Mesh=clsmsh.Closed, Splitters=mesh_7)
item_12 = ListItem(List=msplit_2, Index=0, Wrap=True)
clsmsh_2 = CloseMesh(Mesh=item_12, Quadrangulate=False)  # -> Closed, Amount, Openings, R

# ---- group: Divide dead storage capacity from the rest
msplit_3 = MeshSplit(Mesh=clsmsh_2.Closed, Splitters=movetoplane_2.Geometry)
clean = CleanTree(RemoveNulls=True, RemoveInvalid=True, RemoveEmpty=False, Tree=msplit_3)
cull_i_2 = CullIndex(List=clean, Indices="0", Wrap=True)
item_13 = ListItem(List=clean, Index=0, Wrap=True)
clsmsh_3 = CloseMesh(Mesh=cull_i_2, Quadrangulate=False)  # -> Closed, Amount, Openings, R
clsmsh_4 = CloseMesh(Mesh=item_13, Quadrangulate=False)  # -> Closed, Amount, Openings, R

# ----
dead_storage = Mesh(flatten(clsmsh_3.Closed))
rest = Mesh(clsmsh_4.Closed)

# ---- group: Splitting the rest to the normal water level
msplit_4 = MeshSplit(Mesh=rest, Splitters=movetoplane.Geometry)
clean_2 = CleanTree(RemoveNulls=True, RemoveInvalid=True, RemoveEmpty=False, Tree=msplit_4)
cull_i_3 = CullIndex(List=clean_2, Indices="0", Wrap=True)
item_14 = ListItem(List=cull_i_3, Index=0, Wrap=True)  # -> Item, Item1
geo_2 = Geometry(item_14.Item)

# ---- group: Dividing the levels
bbox_2 = BoundingBox(Content=geo_2, Plane=PlaneXY(0, 0, 0), UnionBox=True)  # -> Box, Box_2
contour = Contour(Shape=bbox_2.Box, Point=Point(0, 0, 0), Direction=Vector(0, 0, 1), Distance=Slider(10, range=0..100))  # -> flatten(Contours)
mesh_8 = Mesh(contour)
msplit_5 = MeshSplit(Mesh=geo_2, Splitters=mesh_8)

# ---- group: Sorting levels in the same branch
Z_5 = UnitZ(Factor=Slider(0.1, range=0..0.1))
move_2 = Move(Geometry=mesh_8, Motion=Z_5)  # -> Geometry, Transform
clean_3 = CleanTree(RemoveNulls=True, RemoveInvalid=True, RemoveEmpty=False, Tree=flatten(msplit_5))
graft = GraftTree(Tree=move_2.Geometry, IncludeEmptyLists=True, IncludeNullItems=True)
clash = Clash(FirstSet=clean_3, SecondSet=graft, Distance=0, L=100)  # -> ClashCount, ClashPoints, ClashRadii, FirstIndex, SecondIndex
item_15 = ListItem(List=clean_3, Index=clash.FirstIndex, Wrap=True)
clean_4 = CleanTree(RemoveNulls=True, RemoveInvalid=True, RemoveEmpty=True, Tree=item_15)
mjoin_2 = MeshJoin(Meshes=clean_4)
disjoint = DisjointMesh(Mesh=mjoin_2)
clsmsh_5 = CloseMesh(Mesh=disjoint, Quadrangulate=True)  # -> Closed, Amount, Openings, R

# ---- group: Filtering too small meshes - assumption that the not so detailed mesh will produce some weird shapes
path_mapper = PathMapper(clsmsh_5.Closed, source="{A;B;C;D}", target="{path_index}")
volume = MeshVolume(Mesh=path_mapper)  # -> Volume, Centroid
larger = LargerThan(FirstNumber=volume.Volume, SecondNumber=Slider(150, range=0..150))  # -> LargerThan, OrEqualTo
dispatch_2 = Dispatch(List=volume.Volume, DispatchPattern=larger.LargerThan)  # -> simplify(ListA), ListB
dispatch_3 = Dispatch(List=path_mapper, DispatchPattern=larger.LargerThan)  # -> ListA, ListB
mjoin_3 = MeshJoin(Meshes=dispatch_3.ListA)  # -> simplify(Mesh)

# ----
mesh_9 = Mesh(dead_storage)
bool_2 = Boolean(False)
bool_3 = Boolean(True)
merge_9 = Merge(Data1=flatten(mjoin_3), Data2=flatten(mesh_9))  # -> simplify(graft(Result))
dup_2 = DuplicateDataMatch(SourceDataTree=mesh_9, SecondaryData1=bool_3)  # -> SourceData, SecondaryData1
dup_3 = DuplicateDataMatch(SourceDataTree=mjoin_3, SecondaryData1=bool_2)  # -> SourceData, SecondaryData1
merge_10 = Merge(Data1=flatten(dup_3.SecondaryData1), Data2=flatten(dup_2.SecondaryData1))  # -> simplify(graft(Result))
dam_type_9 = RemoteReceiver(dam_type_2)
dam_type_10 = RemoteReceiver(dam_type_2)
null = NullPlaceholder()
# Adapt water volume to dam shape
# Adjusts the water sections to the dam section - it is already cutted at the straight axis, but it has to adapt for the arch dam
run_water_final_2 = RemoteReceiver(run_water_final)
dam_type_11 = RemoteReceiver(dam_type_2)
dam_type_12 = RemoteReceiver(dam_type_2)
dam_type_13 = RemoteReceiver(dam_type_2)
ma = MassAddition(Input=flatten(dispatch_2.ListA))  # -> Result, PartialResults; disabled
panel_31 = Panel(ma.Result)  # disabled
dam_type_14 = RemoteReceiver(dam_type_2)
dam_type_15 = RemoteReceiver(dam_type_2)
path_save_2 = RemoteReceiver(path_save)
time = Time("now")
ddate = DeconstructDate(Date=time)  # -> Year, Month, Day, Hour, Minute, Second
panel_32 = Panel(path_save_2)
concat = Concatenate(FragmentD="ArcGIS", FragmentA=ddate.Year, FragmentB=ddate.Month, FragmentC=ddate.Day, JoinSeparator="_")
concat_2 = Concatenate(FragmentA=panel_32, FragmentB=concat, JoinSeparator="\")
transform_origin_2 = RemoteReceiver(transform_origin)
panel_33 = Panel(concat_2)
normal_water_level_4 = RemoteReceiver(normal_water_level)
dam_name_translation_2 = RemoteReceiver(dam_name_translation)
dam_axis_name_2 = RemoteReceiver(dam_axis_name)
concat_3 = Concatenate(
    FragmentA="Water",
    FragmentB=normal_water_level_4,
    FragmentC=dam_name_translation_2,
    FragmentD=dam_axis_name_2,
    JoinSeparator="_")
panel_34 = Panel(concat_3)
jagged_2 = SettingsSpeed()
brep_terrain_4 = RemoteReceiver(brep_terrain)
fields_archdam_2 = RemoteReceiver(fields_archdam)
material = CreateMaterial(
    Diffuse=ColourSwatch(SwatchColor=RGB(76, 143, 98)),
    Specular=ColourSwatch(SwatchColor=RGB(194, 91, 91)),
    Emission=RGB(0, 0, 0),
    Transparency=Slider(0.33, range=0..1),
    Shine=0)
as_text = AnnotationTextSettings(TextHeight=Slider(6, range=0..100))  # -> TextSettings, Font, TextHeight, TextGap, MaskFrame, MaskColour, MaskMargins, HorizontalAlignment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
font_size = RemoteSender(Slider(12, range=0..100))
preview = CustomPreview(Geometry=brep_terrain_4, Material=material)
leader_text_settings = RemoteSender(as_text.TextSettings)
panel_35 = Panel(fields_archdam_2)
# Export
path_save_3 = RemoteReceiver(path_save)
time_2 = Time("now")
ddate_2 = DeconstructDate(Date=time_2)  # -> Year, Month, Day, Hour, Minute, Second
dam_name_translation_3 = RemoteReceiver(dam_name_translation)
normal_water_level_5 = RemoteReceiver(normal_water_level)
panel_36 = Panel(path_save_3)
as_leaders = AnnotationLeaderSettings()  # -> LeaderSettings, LeaderCurveType, HasLanding, LandingLength, LeaderTextOrientation, HorizontalTextAlignment, VerticalTextAlignment
dam_axis_name_3 = RemoteReceiver(dam_axis_name)
dam_level_3 = RemoteReceiver(dam_level)
concat_4 = Concatenate(FragmentD="ArcGIS", FragmentA=ddate_2.Year, FragmentB=ddate_2.Month, FragmentC=ddate_2.Day, JoinSeparator="_")
chord_dam_7 = RemoteReceiver(chord_dam)
normal_water_level_6 = RemoteReceiver(normal_water_level)
dam_name_translation_4 = RemoteReceiver(dam_name_translation)
dam_axis_name_4 = RemoteReceiver(dam_axis_name)
concat_5 = Concatenate(FragmentA=panel_36, FragmentB=concat_4, JoinSeparator="\")
transform_origin_3 = RemoteReceiver(transform_origin)
item_16 = ListItem(List=fields_archdam_2, Index=Slider(1, range=0..1), Wrap=True)
concat_6 = Concatenate(
    FragmentA="Axis",
    FragmentB=normal_water_level_6,
    FragmentC=dam_name_translation_4,
    FragmentD=dam_axis_name_4,
    JoinSeparator="_")
panel_37 = Panel(concat_5)
dam_axis_name_5 = RemoteReceiver(dam_axis_name)
normal_water_level_7 = RemoteReceiver(normal_water_level)
dam_name_translation_5 = RemoteReceiver(dam_name_translation)
transform_2 = Transform(Geometry=chord_dam_7, Transform=transform_origin_3)
transform_origin_4 = RemoteReceiver(transform_origin)
dam_axis_name_6 = RemoteReceiver(dam_axis_name)
crv = Curve(transform_2)
show_text = BooleanToggle(True)
concat_7 = Concatenate(
    FragmentA="ArchDam",
    FragmentB=normal_water_level_7,
    FragmentC=dam_name_translation_5,
    FragmentD=dam_axis_name_5,
    JoinSeparator="_")
panel_38 = Panel(concat_6)
output = DataOutput(
    D=concat_6,
    E=panel_37,
    A=crv,
    C=item_16,
    B=dam_axis_name_6,
    Destination="C:\Users\Admin\Documents\Github\EarlyStageDesign\JD\Skripts\ghData\DamAxis.ghdata",
    RelativePath="C:\Users\Admin\Documents\Github\EarlyStageDesign\JD\Skripts\ghData\DamAxis.ghdata|ghData\DamAxis.ghdata")
panel_39 = Panel(concat_7)
swatch = ColourSwatch(SwatchColor=RGB(72, 212, 212))
material_2 = CreateMaterial(Diffuse=swatch, Specular=swatch, Emission=swatch, Transparency=Slider(0.8, range=0..1), Shine=0)
normal_water_level_8 = RemoteReceiver(normal_water_level)
panel_40 = Panel("""Water level:
{0}
Dam crest level: 
{1}
Level foundation:
{2}
Arch dam height:
{3}
Straight axis lenght - to terrain:
{4}
Straight axis lenght - to bottom foundation:
{5}
Arch dam axis length - to bottom foundation:
{6}
Volume arch dam:
{7}""")
show_line_of_centers = BooleanToggle(True)
concat_8 = Concatenate(FragmentA="BG + 20m for radius", FragmentB=normal_water_level_8, JoinSeparator="-")
pdecon = Deconstruct()  # -> XComponent, YComponent, ZComponent
path_save_4 = RemoteReceiver(path_save)
geo_3 = Geometry()
axis_straight_terrain_2 = RemoteReceiver(axis_straight_terrain)
panel_41 = Panel("""Top
Perspective
Front
Right""")
show_useful_capacity = BooleanToggle(False)
normal_water_level_9 = RemoteReceiver(normal_water_level)
dam_level_4 = RemoteReceiver(dam_level)
len_2 = Length(Curve=geo_3)
normal_water_level_10 = RemoteReceiver(normal_water_level)
dam_level_5 = RemoteReceiver(dam_level)
captureview = LBCaptureView(
    file_name=concat_8,
    folder=path_save_4,
    viewport=panel_41,
    width="3840",
    height="2160",
    mode="Wireframe",
    capture=Button())  # -> file; plug-in component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
panel_42 = Panel("""Water level
Dam crest level 
Level foundation
Dam height
Straight axis lenght - to terrain
Straight axis lenght - to bottom foundation
Arch dam axis length - to bottom foundation
Volume arch dam""")
transform_origin_5 = RemoteReceiver(transform_origin)
panel_43 = Panel("""Field's names
Values""")
transform_origin_6 = RemoteReceiver(transform_origin)
path_save_5 = RemoteReceiver(path_save)
concat_9 = Concatenate(FragmentA=concat_8, FragmentB="_water")
panel_44 = Panel(path_save_5)
toggle = BooleanToggle(False)
num_3 = Number()
concat_10 = Concatenate(FragmentA=panel_44, FragmentB="ArcGIS_TEST", JoinSeparator="\")
panel_45 = Panel("https://epsg.io/2056")
srs_2 = SetSpatialReferenceSystem(SRS="EPSG:2056")
panel_46 = Panel(concat_9)

dam_axis_4 = RemoteReceiver(dam_axis)

point_upstream = RemoteSender(pipeline)

point_upstream_2 = RemoteReceiver(point_upstream)
crv_cp = CurveClosestPoint(Point=point_upstream_2, Curve=dam_axis_4)  # -> Point, Parameter, Distance
vec2pt_2 = Vector2Pt(PointA=point_upstream_2, PointB=crv_cp.Point, Unitize=False)  # -> Vector, Length

vdisex = VectorDisplayEx(Point=point_upstream_2, Vector=vec2pt_2.Vector, Colour=RGB(0, 0, 0), Width=2)  # disabled
# For optimization: Make perpendicular
# sections on the river line to discover
# best placement for the Dams.
panel_47 = Panel(vec2pt_2.Vector)

vector_waterflow = RemoteSender(vec2pt_2.Vector)

# ----
# vector
vector_waterflow_2 = RemoteReceiver(vector_waterflow)
# vector
vector_waterflow_3 = RemoteReceiver(vector_waterflow)

# ----
# EMBANKMENT DAM
# Top
# Concrete dam settings
# Final volume
midpt = CurveMiddle(Curve=chord_dam_2)  # disabled
project_4 = Project(Curve=chord_dam_2, Brep=brep_terrain_base_foundation_3, Direction=Vector(0, 0, 1))  # disabled
end = EndPoints(Curve=chord_dam_2)  # -> Start, End; disabled
x_tremez = Extremes(Curve=project_4, Plane=PlaneXY(0, 0, 0))  # -> Highest, Lowest; disabled
pdecon_2 = Deconstruct(Point=x_tremez.Lowest)  # -> XComponent, YComponent, ZComponent; disabled
pdecon_3 = Deconstruct(Point=midpt)  # -> XComponent, YComponent, ZComponent; disabled
subtraction = Subtraction(A=pdecon_3.ZComponent, B=pdecon_2.ZComponent)  # disabled
multiplication_3 = Multiplication(A=subtraction, B=1.5)  # disabled
panel_48 = Panel("{0,0,-1}")  # disabled
atan = ArcTangent(Value=embankment_ds_ration_2)  # disabled
line = LineSDL(Start=end.Start, Direction=panel_48, Length=multiplication_3)  # disabled
rotax = RotateAxis(Geometry=line, Angle=atan, Axis=chord_dam_2)  # -> Geometry, Transform; disabled
neg = Negative(Value=atan)  # disabled
rotax_2 = RotateAxis(Geometry=line, Angle=neg, Axis=chord_dam_2)  # -> Geometry, Transform; disabled
swp1 = Sweep1(Rail=chord_dam_2, Sections=rotax_2.Geometry, Miter=1)  # -> flatten(Brep); disabled
swp1_2 = Sweep1(Rail=chord_dam_2, Sections=rotax.Geometry, Miter=1)  # -> flatten(Brep); disabled
swp1_3 = Sweep1(Rail=chord_dam_2, Sections=line, Miter=1)  # -> flatten(Brep); disabled
embankment_face_collision = RemoteSender(swp1)  # disabled
entwine = Entwine(Branch00=swp1, Branch01=swp1_3, Branch02=swp1_2, FlattenInputs=True)  # -> simplify(Result); disabled
bbx = BrepBrep(BrepA=entwine, BrepB=brep_terrain_base_foundation_3)  # -> Curves, Points; disabled
geo_4 = Geometry(bbx.Curves)  # disabled
explode_3 = Explode(Curve=geo_4, Recursive=False)  # -> Segments, Vertices; disabled
pline_2 = PolyLine(Vertices=explode_3.Vertices, Closed=False)  # disabled
lng_3 = ListLength(List=explode_3.Vertices)  # disabled
number_slider_2 = Slider(0.1, range=0..1)  # disabled
panel_49 = Panel("2")  # disabled
division = Division(A=embankment_width_crest_2, B=panel_49)  # disabled
smoothpline = SmoothPolyline(Polyline=pline_2, Strength=number_slider_2, Times=lng_3)  # disabled
amp = Amplitude(Vector=vector_waterflow_2, Amplitude=division)  # disabled
srfsplit = SurfaceSplit(Surface=entwine, Curves=smoothpline)  # disabled
neg_2 = Negative(Value=amp)  # disabled
center = Center(Geometric=srfsplit, referenceAll=2)  # -> Center, Dimension; disabled
merge_11 = Merge(Data1=neg_2, Data2=amp)  # -> flatten(Result); disabled
pt = Point(midpt)  # disabled
sort_2 = SortList(Keys=center.Dimension, ValuesA=srfsplit)  # -> Keys, ValuesA; disabled
move_3 = Move(Geometry=pt, Motion=merge_11)  # -> Geometry, Transform; disabled
item_17 = ListItem(List=sort_2.ValuesA, Index=0, Wrap=True)  # -> simplify(Item); disabled
loft = Loft(
    Curves=flatten(smoothpline),
    Options={Adjust=True, Closed=False, LoftEnds=0, LoftSimp=2, LoftType=5, Rebuild=10, Refit=0.01})  # disabled
simplify = SimplifyTree(Tree=smoothpline, Front=False)  # disabled
bang = ExplodeTree(Data=item_17)  # -> Branch0, Branch1, Branch2; disabled
geo_5 = Geometry([bang.Branch0, bang.Branch2])  # disabled
unflatten = UnflattenTree(Tree=move_3.Geometry, Guide=geo_5)  # disabled
tstat = TreeStatistics(Tree=geo_5)  # -> Paths, Length, Count; disabled
dup_4 = DuplicateDataMatch(SourceDataTree=pt, SecondaryData1=unflatten)  # -> SourceData, SecondaryData1; disabled
panel_50 = Panel("0,0,-1")  # disabled
branch = TreeBranch(Tree=simplify, Path=tstat.Paths, MaintainPaths=True)  # disabled
join_2 = BrepJoin(Breps=flatten([geo_5, loft]))  # -> Breps, Closed; disabled
project_5 = ProjectPoint(Point=unflatten, Direction=panel_50, Geometry=geo_5)  # -> Point, Index; disabled
pline_3 = PolyLine(Vertices=[unflatten, project_5.Point, dup_4.SourceData], Closed=True)  # disabled
number_slider_3 = Slider(100, range=0..100)  # disabled
dup_5 = DuplicateDataMatch(SourceDataTree=chord_dam_2, SecondaryData1=pline_3, Clean_Tree=True)  # -> SourceData, SecondaryData1; disabled
move2pt = MoveToPoint(Geometry=pline_3, PointA=pt, PointB=end.Start)  # -> Moved, Vector, Transform; disabled
Z_6 = UnitZ(Factor=number_slider_3)  # disabled
swp1_4 = Sweep1(Rail=dup_5.SourceData, Sections=move2pt.Moved, Miter=1)  # disabled
extr = Extrude(Base=branch, Direction=Z_6)  # disabled
split = SplitBrep(Brep=swp1_4, Cutter=extr)  # disabled
center_2 = Center(Geometric=split, referenceAll=2)  # -> Center, Dimension; disabled
sort_3 = SortList(Keys=center_2.Dimension, ValuesA=split)  # -> Keys, reverse(ValuesA); disabled
item_18 = ListItem(List=sort_3.ValuesA, Index=0, Wrap=True)  # disabled
capex = CapHolesEx(Brep=item_18)  # -> Brep, Caps, Solid; disabled
sunion = SolidUnion(Breps=flatten([capex.Brep, join_2.Breps]))  # disabled
jagged_3 = SettingsSpeed()  # disabled
mesh_10 = MeshBrep(Brep=sunion, Settings=jagged_3)  # disabled
objfromgroup_3 = GetObjectsInGroup()

# ----
# GRAVITY DAM
# Top
# Concrete dam settings
# Final volume
midpt_2 = CurveMiddle(Curve=chord_dam_3)  # disabled
project_6 = Project(Curve=chord_dam_3, Brep=brep_terrain_base_foundation_4, Direction=Vector(0, 0, 1))  # disabled
end_2 = EndPoints(Curve=chord_dam_3)  # -> Start, End; disabled
x_tremez_2 = Extremes(Curve=project_6, Plane=PlaneXY(0, 0, 0))  # -> Highest, Lowest; disabled
pdecon_4 = Deconstruct(Point=x_tremez_2.Lowest)  # -> XComponent, YComponent, ZComponent; disabled
pdecon_5 = Deconstruct(Point=midpt_2)  # -> XComponent, YComponent, ZComponent; disabled
subtraction_2 = Subtraction(A=pdecon_5.ZComponent, B=pdecon_4.ZComponent)  # disabled
multiplication_4 = Multiplication(A=subtraction_2, B=1.5)  # disabled
panel_51 = Panel("{0,0,-1}")  # disabled
line_2 = LineSDL(Start=end_2.Start, Direction=panel_51, Length=multiplication_4)  # disabled
atan_2 = ArcTangent(Value=gravity_ds_ration_2)  # disabled
rotax_3 = RotateAxis(Geometry=line_2, Angle=atan_2, Axis=chord_dam_3)  # -> Geometry, Transform; disabled
swp1_5 = Sweep1(Rail=chord_dam_3, Sections=line_2, Miter=1)  # -> flatten(Brep); disabled
swp1_6 = Sweep1(Rail=chord_dam_3, Sections=rotax_3.Geometry, Miter=1)  # -> flatten(Brep); disabled
entwine_2 = Entwine(Branch00=swp1_5, Branch01=swp1_6, FlattenInputs=True)  # -> simplify(Result); disabled
bbx_2 = BrepBrep(BrepA=entwine_2, BrepB=brep_terrain_base_foundation_4)  # -> Curves, Points; disabled
geo_6 = Geometry(bbx_2.Curves)  # disabled
explode_4 = Explode(Curve=geo_6, Recursive=False)  # -> Segments, Vertices; disabled
pline_4 = PolyLine(Vertices=explode_4.Vertices, Closed=False)  # disabled
lng_4 = ListLength(List=explode_4.Vertices)  # disabled
number_slider_4 = Slider(0.2, range=0..1)  # disabled
smoothpline_2 = SmoothPolyline(Polyline=pline_4, Strength=number_slider_4, Times=lng_4)  # disabled
srfsplit_2 = SurfaceSplit(Surface=entwine_2, Curves=smoothpline_2)  # disabled
center_3 = Center(Geometric=srfsplit_2, referenceAll=2)  # -> Center, Dimension; disabled
sort_4 = SortList(Keys=center_3.Dimension, ValuesA=srfsplit_2)  # -> Keys, ValuesA; disabled
amp_2 = Amplitude(Vector=vector_waterflow_3, Amplitude=gravity_width_crest_2)  # disabled
pt_2 = Point(midpt_2)  # disabled
item_19 = ListItem(List=sort_4.ValuesA, Index=0, Wrap=True)  # -> simplify(Item); disabled
loft_2 = Loft(
    Curves=flatten(smoothpline_2),
    Options={Adjust=True, Closed=False, LoftEnds=0, LoftSimp=0, LoftType=5, Rebuild=10, Refit=0.01})  # disabled
simplify_2 = SimplifyTree(Tree=smoothpline_2, Front=False)  # disabled
move_4 = Move(Geometry=pt_2, Motion=amp_2)  # -> Geometry, Transform; disabled
panel_52 = Panel("{1}")  # disabled
join_3 = BrepJoin(Breps=flatten([loft_2, item_19]))  # -> Breps, Closed; disabled
branch_2 = TreeBranch(Tree=simplify_2, Path=panel_52, MaintainPaths=True)  # disabled
branch_3 = TreeBranch(Tree=item_19, Path=panel_52, MaintainPaths=True)  # disabled
panel_53 = Panel("0,0,-1")  # disabled
project_7 = ProjectPoint(Point=move_4.Geometry, Direction=panel_53, Geometry=flatten(branch_3))  # -> Point, Index; disabled
number_slider_5 = Slider(100, range=0..100)  # disabled
pline_5 = PolyLine(Vertices=flatten([pt_2, move_4.Geometry, project_7.Point]), Closed=True)  # disabled
move2pt_2 = MoveToPoint(Geometry=pline_5, PointA=pt_2, PointB=end_2.Start)  # -> Moved, Vector, Transform; disabled
Z_7 = UnitZ(Factor=number_slider_5)  # disabled
swp1_7 = Sweep1(Rail=chord_dam_3, Sections=move2pt_2.Moved, Miter=1)  # disabled
extr_2 = Extrude(Base=branch_2, Direction=Z_7)  # disabled
split_2 = SplitBrep(Brep=extr_2, Cutter=swp1_7)  # disabled
split_3 = SplitBrep(Brep=swp1_7, Cutter=extr_2)  # disabled
center_4 = Center(Geometric=split_2, referenceAll=2)  # -> Center, Dimension; disabled
center_5 = Center(Geometric=split_3, referenceAll=2)  # -> Center, Dimension; disabled
sort_5 = SortList(Keys=center_4.Dimension, ValuesA=split_2)  # -> Keys, reverse(ValuesA); disabled
sort_6 = SortList(Keys=center_5.Dimension, ValuesA=split_3)  # -> Keys, reverse(ValuesA); disabled
cull_i_4 = CullIndex(List=sort_5.ValuesA, Indices=0, Wrap=True)  # disabled
item_20 = ListItem(List=sort_6.ValuesA, Index=0, Wrap=True)  # disabled
join_4 = BrepJoin(Breps=flatten([cull_i_4, item_20]))  # -> Breps, Closed; disabled
sunion_2 = SolidUnion(Breps=[join_3.Breps, join_4.Breps])  # disabled
jagged_4 = SettingsSpeed()  # disabled
mesh_11 = MeshBrep(Brep=sunion_2, Settings=jagged_4)  # disabled
objfromgroup_4 = GetObjectsInGroup()

vector_waterflow_4 = RemoteReceiver(vector_waterflow)  # disabled
point_upstream_3 = RemoteReceiver(point_upstream)
hops_2 = Hops(
    BrepTerrain=brep_terrain_base_foundation_5,
    ChordDam=chord_dam_4,
    DSRatio=gravity_ds_ration_3,
    VectorWaterflow=vector_waterflow_4,
    WidthCrest=width_crest,
    CacheResultsInMemory=False,
    CacheSolveResults=False,
    RemoteDefinitionLocation="C:\Users\Admin\Documents\Github\EarlyStageDesign\JD\Skripts\Modules\Gravity.gh",
    RemoteSolveVersion=(0, 1, 0),
    ShowInput_Enabled=False,
    ShowInput_Path=True,
    SynchronousSolve=True)  # -> Geo, Volume; disabled

# ----
# Steps from the Technical Memorandum
#  No. EM36-86-68110
dam_8 = DataDam(
    DataChordToBaseFoundation=chord_dam_6,
    DataBaseFoundationTerrain=brep_terrain_base_foundation_6,
    DataPointUpstream=point_upstream_3,
    DataChord_dam=chord_dam_5,
    BufferDelay=10000000,
    BufferMode=1)  # -> DataChordToBaseFoundation, DataBaseFoundationTerrain, DataPointUpstream, DataChord_dam
objfromgroup_5 = GetObjectsInGroup()

arch_dam_base_foundation_terrain = RemoteSender(dam_8.DataBaseFoundationTerrain)
chord_l1 = RemoteSender(dam_8.DataChord_dam)
chord_l1_2 = RemoteReceiver(chord_l1)
# 1. Determine L1 with section line
end_3 = EndPoints(Curve=chord_l1_2)  # -> Start, End
# On the formulas it is assumed here
# the lenght to excavated sound rock!
# Check technical memorandum. I have
#  changed the axis line to come from the
#  determined excavation on 06.06.23
dist = Distance(PointA=end_3.Start, PointB=end_3.End)
arch_l1 = RemoteSender(dist)
arch_l1_2 = RemoteReceiver(arch_l1)
arch_l1_3 = RemoteReceiver(arch_l1)
onoff = EnableDisableObject(Objects=objfromgroup_5, Enabled=equals.Equality, AllObjects_Object=dam_8)
arch_dam_base_foundation_terrain_2 = RemoteReceiver(arch_dam_base_foundation_terrain)
arch_dam_base_foundation_terrain_3 = RemoteReceiver(arch_dam_base_foundation_terrain)
volume_2 = MeshVolume(Mesh=mesh_10)  # -> Volume, Centroid
volume_3 = MeshVolume(Mesh=mesh_11)  # -> Volume, Centroid
onoff_2 = EnableDisableObject(
    Objects=objfromgroup_3,
    Enabled=equals_2.Equality,
    AllObjects_Object=[line, panel_48, end, rotax, atan, x_tremez, project_4, pdecon_3, pdecon_2, subtraction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])
onoff_3 = EnableDisableObject(
    Objects=objfromgroup_4,
    Enabled=equals_3.Equality,
    AllObjects_Object=[line_2, panel_51, end_2, rotax_3, atan_2, x_tremez_2, project_6, pdecon_5, pdecon_4, subtraction_2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])
gravity_volume = RemoteSender(volume_3.Volume)
geo_embankmentdam = RemoteSender(mesh_10)
geo_concretedam = RemoteSender(mesh_11)
embankment_volume = RemoteSender(volume_2.Volume)
round = Round(Number=volume_2.Volume)  # -> Nearest, Floor, Ceiling
format = Format(Format="{0:#0,000}", Culture=2055, Data0=volume_2.Volume)
round_2 = Round(Number=volume_3.Volume)  # -> Nearest, Floor, Ceiling
format_2 = Format(Format="{0:#0,000}", Culture=2055, Data0=volume_3.Volume)
panel_54 = Panel(round.Nearest)
panel_55 = Panel(format)
num_4 = Number(format_2)
panel_56 = Panel(round_2.Nearest)
panel_57 = Panel(format_2)
arch_dam_base_foundation_terrain_4 = RemoteReceiver(arch_dam_base_foundation_terrain)
geo_embankmentdam_2 = RemoteReceiver(geo_embankmentdam)
geo_concretedam_2 = RemoteReceiver(geo_concretedam)
chord_l1_3 = RemoteReceiver(chord_l1)
roundd = RoundToDecimalPlace(NumberX=chord_l1_3, DecimalPlace=Slider(1, range=0..1), RoundType=0)  # -> flatten(Rounded), Difference

# ----
# Preliminary layout of concrete arch dams (USBR)
# Topographic deiminesions necessary to
# compute thicknesses, projections, and
# volume are:
# - structural height (H)
# - horizontal distances between abutments;
#      - including estimated excavation to sound rock at crest elevation (L1)
#      - and 15 % of H above base (L2)
# Definitions: H = structural height
# Tc = thickness at crest
# Tb = thickness at base
# T_0.45H = thickness of crown cantilever at 0.45H above base (T0.45H)
# USP = upstream projection
# DSP = downestream projection
# L1 = straight line distance at crest elevation between abutmenets assumed excavated to sound rock
# L2 = straight line distance, at 0.15H above base, between abutments assumed excavated to sound rock
# V = estimated volume of dam
# Formulas - conservative as compared with values computed more precisely (in feet)
# at crest:
# at  base
# at 0.45H
arch_l1_4 = RemoteReceiver(arch_l1)
arch_l1_current_m = Panel(arch_l1_4)
panel_58 = Panel("USPcrest = 0.0")
panel_59 = Panel("DSPcrest = Tc")
# Technical Memorandum No. EM36-86-68110: 2.1.3.1 Single-, Two-, or Three- Centered Arch Dams
# 
# The number of lines-of-centers determines whether the arches are the same on the left and right side of the dam, are different on the left and right sides of the dam, or different on the inner and outer parts of the dam.
# 
# A single centered arch dam has a single line-of-centers that results in the same circular arcs from the left to the right abutment.
# 
# A 2-centered arch dam has two lines-of-centers that result in different circular arcs for the left side and right sides of the dam.
# 
# A 3-centered arch dam has two lines-of-centers that result in different circular arcs near the crown cantilever (inner) and near the abutments (outer). The radii for the inner arcs are shorter than the outer arcs.
panel_60 = Panel(" 1 foot = 0.3048 m")

expression = Expression(m=arch_l1_current_m, Expression="m*3.28084")

l1_feet = Panel(expression)
expression_2 = Expression(L1=l1_feet, Expression="0.6*L1")
r_axis_feet = Panel(expression_2)

expression_3 = Expression(ft=r_axis_feet, Expression="ft*0.3048")

r_axis_m = Panel(expression_3)
crest_radius = RemoteSender(r_axis_m)

crest_radius_2 = RemoteReceiver(crest_radius)
crest_radius_3 = RemoteReceiver(crest_radius)
# Technical Memorandum No. EM36-86-68110: 4.2 Determine an Appraisal Level Arch Dam Layout
# 
# 3 - If the topography map is of the ground surface, change the contours to represent the position of sound rock.
crest_radius_4 = RemoteReceiver(crest_radius)

# ----
# Technical Memorandum No. EM36-86-68110: 4.2 Determine an Appraisal Level Arch Dam Layout
# 
# 2 - Determine Raxis= 0.6 L1 and round the value of Raxis up to the nearest 10 to 50 feet.
# This is the initial layout, so no need for decimal accuracy
r_crest_usp = Panel(crest_radius_4)

# ----
# 2. Determine radius according to L1
addition_2 = Addition(A=r_crest_usp, B=raxis_adjustments)

# ----
# 3. Create crest curve
end_4 = EndPoints(Curve=dam_8.DataChordToBaseFoundation)  # -> Start, End
cir = Circle(Plane=end_4.Start, Radius=addition_2)
cir_2 = Circle(Plane=end_4.End, Radius=addition_2)
ccx = CurveCurve(CurveA=cir, CurveB=cir_2)  # -> Points, ParamsA, ParamsB
dist_2 = Distance(PointA=ccx.Points, PointB=dam_8.DataPointUpstream)
sort_7 = SortList(Keys=dist_2, ValuesA=ccx.Points)  # -> reverse(Keys), reverse(ValuesA)
item_21 = ListItem(List=sort_7.ValuesA, Index=0, Wrap=True)  # -> Item, Item1
circle = CircleCNR(Center=item_21.Item, Normal=Vector(0, 0, 1), Radius=addition_2)
ln_3 = Line(StartPoint=item_21.Item, EndPoint=item_21.Item1)
ccx_2 = CurveCurve(CurveA=dam_8.DataChordToBaseFoundation, CurveB=circle)  # -> Points, ParamsA, ParamsB
shatter = Shatter(Curve=circle, Parameters=ccx_2.ParamsB)
colom = CollisionOneMany(Collider=ln_3, Obstacles=shatter)  # -> Collision, Index
item_22 = ListItem(List=shatter, Index=colom.Index, Wrap=True)

# ---- group: Axis arch Dam
# Technical Memorandum No. EM36-86-68110: 4.2 Determine an Appraisal Level Arch Dam Layout
# 
# 4 - Position the dam in the canyon. Draw a circular arc with radius Raxis...This arc is the axis of the dam and is the upstream side of the crest. Move the axis around the propose dam location to
# position the top of the dam in the canyon.
# 
# The angle of incidence of the axis into the left and right abutments should be approximately equal to produce a geometrically symmetric dam in the canyon.
geo_7 = Geometry(item_22)

# ----
usp_arch_crest = RemoteSender(geo_7)
usp_arch_crest_2 = RemoteReceiver(usp_arch_crest)
usp_arch_crest_3 = RemoteReceiver(usp_arch_crest)
usp_arch_crest_4 = RemoteReceiver(flatten(usp_arch_crest))
path_mapper_2 = PathMapper(usp_arch_crest_4, source="{A}", target="{0;A}")
usp_arch_crest_5 = RemoteReceiver(usp_arch_crest)
len_3 = Length(Curve=usp_arch_crest_5)
roundd_2 = RoundToDecimalPlace(NumberX=len_3, DecimalPlace=Slider(1, range=0..1), RoundType=0)  # -> flatten(Rounded), Difference
usp_arch_crest_6 = RemoteReceiver(usp_arch_crest)
len_4 = Length(Curve=usp_arch_crest_6)

# ---- group: Lowest point (Base - middle section)
project_8 = Project(Curve=usp_arch_crest_2, Brep=arch_dam_base_foundation_terrain_3, Direction=Vector(0, 0, 1))

# ----
eval = EvaluateCurve(Curve=reparameterize(project_8), Parameter=Slider(0.58, range=0..1))  # -> Point, Tangent, Angle

# ----
# 4. Figure L2
darc = DeconstructArc(Arc=usp_arch_crest_2)  # -> flatten(BasePlane), Radius, Angle
x_tremez_3 = Extremes(Curve=project_8, Plane=PlaneXY(0, 0, 0))  # -> Highest, Lowest

# ---- group: Lowest point (Base - middle section) (continued)
# Technical Memorandum No. EM36-86-68110: 4.2 Determine an Appraisal Level Arch Dam Layout
# 
# 5 - On the axis, locate a point about midway between the abutments and in the riverbed. This is the location of the crown cantilever...
pt_3 = Point(x_tremez_3.Lowest)

# ----
project_9 = Project(Geometry=pt_3, Plane=darc.BasePlane)  # -> Geometry, Transform
ln_4 = Line(StartPoint=pt_3, EndPoint=project_9.Geometry)
eval_2 = EvaluateCurve(Height=reparameterize(ln_4), Point_at_015H="0.15")  # -> Point, Tangent, Angle
len_5 = Length(Curve=ln_4)

# ---- group: Centrifugal vector
pt_4 = Point(darc.BasePlane)
pt_5 = Point(project_9.Geometry)
vec2pt_3 = Vector2Pt(PointA=pt_5, PointB=pt_4, Unitize=True)  # -> Vector, Length

# ----
vec2pt_4 = Vector2Pt(PointA=pt_5, PointB=eval_2.Point, Unitize=False)  # -> Vector, Length
move_5 = Move(Geometry=usp_arch_crest_2, Motion=vec2pt_4.Vector)  # -> Geometry, Transform
bcx = BrepCurve(Brep=arch_dam_base_foundation_terrain_3, Curve=move_5.Geometry)  # -> Curves, flatten(Points)
crv_cp_2 = CurveClosestPoint(Point=bcx.Points, Curve=move_5.Geometry)  # -> Point, Parameter, Distance
shatter_2 = Shatter(Curve=move_5.Geometry, Parameters=crv_cp_2.Parameter)
colom_2 = CollisionOneMany(Collider=eval_2.Point, Obstacles=shatter_2)  # -> Collision, Index
item_23 = ListItem(List=shatter_2, Index=colom_2.Index, Wrap=True)
end_5 = EndPoints(Curve=item_23)  # -> Start, End
dist_3 = Distance(PointA=end_5.Start, PointB=end_5.End)

# ----
# Technical Memorandum No. EM36-86-68110: 4.2 Determine an Appraisal Level Arch Dam Layout
# 
# 5 - ...The radius of the axis at this point is the orientation of the reference plane and the line of centers. The reference plane is a vertical plane through the crown cantilever and generally parallel to the stream bank.
ln_5 = Line(StartPoint=pt_5, EndPoint=pt_4)

project_10 = Project(Geometry=ln_5, Plane=pt_3)  # -> Geometry, Transform
rulesrf = RuledSurface(CurveA=project_10.Geometry, CurveB=ln_5)

srf = Surface(rulesrf)
evalsrf = EvaluateSurface(Surface=reparameterize(srf), Point="0.5,0.5")  # -> Point, Normal, UDirection, VDirection, Frame
pl = PlaneNormal(Origin=evalsrf.Point, ZAxis=evalsrf.Normal)
crv_2 = Curve(rulesrf)

ext = ExtendCurve(Curve=project_10.Geometry, Type=0, Start=500, End=500)
crv_3 = Curve(ext)
point_crest = RemoteSender(project_9.Geometry)
reference_centers_outline = RemoteSender(crv_2)
abiscissa_dam_axis = RemoteSender(crv_3)
center_crest = RemoteSender(pt_4)
arch_l2 = RemoteSender(dist_3)
refecenre_centers_vector = RemoteSender(evalsrf.Normal)
centrifugal_vector = RemoteSender(vec2pt_3.Vector)
reference_centers_plane = RemoteSender(pl)
arch_dam_height = RemoteSender(len_5)
arch_dam_height_2 = RemoteReceiver(arch_dam_height)
arch_dam_height_3 = RemoteReceiver(arch_dam_height)
point_crest_2 = RemoteReceiver(point_crest)
centrifugal_vector_2 = RemoteReceiver(centrifugal_vector)

# ----
# x. Elevations
# Technical Memorandum No. EM36-86-68110: 4.2 Determine an Appraisal Level Arch Dam Layout
# 
# 9. Select 6 to 8 arch elevations on the crown cantilever to define the 3D dam. Select the lowest arch elevation starting at about 15% H. Then between 15% H and the crest, try to select 6 to 8 arches evenly spaced vertically and rounded to nearest contour elevation.
# E. Goulas: According to the Engineer Manual [1], the dam is divided into 5 to 10 evenly spaced horizontal arches and their respective parabolas are computed. They should be spaced not less than 3.048 meters (10 feet) nor more than 30.48 meters (100 feet) apart. The lowest parabola should be 0.15H to 0.20H above the base.
# DESIGN MANUAL FOR CONCRETE ARCH DAMS, 1977: Usually 5 to 10 arch elevations are selected such that the  entire dam is represented by a system of horizontal elements evenly spaced over the
# height of the structure.
# Usually the intervals are not greater than 100 (30.5m) feet nor less than 20 feet (6.1m).
# Technical Memorandum No. EM36-86-68110: Select the lowest arch elevation starting at about 15% H. Then between 15% H and the crest, try to select 6 to 8 arches evenly spaced vertically and rounded to nearest contour
# elevation. Even spacing arches permit best evaluation of the ADSAS results.
# EM_1110-2-2201_ARCH_DAM_DESIGN: The
# lowest arch should be 0.15H to 0.20H above the base of the crown cantilever.
section_height_approx = Slider(11, range=6..30)
eval_3 = EvaluateCurve(Height=reparameterize(ln_4), Point_at_015H="0.2")  # -> Point, Tangent, Angle
shatter_3 = Shatter(Curve=reparameterize(ln_4), Parameters="0.2")
item_24 = ListItem(List=shatter_3, Index="1", Wrap=True)
len_6 = Length(Curve=item_24)
expression_4 = Expression(section_heights=section_height_approx, height=len_6, Expression="height/section_heights")
eval_4 = EvaluateCurve(Height=reparameterize(ln_4), PointAt0="0")  # -> Point, Tangent, Angle
round_3 = Round(Number=expression_4)  # -> Nearest, Floor, Ceiling
divide = DivideCurve(Curve=item_24, Count=round_3.Nearest, Kinks=False)  # -> Points, Tangents, Parameters
division_2 = Division(A=len_6, B=round_3.Nearest)  # -> flatten(Result)
pt_6 = Point(flatten([divide.Points, eval_4.Point]))
pdecon_6 = Deconstruct(Point=pt_6)  # -> XComponent, YComponent, ZComponent
section_height_actual = Panel(division_2)
sort_8 = SortList(Keys=pdecon_6.ZComponent, ValuesA=pt_6)  # -> reverse(Keys), reverse(ValuesA)
cull_i_5 = CullIndex(List=sort_8.ValuesA, Indices=0, Wrap=True)
pln_4 = Plane(simplify(graft(cull_i_5)))

item_25 = ListItem(List=sort_8.ValuesA, Index=0, Wrap=True)
pln_5 = Plane(simplify(graft(item_25)))
crest_plane_elevation = RemoteSender(pln_5)
plane_elevations = RemoteSender(pln_4)
plane_elevations_2 = RemoteReceiver(plane_elevations)
plane_elevations_3 = RemoteReceiver(plane_elevations)
refecenre_centers_vector_2 = RemoteReceiver(refecenre_centers_vector)
reference_centers_plane_2 = RemoteReceiver(reference_centers_plane)
center_crest_2 = RemoteReceiver(center_crest)
refecenre_centers_vector_3 = RemoteReceiver(refecenre_centers_vector)
reference_centers_plane_3 = RemoteReceiver(reference_centers_plane)
plane_elevations_4 = RemoteReceiver(plane_elevations)
arch_dam_height_4 = RemoteReceiver(arch_dam_height)
roundd_3 = RoundToDecimalPlace(NumberX=arch_dam_height_4, DecimalPlace=Slider(1, range=0..1), RoundType=0)  # -> flatten(Rounded), Difference
arch_dam_height_5 = RemoteReceiver(arch_dam_height)
arch_dam_height_6 = RemoteReceiver(arch_dam_height)

arch_dam_height_7 = RemoteReceiver(arch_dam_height)
# Do concrete formula estimation to check
# how different they are from the volume in gh
# check memoradum
arch_l2_2 = RemoteReceiver(arch_l2)
arch_l2_current_m = Panel(arch_l2_2)
meter = Panel(arch_dam_height_7)

expression_5 = Expression(m=meter, Expression="m*3.28084")
expression_6 = Expression(m=arch_l2_current_m, Expression="m*3.28084")

l2_feet = Panel(expression_6)
feet = Panel(expression_5)
expression_7 = Expression(H=feet, L1=l1_feet, Expression="0.01*(H + 1.2*L1)")
expression_8 = Expression(H=feet, L1=l1_feet, L2=l2_feet, Expression="(0.0012*H*L1*L2*((H/400)^(H/400)))^(⅓)")
expression_9 = Expression(Tb=expression_8, Expression="0.67*Tb")
expression_10 = Expression(Tb=expression_8, Expression="0.33*Tb")
expression_11 = Expression(Tb=expression_8, Expression="0.95*Tb")
expression_12 = Expression(H=feet, L1=l1_feet, L2=l2_feet, Expression="0.000002*(H²)*L2*(((H+0.8*L1)²)/(L1-L2))+0.0004*H*L1*(H+1.1*L1)")
tc_feet = Panel(expression_7)
usp_base_feet = Panel(expression_9)
dsp_base_feet = Panel(expression_10)
tb_0_45h_feet = Panel(expression_11)

expression_13 = Expression(ft=usp_base_feet, Expression="ft*0.3048")
expression_14 = Expression(ft=tc_feet, Expression="ft*0.3048")
expression_15 = Expression(ft=dsp_base_feet, Expression="ft*0.3048")
expression_16 = Expression(ft=tb_0_45h_feet, Expression="ft*0.3048")

usp_base_m = Panel(expression_13)
dsp_base_m = Panel(expression_15)
tc_m = Panel(expression_14)
tb_0_45h_m = Panel(expression_16)
arch_usp_at_045h = RemoteSender(tb_0_45h_m)
arch_usp_base = RemoteSender(usp_base_m)
arch_dsp_base = RemoteSender(dsp_base_m)
arch_tc = RemoteSender(tc_m)

arch_usp_base_2 = RemoteReceiver(arch_usp_base)
arch_usp_at_045h_2 = RemoteReceiver(arch_usp_at_045h)
arch_usp_base_3 = RemoteReceiver(arch_usp_base)
arch_dsp_base_2 = RemoteReceiver(arch_dsp_base)
arch_tc_2 = RemoteReceiver(arch_tc)
arch_tc_3 = RemoteReceiver(arch_tc)
arch_usp_at_045h_3 = RemoteReceiver(arch_usp_at_045h)
arch_usp_base_4 = RemoteReceiver(arch_usp_base)
arch_dsp_base_3 = RemoteReceiver(arch_dsp_base)
format_3 = Format(
    Format=panel_27,
    Culture=127,
    Data0=crest_radius_2,
    Data1=arch_l1_2,
    Data2=arch_tc_2,
    Data3=arch_dam_height_2,
    Data4=arch_usp_base_3,
    Data5=arch_dsp_base_2,
    Data6=arch_usp_at_045h_2,
    Data7=expression_12,
    Data8=raxis_adjustments,
    Data9=addition_2,
    Data10=freeboard_2,
    Data11=offset_foundation_2)
format_4 = Format(
    Format=panel_28,
    Culture=127,
    Data0=crest_radius_3,
    Data1=arch_l1_3,
    Data2=arch_tc_3,
    Data3=arch_dam_height_3,
    Data4=arch_usp_base_4,
    Data5=arch_dsp_base_3,
    Data6=arch_usp_at_045h_3,
    Data7=expression_12,
    Data8=raxis_adjustments,
    Data9=addition_2,
    Data10=freeboard_3,
    Data11=offset_foundation_3)
panel_61 = Panel(format_3)
panel_62 = Panel(format_4)
assumptions = RemoteSender(panel_62)
arch_tc_4 = RemoteReceiver(arch_tc)
subtraction_3 = Subtraction(A=addition_2, B=arch_tc_4)
r_crest_dsp = Panel(subtraction_3)
cir_3 = Circle(Plane=item_21.Item, Radius=r_crest_dsp)
scx_3 = SurfaceCurve(Surface=arch_dam_base_foundation_terrain_2, Curve=cir_3)  # -> Curves, Points, UVPoints, Normals, Parameters, Tangents
shatter_4 = Shatter(Curve=cir_3, Parameters=scx_3.Parameters)
colom_3 = CollisionOneMany(Collider=ln_3, Obstacles=shatter_4)  # -> Collision, Index
item_26 = ListItem(List=shatter_4, Index=colom_3.Index, Wrap=True)
dsp_arch_crest = RemoteSender(item_26)
arch_usp_at_045h_4 = RemoteReceiver(arch_usp_at_045h)
arch_usp_base_5 = RemoteReceiver(arch_usp_base)
arch_dsp_base_4 = RemoteReceiver(arch_dsp_base)
arch_tc_5 = RemoteReceiver(arch_tc)

# ---- group: Crown Cantilever
# 5. Section points - based on the equations
# At Base
# At Crest:
# At 0.45H
panel_63 = Panel("0.45")
eval_5 = EvaluateCurve(Height=reparameterize(ln_4), Point_at_045H=panel_63)  # -> Point, Tangent, Angle
neg_3 = Negative(Value=centrifugal_vector_2)
neg_4 = Negative(Value=centrifugal_vector_2)
amp_3 = Amplitude(Vector=centrifugal_vector_2, Amplitude=arch_tc_5)
amp_4 = Amplitude(Vector=neg_4, Amplitude=arch_usp_base_5)
amp_5 = Amplitude(Vector=neg_3, Amplitude=arch_usp_at_045h_4)
amp_6 = Amplitude(Vector=centrifugal_vector_2, Amplitude=arch_dsp_base_4)
move_6 = Move(Geometry=pt_3, Motion=amp_6)  # -> Geometry, Transform
move_7 = Move(Geometry=pt_3, Motion=amp_4)  # -> Geometry, Transform
move_8 = Move(Geometry=point_crest_2, Motion=amp_3)  # -> Geometry, Transform
move_9 = Move(Geometry=eval_5.Point, Motion=amp_5)  # -> Geometry, Transform
usp_pt_at_base = Point(move_7.Geometry)
pt_at_crest = Point(point_crest_2)
pt_at_0_45h = Point(move_9.Geometry)
pt_at_0_45h_2 = Point(eval_5.Point)
pt_at_crest_2 = Point(move_8.Geometry)
pt_at_base = Point(move_6.Geometry)
# Technical Memorandum No. EM36-86-68110: 4.2 Determine an Appraisal Level Arch Dam Layout
# 
# 7 - Determine the geometry of the upstream and downstream face along the crown cantilever. A circle can be drawn through the 3 points computed for the upstream face in Step 6. Likewise, a circle can be drawn through the 3 points computed for the
# downstream face.
# 
# 8. Draw the upstream and downstream face along the crown cantilever.
arc = Arc3Pt(PointA=pt_at_crest_2, PointB=pt_at_0_45h_2, PointC=pt_at_base)  # -> DownstreamArc, CenterP, RadiusM
arc_2 = Arc3Pt(PointA=pt_at_crest, PointB=pt_at_0_45h, PointC=usp_pt_at_base)  # -> UpstreamArc, CenterP, RadiusM
ds_arc = RemoteSender(arc.DownstreamArc)
us_arc = RemoteSender(arc_2.UpstreamArc)

# ----
ln_6 = Line(StartPoint=point_crest_2, EndPoint=move_8.Geometry)
ln_7 = Line(StartPoint=move_6.Geometry, EndPoint=move_7.Geometry)
ln_8 = Line(StartPoint=eval_5.Point, EndPoint=move_9.Geometry)
len_7 = Length(Curve=ln_6)
len_8 = Length(Curve=ln_7)
len_9 = Length(Curve=ln_8)
roundd_4 = RoundToDecimalPlace(NumberX=len_7, DecimalPlace=Slider(1, range=0..1), RoundType=0)  # -> flatten(Rounded), Difference
# Technical Memorandum No. EM36-86-68110: 4.2 Determine an Appraisal Level Arch Dam Layout
# 
# 6 - Determine the shape of the crown cantilever. From the equations provided,
# compute TC, TB, T0.45H, USPC, USP0.45H, USPB, DSPC, DSP0.45H, and DSPB.
roundd_5 = RoundToDecimalPlace(NumberX=len_9, DecimalPlace=Slider(1, range=0..1), RoundType=0)  # -> flatten(Rounded), Difference
roundd_6 = RoundToDecimalPlace(NumberX=len_8, DecimalPlace=Slider(1, range=0..1), RoundType=0)  # -> flatten(Rounded), Difference
width_0_45 = RemoteSender(roundd_5.Rounded)
width_base = RemoteSender(roundd_6.Rounded)
width_crest_2 = RemoteSender(roundd_4.Rounded)
dsp_arch_crest_2 = RemoteReceiver(dsp_arch_crest)
ds_arc_2 = RemoteReceiver(ds_arc)
us_arc_2 = RemoteReceiver(us_arc)

# ----
# x. Dam Footprint
end_6 = EndPoints(Curve=ds_arc_2)  # -> Start, End
end_7 = EndPoints(Curve=us_arc_2)  # -> Start, End
dsp_point_bottom_foundation = Point(end_6.End)
usp_point_bottom_foundation = Point(end_7.End)
end_8 = EndPoints(Curve=dsp_arch_crest_2)  # -> Start, End
end_9 = EndPoints(Curve=usp_arch_crest_3)  # -> Start, End
# Technical Memorandum No. EM36-86-68110: 4.2 Determine an Appraisal Level Arch Dam Layout
# 
# 10. On the topography map, draw the upstream and downstream projections of the crown cantilever and downstream arc at the crest on the reference plane. Using the same radius center as the axis, draw the circular arc for the downstream side of the crest using the radius (Raxis – Tc). On the reference plane draw points at each arch elevation on the upstream and downstream faces.
project_11 = Project(Geometry=dsp_point_bottom_foundation, Plane=end_8.Start)  # -> Geometry, Transform
project_12 = Project(Geometry=usp_point_bottom_foundation, Plane=end_9.Start)  # -> Geometry, Transform
arc_3 = Arc3Pt(PointA=end_8.Start, PointB=project_11.Geometry, PointC=end_8.End)  # -> UpstreamArc, CenterP, RadiusM
arc_4 = Arc3Pt(PointA=end_9.Start, PointB=project_12.Geometry, PointC=end_9.End)  # -> UpstreamArc, CenterP, RadiusM
project_13 = Project(Curve=arc_4.UpstreamArc, Brep=arch_dam_base_foundation_terrain_4, Direction=Vector(0, 0, 1))
project_14 = Project(Curve=arc_3.UpstreamArc, Brep=arch_dam_base_foundation_terrain_4, Direction=Vector(0, 0, 1))
explode_5 = Explode(Curve=project_13, Recursive=False)  # -> Segments, Vertices
explode_6 = Explode(Curve=project_14, Recursive=False)  # -> Segments, Vertices
pline_6 = PolyLine(Vertices=explode_5.Vertices, Closed=False)
pline_7 = PolyLine(Vertices=explode_6.Vertices, Closed=False)
lng_5 = ListLength(List=explode_5.Vertices)
lng_6 = ListLength(List=explode_6.Vertices)
smoothpline_3 = SmoothPolyline(Polyline=pline_6, Strength=Slider(0.5, range=0..1), Times=lng_5)
smoothpline_4 = SmoothPolyline(Polyline=pline_7, Strength=Slider(0.5, range=0..1), Times=lng_6)
dsp_footprint = Curve(smoothpline_4)
usp_footprint = Curve(smoothpline_3)

usp_prefootprint = RemoteSender(usp_footprint)
dsp_prefootprint = RemoteSender(dsp_footprint)
usp_prefootprint_2 = RemoteReceiver(usp_prefootprint)
dsp_prefootprint_2 = RemoteReceiver(dsp_prefootprint)
us_arc_3 = RemoteReceiver(us_arc)
ds_arc_3 = RemoteReceiver(ds_arc)
us_arc_4 = RemoteReceiver(us_arc)
ds_arc_4 = RemoteReceiver(ds_arc)
pcx = CurvePlane(DownstreamArc=ds_arc_4, Plane=plane_elevations_4)  # -> simplify(Points), ParamsC, ParamsP
pcx_2 = CurvePlane(UpstreamArc=us_arc_4, Plane=plane_elevations_4)  # -> simplify(Points), ParamsC, ParamsP
us_ds_slices_intersections = RemoteSender([pcx_2.Points, pcx.Points])
dsp_arch_crest_3 = RemoteReceiver(flatten(dsp_arch_crest))
path_mapper_3 = PathMapper(dsp_arch_crest_3, source="{A}", target="{1;A}")
width_base_2 = RemoteReceiver(width_base)
width_crest_3 = RemoteReceiver(width_crest_2)
width_0_45_2 = RemoteReceiver(width_0_45)
usp_prefootprint_3 = RemoteReceiver(usp_prefootprint)
dsp_prefootprint_3 = RemoteReceiver(dsp_prefootprint)
dam_pre_footprint = Curve([usp_prefootprint_3, dsp_prefootprint_3])
assumptions_2 = RemoteReceiver(assumptions)
split_4 = TextSplit(Text=flatten(assumptions_2), Separators=":")
dispatch_4 = Dispatch(List=split_4, DispatchPattern=[True, False])  # -> flatten(ListA), flatten(ListB)
trim = TextTrim(Text=dispatch_4.ListB, Start=True, End=True)
merge_12 = Merge(Data1=panel_42, Data2=dispatch_4.ListA)
join_5 = TextJoin(Text=merge_12, Join="|")
panel_64 = Panel(merge_12)

objfromgroup_6 = GetObjectsInGroup()
dam_9 = DataDam(DataA=merge_10, BufferDelay=10000000, BufferMode=0)

dup_6 = DuplicateDataMatch(SourceDataTree=objfromgroup_6, SecondaryData1=run_water_final_2)  # -> SourceData, SecondaryData1
setobj_3 = SetObjectValue(ObjectToSet=objfromgroup_6, ValueToSet=dup_6.SecondaryData1)
panel_65 = Panel(dam_9)

# ----
# Technical Memorandum No. EM36-86-68110: 4.2 Determine an Appraisal Level Arch Dam Layout
# 
# 12.a. Draw the upstream face arch starting with the first arch below the crest. Use an initial guess for the line of centers as a 0.2:1 sloping line.
# x. Line of centers
flatten = FlattenTree(Tree=plane_elevations_2, Path="{0}")
flatten_2 = FlattenTree(Tree=plane_elevations_3, Path="{0}")
cull_i_6 = CullIndex(List=flatten, Indices=-1, Wrap=True)  # -> simplify(graft(List))
cull_i_7 = CullIndex(List=flatten_2, Indices=-1, Wrap=True)  # -> simplify(graft(List))
pcx_3 = CurvePlane(DownstreamArc=ds_arc_3, Plane=cull_i_7)  # -> simplify(Points), ParamsC, ParamsP
pcx_4 = CurvePlane(DSPFootprint=dsp_prefootprint_2, Plane=cull_i_7)  # -> simplify(Points), ParamsC, ParamsP
pcx_5 = CurvePlane(USPFootprint=usp_prefootprint_2, Plane=cull_i_6)  # -> simplify(Points), ParamsC, ParamsP
pcx_6 = CurvePlane(UpstreamArc=us_arc_3, Plane=cull_i_6)  # -> simplify(Points), ParamsC, ParamsP
item_27 = ListItem(List=pcx_4.Points, Index=0, Wrap=True)  # -> Item, Item1
arc_5 = Arc3Pt(PointA=item_27.Item, PointB=pcx_3.Points, PointC=item_27.Item1)  # -> Arc, Plane, Radius
darc_2 = DeconstructArc(Arc=arc_5.Arc)  # -> BasePlane, Radius, Angle
rev_2 = Reverse(Vector=refecenre_centers_vector_3)
project_15 = ProjectPoint(Point=darc_2.BasePlane, Direction=[refecenre_centers_vector_3, rev_2], Geometry=reference_centers_plane_3)  # -> Point, Index
rev_3 = Reverse(Vector=refecenre_centers_vector_2)
clean_5 = CleanTree(RemoveNulls=True, RemoveInvalid=True, RemoveEmpty=False, Tree=project_15.Point)  # -> flatten(Tree)
center_at_crest = Point(center_crest_2)
abiscissa_dam_axis_2 = RemoteReceiver(abiscissa_dam_axis)

item_28 = ListItem(List=pcx_5.Points, Index=0, Wrap=True)  # -> Item, Item1

arc_6 = Arc3Pt(PointA=item_28.Item, PointB=pcx_6.Points, PointC=item_28.Item1)  # -> Arc, Plane, Radius
darc_3 = DeconstructArc(Arc=arc_6.Arc)  # -> BasePlane, Radius, Angle
project_16 = ProjectPoint(Point=darc_3.BasePlane, Direction=[refecenre_centers_vector_2, rev_3], Geometry=reference_centers_plane_2)  # -> Point, Index
clean_6 = CleanTree(RemoveNulls=True, RemoveInvalid=True, RemoveEmpty=False, Tree=project_16.Point)  # -> flatten(Tree)

centers_extrados_not_normalized = Point([center_at_crest, clean_6])
pline_8 = PolyLine(Vertices=centers_extrados_not_normalized, Closed=False)
lng_7 = ListLength(List=centers_extrados_not_normalized)
smoothpline_5 = SmoothPolyline(Polyline=pline_8, Strength=1, Times=lng_7)
ext_2 = ExtendCurve(Curve=smoothpline_5, Type=2, Start=0, End=500)
ccx_3 = CurveCurve(CurveA=ext_2, CurveB=abiscissa_dam_axis_2)  # -> Points, ParamsA, ParamsB
shatter_5 = Shatter(Curve=ext_2, Parameters=flatten(ccx_3.ParamsA))
sort_9 = SortList(Keys=shatter_5, ValuesA=shatter_5)  # -> Keys, ValuesA
item_29 = ListItem(List=sort_9.ValuesA, Index=0, Wrap=True)
geo_8 = Geometry(item_29)

centers_extrados_not_normalized_2 = Point([center_at_crest, clean_5])
pline_9 = PolyLine(Vertices=centers_extrados_not_normalized_2, Closed=False)
lng_8 = ListLength(List=centers_extrados_not_normalized_2)
smoothpline_6 = SmoothPolyline(Polyline=pline_9, Strength=1, Times=lng_8)
ext_3 = ExtendCurve(Curve=smoothpline_6, Type=2, Start=0, End=500)
ccx_4 = CurveCurve(CurveA=ext_3, CurveB=abiscissa_dam_axis_2)  # -> Points, ParamsA, ParamsB
shatter_6 = Shatter(Curve=ext_3, Parameters=flatten(ccx_4.ParamsA))
sort_10 = SortList(Keys=shatter_6, ValuesA=shatter_6)  # -> Keys, ValuesA
item_30 = ListItem(List=sort_10.ValuesA, Index=0, Wrap=True)
geo_9 = Geometry(item_30)

line_of_centers_intrados = RemoteSender(geo_8)
line_of_centers_extrados = RemoteSender(geo_9)
line_of_centers_extrados_2 = RemoteReceiver(line_of_centers_extrados)
line_of_centers_intrados_2 = RemoteReceiver(line_of_centers_intrados)
pcx_7 = CurvePlane(LineOfCentersIntrados=line_of_centers_intrados_2, Plane=plane_elevations_4)  # -> simplify(CenterPoints), ParamsC, ParamsP
pcx_8 = CurvePlane(LineOfCentersExtrados=line_of_centers_extrados_2, Plane=plane_elevations_4)  # -> simplify(CenterPoints), ParamsC, ParamsP
ln_9 = Line(StartPoint=pcx.Points, EndPoint=pcx_7.CenterPoints)
ln_10 = Line(StartPoint=pcx_2.Points, EndPoint=pcx_8.CenterPoints)
len_10 = Length(Curve=ln_9)
len_11 = Length(Curve=ln_10)
cir_4 = Circle(DSCenters=pcx_7.CenterPoints, Radius=len_10)  # -> simplify(Circle)
cir_5 = Circle(USCenters=pcx_8.CenterPoints, Radius=len_11)
path_mapper_4 = PathMapper(ln_10, source="{A}", target="{0;A}")
path_mapper_5 = PathMapper(cir_4, source="{A}", target="{1;A}")
path_mapper_6 = PathMapper(cir_5, source="{A}", target="{0;A}")
path_mapper_7 = PathMapper(ln_9, source="{A}", target="{1;A}")

# ---- group: Finding the intersection with sound rock
arch_dam_base_foundation_terrain_5 = RemoteReceiver(arch_dam_base_foundation_terrain)
relay = Relay([path_mapper_6, path_mapper_5])
relay_2 = Relay([path_mapper_4, path_mapper_7])
scx_4 = SurfaceCurve(Surface=arch_dam_base_foundation_terrain_5, Curve=relay)  # -> Curves, simplify(Points), UVPoints, Normals, Parameters, Tangents

# ----
points_lineofcenters = RemoteSender([pcx_8.CenterPoints, pcx_7.CenterPoints])

# ---- group: Filter away last circle - touching sound rock
geo_10 = Geometry(relay)
tstat_2 = TreeStatistics(Tree=geo_10)  # -> Paths, Length, Count
division_3 = Division(A=tstat_2.Count, B="2")
x_minus_one_2 = XMinusOne(NumberX=division_3)
item_31 = ListItem(List=tstat_2.Paths, Index=flatten(["-1", x_minus_one_2]), Wrap=True)
split_5 = SplitTree(Data=geo_10, Masks=flatten(item_31))  # -> Positive, Negative
geo_11 = Geometry(split_5.Positive)

# ---- group: Adjusting the bottom so there is something to connect with the bottom circle
number_slider_6 = Slider(1, range=0..10)
centrifugal_vector_3 = RemoteReceiver(centrifugal_vector)
neg_5 = Negative(Value=number_slider_6)
rev_4 = Reverse(Vector=centrifugal_vector_3)
rad = Radians(Degrees=[number_slider_6, neg_5])
rotate = Rotate(Geometry=rev_4, Angle=rad, Plane=PlaneXY(0, 0, 0))  # -> flatten(Geometry), Transform
center_6 = Center(Geometric=geo_11)  # -> Center, Dimension
darc_4 = DeconstructArc(Arc=geo_11)  # -> BasePlane, Radius, Angle
line_3 = LineSDL(Start=center_6.Center, Direction=rotate.Geometry, Length=darc_4.Radius)
ccx_5 = CurveCurve(CurveA=geo_11, CurveB=line_3)  # -> Points, ParamsA, ParamsB
pshift = ShiftPaths(Data=ccx_5.ParamsA, Offset="-1")
shatter_7 = Shatter(Curve=geo_11, Parameters=pshift)
pshift_2 = ShiftPaths(Data=shatter_7, Offset="-1")
item_32 = ListItem(List=pshift_2, Index=0, Wrap=True)

# ---- group: Cutting and selecting curves for dam
shatter_8 = Shatter(Curve=relay, Parameters=scx_4.Parameters)  # -> simplify(Segments)
colom_4 = CollisionOneMany(Collider=shatter_8, Obstacles=relay_2)  # -> Collision, Index
dispatch_5 = Dispatch(List=shatter_8, DispatchPattern=colom_4.Collision)  # -> ListA, ListB

# ----
split_6 = SplitTree(Data=dispatch_5.ListA, Masks=flatten(item_31))  # -> Positive, Negative
geo_12 = Geometry(split_6.Negative)
path_mapper_8 = PathMapper(geo_12, source="{A;B}", target="{A;B+1}")
path_mapper_9 = PathMapper(item_32, source="{A;B}", target="{A;B+1}")

end_10 = EndPoints(Curve=path_mapper_9)  # -> Start, End
geo_13 = Geometry([path_mapper_2, path_mapper_3, path_mapper_8])
end_11 = EndPoints(Curve=geo_13)  # -> Start, End
geo_14 = Geometry([end_10.Start, end_10.End])
geo_15 = Geometry([end_11.Start, end_11.End])
path_mapper_10 = PathMapper(geo_15, source="{A;B}", target="{A}")
item_33 = ListItem(List=path_mapper_10, Index=0, Wrap=True)
geo_16 = Geometry(path_mapper_10)
ptsortitems = PointSortItems(Start=item_33, Points=geo_16)  # -> SortedItems, SortedIndices, simplify(SortedPoints)
intcrv = Interpolate(Vertices=ptsortitems.SortedPoints, Degree=3, Periodic=False, KnotStyle=1)  # -> Curve, Length, Domain
lng_9 = ListLength(List=ptsortitems.SortedPoints)
crest_plane_elevation_2 = RemoteReceiver(crest_plane_elevation)
plane_elevations_5 = RemoteReceiver(plane_elevations)
number_slider_7 = Slider(50, range=0..100)
smocrv = SmoothCurve(Curve=intcrv.Curve, Steps=lng_9, StartType=0, EndType=0, DeviationTolerance=Slider(5, range=0..50), AngleTolerance=0.05)
merge_13 = Merge(Data1=flatten(crest_plane_elevation_2), Data2=flatten(plane_elevations_5))
ext_4 = ExtendCurve(Curve=geo_13, Type=1, Start=number_slider_7, End=number_slider_7)
cull_i_8 = CullIndex(List=merge_13, Indices=-1, Wrap=True)
pcx_9 = CurvePlane(Curve=smocrv, Plane=cull_i_8)  # -> simplify(Points), ParamsC, ParamsP
crv_cp_3 = CurveClosestPoint(Point=pcx_9.Points, Curve=ext_4)  # -> Point, Parameter, Distance
dispatch_6 = Dispatch(List=crv_cp_3.Point, DispatchPattern=[True, False])  # -> ListA, ListB
item_34 = ListItem(List=dispatch_6.ListA, Index=0, Wrap=True)
item_35 = ListItem(List=dispatch_6.ListB, Index=0, Wrap=True)
geo_17 = Geometry(geo_14)
geo_18 = Geometry([item_34, item_35, geo_17])

pshift_3 = ShiftPaths(Data=geo_18, Offset=-1)
item_36 = ListItem(List=pshift_3, Index=0, Wrap=True)
ptsortitems_2 = PointSortItems(Start=item_36, Points=pshift_3)  # -> SortedItems, SortedIndices, SortedPoints
path_mapper_11 = PathMapper(ext_4, source="{A;B}", target="{A}")
intcrv_2 = Interpolate(Vertices=ptsortitems_2.SortedPoints, Degree=Slider(3, range=0..10), Periodic=False, KnotStyle=1)  # -> simplify(Curve), Length, Domain
ccx_6 = CurveCurve(CurveA=path_mapper_11, CurveB=intcrv_2.Curve)  # -> Points, ParamsA, ParamsB
shatter_9 = Shatter(Curve=ext_4, Parameters=ccx_6.ParamsA)  # -> simplify(Segments)
dispatch_7 = Dispatch(List=shatter_9, DispatchPattern=[True, False])  # -> ListA, ListB
geo_19 = Geometry(dispatch_7.ListB)

geo_20 = Geometry(geo_19)
tstat_3 = TreeStatistics(Tree=geo_20)  # -> Paths, Length, Count
division_4 = Division(A=tstat_3.Count, B="2")
split_7 = SplitList(List=tstat_3.Paths, Index=division_4)  # -> ListA, ListB
item_37 = ListItem(List=split_7.ListA, Index=-1, Wrap=True)
item_38 = ListItem(List=split_7.ListB, Index=-1, Wrap=True)
cull_i_9 = CullIndex(List=split_7.ListA, Indices=-1, Wrap=True)  # -> flatten(List)
cull_i_10 = CullIndex(List=split_7.ListB, Indices=-1, Wrap=True)  # -> flatten(List)
path_2 = DataPath(flatten([cull_i_9, cull_i_10]))
split_8 = SplitTree(Data=geo_20, Masks=flatten(path_2))  # -> Positive, Negative
split_9 = SplitTree(Data=geo_20, Masks=flatten("{?;0}"))  # -> Positive, Negative
unflatten_2 = UnflattenTree(Tree=intcrv_2.Curve, Guide=split_8.Negative)
unflatten_3 = UnflattenTree(Tree=split_9.Negative, Guide=split_8.Positive)
geo_21 = Geometry([split_8.Positive, unflatten_3])
path_mapper_12 = PathMapper(unflatten_3, source="{A;B}", target="{A}")
lng_10 = ListLength(List=path_mapper_12)
repeat = RepeatData(Data=intcrv_2.Curve, Length=lng_10)
unflatten_4 = UnflattenTree(Tree=repeat, Guide=unflatten_3)
ccx_7 = CurveCurve(CurveA=unflatten_4, CurveB=geo_21)  # -> Points, simplify(ParamsA), ParamsB
pshift_4 = ShiftPaths(Data=ccx_7.ParamsA, Offset=-1)
shatter_10 = Shatter(Curve=unflatten_4, Parameters=pshift_4)  # -> simplify(Segments)
lng_11 = ListLength(List=shatter_10)
python = GhPythonScript(x=lng_11, y=shatter_10)  # -> out, a, b
# ---------- python: Python ----------
__author__ = "Admin"
__version__ = "2023.08.14"

import rhinoscriptsyntax as rs

if x == 3:
    a = y
elif x == 5:
    b = y
# ---------- end python ----------
clean_7 = CleanTree(RemoveNulls=True, RemoveInvalid=True, RemoveEmpty=False, Tree=python.b)
clean_8 = CleanTree(RemoveNulls=True, RemoveInvalid=True, RemoveEmpty=False, Tree=python.a)
geo_22 = Geometry(split_8.Negative)
geo_23 = Geometry(unflatten_2)

dispatch_8 = Dispatch(List=clean_7, DispatchPattern=[True, False])  # -> ListA, ListB
geo_24 = Geometry(clean_8)
cull_i_11 = CullIndex(List=geo_24, Indices="1", Wrap=True)  # -> simplify(List)
geo_25 = Geometry(dispatch_8.ListB)
geo_26 = Geometry([geo_21, geo_25, cull_i_11])
item_39 = ListItem(List=geo_26, Index=0, Wrap=True)  # -> Item, Item1, Item2, Item3
netsurf = NetworkSurface(CurvesU=[item_39.Item, item_39.Item1], CurvesV=[item_39.Item2, item_39.Item3], Continuity=3)

ccx_8 = CurveCurve(CurveA=geo_23, CurveB=geo_22)  # -> Points, ParamsA, ParamsB
shatter_11 = Shatter(Curve=geo_23, Parameters=ccx_8.ParamsA)
pshift_5 = ShiftPaths(Data=shatter_11, Offset=-1)
item_40 = ListItem(List=pshift_5, Index="1", Wrap=True)
loft_3 = Loft(
    Curves=[item_40, geo_22],
    Options={Adjust=True, Closed=False, LoftEnds=0, LoftSimp=0, LoftType=5, Rebuild=10, Refit=0.01})

dam_10 = DataDam(DataA=loft_3, DataB=netsurf, BufferDelay=10000000, BufferMode=1)  # -> DataA, DataB
path_mapper_13 = PathMapper([dam_10.DataA, dam_10.DataB], source="{A;B}", target="{A}")
join_6 = BrepJoin(Breps=flatten(path_mapper_13))  # -> Breps, Closed
item_41 = ListItem(List=join_6.Breps, Index=0, Wrap=True)  # -> Item, Item1
item_42 = ListItem(List=join_6.Breps, Index=1, Wrap=True)
loft_4 = Loft(
    Curves=flatten([item_41.Item, item_41.Item1]),
    Options={Adjust=True, Closed=False, LoftEnds=0, LoftSimp=0, LoftType=5, Rebuild=10, Refit=0.01})
arch_face_collision = RemoteSender(item_42)
arch_face_collision_2 = RemoteReceiver(arch_face_collision)
mesh_12 = Mesh(arch_face_collision_2)
filter_5 = StreamFilter(Gate=dam_type_9, Stream0=null, Stream1=mesh_12, Stream2=null)
join_7 = BrepJoin(Breps=flatten([join_6.Breps, loft_4]))  # -> Breps, Closed
mesh_13 = MeshBrep(Brep=join_7.Breps, Settings=jagged_2)
geo_archdam = RemoteSender(mesh_13)
geo_archdam_2 = RemoteReceiver(geo_archdam)
mshclsd = IsMeshClosed(Mesh=geo_archdam_2)
panel_66 = Panel(mshclsd)
geo_archdam_3 = RemoteReceiver(geo_archdam)
filter_6 = StreamFilter(Gate=dam_type_10, Stream0=geo_concretedam_2, Stream1=geo_archdam_3, Stream2=geo_embankmentdam_2)

dam_11 = DataDam(DataWaterSectionMeshes=merge_9, DataDamGeometry=filter_6, DataDamCollision=filter_5, BufferDelay=10000000, BufferMode=0)  # -> DataWaterSectionMeshes, DataDamGeometry, DataDamCollision

gate = StreamGate(Stream=dam_11.DataWaterSectionMeshes, Gate=dam_type_12)  # -> Target0, Target1, Target2
gate_2 = StreamGate(Stream=dam_11.DataDamGeometry, Gate=dam_type_11)  # -> Target0, Target1, Target2
filter_7 = StreamFilter(Gate=dam_type_13, Stream1=gate.Target1, Stream2=gate.Target2)
filter_8 = StreamFilter(Gate=dam_type_13, Stream0=gate_2.Target0, Stream1=gate_2.Target1, Stream2=gate_2.Target2)
mdif = MeshDifference(MeshesA=filter_7, MeshesB=filter_8)
disjoint_2 = DisjointMesh(Mesh=mdif)
volume_4 = Volume(Geometry=disjoint_2)  # -> Volume, Centroid; disabled
ma_2 = MassAddition(Input=flatten(volume_4.Volume))  # -> Result, PartialResults; disabled
path_mapper_14 = PathMapper(disjoint_2, source="{A;B}", target="{A}")
subtraction_4 = Subtraction(A=ma.Result, B=ma_2.Result)  # disabled
colom_5 = CollisionOneMany(Collider=path_mapper_14, Obstacles=dam_11.DataDamCollision)  # -> Collision, Index
dispatch_9 = Dispatch(List=path_mapper_14, DispatchPattern=colom_5.Index)  # -> ListA, ListB
geo_27 = Geometry(simplify(gate.Target0))
geo_28 = Geometry(dispatch_9.ListA)
gate_3 = StreamGate(Stream=geo_28, Gate=dam_type_14)  # -> Target0, Target1, Target2
filter_9 = StreamFilter(Gate=dam_type_15, Stream0=geo_27, Stream1=gate_3.Target1, Stream2=gate_3.Target2)
flatten_3 = FlattenTree(Tree=filter_9, Path="{0}")
geo_archdam_4 = RemoteReceiver(geo_archdam)
transform_3 = Transform(Geometry=geo_archdam_4, Transform=transform_origin_4)

# ----
# Dam
dam_type_16 = RemoteReceiver(dam_type_2)
geo_concretedam_3 = RemoteReceiver(geo_concretedam)
geo_archdam_5 = RemoteReceiver(geo_archdam)
geo_embankmentdam_3 = RemoteReceiver(geo_embankmentdam)
levels_at_water_height_3 = RemoteReceiver(levels_at_water_height)
filter_10 = StreamFilter(Gate=dam_type_16, Stream0=geo_concretedam_3, Stream1=geo_archdam_5, Stream2=geo_embankmentdam_3)
chord_dam_8 = RemoteReceiver(chord_dam)
swatch_2 = ColourSwatch(SwatchColor=RGB(207, 151, 68))
preview_2 = CustomPreview(Geometry=filter_10, Material=swatch_2)
curve_preview = CustomCurvePreview(Curve=chord_dam_8, Linetype=<geometry referenced from the Rhino model>, Colour=swatch_2)
curve_preview_2 = CustomCurvePreview(
    Curve=levels_at_water_height_3,
    Linetype=<geometry referenced from the Rhino model>,
    Colour=ColourSwatch(SwatchColor=RGB(209, 0, 0)))

# ----
# Line of centers
reference_centers_plane_4 = RemoteReceiver(reference_centers_plane)
refecenre_centers_vector_4 = RemoteReceiver(refecenre_centers_vector)
line_of_centers_intrados_3 = RemoteReceiver(line_of_centers_intrados)
line_of_centers_extrados_3 = RemoteReceiver(line_of_centers_extrados)
reference_centers_outline_2 = RemoteReceiver(reference_centers_outline)
number_slider_8 = Slider(8, range=0..50)
ds_arc_5 = RemoteReceiver(ds_arc)
us_arc_5 = RemoteReceiver(us_arc)
us_ds_slices_intersections_2 = RemoteReceiver(us_ds_slices_intersections)
abiscissa_dam_axis_3 = RemoteReceiver(abiscissa_dam_axis)
points_lineofcenters_2 = RemoteReceiver(points_lineofcenters)
swatch_3 = ColourSwatch(SwatchColor=RGB(130, 133, 129))
number_slider_9 = Slider(50, range=0..100)
swatch_4 = ColourSwatch(SwatchColor=RGB(69, 69, 69))
objfromgroup_7 = GetObjectsInGroup()
symadv = SymbolAdvanced(Style=5, SizePrimary=number_slider_8, SizeSecondary=10, Rotation=0, Fill=swatch_3, Edge=swatch_3, Width=2, Adjust=True)
amp_7 = Amplitude(Vector=refecenre_centers_vector_4, Amplitude=number_slider_9)
curve_preview_3 = CustomCurvePreview(
    Curve=[line_of_centers_intrados_3, line_of_centers_extrados_3],
    Linetype=<geometry referenced from the Rhino model>,
    Colour=swatch_4)
vdisex_2 = VectorDisplayEx(Point=reference_centers_plane_4, Vector=amp_7, Colour=RGB(0, 0, 0), Width=2)
curve_preview_4 = CustomCurvePreview(Curve=reference_centers_outline_2, Linetype="Continuous", Colour=swatch_4)
symbol = SymbolDisplay(Location=[points_lineofcenters_2, us_ds_slices_intersections_2], Display=symadv)
curve_preview_5 = CustomCurvePreview(Curve=[ds_arc_5, us_arc_5], Linetype=<geometry referenced from the Rhino model>, Colour=swatch_4)
flip = FlipMatrix(Data=points_lineofcenters_2)
panel_67 = Panel("{0}")
reference_centers_plane_5 = RemoteReceiver(reference_centers_plane)
center_crest_3 = RemoteReceiver(center_crest)
split_10 = SplitTree(Data=flip, Masks=flatten(panel_67))  # -> Positive, Negative
pt_7 = Point([split_10.Positive, center_crest_3])
number_slider_10 = Slider(86, range=0..100)
deplane = DeconstructPlane(Plane=reference_centers_plane_5)  # -> Origin, XAxis, YAxis, ZAxis
amp_8 = Amplitude(Vector=deplane.XAxis, Amplitude=number_slider_10)
pdecon_7 = Deconstruct(Point=pt_7)  # -> XComponent, YComponent, ZComponent
roundf = RoundToFactor(NumberX=pdecon_7.ZComponent, Factor=0.1, RoundType=0)  # -> Rounded, Difference, MultiplierR, MultiplierX
move_10 = Move(Geometry=pt_7, Motion=amp_8)  # -> Geometry, Transform
pln_6 = Plane(reference_centers_plane_5)
ln_11 = Line(StartPoint=pt_7, EndPoint=move_10.Geometry)
leader_text_settings_2 = RemoteReceiver(leader_text_settings)
leader = Leader(Curve=ln_11, Text=roundf.Rounded, Plane=pln_6, TextSettings=leader_text_settings_2)  # -> Leader, Curve, Text, Plane, TextSettings, ArrowSettings, LeaderSettings

geo_archdam_6 = RemoteReceiver(geo_archdam)
volume_5 = MeshVolume(Mesh=geo_archdam_6)  # -> Volume, Centroid
archdam_volume = RemoteSender(volume_5.Volume)
archdam_volume_2 = RemoteReceiver(archdam_volume)
m3_to_hm3 = Expression(x=archdam_volume_2, Expression="x/1000000")
roundd_7 = RoundToDecimalPlace(NumberX=m3_to_hm3, DecimalPlace=Slider(2, range=0..10), RoundType=0)  # -> Rounded, Difference
panel_68 = Panel(roundd_7.Rounded)
merge_14 = Merge(
    Data1=dam_axis_name_3,
    Data2=dam_name_translation_3,
    Data3="0",
    Data4="0",
    Data5=normal_water_level_5,
    Data6=dam_level_3,
    Data7=roundd_3.Rounded,
    Data8=width_base_2,
    Data9=width_crest_3,
    Data10=width_0_45_2,
    Data11=roundd.Rounded,
    Data12=roundd_2.Rounded,
    Data13="0",
    Data14="0",
    Data15=roundd_7.Rounded,
    Data16="0")
panel_69 = Panel(merge_14)
output_2 = DataOutput(
    A=concat_7,
    B=panel_37,
    C=panel_35,
    D=merge_14,
    E=transform_3,
    Destination="C:\Users\Admin\Documents\Github\EarlyStageDesign\JD\Skripts\ghData\ArchDam_test_to_export.ghdata",
    RelativePath="C:\Users\Admin\Documents\Github\EarlyStageDesign\JD\Skripts\ghData\ArchDam_test_to_export.ghdata|ghData\ArchDam_test_to_export.ghdata")
lng_12 = ListLength(List=objfromgroup_7)
dup_7 = DuplicateData(Data=show_line_of_centers, Number=lng_12, Order=True)
not = GateNot(A=dup_7)
onoff_4 = EnableDisableObject(
    Objects=objfromgroup_7,
    Enabled=dup_7,
    AllObjects_Object=[vdisex_2, amp_7, number_slider_9, line_of_centers_intrados_3, line_of_centers_extrados_3, curve_preview_3, us_arc_5, ds_arc_5, curve_preview_5, swatch_4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])
format_5 = Format(
    Format=panel_40,
    Culture=127,
    Data0=normal_water_level_9,
    Data1=dam_level_4,
    Data2=pdecon.ZComponent,
    Data3=arch_dam_height_5,
    Data4=axis_straight_terrain_2,
    Data5=len_2,
    Data6=len_4,
    Data7=volume_5.Volume)
entwine_3 = Entwine(
    Branch00=normal_water_level_10,
    Branch01=dam_level_5,
    Branch02=pdecon.ZComponent,
    Branch03=arch_dam_height_6,
    Branch04=axis_straight_terrain_2,
    Branch05=len_2,
    Branch06=len_4,
    Branch07=volume_5.Volume,
    FlattenInputs=True)  # -> flatten(Result)
panel_70 = Panel(entwine_3)
transform_4 = Transform(Geometry=geo_archdam_6, Transform=transform_origin_5)
transform_5 = Transform(Geometry=join_7.Breps, Transform=transform_origin_5)
geo_29 = Geometry(flatten(transform_4))
merge_15 = Merge(Data1=panel_70, Data2=trim)
join_8 = TextJoin(Text=merge_15, Join="|")
panel_71 = Panel([join_5, join_8])
panel_72 = Panel(merge_15)
num_5 = Number(panel_72)
move_11 = Move(Geometry=geo_archdam_6, Motion=transform_origin_6)  # -> Geometry, Transform
exportvector = ExportVector(
    VectorDataFilename=concat_9,
    VectorDataFolder=concat_10,
    Fields="Volume",
    Values=num_3,
    FeatureGeometry=move_11.Geometry,
    Export=Button(),
    DriverExtension=".shp",
    DriverType="ESRI Shapefile")
exportvector_2 = ExportVector(
    VectorDataFilename=concat_8,
    VectorDataFolder=concat_10,
    Fields="Test 1",
    Values="1",
    FeatureGeometry=geo_29,
    Export=Button(),
    DriverExtension=".shp",
    DriverType="ESRI Shapefile")
exportvector_3 = ExportVector(
    VectorDataFilename=concat_8,
    VectorDataFolder=concat_10,
    Fields=panel_64,
    Values=num_5,
    FeatureGeometry=geo_29,
    Export=Button(),
    DriverExtension=".shp",
    DriverType="ESRI Shapefile")
panel_73 = Panel(exportvector)

# ----
# Values
# Fields
# Fields
geo_30 = Geometry(simplify(graft(flatten_3)))
dup_8 = DuplicateDataMatch(SourceDataTree=filter_9, SecondaryData1=dam_9)  # -> SourceData, SecondaryData1
volume_6 = Volume(Geometry=geo_30)  # -> Volume, Centroid
debox = DeconstructBox(Box=geo_30)  # -> Plane, X, Y, Z
dedomain = DeconstructDomain(Domain=debox.Z)  # -> Start, End
m3_to_hm3_2 = Expression(x=volume_6.Volume, Expression="x/1000000")
roundd_8 = RoundToDecimalPlace(NumberX=m3_to_hm3_2, DecimalPlace=Slider(2, range=0..10), RoundType=0)  # -> Rounded, Difference
dam_name_translation_6 = RemoteReceiver(dam_name_translation)
normal_water_level_11 = RemoteReceiver(normal_water_level)
dam_axis_name_7 = RemoteReceiver(dam_axis_name)
dup_9 = DuplicateDataMatch(SourceDataTree=roundd_8.Rounded, SecondaryData1=dam_axis_name_7)  # -> SourceData, SecondaryData1
dup_10 = DuplicateDataMatch(SourceDataTree=roundd_8.Rounded, SecondaryData1=dam_name_translation_6)  # -> SourceData, SecondaryData1
dup_11 = DuplicateDataMatch(SourceDataTree=roundd_8.Rounded, SecondaryData1=normal_water_level_11)  # -> SourceData, SecondaryData1
fields_water_2 = RemoteReceiver(fields_water)
panel_74 = Panel(fields_water_2)

# ---- group: Check - Volume final
volume_7 = Volume(Geometry=dispatch_9.ListB)  # -> Volume, Centroid; disabled
ma_3 = MassAddition(Input=flatten(volume_7.Volume))  # -> Result, PartialResults; disabled
ma_4 = MassAddition(Input=flatten(volume_6.Volume))  # -> Result, PartialResults; disabled
subtraction_5 = Subtraction(A=ma.Result, B=ma_3.Result, C=subtraction_4)  # disabled
volume_final = Panel(ma_4.Result)  # disabled
volume_test = Panel(subtraction_5)  # disabled

# ----
water_total_geo = RemoteSender(geo_30)
unflatten_5 = UnflattenTree(Tree=dup_8.SecondaryData1, Guide=geo_30)
is_dead = RemoteSender(unflatten_5)

# ---- group: Rounding to 0.1
number_slider_11 = Slider(1, range=0..10)
roundd_9 = RoundToDecimalPlace(NumberX=dedomain.Start, DecimalPlace=number_slider_11, RoundType=0)  # -> Rounded, Difference
roundd_10 = RoundToDecimalPlace(NumberX=dedomain.End, DecimalPlace=number_slider_11, RoundType=0)  # -> Rounded, Difference

# ----
water_total_volume = RemoteSender(roundd_8.Rounded)

num_6 = Number(roundd_9.Rounded)
num_7 = Number(roundd_10.Rounded)
merge_16 = Merge(
    Data1=dup_9.SecondaryData1,
    Data2=dup_10.SecondaryData1,
    Data3=dup_11.SecondaryData1,
    Data4=num_6,
    Data5=num_7,
    Data6=roundd_8.Rounded,
    Data7=unflatten_5)
panel_75 = Panel(merge_16)

# ----
# Export
panel_76 = Panel(panel_74)
transform_6 = Transform(Geometry=geo_30, Transform=transform_origin_2)
output_3 = DataOutput(
    A=concat_3,
    B=panel_33,
    C=panel_76,
    D=merge_16,
    E=transform_6,
    Destination="C:\Users\Admin\Documents\Github\EarlyStageDesign\JD\Skripts\ghData\Water_test_to_export.ghdata",
    RelativePath="C:\Users\Admin\Documents\Github\EarlyStageDesign\JD\Skripts\ghData\Water_test_to_export.ghdata|ghData\Water_test_to_export.ghdata")

# ----
# Text  Arch Dam
# Text water volume
# Text axis
water_total_geo_2 = RemoteReceiver(water_total_geo)
is_dead_2 = RemoteReceiver(is_dead)
water_total_volume_2 = RemoteReceiver(water_total_volume)
is_dead_3 = RemoteReceiver(is_dead)
dam_type_17 = RemoteReceiver(dam_type_2)
gravity_volume_2 = RemoteReceiver(gravity_volume)
archdam_volume_3 = RemoteReceiver(archdam_volume)
embankment_volume_2 = RemoteReceiver(embankment_volume)
dam_type_18 = RemoteReceiver(dam_type_2)
chord_dam_9 = RemoteReceiver(chord_dam)
point_crest_3 = RemoteReceiver(point_crest)
not_2 = GateNot(A=is_dead_3)
chord_dam_10 = RemoteReceiver(chord_dam)
dam_axis_name_8 = RemoteReceiver(dam_axis_name)
midpt_3 = CurveMiddle(Curve=chord_dam_9)
number_slider_12 = Slider(100, range=0..100)
not_3 = GateNot(A=is_dead_2)
dispatch_10 = Dispatch(List=water_total_volume_2, DispatchPattern=not_2)  # -> ListA, ListB
filter_11 = StreamFilter(Gate=dam_type_17, Stream0=gravity_volume_2, Stream1=archdam_volume_3, Stream2=embankment_volume_2)
filter_12 = StreamFilter(Gate=dam_type_18, Stream0=midpt_3, Stream1=point_crest_3, Stream2=midpt_3)
midpt_4 = CurveMiddle(Curve=chord_dam_10)
dispatch_11 = Dispatch(List=water_total_geo_2, DispatchPattern=not_3)  # -> ListA, ListB
ma_5 = MassAddition(Input=flatten(dispatch_10.ListA))  # -> Result, PartialResults
ma_6 = MassAddition(Input=flatten(dispatch_10.ListB))  # -> Result, PartialResults
panel_77 = Panel("Volume: {0:0,0} m3")
mesh_14 = Mesh(flatten(dispatch_11.ListA))
Z_8 = UnitZ(Factor=number_slider_12)
panel_78 = Panel("""Total capacity: {0:0,0.0} hm3
Useful capacity: {1:0,0.0} hm3
Dead capacity: {2:,0.00} hm3""")
number_slider_13 = Slider(100, range=0..100)
mesh_15 = Mesh(flatten(dispatch_11.ListB))
ma_7 = MassAddition(Input=flatten([ma_5.Result, ma_6.Result]))  # -> Result, PartialResults
move_12 = Move(Geometry=midpt_4, Motion=Z_8)  # -> Geometry, Transform
item_43 = ListItem(List=flatten(mesh_14), Index=0, Wrap=True)
format_6 = Format(Format=panel_77, Culture=2055, Data0=filter_11)
ln_12 = Line(StartPoint=midpt_4, EndPoint=move_12.Geometry)
font_size_2 = RemoteReceiver(font_size)
center_7 = Center(Geometry=flatten(dispatch_11.ListA), forall=True)  # -> Center, Dimension
center_8 = Center(Geometry=mesh_15, forall=True)  # -> Center, Dimension
center_9 = Center(Geometry=item_43, forall=True)  # -> Center, Dimension
Z_9 = UnitZ(Factor=number_slider_13)
text_dot = TextDot(Location=move_12.Geometry, PrimaryText=dam_axis_name_8, TextHeight=font_size_2)
leader_2 = RemoteSender(ln_12)
format_7 = Format(Format=panel_78, Culture=2055, Data0=ma_7.Result, Data1=ma_5.Result, Data2=ma_6.Result)
move_13 = Move(Geometry=filter_12, Motion=Z_9)  # -> Geometry, Transform
item_44 = ListItem(List=format_7, Index=0, Wrap=True)  # -> Item, Item1, Item2
ln_13 = Line(StartPoint=filter_12, EndPoint=move_13.Geometry)
number_slider_14 = Slider(324, range=0..500)
number_slider_15 = Slider(336, range=0..500)
number_slider_16 = Slider(293, range=0..500)
leader_3 = RemoteSender(ln_13)
font_size_3 = RemoteReceiver(font_size)
objfromgroup_8 = GetObjectsInGroup()
Z_10 = UnitZ(Factor=number_slider_15)
Z_11 = UnitZ(Factor=number_slider_14)
Z_12 = UnitZ(Factor=number_slider_16)
text_dot_2 = TextDot(Location=move_13.Geometry, PrimaryText=format_6, TextHeight=font_size_3)
move_14 = Move(Geometry=center_7.Center, Motion=Z_10)  # -> Geometry, Transform
move_15 = Move(Geometry=center_9.Center, Motion=Z_11)  # -> Geometry, Transform
move_16 = Move(Geometry=center_8.Center, Motion=Z_12)  # -> Geometry, Transform
entwine_4 = Entwine(Branch00=item_44.Item, Branch01=item_44.Item1, FlattenInputs=True)
entwine_5 = Entwine(Branch00=move_14.Geometry, Branch01=move_15.Geometry, FlattenInputs=True)
font_size_4 = RemoteReceiver(font_size)
ln_14 = Line(StartPoint=center_7.Center, EndPoint=move_14.Geometry)
ln_15 = Line(StartPoint=center_9.Center, EndPoint=move_15.Geometry)
ln_16 = Line(StartPoint=center_8.Center, EndPoint=move_16.Geometry)
text_dot_3 = TextDot(Location=move_16.Geometry, PrimaryText=item_44.Item2, TextHeight=font_size_4)
leader_4 = RemoteSender(ln_16)

lng_13 = ListLength(List=objfromgroup_8)
dup_12 = DuplicateData(Data=show_text, Number=lng_13, Order=True)
onoff_5 = EnableDisableObject(
    Objects=objfromgroup_8,
    Enabled=dup_12,
    AllObjects_Object=[is_dead_2, water_total_volume_2, water_total_geo_2, dispatch_11, dispatch_10, not_3, item_43, mesh_14, center_9, move_14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])
# Arch dam
# Water
water_total_geo_3 = RemoteReceiver(water_total_geo)
is_dead_4 = RemoteReceiver(is_dead)
not_4 = GateNot(A=is_dead_4)
dispatch_12 = Dispatch(List=water_total_geo_3, DispatchPattern=not_4)  # -> ListA, ListB

font_size_5 = RemoteReceiver(font_size)  # disabled
text_dot_4 = TextDot(Location=entwine_5, PrimaryText=entwine_4, TextHeight=font_size_5)  # disabled
leader_5 = RemoteSender(ln_14)  # disabled
leader_6 = RemoteSender(ln_15)  # disabled
preview_3 = CustomPreview(Geometry=dispatch_12.ListA, Material=material_2)  # disabled
objfromgroup_9 = GetObjectsInGroup()

leader_7 = RemoteReceiver([leader_5, leader_6, leader_4, leader_3, leader_2])
curve_preview_6 = CustomCurvePreview(Curve=leader_7, Linetype=<geometry referenced from the Rhino model>, Colour=ColourSwatch(SwatchColor=RGB(69, 69, 69)))
preview_4 = CustomPreview(Geometry=dispatch_12.ListB, Material=material_2)
lng_14 = ListLength(List=objfromgroup_9)
dup_13 = DuplicateData(Data=show_useful_capacity, Number=lng_14, Order=True)
onoff_6 = EnableDisableObject(Objects=objfromgroup_9, Enabled=dup_13, AllObjects_Object=[preview_3, leader_5, leader_6, text_dot_4, font_size_5])

# ==== cluster GHPythonRemote: Connects the Grasshopper Python component to an external Python instance.
python = PythonScript()  # -> gh_parent_doc_dir
# ---------- python: Python ----------
from os import path

gh_parent_doc_dir = path.abspath(path.dirname(ghenv.Component.OnPingDocument().Owner.OnPingDocument().FilePath))
# ---------- end python ----------
# GH to python remote example.
# Pierre Cuvilliers, 2017-2018
# Released under the MIT license
# github.com/pilcru/ghpythonremote
# Runs and connects to an external python engine, and
# assigns imported modules to scriptcontext.sticky variables.
# 
# Arguments:
#       code (str): Path to the GH_to_python_sticky.py code file.
#       location (str): Path to a python executable, or to a folder
#             containing `python.exe`, or the name of a conda-created
#             virtual environment prefixed by `conda://` (`conda://env_name`).
#             If empty, finds python from your windows %PATH%.
#       run (boolean): Creates the connection, and imports new
#             modules, when turned to True. Kills the connection,
#             and deletes the references to the imports, when turned
#             to False.
#       modules (str list): List of module names to import in the
#             remote python. They will be added to the
#             scriptcontext.sticky dictionary, allowing them to be
#             reused from other python components in the same
#             Grasshopper document. Submodules (for example
#             `numpy.linalg` have to be added explicitly to this list
#             to be available later.
#       log_level (str from ['NOTSET', 'DEBUG', 'INFO', 'WARNING', 'ERROR', 'CRITICAL']):
#             Logging level to use for the local IronPython and the
#             remote python instance.
#       working_dir (str): Working directory for the remote python
#             instance.
# 
# Returns:
#       out (str): Console output with DEBUG information.
#       linked_modules (str list): list of imported module names.
#       rpy (rpyc connection object): The object representing the
#             remote Python interpreter.
location = ClusterInput()  # location (str): Path to a python executable, or to a folder containing `python.exe`, or the name of a conda-created virtual environment prefixed by `conda://` (`conda://env_name`). If empty, finds python from your windows %PATH%.
run = ClusterInput()  # run (boolean): Creates the connection, and imports new modules, when turned to True. Kills the connection,and deletes the references to the imports, when turned to False.
modules = ClusterInput()  # modules (str list): List of module names to import in the remote python. They will be added to the scriptcontext.sticky dictionary, allowing them to be reused from other python components in the same Grasshopper document. Submodules (for example `numpy.linalg` have to be added explicitly to this list to be available later.
list = ValueList({"CRITICAL", "ERROR", "WARNING", "INFO", "DEBUG", "NOTSET"}, selected="DEBUG")
panel = Panel(python)
ghpythonremote = GHPythonRemote(location=location, run=run, modules=modules, log_level=list, working_dir=panel)  # -> out, linked_modules, rpy; inputs run: Boolean, modules: list
# ---------- ghpythonremote: Python ----------
import inspect
import logging
from os import path
import sys
from time import sleep

import scriptcontext

import ghpythonremote
from ghpythonremote.connectors import GrasshopperToPythonRemote

local_log_level = getattr(logging, log_level, logging.WARNING)
logger = logging.getLogger("ghpythonremote")
logger.setLevel(local_log_level)
ch = logging.StreamHandler()
ch.setLevel(local_log_level)
formatter = logging.Formatter("%(levelname)s: %(name)s:\n%(message)s")
ch.setFormatter(formatter)
logger.handlers = []
logger.addHandler(ch)
logger = logging.getLogger("ghpythonremote.GH_to_python")

ROOT = path.abspath(path.dirname(inspect.getfile(ghpythonremote)))
rpyc_server_py = path.join(ROOT, "pythonservice.py")

# Set connection to CLOSED if this is the first run
# and initialize set of linked modules
try:
    remote_python_status
except NameError:
    remote_python_status = "CLOSED"
    lkd_modules = set()

# Wait for connection to connect or terminate
timer = 0
while remote_python_status == "CONNECTING" or remote_python_status == "CLOSING":
    sleep(1)
    timer += 1
    if timer == 10:
        try:
            gh2py_manager.__exit__(*sys.exc_info())
        except Exception:
            pass
        remote_python_status = "CLOSED"
        lkd_modules = set()
        raise RuntimeError(
            "Connection left in an inconsistent state and not returning. Reset "
            "everything."
        )

if run:
    if not remote_python_status == "OPEN":
        remote_python_status = "CONNECTING"
        gh2py_manager = GrasshopperToPythonRemote(
            rpyc_server_py,
            location=location,
            timeout=10,
            port=None,
            log_level=log_level,
            working_dir=working_dir,
        )
        gh2py = gh2py_manager.__enter__()
        remote_python_status = "OPEN"

    # Stuff that we can reach
    rpymod = gh2py.py_remote_modules  # A getter function for a named python module
    rpy = gh2py.connection  # Represents the remote instance root object
    scriptcontext.sticky["rpy"] = rpy
    # Add modules
    for mod in modules:
        try:
            scriptcontext.sticky[mod] = rpymod(mod)
            lkd_modules.add(mod)
        except ImportError:
            gh2py_manager.__exit__(*sys.exc_info())
            raise

elif not remote_python_status == "CLOSED":
    remote_python_status = "CLOSING"
    # Remove linked modules
    for mod in lkd_modules:
        del scriptcontext.sticky[mod]
    del scriptcontext.sticky["rpy"]
    gh2py_manager.__exit__(*sys.exc_info())
    lkd_modules = set()
    remote_python_status = "CLOSED"

# Change variable name because ghpython resets outputs to None before each run
linked_modules = lkd_modules

logger.info("GH to python connection is {}".format(remote_python_status))
# ---------- end ghpythonremote ----------
out = ClusterOutput(ghpythonremote.out)  # Console output.
linked_modules = ClusterOutput(ghpythonremote.linked_modules)  # Names of modules that were successfully added to the scriptcontext.sticky dictionary.
rpy = ClusterOutput(ghpythonremote.rpy)  # The object representing the remote python instance
python_2 = PythonScript(module_names=ghpythonremote.linked_modules)  # -> import_statements; inputs module_names: list
# ---------- python_2: Python ----------
import_statements = ["import scriptcontext as sc"]
for module_name in module_names:
    import_statements.append("{0} = sc.sticky['{0}']".format(module_name))

if len(module_names) == 0:
    import_statements = []
# ---------- end python_2 ----------
import_statements = ClusterOutput(python_2)  # Useful import statements to use the imported modules in your scripts.
