# Grasshopper definition JD_Beta_close origin_design.gh (Grasshopper 1.0.7)
# plug-ins: Telepathy, MetaHopper, UiPlus, Heteroptera, Pufferfish, MeshEdit Components, Hops, Heron, EleFront, TT Toolbox, RhinoCodePluginGH

# Water fields
panel = Panel("Resources\Translations\Water_en.txt")
# Arch Dam fields
panel_2 = Panel("Resources\Translations\ArchDam_en.txt")

panel_3 = Panel("""Concrete gravity dam
Arch dam
Embankment dam""")
# Dam configuration
# Dashboard structure
panel_4 = Panel("Type of Dam (m)")

# ----
# Requirements hops scripts
panel_5 = Panel("Modules\Gravity.gh")
# Requirements plugins
panel_6 = Panel("""UI+
Metahopper
Pufferfish""")
# Language translation
list = ValueList({"English": 0, "French": 1, "German": 2}, selected="German")

# ---- group: INFO
# _________________________________
# 
# This file is done based on the rhino file:
# _________________________________
# "C:\Users\Admin\Gruner AG\BSBE [ORG] - Digitale Anwendungen ESD\04_Projekte\2023\CH_VS_Barrage Les Toules_SensitivityAnalysis_JD\Model\231708_Le toules-WSCH00320.3dm"
# Images folder - saved where the gh file is
# Image size settings
number_slider = Slider(700, range=0..1000)
# Infos & Settings
panel_7 = Panel("231708_Le toules.3dm")
viewport_1_for_images = Panel("Perspektive")
viewport_2_for_images = Panel("Drauf")
# Settings
viewport_3_for_images = Panel("Detail")
relpath = RelativePath(Path="Bilder")
multiplication = Multiplication(A=number_slider, B="7")
multiplication_2 = Multiplication(A=number_slider, B="5")
panel_8 = Panel(relpath)
viewport_name_3 = RemoteSender(viewport_3_for_images)
viewport_name_1 = RemoteSender(viewport_1_for_images)
viewport_name_2 = RemoteSender(viewport_2_for_images)
panel_9 = Panel("1446")
panel_10 = Panel(multiplication)
panel_11 = Panel("883")
panel_12 = Panel(multiplication_2)

# ----
# System unit
unit_system = UnitSystem(4)
# Today date
panel_13 = Panel("Today")
panel_14 = Panel("C:\Users\Admin\Gruner AG\Jumping dams [EXP] - General\03_Model\Les Toules")
# Language formatting (translation and numbers)
culture = Culture(4108)
culture_2 = Culture(2055)
culture_3 = Culture(2057)
time = Time(panel_13)
panel_15 = Panel(unit_system)
panel_16 = Panel(culture_3)
relpath_2 = RelativePath(Path=panel)
panel_17 = Panel(culture)
panel_18 = Panel(culture_2)
relpath_3 = RelativePath(Path="Resources\Translations\Water_fr.txt")
relpath_4 = RelativePath(Path="Resources\Translations\Water_en.txt")
relpath_5 = RelativePath(Path=panel_2)
relpath_6 = RelativePath(Path="Resources\Translations\ArchDam_fr.txt")
relpath_7 = RelativePath(Path="Resources\Translations\ArchDam_en.txt")
panel_19 = Panel(time)
label = UiLabel(Label="Freeboard (m)", Style=3)
label_2 = UiLabel(Label=panel_4, Style=3)
label_3 = UiLabel(Label="Minimum water level", Style=3)
scroll_number = UiScrollNumber(Label="(m.asl)", Number=0, Wrap=False, Digits=3)
label_4 = UiLabel(Label="Normal water level (m.asl)", Style=3)
slider = UiSlider(Value=0.5, Bounds=Domain(0, 1), Increment=0.1)
srs = SetSpatialReferenceSystem(SRS="EPSG:2056")
label_5 = UiLabel(Label="Foundation depth (m)", Style=3)
button = UiButton(Label="Ok")
slider_2 = UiSlider(Value=0.5, Bounds=Domain(0, 1), Increment=0.1)
file = ReadFile(File=relpath_2, PerLineParse=True)
file_2 = ReadFile(File=relpath_3, PerLineParse=True)
file_3 = ReadFile(File=relpath_4, PerLineParse=True)
file_4 = ReadFile(File=relpath_5, PerLineParse=True)
file_5 = ReadFile(File=relpath_6, PerLineParse=True)
relpath_8 = RelativePath(Path="Modules\Dashboard_damConfiguration")
relpath_9 = RelativePath(Path="Modules\Embankment.gh")
relpath_10 = RelativePath(Path="Modules\Arch.gh")
relpath_11 = RelativePath(Path=panel_5)
file_6 = ReadFile(File=relpath_7, PerLineParse=True)
english = Panel(file)
french = Panel(file_2)
german = Panel(file_3)
english_2 = Panel(file_4)
french_2 = Panel(file_5)
german_2 = Panel(file_6)
merge = Merge(Data1=label_5, Data2=slider_2)
merge_2 = Merge(Data1=relpath_11, Data2=relpath_10, Data3=relpath_9, Data4=relpath_8)
merge_3 = Merge(Data1=label, Data2=slider)
merge_4 = Merge(Data1=label_3, Data2=scroll_number)
path_save = RemoteSender(panel_14)
panel_20 = Panel(merge_2)
filepath_hops = RemoteSender(merge_2)
filter = StreamFilter(Gate=list, Stream0=english, Stream1=french, Stream2=german)  # -> flatten(Stream)
filter_2 = StreamFilter(Gate=list, Stream0=english_2, Stream1=french_2, Stream2=german_2)  # -> flatten(Stream)
format = Format(Format="{0:translate}", Culture=culture, Data0="Arch")
fields_water = RemoteSender(filter)
fields_archdam = RemoteSender(filter_2)
slider_3 = UiSlider(Element=slider, Label="m", Value="3", Bounds="0 To 5", Increment=".1")
button_2 = UiButton(Element=button, Label="Send changes")
slider_4 = UiSlider(Element=slider_2, Label="m", Value="10", Bounds="0 To 50", Increment=".1")
heights = Panel("1747.5")
adjust_reservoir_to_dam = Button()
run_pre_geometry_of_water = Button()  # disabled
# Select dam type
heights_2 = Panel("""1836
1839
1842
1844""")
run_water_final = Button()
# Run Dam
# Select dam type
list_2 = ValueList({"Concrete gravity dam": "0", "Arch dam": "1", "Embankment dam": "2"}, selected="Arch dam")
dam_configuration = Button()
run_arch_dam = Button()
get_values = UiValues(Element=slider_3)  # -> flatten(Values)
get_values_2 = UiValues(Element=slider_4)  # -> flatten(Values)
get_values_3 = UiValues(Element=button_2)  # -> flatten(Values)
# Dashboard - fill in data and listen to outputs
dam_type_index = Panel("""0
1
2""")
num = Number(heights_2)
minimum_normal_water_level_preset = RemoteSender(heights)
minimum_normal_water_level_preset_2 = RemoteReceiver(minimum_normal_water_level_preset)
scroll_number_2 = UiScrollNumber(Element=scroll_number, Number=minimum_normal_water_level_preset_2, Wrap=False, Digits=Slider(1, range=0..1))
get_values_4 = UiValues(Element=scroll_number_2)  # -> flatten(Values)
minimum_water_level_m_input_from_dashboa = Panel(get_values_4)  # "Minimum water level (m) - Input from Dashboard"
freeboard_m_input_from_dashboard = Panel(get_values)
run_water_final_2 = RemoteSender(run_water_final)
run_water_pre = RemoteSender(adjust_reservoir_to_dam)
offset_foundation_m_input_from_dashboard = Panel(get_values_2)
panel_21 = Panel(get_values_3)
# must be a closed volume!
run_archdam = RemoteSender(run_arch_dam)
sort = SortList(Keys=heights_2, ValuesA=num)  # -> Keys, ValuesA
panel_22 = Panel("""False
False
False""")
list_of_heights = RemoteSender(sort.ValuesA)
list_of_heights_2 = RemoteReceiver(list_of_heights)
dropdown_list = UiDropdownList(Values=list_of_heights_2)
merge_5 = Merge(Data1=label_4, Data2=dropdown_list)
list_of_heights_3 = RemoteReceiver(list_of_heights)
dropdown_list_2 = UiDropdownList(Element=dropdown_list, Values=list_of_heights_3, Index=Slider(0, range=0..10))
get_values_5 = UiValues(Element=dropdown_list_2)  # -> flatten(Values)
item = ListItem(List=list_of_heights_3, Index=get_values_5, Wrap=True)
water_level_m_input_from_dashboard = Panel(item)
replace = ReplaceItems(List=panel_22, Item="True", Indices=list_2, Wrap=False)
dam_selection = RemoteSender(replace)
dam_selection_2 = RemoteReceiver(dam_selection)
panel_23 = Panel(dam_selection_2)
radio = UiRadio(Label=panel_3, State=panel_23, Group="Group 1")
merge_6 = Merge(Data1=label_2, Data2=radio)  # -> flatten(Result)
merge_7 = Merge(Data1=merge_6, Data2=merge_5, Data3=merge_4, Data4=merge_3, Data5=merge, Data6=button)
get_values_6 = UiValues(Element=radio)  # -> flatten(Values)
dam_type = Panel(get_values_6)
dispatch = Dispatch(List=dam_type_index, DispatchPattern=dam_type)  # -> ListA, ListB
dashboard_damconfiguration = RemoteSender(dam_configuration)
dashboard_damconfiguration_2 = RemoteReceiver(dashboard_damconfiguration)
window = UiWindow(Elements=merge_7, Title="Dam Configuration", Owner=1, Scroll=True, Launch=dashboard_damconfiguration_2)
minimum_water_level = RemoteSender(minimum_water_level_m_input_from_dashboa)

dam = DataDam(
    DataA=dispatch.ListA,
    DataB=water_level_m_input_from_dashboard,
    DataC=freeboard_m_input_from_dashboard,
    DataD=offset_foundation_m_input_from_dashboard,
    BufferDelay=5000000,
    BufferMode=0)  # -> DataA, DataB, DataC, DataD
dam_2 = DataDam(DataA=dispatch.ListA, BufferDelay=2500000, BufferMode=0)
objfromgroup = GetObjectsInGroup()

dam_3 = DataDam(DataA=freeboard_m_input_from_dashboard, BufferDelay=10000000, BufferMode=0)  # disabled
dam_4 = DataDam(DataA=offset_foundation_m_input_from_dashboard, BufferDelay=10000000, BufferMode=0)  # disabled

lng = ListLength(List=objfromgroup)
dup = DuplicateData(Data=panel_21, Number=lng, Order=True)

inpupt_offset_foundation_m = Panel(dam.DataD)
addition = Addition(A=dam.DataB, B=dam.DataC)
bool = Boolean(dup)
normal_water_level = RemoteSender(dam.DataB)
dam_level = RemoteSender(addition)
dam_type_2 = RemoteSender(dam_2)
dam_type_3 = RemoteReceiver(dam_type_2)
num_2 = Number(dam_type_3)
S = Script(lan=list, i=num_2)  # -> out, a
# ---------- S: Python ----------
"""05.10.2023 - CNA"""
"""updated to rhino beta 27.10.2023 - CNA"""

if lan == 0:
    if i == 0:
        a = "Gravity"
    elif i == 1:
        a = "Arch" 
    elif i == 2:
        a = "Embankment"

if lan == 1:
    if i == 0:
        a = "Poids"
    elif i == 1:
        a = "Voûtes" 
    elif i == 2:
        a = "Digue"
# ---------- end S ----------
panel_24 = Panel(S.a)
dam_name_translation = RemoteSender(S.a)
freeboard = RemoteSender(dam.DataC)
offset_foundation = RemoteSender(dam.DataD)
setobj = SetObjectValue(ObjectToSet=flatten(objfromgroup), ValueToSet=flatten(bool))
panel_25 = Panel(lng)
# Formulas - conservative as compared with values computed more precisely (in feet)
panel_26 = Panel(dup)
vector_send_to_local_0 = Panel("{-2.5815e+6,-1.083e+6,0}")
vector_back_to_lv95 = Panel("{2.5815e+6,1.083e+6,0}")
mesh = GeometryPipeline(
    GroupByLayer=False,
    GroupByType=False,
    IncludeHidden=True,
    IncludeLocked=True,
    LayerFilter="Terrain_brep_offset_-10",
    NameFilter="*",
    SublayerFiltering=True,
    TypeFilter=1073741848)
pipeline = GeometryPipeline(
    GroupByLayer=False,
    GroupByType=False,
    IncludeHidden=True,
    IncludeLocked=True,
    LayerFilter="Terrain_levels",
    NameFilter="*",
    SublayerFiltering=True,
    TypeFilter=4)
mesh_2 = GeometryPipeline(
    GroupByLayer=False,
    GroupByType=False,
    IncludeHidden=True,
    IncludeLocked=True,
    LayerFilter="Terrain_brep",
    NameFilter="*",
    SublayerFiltering=True,
    TypeFilter=1073741848)

pipeline_2 = GeometryPipeline(
    GroupByLayer=False,
    GroupByType=False,
    IncludeHidden=True,
    IncludeLocked=True,
    LayerFilter="Gravity::Axes::*",
    NameFilter="*",
    SublayerFiltering=True,
    TypeFilter=4)
pipeline_3 = GeometryPipeline(
    GroupByLayer=False,
    GroupByType=False,
    IncludeHidden=True,
    IncludeLocked=True,
    LayerFilter="Arch::Axes::*",
    NameFilter="*",
    SublayerFiltering=True,
    TypeFilter=4)
pipeline_4 = GeometryPipeline(
    GroupByLayer=False,
    GroupByType=False,
    IncludeHidden=True,
    IncludeLocked=True,
    LayerFilter="Embankment::Axes::*",
    NameFilter="*",
    SublayerFiltering=True,
    TypeFilter=4)
pipeline_5 = GeometryPipeline(
    GroupByLayer=False,
    GroupByType=False,
    IncludeHidden=True,
    IncludeLocked=True,
    LayerFilter="New designs",
    NameFilter="*",
    SublayerFiltering=True,
    TypeFilter=4)

pipeline_6 = GeometryPipeline(
    GroupByLayer=False,
    GroupByType=False,
    IncludeHidden=True,
    IncludeLocked=True,
    LayerFilter="Upstream_point",
    NameFilter="*",
    SublayerFiltering=True,
    TypeFilter=1)
pipeline_7 = GeometryPipeline(
    GroupByLayer=False,
    GroupByType=False,
    IncludeHidden=True,
    IncludeLocked=True,
    LayerFilter="Upstream_point",
    NameFilter="*",
    SublayerFiltering=True,
    TypeFilter=4)
mesh_3 = GeometryPipeline(
    GroupByLayer=False,
    GroupByType=False,
    IncludeHidden=True,
    IncludeLocked=True,
    LayerFilter="Terrain_base_curve",
    NameFilter="*",
    SublayerFiltering=True,
    TypeFilter=4)
dam_type_4 = RemoteReceiver(dam_type_2)
filter_3 = StreamFilter(Gate=dam_type_4, Stream0=pipeline_2, Stream1=pipeline_3, Stream2=pipeline_4)
merge_8 = Merge(Data1=filter_3, Data2=pipeline_5)
details = ContentDetails(Content=merge_8)  # -> Content, Id, Path, Attributes
flip = FlipCurve(Curve=merge_8, Guide=pipeline_7)  # -> Curve, Flag
project = Project(Geometry=flip.Curve, Plane=PlaneXY(0, 0, 0))  # -> Geometry, Transform
panel_27 = Panel(details.Path)
jagged = SettingsSpeed()
axis_selection = Slider(1, range=0..8)

# ---- group: Automation slider
connected = GetConnectedObjects(Objects=axis_selection)
lng_2 = ListLength(List=merge_8)
x_minus_one = XMinusOne(NumberX=lng_2)
set_slider = SetSliderProperties(Slider=connected, Range=x_minus_one, Type=1)

# ----
jagged_2 = SettingsSpeed()
mesh_4 = MeshBrep(Brep=mesh, Settings=jagged)
transform = Transform({TransformCount=1, Name="Translation", tx=-2580598.7, ty=-1083020.6, tz=0})
explode = Explode(Curve=mesh_3, Recursive=True)  # -> Segments, Vertices
brep = Brep(mesh_3)  # disabled
mesh_5 = MeshBrep(Brep=mesh_2, Settings=jagged_2)
inverse = InverseTransform(Transform=transform)
item_2 = ListItem(List=project.Geometry, Index=axis_selection, Wrap=True)
item_3 = ListItem(List=details.Path, Index=axis_selection, Wrap=True)
conmesh = ConstructMesh(Vertices=explode.Vertices, Faces={A=0, B=1, C=2, D=3})
transform_origin = RemoteSender(inverse)
brep_terrain_base_foundation = RemoteSender(mesh)
panel_28 = Panel(item_3)
dam_5 = DataDam(DataAxis=item_2, DataName=item_3, BufferDelay=10000000, BufferMode=0)  # -> DataAxis, DataName
mesh_terrain_flattened = RemoteSender(conmesh)
mesh_terrain_offset = RemoteSender(mesh_4)
brep_terrain_base = RemoteSender(brep)  # disabled
brep_terrain = RemoteSender(mesh_2)
mesh_terrain = RemoteSender(mesh_5)
lines_levels = RemoteSender(pipeline)
dam_axis_name = RemoteSender(dam_5.DataName)
dam_axis = RemoteSender(dam_5.DataAxis)
number_slider_2 = Slider(0.81, range=0..1)
rad = Radians(Degrees=Slider(90, range=0..100))
dam_level_2 = RemoteReceiver(dam_level)
brep_terrain_base_foundation_2 = RemoteReceiver(brep_terrain_base_foundation)
dam_axis_2 = RemoteReceiver(dam_axis)

# ---- group: Selecting dam height level
# This changes when the axis line calculate and recalculate the basics again
brep_terrain_2 = RemoteReceiver(brep_terrain)

# ----
rad_2 = Radians(Degrees=Slider(158, range=0..180))
number_slider_3 = Slider(100, range=0..100)
Z = UnitZ(Factor=dam_level_2)
move = Move(Geometry=dam_axis_2, Motion=Z)  # -> Geometry, Transform
neg = Negative(Value=number_slider_3)
# Technical Memorandum No. EM36-86-68110: 2.1.3 Lines of Centers
# 
# The lines of centers define the horizontal shape of the arches in an arch dam. The shape of the arches starts at the crown cantilever and curves horizontally downstream toward the abutments. The line of centers create the geometry of the circular arcs at each elevation of the dam for the upstream and downstream faces by defining the center point of a circle and the radius of the circle. Depending on the shape and number of lines of centers, the arches can be
# 1) uniform thickness from abutment to abutment,
# 2) variable thickness from abutment to abutment,
# 3) different on the left side of the dam compared to the right side of the dam, or
# 4) different in the center of the dam compared to the outer part of the dam.
# Technical Memorandum No. EM36-86-68110: A double curvature arch dam has curvature in the arches and in the crown cantilever.
panel_29 = Panel(" 1 meter = 3.28084 feet")
axis_at_height = RemoteSender(move.Geometry)

axis_at_height_2 = RemoteReceiver(axis_at_height)
Z_2 = UnitZ(Factor=Slider(200, range=0..1000))
mesh_terrain_2 = RemoteReceiver(mesh_terrain)
neg_2 = Negative(Value=Z_2)
move_2 = Move(Geometry=axis_at_height_2, Motion=neg_2)  # -> Geometry, Transform
Z_3 = UnitZ(Factor=Slider(1000, range=0..1000))
mesh_terrain_offset_2 = RemoteReceiver(mesh_terrain_offset)
extr = Extrude(Base=move_2.Geometry, Direction=Z_3)
mmx = MeshMesh(MeshA=[mesh_terrain_offset_2, mesh_terrain_2], MeshB=extr)  # -> simplify(Intersections)
section_lines_gravity = RemoteSender(mmx)

dom = ConstructDomain(DomainStart=number_slider_3, DomainEnd=neg)
rotate = Rotate(Angle=1.570796327, Plane=PlaneXY(0, 0, 0))  # -> Geometry, Transform
normal_water_level_2 = RemoteReceiver(normal_water_level)
dam_level_3 = RemoteReceiver(dam_level)
rad_3 = Radians(Degrees=Slider(-37, range=-135..135))
scx = SurfaceCurve(Surface=brep_terrain_2, Curve=move.Geometry)  # -> Curves, flatten(Points), UVPoints, Normals, Parameters, Tangents
Z_4 = UnitZ(Factor=dam_level_3)

# ---- group: Finding the crest points at bottom EXCAVATION
scx_2 = SurfaceCurve(Surface=brep_terrain_base_foundation_2, Curve=move.Geometry)  # -> Curves, flatten(Points), UVPoints, Normals, Parameters, Tangents
item_4 = ListItem(List=scx_2.Points, Index=0, Wrap=True)  # -> Item, Item1

# ----
Z_5 = UnitZ(Factor=normal_water_level_2)
section_lines_gravity_2 = RemoteReceiver(section_lines_gravity)
sec = BrepPlane(Brep=brep_terrain_2, Plane=Z_5)  # -> Curves, Points
sec_2 = BrepPlane(Brep=brep_terrain_2, Plane=Z_4)  # -> Curves, Points
item_5 = ListItem(List=scx.Points, Index=0, Wrap=True)  # -> Item, Item1
path = ConstructPath(Indices=Slider(0, range=0..1))
ln = Line(StartPoint=item_5.Item, EndPoint=item_5.Item1)

# ---- group: AXIS LINE
ln_2 = Line(StartPoint=item_4.Item, EndPoint=item_4.Item1)

# ----
split = SplitTree(Data=section_lines_gravity_2, Masks=flatten(path))  # -> Positive, Negative
join = JoinCurves(Curves=sec_2.Curves, Preserve=True)
join_2 = JoinCurves(Curves=sec.Curves, Preserve=False)
len = Length(Curve=ln)
chord_dam = RemoteSender(ln_2)
chord_dam_2 = RemoteReceiver(chord_dam)
eval = EvaluateCurve(Curve=reparameterize(chord_dam_2), Parameter=number_slider_2)  # -> Point, Tangent, Angle
rotate_2 = Rotate(Geometry=eval.Tangent, Angle=rad, Plane=PlaneXY(0, 0, 0))  # -> Geometry, Transform
rotate_3 = Rotate(Geometry=eval.Tangent, Angle=rad_2, Plane=PlaneXY(0, 0, 0))  # -> Geometry, Transform
pl = PlaneNormal(Origin=eval.Point, ZAxis=rotate_3.Geometry)
vdisex = VectorDisplayEx(Point=eval.Point, Vector=rotate_3.Geometry, Colour=RGB(0, 0, 0), Width=2)
vdisex_2 = VectorDisplayEx(Point=eval.Point, Vector=eval.Tangent, Colour=RGB(0, 0, 0), Width=2)
planesrf = PlaneSurface(Plane=pl, XSize=dom, YSize=dom)
yz = YZPlane(Origin=pl)
rotate_4 = Rotate(Geometry=planesrf, Angle=rad_3, Plane=yz)  # -> Geometry, Transform
chord_dam_3 = RemoteReceiver(chord_dam)
txt = Text(join_2)
txt_2 = Text(join)
axis_straight_terrain = RemoteSender(len)
downstream_face_angle_ratio_1 = Slider(0.8, range=0..1)
downstream_face_angle_ratio_1_2 = Slider(0.8, range=0..1)
end = EndPoints(Curve=chord_dam_3)  # -> Start, End
dam_crest_width = Slider(6, range=0..100)
mindex = MemberIndex(Set=txt, Member="Closed Planar Curve")  # -> Index, Count
mindex_2 = MemberIndex(Set=txt_2, Member="Closed Planar Curve")  # -> Index, Count
dam_crest_width_2 = Slider(20, range=0..100)
ptstrimcrv = PointsTrimCurve(Curve=split.Positive, Points=[end.Start, end.End], Flip=False)  # -> Trimmed, SubDomains, Intersected
cull_i = CullIndex(List=join_2, Indices=mindex.Index, Wrap=True)
cull_i_2 = CullIndex(List=join, Indices=mindex_2.Index, Wrap=True)
dedomain = DeconstructDomain(Domain=ptstrimcrv.SubDomains)  # -> reverse(Start), End
item_6 = ListItem(List=dedomain.Start, Index=0, Wrap=True)
item_7 = ListItem(List=dedomain.End, Index=0, Wrap=True)
gravity_width_crest = RemoteSender(dam_crest_width)
embankment_width_crest = RemoteSender(dam_crest_width_2)
gravity_ds_ration = RemoteSender(downstream_face_angle_ratio_1)
embankment_ds_ration = RemoteSender(downstream_face_angle_ratio_1_2)
len_2 = Length(Curve=cull_i_2)
len_3 = Length(Curve=cull_i)
subtraction = Subtraction(A=number_slider_2, B=Slider(0.1, range=0..0.1))
shatter = Shatter(Curve=split.Positive, Parameters=[item_6, item_7])
larger = LargerThan(FirstNumber=len_2, SecondNumber=Slider(2, range=0..10))  # -> LargerThan, OrEqualTo
chord_dam_4 = RemoteReceiver(chord_dam)
larger_2 = LargerThan(FirstNumber=len_3, SecondNumber=Slider(2, range=0..10))  # -> LargerThan, OrEqualTo
item_8 = ListItem(List=shatter, Index=1, Wrap=True)
dispatch_2 = Dispatch(List=cull_i_2, DispatchPattern=larger.LargerThan)  # -> ListA, ListB
dispatch_3 = Dispatch(List=cull_i, DispatchPattern=larger_2.LargerThan)  # -> ListA, ListB
shatter_2 = Shatter(Curve=reparameterize(chord_dam_4), Parameters=subtraction)
end_2 = EndPoints(Curve=dispatch_2.ListA)  # -> Start, End
end_3 = EndPoints(Curve=dispatch_3.ListA)  # -> Start, End
# surface
brep_terrain_base_foundation_3 = RemoteReceiver(brep_terrain_base_foundation)
# surface
brep_terrain_base_foundation_4 = RemoteReceiver(brep_terrain_base_foundation)
item_9 = ListItem(List=shatter_2, Index=1, Wrap=True)
# number
embankment_ds_ration_2 = RemoteReceiver(embankment_ds_ration)
pt = Point([end_2.Start, end_2.End])
# number
embankment_width_crest_2 = RemoteReceiver(embankment_width_crest)
# number
gravity_width_crest_2 = RemoteReceiver(gravity_width_crest)
# number
gravity_ds_ration_2 = RemoteReceiver(gravity_ds_ration)
# line
chord_dam_5 = RemoteReceiver(chord_dam)
pt_2 = Point([end_3.Start, end_3.End])
# number
gravity_width_crest_3 = RemoteReceiver(gravity_width_crest)
# line
chord_dam_6 = RemoteReceiver(chord_dam)
# number
gravity_ds_ration_3 = RemoteReceiver(gravity_ds_ration)
brep_terrain_base_foundation_5 = RemoteReceiver(brep_terrain_base_foundation)
incurve = PointInCurve(Point=pt, Curve=mesh_3)  # -> Relationship, Point
# surface
# line
flip_2 = FlipCurve(Curve=item_9)  # -> Curve, Flag
incurve_2 = PointInCurve(Point=pt_2, Curve=mesh_3)  # -> Relationship, Point
list_3 = ValueList({"Concrete gravity dam": 0, "Arch dam": 1, "Embankment dam": 2}, selected="Concrete gravity dam")  # disabled
filepath_hops_2 = RemoteReceiver(filepath_hops)  # disabled
equals = Equality(FirstNumber=incurve.Relationship, SecondNumber="2")  # -> Equality, Inequality
equals_2 = Equality(FirstNumber=incurve_2.Relationship, SecondNumber="2")  # -> Equality, Inequality
dispatch_4 = Dispatch(List=pt, DispatchPattern=equals.Equality)  # -> ListA, ListB
midpt = CurveMiddle(Curve=flip_2.Curve)
end_4 = EndPoints(Curve=flip_2.Curve)  # -> Start, End
dispatch_5 = Dispatch(List=pt_2, DispatchPattern=equals_2.Equality)  # -> ListA, ListB
item_10 = ListItem(List=filepath_hops_2, Index=list_3, Wrap=True)  # disabled
brep_terrain_base_foundation_6 = RemoteReceiver(brep_terrain_base_foundation)  # disabled
panel_30 = Panel("""All in meters

Dam height: {3}
Radius = 0.6xL1 + Adjustment = {0} + {8} : {9}
L1: {1}
tc: {2}
USP base: {4}
DSP base: {5}
USP @ 0.45H: {6}
Volume if calculated with the equations: {7}
Free board: {10}
Offset foundation: {11}""")
# GRAVITY DAM addition
x_tremez = Extremes(Curve=item_8, Plane=PlaneXY(0, 0, 0))  # -> Highest, Lowest
pline = PolyLine(Vertices=dispatch_4.ListA, Closed=False)
brep_terrain_base_foundation_7 = RemoteReceiver(brep_terrain_base_foundation)
pline_2 = PolyLine(Vertices=dispatch_5.ListA, Closed=False)
panel_31 = Panel(item_10)  # disabled
panel_32 = Panel("""Radius: {9}
L1: {1}
tc: {2}
USP base: {4}
DSP base: {5}
USP at 45%H: {6}
Volume if calculated with the equations: {7}
Free board: {10}
Offset foundation: {11}""")
gravity_ds_ration_4 = RemoteReceiver(gravity_ds_ration)  # disabled
offset_foundation_2 = RemoteReceiver(offset_foundation)
chord_dam_7 = RemoteReceiver(chord_dam)  # disabled
width_crest = RemoteReceiver()  # disabled
brep_terrain_3 = RemoteReceiver(brep_terrain)
chord_dam_8 = RemoteReceiver(chord_dam)
join_3 = JoinCurves(Curves=[dispatch_2.ListA, pline], Preserve=False)
freeboard_2 = RemoteReceiver(freeboard)
offset_foundation_3 = RemoteReceiver(offset_foundation)
mesh_terrain_offset_3 = RemoteReceiver(mesh_terrain_offset)
chord_dam_9 = RemoteReceiver(chord_dam)
join_4 = JoinCurves(Curves=[dispatch_3.ListA, pline_2], Preserve=False)
offset_foundation_4 = RemoteReceiver(offset_foundation)
# ARCH DAM
# Steps from the Technical Memorandum
#  No. EM36-86-68110
mesh_terrain_3 = RemoteReceiver(mesh_terrain)
freeboard_3 = RemoteReceiver(freeboard)
pdecon = Deconstruct(Point=x_tremez.Lowest)  # -> XComponent, YComponent, ZComponent
pdecon_2 = Deconstruct(Point=midpt)  # -> XComponent, YComponent, ZComponent
axis_at_height_3 = RemoteReceiver(axis_at_height)
path_2 = FilePath(panel_31)  # disabled
levels_at_water_height = RemoteSender(join_4)

raxis_adjustments = Slider(20, range=-30..30)

levels_dam_height = RemoteSender(join_3)
hops = Hops(
    _Path=path_2,
    CacheResultsInMemory=True,
    CacheSolveResults=True,
    RemoteDefinitionLocation="C:\Users\Admin\Documents\Github\EarlyStageDesign\JD\Skripts\Modules\Gravity.gh",
    RemoteSolveVersion=(0, 1, 0),
    ShowInput_Enabled=False,
    ShowInput_Path=True,
    SynchronousSolve=True)  # disabled
subtraction_2 = Subtraction(A=pdecon_2.ZComponent, B=pdecon.ZComponent)
list_4 = ValueList({"Concrete gravity dam": 0, "Arch dam": 1, "Embankment dam": 2}, selected="Arch dam")
dam_type_5 = RemoteReceiver(dam_type_2)
multiplication_3 = Multiplication(A=subtraction_2, B=1.5)
gravity_dam_height = RemoteSender(subtraction_2)
equals_3 = Equality(FirstNumber=dam_type_5, SecondNumber=list_4)  # -> Equality, Inequality
atan = ArcTangent(Value=gravity_ds_ration_3)
line = LineSDL(Start=end_4.Start, Direction="{0,0,-1}", Length=multiplication_3)
rotax = RotateAxis(Geometry=line, Angle=atan, Axis=flip_2.Curve)  # -> Geometry, Transform
swp1 = Sweep1(Rail=flip_2.Curve, Sections=line, Miter=1)  # -> flatten(Brep)
swp1_2 = Sweep1(Rail=flip_2.Curve, Sections=rotax.Geometry, Miter=1)  # -> flatten(Brep)
mesh_terrain_offset_4 = RemoteReceiver(mesh_terrain_offset)
entwine = Entwine(Branch00=swp1, Branch01=swp1_2, FlattenInputs=True)  # -> simplify(Result)
mmx_2 = MeshMesh(MeshA=entwine, MeshB=mesh_terrain_offset_4)
bbx = BrepBrep(BrepA=entwine, BrepB=brep_terrain_base_foundation_5)  # -> Curves, Points
geo = Geometry(bbx.Curves)  # disabled
explode_2 = Explode(Curve=geo, Recursive=False)  # -> Segments, Vertices; disabled
pline_3 = PolyLine(Vertices=explode_2.Vertices, Closed=False)  # disabled
lng_3 = ListLength(List=explode_2.Vertices)  # disabled
number_slider_4 = Slider(0.2, range=0..1)  # disabled
smoothpline = SmoothPolyline(Polyline=pline_3, Strength=number_slider_4, Times=lng_3)  # disabled
srfsplit = SurfaceSplit(Surface=entwine, Curves=smoothpline)  # disabled
center = Center(Geometric=srfsplit, referenceAll=2)  # -> Center, Dimension; disabled
sort_2 = SortList(Keys=center.Dimension, ValuesA=srfsplit)  # -> Keys, ValuesA; disabled
path_3 = ConstructPath(Indices=Slider(0, range=0..1))
pt_3 = Point(midpt)  # disabled
item_11 = ListItem(List=sort_2.ValuesA, Index=0, Wrap=True)  # -> simplify(Item); disabled
loft = Loft(
    Curves=flatten(smoothpline),
    Options={Adjust=True, Closed=False, LoftEnds=0, LoftSimp=0, LoftType=5, Rebuild=10, Refit=0.01})  # disabled
simplify = SimplifyTree(Tree=smoothpline, Front=False)  # disabled
panel_33 = Panel("{1}")  # disabled
normal_water_level_3 = RemoteReceiver(normal_water_level)
mesh_terrain_flattened_2 = RemoteReceiver(mesh_terrain_flattened)
minimum_water_level_2 = RemoteReceiver(minimum_water_level)
dam_axis_3 = RemoteReceiver(dam_axis)

# ---- group: Split what is undergound and above ground - Runs once that the file opens
mesh_terrain_4 = RemoteReceiver(mesh_terrain)
# Split what is undergound and above ground - Runs once that the file opens
brep_terrain_4 = RemoteReceiver(brep_terrain)
bbox = BoundingBox(Content=brep_terrain_4, Plane=PlaneXY(0, 0, 0))  # -> Box, Box_2
jagged_3 = SettingsSpeed()
mesh_6 = MeshBrep(Brep=bbox.Box, Settings=jagged_3)
msplit = MeshSplit(Mesh=mesh_6, Splitters=mesh_terrain_4)
item_12 = ListItem(List=msplit, Index=0, Wrap=True)  # -> Item, Item1
bottom_part = Geometry(item_12.Item)
uper_part = Geometry(item_12.Item1)
mjoin = MeshJoin(Meshes=flatten([uper_part, mesh_terrain_4]))
weldvertices = MeshWeldVertices(Mesh=mjoin, Tolerance=0.01)  # -> RuntimeMessage, Mesh
clsmsh = CloseMesh(Mesh=weldvertices.Mesh, Quadrangulate=False)  # -> Closed, Amount, Openings, R

# ----
join_5 = BrepJoin(Breps=flatten([loft, item_11]))  # -> Breps, Closed; disabled
branch = TreeBranch(Tree=simplify, Path=panel_33, MaintainPaths=True)  # disabled
branch_2 = TreeBranch(Tree=item_11, Path=panel_33, MaintainPaths=True)  # disabled
panel_34 = Panel("0,0,-1")  # disabled
number_slider_5 = Slider(100, range=0..100)  # disabled
section_lines_gravity_3 = RemoteReceiver(section_lines_gravity)
linetypes = QueryModelLinetypes(Name="Section", AutoUpdateState=True)
linetypes_2 = QueryModelLinetypes(Name="Section", AutoUpdateState=True)
# Runs the volume of the water for the normal water level height, splits the dead storage and split the water in 10 m levels
# 
# It takes a couple of minutes to run (tested 05.10.23 - 1.1 m)
run_water_pre_2 = RemoteReceiver(run_water_pre)

dam_6 = DataDam(
    DataAxisDam=dam_axis_3,
    DataMeshTerrainFlattened=mesh_terrain_flattened_2,
    DataNormalWaterLevel=normal_water_level_3,
    DataMinimumStorageLevel=minimum_water_level_2,
    BufferDelay=10000000,
    BufferMode=0)  # -> DataAxisDam, DataMeshTerrainFlattened, DataNormalWaterLevel, DataMinimumStorageLevel
objfromgroup_2 = GetObjectsInGroup()

Z_6 = UnitZ(Factor=number_slider_5)  # disabled
angle = Angle()  # -> Angle, Reflex
extr_2 = Extrude(Base=branch, Direction=Z_6)  # disabled
curve_preview = CustomCurvePreview(Curve=section_lines_gravity_3, Linetype=linetypes, Colour=ColourSwatch(SwatchColor=RGB(0, 0, 0)))
setobj_2 = SetObjectValue(ObjectToSet=objfromgroup_2, ValueToSet=run_water_pre_2)
Z_7 = UnitZ(Factor=dam_6.DataNormalWaterLevel)
Z_8 = UnitZ(Factor=dam_6.DataMinimumStorageLevel)
mesh_7 = Mesh(dam_6.DataMeshTerrainFlattened)
pln = Plane(Z_7)
pln_2 = Plane(Z_8)
panel_35 = Panel(Z_8)
movetoplane = MoveToPlane(Geometry=mesh_7, Plane=pln, Above=True, Below=True)  # -> Geometry, Transform
movetoplane_2 = MoveToPlane(Geometry=mesh_7, Plane=pln_2, Above=True, Below=True)  # -> Geometry, Transform
project_2 = Project(Curve=dam_6.DataAxisDam, Brep=bbox.Box, Direction=Vector(0, 0, 1))
mesh_8 = Mesh(project_2)
list_5 = ValueList({"Concrete gravity dam": 0, "Arch dam": 1, "Embankment dam": 2}, selected="Embankment dam")
list_6 = ValueList({"Concrete gravity dam": 0, "Arch dam": 1, "Embankment dam": 2}, selected="Concrete gravity dam")
dam_type_6 = RemoteReceiver(dam_type_2)
dam_type_7 = RemoteReceiver(dam_type_2)
jagged_4 = SettingsSpeed()  # disabled
path_4 = ConstructPath(Indices=Slider(0, range=0..1))
equals_4 = Equality(FirstNumber=dam_type_7, SecondNumber=list_6)  # -> Equality, Inequality
equals_5 = Equality(FirstNumber=dam_type_6, SecondNumber=list_5)  # -> Equality, Inequality
list_7 = ValueList({"Lowest point": 0, "Choosen point": 1}, selected="Lowest point")

# ---- group: Divide on axis
msplit_2 = MeshSplit(Mesh=clsmsh.Closed, Splitters=mesh_8)
item_13 = ListItem(List=msplit_2, Index=0, Wrap=True)
clsmsh_2 = CloseMesh(Mesh=item_13, Quadrangulate=False)  # -> Closed, Amount, Openings, R

# ---- group: Divide dead storage capacity from the rest
msplit_3 = MeshSplit(Mesh=clsmsh_2.Closed, Splitters=movetoplane_2.Geometry)
clean = CleanTree(RemoveNulls=True, RemoveInvalid=True, RemoveEmpty=False, Tree=msplit_3)
cull_i_3 = CullIndex(List=clean, Indices="0", Wrap=True)
item_14 = ListItem(List=clean, Index=0, Wrap=True)
clsmsh_3 = CloseMesh(Mesh=cull_i_3, Quadrangulate=False)  # -> Closed, Amount, Openings, R
clsmsh_4 = CloseMesh(Mesh=item_14, Quadrangulate=False)  # -> Closed, Amount, Openings, R

# ----
dead_storage = Mesh(flatten(clsmsh_3.Closed))
rest = Mesh(clsmsh_4.Closed)

# ---- group: Splitting the rest to the normal water level
msplit_4 = MeshSplit(Mesh=rest, Splitters=movetoplane.Geometry)
clean_2 = CleanTree(RemoveNulls=True, RemoveInvalid=True, RemoveEmpty=False, Tree=msplit_4)
cull_i_4 = CullIndex(List=clean_2, Indices="0", Wrap=True)
item_15 = ListItem(List=cull_i_4, Index=0, Wrap=True)  # -> Item, Item1
geo_2 = Geometry(item_15.Item)

# ---- group: Dividing the levels
bbox_2 = BoundingBox(Content=geo_2, Plane=PlaneXY(0, 0, 0), UnionBox=True)  # -> Box, Box_2
contour = Contour(Shape=bbox_2.Box, Point=Point(0, 0, 0), Direction=Vector(0, 0, 1), Distance=Slider(10, range=0..100))  # -> flatten(Contours)
mesh_9 = Mesh(contour)
msplit_5 = MeshSplit(Mesh=geo_2, Splitters=mesh_9)

# ---- group: Sorting levels in the same branch
Z_9 = UnitZ(Factor=Slider(0.1, range=0..0.1))
move_3 = Move(Geometry=mesh_9, Motion=Z_9)  # -> Geometry, Transform
clean_3 = CleanTree(RemoveNulls=True, RemoveInvalid=True, RemoveEmpty=False, Tree=flatten(msplit_5))
graft = GraftTree(Tree=move_3.Geometry, IncludeEmptyLists=True, IncludeNullItems=True)
clash = Clash(FirstSet=clean_3, SecondSet=graft, Distance=0, L=100)  # -> ClashCount, ClashPoints, ClashRadii, FirstIndex, SecondIndex
item_16 = ListItem(List=clean_3, Index=clash.FirstIndex, Wrap=True)
clean_4 = CleanTree(RemoveNulls=True, RemoveInvalid=True, RemoveEmpty=True, Tree=item_16)
mjoin_2 = MeshJoin(Meshes=clean_4)
disjoint = DisjointMesh(Mesh=mjoin_2)
clsmsh_5 = CloseMesh(Mesh=disjoint, Quadrangulate=True)  # -> Closed, Amount, Openings, R

# ---- group: Filtering too small meshes - assumption that the not so detailed mesh will produce some weird shapes
path_mapper = PathMapper(clsmsh_5.Closed, source="{A;B;C;D}", target="{path_index}")
volume = MeshVolume(Mesh=path_mapper)  # -> Volume, Centroid
larger_3 = LargerThan(FirstNumber=volume.Volume, SecondNumber=Slider(150, range=0..150))  # -> LargerThan, OrEqualTo
dispatch_6 = Dispatch(List=volume.Volume, DispatchPattern=larger_3.LargerThan)  # -> simplify(ListA), ListB
dispatch_7 = Dispatch(List=path_mapper, DispatchPattern=larger_3.LargerThan)  # -> ListA, ListB
mjoin_3 = MeshJoin(Meshes=dispatch_7.ListA)  # -> simplify(Mesh)

# ----
mesh_10 = Mesh(dead_storage)
bool_2 = Boolean(False)
bool_3 = Boolean(True)
merge_9 = Merge(Data1=flatten(mjoin_3), Data2=flatten(mesh_10))  # -> simplify(graft(Result))
dup_2 = DuplicateDataMatch(SourceDataTree=mesh_10, SecondaryData1=bool_3)  # -> SourceData, SecondaryData1
dup_3 = DuplicateDataMatch(SourceDataTree=mjoin_3, SecondaryData1=bool_2)  # -> SourceData, SecondaryData1
merge_10 = Merge(Data1=flatten(dup_3.SecondaryData1), Data2=flatten(dup_2.SecondaryData1))  # -> simplify(graft(Result))
chord_dam_10 = RemoteReceiver(chord_dam)
dam_type_8 = RemoteReceiver(dam_type_2)
dam_type_9 = RemoteReceiver(dam_type_2)
eval_2 = EvaluateCurve(Curve=reparameterize(chord_dam_10), Parameter=Slider(0.5, range=0..1))  # -> Point, Tangent, Angle
null = NullPlaceholder()
# Front view
# Create the clippling plane once for the sections
chord_dam_11 = RemoteReceiver(chord_dam)
# erasing extra clipping planes
id = Guid(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)
rad_4 = Radians(Degrees=Slider(90, range=0..100))
S_2 = Script(obj=id)  # -> out, a
# ---------- S_2: Python ----------
"""Grasshopper Script"""


import rhinoscriptsyntax as rs
import scriptcontext as sc
import Rhino

sc.doc = Rhino.RhinoDoc.ActiveDoc 
rs.DeleteObject(obj)
# ---------- end S_2 ----------
axis_straight_terrain_2 = RemoteReceiver(axis_straight_terrain)
rotate_5 = Rotate(Geometry=eval_2.Tangent, Angle=rad_4, Plane=PlaneXY(0, 0, 0))  # -> Geometry, Transform
eval_3 = EvaluateCurve(Curve=reparameterize(chord_dam_11), Parameter=Slider(0.5, range=0..1))  # -> Point, Tangent, Angle
chord_dam_12 = RemoteReceiver(chord_dam)
pl_2 = PlaneNormal(Origin=eval_2.Point, ZAxis=rotate_5.Geometry)
neg_3 = Negative(Value=axis_straight_terrain_2)
# Adapt water volume to dam shape
# Adjusts the water sections to the dam section - it is already cutted at the straight axis, but it has to adapt for the arch dam
run_water_final_3 = RemoteReceiver(run_water_final_2)
rad_5 = Radians(Degrees=Slider(90, range=0..100))
dom_2 = ConstructDomain(DomainStart=neg_3, DomainEnd=axis_straight_terrain_2)
objfromgroup_3 = GetObjectsInGroup()
rotate_6 = Rotate(Geometry=eval_3.Tangent, Angle=rad_5, Plane=PlaneXY(0, 0, 0))  # -> Geometry, Transform
# Section view
eval_4 = EvaluateCurve(Curve=reparameterize(chord_dam_12), Parameter=Slider(0.5, range=0..1))  # -> Point, Tangent, Angle
flip_3 = Flip()  # -> Surface, Result
pl_3 = PlaneNormal(Origin=eval_3.Point, ZAxis=rotate_6.Geometry)
dup_4 = DuplicateDataMatch(SourceDataTree=objfromgroup_3, SecondaryData1=run_water_final_3)  # -> SourceData, SecondaryData1
dam_type_10 = RemoteReceiver(dam_type_2)
amp = Amplitude(Vector=rotate_5.Geometry, Amplitude=Slider(250, range=0..500))
dam_type_11 = RemoteReceiver(dam_type_2)
number_slider_6 = Slider(368, range=0..1000)
planesrf_2 = PlaneSurface(Plane=pl_2, XSize=dom_2, YSize=dom_2)
setobj_3 = SetObjectValue(ObjectToSet=objfromgroup_3, ValueToSet=dup_4.SecondaryData1)
axis_straight_terrain_3 = RemoteReceiver(axis_straight_terrain)
rad_6 = Radians(Degrees=Slider(270, range=0..360))
move_4 = Move(Geometry=pl_2, Motion=amp)  # -> Geometry, Transform
m2d_perspective = Make2DPerspectiveView()
rotate_7 = Rotate(Geometry=eval_4.Tangent, Angle=rad_6, Plane=PlaneXY(0, 0, 0))  # -> Geometry, Transform
mesh_terrain_5 = RemoteReceiver(mesh_terrain)
m2d_parallel = Make2DParallelView(Projection=planesrf_2)
S_3 = Script(pln=pl_3, u=axis_straight_terrain_3, v=axis_straight_terrain_3)  # -> out, a
# ---------- S_3: Python ----------
"""Grasshopper Script"""


import rhinoscriptsyntax as rs
import scriptcontext as sc
import Rhino

sc.doc = Rhino.RhinoDoc.ActiveDoc 
rs.AddClippingPlane(pln, u, v)
# ---------- end S_3 ----------
pl_4 = PlaneNormal(Origin=eval_4.Point, ZAxis=rotate_7.Geometry)
dam_type_12 = RemoteReceiver(dam_type_2)
amp_2 = Amplitude(Vector=rotate_6.Geometry, Amplitude=Slider(0.5, range=0..1))
make2d = Make2D(
    Geometry=mesh_terrain_5,
    ClippingPlanes=move_4.Geometry,
    View=m2d_parallel,
    TangentEdges=False,
    TangentSeams=False,
    AutoComputeMake2D=False)  # -> VisibleCurves, VisibleIndex, VisibleType, HiddenCurves, HiddenIndex, HiddenType
number_slider_7 = Slider(8, range=0..10)  # disabled
rev = Reverse(Vector=amp_2)
amp_3 = Amplitude(Vector=rotate_7.Geometry, Amplitude=number_slider_6)
geo_3 = Geometry(make2d.VisibleCurves)
toggle = BooleanToggle(True)  # disabled
panel_36 = Panel(m2d_parallel)
move_5 = Move(Geometry=pl_3, Motion=rev)  # -> Geometry, Transform
number_slider_8 = Slider(1, range=0..1)  # disabled
brep_terrain_5 = RemoteReceiver(brep_terrain)  # disabled
move_6 = Move(Geometry=pl_4, Motion=amp_3)  # -> Geometry, Transform
id_2 = Guid(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)
ma = MassAddition(Input=flatten(dispatch_6.ListA))  # -> Result, PartialResults; disabled
c_script = CSharpScript(id=id_2, pl=move_5.Geometry)  # -> out; inputs id: Guid, pl: Plane
# ---------- c_script: C# ----------
    var cp = new Rhino.DocObjects.ObjRef(id);
    var source = cp.ClippingPlaneSurface().Plane;
    RhinoDoc.ActiveDoc.Objects.Transform(id, Transform.PlaneToPlane(source, pl), true);
# ---------- end c_script ----------
python = GhPythonScript(Brep=brep_terrain_5)  # -> out, a; inputs Plane: Plane; disabled
# ---------- python: Python ----------
import Rhino.Geometry as rg

camera_dir = Plane.Normal # get the camera direction
# Compute the silhouettes
silhouettes = rg.Silhouette.Compute(Brep, 0, camera_dir, 0.001, 0.001)
# Extract the silhouette curves
scurves = (sil.Curve for sil in silhouettes)

# Outputs
a = scurves
# ---------- end python ----------
camera = CameraCrane(Location=move_6.Geometry, Target=pl_4, View=3, Refresh=Button())  # -> Camera, Target, Lens, Up, HorizontalViewAngle, VerticalViewAngle, ScreenRatio, Frame
vdisex_3 = VectorDisplayEx(Point=eval_3.Point, Vector=rotate_6.Geometry, Colour=RGB(0, 0, 0), Width=2)
view = View(<view referenced from the Rhino model>, ViewSource=1)
S_4 = Script(Brep=brep_terrain_5, Plane=pl_4)  # -> out, a; disabled; same code as python
view_2 = ModelView(View=view, Perspective=True, Location=move_6.Geometry, Target=number_slider_6)  # -> View, Title, Perspective, Location, Target, XExtents, YExtents, ZExtents
panel_37 = Panel(ma.Result)  # disabled
xz = XZPlane(Origin=Point(0, 0, 0))
brep_2 = Brep([<brep referenced from the Rhino model> x3])
dam_type_13 = RemoteReceiver(dam_type_2)
python_2 = GhPythonScript(Brep=brep_2, Plane=xz)  # -> out, a; inputs Plane: Plane; same code as python
dam_type_14 = RemoteReceiver(dam_type_2)
project_3 = Project(Geometry=python_2.a, Plane=xz)  # -> Geometry, Transform
# Section
join_6 = JoinCurves(Curves=project_3.Geometry, Preserve=False)
number_slider_9 = Slider(0.4, range=0.1..1)  # disabled
number_slider_10 = Slider(3, range=0..10)  # disabled
panel_38 = Panel("3")  # disabled
number_slider_11 = Slider(10, range=0..100)  # disabled
jagged_5 = SettingsSpeed()
number_slider_12 = Slider(1, range=0..1)
linetypes_3 = QueryModelLinetypes(Name="Continuous", AutoUpdateState=True)
# Export Shapefile
# Export water
path_save_2 = RemoteReceiver(path_save)
as_text = AnnotationTextSettings(TextHeight=Slider(6, range=0..100))  # -> TextSettings, Font, TextHeight, TextGap, MaskFrame, MaskColour, MaskMargins, HorizontalAlignment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
font_size = RemoteSender(Slider(12, range=0..100))
panel_39 = Panel(path_save_2)
leader_text_settings = RemoteSender(as_text.TextSettings)
show_line_of_centers = BooleanToggle(False)
normal_water_level_4 = RemoteReceiver(normal_water_level)
dam_name_translation_2 = RemoteReceiver(dam_name_translation)
dam_axis_name_2 = RemoteReceiver(dam_axis_name)
transform_origin_2 = RemoteReceiver(transform_origin)
fields_water_2 = RemoteReceiver(fields_water)
# Export axis
normal_water_level_5 = RemoteReceiver(normal_water_level)
dam_name_translation_3 = RemoteReceiver(dam_name_translation)
dam_axis_name_3 = RemoteReceiver(dam_axis_name)
chord_dam_13 = RemoteReceiver(chord_dam)
transform_origin_3 = RemoteReceiver(transform_origin)
fields_archdam_2 = RemoteReceiver(fields_archdam)
# Export arch dam
number_slider_13 = Slider(1, range=0..1)
normal_water_level_6 = RemoteReceiver(normal_water_level)
dam_name_translation_4 = RemoteReceiver(dam_name_translation)
dam_axis_name_4 = RemoteReceiver(dam_axis_name)
dam_name_translation_5 = RemoteReceiver(dam_name_translation)
normal_water_level_7 = RemoteReceiver(normal_water_level)
as_leaders = AnnotationLeaderSettings()  # -> LeaderSettings, LeaderCurveType, HasLanding, LandingLength, LeaderTextOrientation, HorizontalTextAlignment, VerticalTextAlignment
dam_axis_name_5 = RemoteReceiver(dam_axis_name)
fields_archdam_3 = RemoteReceiver(fields_archdam)
time_2 = Time("now")
transform_2 = Transform(Geometry=chord_dam_13, Transform=transform_origin_3)
dam_level_4 = RemoteReceiver(dam_level)
concat = Concatenate(
    FragmentA=normal_water_level_4,
    FragmentB="Water",
    FragmentC=dam_name_translation_2,
    FragmentD=dam_axis_name_2,
    JoinSeparator="_")
concat_2 = Concatenate(
    FragmentA=normal_water_level_6,
    FragmentB="ArchDam",
    FragmentC=dam_name_translation_4,
    FragmentD=dam_axis_name_4,
    JoinSeparator="_")
concat_3 = Concatenate(
    FragmentA=normal_water_level_5,
    FragmentB="Axis",
    FragmentC=dam_name_translation_3,
    FragmentD=dam_axis_name_3,
    JoinSeparator="_")
ddate = DeconstructDate(Date=time_2)  # -> Year, Month, Day, Hour, Minute, Second
item_17 = ListItem(List=fields_archdam_2, Index=number_slider_13, Wrap=True)
crv = Curve(transform_2)
panel_40 = Panel(fields_water_2)
panel_41 = Panel(concat)
panel_42 = Panel(concat_3)
concat_4 = Concatenate(FragmentD="Export\ArcGIS", FragmentA=ddate.Year, FragmentB=ddate.Month, FragmentC=ddate.Day, JoinSeparator="_")
panel_43 = Panel(concat_2)
panel_44 = Panel(fields_archdam_3)
transform_origin_4 = RemoteReceiver(transform_origin)
concat_5 = Concatenate(FragmentA=panel_39, FragmentB=concat_4, JoinSeparator="\")
panel_45 = Panel(concat_5)
show_text = BooleanToggle(False)
dam_axis_name_6 = RemoteReceiver(dam_axis_name)
path_5 = FilePath(panel_45)
path_save_arcgis = RemoteSender(path_5)
path_save_arcgis_2 = RemoteReceiver(path_save_arcgis)
path_save_arcgis_3 = RemoteReceiver(path_save_arcgis)
path_save_arcgis_4 = RemoteReceiver(path_save_arcgis)
panel_46 = Panel(path_save_arcgis_2)
panel_47 = Panel(path_save_arcgis_3)
panel_48 = Panel(path_save_arcgis_4)
send_to_export = Button()
linetypes_4 = QueryModelLinetypes(Name="leader", AutoUpdateState=True)
swatch = ColourSwatch(SwatchColor=RGB(0, 232, 155))
# Terrain
brep_terrain_6 = RemoteReceiver(brep_terrain)
lines_levels_2 = RemoteReceiver(lines_levels)
swatch_2 = ColourSwatch(SwatchColor=RGB(207, 255, 255))
swatch_3 = ColourSwatch(SwatchColor=RGB(72, 212, 212))
material = CreateMaterial(
    Diffuse=ColourSwatch(SwatchColor=RGB(125, 161, 125)),
    Specular=ColourSwatch(SwatchColor=RGB(194, 91, 91)),
    Emission=ColourSwatch(SwatchColor=RGB(196, 255, 247)),
    Transparency=Slider(0.14, range=0..1),
    Shine=0)
print_width = PrintWidth()  # -> PrintWidth, Source, Width
material_2 = CreateMaterial(
    Diffuse=swatch_3,
    Specular=swatch_3,
    Emission=swatch_3,
    Transparency=Slider(0.8, range=0..1),
    Shine=Slider(0, range=0..100))
preview = CustomPreview(Geometry=brep_terrain_6, Material=material)
preview_2 = CustomPreview(Geometry=brep_terrain_6, Material=material)
curve_preview_2 = CustomCurvePreview(Curve=lines_levels_2, Linetype=linetypes_4, Colour=ColourSwatch(SwatchColor=RGB(64, 64, 64)))  # disabled
ordinate_dimension = OrdinateDimension()  # -> OrdinateDimension, Plane, Direction, FeatureLocation, DimensionLocation, Offset1, Offset2
leader = Leader()  # -> Leader, Curve, Text, Plane
show_dead_capacity = BooleanToggle(False)
show_useful_capacity = BooleanToggle(False)
material_3 = CreateMaterial(
    Diffuse=ColourSwatch(SwatchColor=RGBA(138, 110, 67, 122)),
    Specular=RGB(255, 255, 255),
    Emission=RGB(0, 0, 0),
    Transparency=Slider(0.8, range=0..1),
    Shine=0)
panel_49 = Panel("BG + 20m for radius")  # disabled
normal_water_level_8 = RemoteReceiver(normal_water_level)  # disabled
panel_50 = Panel("""Water level:
{0}
Dam crest level: 
{1}
Level foundation:
{2}
Arch dam height:
{3}
Straight axis lenght - to terrain:
{4}
Straight axis lenght - to bottom foundation:
{5}
Arch dam axis length - to bottom foundation:
{6}
Volume arch dam:
{7}""")  # disabled
concat_6 = Concatenate(FragmentA=panel_49, FragmentB=normal_water_level_8, JoinSeparator="-")  # disabled
pdecon_3 = Deconstruct()  # -> XComponent, YComponent, ZComponent; disabled
path_save_3 = RemoteReceiver(path_save)  # disabled
geo_4 = Geometry()  # disabled
axis_straight_terrain_4 = RemoteReceiver(axis_straight_terrain)  # disabled
panel_51 = Panel("""Top
Perspective
Front
Right""")  # disabled
normal_water_level_9 = RemoteReceiver(normal_water_level)  # disabled
button_3 = Button()  # disabled
panel_52 = Panel("Wireframe")  # disabled
dam_level_5 = RemoteReceiver(dam_level)  # disabled
len_4 = Length(Curve=geo_4)  # disabled
panel_53 = Panel("3840")  # disabled
panel_54 = Panel("2160")  # disabled
normal_water_level_10 = RemoteReceiver(normal_water_level)  # disabled
dam_level_6 = RemoteReceiver(dam_level)  # disabled
captureview = LBCaptureView(
    file_name=concat_6,
    folder=path_save_3,
    viewport=panel_51,
    width=panel_53,
    height=panel_54,
    mode=panel_52,
    capture=button_3)  # -> file; disabled; plug-in component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
cadexporter = CADExporter(Export=False, ExportType="dwg")  # disabled
panel_55 = Panel("""Water level
Dam crest level 
Level foundation
Dam height
Straight axis lenght - to terrain
Straight axis lenght - to bottom foundation
Arch dam axis length - to bottom foundation
Volume arch dam""")  # disabled
panel_56 = Panel(":")  # disabled
transform_origin_5 = RemoteReceiver(transform_origin)  # disabled
panel_57 = Panel("""Field's names
Values""")  # disabled
panel_58 = Panel("|")  # disabled
panel_59 = Panel("|")  # disabled
panel_60 = Panel("_water")  # disabled
transform_origin_6 = RemoteReceiver(transform_origin)  # disabled
path_save_4 = RemoteReceiver(path_save)  # disabled
concat_7 = Concatenate(FragmentA=concat_6, FragmentB=panel_60)  # disabled
panel_61 = Panel(path_save_4)  # disabled
panel_62 = Panel("Volume")  # disabled
panel_63 = Panel("ArcGIS_TEST")  # disabled
button_4 = Button()  # disabled
num_3 = Number()  # disabled
button_5 = Button()  # disabled
concat_8 = Concatenate(FragmentA=panel_61, FragmentB=panel_63, JoinSeparator="\")  # disabled
toggle_2 = BooleanToggle(True)  # disabled
button_6 = Button()  # disabled
panel_64 = Panel("https://epsg.io/2056")  # disabled
panel_65 = Panel("1")  # disabled
panel_66 = Panel("Test 1")  # disabled
panel_67 = Panel("EPSG:2056")  # disabled
srs_2 = SetSpatialReferenceSystem(SRS=panel_67)  # disabled
panel_68 = Panel(concat_7)  # disabled

dam_axis_4 = RemoteReceiver(dam_axis)

point_upstream = RemoteSender(pipeline_6)

point_upstream_2 = RemoteReceiver(point_upstream)
crv_cp = CurveClosestPoint(Point=point_upstream_2, Curve=dam_axis_4)  # -> Point, Parameter, Distance
vec2pt = Vector2Pt(PointA=point_upstream_2, PointB=crv_cp.Point, Unitize=False)  # -> Vector, Length

vdisex_4 = VectorDisplayEx(Point=point_upstream_2, Vector=vec2pt.Vector, Colour=RGB(0, 0, 0), Width=2)  # disabled
# For optimization: Make perpendicular
# sections on the river line to discover
# best placement for the Dams.
panel_69 = Panel(vec2pt.Vector)

vector_waterflow = RemoteSender(vec2pt.Vector)

# ----
# vector
vector_waterflow_2 = RemoteReceiver(vector_waterflow)
# vector
vector_waterflow_3 = RemoteReceiver(vector_waterflow)
# vector
vector_waterflow_4 = RemoteReceiver(vector_waterflow)

# ----
# GRAVITY DAM
# Top
# Concrete dam settings
midpt_2 = CurveMiddle(Curve=chord_dam_6)  # disabled
project_4 = Project(Curve=chord_dam_6, Brep=brep_terrain_base_foundation_4, Direction=Vector(0, 0, 1))  # disabled
end_5 = EndPoints(Curve=chord_dam_6)  # -> Start, End; disabled
x_tremez_2 = Extremes(Curve=project_4, Plane=PlaneXY(0, 0, 0))  # -> Highest, Lowest; disabled
pdecon_4 = Deconstruct(Point=x_tremez_2.Lowest)  # -> XComponent, YComponent, ZComponent; disabled
pdecon_5 = Deconstruct(Point=midpt_2)  # -> XComponent, YComponent, ZComponent; disabled
subtraction_3 = Subtraction(A=pdecon_5.ZComponent, B=pdecon_4.ZComponent)  # disabled
multiplication_4 = Multiplication(A=subtraction_3, B=1.5)  # disabled
gravity_dam_height_2 = RemoteSender(subtraction_3)  # disabled
panel_70 = Panel("{0,0,-1}")  # disabled
line_2 = LineSDL(Start=end_5.Start, Direction=panel_70, Length=multiplication_4)  # disabled
atan_2 = ArcTangent(Value=gravity_ds_ration_2)  # disabled
rotax_2 = RotateAxis(Geometry=line_2, Angle=atan_2, Axis=chord_dam_6)  # -> Geometry, Transform; disabled
swp1_3 = Sweep1(Rail=chord_dam_6, Sections=line_2, Miter=1)  # -> flatten(Brep); disabled
swp1_4 = Sweep1(Rail=chord_dam_6, Sections=rotax_2.Geometry, Miter=1)  # -> flatten(Brep); disabled
entwine_2 = Entwine(Branch00=swp1_3, Branch01=swp1_4, FlattenInputs=True)  # -> simplify(Result); disabled
bbx_2 = BrepBrep(BrepA=entwine_2, BrepB=brep_terrain_base_foundation_4)  # -> Curves, Points; disabled
geo_5 = Geometry(bbx_2.Curves)  # disabled
explode_3 = Explode(Curve=geo_5, Recursive=False)  # -> Segments, Vertices; disabled
pline_4 = PolyLine(Vertices=explode_3.Vertices, Closed=False)  # disabled
lng_4 = ListLength(List=explode_3.Vertices)  # disabled
number_slider_14 = Slider(0.2, range=0..1)  # disabled
smoothpline_2 = SmoothPolyline(Polyline=pline_4, Strength=number_slider_14, Times=lng_4)  # disabled
srfsplit_2 = SurfaceSplit(Surface=entwine_2, Curves=smoothpline_2)  # disabled
center_2 = Center(Geometric=srfsplit_2, referenceAll=2)  # -> Center, Dimension; disabled
sort_3 = SortList(Keys=center_2.Dimension, ValuesA=srfsplit_2)  # -> Keys, ValuesA; disabled
amp_4 = Amplitude(Vector=vector_waterflow_3, Amplitude=gravity_width_crest_2)  # disabled
pt_4 = Point(midpt_2)  # disabled
item_18 = ListItem(List=sort_3.ValuesA, Index=0, Wrap=True)  # -> simplify(Item); disabled
loft_2 = Loft(
    Curves=flatten(smoothpline_2),
    Options={Adjust=True, Closed=False, LoftEnds=0, LoftSimp=0, LoftType=5, Rebuild=10, Refit=0.01})  # disabled
simplify_2 = SimplifyTree(Tree=smoothpline_2, Front=False)  # disabled
move_7 = Move(Geometry=pt_4, Motion=amp_4)  # -> Geometry, Transform; disabled
panel_71 = Panel("{1}")  # disabled
join_7 = BrepJoin(Breps=flatten([loft_2, item_18]))  # -> Breps, Closed; disabled
branch_3 = TreeBranch(Tree=simplify_2, Path=panel_71, MaintainPaths=True)  # disabled
branch_4 = TreeBranch(Tree=item_18, Path=panel_71, MaintainPaths=True)  # disabled
panel_72 = Panel("0,0,-1")  # disabled
project_5 = ProjectPoint(Point=move_7.Geometry, Direction=panel_72, Geometry=flatten(branch_4))  # -> Point, Index; disabled
number_slider_15 = Slider(100, range=0..100)  # disabled
pline_5 = PolyLine(Vertices=flatten([pt_4, move_7.Geometry, project_5.Point]), Closed=True)  # disabled
move2pt = MoveToPoint(Geometry=pline_5, PointA=pt_4, PointB=end_5.Start)  # -> Moved, Vector, Transform; disabled
Z_10 = UnitZ(Factor=number_slider_15)  # disabled
swp1_5 = Sweep1(Rail=chord_dam_6, Sections=move2pt.Moved, Miter=1)  # disabled
extr_3 = Extrude(Base=branch_3, Direction=Z_10)  # disabled
split_2 = SplitBrep(Brep=extr_3, Cutter=swp1_5)  # disabled
split_3 = SplitBrep(Brep=swp1_5, Cutter=extr_3)  # disabled
center_3 = Center(Geometric=split_2, referenceAll=2)  # -> Center, Dimension; disabled
center_4 = Center(Geometric=split_3, referenceAll=2)  # -> Center, Dimension; disabled
sort_4 = SortList(Keys=center_3.Dimension, ValuesA=split_2)  # -> Keys, reverse(ValuesA); disabled
sort_5 = SortList(Keys=center_4.Dimension, ValuesA=split_3)  # -> Keys, reverse(ValuesA); disabled
cull_i_5 = CullIndex(List=sort_4.ValuesA, Indices=0, Wrap=True)  # disabled
item_19 = ListItem(List=sort_5.ValuesA, Index=0, Wrap=True)  # disabled
join_8 = BrepJoin(Breps=flatten([cull_i_5, item_19]))  # -> Breps, Closed; disabled
# Final volume
sunion = SolidUnion(Breps=[join_7.Breps, join_8.Breps])  # disabled
jagged_6 = SettingsSpeed()  # disabled
mesh_11 = MeshBrep(Brep=sunion, Settings=jagged_6)  # disabled
objfromgroup_4 = GetObjectsInGroup()

# ----
# EMBANKMENT DAM
# Top
# Concrete dam settings
# Final volume
midpt_3 = CurveMiddle(Curve=chord_dam_5)  # disabled
project_6 = Project(Curve=chord_dam_5, Brep=brep_terrain_base_foundation_3, Direction=Vector(0, 0, 1))  # disabled
end_6 = EndPoints(Curve=chord_dam_5)  # -> Start, End; disabled
x_tremez_3 = Extremes(Curve=project_6, Plane=PlaneXY(0, 0, 0))  # -> Highest, Lowest; disabled
pdecon_6 = Deconstruct(Point=x_tremez_3.Lowest)  # -> XComponent, YComponent, ZComponent; disabled
pdecon_7 = Deconstruct(Point=midpt_3)  # -> XComponent, YComponent, ZComponent; disabled
subtraction_4 = Subtraction(A=pdecon_7.ZComponent, B=pdecon_6.ZComponent)  # disabled
embankment_dam_height = RemoteSender(subtraction_4)  # disabled
multiplication_5 = Multiplication(A=subtraction_4, B=1.5)  # disabled
panel_73 = Panel("{0,0,-1}")  # disabled
atan_3 = ArcTangent(Value=embankment_ds_ration_2)  # disabled
line_3 = LineSDL(Start=end_6.Start, Direction=panel_73, Length=multiplication_5)  # disabled
rotax_3 = RotateAxis(Geometry=line_3, Angle=atan_3, Axis=chord_dam_5)  # -> Geometry, Transform; disabled
neg_4 = Negative(Value=atan_3)  # disabled
rotax_4 = RotateAxis(Geometry=line_3, Angle=neg_4, Axis=chord_dam_5)  # -> Geometry, Transform; disabled
swp1_6 = Sweep1(Rail=chord_dam_5, Sections=rotax_4.Geometry, Miter=1)  # -> flatten(Brep); disabled
swp1_7 = Sweep1(Rail=chord_dam_5, Sections=rotax_3.Geometry, Miter=1)  # -> flatten(Brep); disabled
swp1_8 = Sweep1(Rail=chord_dam_5, Sections=line_3, Miter=1)  # -> flatten(Brep); disabled
embankment_face_collision = RemoteSender(swp1_6)  # disabled
entwine_3 = Entwine(Branch00=swp1_6, Branch01=swp1_8, Branch02=swp1_7, FlattenInputs=True)  # -> simplify(Result); disabled
bbx_3 = BrepBrep(BrepA=entwine_3, BrepB=brep_terrain_base_foundation_3)  # -> Curves, Points; disabled
geo_6 = Geometry(bbx_3.Curves)  # disabled
explode_4 = Explode(Curve=geo_6, Recursive=False)  # -> Segments, Vertices; disabled
pline_6 = PolyLine(Vertices=explode_4.Vertices, Closed=False)  # disabled
lng_5 = ListLength(List=explode_4.Vertices)  # disabled
number_slider_16 = Slider(0.1, range=0..1)  # disabled
panel_74 = Panel("2")  # disabled
division = Division(A=embankment_width_crest_2, B=panel_74)  # disabled
smoothpline_3 = SmoothPolyline(Polyline=pline_6, Strength=number_slider_16, Times=lng_5)  # disabled
amp_5 = Amplitude(Vector=vector_waterflow_2, Amplitude=division)  # disabled
srfsplit_3 = SurfaceSplit(Surface=entwine_3, Curves=smoothpline_3)  # disabled
neg_5 = Negative(Value=amp_5)  # disabled
center_5 = Center(Geometric=srfsplit_3, referenceAll=2)  # -> Center, Dimension; disabled
merge_11 = Merge(Data1=neg_5, Data2=amp_5)  # -> flatten(Result); disabled
pt_5 = Point(midpt_3)  # disabled
sort_6 = SortList(Keys=center_5.Dimension, ValuesA=srfsplit_3)  # -> Keys, ValuesA; disabled
move_8 = Move(Geometry=pt_5, Motion=merge_11)  # -> Geometry, Transform; disabled
item_20 = ListItem(List=sort_6.ValuesA, Index=0, Wrap=True)  # -> simplify(Item); disabled
loft_3 = Loft(
    Curves=flatten(smoothpline_3),
    Options={Adjust=True, Closed=False, LoftEnds=0, LoftSimp=2, LoftType=5, Rebuild=10, Refit=0.01})  # disabled
simplify_3 = SimplifyTree(Tree=smoothpline_3, Front=False)  # disabled
bang = ExplodeTree(Data=item_20)  # -> Branch0, Branch1, Branch2; disabled
geo_7 = Geometry([bang.Branch0, bang.Branch2])  # disabled
unflatten = UnflattenTree(Tree=move_8.Geometry, Guide=geo_7)  # disabled
tstat = TreeStatistics(Tree=geo_7)  # -> Paths, Length, Count; disabled
dup_5 = DuplicateDataMatch(SourceDataTree=pt_5, SecondaryData1=unflatten)  # -> SourceData, SecondaryData1; disabled
panel_75 = Panel("0,0,-1")  # disabled
branch_5 = TreeBranch(Tree=simplify_3, Path=tstat.Paths, MaintainPaths=True)  # disabled
join_9 = BrepJoin(Breps=flatten([geo_7, loft_3]))  # -> Breps, Closed; disabled
project_7 = ProjectPoint(Point=unflatten, Direction=panel_75, Geometry=geo_7)  # -> Point, Index; disabled
pline_7 = PolyLine(Vertices=[unflatten, project_7.Point, dup_5.SourceData], Closed=True)  # disabled
number_slider_17 = Slider(100, range=0..100)  # disabled
dup_6 = DuplicateDataMatch(SourceDataTree=chord_dam_5, SecondaryData1=pline_7, Clean_Tree=True)  # -> SourceData, SecondaryData1; disabled
move2pt_2 = MoveToPoint(Geometry=pline_7, PointA=pt_5, PointB=end_6.Start)  # -> Moved, Vector, Transform; disabled
Z_11 = UnitZ(Factor=number_slider_17)  # disabled
swp1_9 = Sweep1(Rail=dup_6.SourceData, Sections=move2pt_2.Moved, Miter=1)  # disabled
extr_4 = Extrude(Base=branch_5, Direction=Z_11)  # disabled
split_4 = SplitBrep(Brep=swp1_9, Cutter=extr_4)  # disabled
center_6 = Center(Geometric=split_4, referenceAll=2)  # -> Center, Dimension; disabled
sort_7 = SortList(Keys=center_6.Dimension, ValuesA=split_4)  # -> Keys, reverse(ValuesA); disabled
item_21 = ListItem(List=sort_7.ValuesA, Index=0, Wrap=True)  # disabled
capex = CapHolesEx(Brep=item_21)  # -> Brep, Caps, Solid; disabled
sunion_2 = SolidUnion(Breps=flatten([capex.Brep, join_9.Breps]))  # disabled
jagged_7 = SettingsSpeed()  # disabled
mesh_12 = MeshBrep(Brep=sunion_2, Settings=jagged_7)  # disabled
objfromgroup_5 = GetObjectsInGroup()

vector_waterflow_5 = RemoteReceiver(vector_waterflow)  # disabled
point_upstream_3 = RemoteReceiver(point_upstream)
hops_2 = Hops(
    BrepTerrain=brep_terrain_base_foundation_6,
    ChordDam=chord_dam_7,
    DSRatio=gravity_ds_ration_4,
    VectorWaterflow=vector_waterflow_5,
    WidthCrest=width_crest,
    CacheResultsInMemory=False,
    CacheSolveResults=False,
    RemoteDefinitionLocation="C:\Users\Admin\Documents\Github\EarlyStageDesign\JD\Skripts\Modules\Gravity.gh",
    RemoteSolveVersion=(0, 1, 0),
    ShowInput_Enabled=False,
    ShowInput_Path=True,
    SynchronousSolve=True)  # -> Geo, Volume; disabled

dam_7 = DataDam(
    DataChordToBaseFoundation=chord_dam_9,
    DataBaseFoundationTerrain=brep_terrain_base_foundation_7,
    DataPointUpstream=point_upstream_3,
    DataChord_dam=chord_dam_8,
    DataTerrain=brep_terrain_3,
    DataA=axis_at_height_3,
    DataB=mesh_terrain_offset_3,
    DataC=mesh_terrain_3,
    DataD=offset_foundation_3,
    BufferDelay=10000000,
    BufferMode=1)  # -> DataChordToBaseFoundation, DataBaseFoundationTerrain, DataPointUpstream, DataChord_dam, DataTerrain, DataA, DataB, DataC, DataD
objfromgroup_6 = GetObjectsInGroup()

arch_dam_base_foundation_terrain = RemoteSender(dam_7.DataBaseFoundationTerrain)
arch_dam_original_terrain = RemoteSender(dam_7.DataTerrain)
chord_l1 = RemoteSender(dam_7.DataChord_dam)
chord_l1_2 = RemoteReceiver(chord_l1)
# 1. Determine L1 with section line
end_7 = EndPoints(Curve=chord_l1_2)  # -> Start, End
# On the formulas it is assumed here
# the lenght to excavated sound rock!
# Check technical memorandum. I have
#  changed the axis line to come from the
#  determined excavation on 06.06.23
dist = Distance(PointA=end_7.Start, PointB=end_7.End)
arch_l1 = RemoteSender(dist)
arch_l1_2 = RemoteReceiver(arch_l1)
arch_l1_3 = RemoteReceiver(arch_l1)
onoff = EnableDisableObject(Objects=objfromgroup_6, Enabled=equals_3.Equality, AllObjects_Object=dam_7)
arch_dam_base_foundation_terrain_2 = RemoteReceiver(arch_dam_base_foundation_terrain)
chord_l1_3 = RemoteReceiver(chord_l1)
amp_6 = Amplitude(Vector=vector_waterflow_4, Amplitude=gravity_width_crest_3)  # disabled
move_9 = Move(Geometry=pt_3, Motion=amp_6)  # -> Geometry, Transform; disabled
project_8 = ProjectPoint(Point=move_9.Geometry, Direction=panel_34, Geometry=flatten(branch_2))  # -> Point, Index; disabled
pline_8 = PolyLine(Vertices=flatten([pt_3, move_9.Geometry, project_8.Point]), Closed=True)  # disabled
move2pt_3 = MoveToPoint(Geometry=pline_8, PointA=pt_3, PointB=end_4.Start)  # -> Moved, Vector, Transform; disabled
swp1_10 = Sweep1(Rail=flip_2.Curve, Sections=move2pt_3.Moved, Miter=1)  # disabled
split_5 = SplitBrep(Brep=extr_2, Cutter=swp1_10)  # disabled
split_6 = SplitBrep(Brep=swp1_10, Cutter=extr_2)  # disabled
center_7 = Center(Geometric=split_5, referenceAll=2)  # -> Center, Dimension; disabled
center_8 = Center(Geometric=split_6, referenceAll=2)  # -> Center, Dimension; disabled
sort_8 = SortList(Keys=center_7.Dimension, ValuesA=split_5)  # -> Keys, reverse(ValuesA); disabled
sort_9 = SortList(Keys=center_8.Dimension, ValuesA=split_6)  # -> Keys, reverse(ValuesA); disabled
cull_i_6 = CullIndex(List=sort_8.ValuesA, Indices=0, Wrap=True)  # disabled
item_22 = ListItem(List=sort_9.ValuesA, Index=0, Wrap=True)  # disabled
chord_l1_4 = RemoteReceiver(chord_l1)
join_10 = BrepJoin(Breps=flatten([cull_i_6, item_22]))  # -> Breps, Closed; disabled
end_8 = EndPoints(Curve=chord_l1_4)  # -> Start, End
sunion_3 = SolidUnion(Breps=[join_5.Breps, join_10.Breps])  # disabled
arch_dam_base_foundation_terrain_3 = RemoteReceiver(arch_dam_base_foundation_terrain)
mesh_13 = MeshBrep(Brep=sunion_3, Settings=jagged_4)  # disabled
volume_2 = MeshVolume(Mesh=mesh_11)  # -> Volume, Centroid
volume_3 = MeshVolume(Mesh=mesh_12)  # -> Volume, Centroid
volume_4 = MeshVolume(Mesh=mesh_13)  # -> Volume, Centroid
onoff_2 = EnableDisableObject(
    Objects=objfromgroup_5,
    Enabled=equals_5.Equality,
    AllObjects_Object=[line_3, panel_73, end_6, rotax_3, atan_3, x_tremez_3, project_6, pdecon_7, pdecon_6, subtraction_4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])
onoff_3 = EnableDisableObject(
    Objects=objfromgroup_4,
    Enabled=equals_4.Equality,
    AllObjects_Object=[line_2, panel_70, end_5, rotax_2, atan_2, x_tremez_2, project_4, pdecon_5, pdecon_4, subtraction_3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])
gravity_volume = RemoteSender(volume_2.Volume)
geo_concretedam = RemoteSender(mesh_11)
gravity_volume_2 = RemoteSender(volume_4.Volume)
geo_embankmentdam = RemoteSender(mesh_12)
embankment_volume = RemoteSender(volume_3.Volume)
geo_concretedam_2 = RemoteSender(mesh_13)
round = Round(Number=volume_2.Volume)  # -> Nearest, Floor, Ceiling
format_2 = Format(Format="{0:#0,000}", Culture=2055, Data0=volume_2.Volume)
round_2 = Round(Number=volume_3.Volume)  # -> Nearest, Floor, Ceiling
format_3 = Format(Format="{0:#0,000}", Culture=2055, Data0=volume_3.Volume)
round_3 = Round(Number=volume_4.Volume)  # -> Nearest, Floor, Ceiling
format_4 = Format(Format="{0:#0,000}", Culture=2055, Data0=volume_4.Volume)
panel_76 = Panel(round_2.Nearest)
panel_77 = Panel(format_3)
num_4 = Number(format_2)
num_5 = Number(format_4)
panel_78 = Panel(round.Nearest)
panel_79 = Panel(format_2)
panel_80 = Panel(round_3.Nearest)
panel_81 = Panel(format_4)
arch_dam_original_terrain_2 = RemoteReceiver(arch_dam_original_terrain)
arch_dam_base_foundation_terrain_4 = RemoteReceiver(arch_dam_base_foundation_terrain)
geo_embankmentdam_2 = RemoteReceiver(geo_embankmentdam)
geo_concretedam_3 = RemoteReceiver([geo_concretedam, geo_concretedam_2])
chord_l1_5 = RemoteReceiver(chord_l1)
roundd = RoundToDecimalPlace(NumberX=chord_l1_5, DecimalPlace=number_slider_12, RoundType=0)  # -> flatten(Rounded), Difference

# ----
# Preliminary layout of concrete arch dams (USBR)
# Topographic deiminesions necessary to
# compute thicknesses, projections, and
# volume are:
# - structural height (H)
# - horizontal distances between abutments;
#      - including estimated excavation to sound rock at crest elevation (L1)
#      - and 15 % of H above base (L2)
# Definitions: H = structural height
# Tc = thickness at crest
# Tb = thickness at base
# T_0.45H = thickness of crown cantilever at 0.45H above base (T0.45H)
# USP = upstream projection
# DSP = downestream projection
# L1 = straight line distance at crest elevation between abutmenets assumed excavated to sound rock
# L2 = straight line distance, at 0.15H above base, between abutments assumed excavated to sound rock
# V = estimated volume of dam
# Formulas - conservative as compared with values computed more precisely (in feet)
# at crest:
# at  base
# at 0.45H
arch_l1_4 = RemoteReceiver(arch_l1)
arch_l1_current_m = Panel(arch_l1_4)
panel_82 = Panel("USPcrest = 0.0")
panel_83 = Panel("DSPcrest = Tc")
# Technical Memorandum No. EM36-86-68110: 2.1.3.1 Single-, Two-, or Three- Centered Arch Dams
# 
# The number of lines-of-centers determines whether the arches are the same on the left and right side of the dam, are different on the left and right sides of the dam, or different on the inner and outer parts of the dam.
# 
# A single centered arch dam has a single line-of-centers that results in the same circular arcs from the left to the right abutment.
# 
# A 2-centered arch dam has two lines-of-centers that result in different circular arcs for the left side and right sides of the dam.
# 
# A 3-centered arch dam has two lines-of-centers that result in different circular arcs near the crown cantilever (inner) and near the abutments (outer). The radii for the inner arcs are shorter than the outer arcs.
# Technical Memorandum No. EM36-86-68110: 2.1.3.2 Uniform- or Variable Thickness Arch Dams
# 
# The number of lines that define the line-of-centers determines whether the arches are uniform thickness or variable thickness arches.
# The arches have uniform thickness if there is one line defining the extrados and intrados line-of-centers. This means that the radius center for the upstream and downstream faces is the same. The radii lengths are different at each elevation, but since the radius center is the same, the thickness of the arch is uniform.
# The arches vary in thickness if there are two lines defining the extrados and intrados line-of-centers. This means that the radius centers for the upstream and downstream faces are in different positions in space forcing the circular arcs of the arches to diverge.
panel_84 = Panel(" 1 foot = 0.3048 m")

expression = Expression(m=arch_l1_current_m, Expression="m*3.28084")

l1_feet = Panel(expression)
expression_2 = Expression(L1=l1_feet, Expression="0.6*L1")
r_axis_feet = Panel(expression_2)

expression_3 = Expression(ft=r_axis_feet, Expression="ft*0.3048")

r_axis_m = Panel(expression_3)
crest_radius = RemoteSender(r_axis_m)

crest_radius_2 = RemoteReceiver(crest_radius)
crest_radius_3 = RemoteReceiver(crest_radius)
# Technical Memorandum No. EM36-86-68110: 4.2 Determine an Appraisal Level Arch Dam Layout
# 
# 3 - If the topography map is of the ground surface, change the contours to represent the position of sound rock.
crest_radius_4 = RemoteReceiver(crest_radius)

# ----
# Technical Memorandum No. EM36-86-68110: 4.2 Determine an Appraisal Level Arch Dam Layout
# 
# 2 - Determine Raxis= 0.6 L1 and round the value of Raxis up to the nearest 10 to 50 feet.
# This is the initial layout, so no need for decimal accuracy
r_crest_usp = Panel(crest_radius_4)

# ----
# 2. Determine radius according to L1
addition_2 = Addition(A=r_crest_usp, B=raxis_adjustments)

# ----
# 3. Create crest curve
end_9 = EndPoints(Curve=chord_l1_3)  # -> Start, End
cir = Circle(Plane=end_9.Start, Radius=addition_2)
cir_2 = Circle(Plane=end_9.End, Radius=addition_2)
ccx = CurveCurve(CurveA=cir, CurveB=cir_2)  # -> Points, ParamsA, ParamsB
dist_2 = Distance(PointA=ccx.Points, PointB=dam_7.DataPointUpstream)
sort_10 = SortList(Keys=dist_2, ValuesA=ccx.Points)  # -> reverse(Keys), reverse(ValuesA)
item_23 = ListItem(List=sort_10.ValuesA, Index=0, Wrap=True)  # -> Item, Item1
circle = CircleCNR(Center=item_23.Item, Normal=Vector(0, 0, 1), Radius=addition_2)
ln_3 = Line(StartPoint=item_23.Item, EndPoint=item_23.Item1)
ccx_2 = CurveCurve(CurveA=chord_l1_3, CurveB=circle)  # -> Points, ParamsA, ParamsB
shatter_3 = Shatter(Curve=circle, Parameters=ccx_2.ParamsB)
colom = CollisionOneMany(Collider=ln_3, Obstacles=shatter_3)  # -> Collision, Index
item_24 = ListItem(List=shatter_3, Index=colom.Index, Wrap=True)

# ---- group: Axis arch Dam
# Technical Memorandum No. EM36-86-68110: 4.2 Determine an Appraisal Level Arch Dam Layout
# 
# 4 - Position the dam in the canyon. Draw a circular arc with radius Raxis...This arc is the axis of the dam and is the upstream side of the crest. Move the axis around the propose dam location to
# position the top of the dam in the canyon.
# 
# The angle of incidence of the axis into the left and right abutments should be approximately equal to produce a geometrically symmetric dam in the canyon.
geo_8 = Geometry(item_24)

# ----
usp_arch_crest = RemoteSender(geo_8)

chord_l1_6 = RemoteReceiver(chord_l1)
usp_arch_crest_2 = RemoteReceiver(usp_arch_crest)
end_10 = EndPoints(Curve=chord_l1_6)  # -> Start, End
addition_3 = Addition(A=Slider(200, range=0..1000), B=dam_7.DataD)
ptstrimcrv_2 = PointsTrimCurve(Curve=dam_7.DataA, Points=[end_10.Start, end_10.End], Flip=False)  # -> Trimmed, SubDomains, Intersected
join_11 = JoinCurves(Curves=flatten([ptstrimcrv_2.Trimmed, usp_arch_crest_2]), Preserve=False)
Z_12 = UnitZ(Factor=addition_3)
neg_6 = Negative(Value=Z_12)
move_10 = Move(Geometry=join_11, Motion=neg_6)  # -> Geometry, Transform
Z_13 = UnitZ(Factor=Slider(1000, range=0..1000))
extr_5 = Extrude(Base=move_10.Geometry, Direction=Z_13)
mmx_3 = MeshMesh(MeshA=[dam_7.DataB, dam_7.DataC], MeshB=extr_5)  # -> simplify(Intersections)
section_lines_arch = RemoteSender(mmx_3)

split_7 = SplitTree(Data=mmx_3, Masks=flatten(path_3))  # -> Positive, Negative
section_lines_arch_2 = RemoteReceiver(section_lines_arch)
curve_preview_3 = CustomCurvePreview(Curve=section_lines_arch_2, Linetype=linetypes_2, Colour=ColourSwatch(SwatchColor=RGB(0, 0, 0)))
section_lines_arch_3 = RemoteReceiver(section_lines_arch)
usp_arch_crest_3 = RemoteReceiver(usp_arch_crest)
split_8 = SplitTree(Data=section_lines_arch_3, Masks=flatten(path_4))  # -> Positive, Negative
ptstrimcrv_3 = PointsTrimCurve(Curve=split_8.Positive, Points=[end_8.Start, end_8.End], Flip=False)  # -> Trimmed, SubDomains, Intersected
dedomain_2 = DeconstructDomain(Domain=ptstrimcrv_3.SubDomains)  # -> reverse(Start), End
item_25 = ListItem(List=dedomain_2.Start, Index=0, Wrap=True)
item_26 = ListItem(List=dedomain_2.End, Index=0, Wrap=True)
shatter_4 = Shatter(Curve=split_8.Positive, Parameters=[item_25, item_26])
item_27 = ListItem(List=shatter_4, Index=1, Wrap=True)
eval_5 = EvaluateCurve(Curve=reparameterize(item_27), Parameter=Slider(0.369, range=0..1))  # -> Point, Tangent, Angle
x_tremez_4 = Extremes(Curve=split_8.Positive, Plane=PlaneXY(0, 0, 0))  # -> Highest, Lowest
filter_4 = StreamFilter(Gate=list_7, Stream0=x_tremez_4.Lowest, Stream1=eval_5.Point)
# ---- group: Lowest point (Base - middle section)
point_foot_dam = Point(filter_4)

# ----
point_at_base = RemoteSender(point_foot_dam)
point_at_base_2 = RemoteReceiver(point_at_base)
usp_arch_crest_4 = RemoteReceiver(usp_arch_crest)
usp_arch_crest_5 = RemoteReceiver(flatten(usp_arch_crest))
path_mapper_2 = PathMapper(usp_arch_crest_5, source="{A}", target="{0;A}")
usp_arch_crest_6 = RemoteReceiver(usp_arch_crest)
geo_9 = Geometry(usp_arch_crest_6)
len_5 = Length(Curve=geo_9)
roundd_2 = RoundToDecimalPlace(NumberX=geo_9, DecimalPlace=number_slider_12, RoundType=0)  # -> flatten(Rounded), Difference
usp_arch_crest_7 = RemoteReceiver(usp_arch_crest)  # disabled
len_6 = Length(Curve=usp_arch_crest_7)  # disabled

# ----
# 4. Figure L2
darc = DeconstructArc(Arc=usp_arch_crest_3)  # -> flatten(BasePlane), Radius, Angle
# Technical Memorandum No. EM36-86-68110: 4.2 Determine an Appraisal Level Arch Dam Layout
# 
# 5 - On the axis, locate a point about midway between the abutments and in the riverbed. This is the location of the crown cantilever...
project_9 = Project(Geometry=point_foot_dam, Plane=darc.BasePlane)  # -> Geometry, Transform
ln_4 = Line(StartPoint=point_foot_dam, EndPoint=project_9.Geometry)
eval_6 = EvaluateCurve(Height=reparameterize(ln_4), Point_at_015H="0.15")  # -> Point, Tangent, Angle
len_7 = Length(Curve=ln_4)

# ---- group: Centrifugal vector
pt_6 = Point(darc.BasePlane)
pt_7 = Point(project_9.Geometry)
vec2pt_2 = Vector2Pt(PointA=pt_7, PointB=pt_6, Unitize=True)  # -> Vector, Length

# ----
# Technical Memorandum No. EM36-86-68110: 4.2 Determine an Appraisal Level Arch Dam Layout
# 
# 5 - ...The radius of the axis at this point is the orientation of the reference plane and the line of centers. The reference plane is a vertical plane through the crown cantilever and generally parallel to the stream bank.
ln_5 = Line(StartPoint=pt_7, EndPoint=pt_6)

project_10 = Project(Geometry=ln_5, Plane=point_foot_dam)  # -> Geometry, Transform

rulesrf = RuledSurface(CurveA=project_10.Geometry, CurveB=ln_5)
srf = Surface(rulesrf)
evalsrf = EvaluateSurface(Surface=reparameterize(srf), Point="0.5,0.5")  # -> Point, Normal, UDirection, VDirection, Frame
pl_5 = PlaneNormal(Origin=evalsrf.Point, ZAxis=evalsrf.Normal)
crv_2 = Curve(rulesrf)

ext = ExtendCurve(Curve=project_10.Geometry, Type=0, Start=500, End=500)
crv_3 = Curve(ext)
point_crest = RemoteSender(project_9.Geometry)
# Elevation here!
reference_centers_outline = RemoteSender(crv_2)
abiscissa_dam_axis = RemoteSender(crv_3)
center_crest = RemoteSender(pt_6)
refecenre_centers_vector = RemoteSender(evalsrf.Normal)
centrifugal_vector = RemoteSender(vec2pt_2.Vector)
reference_centers_plane = RemoteSender(pl_5)
arch_dam_height = RemoteSender(len_7)
arch_dam_height_2 = RemoteReceiver(arch_dam_height)
arch_dam_height_3 = RemoteReceiver(arch_dam_height)
point_crest_2 = RemoteReceiver(point_crest)
centrifugal_vector_2 = RemoteReceiver(centrifugal_vector)

# ----
# x. Elevations
# Technical Memorandum No. EM36-86-68110: 4.2 Determine an Appraisal Level Arch Dam Layout
# 
# 9. Select 6 to 8 arch elevations on the crown cantilever to define the 3D dam. Select the lowest arch elevation starting at about 15% H. Then between 15% H and the crest, try to select 6 to 8 arches evenly spaced vertically and rounded to nearest contour elevation.
# E. Goulas: According to the Engineer Manual [1], the dam is divided into 5 to 10 evenly spaced horizontal arches and their respective parabolas are computed. They should be spaced not less than 3.048 meters (10 feet) nor more than 30.48 meters (100 feet) apart. The lowest parabola should be 0.15H to 0.20H above the base.
# DESIGN MANUAL FOR CONCRETE ARCH DAMS, 1977: Usually 5 to 10 arch elevations are selected such that the  entire dam is represented by a system of horizontal elements evenly spaced over the
# height of the structure.
# Usually the intervals are not greater than 100 (30.5m) feet nor less than 20 feet (6.1m).
# Technical Memorandum No. EM36-86-68110: Select the lowest arch elevation starting at about 15% H. Then between 15% H and the crest, try to select 6 to 8 arches evenly spaced vertically and rounded to nearest contour
# elevation. Even spacing arches permit best evaluation of the ADSAS results.
# EM_1110-2-2201_ARCH_DAM_DESIGN: The
# lowest arch should be 0.15H to 0.20H above the base of the crown cantilever.
section_height_approx = Slider(11, range=6..30)
eval_7 = EvaluateCurve(Height=reparameterize(ln_4), Point_at_015H="0.2")  # -> Point, Tangent, Angle
shatter_5 = Shatter(Curve=reparameterize(ln_4), Parameters="0.2")
item_28 = ListItem(List=shatter_5, Index="1", Wrap=True)
len_8 = Length(Curve=item_28)
expression_4 = Expression(section_heights=section_height_approx, height=len_8, Expression="height/section_heights")
eval_8 = EvaluateCurve(Height=reparameterize(ln_4), PointAt0="0")  # -> Point, Tangent, Angle
round_4 = Round(Number=expression_4)  # -> Nearest, Floor, Ceiling
divide = DivideCurve(Curve=item_28, Count=round_4.Nearest, Kinks=False)  # -> Points, Tangents, Parameters
division_2 = Division(A=len_8, B=round_4.Nearest)  # -> flatten(Result)
pt_8 = Point(flatten([divide.Points, eval_8.Point]))
pdecon_8 = Deconstruct(Point=pt_8)  # -> XComponent, YComponent, ZComponent
section_height_actual = Panel(division_2)
sort_11 = SortList(Keys=pdecon_8.ZComponent, ValuesA=pt_8)  # -> reverse(Keys), reverse(ValuesA)
cull_i_7 = CullIndex(List=sort_11.ValuesA, Indices=0, Wrap=True)
pln_3 = Plane(simplify(graft(cull_i_7)))

item_29 = ListItem(List=sort_11.ValuesA, Index=0, Wrap=True)
pln_4 = Plane(simplify(graft(item_29)))
crest_plane_elevation = RemoteSender(pln_4)
plane_elevations = RemoteSender(pln_3)
plane_elevations_2 = RemoteReceiver(plane_elevations)
plane_elevations_3 = RemoteReceiver(plane_elevations)
refecenre_centers_vector_2 = RemoteReceiver(refecenre_centers_vector)
reference_centers_plane_2 = RemoteReceiver(reference_centers_plane)
center_crest_2 = RemoteReceiver(center_crest)
refecenre_centers_vector_3 = RemoteReceiver(refecenre_centers_vector)
reference_centers_plane_3 = RemoteReceiver(reference_centers_plane)
plane_elevations_4 = RemoteReceiver(plane_elevations)
arch_dam_height_4 = RemoteReceiver(arch_dam_height)
arch_dam_height_5 = RemoteReceiver(arch_dam_height)
expression_5 = Expression(L=len_5, H=arch_dam_height_5, Expression="L/H")
roundd_3 = RoundToDecimalPlace(NumberX=arch_dam_height_4, DecimalPlace=number_slider_12, RoundType=0)  # -> flatten(Rounded), Difference
roundd_4 = RoundToDecimalPlace(NumberX=expression_5, DecimalPlace=number_slider_12, RoundType=0)  # -> flatten(Rounded), Difference
arch_dam_height_6 = RemoteReceiver(arch_dam_height)  # disabled
arch_dam_height_7 = RemoteReceiver(arch_dam_height)  # disabled

arch_dam_height_8 = RemoteReceiver(arch_dam_height)
meter = Panel(arch_dam_height_8)

expression_6 = Expression(m=meter, Expression="m*3.28084")

feet = Panel(expression_6)
expression_7 = Expression(H=feet, L1=l1_feet, Expression="0.01*(H + 1.2*L1)")
tc_feet = Panel(expression_7)

expression_8 = Expression(ft=tc_feet, Expression="ft*0.3048")

tc_m = Panel(expression_8)
arch_tc = RemoteSender(tc_m)

arch_tc_2 = RemoteReceiver(arch_tc)
arch_tc_3 = RemoteReceiver(arch_tc)
arch_tc_4 = RemoteReceiver(arch_tc)
subtraction_5 = Subtraction(A=addition_2, B=arch_tc_4)
r_crest_dsp = Panel(subtraction_5)
cir_3 = Circle(Plane=item_23.Item, Radius=r_crest_dsp)
scx_3 = SurfaceCurve(Surface=arch_dam_base_foundation_terrain_2, Curve=cir_3)  # -> Curves, Points, UVPoints, Normals, Parameters, Tangents
shatter_6 = Shatter(Curve=cir_3, Parameters=scx_3.Parameters)
colom_2 = CollisionOneMany(Collider=ln_3, Obstacles=shatter_6)  # -> Collision, Index
item_30 = ListItem(List=shatter_6, Index=colom_2.Index, Wrap=True)
dsp_arch_crest = RemoteSender(item_30)
arch_tc_5 = RemoteReceiver(arch_tc)
dsp_arch_crest_2 = RemoteReceiver(dsp_arch_crest)
dsp_arch_crest_3 = RemoteReceiver(flatten(dsp_arch_crest))
path_mapper_3 = PathMapper(dsp_arch_crest_3, source="{A}", target="{1;A}")

vec2pt_3 = Vector2Pt(PointA=pt_7, PointB=eval_6.Point, Unitize=False)  # -> Vector, Length
move_11 = Move(Geometry=usp_arch_crest_3, Motion=vec2pt_3.Vector)  # -> Geometry, Transform

mcx = MeshCurve(Mesh=dam_7.DataB, Curve=move_11.Geometry)  # -> flatten(Points), Faces

crv_cp_2 = CurveClosestPoint(Point=mcx.Points, Curve=move_11.Geometry)  # -> Point, Parameter, Distance
shatter_7 = Shatter(Curve=move_11.Geometry, Parameters=crv_cp_2.Parameter)
colom_3 = CollisionOneMany(Collider=eval_6.Point, Obstacles=shatter_7)  # -> Collision, Index
item_31 = ListItem(List=shatter_7, Index=colom_3.Index, Wrap=True)
end_11 = EndPoints(Curve=item_31)  # -> Start, End
dist_3 = Distance(PointA=end_11.Start, PointB=end_11.End)

arch_l2 = RemoteSender(dist_3)

# ----
# Do concrete formula estimation to check
# how different they are from the volume in gh
# check memoradum
arch_l2_2 = RemoteReceiver(arch_l2)
arch_l2_current_m = Panel(arch_l2_2)

expression_9 = Expression(m=arch_l2_current_m, Expression="m*3.28084")

l2_feet = Panel(expression_9)
expression_10 = Expression(H=feet, L1=l1_feet, L2=l2_feet, Expression="(0.0012*H*L1*L2*((H/400)^(H/400)))^(⅓)")
expression_11 = Expression(Tb=expression_10, Expression="0.67*Tb")
expression_12 = Expression(Tb=expression_10, Expression="0.33*Tb")
expression_13 = Expression(Tb=expression_10, Expression="0.95*Tb")
expression_14 = Expression(H=feet, L1=l1_feet, L2=l2_feet, Expression="0.000002*(H²)*L2*(((H+0.8*L1)²)/(L1-L2))+0.0004*H*L1*(H+1.1*L1)")
usp_base_feet = Panel(expression_11)
dsp_base_feet = Panel(expression_12)
tb_0_45h_feet = Panel(expression_13)

expression_15 = Expression(ft=usp_base_feet, Expression="ft*0.3048")
expression_16 = Expression(ft=dsp_base_feet, Expression="ft*0.3048")
expression_17 = Expression(ft=tb_0_45h_feet, Expression="ft*0.3048")

usp_base_m = Panel(expression_15)
dsp_base_m = Panel(expression_16)
tb_0_45h_m = Panel(expression_17)
arch_usp_at_045h = RemoteSender(tb_0_45h_m)
arch_usp_base = RemoteSender(usp_base_m)
arch_dsp_base = RemoteSender(dsp_base_m)

arch_usp_base_2 = RemoteReceiver(arch_usp_base)
arch_usp_at_045h_2 = RemoteReceiver(arch_usp_at_045h)
arch_usp_base_3 = RemoteReceiver(arch_usp_base)
arch_dsp_base_2 = RemoteReceiver(arch_dsp_base)
arch_usp_at_045h_3 = RemoteReceiver(arch_usp_at_045h)
arch_usp_base_4 = RemoteReceiver(arch_usp_base)
arch_dsp_base_3 = RemoteReceiver(arch_dsp_base)
format_5 = Format(
    Format=panel_30,
    Culture=127,
    Data0=crest_radius_2,
    Data1=arch_l1_2,
    Data2=arch_tc_2,
    Data3=arch_dam_height_2,
    Data4=arch_usp_base_3,
    Data5=arch_dsp_base_2,
    Data6=arch_usp_at_045h_2,
    Data7=expression_14,
    Data8=raxis_adjustments,
    Data9=addition_2,
    Data10=freeboard_2,
    Data11=offset_foundation_2)
format_6 = Format(
    Format=panel_32,
    Culture=127,
    Data0=crest_radius_3,
    Data1=arch_l1_3,
    Data2=arch_tc_3,
    Data3=arch_dam_height_3,
    Data4=arch_usp_base_4,
    Data5=arch_dsp_base_3,
    Data6=arch_usp_at_045h_3,
    Data7=expression_14,
    Data8=raxis_adjustments,
    Data9=addition_2,
    Data10=freeboard_3,
    Data11=offset_foundation_4)
panel_85 = Panel(format_5)
panel_86 = Panel(format_6)
assumptions = RemoteSender(panel_86)
arch_usp_at_045h_4 = RemoteReceiver(arch_usp_at_045h)
arch_usp_base_5 = RemoteReceiver(arch_usp_base)
arch_dsp_base_4 = RemoteReceiver(arch_dsp_base)

# ---- group: Crown Cantilever
# 5. Section points - based on the equations
# At Base
# At Crest:
# At 0.45H
panel_87 = Panel("0.45")
eval_9 = EvaluateCurve(Height=reparameterize(ln_4), Point_at_045H=panel_87)  # -> Point, Tangent, Angle
neg_7 = Negative(Value=centrifugal_vector_2)
neg_8 = Negative(Value=centrifugal_vector_2)
amp_7 = Amplitude(Vector=centrifugal_vector_2, Amplitude=arch_tc_5)
amp_8 = Amplitude(Vector=neg_8, Amplitude=arch_usp_base_5)
amp_9 = Amplitude(Vector=neg_7, Amplitude=arch_usp_at_045h_4)
amp_10 = Amplitude(Vector=centrifugal_vector_2, Amplitude=arch_dsp_base_4)
move_12 = Move(Geometry=point_at_base_2, Motion=amp_10)  # -> Geometry, Transform
move_13 = Move(Geometry=point_at_base_2, Motion=amp_8)  # -> Geometry, Transform
move_14 = Move(Geometry=point_crest_2, Motion=amp_7)  # -> Geometry, Transform
move_15 = Move(Geometry=eval_9.Point, Motion=amp_9)  # -> Geometry, Transform
usp_pt_at_base = Point(move_13.Geometry)
pt_at_0_45h = Point(move_15.Geometry)
pt_at_crest = Point(point_crest_2)
pt_at_0_45h_2 = Point(eval_9.Point)
pt_at_crest_2 = Point(move_14.Geometry)
pt_at_base = Point(move_12.Geometry)
# Technical Memorandum No. EM36-86-68110: 4.2 Determine an Appraisal Level Arch Dam Layout
# 
# 7 - Determine the geometry of the upstream and downstream face along the crown cantilever. A circle can be drawn through the 3 points computed for the upstream face in Step 6. Likewise, a circle can be drawn through the 3 points computed for the
# downstream face.
# 
# 8. Draw the upstream and downstream face along the crown cantilever.
arc = Arc3Pt(PointA=pt_at_crest_2, PointB=pt_at_0_45h_2, PointC=pt_at_base)  # -> DownstreamArc, CenterP, RadiusM
arc_2 = Arc3Pt(PointA=pt_at_crest, PointB=pt_at_0_45h, PointC=usp_pt_at_base)  # -> UpstreamArc, CenterP, RadiusM
ds_arc = RemoteSender(arc.DownstreamArc)
us_arc = RemoteSender(arc_2.UpstreamArc)

# ----
ln_6 = Line(StartPoint=point_crest_2, EndPoint=move_14.Geometry)
ln_7 = Line(StartPoint=move_12.Geometry, EndPoint=move_13.Geometry)
ln_8 = Line(StartPoint=eval_9.Point, EndPoint=move_15.Geometry)
len_9 = Length(Curve=ln_6)
len_10 = Length(Curve=ln_7)
len_11 = Length(Curve=ln_8)
roundd_5 = RoundToDecimalPlace(NumberX=len_9, DecimalPlace=Slider(1, range=0..1), RoundType=0)  # -> flatten(Rounded), Difference
# Technical Memorandum No. EM36-86-68110: 4.2 Determine an Appraisal Level Arch Dam Layout
# 
# 6 - Determine the shape of the crown cantilever. From the equations provided,
# compute TC, TB, T0.45H, USPC, USP0.45H, USPB, DSPC, DSP0.45H, and DSPB.
roundd_6 = RoundToDecimalPlace(NumberX=len_11, DecimalPlace=Slider(1, range=0..1), RoundType=0)  # -> flatten(Rounded), Difference
roundd_7 = RoundToDecimalPlace(NumberX=len_10, DecimalPlace=Slider(1, range=0..1), RoundType=0)  # -> flatten(Rounded), Difference
width_0_45 = RemoteSender(roundd_6.Rounded)
width_base = RemoteSender(roundd_7.Rounded)
width_crest_2 = RemoteSender(roundd_5.Rounded)
ds_arc_2 = RemoteReceiver(ds_arc)
bcx = BrepCurve(Brep=arch_dam_original_terrain_2, Curve=ds_arc_2)  # -> Curves, Points
point_foot_arch_dam = RemoteSender(bcx.Points)
ds_arc_3 = RemoteReceiver(ds_arc)
us_arc_2 = RemoteReceiver(us_arc)

# ----
# x. Dam Footprint
# original projection to foundation
end_12 = EndPoints(Curve=ds_arc_3)  # -> Start, End
end_13 = EndPoints(Curve=us_arc_2)  # -> Start, End
dsp_point_bottom_foundation = Point(end_12.End)
usp_point_bottom_foundation = Point(end_13.End)
end_14 = EndPoints(Curve=usp_arch_crest_4)  # -> Start, End
end_15 = EndPoints(Curve=dsp_arch_crest_2)  # -> Start, End
project_11 = Project(Geometry=dsp_point_bottom_foundation, Plane=end_15.Start)  # -> Geometry, Transform
project_12 = Project(Geometry=usp_point_bottom_foundation, Plane=end_14.Start)  # -> Geometry, Transform
arc_3 = Arc3Pt(PointA=end_15.Start, PointB=project_11.Geometry, PointC=end_15.End)  # -> UpstreamArc, CenterP, RadiusM
arc_4 = Arc3Pt(PointA=end_14.Start, PointB=project_12.Geometry, PointC=end_14.End)  # -> UpstreamArc, CenterP, RadiusM
project_13 = Project(Curve=arc_4.UpstreamArc, Brep=arch_dam_base_foundation_terrain_4, Direction=Vector(0, 0, 1))
project_14 = Project(Curve=arc_3.UpstreamArc, Brep=arch_dam_base_foundation_terrain_4, Direction=Vector(0, 0, 1))
explode_5 = Explode(Curve=project_13, Recursive=False)  # -> Segments, Vertices
explode_6 = Explode(Curve=project_14, Recursive=False)  # -> Segments, Vertices
pline_9 = PolyLine(Vertices=explode_5.Vertices, Closed=False)
pline_10 = PolyLine(Vertices=explode_6.Vertices, Closed=False)
lng_6 = ListLength(List=explode_5.Vertices)
lng_7 = ListLength(List=explode_6.Vertices)
smoothpline_4 = SmoothPolyline(Polyline=pline_9, Strength=Slider(0.5, range=0..1), Times=lng_6)
smoothpline_5 = SmoothPolyline(Polyline=pline_10, Strength=Slider(0.5, range=0..1), Times=lng_7)
usp_footprint = Curve(smoothpline_4)
dsp_footprint = Curve(smoothpline_5)

usp_prefootprint = RemoteSender(usp_footprint)
dsp_prefootprint = RemoteSender(dsp_footprint)
usp_prefootprint_2 = RemoteReceiver(usp_prefootprint)
dsp_prefootprint_2 = RemoteReceiver(dsp_prefootprint)
us_arc_3 = RemoteReceiver(us_arc)
ds_arc_4 = RemoteReceiver(ds_arc)
# building arches at each level
us_arc_4 = RemoteReceiver(us_arc)
ds_arc_5 = RemoteReceiver(ds_arc)
pcx = CurvePlane(DownstreamArc=ds_arc_5, Plane=plane_elevations_4)  # -> simplify(Points), ParamsC, ParamsP
# Technical Memorandum No. EM36-86-68110: 4.2 Determine an Appraisal Level Arch Dam Layout
# 
# 10. On the topography map, draw the upstream and downstream projections of the crown cantilever and downstream arc at the crest on the reference plane. Using the same radius center as the axis, draw the circular arc for the downstream side of the crest using the radius (Raxis – Tc). On the reference plane draw points at each arch elevation on the upstream and downstream faces.
pcx_2 = CurvePlane(UpstreamArc=us_arc_4, Plane=plane_elevations_4)  # -> simplify(Points), ParamsC, ParamsP
us_ds_slices_intersections = RemoteSender([pcx_2.Points, pcx.Points])
point_foot_arch_dam_2 = RemoteReceiver(point_foot_arch_dam)
pdecon_9 = Deconstruct(Point=point_foot_arch_dam_2)  # -> XComponent, YComponent, ZComponent
roundd_8 = RoundToDecimalPlace(NumberX=pdecon_9.ZComponent, DecimalPlace=number_slider_12, RoundType=0)  # -> flatten(Rounded), Difference
width_crest_3 = RemoteReceiver(width_crest_2)
width_base_2 = RemoteReceiver(width_base)
width_0_45_2 = RemoteReceiver(width_0_45)
usp_prefootprint_3 = RemoteReceiver(usp_prefootprint)  # disabled
dsp_prefootprint_3 = RemoteReceiver(dsp_prefootprint)  # disabled
dam_pre_footprint = Curve([usp_prefootprint_3, dsp_prefootprint_3])  # disabled
assumptions_2 = RemoteReceiver(assumptions)  # disabled
split_9 = TextSplit(Text=flatten(assumptions_2), Separators=panel_56)  # disabled
dispatch_8 = Dispatch(List=split_9, DispatchPattern=[True, False])  # -> flatten(ListA), flatten(ListB); disabled
trim = TextTrim(Text=dispatch_8.ListB, Start=True, End=True)  # disabled
merge_12 = Merge(Data1=panel_55, Data2=dispatch_8.ListA)  # disabled
join_12 = TextJoin(Text=merge_12, Join=panel_59)  # disabled
panel_88 = Panel(merge_12)  # disabled

dam_8 = DataDam(DataA=merge_10, BufferDelay=10000000, BufferMode=1)

# ----
# Technical Memorandum No. EM36-86-68110: 4.2 Determine an Appraisal Level Arch Dam Layout
# 
# 12.a. Draw the upstream face arch starting with the first arch below the crest. Use an initial guess for the line of centers as a 0.2:1 sloping line.
# x. Line of centers
flatten = FlattenTree(Tree=plane_elevations_2, Path="{0}")
flatten_2 = FlattenTree(Tree=plane_elevations_3, Path="{0}")
cull_i_8 = CullIndex(List=flatten, Indices=-1, Wrap=True)  # -> simplify(graft(List))
cull_i_9 = CullIndex(List=flatten_2, Indices=-1, Wrap=True)  # -> simplify(graft(List))
pcx_3 = CurvePlane(DownstreamArc=ds_arc_4, Plane=cull_i_9)  # -> simplify(Points), ParamsC, ParamsP
pcx_4 = CurvePlane(DSPFootprint=dsp_prefootprint_2, Plane=cull_i_9)  # -> simplify(Points), ParamsC, ParamsP
pcx_5 = CurvePlane(USPFootprint=usp_prefootprint_2, Plane=cull_i_8)  # -> simplify(Points), ParamsC, ParamsP
pcx_6 = CurvePlane(UpstreamArc=us_arc_3, Plane=cull_i_8)  # -> simplify(Points), ParamsC, ParamsP
item_32 = ListItem(List=pcx_4.Points, Index=0, Wrap=True)  # -> Item, Item1
arc_5 = Arc3Pt(PointA=item_32.Item, PointB=pcx_3.Points, PointC=item_32.Item1)  # -> Arc, Plane, Radius
darc_2 = DeconstructArc(Arc=arc_5.Arc)  # -> BasePlane, Radius, Angle
rev_2 = Reverse(Vector=refecenre_centers_vector_3)
project_15 = ProjectPoint(Point=darc_2.BasePlane, Direction=[refecenre_centers_vector_3, rev_2], Geometry=reference_centers_plane_3)  # -> Point, Index
rev_3 = Reverse(Vector=refecenre_centers_vector_2)
clean_5 = CleanTree(RemoveNulls=True, RemoveInvalid=True, RemoveEmpty=False, Tree=project_15.Point)  # -> flatten(Tree)
center_at_crest = Point(center_crest_2)
abiscissa_dam_axis_2 = RemoteReceiver(abiscissa_dam_axis)

item_33 = ListItem(List=pcx_5.Points, Index=0, Wrap=True)  # -> Item, Item1

arc_6 = Arc3Pt(PointA=item_33.Item, PointB=pcx_6.Points, PointC=item_33.Item1)  # -> Arc, Plane, Radius
darc_3 = DeconstructArc(Arc=arc_6.Arc)  # -> BasePlane, Radius, Angle
project_16 = ProjectPoint(Point=darc_3.BasePlane, Direction=[refecenre_centers_vector_2, rev_3], Geometry=reference_centers_plane_2)  # -> Point, Index
clean_6 = CleanTree(RemoveNulls=True, RemoveInvalid=True, RemoveEmpty=False, Tree=project_16.Point)  # -> flatten(Tree)

centers_extrados_not_normalized = Point([center_at_crest, clean_6])
pline_11 = PolyLine(Vertices=centers_extrados_not_normalized, Closed=False)
lng_8 = ListLength(List=centers_extrados_not_normalized)
smoothpline_6 = SmoothPolyline(Polyline=pline_11, Strength=1, Times=lng_8)
ext_2 = ExtendCurve(Curve=smoothpline_6, Type=2, Start=0, End=500)
ccx_3 = CurveCurve(CurveA=ext_2, CurveB=abiscissa_dam_axis_2)  # -> Points, ParamsA, ParamsB
shatter_8 = Shatter(Curve=ext_2, Parameters=flatten(ccx_3.ParamsA))
sort_12 = SortList(Keys=shatter_8, ValuesA=shatter_8)  # -> Keys, ValuesA
item_34 = ListItem(List=sort_12.ValuesA, Index=0, Wrap=True)
geo_10 = Geometry(item_34)

centers_extrados_not_normalized_2 = Point([center_at_crest, clean_5])
pline_12 = PolyLine(Vertices=centers_extrados_not_normalized_2, Closed=False)
lng_9 = ListLength(List=centers_extrados_not_normalized_2)
smoothpline_7 = SmoothPolyline(Polyline=pline_12, Strength=1, Times=lng_9)
ext_3 = ExtendCurve(Curve=smoothpline_7, Type=2, Start=0, End=500)
ccx_4 = CurveCurve(CurveA=ext_3, CurveB=abiscissa_dam_axis_2)  # -> Points, ParamsA, ParamsB
shatter_9 = Shatter(Curve=ext_3, Parameters=flatten(ccx_4.ParamsA))
sort_13 = SortList(Keys=shatter_9, ValuesA=shatter_9)  # -> Keys, ValuesA
item_35 = ListItem(List=sort_13.ValuesA, Index=0, Wrap=True)
geo_11 = Geometry(item_35)

line_of_centers_intrados = RemoteSender(geo_10)
line_of_centers_extrados = RemoteSender(geo_11)
line_of_centers_extrados_2 = RemoteReceiver(line_of_centers_extrados)
line_of_centers_intrados_2 = RemoteReceiver(line_of_centers_intrados)
pcx_7 = CurvePlane(LineOfCentersIntrados=line_of_centers_intrados_2, Plane=plane_elevations_4)  # -> simplify(CenterPoints), ParamsC, ParamsP
pcx_8 = CurvePlane(LineOfCentersExtrados=line_of_centers_extrados_2, Plane=plane_elevations_4)  # -> simplify(CenterPoints), ParamsC, ParamsP
ln_9 = Line(StartPoint=pcx.Points, EndPoint=pcx_7.CenterPoints)
ln_10 = Line(StartPoint=pcx_2.Points, EndPoint=pcx_8.CenterPoints)
len_12 = Length(Curve=ln_9)
len_13 = Length(Curve=ln_10)
cir_4 = Circle(DSCenters=pcx_7.CenterPoints, Radius=len_12)  # -> simplify(Circle)
cir_5 = Circle(USCenters=pcx_8.CenterPoints, Radius=len_13)
points_lineofcenters = RemoteSender([pcx_8.CenterPoints, pcx_7.CenterPoints])
path_mapper_4 = PathMapper(ln_10, source="{A}", target="{0;A}")
path_mapper_5 = PathMapper(cir_4, source="{A}", target="{1;A}")
path_mapper_6 = PathMapper(cir_5, source="{A}", target="{0;A}")
path_mapper_7 = PathMapper(ln_9, source="{A}", target="{1;A}")

# ---- group: Finding the intersection with sound rock
arch_dam_base_foundation_terrain_5 = RemoteReceiver(arch_dam_base_foundation_terrain)
relay = Relay([path_mapper_6, path_mapper_5])
relay_2 = Relay([path_mapper_4, path_mapper_7])
scx_4 = SurfaceCurve(Surface=arch_dam_base_foundation_terrain_5, Curve=relay)  # -> Curves, simplify(Points), UVPoints, Normals, Parameters, Tangents

# ---- group: Filter away last circle - touching sound rock
geo_12 = Geometry(relay)
tstat_2 = TreeStatistics(Tree=geo_12)  # -> Paths, Length, Count
division_3 = Division(A=tstat_2.Count, B="2")
x_minus_one_2 = XMinusOne(NumberX=division_3)
item_36 = ListItem(List=tstat_2.Paths, Index=flatten(["-1", x_minus_one_2]), Wrap=True)
split_10 = SplitTree(Data=geo_12, Masks=flatten(item_36))  # -> Positive, Negative
geo_13 = Geometry(split_10.Positive)

# ---- group: Adjusting the bottom so there is something to connect with the bottom circle
number_slider_18 = Slider(1, range=0..10)
centrifugal_vector_3 = RemoteReceiver(centrifugal_vector)
neg_9 = Negative(Value=number_slider_18)
rev_4 = Reverse(Vector=centrifugal_vector_3)
rad_7 = Radians(Degrees=[number_slider_18, neg_9])
rotate_8 = Rotate(Geometry=rev_4, Angle=rad_7, Plane=PlaneXY(0, 0, 0))  # -> flatten(Geometry), Transform
center_9 = Center(Geometric=geo_13)  # -> Center, Dimension
darc_4 = DeconstructArc(Arc=geo_13)  # -> BasePlane, Radius, Angle
line_4 = LineSDL(Start=center_9.Center, Direction=rotate_8.Geometry, Length=darc_4.Radius)
ccx_5 = CurveCurve(CurveA=geo_13, CurveB=line_4)  # -> Points, ParamsA, ParamsB
pshift = ShiftPaths(Data=ccx_5.ParamsA, Offset="-1")
shatter_10 = Shatter(Curve=geo_13, Parameters=pshift)
pshift_2 = ShiftPaths(Data=shatter_10, Offset="-1")

# ---- group: Cutting and selecting curves for dam
shatter_11 = Shatter(Curve=relay, Parameters=scx_4.Parameters)  # -> simplify(Segments)
colom_4 = CollisionOneMany(Collider=shatter_11, Obstacles=relay_2)  # -> Collision, Index
dispatch_9 = Dispatch(List=shatter_11, DispatchPattern=colom_4.Collision)  # -> ListA, ListB

# ----
split_11 = SplitTree(Data=dispatch_9.ListA, Masks=flatten(item_36))  # -> Positive, Negative

geo_14 = Geometry(split_11.Negative)
item_37 = ListItem(List=pshift_2, Index=0, Wrap=True)

path_mapper_8 = PathMapper(geo_14, source="{A;B}", target="{A;B+1}")
path_mapper_9 = PathMapper(item_37, source="{A;B}", target="{A;B+1}")

# ----
# Line of centers
reference_centers_outline_2 = RemoteReceiver(reference_centers_outline)  # disabled
reference_centers_plane_4 = RemoteReceiver(reference_centers_plane)  # disabled
refecenre_centers_vector_4 = RemoteReceiver(refecenre_centers_vector)  # disabled
line_of_centers_intrados_3 = RemoteReceiver(line_of_centers_intrados)  # disabled
line_of_centers_extrados_3 = RemoteReceiver(line_of_centers_extrados)  # disabled
abiscissa_dam_axis_3 = RemoteReceiver(abiscissa_dam_axis)  # disabled
number_slider_19 = Slider(5, range=0..50)  # disabled
ds_arc_6 = RemoteReceiver(ds_arc)  # disabled
us_arc_5 = RemoteReceiver(us_arc)  # disabled
us_ds_slices_intersections_2 = RemoteReceiver(us_ds_slices_intersections)  # disabled
points_lineofcenters_2 = RemoteReceiver(points_lineofcenters)  # disabled
swatch_4 = ColourSwatch(SwatchColor=RGB(164, 24, 219))  # disabled
number_slider_20 = Slider(50, range=0..100)  # disabled
swatch_5 = ColourSwatch(SwatchColor=RGB(69, 69, 69))  # disabled
objfromgroup_7 = GetObjectsInGroup()
symadv = SymbolAdvanced(Style=5, SizePrimary=number_slider_19, SizeSecondary=10, Rotation=0, Fill=swatch_4, Edge=swatch_4, Width=2, Adjust=True)  # disabled
amp_11 = Amplitude(Vector=refecenre_centers_vector_4, Amplitude=number_slider_20)  # disabled
vdisex_5 = VectorDisplayEx(Point=reference_centers_plane_4, Vector=amp_11, Colour=RGB(0, 0, 0), Width=2)  # disabled
curve_preview_4 = CustomCurvePreview(Curve=reference_centers_outline_2, Linetype={Width=0, BaseSystem=0}, Colour=swatch_5)  # disabled
symbol = SymbolDisplay(Location=[points_lineofcenters_2, us_ds_slices_intersections_2], Display=symadv)  # disabled
curve_preview_5 = CustomCurvePreview(Curve=[ds_arc_6, us_arc_5], Linetype=<geometry referenced from the Rhino model>, Colour=swatch_5)  # disabled
curve_preview_6 = CustomCurvePreview(
    Curve=[line_of_centers_intrados_3, line_of_centers_extrados_3],
    Linetype=<geometry referenced from the Rhino model>,
    Colour=swatch_5)  # disabled
flip_4 = FlipMatrix(Data=points_lineofcenters_2)  # disabled
panel_89 = Panel("{0}")  # disabled
reference_centers_plane_5 = RemoteReceiver(reference_centers_plane)  # disabled
center_crest_3 = RemoteReceiver(center_crest)  # disabled
split_12 = SplitTree(Data=flip_4, Masks=flatten(panel_89))  # -> Positive, Negative; disabled
pt_9 = Point([split_12.Positive, center_crest_3])  # disabled
number_slider_21 = Slider(86, range=0..100)  # disabled
deplane = DeconstructPlane(Plane=reference_centers_plane_5)  # -> Origin, XAxis, YAxis, ZAxis; disabled
amp_12 = Amplitude(Vector=deplane.XAxis, Amplitude=number_slider_21)  # disabled
pdecon_10 = Deconstruct(Point=pt_9)  # -> XComponent, YComponent, ZComponent; disabled
roundf = RoundToFactor(NumberX=pdecon_10.ZComponent, Factor=0.1, RoundType=0)  # -> Rounded, Difference, MultiplierR, MultiplierX; disabled
move_16 = Move(Geometry=pt_9, Motion=amp_12)  # -> Geometry, Transform; disabled
pln_5 = Plane(reference_centers_plane_5)  # disabled
ln_11 = Line(StartPoint=pt_9, EndPoint=move_16.Geometry)  # disabled
leader_text_settings_2 = RemoteReceiver(leader_text_settings)  # disabled
leader_2 = Leader(Curve=ln_11, Text=roundf.Rounded, Plane=pln_5, TextSettings=leader_text_settings_2)  # -> Leader, Curve, Text, Plane, TextSettings, ArrowSettings, LeaderSettings; disabled

lng_10 = ListLength(List=objfromgroup_7)
dup_7 = DuplicateData(Data=show_line_of_centers, Number=lng_10, Order=True)
not = GateNot(A=dup_7)
onoff_4 = EnableDisableObject(
    Objects=objfromgroup_7,
    Enabled=dup_7,
    AllObjects_Object=[vdisex_5, amp_11, number_slider_20, line_of_centers_intrados_3, line_of_centers_extrados_3, curve_preview_6, us_arc_5, ds_arc_6, curve_preview_5, swatch_5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])

# ---- group: Rounding to 0.1
number_slider_22 = Slider(1, range=0..10)

# ----
# Values
# Fields
# Fields
number_slider_23 = Slider(2, range=0..10)
dam_name_translation_6 = RemoteReceiver(dam_name_translation)
normal_water_level_11 = RemoteReceiver(normal_water_level)
dam_axis_name_7 = RemoteReceiver(dam_axis_name)
fields_water_3 = RemoteReceiver(fields_water)
panel_90 = Panel(fields_water_3)

end_16 = EndPoints(Curve=path_mapper_9)  # -> Start, End; disabled
geo_15 = Geometry([path_mapper_2, path_mapper_3, path_mapper_8])  # disabled
# smoothing ends
end_17 = EndPoints(Curve=geo_15)  # -> Start, End; disabled
geo_16 = Geometry([end_16.Start, end_16.End])  # disabled
geo_17 = Geometry([end_17.Start, end_17.End])  # disabled
path_mapper_10 = PathMapper([geo_17, geo_16], source="{A;B}", target="{A}")  # disabled
item_38 = ListItem(List=path_mapper_10, Index=0, Wrap=True)  # disabled
geo_18 = Geometry(path_mapper_10)  # disabled
ptsortitems = PointSortItems(Start=item_38, Points=geo_18)  # -> SortedItems, SortedIndices, simplify(SortedPoints); disabled
intcrv = Interpolate(Vertices=ptsortitems.SortedPoints, Degree=3, Periodic=False, KnotStyle=1)  # -> Curve, Length, Domain; disabled
crest_plane_elevation_2 = RemoteReceiver(crest_plane_elevation)  # disabled
plane_elevations_5 = RemoteReceiver(plane_elevations)  # disabled
number_slider_24 = Slider(50, range=0..100)  # disabled
merge_13 = Merge(Data1=flatten(crest_plane_elevation_2), Data2=flatten(plane_elevations_5))  # disabled
ext_4 = ExtendCurve(Curve=geo_15, Type=1, Start=number_slider_24, End=number_slider_24)  # disabled
cull_i_10 = CullIndex(List=merge_13, Indices=-1, Wrap=True)  # disabled
geo_19 = Geometry(geo_16)  # disabled

topoly = CurveToPolyline(Curve=intcrv.Curve, ToleranceDistance=0, ToleranceAngle=number_slider_9)  # -> Polyline, Segments; disabled

pcx_9 = CurvePlane(Curve=topoly.Polyline, Plane=cull_i_10)  # -> simplify(Points), ParamsC, ParamsP; disabled
crv_cp_3 = CurveClosestPoint(Point=pcx_9.Points, Curve=ext_4)  # -> Point, Parameter, Distance; disabled
dispatch_10 = Dispatch(List=crv_cp_3.Point, DispatchPattern=[True, False])  # -> ListA, ListB; disabled
item_39 = ListItem(List=dispatch_10.ListA, Index=0, Wrap=True)  # disabled
item_40 = ListItem(List=dispatch_10.ListB, Index=0, Wrap=True)  # disabled
geo_20 = Geometry([item_39, item_40, geo_19])  # disabled

pshift_3 = ShiftPaths(Data=geo_20, Offset=-1)  # disabled
item_41 = ListItem(List=pshift_3, Index=0, Wrap=True)  # disabled
ptsortitems_2 = PointSortItems(Start=item_41, Points=pshift_3)  # -> SortedItems, SortedIndices, SortedPoints; disabled
pline_13 = PolyLine(Vertices=ptsortitems_2.SortedPoints, Closed=False)  # disabled
intcrv_2 = Interpolate(Vertices=ptsortitems_2.SortedPoints, Degree=number_slider_10, Periodic=False, KnotStyle=1)  # -> simplify(Curve), Length, Domain; disabled
path_mapper_11 = PathMapper(ext_4, source="{A;B}", target="{A}")  # disabled
ccx_6 = CurveCurve(CurveA=path_mapper_11, CurveB=pline_13)  # -> Points, ParamsA, ParamsB; disabled
shatter_12 = Shatter(Curve=ext_4, Parameters=ccx_6.ParamsA)  # -> simplify(Segments); disabled
dispatch_11 = Dispatch(List=shatter_12, DispatchPattern=[True, False])  # -> ListA, ListB; disabled
geo_21 = Geometry(dispatch_11.ListB)  # disabled

end_18 = EndPoints(Curve=path_mapper_9)  # -> Start, End
geo_22 = Geometry([path_mapper_2, path_mapper_3, path_mapper_8])
# smoothing ends
# smoothing ends
end_19 = EndPoints(Curve=geo_22)  # -> Start, End
geo_23 = Geometry([end_18.Start, end_18.End])
geo_24 = Geometry([end_19.Start, end_19.End])
path_mapper_12 = PathMapper(geo_24, source="{A;B}", target="{A}")
item_42 = ListItem(List=path_mapper_12, Index=0, Wrap=True)
geo_25 = Geometry(path_mapper_12)
ptsortitems_3 = PointSortItems(Start=item_42, Points=geo_25)  # -> SortedItems, SortedIndices, simplify(SortedPoints)
intcrv_3 = Interpolate(Vertices=ptsortitems_3.SortedPoints, Degree=3, Periodic=False, KnotStyle=1)  # -> Curve, Length, Domain
lng_11 = ListLength(List=ptsortitems_3.SortedPoints)
crest_plane_elevation_3 = RemoteReceiver(crest_plane_elevation)
plane_elevations_6 = RemoteReceiver(plane_elevations)
number_slider_25 = Slider(50, range=0..100)
smocrv = SmoothCurve(
    Curve=intcrv_3.Curve,
    Steps=lng_11,
    StartType=0,
    EndType=0,
    DeviationTolerance=Slider(6, range=0..50),
    AngleTolerance=0.05)  # disabled
merge_14 = Merge(Data1=flatten(crest_plane_elevation_3), Data2=flatten(plane_elevations_6))
ext_5 = ExtendCurve(Curve=geo_22, Type=1, Start=number_slider_25, End=number_slider_25)
cull_i_11 = CullIndex(List=merge_14, Indices=-1, Wrap=True)
geo_26 = Geometry(geo_23)

# ----
# Deviation foundation here!
topoly_2 = CurveToPolyline(Curve=intcrv_3.Curve, ToleranceDistance=0, ToleranceAngle=Slider(0.4, range=0.1..1))  # -> Polyline, Segments

pcx_10 = CurvePlane(Curve=topoly_2.Polyline, Plane=cull_i_11)  # -> simplify(Points), ParamsC, ParamsP
crv_cp_4 = CurveClosestPoint(Point=pcx_10.Points, Curve=ext_5)  # -> Point, Parameter, Distance
dispatch_12 = Dispatch(List=crv_cp_4.Point, DispatchPattern=[True, False])  # -> ListA, ListB
item_43 = ListItem(List=dispatch_12.ListA, Index=0, Wrap=True)
item_44 = ListItem(List=dispatch_12.ListB, Index=0, Wrap=True)
geo_27 = Geometry([item_43, item_44, geo_26])

pshift_4 = ShiftPaths(Data=geo_27, Offset=-1)
item_45 = ListItem(List=pshift_4, Index=0, Wrap=True)
ptsortitems_4 = PointSortItems(Start=item_45, Points=pshift_4)  # -> SortedItems, SortedIndices, SortedPoints
path_mapper_13 = PathMapper(ext_5, source="{A;B}", target="{A}")
intcrv_4 = Interpolate(Vertices=ptsortitems_4.SortedPoints, Degree=Slider(3, range=0..10), Periodic=False, KnotStyle=1)  # -> simplify(Curve), Length, Domain
ccx_7 = CurveCurve(CurveA=path_mapper_13, CurveB=intcrv_4.Curve)  # -> Points, ParamsA, ParamsB
shatter_13 = Shatter(Curve=ext_5, Parameters=ccx_7.ParamsA)  # -> simplify(Segments)
dispatch_13 = Dispatch(List=shatter_13, DispatchPattern=[True, False])  # -> ListA, ListB
geo_28 = Geometry(dispatch_13.ListB)

geo_29 = Geometry(geo_28)
tstat_3 = TreeStatistics(Tree=geo_29)  # -> Paths, Length, Count
division_4 = Division(A=tstat_3.Count, B="2")
split_13 = SplitList(List=tstat_3.Paths, Index=division_4)  # -> ListA, ListB
item_46 = ListItem(List=split_13.ListA, Index=-1, Wrap=True)
item_47 = ListItem(List=split_13.ListB, Index=-1, Wrap=True)
cull_i_12 = CullIndex(List=split_13.ListA, Indices=-1, Wrap=True)  # -> flatten(List)
cull_i_13 = CullIndex(List=split_13.ListB, Indices=-1, Wrap=True)  # -> flatten(List)
path_6 = DataPath(flatten([cull_i_12, cull_i_13]))
split_14 = SplitTree(Data=geo_29, Masks=flatten(path_6))  # -> Positive, Negative
split_15 = SplitTree(Data=geo_29, Masks=flatten("{?;0}"))  # -> Positive, Negative
unflatten_2 = UnflattenTree(Tree=intcrv_4.Curve, Guide=split_14.Negative)
unflatten_3 = UnflattenTree(Tree=split_15.Negative, Guide=split_14.Positive)
geo_30 = Geometry([split_14.Positive, unflatten_3])
path_mapper_14 = PathMapper(unflatten_3, source="{A;B}", target="{A}")
lng_12 = ListLength(List=path_mapper_14)
repeat = RepeatData(Data=intcrv_4.Curve, Length=lng_12)
unflatten_4 = UnflattenTree(Tree=repeat, Guide=unflatten_3)
ccx_8 = CurveCurve(CurveA=unflatten_4, CurveB=geo_30)  # -> Points, simplify(ParamsA), ParamsB
pshift_5 = ShiftPaths(Data=ccx_8.ParamsA, Offset=-1)
shatter_14 = Shatter(Curve=unflatten_4, Parameters=pshift_5)  # -> simplify(Segments)
lng_13 = ListLength(List=shatter_14)
python_3 = GhPythonScript(x=lng_13, y=shatter_14)  # -> out, a, b
# ---------- python_3: Python ----------
__author__ = "Admin"
__version__ = "2023.08.14"

import rhinoscriptsyntax as rs

if x == 3:
    a = y
elif x == 5:
    b = y
# ---------- end python_3 ----------
clean_7 = CleanTree(RemoveNulls=True, RemoveInvalid=True, RemoveEmpty=False, Tree=python_3.b)
clean_8 = CleanTree(RemoveNulls=True, RemoveInvalid=True, RemoveEmpty=False, Tree=python_3.a)
geo_31 = Geometry(split_14.Negative)
geo_32 = Geometry(unflatten_2)

panel_91 = Panel(geo_28)
equals_6 = Equality(FirstNumber=lng_13, SecondNumber=panel_38)  # -> Equality, Inequality; disabled
dispatch_14 = Dispatch(List=shatter_14, DispatchPattern=equals_6.Equality)  # -> ListA, ListB; disabled
clean_9 = CleanTree(RemoveNulls=True, RemoveInvalid=True, RemoveEmpty=False, Tree=dispatch_14.ListA)  # disabled
clean_10 = CleanTree(RemoveNulls=True, RemoveInvalid=True, RemoveEmpty=False, Tree=dispatch_14.ListB)  # disabled

dispatch_15 = Dispatch(List=clean_10, DispatchPattern=[True, False])  # -> ListA, ListB; disabled
geo_33 = Geometry(clean_9)  # disabled
panel_92 = Panel("1")  # disabled
geo_34 = Geometry(dispatch_15.ListB)  # disabled
cull_i_14 = CullIndex(List=geo_33, Indices=panel_92, Wrap=True)  # -> simplify(List); disabled
geo_35 = Geometry([geo_30, geo_34, cull_i_14])  # disabled
item_48 = ListItem(List=geo_35, Index=0, Wrap=True)  # -> Item, Item1, Item2, Item3; disabled
netsurf = NetworkSurface(CurvesU=[item_48.Item, item_48.Item1], CurvesV=[item_48.Item2, item_48.Item3], Continuity=3)  # disabled

dispatch_16 = Dispatch(List=clean_7, DispatchPattern=[True, False])  # -> ListA, ListB
geo_36 = Geometry(clean_8)
cull_i_15 = CullIndex(List=geo_36, Indices="1", Wrap=True)  # -> simplify(List)
geo_37 = Geometry(dispatch_16.ListB)
geo_38 = Geometry([geo_30, geo_37, cull_i_15])
item_49 = ListItem(List=geo_38, Index=0, Wrap=True)  # -> Item, Item1, Item2, Item3
netsurf_2 = NetworkSurface(CurvesU=[item_49.Item, item_49.Item1], CurvesV=[item_49.Item2, item_49.Item3], Continuity=3)

# ----
# Creating surfaces
ccx_9 = CurveCurve(CurveA=geo_32, CurveB=geo_31)  # -> Points, ParamsA, ParamsB
shatter_15 = Shatter(Curve=geo_32, Parameters=ccx_9.ParamsA)
pshift_6 = ShiftPaths(Data=shatter_15, Offset=-1)
item_50 = ListItem(List=pshift_6, Index="1", Wrap=True)
loft_4 = Loft(
    Curves=[item_50, geo_31],
    Options={Adjust=True, Closed=False, LoftEnds=0, LoftSimp=0, LoftType=5, Rebuild=10, Refit=0.01})

tbi = TreeBranchIndex(DataTree=netsurf, BranchIndex=number_slider_11)  # disabled
x_tremez_5 = Extremes(Curve=flatten(item_50), Plane=PlaneXY(0, 0, 0))  # -> Highest, Lowest
dam_9 = DataDam(DataA=loft_4, DataB=netsurf_2, BufferDelay=10000000, BufferMode=1)  # -> DataA, DataB
pt_10 = Point(x_tremez_5.Lowest)
foundation_point_arch_dam = RemoteSender(pt_10)
path_mapper_15 = PathMapper([dam_9.DataA, dam_9.DataB], source="{A;B}", target="{A}")
join_13 = BrepJoin(Breps=flatten(path_mapper_15))  # -> Breps, Closed
item_51 = ListItem(List=join_13.Breps, Index=Slider(2, range=0..10), Wrap=True)
item_52 = ListItem(List=join_13.Breps, Index=1, Wrap=True)  # -> Item, Item1
item_53 = ListItem(List=join_13.Breps, Index=0, Wrap=True)  # -> Item, Item1
arch_us_face = RemoteSender(item_52.Item1)
arch_ds_face = RemoteSender(item_52.Item)
arch_ds_face_2 = RemoteReceiver(arch_ds_face)
mesh_14 = Mesh(arch_ds_face_2)
filter_5 = StreamFilter(Gate=dam_type_8, Stream0=null, Stream1=mesh_14, Stream2=null)
loft_5 = Loft(
    Curves=flatten([item_53.Item, item_53.Item1]),
    Options={Adjust=True, Closed=False, LoftEnds=0, LoftSimp=0, LoftType=5, Rebuild=10, Refit=0.01})
join_14 = BrepJoin(Breps=flatten([join_13.Breps, loft_5]))  # -> Breps, Closed
mesh_15 = MeshBrep(Brep=join_14.Breps, Settings=jagged_5)
volume_5 = MeshVolume(Mesh=mesh_15)  # -> Volume, Centroid
geo_archdam = RemoteSender(mesh_15)
geo_archdam_2 = RemoteReceiver(geo_archdam)
mshclsd = IsMeshClosed(Mesh=geo_archdam_2)
panel_93 = Panel(mshclsd)
geo_archdam_3 = RemoteReceiver(geo_archdam)
filter_6 = StreamFilter(Gate=dam_type_9, Stream0=geo_concretedam_3, Stream1=geo_archdam_3, Stream2=geo_embankmentdam_2)

dam_10 = DataDam(DataWaterSectionMeshes=merge_9, DataDamGeometry=filter_6, DataDamCollision=filter_5, BufferDelay=10000000, BufferMode=1)  # -> DataWaterSectionMeshes, DataDamGeometry, DataDamCollision

gate = StreamGate(Stream=dam_10.DataWaterSectionMeshes, Gate=dam_type_10)  # -> Target0, Target1, Target2
gate_2 = StreamGate(Stream=dam_10.DataDamGeometry, Gate=dam_type_11)  # -> Target0, Target1, Target2
cullvertices = MeshCullUnusedVertices(Mesh=gate_2.Target1)
filter_7 = StreamFilter(Gate=dam_type_12, Stream1=gate.Target1, Stream2=gate.Target2)
filter_8 = StreamFilter(Gate=dam_type_12, Stream0=gate_2.Target0, Stream1=cullvertices, Stream2=gate_2.Target2)
mdif = MeshDifference(MeshesA=filter_7, MeshesB=filter_8)
disjoint_2 = DisjointMesh(Mesh=mdif)
volume_6 = Volume(Geometry=disjoint_2)  # -> Volume, Centroid; disabled
tbi_2 = TreeBranchIndex(DataTree=mdif, BranchIndex=number_slider_7)  # disabled
ma_2 = MassAddition(Input=flatten(volume_6.Volume))  # -> Result, PartialResults; disabled
path_mapper_16 = PathMapper(disjoint_2, source="{A;B}", target="{A}")
rebmsh = RebuildMesh(
    Mesh=mdif,
    RebuildNormals=toggle,
    CullUnused=toggle,
    UnifyNormals=toggle,
    FlipNormals=toggle,
    IdenticalCombine=toggle,
    WeldVertices=number_slider_8)  # disabled
subtraction_6 = Subtraction(A=ma.Result, B=ma_2.Result)  # disabled
disjoint_3 = DisjointMesh(Mesh=rebmsh)  # disabled
colom_5 = CollisionOneMany(Collider=path_mapper_16, Obstacles=dam_10.DataDamCollision)  # -> Collision, Index
dispatch_17 = Dispatch(List=path_mapper_16, DispatchPattern=colom_5.Index)  # -> ListA, ListB
geo_39 = Geometry(simplify(gate.Target0))
geo_40 = Geometry(dispatch_17.ListA)
gate_3 = StreamGate(Stream=geo_40, Gate=dam_type_13)  # -> Target0, Target1, Target2
filter_9 = StreamFilter(Gate=dam_type_14, Stream0=geo_39, Stream1=gate_3.Target1, Stream2=gate_3.Target2)
flatten_3 = FlattenTree(Tree=filter_9, Path="{0}")
archdam_volume = RemoteSender(volume_5.Volume)
foundation_point_arch_dam_2 = RemoteReceiver(foundation_point_arch_dam)
arch_us_face_2 = RemoteReceiver(arch_us_face)
archdam_volume_2 = RemoteReceiver(archdam_volume)
m3_to_hm3 = Expression(x=archdam_volume_2, Expression="x/1000000")
area = Area(Geometry=arch_us_face_2)  # -> Area, Centroid
sort_14 = SortList(Keys=foundation_point_arch_dam_2, ValuesA=foundation_point_arch_dam_2)  # -> Keys, ValuesA
expression_18 = Expression(S=area.Area, H=arch_dam_height_5, V=archdam_volume_2, Expression="(s²)/(H*V)")
item_54 = ListItem(List=sort_14.ValuesA, Index=0, Wrap=True)
pdecon_11 = Deconstruct(Point=item_54)  # -> XComponent, YComponent, ZComponent
roundd_9 = RoundToDecimalPlace(NumberX=m3_to_hm3, DecimalPlace=Slider(2, range=0..10), RoundType=0)  # -> flatten(Rounded), Difference
roundd_10 = RoundToDecimalPlace(NumberX=expression_18, DecimalPlace=number_slider_12, RoundType=0)  # -> flatten(Rounded), Difference
roundd_11 = RoundToDecimalPlace(NumberX=pdecon_11.ZComponent, DecimalPlace=number_slider_12, RoundType=0)  # -> flatten(Rounded), Difference
roundd_12 = RoundToDecimalPlace(NumberX=area.Area, DecimalPlace=number_slider_12, RoundType=0)  # -> flatten(Rounded), Difference
panel_94 = Panel(roundd_10.Rounded)
panel_95 = Panel(roundd_9.Rounded)
merge_15 = Merge(
    Data1=dam_axis_name_5,
    Data2=dam_name_translation_5,
    Data3=roundd_8.Rounded,
    Data4=roundd_11.Rounded,
    Data5=normal_water_level_7,
    Data6=dam_level_4,
    Data7=roundd_3.Rounded,
    Data8=width_base_2,
    Data9=width_crest_3,
    Data10=width_0_45_2,
    Data11=roundd.Rounded,
    Data12=roundd_2.Rounded,
    Data13=roundd_4.Rounded,
    Data14=roundd_12.Rounded,
    Data15=roundd_9.Rounded,
    Data16=roundd_10.Rounded)
panel_96 = Panel(merge_15)
geo_archdam_4 = RemoteReceiver(geo_archdam)
transform_3 = Transform(Geometry=geo_archdam_4, Transform=transform_origin_4)

# ----
# Dam
dam_type_15 = RemoteReceiver(dam_type_2)
geo_concretedam_4 = RemoteReceiver([geo_concretedam, geo_concretedam_2])
geo_archdam_5 = RemoteReceiver(geo_archdam)
geo_embankmentdam_3 = RemoteReceiver(geo_embankmentdam)
filter_10 = StreamFilter(Gate=dam_type_15, Stream0=geo_concretedam_4, Stream1=geo_archdam_5, Stream2=geo_embankmentdam_3)
chord_dam_14 = RemoteReceiver(chord_dam)
swatch_6 = ColourSwatch(SwatchColor=RGB(207, 151, 68))
preview_3 = CustomPreview(Geometry=filter_10, Material=swatch_6)
curve_preview_7 = CustomCurvePreview(Curve=chord_dam_14, Linetype=<geometry referenced from the Rhino model>, Colour=swatch_6)

# ----
# Levels
levels_at_water_height_2 = RemoteReceiver(levels_at_water_height)
levels_dam_height_2 = RemoteReceiver(levels_dam_height)
linetypes_5 = QueryModelLinetypes(Name="Section", AutoUpdateState=True)
curve_preview_8 = CustomCurvePreview(Curve=levels_dam_height_2, Linetype=linetypes_5, Colour=swatch_6)
curve_preview_9 = CustomCurvePreview(Curve=levels_at_water_height_2, Linetype=linetypes_5, Colour=ColourSwatch(SwatchColor=RGB(2, 102, 189)))

end_20 = EndPoints(Curve=levels_at_water_height_2)  # -> Start, End
end_21 = EndPoints(Curve=levels_dam_height_2)  # -> Start, End
linear_dimension = LinearDimension(PointA=end_20.Start, PointB=end_21.Start)  # -> LinearDimension, BaseLine, PointA, PointB
aligned_dimension = AlignedDimension(PointA=end_20.Start, PointB=end_21.Start)  # -> AlignedDimension, PointA, PointB, Offset, Plane
preview_4 = CustomPreview(Geometry=filter_10, Material=swatch_6)
preview_5 = CustomPreview(Geometry=filter_10, Material=material_3)
geo_archdam_6 = RemoteReceiver(geo_archdam)  # disabled
archdam_volume_3 = RemoteReceiver(archdam_volume)  # disabled
format_7 = Format(
    Format=panel_50,
    Culture=127,
    Data0=normal_water_level_9,
    Data1=dam_level_5,
    Data2=pdecon_3.ZComponent,
    Data3=arch_dam_height_6,
    Data4=axis_straight_terrain_4,
    Data5=len_4,
    Data6=len_6,
    Data7=archdam_volume_3)  # disabled
archdam_volume_4 = RemoteReceiver(archdam_volume)  # disabled
archdam_volume_5 = RemoteReceiver(archdam_volume)  # disabled
entwine_4 = Entwine(
    Branch00=normal_water_level_10,
    Branch01=dam_level_6,
    Branch02=pdecon_3.ZComponent,
    Branch03=arch_dam_height_7,
    Branch04=archdam_volume_4,
    Branch05=len_4,
    Branch06=len_6,
    Branch07=archdam_volume_5,
    FlattenInputs=True)  # -> flatten(Result); disabled
panel_97 = Panel(entwine_4)  # disabled
transform_4 = Transform(Geometry=geo_archdam_6, Transform=transform_origin_5)  # disabled
geo_41 = Geometry(flatten(transform_4))  # disabled
merge_16 = Merge(Data1=panel_97, Data2=trim)  # disabled
join_15 = TextJoin(Text=merge_16, Join=panel_58)  # disabled
panel_98 = Panel([join_12, join_15])  # disabled
panel_99 = Panel(merge_16)  # disabled
num_6 = Number(panel_99)  # disabled
move_17 = Move(Geometry=geo_archdam_6, Motion=transform_origin_6)  # -> Geometry, Transform; disabled
exportvector = ExportVector(
    VectorDataFilename=concat_7,
    VectorDataFolder=concat_8,
    Fields=panel_62,
    Values=num_3,
    FeatureGeometry=move_17.Geometry,
    Export=button_4,
    DriverExtension=".shp",
    DriverType="ESRI Shapefile")  # disabled
exportvector_2 = ExportVector(
    VectorDataFilename=concat_6,
    VectorDataFolder=concat_8,
    Fields=panel_66,
    Values=panel_65,
    FeatureGeometry=geo_41,
    Export=button_5,
    DriverExtension=".shp",
    DriverType="ESRI Shapefile")  # disabled
exportvector_3 = ExportVector(
    VectorDataFilename=concat_6,
    VectorDataFolder=concat_8,
    Fields=panel_88,
    Values=num_6,
    FeatureGeometry=geo_41,
    Export=toggle_2,
    DriverExtension=".shp",
    DriverType="ESRI Shapefile")  # disabled
panel_100 = Panel(exportvector)  # disabled

geo_42 = Geometry(simplify(graft(flatten_3)))
dup_8 = DuplicateDataMatch(SourceDataTree=filter_9, SecondaryData1=dam_8)  # -> SourceData, SecondaryData1
volume_7 = Volume(Geometry=geo_42)  # -> Volume, Centroid
debox = DeconstructBox(Box=geo_42)  # -> Plane, X, Y, Z
dedomain_3 = DeconstructDomain(Domain=debox.Z)  # -> Start, End
m3_to_hm3_2 = Expression(x=volume_7.Volume, Expression="x/1000000")
roundd_13 = RoundToDecimalPlace(NumberX=m3_to_hm3_2, DecimalPlace=number_slider_23, RoundType=0)  # -> Rounded, Difference
dup_9 = DuplicateDataMatch(SourceDataTree=roundd_13.Rounded, SecondaryData1=dam_axis_name_7)  # -> SourceData, SecondaryData1
dup_10 = DuplicateDataMatch(SourceDataTree=roundd_13.Rounded, SecondaryData1=dam_name_translation_6)  # -> SourceData, SecondaryData1
dup_11 = DuplicateDataMatch(SourceDataTree=roundd_13.Rounded, SecondaryData1=normal_water_level_11)  # -> SourceData, SecondaryData1

water_total_geo = RemoteSender(geo_42)

# ---- group: Check - Volume final
volume_8 = Volume(Geometry=dispatch_17.ListB)  # -> Volume, Centroid; disabled
ma_3 = MassAddition(Input=flatten(volume_8.Volume))  # -> Result, PartialResults; disabled
ma_4 = MassAddition(Input=flatten(volume_7.Volume))  # -> Result, PartialResults; disabled
subtraction_7 = Subtraction(A=ma.Result, B=ma_3.Result, C=subtraction_6)  # disabled
volume_final = Panel(ma_4.Result)  # disabled
volume_test = Panel(subtraction_7)  # disabled

# ----
unflatten_5 = UnflattenTree(Tree=dup_8.SecondaryData1, Guide=geo_42)
is_dead = RemoteSender(unflatten_5)

# ---- group: Rounding to 0.1 (continued)
roundd_14 = RoundToDecimalPlace(NumberX=dedomain_3.Start, DecimalPlace=number_slider_22, RoundType=0)  # -> Rounded, Difference
roundd_15 = RoundToDecimalPlace(NumberX=dedomain_3.End, DecimalPlace=number_slider_22, RoundType=0)  # -> Rounded, Difference

# ----
water_total_volume = RemoteSender(roundd_13.Rounded)

num_7 = Number(roundd_14.Rounded)
num_8 = Number(roundd_15.Rounded)
merge_17 = Merge(
    Data1=dup_9.SecondaryData1,
    Data2=dup_10.SecondaryData1,
    Data3=dup_11.SecondaryData1,
    Data4=num_7,
    Data5=num_8,
    Data6=roundd_13.Rounded,
    Data7=unflatten_5)
panel_101 = Panel(merge_17)

values_water = RemoteSender(merge_17)
values_water_2 = RemoteReceiver(values_water)
water_total_geo_2 = RemoteReceiver(water_total_geo)
transform_5 = Transform(Geometry=water_total_geo_2, Transform=transform_origin_2)

dam_11 = DataDam(
    DataA=panel_41,
    DataB=panel_46,
    DataC=panel_40,
    DataD=values_water_2,
    DataE=transform_5,
    BufferDelay=10000000,
    BufferMode=0)  # -> DataA, DataB, DataC, DataD, DataE
dam_12 = DataDam(DataA=panel_42, DataE=panel_47, DataB=crv, DataC=item_17, DataD=dam_axis_name_6, BufferDelay=10000000, BufferMode=0)  # -> DataA, DataE, DataB, DataC, DataD
dam_13 = DataDam(DataA=panel_43, DataB=panel_48, DataC=panel_44, DataD=merge_15, DataE=transform_3, BufferDelay=10000000, BufferMode=0)  # -> DataA, DataB, DataC, DataD, DataE
objfromgroup_8 = GetObjectsInGroup()

output = DataOutput(
    A=dam_11.DataA,
    B=dam_11.DataB,
    C=dam_11.DataC,
    D=dam_11.DataD,
    E=dam_11.DataE,
    Destination="C:\Users\Admin\Documents\Github\EarlyStageDesign\JD\Skripts\ghData\Water_test_to_export.ghdata",
    RelativePath="C:\Users\Admin\Documents\Github\EarlyStageDesign\JD\Skripts\ghData\Water_test_to_export.ghdata|ghData\Water_test_to_export.ghdata")
output_2 = DataOutput(
    D=dam_12.DataA,
    E=dam_12.DataE,
    A=dam_12.DataB,
    C=dam_12.DataC,
    B=dam_12.DataD,
    Destination="C:\Users\Admin\Documents\Github\EarlyStageDesign\JD\Skripts\ghData\DamAxis.ghdata",
    RelativePath="C:\Users\Admin\Documents\Github\EarlyStageDesign\JD\Skripts\ghData\DamAxis.ghdata|ghData\DamAxis.ghdata")
output_3 = DataOutput(
    A=dam_13.DataA,
    B=dam_13.DataB,
    C=dam_13.DataC,
    D=dam_13.DataD,
    E=dam_13.DataE,
    Destination="C:\Users\Admin\Documents\Github\EarlyStageDesign\JD\Skripts\ghData\ArchDam_test_to_export.ghdata",
    RelativePath="C:\Users\Admin\Documents\Github\EarlyStageDesign\JD\Skripts\ghData\ArchDam_test_to_export.ghdata|ghData\ArchDam_test_to_export.ghdata")
lng_14 = ListLength(List=objfromgroup_8)
panel_102 = Panel(dam_12.DataD)
dup_12 = DuplicateData(Data=send_to_export, Number=lng_14, Order=True)
panel_103 = Panel(dam_12.DataC)
# Arch dam
# Water
water_total_geo_3 = RemoteReceiver(water_total_geo)
is_dead_2 = RemoteReceiver(is_dead)
setobj_4 = SetObjectValue(ObjectToSet=objfromgroup_8, ValueToSet=dup_12)
not_2 = GateNot(A=is_dead_2)
dispatch_18 = Dispatch(List=water_total_geo_3, DispatchPattern=not_2)  # -> ListA, ListB

# ----
# Text  Arch Dam
# Text water volume
# Text axis
# Text water level
# Text dam level
levels_at_water_height_3 = RemoteReceiver(levels_at_water_height)  # disabled
levels_dam_height_3 = RemoteReceiver(levels_dam_height)  # disabled
water_total_geo_4 = RemoteReceiver(water_total_geo)  # disabled
is_dead_3 = RemoteReceiver(is_dead)  # disabled
water_total_volume_2 = RemoteReceiver(water_total_volume)  # disabled
is_dead_4 = RemoteReceiver(is_dead)  # disabled
dam_type_16 = RemoteReceiver(dam_type_2)  # disabled
gravity_volume_3 = RemoteReceiver([gravity_volume, gravity_volume_2])  # disabled
archdam_volume_6 = RemoteReceiver(archdam_volume)  # disabled
embankment_volume_2 = RemoteReceiver(embankment_volume)  # disabled
dam_type_17 = RemoteReceiver(dam_type_2)  # disabled
chord_dam_15 = RemoteReceiver(chord_dam)  # disabled
point_crest_3 = RemoteReceiver(point_crest)  # disabled
not_3 = GateNot(A=is_dead_4)  # disabled
dam_axis_name_8 = RemoteReceiver(dam_axis_name)  # disabled
chord_dam_16 = RemoteReceiver(chord_dam)  # disabled
midpt_4 = CurveMiddle(Curve=chord_dam_15)  # disabled
font_size_2 = RemoteReceiver(font_size)  # disabled
not_4 = GateNot(A=is_dead_3)  # disabled
dispatch_19 = Dispatch(List=water_total_volume_2, DispatchPattern=not_3)  # -> ListA, ListB; disabled
number_slider_26 = Slider(0.9, range=0..1)  # disabled
number_slider_27 = Slider(100, range=0..100)  # disabled
number_slider_28 = Slider(0.99, range=0..1)  # disabled
filter_11 = StreamFilter(Gate=dam_type_16, Stream0=gravity_volume_3, Stream1=archdam_volume_6, Stream2=embankment_volume_2)  # disabled
filter_12 = StreamFilter(Gate=dam_type_17, Stream0=midpt_4, Stream1=point_crest_3, Stream2=midpt_4)  # disabled
number_slider_29 = Slider(0.2, range=0..1)  # disabled
number_slider_30 = Slider(100, range=0..100)  # disabled
dispatch_20 = Dispatch(List=water_total_geo_4, DispatchPattern=not_4)  # -> ListA, ListB; disabled
number_slider_31 = Slider(100, range=0..100)  # disabled
ma_5 = MassAddition(Input=flatten(dispatch_19.ListA))  # -> Result, PartialResults; disabled
ma_6 = MassAddition(Input=flatten(dispatch_19.ListB))  # -> Result, PartialResults; disabled
panel_104 = Panel("Volume: {0:0,0} m3")  # disabled
mesh_16 = Mesh(flatten(dispatch_20.ListA))  # disabled
panel_105 = Panel("""Total capacity: {0:0,0.0} hm3
Useful capacity: {1:0,0.0} hm3
Dead capacity: {2:,0.00} hm3""")  # disabled
number_slider_32 = Slider(100, range=0..100)  # disabled
mesh_17 = Mesh(flatten(dispatch_20.ListB))  # disabled
ma_7 = MassAddition(Input=flatten([ma_5.Result, ma_6.Result]))  # -> Result, PartialResults; disabled
Z_14 = UnitZ(Factor=number_slider_27)  # disabled
item_55 = ListItem(List=flatten(mesh_16), Index=0, Wrap=True)  # disabled
Z_15 = UnitZ(Factor=number_slider_30)  # disabled
eval_10 = EvaluateCurve(Curve=reparameterize(chord_dam_16), Parameter=number_slider_29)  # -> Point, Tangent, Angle; disabled
Z_16 = UnitZ(Factor=number_slider_31)  # disabled
format_8 = Format(Format=panel_104, Culture=2055, Data0=filter_11)  # disabled
center_10 = Center(Geometry=flatten(dispatch_20.ListA), forall=True)  # -> Center, Dimension; disabled
center_11 = Center(Geometry=mesh_17, forall=True)  # -> Center, Dimension; disabled
center_12 = Center(Geometry=item_55, forall=True)  # -> Center, Dimension; disabled
move_18 = Move(Geometry=eval_10.Point, Motion=Z_16)  # -> Geometry, Transform; disabled
Z_17 = UnitZ(Factor=number_slider_32)  # disabled
panel_106 = Panel(format_8)  # disabled
format_9 = Format(Format=panel_105, Culture=2055, Data0=ma_7.Result, Data1=ma_5.Result, Data2=ma_6.Result)  # disabled
move_19 = Move(Geometry=filter_12, Motion=Z_17)  # -> Geometry, Transform; disabled
ln_12 = Line(StartPoint=eval_10.Point, EndPoint=move_18.Geometry)  # disabled
item_56 = ListItem(List=format_9, Index=0, Wrap=True)  # -> Item, Item1, Item2; disabled
ln_13 = Line(StartPoint=filter_12, EndPoint=move_19.Geometry)  # disabled
number_slider_33 = Slider(324, range=0..500)  # disabled
number_slider_34 = Slider(336, range=0..500)  # disabled
number_slider_35 = Slider(293, range=0..500)  # disabled
font_size_3 = RemoteReceiver(font_size)  # disabled
font_size_4 = RemoteReceiver(font_size)  # disabled
panel_107 = Panel("Crest level: {0:0,0} m")  # disabled
leader_3 = RemoteSender(ln_12)  # disabled
leader_4 = RemoteSender(ln_13)  # disabled
panel_108 = Panel("Water level: {0:0,0} m")  # disabled
font_size_5 = RemoteReceiver(font_size)  # disabled
objfromgroup_9 = GetObjectsInGroup()
Z_18 = UnitZ(Factor=number_slider_34)  # disabled
Z_19 = UnitZ(Factor=number_slider_33)  # disabled
Z_20 = UnitZ(Factor=number_slider_35)  # disabled
move_20 = Move(Geometry=center_10.Center, Motion=Z_18)  # -> Geometry, Transform; disabled
move_21 = Move(Geometry=center_12.Center, Motion=Z_19)  # -> Geometry, Transform; disabled
move_22 = Move(Geometry=center_11.Center, Motion=Z_20)  # -> Geometry, Transform; disabled
entwine_5 = Entwine(Branch00=item_56.Item, Branch01=item_56.Item1, FlattenInputs=True)  # disabled
entwine_6 = Entwine(Branch00=move_20.Geometry, Branch01=move_21.Geometry, FlattenInputs=True)  # disabled
ln_14 = Line(StartPoint=center_10.Center, EndPoint=move_20.Geometry)  # disabled
ln_15 = Line(StartPoint=center_12.Center, EndPoint=move_21.Geometry)  # disabled
ln_16 = Line(StartPoint=center_11.Center, EndPoint=move_22.Geometry)  # disabled

item_57 = ListItem(List=levels_dam_height_3, Index=0, Wrap=True)
item_58 = ListItem(List=levels_at_water_height_3, Index=0, Wrap=True)

eval_11 = EvaluateCurve(Curve=reparameterize(item_57), Parameter=number_slider_26)  # -> Point, Tangent, Angle; disabled
eval_12 = EvaluateCurve(Curve=reparameterize(item_58), Parameter=number_slider_28)  # -> Point, Tangent, Angle; disabled
move_23 = Move(Geometry=eval_11.Point, Motion=Z_14)  # -> Geometry, Transform; disabled
move_24 = Move(Geometry=eval_12.Point, Motion=Z_15)  # -> Geometry, Transform; disabled
ln_17 = Line(StartPoint=eval_11.Point, EndPoint=move_23.Geometry)  # disabled
ln_18 = Line(StartPoint=eval_12.Point, EndPoint=move_24.Geometry)  # disabled
pdecon_12 = Deconstruct(Point=eval_11.Point)  # -> XComponent, YComponent, ZComponent; disabled
pdecon_13 = Deconstruct(Point=eval_12.Point)  # -> XComponent, YComponent, ZComponent; disabled
leader_5 = RemoteSender(ln_17)  # disabled
leader_6 = RemoteSender(ln_18)  # disabled
format_10 = Format(Format=panel_107, Culture=2055, Data0=pdecon_12.ZComponent)  # disabled
format_11 = Format(Format=panel_108, Culture=2055, Data0=pdecon_13.ZComponent)  # disabled

text_dot = TextDot(Location=move_18.Geometry, PrimaryText=dam_axis_name_8, TextHeight=font_size_2)
text_dot_2 = TextDot(Location=move_19.Geometry, PrimaryText=panel_106, TextHeight=font_size_5)
text_dot_3 = TextDot(Location=move_23.Geometry, PrimaryText=format_10, TextHeight=font_size_3)
text_dot_4 = TextDot(Location=move_24.Geometry, PrimaryText=format_11, TextHeight=font_size_4)
lng_15 = ListLength(List=objfromgroup_9)

font_size_6 = RemoteReceiver(font_size)  # disabled
text_dot_5 = TextDot(Location=move_22.Geometry, PrimaryText=item_56.Item2, TextHeight=font_size_6)  # disabled
leader_7 = RemoteSender(ln_16)  # disabled
preview_6 = CustomPreview(Geometry=dispatch_18.ListB, Material=material_2)  # disabled
preview_7 = CustomPreview(Geometry=dispatch_18.ListB, Material=material_2)  # disabled
objfromgroup_10 = GetObjectsInGroup()

dup_13 = DuplicateData(Data=show_text, Number=lng_15, Order=True)

font_size_7 = RemoteReceiver(font_size)  # disabled
text_dot_6 = TextDot(Location=entwine_6, PrimaryText=entwine_5, TextHeight=font_size_7)  # disabled
leader_8 = RemoteSender(ln_14)  # disabled
leader_9 = RemoteSender(ln_15)  # disabled
preview_8 = CustomPreview(Geometry=dispatch_18.ListA, Material=material_2)  # disabled
preview_9 = CustomPreview(Geometry=dispatch_18.ListA, Material=material_2)  # disabled
objfromgroup_11 = GetObjectsInGroup()

leader_10 = RemoteReceiver([leader_8, leader_9, leader_7, leader_4, leader_3, leader_6, leader_5])
curve_preview_10 = CustomCurvePreview(Curve=leader_10, Linetype={Path="Continuous", Width=0, BaseSystem=0}, Colour=ColourSwatch(SwatchColor=RGB(69, 69, 69)))
onoff_5 = EnableDisableObject(
    Objects=objfromgroup_9,
    Enabled=dup_13,
    AllObjects_Object=[is_dead_3, water_total_volume_2, water_total_geo_4, dispatch_20, dispatch_19, not_4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])
lng_16 = ListLength(List=objfromgroup_10)
lng_17 = ListLength(List=objfromgroup_11)
dup_14 = DuplicateData(Data=show_dead_capacity, Number=lng_16, Order=True)
dup_15 = DuplicateData(Data=show_useful_capacity, Number=lng_17, Order=True)
onoff_6 = EnableDisableObject(Objects=objfromgroup_10, Enabled=dup_14, AllObjects_Object=[preview_6, leader_7, font_size_6, text_dot_5, preview_7])
onoff_7 = EnableDisableObject(
    Objects=objfromgroup_11,
    Enabled=dup_15,
    AllObjects_Object=[preview_8, leader_8, leader_9, font_size_7, text_dot_6, preview_9])
