# Grasshopper definition JD_Beta_close origin_design_hybrid_2.gh (Grasshopper 1.0.7)
# plug-ins: Telepathy, MetaHopper, UiPlus, Heteroptera, Pufferfish, MeshEdit Components, Hops, EleFront, Heron, TT Toolbox, RhinoCodePluginGH

panel = Panel("Resources\Translations\Water_fr.txt")
panel_2 = Panel("Resources\Translations\Water_en.txt")
# Water fields
panel_3 = Panel("Resources\Translations\Water_en_simplified.txt")
# Arch Dam fields
panel_4 = Panel("Resources\Translations\ArchDam_en.txt")

panel_5 = Panel("""Concrete gravity dam
Arch dam
Embankment dam
Hybrid""")
# Dam configuration
# Dashboard structure
panel_6 = Panel("Type of Dam (m)")

# ----
# Requirements hops scripts
panel_7 = Panel("Modules\Gravity.gh")
# Requirements plugins
panel_8 = Panel("""UI+
Metahopper
Pufferfish""")
# Language translation
list = ValueList({"English": 0, "French": 1, "German": 2}, selected="English")

# ---- group: INFO
# _________________________________
# 
# This file is done based on the rhino file:
# _________________________________
# "C:\Users\Admin\Gruner AG\BSBE [ORG] - Digitale Anwendungen ESD\04_Projekte\2023\CH_VS_Barrage Les Toules_SensitivityAnalysis_JD\Model\231708_Le toules-WSCH00320.3dm"
# Images folder - saved where the gh file is
# Image size settings
number_slider = Slider(700, range=0..1000)
# Infos & Settings
panel_9 = Panel("231708_Le toules.3dm")
viewport_1_for_images = Panel("Perspektive")
viewport_2_for_images = Panel("Drauf")
# Settings
viewport_3_for_images = Panel("Detail")
relpath = RelativePath(Path="Bilder")
multiplication = Multiplication(A=number_slider, B="7")
multiplication_2 = Multiplication(A=number_slider, B="5")
panel_10 = Panel(relpath)
viewport_name_3 = RemoteSender(viewport_3_for_images)
viewport_name_1 = RemoteSender(viewport_1_for_images)
viewport_name_2 = RemoteSender(viewport_2_for_images)
panel_11 = Panel("1446")
panel_12 = Panel(multiplication)
panel_13 = Panel("883")
panel_14 = Panel(multiplication_2)

# ----
panel_15 = Panel("C:\Users\Admin\Gruner AG\E2301308000 Nouveau Barrage des Toules [P_INT] - 2 TEC_DOC\JD")
# System unit
unit_system = UnitSystem(4)
# Today date
panel_16 = Panel("Today")
# Language formatting (translation and numbers)
culture = Culture(4108)
culture_2 = Culture(2055)
culture_3 = Culture(2057)
time = Time(panel_16)
panel_17 = Panel(unit_system)
panel_18 = Panel(culture_3)
panel_19 = Panel(culture_2)
panel_20 = Panel(culture)
relpath_2 = RelativePath(Path=panel_3)
relpath_3 = RelativePath(Path="Resources\Translations\Water_fr_simplified.txt")
relpath_4 = RelativePath(Path="Resources\Translations\Water_en_simplified.txt")
relpath_5 = RelativePath(Path=panel_4)
relpath_6 = RelativePath(Path="Resources\Translations\ArchDam_fr.txt")
relpath_7 = RelativePath(Path="Resources\Translations\ArchDam_en.txt")
panel_21 = Panel(time)
label = UiLabel(Label="Freeboard (m)", Style=3)
label_2 = UiLabel(Label=panel_6, Style=3)
label_3 = UiLabel(Label="Minimum water level", Style=3)
scroll_number = UiScrollNumber(Label="(m.asl)", Number=0, Wrap=False, Digits=3)
label_4 = UiLabel(Label="Normal water level (m.asl)", Style=3)
slider = UiSlider(Value=0.5, Bounds=Domain(0, 1), Increment=0.1)
srs = SetSpatialReferenceSystem(SRS="EPSG:2056")
label_5 = UiLabel(Label="Foundation depth (m)", Style=3)
button = UiButton(Label="Ok")
slider_2 = UiSlider(Value=0.5, Bounds=Domain(0, 1), Increment=0.1)
file = ReadFile(File=relpath_2, PerLineParse=True)
file_2 = ReadFile(File=relpath_3, PerLineParse=True)
file_3 = ReadFile(File=relpath_4, PerLineParse=True)
file_4 = ReadFile(File=relpath_5, PerLineParse=True)
file_5 = ReadFile(File=relpath_6, PerLineParse=True)
relpath_8 = RelativePath(Path="Modules\Dashboard_damConfiguration")
relpath_9 = RelativePath(Path="Modules\Embankment.gh")
relpath_10 = RelativePath(Path="Modules\Arch.gh")
relpath_11 = RelativePath(Path=panel_7)
file_6 = ReadFile(File=relpath_7, PerLineParse=True)
button_2 = UiButton(Label="Ok")
english = Panel(file)
french = Panel(file_2)
german = Panel(file_3)
english_2 = Panel(file_4)
french_2 = Panel(file_5)
german_2 = Panel(file_6)
merge = Merge(Data1=label_5, Data2=slider_2)
merge_2 = Merge(Data1=relpath_11, Data2=relpath_10, Data3=relpath_9, Data4=relpath_8)
merge_3 = Merge(Data1=label, Data2=slider)
merge_4 = Merge(Data1=label_3, Data2=scroll_number)
panel_22 = Panel(merge_2)
path_save = RemoteSender(panel_15)
filepath_hops = RemoteSender(merge_2)
filter = StreamFilter(Gate=list, Stream0=english, Stream1=french, Stream2=german)  # -> flatten(Stream)
filter_2 = StreamFilter(Gate=list, Stream0=english_2, Stream1=french_2, Stream2=german_2)  # -> flatten(Stream)
format = Format(Format="{0:translate}", Culture=culture, Data0="Arch")
fields_water = RemoteSender(filter)
panel_23 = Panel(filter)
fields_archdam = RemoteSender(filter_2)
water_levels_17_11_23 = Panel("""1810
1823
1836
1842
1848""")
window = UiWindow(Elements=button_2, Title="Test button", Owner=1, Scroll=True, Launch=Button())
button_3 = UiButton(Element=button_2, Label="Send changes")
heights = Panel("""1836
1839
1842
1844""")
slider_3 = UiSlider(Element=slider, Label="m", Value="3", Bounds="0 To 5", Increment=".1")
button_4 = UiButton(Element=button, Label="Send changes")
slider_4 = UiSlider(Element=slider_2, Label="m", Value="10", Bounds="0 To 50", Increment=".1")
get_values = UiValues(Element=button_3)  # -> flatten(Values)
heights_2 = Panel("1747.5")
adjust_reservoir_to_dam = Button()
run_pre_geometry_of_water = Button()  # disabled
# Select dam type
run_water_final = Button()
# Select dam type
list_2 = ValueList({"Concrete gravity dam": "0", "Arch dam": "1", "Embankment dam": "2", "Hybrid": "3"}, selected="Hybrid")
dam_configuration = Button()
run_arch_dam = Button()
get_values_2 = UiValues(Element=slider_3)  # -> flatten(Values)
get_values_3 = UiValues(Element=slider_4)  # -> flatten(Values)
get_values_4 = UiValues(Element=button_4)  # -> flatten(Values)
# Dashboard - fill in data and listen to outputs
dam_type_index = Panel("""0
1
2
3""")
num = Number(water_levels_17_11_23)
minimum_normal_water_level_preset = RemoteSender(heights_2)
minimum_normal_water_level_preset_2 = RemoteReceiver(minimum_normal_water_level_preset)
scroll_number_2 = UiScrollNumber(Element=scroll_number, Number=minimum_normal_water_level_preset_2, Wrap=False, Digits=Slider(1, range=0..1))
get_values_5 = UiValues(Element=scroll_number_2)  # -> flatten(Values)
minimum_water_level_m_input_from_dashboa = Panel(get_values_5)  # "Minimum water level (m) - Input from Dashboard"
freeboard_m_input_from_dashboard = Panel(get_values_2)
run_water_final_2 = RemoteSender(run_water_final)
run_water_pre = RemoteSender(adjust_reservoir_to_dam)
offset_foundation_m_input_from_dashboard = Panel(get_values_3)
# must be a closed volume!
run_archdam = RemoteSender(run_arch_dam)
sort = SortList(Keys=water_levels_17_11_23, ValuesA=num)  # -> Keys, ValuesA
panel_24 = Panel(get_values_4)
panel_25 = Panel(get_values_4)
panel_26 = Panel("""False
False
False
False""")
list_of_heights = RemoteSender(sort.ValuesA)
list_of_heights_2 = RemoteReceiver(list_of_heights)
dropdown_list = UiDropdownList(Values=list_of_heights_2)
merge_5 = Merge(Data1=label_4, Data2=dropdown_list)
list_of_heights_3 = RemoteReceiver(list_of_heights)
dropdown_list_2 = UiDropdownList(Element=dropdown_list, Values=list_of_heights_3, Index=Slider(0, range=0..10))
get_values_6 = UiValues(Element=dropdown_list_2)  # -> flatten(Values)
item = ListItem(List=list_of_heights_3, Index=get_values_6, Wrap=True)
water_level_m_input_from_dashboard = Panel(item)
replace = ReplaceItems(List=panel_26, Item="True", Indices=list_2, Wrap=False)
dam_selection = RemoteSender(replace)
dam_selection_2 = RemoteReceiver(dam_selection)
panel_27 = Panel(dam_selection_2)
radio = UiRadio(Label=panel_5, State=panel_27, Group="Group 1")
merge_6 = Merge(Data1=label_2, Data2=radio)  # -> flatten(Result)
merge_7 = Merge(Data1=merge_6, Data2=merge_5, Data3=merge_4, Data4=merge_3, Data5=merge, Data6=button)
get_values_7 = UiValues(Element=radio)  # -> flatten(Values)
dam_type = Panel(get_values_7)
dispatch = Dispatch(List=dam_type_index, DispatchPattern=dam_type)  # -> ListA, ListB
dashboard_damconfiguration = RemoteSender(dam_configuration)
dashboard_damconfiguration_2 = RemoteReceiver(dashboard_damconfiguration)
window_2 = UiWindow(Elements=merge_7, Title="Dam Configuration", Owner=1, Scroll=True, Launch=dashboard_damconfiguration_2)
minimum_water_level = RemoteSender(minimum_water_level_m_input_from_dashboa)

dam = DataDam(
    DataA=dispatch.ListA,
    DataB=water_level_m_input_from_dashboard,
    DataC=freeboard_m_input_from_dashboard,
    DataD=offset_foundation_m_input_from_dashboard,
    BufferDelay=5000000,
    BufferMode=0)  # -> DataA, DataB, DataC, DataD
dam_2 = DataDam(DataA=dispatch.ListA, BufferDelay=2500000, BufferMode=0)
objfromgroup = GetObjectsInGroup()

dam_3 = DataDam(DataA=freeboard_m_input_from_dashboard, BufferDelay=10000000, BufferMode=0)  # disabled
dam_4 = DataDam(DataA=offset_foundation_m_input_from_dashboard, BufferDelay=10000000, BufferMode=0)  # disabled

lng = ListLength(List=objfromgroup)
dup = DuplicateData(Data=panel_24, Number=lng, Order=True)

inpupt_offset_foundation_m = Panel(dam.DataD)
addition = Addition(A=dam.DataB, B=dam.DataC)
bool = Boolean(dup)
normal_water_level = RemoteSender(dam.DataB)
dam_level = RemoteSender(addition)
dam_type_2 = RemoteSender(dam_2)
dam_type_3 = RemoteReceiver(dam_type_2)
num_2 = Number(dam_type_3)
S = Script(lan=list, i=num_2)  # -> out, a
# ---------- S: Python ----------
"""05.10.2023 - CNA"""
"""updated to rhino beta 27.10.2023 - CNA"""

if lan == 0:
    if i == 0:
        a = "Gravity"
    elif i == 1:
        a = "Arch" 
    elif i == 2:
        a = "Embankment"
    elif i == 3:
        a = "Hybrid"

if lan == 1:
    if i == 0:
        a = "Poids"
    elif i == 1:
        a = "Voûtes" 
    elif i == 2:
        a = "Digue"
    elif i == 3:
        a = "Hybride"

if lan == 2:
    if i == 0:
        a = "Gravity"
    elif i == 1:
        a = "Arch" 
    elif i == 2:
        a = "Embankment"
    elif i == 3:
        a = "Hybrid"
# ---------- end S ----------
panel_28 = Panel(S.a)
dam_name_translation = RemoteSender(S.a)
dam_type_4 = RemoteReceiver(dam_type_2)
# Run Dam
num_3 = Number(dam_type_4)
S_2 = Script(x=num_3)  # -> out, a
# ---------- S_2: Python ----------
"""Grasshopper Script"""
a = "Hello Python 3 in Grasshopper!"
print(a)

if x == 3:
    a = 1
else:
    a = 0
# ---------- end S_2 ----------
hybrid_normal = RemoteSender(S_2.a)
freeboard = RemoteSender(dam.DataC)
offset_foundation = RemoteSender(dam.DataD)
setobj = SetObjectValue(ObjectToSet=flatten(objfromgroup), ValueToSet=flatten(bool))
panel_29 = Panel(lng)
# Formulas - conservative as compared with values computed more precisely (in feet)
panel_30 = Panel(dup)
vector_send_to_local_0 = Panel("{-2.5815e+6,-1.083e+6,0}")
vector_back_to_lv95 = Panel("{2.5815e+6,1.083e+6,0}")
mesh = GeometryPipeline(
    GroupByLayer=False,
    GroupByType=False,
    IncludeHidden=True,
    IncludeLocked=True,
    LayerFilter="Terrain_brep_offset_-10",
    NameFilter="*",
    SublayerFiltering=True,
    TypeFilter=1073741848)
pipeline = GeometryPipeline(
    GroupByLayer=False,
    GroupByType=False,
    IncludeHidden=True,
    IncludeLocked=True,
    LayerFilter="Terrain_levels",
    NameFilter="*",
    SublayerFiltering=True,
    TypeFilter=4)
mesh_2 = GeometryPipeline(
    GroupByLayer=False,
    GroupByType=False,
    IncludeHidden=True,
    IncludeLocked=True,
    LayerFilter="Terrain_brep",
    NameFilter="*",
    SublayerFiltering=True,
    TypeFilter=1073741848)

pipeline_2 = GeometryPipeline(
    GroupByLayer=False,
    GroupByType=False,
    IncludeHidden=True,
    IncludeLocked=True,
    LayerFilter="Gravity::Axes::*",
    NameFilter="*",
    SublayerFiltering=True,
    TypeFilter=4)
pipeline_3 = GeometryPipeline(
    GroupByLayer=False,
    GroupByType=False,
    IncludeHidden=True,
    IncludeLocked=True,
    LayerFilter="Arch::Axes::*",
    NameFilter="*",
    SublayerFiltering=True,
    TypeFilter=4)
pipeline_4 = GeometryPipeline(
    GroupByLayer=False,
    GroupByType=False,
    IncludeHidden=True,
    IncludeLocked=True,
    LayerFilter="Embankment::Axes::*",
    NameFilter="*",
    SublayerFiltering=True,
    TypeFilter=4)
pipeline_5 = GeometryPipeline(
    GroupByLayer=False,
    GroupByType=False,
    IncludeHidden=True,
    IncludeLocked=True,
    LayerFilter="New designs",
    NameFilter="*",
    SublayerFiltering=True,
    TypeFilter=4)

pipeline_6 = GeometryPipeline(
    GroupByLayer=False,
    GroupByType=False,
    IncludeHidden=True,
    IncludeLocked=True,
    LayerFilter="Upstream_point",
    NameFilter="*",
    SublayerFiltering=True,
    TypeFilter=1)
pipeline_7 = GeometryPipeline(
    GroupByLayer=False,
    GroupByType=False,
    IncludeHidden=True,
    IncludeLocked=True,
    LayerFilter="Upstream_point",
    NameFilter="*",
    SublayerFiltering=True,
    TypeFilter=4)
mesh_3 = GeometryPipeline(
    GroupByLayer=False,
    GroupByType=False,
    IncludeHidden=True,
    IncludeLocked=True,
    LayerFilter="Terrain_base_curve",
    NameFilter="*",
    SublayerFiltering=True,
    TypeFilter=4)
dam_type_5 = RemoteReceiver(dam_type_2)
filter_3 = StreamFilter(Gate=dam_type_5, Stream0=[pipeline_2, pipeline_3], Stream1=pipeline_3, Stream2=pipeline_4, Stream3=pipeline_3)
merge_8 = Merge(Data1=filter_3, Data2=pipeline_5)
details = ContentDetails(Content=merge_8)  # -> Content, Id, Path, Attributes
panel_31 = Panel(details.Path)
details_2 = ContentDetails(Content=merge_8)  # -> Content, Id, Path, Attributes
rhatt = GetRhinoAttributes(Geometry=merge_8)  # -> Name, Layer, Color
flip = FlipCurve(Curve=merge_8, Guide=pipeline_7)  # -> Curve, Flag
item_2 = ListItem(List=details.Attributes, Index=0, Wrap=True)  # -> flatten(Item)
panel_32 = Panel(details_2.Attributes)
project = Project(Geometry=flip.Curve, Plane=PlaneXY(0, 0, 0))  # -> Geometry, Transform
sunion = SetUnion(SetA=item_2)
txt = Text(rhatt.Layer)
jagged = SettingsSpeed()
sunion_2 = SetUnion(SetA=txt)
axis_selection = Slider(8, range=0..8)

# ---- group: Automation slider
connected = GetConnectedObjects(Objects=axis_selection)
lng_2 = ListLength(List=merge_8)
x_minus_one = XMinusOne(NumberX=lng_2)
set_slider = SetSliderProperties(Slider=connected, Range=x_minus_one, Type=1)

# ----
item_3 = ListItem(List=sunion, Index=Slider(6, range=0..6), Wrap=True)
jagged_2 = SettingsSpeed()
mesh_4 = MeshBrep(Brep=mesh, Settings=jagged)
transform = Transform({TransformCount=1, Name="Translation", tx=-2580598.7, ty=-1083020.6, tz=0})
panel_33 = Panel(sunion_2)
panel_34 = Panel(item_3)
explode = Explode(Curve=mesh_3, Recursive=True)  # -> Segments, Vertices
brep = Brep(mesh_3)  # disabled
mesh_5 = MeshBrep(Brep=mesh_2, Settings=jagged_2)
inverse = InverseTransform(Transform=transform)
item_4 = ListItem(List=project.Geometry, Index=axis_selection, Wrap=True)
item_5 = ListItem(List=details_2.Path, Index=axis_selection, Wrap=True)
conmesh = ConstructMesh(Vertices=explode.Vertices, Faces={A=0, B=1, C=2, D=3})
transform_origin = RemoteSender(inverse)
mindex = MemberIndex(Set=item_2, Member=panel_34)  # -> Index, Count
brep_terrain_base_foundation = RemoteSender(mesh)
panel_35 = Panel(item_5)
dam_5 = DataDam(DataAxis=item_4, DataName=item_5, BufferDelay=10000000, BufferMode=0)  # -> DataAxis, DataName
mesh_terrain_flattened = RemoteSender(conmesh)
mesh_terrain_offset = RemoteSender(mesh_4)
brep_terrain_base = RemoteSender(brep)  # disabled
brep_terrain = RemoteSender(mesh_2)
mesh_terrain = RemoteSender(mesh_5)
lines_levels = RemoteSender(pipeline)
item_6 = ListItem(List=merge_8, Index=mindex.Index, Wrap=True)
panel_36 = Panel(merge_8)
dam_axis_name = RemoteSender(dam_5.DataName)
dam_axis = RemoteSender(dam_5.DataAxis)
panel_37 = Panel(mindex.Index)
panel_38 = Panel(item_6)
rec = DataRecorder(item_6, DataLimit=-10, RecordData=True)
panel_39 = Panel(rec)
dam_level_2 = RemoteReceiver(dam_level)
dam_axis_2 = RemoteReceiver(dam_axis)
brep_terrain_base_foundation_2 = RemoteReceiver(brep_terrain_base_foundation)

# ---- group: Selecting dam height level
# This changes when the axis line calculate and recalculate the basics again
brep_terrain_2 = RemoteReceiver(brep_terrain)

# ---- group: This decides where to cut the axis
number_slider_2 = Slider(0.8, range=0..1)

# ----
number_slider_3 = Slider(0.8, range=0..1)
Z = UnitZ(Factor=dam_level_2)
hybrid_normal_2 = RemoteReceiver(hybrid_normal)
move = Move(Geometry=dam_axis_2, Motion=Z)  # -> Geometry, Transform
# Technical Memorandum No. EM36-86-68110: 2.1.3 Lines of Centers
# 
# The lines of centers define the horizontal shape of the arches in an arch dam. The shape of the arches starts at the crown cantilever and curves horizontally downstream toward the abutments. The line of centers create the geometry of the circular arcs at each elevation of the dam for the upstream and downstream faces by defining the center point of a circle and the radius of the circle. Depending on the shape and number of lines of centers, the arches can be
# 1) uniform thickness from abutment to abutment,
# 2) variable thickness from abutment to abutment,
# 3) different on the left side of the dam compared to the right side of the dam, or
# 4) different in the center of the dam compared to the outer part of the dam.
# Technical Memorandum No. EM36-86-68110: A double curvature arch dam has curvature in the arches and in the crown cantilever.
panel_40 = Panel(" 1 meter = 3.28084 feet")
axis_at_height = RemoteSender(move.Geometry)

axis_at_height_2 = RemoteReceiver(axis_at_height)
Z_2 = UnitZ(Factor=Slider(200, range=0..1000))
mesh_terrain_2 = RemoteReceiver(mesh_terrain)
neg = Negative(Value=Z_2)
move_2 = Move(Geometry=axis_at_height_2, Motion=neg)  # -> Geometry, Transform
Z_3 = UnitZ(Factor=Slider(1000, range=0..1000))
mesh_terrain_offset_2 = RemoteReceiver(mesh_terrain_offset)
extr = Extrude(Base=move_2.Geometry, Direction=Z_3)
mmx = MeshMesh(MeshA=[mesh_terrain_offset_2, mesh_terrain_2], MeshB=extr)  # -> simplify(Intersections)
section_lines_gravity = RemoteSender(mmx)

normal_water_level_2 = RemoteReceiver(normal_water_level)
dam_level_3 = RemoteReceiver(dam_level)
number_slider_4 = Slider(214, range=0..500)
number_slider_5 = Slider(214, range=0..500)
rad = Radians(Degrees=Slider(164, range=0..180))
rad_2 = Radians(Degrees=Slider(164, range=0..180))
scx = SurfaceCurve(Surface=brep_terrain_2, Curve=move.Geometry)  # -> Curves, flatten(Points), UVPoints, Normals, Parameters, Tangents
Z_4 = UnitZ(Factor=dam_level_3)

# ---- group: Finding the crest points at bottom EXCAVATION
scx_2 = SurfaceCurve(Surface=brep_terrain_base_foundation_2, Curve=move.Geometry)  # -> Curves, flatten(Points), UVPoints, Normals, Parameters, Tangents
item_7 = ListItem(List=scx_2.Points, Index=0, Wrap=True)  # -> Item, Item1

# ----
Z_5 = UnitZ(Factor=normal_water_level_2)
sec = BrepPlane(Brep=brep_terrain_2, Plane=Z_5)  # -> Curves, Points
sec_2 = BrepPlane(Brep=brep_terrain_2, Plane=Z_4)  # -> Curves, Points
item_8 = ListItem(List=scx.Points, Index=0, Wrap=True)  # -> Item, Item1
neg_2 = Negative(Value=number_slider_4)
neg_3 = Negative(Value=number_slider_5)
ln = Line(StartPoint=item_8.Item, EndPoint=item_8.Item1)

# ---- group: AXIS LINE
ln_2 = Line(StartPoint=item_7.Item, EndPoint=item_7.Item1)

# ----
dom = ConstructDomain(DomainStart=number_slider_4, DomainEnd=neg_2)
join = JoinCurves(Curves=sec_2.Curves, Preserve=True)
join_2 = JoinCurves(Curves=sec.Curves, Preserve=False)
dom_2 = ConstructDomain(DomainStart=number_slider_5, DomainEnd=neg_3)
len = Length(Curve=ln)
chord_dam = RemoteSender(ln_2)
chord_dam_2 = RemoteReceiver(chord_dam)
eval = EvaluateCurve(Curve=reparameterize(chord_dam_2), Parameter=number_slider_2)  # -> Point, Tangent, Angle
gate = StreamGate(Stream=chord_dam_2, Gate=hybrid_normal_2)  # -> Target0, Target1
eval_2 = EvaluateCurve(Curve=reparameterize(gate.Target1), Parameter=number_slider_3)  # -> Point, Tangent, Angle
rotate = Rotate(Geometry=eval.Tangent, Angle=rad, Plane=PlaneXY(0, 0, 0))  # -> Geometry, Transform
rotate_2 = Rotate(Geometry=eval_2.Tangent, Angle=rad_2, Plane=PlaneXY(0, 0, 0))  # -> Geometry, Transform
pl = PlaneNormal(Origin=eval.Point, ZAxis=rotate.Geometry)
pl_2 = PlaneNormal(Origin=eval_2.Point, ZAxis=rotate_2.Geometry)
txt_2 = Text(join_2)
txt_3 = Text(join)
planesrf = PlaneSurface(Plane=pl, XSize=dom, YSize=dom)
axis_straight_terrain = RemoteSender(len)
planesrf_2 = PlaneSurface(Plane=pl_2, XSize=dom_2, YSize=dom_2)
downstream_face_angle_ratio_1 = Slider(0.8, range=0..1)
downstream_face_angle_ratio_1_2 = Slider(0.8, range=0..1)
dam_crest_width = Slider(6, range=0..100)
mindex_2 = MemberIndex(Set=txt_2, Member="Closed Planar Curve")  # -> Index, Count
mindex_3 = MemberIndex(Set=txt_3, Member="Closed Planar Curve")  # -> Index, Count
dam_crest_width_2 = Slider(20, range=0..100)
yz = YZPlane(Origin=pl_2)
cull_i = CullIndex(List=join_2, Indices=mindex_2.Index, Wrap=True)
cull_i_2 = CullIndex(List=join, Indices=mindex_3.Index, Wrap=True)
rad_3 = Radians(Degrees=Slider(-13, range=-135..135))
rad_4 = Radians(Degrees=Slider(0, range=-135..135))  # disabled
gravity_width_crest = RemoteSender(dam_crest_width)
embankment_width_crest = RemoteSender(dam_crest_width_2)
gravity_ds_ration = RemoteSender(downstream_face_angle_ratio_1)
embankment_ds_ration = RemoteSender(downstream_face_angle_ratio_1_2)
rotate_3 = Rotate(Geometry=planesrf_2, Angle=rad_4, Plane=yz)  # -> Geometry, Transform; disabled
rotate_4 = Rotate(Geometry=planesrf_2, Angle=rad_3, Plane=yz)  # -> Geometry, Transform
len_2 = Length(Curve=cull_i_2)
rad_5 = Radians(Degrees=Slider(-13, range=-135..135))
len_3 = Length(Curve=cull_i)
larger = LargerThan(FirstNumber=len_2, SecondNumber=Slider(2, range=0..10))  # -> LargerThan, OrEqualTo
rotate_5 = Rotate(Geometry=planesrf, Angle=rad_5, Plane=yz)  # -> Geometry, Transform
larger_2 = LargerThan(FirstNumber=len_3, SecondNumber=Slider(2, range=0..10))  # -> LargerThan, OrEqualTo
hybrid_surface_barrier = RemoteSender(rotate_4.Geometry)
dispatch_2 = Dispatch(List=cull_i_2, DispatchPattern=larger.LargerThan)  # -> ListA, ListB
dispatch_3 = Dispatch(List=cull_i, DispatchPattern=larger_2.LargerThan)  # -> ListA, ListB
brep_terrain_base_foundation_3 = RemoteReceiver(brep_terrain_base_foundation)
end = EndPoints(Curve=dispatch_2.ListA)  # -> Start, End
end_2 = EndPoints(Curve=dispatch_3.ListA)  # -> Start, End
# surface
brep_terrain_base_foundation_4 = RemoteReceiver(brep_terrain_base_foundation)
hybrid_normal_3 = RemoteReceiver(hybrid_normal)
chord_dam_3 = RemoteReceiver(chord_dam)
# number
embankment_ds_ration_2 = RemoteReceiver(embankment_ds_ration)
pt = Point([end.Start, end.End])
# number
embankment_width_crest_2 = RemoteReceiver(embankment_width_crest)
# number
gravity_width_crest_2 = RemoteReceiver(gravity_width_crest)
# number
gravity_ds_ration_2 = RemoteReceiver(gravity_ds_ration)
# line
chord_dam_4 = RemoteReceiver(chord_dam)
pt_2 = Point([end_2.Start, end_2.End])
# line
chord_dam_5 = RemoteReceiver(chord_dam)
incurve = PointInCurve(Point=pt, Curve=mesh_3)  # -> Relationship, Point
shatter = Shatter(Curve=reparameterize(chord_dam_3), Parameters=number_slider_3)
incurve_2 = PointInCurve(Point=pt_2, Curve=mesh_3)  # -> Relationship, Point
list_3 = ValueList({"Concrete gravity dam": 0, "Arch dam": 1, "Embankment dam": 2}, selected="Concrete gravity dam")  # disabled
item_9 = ListItem(List=shatter, Index=0, Wrap=True)
filepath_hops_2 = RemoteReceiver(filepath_hops)  # disabled
equals = Equality(FirstNumber=incurve.Relationship, SecondNumber="2")  # -> Equality, Inequality
equals_2 = Equality(FirstNumber=incurve_2.Relationship, SecondNumber="2")  # -> Equality, Inequality
filter_4 = StreamFilter(Gate=hybrid_normal_3, Stream0=chord_dam_3, Stream1=item_9)
dispatch_4 = Dispatch(List=pt, DispatchPattern=equals.Equality)  # -> ListA, ListB
dispatch_5 = Dispatch(List=pt_2, DispatchPattern=equals_2.Equality)  # -> ListA, ListB
item_10 = ListItem(List=filepath_hops_2, Index=list_3, Wrap=True)  # disabled
brep_terrain_base_foundation_5 = RemoteReceiver(brep_terrain_base_foundation)  # disabled
pline = PolyLine(Vertices=dispatch_4.ListA, Closed=False)
brep_terrain_base_foundation_6 = RemoteReceiver(brep_terrain_base_foundation)
pline_2 = PolyLine(Vertices=dispatch_5.ListA, Closed=False)
panel_41 = Panel(item_10)  # disabled
gravity_ds_ration_3 = RemoteReceiver(gravity_ds_ration)  # disabled
chord_dam_6 = RemoteReceiver(chord_dam)  # disabled
width_crest = RemoteReceiver()  # disabled
brep_terrain_3 = RemoteReceiver(brep_terrain)
join_3 = JoinCurves(Curves=[dispatch_2.ListA, pline], Preserve=False)
offset_foundation_2 = RemoteReceiver(offset_foundation)
mesh_terrain_offset_3 = RemoteReceiver(mesh_terrain_offset)
join_4 = JoinCurves(Curves=[dispatch_3.ListA, pline_2], Preserve=False)
# ARCH DAM
# Steps from the Technical Memorandum
#  No. EM36-86-68110
mesh_terrain_3 = RemoteReceiver(mesh_terrain)
axis_at_height_3 = RemoteReceiver(axis_at_height)
dam_type_6 = RemoteReceiver(dam_type_2)
path = FilePath(panel_41)  # disabled
levels_at_water_height = RemoteSender(join_4)

raxis_adjustments = Slider(20, range=-30..30)

levels_dam_height = RemoteSender(join_3)
hops = Hops(
    _Path=path,
    CacheResultsInMemory=True,
    CacheSolveResults=True,
    RemoteDefinitionLocation="C:\Users\Admin\Documents\Github\EarlyStageDesign\JD\Skripts\Modules\Gravity.gh",
    RemoteSolveVersion=(0, 1, 0),
    ShowInput_Enabled=False,
    ShowInput_Path=True,
    SynchronousSolve=True)  # disabled
num_4 = Number(dam_type_6)
S_3 = Script(x=num_4)  # -> out, a
# ---------- S_3: Python ----------
"""Grasshopper Script"""
a = "Hello Python 3 in Grasshopper!"
print(a)

if x == 1:
    a = "True"
elif x == 3: 
    a = "True"
else:
    a = "False"
# ---------- end S_3 ----------
neg_4 = Negative(Value=gravity_ds_ration_2)
hybrid_surface_barrier_2 = RemoteReceiver(hybrid_surface_barrier)
hybrid_normal_4 = RemoteReceiver(hybrid_normal)
normal_water_level_3 = RemoteReceiver(normal_water_level)  # disabled
minimum_water_level_2 = RemoteReceiver(minimum_water_level)  # disabled
mesh_terrain_flattened_2 = RemoteReceiver(mesh_terrain_flattened)  # disabled
dam_axis_3 = RemoteReceiver(dam_axis)  # disabled

# ---- group: Split what is undergound and above ground - Runs once that the file opens
mesh_terrain_4 = RemoteReceiver(mesh_terrain)  # disabled
# Split what is undergound and above ground - Runs once that the file opens
brep_terrain_4 = RemoteReceiver(brep_terrain)  # disabled
bbox = BoundingBox(Content=brep_terrain_4, Plane=PlaneXY(0, 0, 0))  # -> Box, Box_2; disabled
jagged_3 = SettingsSpeed()  # disabled
mesh_6 = MeshBrep(Brep=bbox.Box, Settings=jagged_3)  # disabled
msplit = MeshSplit(Mesh=mesh_6, Splitters=mesh_terrain_4)  # disabled
item_11 = ListItem(List=msplit, Index=0, Wrap=True)  # -> Item, Item1; disabled
bottom_part = Geometry(item_11.Item)  # disabled
uper_part = Geometry(item_11.Item1)  # disabled
mjoin = MeshJoin(Meshes=flatten([uper_part, mesh_terrain_4]))  # disabled
weldvertices = MeshWeldVertices(Mesh=mjoin, Tolerance=0.01)  # -> RuntimeMessage, Mesh; disabled
clsmsh = CloseMesh(Mesh=weldvertices.Mesh, Quadrangulate=False)  # -> Closed, Amount, Openings, R; disabled

# ----
normal_water_level_4 = RemoteReceiver(normal_water_level)
mesh_terrain_flattened_3 = RemoteReceiver(mesh_terrain_flattened)
minimum_water_level_3 = RemoteReceiver(minimum_water_level)
dam_axis_4 = RemoteReceiver(dam_axis)

# ---- group: Split what is undergound and above ground - Runs once that the file opens
mesh_terrain_5 = RemoteReceiver(mesh_terrain)
# Split what is undergound and above ground - Runs once that the file opens
brep_terrain_5 = RemoteReceiver(brep_terrain)
bbox_2 = BoundingBox(Content=brep_terrain_5, Plane=PlaneXY(0, 0, 0))  # -> Box, Box_2
jagged_4 = SettingsSpeed()
mesh_7 = MeshBrep(Brep=bbox_2.Box, Settings=jagged_4)
msplit_2 = MeshSplit(Mesh=mesh_7, Splitters=mesh_terrain_5)
item_12 = ListItem(List=msplit_2, Index=0, Wrap=True)  # -> Item, Item1
bottom_part_2 = Geometry(item_12.Item)
uper_part_2 = Geometry(item_12.Item1)
mjoin_2 = MeshJoin(Meshes=flatten([uper_part_2, mesh_terrain_5]))
weldvertices_2 = MeshWeldVertices(Mesh=mjoin_2, Tolerance=0.01)  # -> RuntimeMessage, Mesh
clsmsh_2 = CloseMesh(Mesh=weldvertices_2.Mesh, Quadrangulate=False)  # -> Closed, Amount, Openings, R

# ----
# Runs the volume of the water for the normal water level height, splits the dead storage and split the water in 10 m levels
# 
# It takes a couple of minutes to run (tested 05.10.23 - 1.1 m)
run_water_pre_2 = RemoteReceiver(run_water_pre)  # disabled

dam_6 = DataDam(
    DataAxisDam=dam_axis_3,
    DataMeshTerrainFlattened=mesh_terrain_flattened_2,
    DataNormalWaterLevel=normal_water_level_3,
    DataMinimumStorageLevel=minimum_water_level_2,
    BufferDelay=10000000,
    BufferMode=0)  # -> DataAxisDam, DataMeshTerrainFlattened, DataNormalWaterLevel, DataMinimumStorageLevel; disabled
objfromgroup_2 = GetObjectsInGroup()  # disabled

dam_7 = DataDam(
    DataAxisDam=dam_axis_4,
    DataMeshTerrainFlattened=mesh_terrain_flattened_3,
    DataNormalWaterLevel=normal_water_level_4,
    DataMinimumStorageLevel=minimum_water_level_3,
    BufferDelay=10000000,
    BufferMode=0)  # -> DataAxisDam, DataMeshTerrainFlattened, DataNormalWaterLevel, DataMinimumStorageLevel
objfromgroup_3 = GetObjectsInGroup()

# ----
# Runs the volume of the water for the normal water level height, splits the dead storage and split the water in 10 m levels
# 
# It takes a couple of minutes to run (tested 05.10.23 - 1.1 m)
run_water_pre_3 = RemoteReceiver(run_water_pre)
setobj_2 = SetObjectValue(ObjectToSet=objfromgroup_2, ValueToSet=run_water_pre_2)  # disabled
setobj_3 = SetObjectValue(ObjectToSet=objfromgroup_3, ValueToSet=run_water_pre_3)
Z_6 = UnitZ(Factor=dam_6.DataNormalWaterLevel)  # disabled
Z_7 = UnitZ(Factor=dam_6.DataMinimumStorageLevel)  # disabled
mesh_8 = Mesh(dam_6.DataMeshTerrainFlattened)  # disabled
Z_8 = UnitZ(Factor=dam_7.DataNormalWaterLevel)
Z_9 = UnitZ(Factor=dam_7.DataMinimumStorageLevel)
mesh_9 = Mesh(dam_7.DataMeshTerrainFlattened)
number_slider_6 = Slider(0, range=0..1)  # disabled
pln = Plane(Z_6)  # disabled
pln_2 = Plane(Z_7)  # disabled
panel_42 = Panel(Z_7)  # disabled
pln_3 = Plane(Z_8)
pln_4 = Plane(Z_9)
panel_43 = Panel(Z_9)
movetoplane = MoveToPlane(Geometry=mesh_8, Plane=pln, Above=True, Below=True)  # -> Geometry, Transform; disabled
movetoplane_2 = MoveToPlane(Geometry=mesh_8, Plane=pln_2, Above=True, Below=True)  # -> Geometry, Transform; disabled
project_2 = Project(Curve=dam_6.DataAxisDam, Brep=bbox.Box, Direction=Vector(0, 0, 1))  # disabled
movetoplane_3 = MoveToPlane(Geometry=mesh_9, Plane=pln_3, Above=True, Below=True)  # -> Geometry, Transform
movetoplane_4 = MoveToPlane(Geometry=mesh_9, Plane=pln_4, Above=True, Below=True)  # -> Geometry, Transform
project_3 = Project(Curve=dam_7.DataAxisDam, Brep=bbox_2.Box, Direction=Vector(0, 0, 1))
path_2 = ConstructPath(Indices=number_slider_6)  # disabled
mesh_10 = Mesh(project_2)  # disabled
list_4 = ValueList({"Concrete gravity dam": 0, "Arch dam": 1, "Embankment dam": 2}, selected="Embankment dam")
list_5 = ValueList({"Concrete gravity dam": 0, "Arch dam": 1, "Embankment dam": 2}, selected="Concrete gravity dam")
mesh_11 = Mesh(project_3)
dam_type_7 = RemoteReceiver(dam_type_2)
dam_type_8 = RemoteReceiver(dam_type_2)
equals_3 = Equality(FirstNumber=dam_type_7, SecondNumber=list_4)  # -> Equality, Inequality
equals_4 = Equality(FirstNumber=dam_type_8, SecondNumber=list_5)  # -> Equality, Inequality
list_6 = ValueList({"Lowest point": 0, "Choosen point": 1}, selected="Choosen point")

# ---- group: Divide on axis
msplit_3 = MeshSplit(Mesh=clsmsh.Closed, Splitters=mesh_10)  # disabled
item_13 = ListItem(List=msplit_3, Index=0, Wrap=True)  # disabled
clsmsh_3 = CloseMesh(Mesh=item_13, Quadrangulate=False)  # -> Closed, Amount, Openings, R; disabled

msplit_4 = MeshSplit(Mesh=clsmsh_2.Closed, Splitters=mesh_11)
item_14 = ListItem(List=msplit_4, Index=0, Wrap=True)
clsmsh_4 = CloseMesh(Mesh=item_14, Quadrangulate=False)  # -> Closed, Amount, Openings, R

# ----
split_dead_storage = BooleanToggle(False)  # disabled
gate_2 = StreamGate(Stream=clsmsh_3.Closed, Gate=split_dead_storage)  # -> Target0, Target1; disabled

# ---- group: Divide dead storage capacity from the rest
msplit_5 = MeshSplit(Mesh=gate_2.Target1, Splitters=movetoplane_2.Geometry)  # disabled
clean = CleanTree(RemoveNulls=True, RemoveInvalid=True, RemoveEmpty=False, Tree=msplit_5)  # disabled
panel_44 = Panel("0")  # disabled
cull_i_3 = CullIndex(List=clean, Indices=panel_44, Wrap=True)  # disabled
item_15 = ListItem(List=clean, Index=0, Wrap=True)  # disabled
clsmsh_5 = CloseMesh(Mesh=cull_i_3, Quadrangulate=False)  # -> Closed, Amount, Openings, R; disabled
clsmsh_6 = CloseMesh(Mesh=item_15, Quadrangulate=False)  # -> Closed, Amount, Openings, R; disabled

# ----
msplit_6 = MeshSplit(Mesh=clsmsh_4.Closed, Splitters=movetoplane_3.Geometry)
msplit_7 = MeshSplit(Mesh=gate_2.Target0, Splitters=movetoplane.Geometry)  # disabled
clean_2 = CleanTree(RemoveNulls=True, RemoveInvalid=True, RemoveEmpty=False, Tree=msplit_6)
clean_3 = CleanTree(RemoveNulls=True, RemoveInvalid=True, RemoveEmpty=False, Tree=msplit_7)  # disabled
rest = Mesh(clsmsh_6.Closed)  # disabled
cull_i_4 = CullIndex(List=clean_2, Indices="0", Wrap=True)
panel_45 = Panel("0")  # disabled
rebmsh = RebuildMesh(
    Mesh=clsmsh_5.Closed,
    RebuildNormals=True,
    CullUnused=True,
    UnifyNormals=True,
    FlipNormals=False,
    IdenticalCombine=True,
    WeldVertices=1)  # disabled
cull_i_5 = CullIndex(List=clean_3, Indices=panel_45, Wrap=True)  # disabled
geo = Geometry(cull_i_4)

# ---- group: Splitting the rest to the normal water level
msplit_8 = MeshSplit(Mesh=rest, Splitters=movetoplane.Geometry)  # disabled
clean_4 = CleanTree(RemoveNulls=True, RemoveInvalid=True, RemoveEmpty=False, Tree=msplit_8)  # disabled
panel_46 = Panel("0")  # disabled
cull_i_6 = CullIndex(List=clean_4, Indices=panel_46, Wrap=True)  # disabled
item_16 = ListItem(List=cull_i_6, Index=0, Wrap=True)  # -> Item, Item1; disabled
geo_2 = Geometry(item_16.Item)  # disabled

# ----
dead_storage = Mesh(flatten(rebmsh))  # disabled
geo_3 = Geometry(cull_i_5)  # disabled
clsmsh_7 = CloseMesh(Mesh=geo, Quadrangulate=False)  # -> Closed, Amount, Openings, R
clsmsh_8 = CloseMesh(Mesh=geo_3, Quadrangulate=False)  # -> Closed, Amount, Openings, R; disabled
rebmsh_2 = RebuildMesh(
    Mesh=clsmsh_7.Closed,
    RebuildNormals=False,
    CullUnused=True,
    UnifyNormals=False,
    FlipNormals=False,
    IdenticalCombine=False,
    WeldVertices=0)
cut_water_body_in_levels = BooleanToggle(False)  # disabled
dam_type_9 = RemoteReceiver(dam_type_2)
# Adapt water volume to dam shape
dam_type_10 = RemoteReceiver(dam_type_2)
gate_3 = StreamGate(Stream=geo_2, Gate=cut_water_body_in_levels)  # -> Target0, Target1; disabled

# ---- group: Dividing the levels
bbox_3 = BoundingBox(Content=gate_3.Target1, Plane=PlaneXY(0, 0, 0), UnionBox=True)  # -> Box, Box_2; disabled
number_slider_7 = Slider(10, range=0..100)  # disabled
contour = Contour(Shape=bbox_3.Box, Point=Point(0, 0, 0), Direction=Vector(0, 0, 1), Distance=number_slider_7)  # -> flatten(Contours); disabled
mesh_12 = Mesh(contour)  # disabled
msplit_9 = MeshSplit(Mesh=gate_3.Target1, Splitters=mesh_12)  # disabled

# ----
null = NullPlaceholder()
rest_of_mesh_non_cutted = Mesh(flatten(gate_3.Target0))  # disabled
clsmsh_9 = CloseMesh(Mesh=rest_of_mesh_non_cutted, Quadrangulate=False)  # -> Closed, Amount, Openings, R; disabled
rebmsh_3 = RebuildMesh(
    Mesh=clsmsh_9.Closed,
    RebuildNormals=True,
    CullUnused=True,
    UnifyNormals=True,
    FlipNormals=True,
    IdenticalCombine=True,
    WeldVertices=1)  # disabled
# Adjusts the water sections to the dam section - it is already cutted at the straight axis, but it has to adapt for the arch dam
run_water_final_3 = RemoteReceiver(run_water_final_2)
objfromgroup_4 = GetObjectsInGroup()

# ---- group: Sorting levels in the same branch
number_slider_8 = Slider(0.1, range=0..0.1)  # disabled
Z_10 = UnitZ(Factor=number_slider_8)  # disabled
move_3 = Move(Geometry=mesh_12, Motion=Z_10)  # -> Geometry, Transform; disabled
clean_5 = CleanTree(RemoveNulls=True, RemoveInvalid=True, RemoveEmpty=False, Tree=flatten(msplit_9))  # disabled
graft = GraftTree(Tree=move_3.Geometry, IncludeEmptyLists=True, IncludeNullItems=True)  # disabled
clash = Clash(FirstSet=clean_5, SecondSet=graft, Distance=0, L=100)  # -> ClashCount, ClashPoints, ClashRadii, FirstIndex, SecondIndex; disabled
item_17 = ListItem(List=clean_5, Index=clash.FirstIndex, Wrap=True)  # disabled
clean_6 = CleanTree(RemoveNulls=True, RemoveInvalid=True, RemoveEmpty=True, Tree=item_17)  # disabled
mjoin_3 = MeshJoin(Meshes=clean_6)  # disabled
disjoint = DisjointMesh(Mesh=mjoin_3)  # disabled
clsmsh_10 = CloseMesh(Mesh=disjoint, Quadrangulate=True)  # -> Closed, Amount, Openings, R; disabled

# ----
dup_2 = DuplicateDataMatch(SourceDataTree=objfromgroup_4, SecondaryData1=run_water_final_3)  # -> SourceData, SecondaryData1
dam_type_11 = RemoteReceiver(dam_type_2)
dam_type_12 = RemoteReceiver(dam_type_2)
dam_type_13 = RemoteReceiver(dam_type_2)
setobj_4 = SetObjectValue(ObjectToSet=objfromgroup_4, ValueToSet=dup_2.SecondaryData1)
hybrid_normal_5 = RemoteReceiver(hybrid_normal)
list_7 = ValueList({"Normal": 0, "Hybrid": 1}, selected="Hybrid")
equals_5 = Equality(FirstNumber=hybrid_normal_5, SecondNumber=list_7)  # -> Equality, Inequality
Z_11 = UnitZ(Factor="-50")
hybrid_surface_barrier_3 = RemoteReceiver(hybrid_surface_barrier)
number_slider_9 = Slider(18, range=0..20)  # disabled

# ---- group: Filtering too small meshes - assumption that the not so detailed mesh will produce some weird shapes
path_mapper = PathMapper(clsmsh_10.Closed, source="{A;B;C;D}", target="{path_index}")  # disabled
number_slider_10 = Slider(100, range=0..150)  # disabled
volume = MeshVolume(Mesh=path_mapper)  # -> Volume, Centroid; disabled
larger_3 = LargerThan(FirstNumber=volume.Volume, SecondNumber=number_slider_10)  # -> LargerThan, OrEqualTo; disabled
dispatch_6 = Dispatch(List=volume.Volume, DispatchPattern=larger_3.LargerThan)  # -> simplify(ListA), ListB; disabled
dispatch_7 = Dispatch(List=path_mapper, DispatchPattern=larger_3.LargerThan)  # -> ListA, ListB; disabled
mjoin_4 = MeshJoin(Meshes=dispatch_7.ListA)  # -> simplify(Mesh); disabled

# ----
item_18 = ListItem(List=flatten(clsmsh_10.Closed), Index=number_slider_9, Wrap=True)  # disabled
dam_type_14 = RemoteReceiver(dam_type_2)
dam_type_15 = RemoteReceiver(dam_type_2)
clean_7 = CleanTree(RemoveNulls=True, RemoveInvalid=True, RemoveEmpty=True, Tree=mjoin_4)  # disabled
filter_5 = StreamFilter(Gate=cut_water_body_in_levels, Stream0=rebmsh_3, Stream1=clean_7)  # disabled
mesh_13 = Mesh(dead_storage)  # disabled
bool_2 = Boolean(False)  # disabled
bool_3 = Boolean(True)  # disabled
merge_9 = Merge(Data1=flatten(filter_5), Data2=flatten(mesh_13))  # -> simplify(graft(Result)); disabled
dup_3 = DuplicateDataMatch(SourceDataTree=mesh_13, SecondaryData1=bool_3)  # -> SourceData, SecondaryData1; disabled
dup_4 = DuplicateDataMatch(SourceDataTree=filter_5, SecondaryData1=bool_2)  # -> SourceData, SecondaryData1; disabled
merge_10 = Merge(Data1=flatten(dup_4.SecondaryData1), Data2=flatten(dup_3.SecondaryData1))  # -> simplify(graft(Result)); disabled
chord_dam_7 = RemoteReceiver(chord_dam)
filter_6 = StreamFilter(Gate=split_dead_storage, Stream0=clsmsh_8.Closed, Stream1=merge_9)  # disabled
dam_type_16 = RemoteReceiver(dam_type_2)  # disabled
dam_type_17 = RemoteReceiver(dam_type_2)  # disabled
eval_3 = EvaluateCurve(Curve=reparameterize(chord_dam_7), Parameter=Slider(0.5, range=0..1))  # -> Point, Tangent, Angle
null_2 = NullPlaceholder()  # disabled
chord_dam_8 = RemoteReceiver(chord_dam)
# Front view
# Create the clippling plane once for the sections
chord_dam_9 = RemoteReceiver(chord_dam)
# erasing extra clipping planes
id = Guid(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)  # disabled
rad_6 = Radians(Degrees=Slider(90, range=0..100))
S_4 = Script(obj=id)  # -> out, a; disabled
# ---------- S_4: Python ----------
"""Grasshopper Script"""


import rhinoscriptsyntax as rs
import scriptcontext as sc
import Rhino

sc.doc = Rhino.RhinoDoc.ActiveDoc 
rs.DeleteObject(obj)
# ---------- end S_4 ----------
axis_straight_terrain_2 = RemoteReceiver(axis_straight_terrain)
eval_4 = EvaluateCurve(Curve=reparameterize(chord_dam_8), Parameter=Slider(0.82, range=0..1))  # -> Point, Tangent, Angle
rotate_6 = Rotate(Geometry=eval_3.Tangent, Angle=rad_6, Plane=PlaneXY(0, 0, 0))  # -> Geometry, Transform
eval_5 = EvaluateCurve(Curve=reparameterize(chord_dam_9), Parameter=Slider(0.5, range=0..1))  # -> Point, Tangent, Angle
chord_dam_10 = RemoteReceiver(chord_dam)
pl_3 = PlaneNormal(Origin=eval_3.Point, ZAxis=rotate_6.Geometry)
neg_5 = Negative(Value=axis_straight_terrain_2)
# Adapt water volume to dam shape
# Adjusts the water sections to the dam section - it is already cutted at the straight axis, but it has to adapt for the arch dam
run_water_final_4 = RemoteReceiver(run_water_final_2)  # disabled
rad_7 = Radians(Degrees=Slider(180, range=0..180))
rad_8 = Radians(Degrees=Slider(90, range=0..100))
dom_3 = ConstructDomain(DomainStart=neg_5, DomainEnd=axis_straight_terrain_2)
objfromgroup_5 = GetObjectsInGroup()  # disabled
rotate_7 = Rotate(Geometry=eval_4.Tangent, Angle=rad_7, Plane=PlaneXY(0, 0, 0))  # -> Geometry, Transform
rotate_8 = Rotate(Geometry=eval_5.Tangent, Angle=rad_8, Plane=PlaneXY(0, 0, 0))  # -> Geometry, Transform
axis_straight_terrain_3 = RemoteReceiver(axis_straight_terrain)
# Section view
eval_6 = EvaluateCurve(Curve=reparameterize(chord_dam_10), Parameter=Slider(0.5, range=0..1))  # -> Point, Tangent, Angle
pl_4 = PlaneNormal(Origin=eval_4.Point, ZAxis=rotate_7.Geometry)
flip_2 = Flip()  # -> Surface, Result
pl_5 = PlaneNormal(Origin=eval_5.Point, ZAxis=rotate_8.Geometry)
axis_straight_terrain_4 = RemoteReceiver(axis_straight_terrain)
dup_5 = DuplicateDataMatch(SourceDataTree=objfromgroup_5, SecondaryData1=run_water_final_4)  # -> SourceData, SecondaryData1; disabled
amp = Amplitude(Vector=rotate_6.Geometry, Amplitude=Slider(250, range=0..500))
dam_type_18 = RemoteReceiver(dam_type_2)  # disabled
dam_type_19 = RemoteReceiver(dam_type_2)  # disabled
dam_type_20 = RemoteReceiver(dam_type_2)  # disabled
number_slider_11 = Slider(368, range=0..1000)
dam_8 = DataDam(DataA=pl_4, BufferDelay=10000000, BufferMode=0)
planesrf_3 = PlaneSurface(Plane=pl_3, XSize=dom_3, YSize=dom_3)
setobj_5 = SetObjectValue(ObjectToSet=objfromgroup_5, ValueToSet=dup_5.SecondaryData1)  # disabled
rad_9 = Radians(Degrees=Slider(270, range=0..360))
move_4 = Move(Geometry=pl_3, Motion=amp)  # -> Geometry, Transform
m2d_perspective = Make2DPerspectiveView()
rotate_9 = Rotate(Geometry=eval_6.Tangent, Angle=rad_9, Plane=PlaneXY(0, 0, 0))  # -> Geometry, Transform
mesh_terrain_6 = RemoteReceiver(mesh_terrain)
hybrid_normal_6 = RemoteReceiver(hybrid_normal)
m2d_parallel = Make2DParallelView(Projection=planesrf_3)
S_5 = Script(pln=dam_8, u=axis_straight_terrain_3, v=axis_straight_terrain_3)  # -> out, a; disabled
# ---------- S_5: Python ----------
"""Grasshopper Script"""


import rhinoscriptsyntax as rs
import scriptcontext as sc
import Rhino

sc.doc = Rhino.RhinoDoc.ActiveDoc 
rs.AddClippingPlane(pln, u, v)
# ---------- end S_5 ----------
hybrid_normal_7 = RemoteReceiver(hybrid_normal)
S_6 = Script(pln=pl_5, u=axis_straight_terrain_4, v=axis_straight_terrain_4)  # -> out, a; disabled; same code as S_5
pl_6 = PlaneNormal(Origin=eval_6.Point, ZAxis=rotate_9.Geometry)
amp_2 = Amplitude(Vector=rotate_8.Geometry, Amplitude=Slider(41.7, range=0..100))
make2d = Make2D(
    Geometry=mesh_terrain_6,
    ClippingPlanes=move_4.Geometry,
    View=m2d_parallel,
    TangentEdges=False,
    TangentSeams=False,
    AutoComputeMake2D=False)  # -> VisibleCurves, VisibleIndex, VisibleType, HiddenCurves, HiddenIndex, HiddenType
rev = Reverse(Vector=amp_2)
amp_3 = Amplitude(Vector=rotate_9.Geometry, Amplitude=number_slider_11)
geo_4 = Geometry(make2d.VisibleCurves)
panel_47 = Panel(m2d_parallel)
move_5 = Move(Geometry=pl_5, Motion=rev)  # -> Geometry, Transform
id_2 = Guid(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)
brep_terrain_6 = RemoteReceiver(brep_terrain)  # disabled
move_6 = Move(Geometry=pl_6, Motion=amp_3)  # -> Geometry, Transform
vdisex = VectorDisplayEx(Point=eval_5.Point, Vector=rotate_8.Geometry, Colour=RGB(0, 0, 0), Width=2)  # disabled
c_script = CSharpScript(id=id_2, pl=move_5.Geometry)  # -> out; inputs id: Guid, pl: Plane
# ---------- c_script: C# ----------
    var cp = new Rhino.DocObjects.ObjRef(id);
    var source = cp.ClippingPlaneSurface().Plane;
    RhinoDoc.ActiveDoc.Objects.Transform(id, Transform.PlaneToPlane(source, pl), true);
# ---------- end c_script ----------
python = GhPythonScript(Brep=brep_terrain_6)  # -> out, a; inputs Plane: Plane; disabled
# ---------- python: Python ----------
import Rhino.Geometry as rg

camera_dir = Plane.Normal # get the camera direction
# Compute the silhouettes
silhouettes = rg.Silhouette.Compute(Brep, 0, camera_dir, 0.001, 0.001)
# Extract the silhouette curves
scurves = (sil.Curve for sil in silhouettes)

# Outputs
a = scurves
# ---------- end python ----------
camera = CameraCrane(Location=move_6.Geometry, Target=pl_6, View=3, Refresh=Button())  # -> Camera, Target, Lens, Up, HorizontalViewAngle, VerticalViewAngle, ScreenRatio, Frame
vdisex_2 = VectorDisplayEx(Point=eval_5.Point, Vector=rotate_8.Geometry, Colour=RGB(0, 0, 0), Width=2)  # disabled
view = View(<view referenced from the Rhino model>, ViewSource=1)
S_7 = Script(Brep=brep_terrain_6, Plane=pl_6)  # -> out, a; disabled; same code as python
view_2 = ModelView(View=view, Perspective=True, Location=move_6.Geometry, Target=number_slider_11)  # -> View, Title, Perspective, Location, Target, XExtents, YExtents, ZExtents
hybrid_normal_8 = RemoteReceiver(hybrid_normal)
hybrid_normal_9 = RemoteReceiver(hybrid_normal)
ma = MassAddition(Input=flatten(dispatch_6.ListA))  # -> Result, PartialResults; disabled
xz = XZPlane(Origin=Point(0, 0, 0))
brep_2 = Brep([<brep referenced from the Rhino model> x3])
python_2 = GhPythonScript(Brep=brep_2, Plane=xz)  # -> out, a; inputs Plane: Plane; same code as python
panel_48 = Panel(ma.Result)  # disabled
project_4 = Project(Geometry=python_2.a, Plane=xz)  # -> Geometry, Transform
join_5 = JoinCurves(Curves=project_4.Geometry, Preserve=False)
dam_type_21 = RemoteReceiver(dam_type_2)  # disabled
dam_type_22 = RemoteReceiver(dam_type_2)  # disabled
minimum_water_level_4 = RemoteReceiver(minimum_water_level)  # disabled
number_slider_12 = Slider(1, range=0..1)  # disabled
toggle = BooleanToggle(True)  # disabled
rebmsh_4 = RebuildMesh(
    RebuildNormals=toggle,
    CullUnused=toggle,
    UnifyNormals=False,
    FlipNormals=toggle,
    IdenticalCombine=False,
    WeldVertices=number_slider_12)  # disabled
hybrid_normal_10 = RemoteReceiver(hybrid_normal)
hybrid_normal_11 = RemoteReceiver(hybrid_normal)
number_slider_13 = Slider(0.4, range=0.1..1)  # disabled
number_slider_14 = Slider(3, range=0..10)  # disabled
number_slider_15 = Slider(3, range=0..10)  # disabled
number_slider_16 = Slider(1, range=0..10)
panel_49 = Panel("3")  # disabled
number_slider_17 = Slider(10, range=0..100)  # disabled
jagged_5 = SettingsSpeed()
number_slider_18 = Slider(1, range=0..1)
offset_foundation_3 = RemoteReceiver(offset_foundation)
linetypes = QueryModelLinetypes(Name="Continuous", AutoUpdateState=True)
# Export Shapefile
# Export water
path_save_2 = RemoteReceiver(path_save)

# ---- group: Upgraded : Annotation Text Settings
as_text = AnnotationTextSettings(TextHeight=Slider(7, range=0..100))  # -> TextSettings, Font, TextHeight, TextGap, MaskFrame, MaskColour, MaskMargins, HorizontalAlignment, VerticalAlignment, FitText
wt = WrapText()  # disabled
ww = WrapWidth()  # disabled
wt_2 = WrapText()  # disabled
ww_2 = WrapWidth()  # disabled

# ----
font_size = RemoteSender(Slider(12, range=0..100))
panel_50 = Panel(path_save_2)
leader_text_settings = RemoteSender(as_text.TextSettings)
show_line_of_centers = BooleanToggle(False)
normal_water_level_5 = RemoteReceiver(normal_water_level)
dam_name_translation_2 = RemoteReceiver(dam_name_translation)
dam_axis_name_2 = RemoteReceiver(dam_axis_name)
transform_origin_2 = RemoteReceiver(transform_origin)
fields_water_2 = RemoteReceiver(fields_water)
# Export axis
normal_water_level_6 = RemoteReceiver(normal_water_level)
dam_name_translation_3 = RemoteReceiver(dam_name_translation)
dam_axis_name_3 = RemoteReceiver(dam_axis_name)
chord_dam_11 = RemoteReceiver(chord_dam)
transform_origin_3 = RemoteReceiver(transform_origin)
fields_archdam_2 = RemoteReceiver(fields_archdam)
# Export arch dam
number_slider_19 = Slider(1, range=0..1)
normal_water_level_7 = RemoteReceiver(normal_water_level)
dam_name_translation_4 = RemoteReceiver(dam_name_translation)
dam_axis_name_4 = RemoteReceiver(dam_axis_name)
dam_name_translation_5 = RemoteReceiver(dam_name_translation)
normal_water_level_8 = RemoteReceiver(normal_water_level)
as_leaders = AnnotationLeaderSettings()  # -> LeaderSettings, LeaderCurveType, HasLanding, LandingLength, HorizontalTextAlignment, VerticalTextAlignment, LeaderTextOrientation
dam_axis_name_5 = RemoteReceiver(dam_axis_name)
fields_archdam_3 = RemoteReceiver(fields_archdam)
time_2 = Time("now")
transform_2 = Transform(Geometry=chord_dam_11, Transform=transform_origin_3)
dam_level_4 = RemoteReceiver(dam_level)
concat = Concatenate(
    FragmentA=normal_water_level_5,
    FragmentB="Water",
    FragmentC=dam_name_translation_2,
    FragmentD=dam_axis_name_2,
    JoinSeparator="_")
concat_2 = Concatenate(
    FragmentA=normal_water_level_7,
    FragmentB="ArchDam",
    FragmentC=dam_name_translation_4,
    FragmentD=dam_axis_name_4,
    JoinSeparator="_")
concat_3 = Concatenate(
    FragmentA=normal_water_level_6,
    FragmentB="Axis",
    FragmentC=dam_name_translation_3,
    FragmentD=dam_axis_name_3,
    JoinSeparator="_")
ddate = DeconstructDate(Date=time_2)  # -> Year, Month, Day, Hour, Minute, Second
item_19 = ListItem(List=fields_archdam_2, Index=number_slider_19, Wrap=True)
crv = Curve(transform_2)
hybrid_normal_12 = RemoteReceiver(hybrid_normal)
panel_51 = Panel(fields_water_2)
panel_52 = Panel(concat)
panel_53 = Panel(concat_3)
concat_4 = Concatenate(FragmentD="Results\Model_GIS", FragmentA=ddate.Year, FragmentB=ddate.Month, FragmentC=ddate.Day, JoinSeparator="_")
panel_54 = Panel(concat_2)
panel_55 = Panel(fields_archdam_3)
concat_5 = Concatenate(FragmentA=panel_50, FragmentB=concat_4, JoinSeparator="\")
transform_origin_4 = RemoteReceiver(transform_origin)
panel_56 = Panel(concat_5)
show_text = BooleanToggle(True)
dam_axis_name_6 = RemoteReceiver(dam_axis_name)
path_3 = FilePath(panel_56)
path_save_arcgis = RemoteSender(path_3)
path_save_arcgis_2 = RemoteReceiver(path_save_arcgis)
path_save_arcgis_3 = RemoteReceiver(path_save_arcgis)
path_save_arcgis_4 = RemoteReceiver(path_save_arcgis)
panel_57 = Panel(path_save_arcgis_2)
panel_58 = Panel(path_save_arcgis_3)
panel_59 = Panel(path_save_arcgis_4)
send_to_export = Button()
number_slider_20 = Slider(0.45, range=0..1)
swatch = ColourSwatch(SwatchColor=RGB(0, 232, 155))
swatch_2 = ColourSwatch(SwatchColor=RGB(194, 91, 91))
swatch_3 = ColourSwatch(SwatchColor=RGB(196, 255, 247))
swatch_4 = ColourSwatch(SwatchColor=RGB(125, 161, 125))
# Terrain
brep_terrain_7 = RemoteReceiver(brep_terrain)
swatch_5 = ColourSwatch(SwatchColor=RGB(207, 255, 255))
swatch_6 = ColourSwatch(SwatchColor=RGB(72, 212, 212))

# ---- group: Levels
linetypes_2 = QueryModelLinetypes(Name="leader", AutoUpdateState=True)
lines_levels_2 = RemoteReceiver(lines_levels)
curve_preview = CustomCurvePreview(Curve=lines_levels_2, Linetype=linetypes_2, Colour=ColourSwatch(SwatchColor=RGBA(102, 101, 101, 163)))  # disabled

# ----
material = CreateMaterial(
    Diffuse=ColourSwatch(SwatchColor=RGB(125, 161, 125)),
    Specular=ColourSwatch(SwatchColor=RGB(194, 91, 91)),
    Emission=RGB(0, 0, 0),
    Transparency=Slider(0.81, range=0..1),
    Shine=0)  # disabled
material_2 = CreateMaterial(Diffuse=swatch_4, Specular=swatch_2, Emission=swatch_3, Transparency=Slider(0.22, range=0..1), Shine=0)
hybrid_surface_barrier_4 = RemoteReceiver(hybrid_surface_barrier)
print_width = PrintWidth()  # -> PrintWidth, Source, Width; disabled
material_3 = CreateMaterial(
    Diffuse=swatch_6,
    Specular=swatch_6,
    Emission=swatch_6,
    Transparency=Slider(0.8, range=0..1),
    Shine=Slider(0, range=0..100))
preview = CustomPreview(Geometry=brep_terrain_7, Material=material_2)
preview_2 = CustomPreview(Geometry=brep_terrain_7, Material=material_2)
preview_3 = CustomPreview(Geometry=brep_terrain_7, Material=material_2)
preview_4 = CustomPreview(Geometry=brep_terrain_7, Material=material_2)
material_4 = CreateMaterial(
    Diffuse=ColourSwatch(SwatchColor=RGB(207, 151, 68)),
    Specular=ColourSwatch(SwatchColor=RGB(255, 255, 255)),
    Emission=ColourSwatch(SwatchColor=RGB(97, 97, 97)),
    Transparency=0,
    Shine=0)
preview_5 = CustomPreview(Geometry=brep_terrain_7, Material=material_2)
ordinate_dimension = OrdinateDimension()  # -> OrdinateDimension, Plane, Direction, FeatureLocation, DimensionLocation, Offset1, Offset2; disabled
preview_6 = CustomPreview(Geometry=hybrid_surface_barrier_4, Material=ColourSwatch(SwatchColor=RGBA(255, 255, 255, 2)))
preview_7 = CustomPreview(Geometry=brep_terrain_7, Material=material_2)
mesh_terrain_offset_4 = RemoteReceiver(mesh_terrain_offset)
material_5 = CreateMaterial(Diffuse=swatch_4, Specular=swatch_2, Emission=swatch_3, Transparency=Slider(0.34, range=0..1), Shine=0)
preview_8 = CustomPreview(Geometry=mesh_terrain_offset_4, Material=material_5)  # disabled
show_dead_capacity = BooleanToggle(True)
show_useful_capacity = BooleanToggle(True)
material_6 = CreateMaterial(
    Diffuse=ColourSwatch(SwatchColor=RGBA(138, 110, 67, 122)),
    Specular=RGB(255, 255, 255),
    Emission=RGB(0, 0, 0),
    Transparency=Slider(0.6, range=0..1),
    Shine=0)

# ---- group: Connection between gravity and Arch Dam
number_slider_21 = Slider(61, range=0..100)
loft_opt = LoftOptions(Closed=False, Adjust=True, Rebuild=Slider(0, range=0..100), Refit=0, Type=Slider(2, range=0..10))

# ----
mjoin_5 = MeshJoin()

dam_axis_5 = RemoteReceiver(dam_axis)

point_upstream = RemoteSender(pipeline_6)

point_upstream_2 = RemoteReceiver(point_upstream)
crv_cp = CurveClosestPoint(Point=point_upstream_2, Curve=dam_axis_5)  # -> Point, Parameter, Distance
vec2pt = Vector2Pt(PointA=point_upstream_2, PointB=crv_cp.Point, Unitize=False)  # -> Vector, Length

vdisex_3 = VectorDisplayEx(Point=point_upstream_2, Vector=vec2pt.Vector, Colour=RGB(0, 0, 0), Width=2)  # disabled
# For optimization: Make perpendicular
# sections on the river line to discover
# best placement for the Dams.
panel_60 = Panel(vec2pt.Vector)

vector_waterflow = RemoteSender(vec2pt.Vector)

# ----
# vector
vector_waterflow_2 = RemoteReceiver(vector_waterflow)
# vector
vector_waterflow_3 = RemoteReceiver(vector_waterflow)

# ----
# GRAVITY DAM
# Top
# Concrete dam settings
midpt = CurveMiddle(Curve=chord_dam_5)  # disabled
project_5 = Project(Curve=chord_dam_5, Brep=brep_terrain_base_foundation_3, Direction=Vector(0, 0, 1))  # disabled
# surface
end_3 = EndPoints(Curve=chord_dam_5)  # -> Start, End; disabled
x_tremez = Extremes(Curve=project_5, Plane=PlaneXY(0, 0, 0))  # -> Highest, Lowest; disabled
pdecon = Deconstruct(Point=x_tremez.Lowest)  # -> XComponent, YComponent, ZComponent; disabled
pdecon_2 = Deconstruct(Point=midpt)  # -> XComponent, YComponent, ZComponent; disabled
subtraction = Subtraction(A=pdecon_2.ZComponent, B=pdecon.ZComponent)  # disabled
multiplication_3 = Multiplication(A=subtraction, B=1.5)  # disabled
gravity_dam_height = RemoteSender(subtraction)  # disabled
panel_61 = Panel("{0,0,-1}")  # disabled
atan = ArcTangent(Value=neg_4)  # disabled
line = LineSDL(Start=end_3.Start, Direction=panel_61, Length=multiplication_3)  # disabled
rotax = RotateAxis(Geometry=line, Angle=atan, Axis=chord_dam_5)  # -> Geometry, Transform; disabled
swp1 = Sweep1(Rail=chord_dam_5, Sections=line, Miter=1)  # -> flatten(Brep); disabled
swp1_2 = Sweep1(Rail=chord_dam_5, Sections=rotax.Geometry, Miter=1)  # -> flatten(Brep); disabled
entwine = Entwine(Branch00=swp1, Branch01=swp1_2, FlattenInputs=True)  # -> simplify(Result); disabled
bbx = BrepBrep(BrepA=entwine, BrepB=brep_terrain_base_foundation_3)  # -> Curves, Points; disabled
geo_5 = Geometry(bbx.Curves)  # disabled
explode_2 = Explode(Curve=geo_5, Recursive=False)  # -> Segments, Vertices; disabled
pline_3 = PolyLine(Vertices=explode_2.Vertices, Closed=False)  # disabled
lng_3 = ListLength(List=explode_2.Vertices)  # disabled
number_slider_22 = Slider(0.2, range=0..1)  # disabled
smoothpline = SmoothPolyline(Polyline=pline_3, Strength=number_slider_22, Times=lng_3)  # disabled
srfsplit = SurfaceSplit(Surface=entwine, Curves=smoothpline)  # disabled
center = Center(Geometric=srfsplit, referenceAll=2)  # -> Center, Dimension; disabled
sort_2 = SortList(Keys=center.Dimension, ValuesA=srfsplit)  # -> Keys, ValuesA; disabled
amp_4 = Amplitude(Vector=vector_waterflow_3, Amplitude=gravity_width_crest_2)  # disabled
pt_3 = Point(midpt)  # disabled
item_20 = ListItem(List=sort_2.ValuesA, Index=0, Wrap=True)  # -> simplify(Item); disabled
loft = Loft(
    Curves=flatten(smoothpline),
    Options={Adjust=True, Closed=False, LoftEnds=0, LoftSimp=0, LoftType=5, Rebuild=10, Refit=0.01})  # disabled
simplify = SimplifyTree(Tree=smoothpline, Front=False)  # disabled
move_7 = Move(Geometry=pt_3, Motion=amp_4)  # -> Geometry, Transform; disabled
panel_62 = Panel("{1}")  # disabled
join_6 = BrepJoin(Breps=flatten([loft, item_20]))  # -> Breps, Closed; disabled
branch = TreeBranch(Tree=simplify, Path=panel_62, MaintainPaths=True)  # disabled
branch_2 = TreeBranch(Tree=item_20, Path=panel_62, MaintainPaths=True)  # disabled
panel_63 = Panel("0,0,-1")  # disabled
project_6 = ProjectPoint(Point=move_7.Geometry, Direction=panel_63, Geometry=flatten(branch_2))  # -> Point, Index; disabled
number_slider_23 = Slider(100, range=0..100)  # disabled
pline_4 = PolyLine(Vertices=flatten([pt_3, move_7.Geometry, project_6.Point]), Closed=True)  # disabled
move2pt = MoveToPoint(Geometry=pline_4, PointA=pt_3, PointB=end_3.Start)  # -> Moved, Vector, Transform; disabled
Z_12 = UnitZ(Factor=number_slider_23)  # disabled
swp1_3 = Sweep1(Rail=chord_dam_5, Sections=move2pt.Moved, Miter=1)  # disabled
extr_2 = Extrude(Base=branch, Direction=Z_12)  # disabled
split = SplitBrep(Brep=extr_2, Cutter=swp1_3)  # disabled
split_2 = SplitBrep(Brep=swp1_3, Cutter=extr_2)  # disabled
center_2 = Center(Geometric=split, referenceAll=2)  # -> Center, Dimension; disabled
center_3 = Center(Geometric=split_2, referenceAll=2)  # -> Center, Dimension; disabled
sort_3 = SortList(Keys=center_2.Dimension, ValuesA=split)  # -> Keys, reverse(ValuesA); disabled
sort_4 = SortList(Keys=center_3.Dimension, ValuesA=split_2)  # -> Keys, reverse(ValuesA); disabled
cull_i_7 = CullIndex(List=sort_3.ValuesA, Indices=0, Wrap=True)  # disabled
item_21 = ListItem(List=sort_4.ValuesA, Index=0, Wrap=True)  # disabled
join_7 = BrepJoin(Breps=flatten([cull_i_7, item_21]))  # -> Breps, Closed; disabled
# Final volume
sunion_3 = SolidUnion(Breps=[join_6.Breps, join_7.Breps])  # disabled
jagged_6 = SettingsSpeed()  # disabled
mesh_14 = MeshBrep(Brep=sunion_3, Settings=jagged_6)  # disabled
objfromgroup_6 = GetObjectsInGroup()

# ----
# EMBANKMENT DAM
# Top
# Concrete dam settings
# Final volume
midpt_2 = CurveMiddle(Curve=chord_dam_4)  # disabled
project_7 = Project(Curve=chord_dam_4, Brep=brep_terrain_base_foundation_4, Direction=Vector(0, 0, 1))  # disabled
end_4 = EndPoints(Curve=chord_dam_4)  # -> Start, End; disabled
x_tremez_2 = Extremes(Curve=project_7, Plane=PlaneXY(0, 0, 0))  # -> Highest, Lowest; disabled
pdecon_3 = Deconstruct(Point=x_tremez_2.Lowest)  # -> XComponent, YComponent, ZComponent; disabled
pdecon_4 = Deconstruct(Point=midpt_2)  # -> XComponent, YComponent, ZComponent; disabled
subtraction_2 = Subtraction(A=pdecon_4.ZComponent, B=pdecon_3.ZComponent)  # disabled
embankment_dam_height = RemoteSender(subtraction_2)  # disabled
multiplication_4 = Multiplication(A=subtraction_2, B=1.5)  # disabled
panel_64 = Panel("{0,0,-1}")  # disabled
atan_2 = ArcTangent(Value=embankment_ds_ration_2)  # disabled
line_2 = LineSDL(Start=end_4.Start, Direction=panel_64, Length=multiplication_4)  # disabled
rotax_2 = RotateAxis(Geometry=line_2, Angle=atan_2, Axis=chord_dam_4)  # -> Geometry, Transform; disabled
neg_6 = Negative(Value=atan_2)  # disabled
rotax_3 = RotateAxis(Geometry=line_2, Angle=neg_6, Axis=chord_dam_4)  # -> Geometry, Transform; disabled
swp1_4 = Sweep1(Rail=chord_dam_4, Sections=rotax_3.Geometry, Miter=1)  # -> flatten(Brep); disabled
swp1_5 = Sweep1(Rail=chord_dam_4, Sections=rotax_2.Geometry, Miter=1)  # -> flatten(Brep); disabled
swp1_6 = Sweep1(Rail=chord_dam_4, Sections=line_2, Miter=1)  # -> flatten(Brep); disabled
embankment_face_collision = RemoteSender(swp1_4)  # disabled
entwine_2 = Entwine(Branch00=swp1_4, Branch01=swp1_6, Branch02=swp1_5, FlattenInputs=True)  # -> simplify(Result); disabled
bbx_2 = BrepBrep(BrepA=entwine_2, BrepB=brep_terrain_base_foundation_4)  # -> Curves, Points; disabled
geo_6 = Geometry(bbx_2.Curves)  # disabled
explode_3 = Explode(Curve=geo_6, Recursive=False)  # -> Segments, Vertices; disabled
pline_5 = PolyLine(Vertices=explode_3.Vertices, Closed=False)  # disabled
lng_4 = ListLength(List=explode_3.Vertices)  # disabled
number_slider_24 = Slider(0.1, range=0..1)  # disabled
panel_65 = Panel("2")  # disabled
division = Division(A=embankment_width_crest_2, B=panel_65)  # disabled
smoothpline_2 = SmoothPolyline(Polyline=pline_5, Strength=number_slider_24, Times=lng_4)  # disabled
amp_5 = Amplitude(Vector=vector_waterflow_2, Amplitude=division)  # disabled
srfsplit_2 = SurfaceSplit(Surface=entwine_2, Curves=smoothpline_2)  # disabled
neg_7 = Negative(Value=amp_5)  # disabled
center_4 = Center(Geometric=srfsplit_2, referenceAll=2)  # -> Center, Dimension; disabled
merge_11 = Merge(Data1=neg_7, Data2=amp_5)  # -> flatten(Result); disabled
pt_4 = Point(midpt_2)  # disabled
sort_5 = SortList(Keys=center_4.Dimension, ValuesA=srfsplit_2)  # -> Keys, ValuesA; disabled
move_8 = Move(Geometry=pt_4, Motion=merge_11)  # -> Geometry, Transform; disabled
item_22 = ListItem(List=sort_5.ValuesA, Index=0, Wrap=True)  # -> simplify(Item); disabled
loft_2 = Loft(
    Curves=flatten(smoothpline_2),
    Options={Adjust=True, Closed=False, LoftEnds=0, LoftSimp=2, LoftType=5, Rebuild=10, Refit=0.01})  # disabled
simplify_2 = SimplifyTree(Tree=smoothpline_2, Front=False)  # disabled
bang = ExplodeTree(Data=item_22)  # -> Branch0, Branch1, Branch2; disabled
geo_7 = Geometry([bang.Branch0, bang.Branch2])  # disabled
unflatten = UnflattenTree(Tree=move_8.Geometry, Guide=geo_7)  # disabled
tstat = TreeStatistics(Tree=geo_7)  # -> Paths, Length, Count; disabled
dup_6 = DuplicateDataMatch(SourceDataTree=pt_4, SecondaryData1=unflatten)  # -> SourceData, SecondaryData1; disabled
panel_66 = Panel("0,0,-1")  # disabled
branch_3 = TreeBranch(Tree=simplify_2, Path=tstat.Paths, MaintainPaths=True)  # disabled
join_8 = BrepJoin(Breps=flatten([geo_7, loft_2]))  # -> Breps, Closed; disabled
project_8 = ProjectPoint(Point=unflatten, Direction=panel_66, Geometry=geo_7)  # -> Point, Index; disabled
pline_6 = PolyLine(Vertices=[unflatten, project_8.Point, dup_6.SourceData], Closed=True)  # disabled
number_slider_25 = Slider(100, range=0..100)  # disabled
dup_7 = DuplicateDataMatch(SourceDataTree=chord_dam_4, SecondaryData1=pline_6, Clean_Tree=True)  # -> SourceData, SecondaryData1; disabled
move2pt_2 = MoveToPoint(Geometry=pline_6, PointA=pt_4, PointB=end_4.Start)  # -> Moved, Vector, Transform; disabled
Z_13 = UnitZ(Factor=number_slider_25)  # disabled
swp1_7 = Sweep1(Rail=dup_7.SourceData, Sections=move2pt_2.Moved, Miter=1)  # disabled
extr_3 = Extrude(Base=branch_3, Direction=Z_13)  # disabled
split_3 = SplitBrep(Brep=swp1_7, Cutter=extr_3)  # disabled
center_5 = Center(Geometric=split_3, referenceAll=2)  # -> Center, Dimension; disabled
sort_6 = SortList(Keys=center_5.Dimension, ValuesA=split_3)  # -> Keys, reverse(ValuesA); disabled
item_23 = ListItem(List=sort_6.ValuesA, Index=0, Wrap=True)  # disabled
capex = CapHolesEx(Brep=item_23)  # -> Brep, Caps, Solid; disabled
sunion_4 = SolidUnion(Breps=flatten([capex.Brep, join_8.Breps]))  # disabled
jagged_7 = SettingsSpeed()  # disabled
mesh_15 = MeshBrep(Brep=sunion_4, Settings=jagged_7)  # disabled
objfromgroup_7 = GetObjectsInGroup()

vector_waterflow_4 = RemoteReceiver(vector_waterflow)  # disabled
point_upstream_3 = RemoteReceiver(point_upstream)
hops_2 = Hops(
    BrepTerrain=brep_terrain_base_foundation_5,
    ChordDam=chord_dam_6,
    DSRatio=gravity_ds_ration_3,
    VectorWaterflow=vector_waterflow_4,
    WidthCrest=width_crest,
    CacheResultsInMemory=False,
    CacheSolveResults=False,
    RemoteDefinitionLocation="C:\Users\Admin\Documents\Github\EarlyStageDesign\JD\Skripts\Modules\Gravity.gh",
    RemoteSolveVersion=(0, 1, 0),
    ShowInput_Enabled=False,
    ShowInput_Path=True,
    SynchronousSolve=True)  # -> Geo, Volume; disabled

dam_9 = DataDam(
    DataChordToBaseFoundation=chord_dam_3,
    DataBaseFoundationTerrain=brep_terrain_base_foundation_6,
    DataPointUpstream=point_upstream_3,
    DataChord_dam=filter_4,
    DataTerrain=brep_terrain_3,
    DataA=axis_at_height_3,
    DataB=mesh_terrain_offset_3,
    DataC=mesh_terrain_3,
    DataD=offset_foundation_2,
    BufferDelay=10000000,
    BufferMode=1)  # -> DataChordToBaseFoundation, DataBaseFoundationTerrain, DataPointUpstream, DataChord_dam, DataTerrain, DataA, DataB, DataC, DataD
objfromgroup_8 = GetObjectsInGroup()

arch_dam_base_foundation_terrain = RemoteSender(dam_9.DataBaseFoundationTerrain)
arch_dam_original_terrain = RemoteSender(dam_9.DataTerrain)
chord_l1 = RemoteSender(dam_9.DataChord_dam)
chord_l1_2 = RemoteReceiver(chord_l1)
# 1. Determine L1 with section line
end_5 = EndPoints(Curve=chord_l1_2)  # -> Start, End
# On the formulas it is assumed here
# the lenght to excavated sound rock!
# Check technical memorandum. I have
#  changed the axis line to come from the
#  determined excavation on 06.06.23
dist = Distance(PointA=end_5.Start, PointB=end_5.End)
arch_l1 = RemoteSender(dist)
onoff = EnableDisableObject(Objects=objfromgroup_8, Enabled=S_3.a, AllObjects_Object=dam_9)
arch_dam_base_foundation_terrain_2 = RemoteReceiver(arch_dam_base_foundation_terrain)
chord_l1_3 = RemoteReceiver(chord_l1)
relay = Relay([arch_dam_base_foundation_terrain_2, hybrid_surface_barrier_2])
filter_7 = StreamFilter(Gate=hybrid_normal_4, Stream0=flatten(arch_dam_base_foundation_terrain_2), Stream1=flatten(relay))
brep_terrain_plus_barrier = RemoteSender(filter_7)
chord_l1_4 = RemoteReceiver(chord_l1)  # disabled
end_6 = EndPoints(Curve=chord_l1_4)  # -> Start, End; disabled
arch_dam_base_foundation_terrain_3 = RemoteReceiver(arch_dam_base_foundation_terrain)
onoff_2 = EnableDisableObject(
    Objects=objfromgroup_7,
    Enabled=equals_3.Equality,
    AllObjects_Object=[line_2, panel_64, end_4, rotax_2, atan_2, x_tremez_2, project_7, pdecon_4, pdecon_3, subtraction_2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])
arch_dam_base_foundation_terrain_4 = RemoteReceiver(arch_dam_base_foundation_terrain)
volume_2 = MeshVolume(Mesh=mesh_14)  # -> Volume, Centroid
volume_3 = MeshVolume(Mesh=mesh_15)  # -> Volume, Centroid
arch_dam_original_terrain_2 = RemoteReceiver(arch_dam_original_terrain)
onoff_3 = EnableDisableObject(
    Objects=objfromgroup_6,
    Enabled=equals_4.Equality,
    AllObjects_Object=[line, panel_61, end_3, rotax, atan, x_tremez, project_5, pdecon_2, pdecon, subtraction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])
gravity_volume = RemoteSender(volume_2.Volume)
geo_concretedam = RemoteSender(mesh_14)
geo_embankmentdam = RemoteSender(mesh_15)
embankment_volume = RemoteSender(volume_3.Volume)
round = Round(Number=volume_2.Volume)  # -> Nearest, Floor, Ceiling
format_2 = Format(Format="{0:#0,000}", Culture=2055, Data0=volume_2.Volume)
round_2 = Round(Number=volume_3.Volume)  # -> Nearest, Floor, Ceiling
format_3 = Format(Format="{0:#0,000}", Culture=2055, Data0=volume_3.Volume)
panel_67 = Panel(round_2.Nearest)
panel_68 = Panel(format_3)
panel_69 = Panel(round.Nearest)
panel_70 = Panel(format_2)
geo_embankmentdam_2 = RemoteReceiver(geo_embankmentdam)
geo_concretedam_2 = RemoteReceiver(geo_concretedam)
arch_dam_base_foundation_terrain_5 = RemoteReceiver(arch_dam_base_foundation_terrain)
arch_dam_base_foundation_terrain_6 = RemoteReceiver(arch_dam_base_foundation_terrain)
geo_embankmentdam_3 = RemoteReceiver(geo_embankmentdam)  # disabled
geo_concretedam_3 = RemoteReceiver(geo_concretedam)  # disabled
brep_terrain_plus_barrier_2 = RemoteReceiver(brep_terrain_plus_barrier)
arch_dam_base_foundation_terrain_7 = RemoteReceiver(arch_dam_base_foundation_terrain)
chord_l1_5 = RemoteReceiver(chord_l1)
roundd = RoundToDecimalPlace(NumberX=chord_l1_5, DecimalPlace=number_slider_18, RoundType=0)  # -> flatten(Rounded), Difference

# ----
# Preliminary layout of concrete arch dams (USBR)
# Topographic deiminesions necessary to
# compute thicknesses, projections, and
# volume are:
# - structural height (H)
# - horizontal distances between abutments;
#      - including estimated excavation to sound rock at crest elevation (L1)
#      - and 15 % of H above base (L2)
# Definitions: H = structural height
# Tc = thickness at crest
# Tb = thickness at base
# T_0.45H = thickness of crown cantilever at 0.45H above base (T0.45H)
# USP = upstream projection
# DSP = downestream projection
# L1 = straight line distance at crest elevation between abutmenets assumed excavated to sound rock
# L2 = straight line distance, at 0.15H above base, between abutments assumed excavated to sound rock
# V = estimated volume of dam
# Formulas - conservative as compared with values computed more precisely (in feet)
# at crest:
# at  base
# at 0.45H
arch_l1_2 = RemoteReceiver(arch_l1)
arch_l1_current_m = Panel(arch_l1_2)
panel_71 = Panel("USPcrest = 0.0")
panel_72 = Panel("DSPcrest = Tc")
# Technical Memorandum No. EM36-86-68110: 2.1.3.1 Single-, Two-, or Three- Centered Arch Dams
# 
# The number of lines-of-centers determines whether the arches are the same on the left and right side of the dam, are different on the left and right sides of the dam, or different on the inner and outer parts of the dam.
# 
# A single centered arch dam has a single line-of-centers that results in the same circular arcs from the left to the right abutment.
# 
# A 2-centered arch dam has two lines-of-centers that result in different circular arcs for the left side and right sides of the dam.
# 
# A 3-centered arch dam has two lines-of-centers that result in different circular arcs near the crown cantilever (inner) and near the abutments (outer). The radii for the inner arcs are shorter than the outer arcs.
# Technical Memorandum No. EM36-86-68110: 2.1.3.2 Uniform- or Variable Thickness Arch Dams
# 
# The number of lines that define the line-of-centers determines whether the arches are uniform thickness or variable thickness arches.
# The arches have uniform thickness if there is one line defining the extrados and intrados line-of-centers. This means that the radius center for the upstream and downstream faces is the same. The radii lengths are different at each elevation, but since the radius center is the same, the thickness of the arch is uniform.
# The arches vary in thickness if there are two lines defining the extrados and intrados line-of-centers. This means that the radius centers for the upstream and downstream faces are in different positions in space forcing the circular arcs of the arches to diverge.
panel_73 = Panel(" 1 foot = 0.3048 m")

expression = Expression(m=arch_l1_current_m, Expression="m*3.28084")

l1_feet = Panel(expression)
expression_2 = Expression(L1=l1_feet, Expression="0.6*L1")
r_axis_feet = Panel(expression_2)

expression_3 = Expression(ft=r_axis_feet, Expression="ft*0.3048")

r_axis_m = Panel(expression_3)
crest_radius = RemoteSender(r_axis_m)

# ----
# Technical Memorandum No. EM36-86-68110: 4.2 Determine an Appraisal Level Arch Dam Layout
# 
# 3 - If the topography map is of the ground surface, change the contours to represent the position of sound rock.
crest_radius_2 = RemoteReceiver(crest_radius)

# ----
# Technical Memorandum No. EM36-86-68110: 4.2 Determine an Appraisal Level Arch Dam Layout
# 
# 2 - Determine Raxis= 0.6 L1 and round the value of Raxis up to the nearest 10 to 50 feet.
# This is the initial layout, so no need for decimal accuracy
r_crest_usp = Panel(crest_radius_2)

# ----
# 2. Determine radius according to L1
addition_2 = Addition(A=r_crest_usp, B=raxis_adjustments)

# ----
# 3. Create crest curve
end_7 = EndPoints(Curve=chord_l1_3)  # -> Start, End
cir = Circle(Plane=end_7.Start, Radius=addition_2)
cir_2 = Circle(Plane=end_7.End, Radius=addition_2)
ccx = CurveCurve(CurveA=cir, CurveB=cir_2)  # -> Points, ParamsA, ParamsB
dist_2 = Distance(PointA=ccx.Points, PointB=dam_9.DataPointUpstream)
sort_7 = SortList(Keys=dist_2, ValuesA=ccx.Points)  # -> reverse(Keys), reverse(ValuesA)
item_24 = ListItem(List=sort_7.ValuesA, Index=0, Wrap=True)  # -> Item, Item1
circle = CircleCNR(Center=item_24.Item, Normal=Vector(0, 0, 1), Radius=addition_2)
ln_3 = Line(StartPoint=item_24.Item, EndPoint=item_24.Item1)
ccx_2 = CurveCurve(CurveA=chord_l1_3, CurveB=circle)  # -> Points, ParamsA, ParamsB
shatter_2 = Shatter(Curve=circle, Parameters=ccx_2.ParamsB)
colom = CollisionOneMany(Collider=ln_3, Obstacles=shatter_2)  # -> Collision, Index
item_25 = ListItem(List=shatter_2, Index=colom.Index, Wrap=True)

# ---- group: Axis arch Dam
# Technical Memorandum No. EM36-86-68110: 4.2 Determine an Appraisal Level Arch Dam Layout
# 
# 4 - Position the dam in the canyon. Draw a circular arc with radius Raxis...This arc is the axis of the dam and is the upstream side of the crest. Move the axis around the propose dam location to
# position the top of the dam in the canyon.
# 
# The angle of incidence of the axis into the left and right abutments should be approximately equal to produce a geometrically symmetric dam in the canyon.
geo_8 = Geometry(item_25)

# ----
usp_arch_crest = RemoteSender(geo_8)

# ---- group: Visualization section lines
chord_l1_6 = RemoteReceiver(chord_l1)
usp_arch_crest_2 = RemoteReceiver(usp_arch_crest)
end_8 = EndPoints(Curve=chord_l1_6)  # -> Start, End
addition_3 = Addition(A=Slider(200, range=0..1000), B=dam_9.DataD)
ptstrimcrv = PointsTrimCurve(Curve=dam_9.DataA, Points=[end_8.Start, end_8.End], Flip=False)  # -> Trimmed, SubDomains, Intersected
join_9 = JoinCurves(Curves=flatten([ptstrimcrv.Trimmed, usp_arch_crest_2]), Preserve=False)
Z_14 = UnitZ(Factor=addition_3)
neg_8 = Negative(Value=Z_14)
move_9 = Move(Geometry=join_9, Motion=neg_8)  # -> Geometry, Transform
Z_15 = UnitZ(Factor=Slider(1000, range=0..1000))
extr_4 = Extrude(Base=move_9.Geometry, Direction=Z_15)
mmx_2 = MeshMesh(MeshA=[dam_9.DataB, dam_9.DataC], MeshB=extr_4)  # -> simplify(Intersections)
section_lines_arch = RemoteSender(mmx_2)

# ----
section_lines_arch_2 = RemoteReceiver(section_lines_arch)  # disabled
split_4 = SplitTree(Data=section_lines_arch_2, Masks=flatten(path_2))  # -> Positive, Negative; disabled
cluster = Cluster(relay_2=split_4.Positive, relay=[end_6.Start, end_6.End])  # disabled
usp_arch_crest_3 = RemoteReceiver(usp_arch_crest)
project_9 = Project(Curve=usp_arch_crest_3, Brep=arch_dam_base_foundation_terrain_3, Direction=Vector(0, 0, 1))
eval_7 = EvaluateCurve(Curve=reparameterize(project_9), Parameter=Slider(0.469, range=0..1))  # -> Point, Tangent, Angle
eval_8 = EvaluateCurve(Curve=reparameterize(project_9), Parameter=Slider(0.53, range=0..1))  # -> Point, Tangent, Angle
x_tremez_3 = Extremes(Curve=project_9, Plane=PlaneXY(0, 0, 0))  # -> Highest, Lowest
movetoplane_5 = MoveToPlane(Geometry=eval_8.Point, Plane=x_tremez_3.Lowest, Above=True, Below=True)  # -> Geometry, Transform
filter_8 = StreamFilter(Gate=list_6, Stream0=x_tremez_3.Lowest, Stream1=movetoplane_5.Geometry)
dam_10 = DataDam(DataA=filter_8, BufferDelay=10000000, BufferMode=1)

# ---- group: Lowest point (Base - middle section)
point_foot_dam = Point(dam_10)

# ----
point_at_base = RemoteSender(point_foot_dam)
point_at_base_2 = RemoteReceiver(point_at_base)
usp_arch_crest_4 = RemoteReceiver(usp_arch_crest)
usp_arch_crest_5 = RemoteReceiver(flatten(usp_arch_crest))
path_mapper_2 = PathMapper(usp_arch_crest_5, source="{A}", target="{0;A}")
usp_arch_crest_6 = RemoteReceiver(usp_arch_crest)
geo_9 = Geometry(usp_arch_crest_6)
len_4 = Length(Curve=geo_9)
roundd_2 = RoundToDecimalPlace(NumberX=geo_9, DecimalPlace=number_slider_18, RoundType=0)  # -> flatten(Rounded), Difference

# ---- group: Section lines
section_lines_arch_3 = RemoteReceiver(section_lines_arch)
section_lines_gravity_2 = RemoteReceiver(section_lines_gravity)
linetypes_3 = QueryModelLinetypes(Name="Section", AutoUpdateState=True)
linetypes_4 = QueryModelLinetypes(Name="Section", AutoUpdateState=True)
swatch_7 = ColourSwatch(SwatchColor=RGB(63, 64, 63))
curve_preview_2 = CustomCurvePreview(Curve=section_lines_arch_3, Linetype=linetypes_4, Colour=ColourSwatch(SwatchColor=RGB(255, 221, 0)))  # disabled
curve_preview_3 = CustomCurvePreview(Curve=section_lines_gravity_2, Linetype=linetypes_3, Colour=swatch_7)  # disabled

# ----
# surface
# line
# number
# GRAVITY DAM addition
# vector
# number
number_slider_26 = Slider(0, range=0..1)
section_lines_gravity_3 = RemoteReceiver(section_lines_gravity)
chord_dam_12 = RemoteReceiver(chord_dam)
path_4 = ConstructPath(Indices=number_slider_26)
split_5 = SplitTree(Data=section_lines_gravity_3, Masks=flatten(path_4))  # -> Positive, Negative
end_9 = EndPoints(Curve=chord_dam_12)  # -> Start, End
ptstrimcrv_2 = PointsTrimCurve(Curve=split_5.Positive, Points=[end_9.Start, end_9.End], Flip=False)  # -> Trimmed, SubDomains, Intersected
dedomain = DeconstructDomain(Domain=ptstrimcrv_2.SubDomains)  # -> reverse(Start), End
number_slider_27 = Slider(0.1, range=0..0.1)
item_26 = ListItem(List=dedomain.Start, Index=0, Wrap=True)
item_27 = ListItem(List=dedomain.End, Index=0, Wrap=True)
subtraction_3 = Subtraction(A=number_slider_3, B=number_slider_27)
shatter_3 = Shatter(Curve=split_5.Positive, Parameters=[item_26, item_27])
chord_dam_13 = RemoteReceiver(chord_dam)
item_28 = ListItem(List=shatter_3, Index=1, Wrap=True)
shatter_4 = Shatter(Curve=reparameterize(chord_dam_13), Parameters=subtraction_3)
item_29 = ListItem(List=shatter_4, Index=1, Wrap=True)
gravity_width_crest_3 = RemoteReceiver(gravity_width_crest)
vector_waterflow_5 = RemoteReceiver(vector_waterflow)
gravity_ds_ration_4 = RemoteReceiver(gravity_ds_ration)
brep_terrain_base_foundation_7 = RemoteReceiver(brep_terrain_base_foundation)
flip_3 = FlipCurve(Curve=item_29)  # -> Curve, Flag
midpt_3 = CurveMiddle(Curve=flip_3.Curve)
end_10 = EndPoints(Curve=flip_3.Curve)  # -> Start, End
x_tremez_4 = Extremes(Curve=item_28, Plane=PlaneXY(0, 0, 0))  # -> Highest, Lowest
pdecon_5 = Deconstruct(Point=x_tremez_4.Lowest)  # -> XComponent, YComponent, ZComponent
pdecon_6 = Deconstruct(Point=midpt_3)  # -> XComponent, YComponent, ZComponent
subtraction_4 = Subtraction(A=pdecon_6.ZComponent, B=pdecon_5.ZComponent)
multiplication_5 = Multiplication(A=subtraction_4, B=1.5)
gravity_dam_height_2 = RemoteSender(subtraction_4)
panel_74 = Panel("{0,0,-1}")
atan_3 = ArcTangent(Value=gravity_ds_ration_4)
line_3 = LineSDL(Start=end_10.Start, Direction=panel_74, Length=multiplication_5)
rotax_4 = RotateAxis(Geometry=line_3, Angle=atan_3, Axis=flip_3.Curve)  # -> Geometry, Transform
swp1_8 = Sweep1(Rail=flip_3.Curve, Sections=line_3, Miter=1)  # -> flatten(Brep)
swp1_9 = Sweep1(Rail=flip_3.Curve, Sections=rotax_4.Geometry, Miter=1)  # -> flatten(Brep)
mesh_terrain_offset_5 = RemoteReceiver(mesh_terrain_offset)
entwine_3 = Entwine(Branch00=swp1_8, Branch01=swp1_9, FlattenInputs=True)  # -> simplify(Result)
bbx_3 = BrepBrep(BrepA=entwine_3, BrepB=brep_terrain_base_foundation_7)  # -> Curves, Points
mmx_3 = MeshMesh(MeshA=entwine_3, MeshB=mesh_terrain_offset_5)
geo_10 = Geometry(mmx_3)
explode_4 = Explode(Curve=geo_10, Recursive=False)  # -> Segments, Vertices
number_slider_28 = Slider(8.81, range=0.1..90)
panel_75 = Panel(mmx_3)
pline_7 = PolyLine(Vertices=explode_4.Vertices, Closed=False)
lng_5 = ListLength(List=explode_4.Vertices)
number_slider_29 = Slider(0, range=0..1)
topoly = CurveToPolyline(Curve=mmx_3, ToleranceDistance=0, ToleranceAngle=number_slider_28)  # -> Polyline, Segments
usp_arch_crest_7 = RemoteReceiver(usp_arch_crest)
smoothpline_3 = SmoothPolyline(Polyline=pline_7, Strength=number_slider_29, Times=lng_5)
end_11 = EndPoints(Curve=usp_arch_crest_7)  # -> Start, End
pt_5 = Point(end_11.Start)
pt_6 = Point(midpt_3)
panel_76 = Panel("{1}")
panel_77 = Panel("0,0,-1")
number_slider_30 = Slider(100, range=0..100)
Z_16 = UnitZ(Factor=number_slider_30)
hybrid_surface_barrier_5 = RemoteReceiver(hybrid_surface_barrier)
jagged_8 = SettingsSpeed()
panel_78 = Panel("{0:#0,000}")
objfromgroup_9 = GetObjectsInGroup()

crv_2 = Curve(mmx_3)
onoff_4 = EnableDisableObject(
    Objects=objfromgroup_9,
    Enabled=equals_5.Equality,
    AllObjects_Object=[line_3, panel_74, end_10, chord_dam_13, rotax_4, atan_3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])

srfsplit_3 = SurfaceSplit(Surface=entwine_3, Curves=crv_2)
center_6 = Center(Geometric=srfsplit_3, referenceAll=2)  # -> Center, Dimension
sort_8 = SortList(Keys=center_6.Dimension, ValuesA=srfsplit_3)  # -> Keys, ValuesA
item_30 = ListItem(List=sort_8.ValuesA, Index=0, Wrap=True)  # -> simplify(Item)
loft_3 = Loft(Curves=flatten(crv_2), Options={Adjust=True, Closed=False, LoftEnds=0, LoftSimp=0, LoftType=5, Rebuild=10, Refit=0.01})
simplify_3 = SimplifyTree(Tree=crv_2, Front=False)
join_10 = BrepJoin(Breps=flatten([loft_3, item_30]))  # -> Breps, Closed
branch_4 = TreeBranch(Tree=simplify_3, Path=panel_76, MaintainPaths=True)
branch_5 = TreeBranch(Tree=item_30, Path=panel_76, MaintainPaths=True)
extr_5 = Extrude(Base=branch_4, Direction=Z_16)
capex_2 = CapHolesEx(Brep=join_10.Breps)  # -> Brep, Caps, Solid

srf = Surface(flatten(item_30))
split_6 = SplitBrep(Brep=srf, Cutter=hybrid_surface_barrier_3)
item_31 = ListItem(List=reverse(split_6), Index=0, Wrap=True)  # -> flatten(Item)
item_32 = ListItem(List=item_31, Index=0, Wrap=True)

split_dead_storage_2 = BooleanToggle(False)  # disabled
gate_4 = StreamGate(Stream=clsmsh_4.Closed, Gate=split_dead_storage_2)  # -> Target0, Target1; disabled
cut_water_body_in_levels_2 = BooleanToggle(False)  # disabled
number_slider_31 = Slider(18, range=0..20)  # disabled
bool_4 = Boolean(False)  # disabled
bool_5 = Boolean(True)  # disabled

# ---- group: Divide dead storage capacity from the rest
msplit_10 = MeshSplit(Mesh=gate_4.Target1, Splitters=movetoplane_4.Geometry)  # disabled
clean_8 = CleanTree(RemoveNulls=True, RemoveInvalid=True, RemoveEmpty=False, Tree=msplit_10)  # disabled
panel_79 = Panel("0")  # disabled
cull_i_8 = CullIndex(List=clean_8, Indices=panel_79, Wrap=True)  # disabled
item_33 = ListItem(List=clean_8, Index=0, Wrap=True)  # disabled
clsmsh_11 = CloseMesh(Mesh=cull_i_8, Quadrangulate=False)  # -> Closed, Amount, Openings, R; disabled
clsmsh_12 = CloseMesh(Mesh=item_33, Quadrangulate=False)  # -> Closed, Amount, Openings, R; disabled

# ----
# 4. Figure L2
darc = DeconstructArc(Arc=usp_arch_crest_3)  # -> flatten(BasePlane), Radius, Angle
# Technical Memorandum No. EM36-86-68110: 4.2 Determine an Appraisal Level Arch Dam Layout
# 
# 5 - On the axis, locate a point about midway between the abutments and in the riverbed. This is the location of the crown cantilever...
project_10 = Project(Geometry=point_foot_dam, Plane=darc.BasePlane)  # -> Geometry, Transform
ln_4 = Line(StartPoint=point_foot_dam, EndPoint=project_10.Geometry)
eval_9 = EvaluateCurve(Height=reparameterize(ln_4), Point_at_015H="0.15")  # -> Point, Tangent, Angle
len_5 = Length(Curve=ln_4)

# ---- group: Centrifugal vector
pt_7 = Point(darc.BasePlane)
pt_8 = Point(project_10.Geometry)
vec2pt_2 = Vector2Pt(PointA=pt_8, PointB=pt_7, Unitize=True)  # -> Vector, Length

# ----
# Technical Memorandum No. EM36-86-68110: 4.2 Determine an Appraisal Level Arch Dam Layout
# 
# 5 - ...The radius of the axis at this point is the orientation of the reference plane and the line of centers. The reference plane is a vertical plane through the crown cantilever and generally parallel to the stream bank.
ln_5 = Line(StartPoint=pt_8, EndPoint=pt_7)

project_11 = Project(Geometry=ln_5, Plane=point_foot_dam)  # -> Geometry, Transform

rulesrf = RuledSurface(CurveA=project_11.Geometry, CurveB=ln_5)
srf_2 = Surface(rulesrf)
evalsrf = EvaluateSurface(Surface=reparameterize(srf_2), Point="0.5,0.5")  # -> Point, Normal, UDirection, VDirection, Frame
pl_7 = PlaneNormal(Origin=evalsrf.Point, ZAxis=evalsrf.Normal)
crv_3 = Curve(rulesrf)

ext = ExtendCurve(Curve=project_11.Geometry, Type=0, Start=500, End=500)
crv_4 = Curve(ext)
point_crest = RemoteSender(project_10.Geometry)
# Elevation here!
reference_centers_outline = RemoteSender(crv_3)
abiscissa_dam_axis = RemoteSender(crv_4)
refecenre_centers_vector = RemoteSender(evalsrf.Normal)
centrifugal_vector = RemoteSender(vec2pt_2.Vector)
center_crest = RemoteSender(pt_7)
reference_centers_plane = RemoteSender(pl_7)
arch_dam_height = RemoteSender(len_5)
point_crest_2 = RemoteReceiver(point_crest)
centrifugal_vector_2 = RemoteReceiver(centrifugal_vector)

# ----
# x. Elevations
# Technical Memorandum No. EM36-86-68110: 4.2 Determine an Appraisal Level Arch Dam Layout
# 
# 9. Select 6 to 8 arch elevations on the crown cantilever to define the 3D dam. Select the lowest arch elevation starting at about 15% H. Then between 15% H and the crest, try to select 6 to 8 arches evenly spaced vertically and rounded to nearest contour elevation.
# E. Goulas: According to the Engineer Manual [1], the dam is divided into 5 to 10 evenly spaced horizontal arches and their respective parabolas are computed. They should be spaced not less than 3.048 meters (10 feet) nor more than 30.48 meters (100 feet) apart. The lowest parabola should be 0.15H to 0.20H above the base.
# DESIGN MANUAL FOR CONCRETE ARCH DAMS, 1977: Usually 5 to 10 arch elevations are selected such that the  entire dam is represented by a system of horizontal elements evenly spaced over the
# height of the structure.
# Usually the intervals are not greater than 100 (30.5m) feet nor less than 20 feet (6.1m).
# Technical Memorandum No. EM36-86-68110: Select the lowest arch elevation starting at about 15% H. Then between 15% H and the crest, try to select 6 to 8 arches evenly spaced vertically and rounded to nearest contour
# elevation. Even spacing arches permit best evaluation of the ADSAS results.
# EM_1110-2-2201_ARCH_DAM_DESIGN: The
# lowest arch should be 0.15H to 0.20H above the base of the crown cantilever.
section_height_approx = Slider(11, range=6..30)
eval_10 = EvaluateCurve(Height=reparameterize(ln_4), Point_at_015H="0.2")  # -> Point, Tangent, Angle
shatter_5 = Shatter(Curve=reparameterize(ln_4), Parameters="0.2")
item_34 = ListItem(List=shatter_5, Index="1", Wrap=True)
len_6 = Length(Curve=item_34)
expression_4 = Expression(section_heights=section_height_approx, height=len_6, Expression="height/section_heights")
eval_11 = EvaluateCurve(Height=reparameterize(ln_4), PointAt0="0")  # -> Point, Tangent, Angle
round_3 = Round(Number=expression_4)  # -> Nearest, Floor, Ceiling
divide = DivideCurve(Curve=item_34, Count=round_3.Nearest, Kinks=False)  # -> Points, Tangents, Parameters
division_2 = Division(A=len_6, B=round_3.Nearest)  # -> flatten(Result)
pt_9 = Point(flatten([divide.Points, eval_11.Point]))
pdecon_7 = Deconstruct(Point=pt_9)  # -> XComponent, YComponent, ZComponent
section_height_actual = Panel(division_2)
sort_9 = SortList(Keys=pdecon_7.ZComponent, ValuesA=pt_9)  # -> reverse(Keys), reverse(ValuesA)
cull_i_9 = CullIndex(List=sort_9.ValuesA, Indices=0, Wrap=True)
pln_5 = Plane(simplify(graft(cull_i_9)))

item_35 = ListItem(List=sort_9.ValuesA, Index=0, Wrap=True)
pln_6 = Plane(simplify(graft(item_35)))
crest_plane_elevation = RemoteSender(pln_6)
plane_elevations = RemoteSender(pln_5)
plane_elevations_2 = RemoteReceiver(plane_elevations)
refecenre_centers_vector_2 = RemoteReceiver(refecenre_centers_vector)
reference_centers_plane_2 = RemoteReceiver(reference_centers_plane)
center_crest_2 = RemoteReceiver(center_crest)
plane_elevations_3 = RemoteReceiver(plane_elevations)
refecenre_centers_vector_3 = RemoteReceiver(refecenre_centers_vector)
reference_centers_plane_3 = RemoteReceiver(reference_centers_plane)
plane_elevations_4 = RemoteReceiver(plane_elevations)
arch_dam_height_2 = RemoteReceiver(arch_dam_height)
arch_dam_height_3 = RemoteReceiver(arch_dam_height)
expression_5 = Expression(L=len_4, H=arch_dam_height_3, Expression="L/H")
roundd_3 = RoundToDecimalPlace(NumberX=arch_dam_height_2, DecimalPlace=number_slider_18, RoundType=0)  # -> flatten(Rounded), Difference
roundd_4 = RoundToDecimalPlace(NumberX=expression_5, DecimalPlace=number_slider_18, RoundType=0)  # -> flatten(Rounded), Difference

arch_dam_height_4 = RemoteReceiver(arch_dam_height)
meter = Panel(arch_dam_height_4)

expression_6 = Expression(m=meter, Expression="m*3.28084")

feet = Panel(expression_6)
expression_7 = Expression(H=feet, L1=l1_feet, Expression="0.01*(H + 1.2*L1)")
tc_feet = Panel(expression_7)

expression_8 = Expression(ft=tc_feet, Expression="ft*0.3048")

tc_m = Panel(expression_8)
arch_tc = RemoteSender(tc_m)

arch_tc_2 = RemoteReceiver(arch_tc)
subtraction_5 = Subtraction(A=addition_2, B=arch_tc_2)
r_crest_dsp = Panel(subtraction_5)
cir_3 = Circle(Plane=item_24.Item, Radius=r_crest_dsp)
scx_3 = SurfaceCurve(Surface=filter_7, Curve=cir_3)  # -> Curves, Points, UVPoints, Normals, flatten(Parameters), Tangents
shatter_6 = Shatter(Curve=cir_3, Parameters=scx_3.Parameters)
colom_2 = CollisionOneMany(Collider=ln_3, Obstacles=shatter_6)  # -> Collision, Index
item_36 = ListItem(List=shatter_6, Index=colom_2.Index, Wrap=True)
dsp_arch_crest = RemoteSender(item_36)
arch_tc_3 = RemoteReceiver(arch_tc)
dsp_arch_crest_2 = RemoteReceiver(dsp_arch_crest)
dsp_arch_crest_3 = RemoteReceiver(flatten(dsp_arch_crest))
path_mapper_3 = PathMapper(dsp_arch_crest_3, source="{A}", target="{1;A}")

dsp_arch_crest_4 = RemoteReceiver(dsp_arch_crest)
end_12 = EndPoints(Curve=dsp_arch_crest_4)  # -> Start, End
dist_3 = Distance(PointA=end_11.Start, PointB=end_12.Start)
amp_6 = Amplitude(Vector=vector_waterflow_5, Amplitude=dist_3)
pt_10 = Point(end_12.Start)
vec2pt_3 = Vector2Pt(PointA=end_11.Start, PointB=end_12.Start, Unitize=False)  # -> Vector, Length
move_10 = Move(Geometry=pt_6, Motion=vec2pt_3.Vector)  # -> Geometry, Transform
project_12 = ProjectPoint(Point=move_10.Geometry, Direction=panel_77, Geometry=flatten(branch_5))  # -> Point, Index
pline_8 = PolyLine(Vertices=flatten([pt_6, move_10.Geometry, project_12.Point]), Closed=True)
move2pt_3 = MoveToPoint(Geometry=pline_8, PointA=pt_6, PointB=end_10.Start)  # -> Moved, Vector, Transform
swp1_10 = Sweep1(Rail=flip_3.Curve, Sections=move2pt_3.Moved, Miter=1)
split_7 = SplitBrep(Brep=extr_5, Cutter=swp1_10)
split_8 = SplitBrep(Brep=swp1_10, Cutter=extr_5)
center_7 = Center(Geometric=split_7, referenceAll=2)  # -> Center, Dimension
center_8 = Center(Geometric=split_8, referenceAll=2)  # -> Center, Dimension
sort_10 = SortList(Keys=center_7.Dimension, ValuesA=split_7)  # -> Keys, reverse(ValuesA)
sort_11 = SortList(Keys=center_8.Dimension, ValuesA=split_8)  # -> Keys, reverse(ValuesA)
cull_i_10 = CullIndex(List=sort_10.ValuesA, Indices=0, Wrap=True)
item_37 = ListItem(List=sort_11.ValuesA, Index=0, Wrap=True)
join_11 = BrepJoin(Breps=flatten([cull_i_10, item_37]))  # -> Breps, Closed
capex_3 = CapHolesEx(Brep=join_11.Breps)  # -> Brep, Caps, Solid
sunion_5 = SolidUnion(Breps=[capex_2.Brep, capex_3.Brep])
split_9 = SplitBrep(Brep=sunion_5, Cutter=hybrid_surface_barrier_5)
center_9 = Center(Geometric=split_9, referenceAll=2)  # -> Center, Dimension
sort_12 = SortList(Keys=center_9.Dimension, ValuesA=split_9)  # -> Keys, reverse(ValuesA)
item_38 = ListItem(List=sort_12.ValuesA, Index=0, Wrap=True)

capex_4 = CapHolesEx(Brep=item_38)  # -> Brep, Caps, Solid
fmerge = MergeFaces(Brep=capex_4.Brep)  # -> Breps, Before, After

mesh_16 = MeshBrep(Brep=capex_4.Brep, Settings=jagged_8)
volume_4 = MeshVolume(Mesh=mesh_16)  # -> Volume, Centroid
gravity_hybrid_volume = RemoteSender(volume_4.Volume)
geo_gravity_hybrid_dam = RemoteSender(mesh_16)
round_4 = Round(Number=volume_4.Volume)  # -> Nearest, Floor, Ceiling
format_4 = Format(Format=panel_78, Culture=2055, Data0=volume_4.Volume)
panel_80 = Panel(round_4.Nearest)
panel_81 = Panel(format_4)

move_11 = Move(Geometry=project_12.Point, Motion=Z_11)  # -> Geometry, Transform
pline_9 = PolyLine(Vertices=flatten([move_10.Geometry, move_11.Geometry]), Closed=False)
rev_2 = Reverse(Vector=vec2pt_3.Vector)
move2pt_4 = MoveToPoint(Geometry=pline_9, PointA=pt_6, PointB=end_10.Start)  # -> Moved, Vector, Transform
vlen = VectorLength(Vector=rev_2)
swp1_11 = Sweep1(Rail=flip_3.Curve, Sections=move2pt_4.Moved, Miter=1)
division_3 = Division(A=vlen, B="2")
amp_7 = Amplitude(Vector=rev_2, Amplitude=division_3)
move_12 = Move(Geometry=swp1_11, Motion=amp_7)  # -> Geometry, Transform
srf_3 = Surface(move_12.Geometry)
srf_4 = Surface([item_32, srf_3])
brep_3 = Brep(flatten([arch_dam_base_foundation_terrain_5, capex_4.Brep]))
terrain_plus_gravity_hybrid = RemoteSender(brep_3)
terrain_plus_gravity_hybrid_2 = RemoteReceiver(terrain_plus_gravity_hybrid)
terrain_plus_gravity_hybrid_3 = RemoteReceiver(terrain_plus_gravity_hybrid)
geo_11 = Geometry(terrain_plus_gravity_hybrid_2)
srf_5 = Surface(flatten([arch_dam_base_foundation_terrain_7, srf_4]))
geo_12 = Geometry(item_38)
geo_13 = Geometry(capex_4.Brep)
psrfclsd = IsPolysurfaceClosed(Polysurface=geo_13)
geo_14 = Geometry(item_38)  # disabled
mesh_17 = MeshBrep(
    Brep=geo_13,
    Settings={GridMaxCount=0, GridMinCount=16, JaggedSeams=False, MaxEdgeLength=0, MinEdgeLength=0.0001, MinTolerance=0, Refine=True, RefineAngle=0, RelativeTolerance=0.65, SimplePlanes=True, Tolerance=0})
bvol = BoundaryVolume(Boundaries=capex_4.Brep)  # disabled

rest_2 = Mesh(clsmsh_12.Closed)  # disabled
rebmsh_5 = RebuildMesh(
    Mesh=clsmsh_11.Closed,
    RebuildNormals=True,
    CullUnused=True,
    UnifyNormals=True,
    FlipNormals=False,
    IdenticalCombine=True,
    WeldVertices=1)  # disabled
dead_storage_2 = Mesh(flatten(rebmsh_5))  # disabled
mesh_18 = Mesh(dead_storage_2)  # disabled
dup_8 = DuplicateDataMatch(SourceDataTree=mesh_18, SecondaryData1=bool_5)  # -> SourceData, SecondaryData1; disabled

# ---- group: Splitting the rest to the normal water level
msplit_11 = MeshSplit(Mesh=rest_2, Splitters=movetoplane_3.Geometry)  # disabled
clean_9 = CleanTree(RemoveNulls=True, RemoveInvalid=True, RemoveEmpty=False, Tree=msplit_11)  # disabled
panel_82 = Panel("0")  # disabled
cull_i_11 = CullIndex(List=clean_9, Indices=panel_82, Wrap=True)  # disabled
item_39 = ListItem(List=cull_i_11, Index=0, Wrap=True)  # -> Item, Item1; disabled
geo_15 = Geometry(item_39.Item)  # disabled

# ----
vec2pt_4 = Vector2Pt(PointA=pt_8, PointB=eval_9.Point, Unitize=False)  # -> Vector, Length
move_13 = Move(Geometry=usp_arch_crest_3, Motion=vec2pt_4.Vector)  # -> Geometry, Transform

mcx = MeshCurve(Mesh=dam_9.DataB, Curve=move_13.Geometry)  # -> flatten(Points), Faces

crv_cp_2 = CurveClosestPoint(Point=mcx.Points, Curve=move_13.Geometry)  # -> Point, Parameter, Distance
shatter_7 = Shatter(Curve=move_13.Geometry, Parameters=crv_cp_2.Parameter)
colom_3 = CollisionOneMany(Collider=eval_9.Point, Obstacles=shatter_7)  # -> Collision, Index
item_40 = ListItem(List=shatter_7, Index=colom_3.Index, Wrap=True)
end_13 = EndPoints(Curve=item_40)  # -> Start, End
dist_4 = Distance(PointA=end_13.Start, PointB=end_13.End)

arch_l2 = RemoteSender(dist_4)

# ----
# Do concrete formula estimation to check
# how different they are from the volume in gh
# check memoradum
arch_l2_2 = RemoteReceiver(arch_l2)
arch_l2_current_m = Panel(arch_l2_2)

expression_9 = Expression(m=arch_l2_current_m, Expression="m*3.28084")

l2_feet = Panel(expression_9)
expression_10 = Expression(H=feet, L1=l1_feet, L2=l2_feet, Expression="(0.0012*H*L1*L2*((H/400)^(H/400)))^(⅓)")
expression_11 = Expression(Tb=expression_10, Expression="0.67*Tb")
expression_12 = Expression(Tb=expression_10, Expression="0.33*Tb")
expression_13 = Expression(Tb=expression_10, Expression="0.95*Tb")
expression_14 = Expression(H=feet, L1=l1_feet, L2=l2_feet, Expression="0.000002*(H²)*L2*(((H+0.8*L1)²)/(L1-L2))+0.0004*H*L1*(H+1.1*L1)")
usp_base_feet = Panel(expression_11)
dsp_base_feet = Panel(expression_12)
tb_0_45h_feet = Panel(expression_13)

expression_15 = Expression(ft=usp_base_feet, Expression="ft*0.3048")
expression_16 = Expression(ft=dsp_base_feet, Expression="ft*0.3048")
expression_17 = Expression(ft=tb_0_45h_feet, Expression="ft*0.3048")

usp_base_m = Panel(expression_15)
dsp_base_m = Panel(expression_16)
tb_0_45h_m = Panel(expression_17)
arch_usp_at_045h = RemoteSender(tb_0_45h_m)
arch_usp_base = RemoteSender(usp_base_m)
arch_dsp_base = RemoteSender(dsp_base_m)

arch_usp_at_045h_2 = RemoteReceiver(arch_usp_at_045h)
arch_usp_base_2 = RemoteReceiver(arch_usp_base)
arch_dsp_base_2 = RemoteReceiver(arch_dsp_base)

# ---- group: Crown Cantilever
# 5. Section points - based on the equations
# At Base
# At Crest:
# At 0.45H
panel_83 = Panel("0.45")
eval_12 = EvaluateCurve(Height=reparameterize(ln_4), Point_at_045H=panel_83)  # -> Point, Tangent, Angle
neg_9 = Negative(Value=centrifugal_vector_2)
neg_10 = Negative(Value=centrifugal_vector_2)
amp_8 = Amplitude(Vector=centrifugal_vector_2, Amplitude=arch_tc_3)
amp_9 = Amplitude(Vector=neg_10, Amplitude=arch_usp_base_2)
amp_10 = Amplitude(Vector=neg_9, Amplitude=arch_usp_at_045h_2)
amp_11 = Amplitude(Vector=centrifugal_vector_2, Amplitude=arch_dsp_base_2)
move_14 = Move(Geometry=point_at_base_2, Motion=amp_11)  # -> Geometry, Transform
move_15 = Move(Geometry=point_at_base_2, Motion=amp_9)  # -> Geometry, Transform
move_16 = Move(Geometry=point_crest_2, Motion=amp_8)  # -> Geometry, Transform
move_17 = Move(Geometry=eval_12.Point, Motion=amp_10)  # -> Geometry, Transform
usp_pt_at_base = Point(move_15.Geometry)
pt_at_0_45h = Point(move_17.Geometry)
pt_at_crest = Point(point_crest_2)
pt_at_0_45h_2 = Point(eval_12.Point)
pt_at_crest_2 = Point(move_16.Geometry)
pt_at_base = Point(move_14.Geometry)
# Technical Memorandum No. EM36-86-68110: 4.2 Determine an Appraisal Level Arch Dam Layout
# 
# 7 - Determine the geometry of the upstream and downstream face along the crown cantilever. A circle can be drawn through the 3 points computed for the upstream face in Step 6. Likewise, a circle can be drawn through the 3 points computed for the
# downstream face.
# 
# 8. Draw the upstream and downstream face along the crown cantilever.
arc = Arc3Pt(PointA=pt_at_crest_2, PointB=pt_at_0_45h_2, PointC=pt_at_base)  # -> DownstreamArc, CenterP, RadiusM
arc_2 = Arc3Pt(PointA=pt_at_crest, PointB=pt_at_0_45h, PointC=usp_pt_at_base)  # -> UpstreamArc, CenterP, RadiusM
ds_arc = RemoteSender(arc.DownstreamArc)
us_arc = RemoteSender(arc_2.UpstreamArc)

# ----
ds_arc_2 = RemoteReceiver(ds_arc)
bcx = BrepCurve(Brep=arch_dam_original_terrain_2, Curve=ds_arc_2)  # -> Curves, Points
ln_6 = Line(StartPoint=point_crest_2, EndPoint=move_16.Geometry)
ln_7 = Line(StartPoint=move_14.Geometry, EndPoint=move_15.Geometry)
ln_8 = Line(StartPoint=eval_12.Point, EndPoint=move_17.Geometry)
len_7 = Length(Curve=ln_6)
len_8 = Length(Curve=ln_7)
len_9 = Length(Curve=ln_8)
roundd_5 = RoundToDecimalPlace(NumberX=len_7, DecimalPlace=Slider(1, range=0..1), RoundType=0)  # -> flatten(Rounded), Difference
# Technical Memorandum No. EM36-86-68110: 4.2 Determine an Appraisal Level Arch Dam Layout
# 
# 6 - Determine the shape of the crown cantilever. From the equations provided,
# compute TC, TB, T0.45H, USPC, USP0.45H, USPB, DSPC, DSP0.45H, and DSPB.
roundd_6 = RoundToDecimalPlace(NumberX=len_9, DecimalPlace=Slider(1, range=0..1), RoundType=0)  # -> flatten(Rounded), Difference
roundd_7 = RoundToDecimalPlace(NumberX=len_8, DecimalPlace=Slider(1, range=0..1), RoundType=0)  # -> flatten(Rounded), Difference
width_0_45 = RemoteSender(roundd_6.Rounded)
width_base = RemoteSender(roundd_7.Rounded)
width_crest_2 = RemoteSender(roundd_5.Rounded)
us_arc_2 = RemoteReceiver(us_arc)
ds_arc_3 = RemoteReceiver(ds_arc)
us_arc_3 = RemoteReceiver(us_arc)
ds_arc_4 = RemoteReceiver(ds_arc)
# building arches at each level
us_arc_4 = RemoteReceiver(us_arc)
ds_arc_5 = RemoteReceiver(ds_arc)
pcx = CurvePlane(DownstreamArc=ds_arc_5, Plane=plane_elevations_4)  # -> simplify(Points), ParamsC, ParamsP
# Technical Memorandum No. EM36-86-68110: 4.2 Determine an Appraisal Level Arch Dam Layout
# 
# 10. On the topography map, draw the upstream and downstream projections of the crown cantilever and downstream arc at the crest on the reference plane. Using the same radius center as the axis, draw the circular arc for the downstream side of the crest using the radius (Raxis – Tc). On the reference plane draw points at each arch elevation on the upstream and downstream faces.
pcx_2 = CurvePlane(UpstreamArc=us_arc_4, Plane=plane_elevations_4)  # -> simplify(Points), ParamsC, ParamsP
us_ds_slices_intersections = RemoteSender([pcx_2.Points, pcx.Points])
width_crest_3 = RemoteReceiver(width_crest_2)
width_base_2 = RemoteReceiver(width_base)
width_0_45_2 = RemoteReceiver(width_0_45)

gate_5 = StreamGate(Stream=geo_15, Gate=cut_water_body_in_levels_2)  # -> Target0, Target1; disabled
rest_of_mesh_non_cutted_2 = Mesh(flatten(gate_5.Target0))  # disabled
clsmsh_13 = CloseMesh(Mesh=rest_of_mesh_non_cutted_2, Quadrangulate=False)  # -> Closed, Amount, Openings, R; disabled
rebmsh_6 = RebuildMesh(
    Mesh=clsmsh_13.Closed,
    RebuildNormals=True,
    CullUnused=True,
    UnifyNormals=True,
    FlipNormals=True,
    IdenticalCombine=True,
    WeldVertices=1)  # disabled

# ---- group: Dividing the levels
bbox_4 = BoundingBox(Content=gate_5.Target1, Plane=PlaneXY(0, 0, 0), UnionBox=True)  # -> Box, Box_2; disabled
number_slider_32 = Slider(10, range=0..100)  # disabled
contour_2 = Contour(Shape=bbox_4.Box, Point=Point(0, 0, 0), Direction=Vector(0, 0, 1), Distance=number_slider_32)  # -> flatten(Contours); disabled
mesh_19 = Mesh(contour_2)  # disabled
msplit_12 = MeshSplit(Mesh=gate_5.Target1, Splitters=mesh_19)  # disabled

# ---- group: Sorting levels in the same branch
number_slider_33 = Slider(0.1, range=0..0.1)  # disabled
Z_17 = UnitZ(Factor=number_slider_33)  # disabled
move_18 = Move(Geometry=mesh_19, Motion=Z_17)  # -> Geometry, Transform; disabled
clean_10 = CleanTree(RemoveNulls=True, RemoveInvalid=True, RemoveEmpty=False, Tree=flatten(msplit_12))  # disabled
graft_2 = GraftTree(Tree=move_18.Geometry, IncludeEmptyLists=True, IncludeNullItems=True)  # disabled
clash_2 = Clash(FirstSet=clean_10, SecondSet=graft_2, Distance=0, L=100)  # -> ClashCount, ClashPoints, ClashRadii, FirstIndex, SecondIndex; disabled
item_41 = ListItem(List=clean_10, Index=clash_2.FirstIndex, Wrap=True)  # disabled
clean_11 = CleanTree(RemoveNulls=True, RemoveInvalid=True, RemoveEmpty=True, Tree=item_41)  # disabled
mjoin_6 = MeshJoin(Meshes=clean_11)  # disabled
disjoint_2 = DisjointMesh(Mesh=mjoin_6)  # disabled
clsmsh_14 = CloseMesh(Mesh=disjoint_2, Quadrangulate=True)  # -> Closed, Amount, Openings, R; disabled

# ---- group: Filtering too small meshes - assumption that the not so detailed mesh will produce some weird shapes
path_mapper_4 = PathMapper(clsmsh_14.Closed, source="{A;B;C;D}", target="{path_index}")  # disabled
number_slider_34 = Slider(100, range=0..150)  # disabled
volume_5 = MeshVolume(Mesh=path_mapper_4)  # -> Volume, Centroid; disabled
larger_4 = LargerThan(FirstNumber=volume_5.Volume, SecondNumber=number_slider_34)  # -> LargerThan, OrEqualTo; disabled
dispatch_8 = Dispatch(List=volume_5.Volume, DispatchPattern=larger_4.LargerThan)  # -> simplify(ListA), ListB; disabled
dispatch_9 = Dispatch(List=path_mapper_4, DispatchPattern=larger_4.LargerThan)  # -> ListA, ListB; disabled
mjoin_7 = MeshJoin(Meshes=dispatch_9.ListA)  # -> simplify(Mesh); disabled

# ----
item_42 = ListItem(List=flatten(clsmsh_14.Closed), Index=number_slider_31, Wrap=True)  # disabled
clean_12 = CleanTree(RemoveNulls=True, RemoveInvalid=True, RemoveEmpty=True, Tree=mjoin_7)  # disabled
filter_9 = StreamFilter(Gate=cut_water_body_in_levels_2, Stream0=rebmsh_6, Stream1=clean_12)  # disabled
merge_12 = Merge(Data1=flatten(filter_9), Data2=flatten(mesh_18))  # -> simplify(graft(Result)); disabled
dup_9 = DuplicateDataMatch(SourceDataTree=filter_9, SecondaryData1=bool_4)  # -> SourceData, SecondaryData1; disabled
merge_13 = Merge(Data1=flatten(dup_9.SecondaryData1), Data2=flatten(dup_8.SecondaryData1))  # -> simplify(graft(Result)); disabled
filter_10 = StreamFilter(Gate=split_dead_storage_2, Stream0=gate_4.Target0, Stream1=merge_12)  # disabled
dam_11 = DataDam(DataA=merge_13, BufferDelay=10000000, BufferMode=1)  # disabled

# ----
# x. Dam Footprint
# original projection to foundation
end_14 = EndPoints(Curve=ds_arc_3)  # -> Start, End
end_15 = EndPoints(Curve=us_arc_2)  # -> Start, End
dsp_point_bottom_foundation = Point(end_14.End)
usp_point_bottom_foundation = Point(end_15.End)
end_16 = EndPoints(Curve=usp_arch_crest_4)  # -> Start, End
end_17 = EndPoints(Curve=dsp_arch_crest_2)  # -> Start, End
project_13 = Project(Geometry=dsp_point_bottom_foundation, Plane=end_17.Start)  # -> Geometry, Transform
project_14 = Project(Geometry=usp_point_bottom_foundation, Plane=end_16.Start)  # -> Geometry, Transform
arc_3 = Arc3Pt(PointA=end_17.Start, PointB=project_13.Geometry, PointC=end_17.End)  # -> UpstreamArc, CenterP, RadiusM
arc_4 = Arc3Pt(PointA=end_16.Start, PointB=project_14.Geometry, PointC=end_16.End)  # -> UpstreamArc, CenterP, RadiusM
project_15 = Project(Curve=arc_3.UpstreamArc, Brep=arch_dam_base_foundation_terrain_6, Direction=Vector(0, 0, 1))
project_16 = Project(Curve=arc_4.UpstreamArc, Brep=arch_dam_base_foundation_terrain_6, Direction=Vector(0, 0, 1))

project_17 = Project(Curve=arc_4.UpstreamArc, Brep=flatten(terrain_plus_gravity_hybrid_2), Direction=Vector(0, 0, 1))  # -> flatten(Curve)
project_18 = Project(Curve=arc_3.UpstreamArc, Brep=flatten(terrain_plus_gravity_hybrid_3), Direction=Vector(0, 0, 1))  # -> flatten(Curve)
item_43 = ListItem(List=project_17, Index=0, Wrap=True)  # -> Item, Item1
item_44 = ListItem(List=project_18, Index=0, Wrap=True)  # -> Item, Item1
ccx_3 = CurveCurve(CurveA=item_43.Item, CurveB=item_43.Item1)  # -> Points, ParamsA, ParamsB
ccx_4 = CurveCurve(CurveA=item_44.Item, CurveB=item_44.Item1)  # -> Points, ParamsA, ParamsB
shatter_8 = Shatter(Curve=item_43.Item1, Parameters=ccx_3.ParamsB)
shatter_9 = Shatter(Curve=item_43.Item, Parameters=ccx_3.ParamsA)
shatter_10 = Shatter(Curve=item_44.Item, Parameters=ccx_4.ParamsA)  # -> flatten(Segments)
shatter_11 = Shatter(Curve=item_44.Item1, Parameters=ccx_4.ParamsB)
sort_13 = SortList(Keys=shatter_8, ValuesA=shatter_8)  # -> reverse(Keys), reverse(ValuesA)
item_45 = ListItem(List=shatter_9, Index=1, Wrap=True)
sort_14 = SortList(Keys=shatter_10, ValuesA=shatter_10)  # -> reverse(Keys), ValuesA
sort_15 = SortList(Keys=shatter_11, ValuesA=shatter_11)  # -> reverse(Keys), reverse(ValuesA)
item_46 = ListItem(List=sort_13.ValuesA, Index=0, Wrap=True)
join_12 = JoinCurves(Curves=flatten([item_45, item_46]), Preserve=False)
item_47 = ListItem(List=sort_14.ValuesA, Index=1, Wrap=True)  # -> Item, Item1, Item2
item_48 = ListItem(List=sort_15.ValuesA, Index=0, Wrap=True)
filter_11 = StreamFilter(Gate=hybrid_normal_6, Stream0=flatten(project_16), Stream1=flatten(join_12))
join_13 = JoinCurves(Curves=flatten([item_47.Item, item_48]), Preserve=False)
filter_12 = StreamFilter(Gate=hybrid_normal_7, Stream0=flatten(project_15), Stream1=flatten(join_13))
topoly_2 = CurveToPolyline(Curve=filter_11, ToleranceDistance=0, ToleranceAngle=Slider(0.1, range=0.1..20))  # -> Polyline, Segments
topoly_3 = CurveToPolyline(Curve=filter_12, ToleranceDistance=0, ToleranceAngle=Slider(0.1, range=0.1..20))  # -> Polyline, Segments

# ----
# Fields
# Values
# Fields
number_slider_35 = Slider(2, range=0..10)
dam_name_translation_6 = RemoteReceiver(dam_name_translation)
normal_water_level_9 = RemoteReceiver(normal_water_level)
dam_axis_name_7 = RemoteReceiver(dam_axis_name)
fields_water_3 = RemoteReceiver(fields_water)
panel_84 = Panel(fields_water_3)

dam_12 = DataDam(DataA=merge_10, BufferDelay=10000000, BufferMode=1)  # disabled

explode_5 = Explode(Curve=filter_11, Recursive=True)  # -> Segments, Vertices
explode_6 = Explode(Curve=filter_12, Recursive=True)  # -> Segments, Vertices
pline_10 = PolyLine(Vertices=explode_5.Vertices, Closed=False)
pline_11 = PolyLine(Vertices=explode_6.Vertices, Closed=False)
lng_6 = ListLength(List=explode_5.Vertices)
lng_7 = ListLength(List=explode_6.Vertices)
smoothpline_4 = SmoothPolyline(Polyline=pline_11, Strength=Slider(0.5, range=0..1), Times=lng_7)
smoothpline_5 = SmoothPolyline(Polyline=pline_10, Strength=Slider(0.5, range=0..1), Times=lng_6)

filter_13 = StreamFilter(Gate=hybrid_normal_8, Stream0=flatten(smoothpline_5), Stream1=flatten(topoly_2.Polyline))
filter_14 = StreamFilter(Gate=hybrid_normal_9, Stream0=flatten(smoothpline_4), Stream1=flatten(topoly_3.Polyline))

usp_footprint = Curve(filter_13)
dsp_footprint = Curve(filter_14)

usp_prefootprint = RemoteSender(usp_footprint)
dsp_prefootprint = RemoteSender(dsp_footprint)
usp_prefootprint_2 = RemoteReceiver(usp_prefootprint)
dsp_prefootprint_2 = RemoteReceiver(dsp_prefootprint)

# ----
# Technical Memorandum No. EM36-86-68110: 4.2 Determine an Appraisal Level Arch Dam Layout
# 
# 12.a. Draw the upstream face arch starting with the first arch below the crest. Use an initial guess for the line of centers as a 0.2:1 sloping line.
# x. Line of centers
flatten = FlattenTree(Tree=plane_elevations_2, Path="{0}")
flatten_2 = FlattenTree(Tree=plane_elevations_3, Path="{0}")
cull_i_12 = CullIndex(List=flatten, Indices=-1, Wrap=True)  # -> simplify(graft(List))
cull_i_13 = CullIndex(List=flatten_2, Indices=-1, Wrap=True)  # -> simplify(graft(List))
pcx_3 = CurvePlane(DownstreamArc=ds_arc_4, Plane=cull_i_13)  # -> simplify(Points), ParamsC, ParamsP
pcx_4 = CurvePlane(DSPFootprint=dsp_prefootprint_2, Plane=cull_i_13)  # -> simplify(Points), ParamsC, ParamsP
pcx_5 = CurvePlane(UpstreamArc=us_arc_3, Plane=cull_i_12)  # -> simplify(Points), ParamsC, ParamsP
pcx_6 = CurvePlane(USPFootprint=usp_prefootprint_2, Plane=cull_i_12)  # -> simplify(Points), ParamsC, ParamsP
item_49 = ListItem(List=pcx_4.Points, Index=0, Wrap=True)  # -> Item, Item1
arc_5 = Arc3Pt(PointA=item_49.Item, PointB=pcx_3.Points, PointC=item_49.Item1)  # -> Arc, Plane, Radius
darc_2 = DeconstructArc(Arc=arc_5.Arc)  # -> BasePlane, Radius, Angle
rev_3 = Reverse(Vector=refecenre_centers_vector_3)
project_19 = ProjectPoint(Point=darc_2.BasePlane, Direction=[refecenre_centers_vector_3, rev_3], Geometry=reference_centers_plane_3)  # -> Point, Index
rev_4 = Reverse(Vector=refecenre_centers_vector_2)
clean_13 = CleanTree(RemoveNulls=True, RemoveInvalid=True, RemoveEmpty=False, Tree=project_19.Point)  # -> flatten(Tree)
center_at_crest = Point(center_crest_2)
abiscissa_dam_axis_2 = RemoteReceiver(abiscissa_dam_axis)

item_50 = ListItem(List=pcx_6.Points, Index=0, Wrap=True)  # -> Item, Item1

arc_6 = Arc3Pt(PointA=item_50.Item, PointB=pcx_5.Points, PointC=item_50.Item1)  # -> Arc, Plane, Radius
darc_3 = DeconstructArc(Arc=arc_6.Arc)  # -> BasePlane, Radius, Angle
project_20 = ProjectPoint(Point=darc_3.BasePlane, Direction=[refecenre_centers_vector_2, rev_4], Geometry=reference_centers_plane_2)  # -> Point, Index
clean_14 = CleanTree(RemoveNulls=True, RemoveInvalid=True, RemoveEmpty=False, Tree=project_20.Point)  # -> flatten(Tree)

centers_extrados_not_normalized = Point([center_at_crest, clean_14])
pline_12 = PolyLine(Vertices=centers_extrados_not_normalized, Closed=False)
lng_8 = ListLength(List=centers_extrados_not_normalized)
smoothpline_6 = SmoothPolyline(Polyline=pline_12, Strength=1, Times=lng_8)
ext_2 = ExtendCurve(Curve=smoothpline_6, Type=2, Start=0, End=500)
ccx_5 = CurveCurve(CurveA=ext_2, CurveB=abiscissa_dam_axis_2)  # -> Points, ParamsA, ParamsB
shatter_12 = Shatter(Curve=ext_2, Parameters=flatten(ccx_5.ParamsA))
sort_16 = SortList(Keys=shatter_12, ValuesA=shatter_12)  # -> Keys, ValuesA
item_51 = ListItem(List=sort_16.ValuesA, Index=0, Wrap=True)
geo_16 = Geometry(item_51)

centers_extrados_not_normalized_2 = Point([center_at_crest, clean_13])
pline_13 = PolyLine(Vertices=centers_extrados_not_normalized_2, Closed=False)
lng_9 = ListLength(List=centers_extrados_not_normalized_2)
smoothpline_7 = SmoothPolyline(Polyline=pline_13, Strength=1, Times=lng_9)
ext_3 = ExtendCurve(Curve=smoothpline_7, Type=2, Start=0, End=500)
ccx_6 = CurveCurve(CurveA=ext_3, CurveB=abiscissa_dam_axis_2)  # -> Points, ParamsA, ParamsB
shatter_13 = Shatter(Curve=ext_3, Parameters=flatten(ccx_6.ParamsA))
sort_17 = SortList(Keys=shatter_13, ValuesA=shatter_13)  # -> Keys, ValuesA
item_52 = ListItem(List=sort_17.ValuesA, Index=0, Wrap=True)
geo_17 = Geometry(item_52)

line_of_centers_intrados = RemoteSender(geo_16)
line_of_centers_extrados = RemoteSender(geo_17)
line_of_centers_extrados_2 = RemoteReceiver(line_of_centers_extrados)
line_of_centers_intrados_2 = RemoteReceiver(line_of_centers_intrados)
pcx_7 = CurvePlane(LineOfCentersIntrados=line_of_centers_intrados_2, Plane=plane_elevations_4)  # -> simplify(CenterPoints), ParamsC, ParamsP
pcx_8 = CurvePlane(LineOfCentersExtrados=line_of_centers_extrados_2, Plane=plane_elevations_4)  # -> simplify(CenterPoints), ParamsC, ParamsP
ln_9 = Line(StartPoint=pcx.Points, EndPoint=pcx_7.CenterPoints)
ln_10 = Line(StartPoint=pcx_2.Points, EndPoint=pcx_8.CenterPoints)
len_10 = Length(Curve=ln_9)
len_11 = Length(Curve=ln_10)
cir_4 = Circle(DSCenters=pcx_7.CenterPoints, Radius=len_10)  # -> simplify(Circle)
cir_5 = Circle(USCenters=pcx_8.CenterPoints, Radius=len_11)
points_lineofcenters = RemoteSender([pcx_8.CenterPoints, pcx_7.CenterPoints])
path_mapper_5 = PathMapper(ln_10, source="{A}", target="{0;A}")
path_mapper_6 = PathMapper(cir_4, source="{A}", target="{1;A}")
path_mapper_7 = PathMapper(cir_5, source="{A}", target="{0;A}")
path_mapper_8 = PathMapper(ln_9, source="{A}", target="{1;A}")

# ----
# Line of centers
reference_centers_plane_4 = RemoteReceiver(reference_centers_plane)  # disabled
refecenre_centers_vector_4 = RemoteReceiver(refecenre_centers_vector)  # disabled
line_of_centers_intrados_3 = RemoteReceiver(line_of_centers_intrados)  # disabled
line_of_centers_extrados_3 = RemoteReceiver(line_of_centers_extrados)  # disabled
reference_centers_outline_2 = RemoteReceiver(reference_centers_outline)  # disabled
abiscissa_dam_axis_3 = RemoteReceiver(abiscissa_dam_axis)  # disabled
number_slider_36 = Slider(5, range=0..50)  # disabled
ds_arc_6 = RemoteReceiver(ds_arc)  # disabled
us_arc_5 = RemoteReceiver(us_arc)  # disabled
us_ds_slices_intersections_2 = RemoteReceiver(us_ds_slices_intersections)  # disabled
points_lineofcenters_2 = RemoteReceiver(points_lineofcenters)  # disabled
panel_85 = Panel("Continuous")  # disabled
swatch_8 = ColourSwatch(SwatchColor=RGB(164, 24, 219))  # disabled
number_slider_37 = Slider(50, range=0..100)  # disabled
linetypes_5 = QueryModelLinetypes(Name=panel_85, AutoUpdateState=True)  # disabled
swatch_9 = ColourSwatch(SwatchColor=RGB(69, 69, 69))  # disabled
objfromgroup_10 = GetObjectsInGroup()
symadv = SymbolAdvanced(Style=5, SizePrimary=number_slider_36, SizeSecondary=10, Rotation=0, Fill=swatch_8, Edge=swatch_8, Width=2, Adjust=True)  # disabled
amp_12 = Amplitude(Vector=refecenre_centers_vector_4, Amplitude=number_slider_37)  # disabled
vdisex_4 = VectorDisplayEx(Point=reference_centers_plane_4, Vector=amp_12, Colour=RGB(0, 0, 0), Width=2)  # disabled
curve_preview_4 = CustomCurvePreview(Curve=reference_centers_outline_2, Linetype=linetypes_5, Colour=swatch_9)  # disabled
symbol = SymbolDisplay(Location=[points_lineofcenters_2, us_ds_slices_intersections_2], Display=symadv)  # disabled
curve_preview_5 = CustomCurvePreview(Curve=[ds_arc_6, us_arc_5], Linetype=linetypes_5, Colour=swatch_9)  # disabled
curve_preview_6 = CustomCurvePreview(Curve=[line_of_centers_intrados_3, line_of_centers_extrados_3], Linetype=linetypes_5, Colour=swatch_9)  # disabled
flip_4 = FlipMatrix(Data=points_lineofcenters_2)  # disabled
panel_86 = Panel("{0}")  # disabled
reference_centers_plane_5 = RemoteReceiver(reference_centers_plane)  # disabled
center_crest_3 = RemoteReceiver(center_crest)  # disabled
split_10 = SplitTree(Data=flip_4, Masks=flatten(panel_86))  # -> Positive, Negative; disabled
pt_11 = Point([split_10.Positive, center_crest_3])  # disabled
number_slider_38 = Slider(86, range=0..100)  # disabled
deplane = DeconstructPlane(Plane=reference_centers_plane_5)  # -> Origin, XAxis, YAxis, ZAxis; disabled
pdecon_8 = Deconstruct(Point=pt_11)  # -> XComponent, YComponent, ZComponent; disabled
amp_13 = Amplitude(Vector=deplane.XAxis, Amplitude=number_slider_38)  # disabled
roundf = RoundToFactor(NumberX=pdecon_8.ZComponent, Factor=1, RoundType=0)  # -> Rounded, Difference, MultiplierR, MultiplierX; disabled
move_19 = Move(Geometry=pt_11, Motion=amp_13)  # -> Geometry, Transform; disabled
pln_7 = Plane(reference_centers_plane_5)  # disabled
ln_11 = Line(StartPoint=pt_11, EndPoint=move_19.Geometry)  # disabled
leader_text_settings_2 = RemoteReceiver(leader_text_settings)  # disabled
leader = Leader(Curve=ln_11, Text=roundf.Rounded, Plane=pln_7, TextSettings=leader_text_settings_2)  # -> Leader, Curve, Text, Plane, TextSettings, ArrowSettings, LeaderSettings; disabled

lng_10 = ListLength(List=objfromgroup_10)
dup_10 = DuplicateData(Data=show_line_of_centers, Number=lng_10, Order=True)
not = GateNot(A=dup_10)
onoff_5 = EnableDisableObject(
    Objects=objfromgroup_10,
    Enabled=dup_10,
    AllObjects_Object=[vdisex_4, amp_12, number_slider_37, line_of_centers_intrados_3, line_of_centers_extrados_3, curve_preview_6, us_arc_5, ds_arc_6, curve_preview_5, swatch_9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])

# ---- group: Rounding to 0.1
number_slider_39 = Slider(1, range=0..10)  # disabled

# ----
# Fields
# Values
# Fields
number_slider_40 = Slider(2, range=0..10)  # disabled
dam_name_translation_7 = RemoteReceiver(dam_name_translation)  # disabled
normal_water_level_10 = RemoteReceiver(normal_water_level)  # disabled
dam_axis_name_8 = RemoteReceiver(dam_axis_name)  # disabled
fields_water_4 = RemoteReceiver(fields_water)  # disabled
panel_87 = Panel(fields_water_4)  # disabled

# ---- group: Finding the intersection with sound rock
arch_dam_base_foundation_terrain_8 = RemoteReceiver(arch_dam_base_foundation_terrain)
relay_2 = Relay([path_mapper_7, path_mapper_6])
relay_3 = Relay([path_mapper_5, path_mapper_8])

# ----
gate_6 = StreamGate(Stream=relay_2, Gate=hybrid_normal_10)  # -> Target0, Target1

# ---- group: Filter away last circle - touching sound rock
geo_18 = Geometry(relay_2)
tstat_2 = TreeStatistics(Tree=geo_18)  # -> Paths, Length, Count
division_4 = Division(A=tstat_2.Count, B="2")
x_minus_one_2 = XMinusOne(NumberX=division_4)
item_53 = ListItem(List=tstat_2.Paths, Index=flatten(["-1", x_minus_one_2]), Wrap=True)
split_11 = SplitTree(Data=geo_18, Masks=flatten(item_53))  # -> Positive, Negative
geo_19 = Geometry(split_11.Positive)

# ---- group: Adjusting the bottom so there is something to connect with the bottom circle
number_slider_41 = Slider(1, range=0..10)
centrifugal_vector_3 = RemoteReceiver(centrifugal_vector)
neg_11 = Negative(Value=number_slider_41)
rev_5 = Reverse(Vector=centrifugal_vector_3)
rad_10 = Radians(Degrees=[number_slider_41, neg_11])
rotate_10 = Rotate(Geometry=rev_5, Angle=rad_10, Plane=PlaneXY(0, 0, 0))  # -> flatten(Geometry), Transform
center_10 = Center(Geometric=geo_19)  # -> Center, Dimension
darc_4 = DeconstructArc(Arc=geo_19)  # -> BasePlane, Radius, Angle
line_4 = LineSDL(Start=center_10.Center, Direction=rotate_10.Geometry, Length=darc_4.Radius)
ccx_7 = CurveCurve(CurveA=geo_19, CurveB=line_4)  # -> Points, ParamsA, ParamsB
pshift = ShiftPaths(Data=ccx_7.ParamsA, Offset="-1")
shatter_14 = Shatter(Curve=geo_19, Parameters=pshift)
pshift_2 = ShiftPaths(Data=shatter_14, Offset="-1")

# ----
scx_4 = SurfaceCurve(Surface=srf_5, Curve=gate_6.Target1)  # -> Curves, simplify(Points), UVPoints, Normals, Parameters, Tangents

# ---- group: Finding the intersection with sound rock (continued)
scx_5 = SurfaceCurve(Surface=arch_dam_base_foundation_terrain_8, Curve=gate_6.Target0)  # -> Curves, simplify(Points), UVPoints, Normals, Parameters, Tangents

# ----
path_mapper_9 = PathMapper(scx_4.Parameters, source="{A;B;C}", target="{A;B}")

# ---- group: Cutting and selecting curves for dam
shatter_15 = Shatter(Curve=gate_6.Target0, Parameters=scx_5.Parameters)  # -> simplify(Segments)
colom_4 = CollisionOneMany(Collider=shatter_15, Obstacles=relay_3)  # -> Collision, Index
dispatch_10 = Dispatch(List=shatter_15, DispatchPattern=colom_4.Collision)  # -> ListA, ListB

# ----
shatter_16 = Shatter(Curve=gate_6.Target1, Parameters=path_mapper_9)  # -> simplify(Segments)
colom_5 = CollisionOneMany(Collider=shatter_16, Obstacles=relay_3)  # -> Collision, Index
dispatch_11 = Dispatch(List=shatter_16, DispatchPattern=colom_5.Collision)  # -> ListA, ListB
filter_15 = StreamFilter(Gate=hybrid_normal_11, Stream0=dispatch_10.ListA, Stream1=dispatch_11.ListA)
split_12 = SplitTree(Data=filter_15, Masks=flatten(item_53))  # -> Positive, Negative

geo_20 = Geometry(split_12.Negative)
item_54 = ListItem(List=pshift_2, Index=0, Wrap=True)

path_mapper_10 = PathMapper(geo_20, source="{A;B}", target="{A;B+1}")
path_mapper_11 = PathMapper(item_54, source="{A;B}", target="{A;B+1}")

end_18 = EndPoints(Curve=path_mapper_11)  # -> Start, End; disabled
geo_21 = Geometry([path_mapper_2, path_mapper_3, path_mapper_10])  # disabled
# smoothing ends
end_19 = EndPoints(Curve=geo_21)  # -> Start, End; disabled
geo_22 = Geometry([end_18.Start, end_18.End])  # disabled
geo_23 = Geometry([end_19.Start, end_19.End])  # disabled
path_mapper_12 = PathMapper([geo_23, geo_22], source="{A;B}", target="{A}")  # disabled
item_55 = ListItem(List=path_mapper_12, Index=0, Wrap=True)  # disabled
geo_24 = Geometry(path_mapper_12)  # disabled
ptsortitems = PointSortItems(Start=item_55, Points=geo_24)  # -> SortedItems, SortedIndices, simplify(SortedPoints); disabled
intcrv = Interpolate(Vertices=ptsortitems.SortedPoints, Degree=3, Periodic=False, KnotStyle=1)  # -> Curve, Length, Domain; disabled
crest_plane_elevation_2 = RemoteReceiver(crest_plane_elevation)  # disabled
plane_elevations_5 = RemoteReceiver(plane_elevations)  # disabled
number_slider_42 = Slider(50, range=0..100)  # disabled
merge_14 = Merge(Data1=flatten(crest_plane_elevation_2), Data2=flatten(plane_elevations_5))  # disabled
ext_4 = ExtendCurve(Curve=geo_21, Type=1, Start=number_slider_42, End=number_slider_42)  # disabled
cull_i_14 = CullIndex(List=merge_14, Indices=-1, Wrap=True)  # disabled
geo_25 = Geometry(geo_22)  # disabled

topoly_4 = CurveToPolyline(Curve=intcrv.Curve, ToleranceDistance=0, ToleranceAngle=number_slider_13)  # -> Polyline, Segments; disabled

pcx_9 = CurvePlane(Curve=topoly_4.Polyline, Plane=cull_i_14)  # -> simplify(Points), ParamsC, ParamsP; disabled
crv_cp_3 = CurveClosestPoint(Point=pcx_9.Points, Curve=ext_4)  # -> Point, Parameter, Distance; disabled
dispatch_12 = Dispatch(List=crv_cp_3.Point, DispatchPattern=[True, False])  # -> ListA, ListB; disabled
item_56 = ListItem(List=dispatch_12.ListA, Index=0, Wrap=True)  # disabled
item_57 = ListItem(List=dispatch_12.ListB, Index=0, Wrap=True)  # disabled
geo_26 = Geometry([item_56, item_57, geo_25])  # disabled

pshift_3 = ShiftPaths(Data=geo_26, Offset=-1)  # disabled
item_58 = ListItem(List=pshift_3, Index=0, Wrap=True)  # disabled
ptsortitems_2 = PointSortItems(Start=item_58, Points=pshift_3)  # -> SortedItems, SortedIndices, SortedPoints; disabled
pline_14 = PolyLine(Vertices=ptsortitems_2.SortedPoints, Closed=False)  # disabled
intcrv_2 = Interpolate(Vertices=ptsortitems_2.SortedPoints, Degree=number_slider_14, Periodic=False, KnotStyle=1)  # -> simplify(Curve), Length, Domain; disabled
path_mapper_13 = PathMapper(ext_4, source="{A;B}", target="{A}")  # disabled
ccx_8 = CurveCurve(CurveA=path_mapper_13, CurveB=pline_14)  # -> Points, ParamsA, ParamsB; disabled
shatter_17 = Shatter(Curve=ext_4, Parameters=ccx_8.ParamsA)  # -> simplify(Segments); disabled
dispatch_13 = Dispatch(List=shatter_17, DispatchPattern=[True, False])  # -> ListA, ListB; disabled
geo_27 = Geometry(dispatch_13.ListB)  # disabled

end_20 = EndPoints(Curve=path_mapper_11)  # -> Start, End
geo_28 = Geometry([path_mapper_2, path_mapper_3, path_mapper_10])
# smoothing ends
# smoothing ends
end_21 = EndPoints(Curve=geo_28)  # -> Start, End
geo_29 = Geometry([end_20.Start, end_20.End])
geo_30 = Geometry([end_21.Start, end_21.End])
path_mapper_14 = PathMapper(geo_30, source="{A;B}", target="{A}")
item_59 = ListItem(List=path_mapper_14, Index=0, Wrap=True)
geo_31 = Geometry(path_mapper_14)
ptsortitems_3 = PointSortItems(Start=item_59, Points=geo_31)  # -> SortedItems, SortedIndices, simplify(SortedPoints)
intcrv_3 = Interpolate(Vertices=ptsortitems_3.SortedPoints, Degree=3, Periodic=False, KnotStyle=1)  # -> Curve, Length, Domain
lng_11 = ListLength(List=ptsortitems_3.SortedPoints)
crest_plane_elevation_3 = RemoteReceiver(crest_plane_elevation)
plane_elevations_6 = RemoteReceiver(plane_elevations)
number_slider_43 = Slider(50, range=0..100)
smocrv = SmoothCurve(
    Curve=intcrv_3.Curve,
    Steps=lng_11,
    StartType=0,
    EndType=0,
    DeviationTolerance=Slider(6, range=0..50),
    AngleTolerance=0.05)  # disabled
merge_15 = Merge(Data1=flatten(crest_plane_elevation_3), Data2=flatten(plane_elevations_6))
ext_5 = ExtendCurve(Curve=geo_28, Type=1, Start=number_slider_43, End=number_slider_43)
cull_i_15 = CullIndex(List=merge_15, Indices=-1, Wrap=True)
geo_32 = Geometry(geo_29)

# ----
# Deviation foundation here!
topoly_5 = CurveToPolyline(Curve=intcrv_3.Curve, ToleranceDistance=0, ToleranceAngle=Slider(0.42, range=0.1..1))  # -> Polyline, Segments
geo_33 = Geometry(ext_5)
midpt_4 = CurveMiddle(Curve=geo_33)
cir_6 = Circle(Plane=midpt_4, Radius=1)

pcx_10 = CurvePlane(Curve=topoly_5.Polyline, Plane=cull_i_15)  # -> simplify(Points), ParamsC, ParamsP

lng_12 = ListLength(List=pcx_10.Points)
larger_5 = LargerThan(FirstNumber=lng_12, SecondNumber=Slider(2, range=0..10))  # -> LargerThan, OrEqualTo
dispatch_14 = Dispatch(List=pcx_10.Points, DispatchPattern=larger_5.LargerThan)  # -> ListA, ListB
crossref = CrossReference(ListA=dispatch_14.ListA, ListB=dispatch_14.ListA, CrossMode=5)  # -> ListA, ListB
dist_5 = Distance(PointA=crossref.ListA, PointB=crossref.ListB)
sort_18 = SortList(Keys=dist_5, ValuesA=dispatch_14.ListA)  # -> Keys, ValuesA
cull_i_16 = CullIndex(List=sort_18.ValuesA, Indices="0", Wrap=True)  # -> simplify(List)
pt_12 = Point([cull_i_16, dispatch_14.ListB])

crv_cp_4 = CurveClosestPoint(Point=pt_12, Curve=ext_5)  # -> Point, Parameter, Distance
dispatch_15 = Dispatch(List=crv_cp_4.Point, DispatchPattern=[True, False])  # -> ListA, ListB
item_60 = ListItem(List=dispatch_15.ListA, Index=0, Wrap=True)
item_61 = ListItem(List=dispatch_15.ListB, Index=0, Wrap=True)
geo_34 = Geometry([item_60, item_61, geo_32])

pshift_4 = ShiftPaths(Data=geo_34, Offset=-1)
item_62 = ListItem(List=pshift_4, Index=0, Wrap=True)
ptsortitems_4 = PointSortItems(Start=item_62, Points=pshift_4)  # -> SortedItems, SortedIndices, SortedPoints
path_mapper_15 = PathMapper(ext_5, source="{A;B}", target="{A}")
intcrv_4 = Interpolate(Vertices=ptsortitems_4.SortedPoints, Degree=Slider(3, range=0..10), Periodic=False, KnotStyle=2)  # -> simplify(Curve), Length, Domain
ccx_9 = CurveCurve(CurveA=path_mapper_15, CurveB=intcrv_4.Curve)  # -> Points, ParamsA, ParamsB
shatter_18 = Shatter(Curve=ext_5, Parameters=ccx_9.ParamsA)  # -> simplify(Segments)

pline_15 = PolyLine(Vertices=ptsortitems_4.SortedPoints, Closed=False)  # disabled
intcrv_t = InterpolateT(Vertices=ptsortitems_4.SortedPoints, TangentStart=Vector(0, 0, 0), TangentEnd=Vector(0, 0, 0), KnotStyle=2)  # -> Curve, Length, Domain; disabled
kinkcrv = KinkyCurve(Vertices=ptsortitems_4.SortedPoints, Degree=3, Angle=0.1745329252)  # -> Curve, Length, Domain; disabled
intcrv_5 = Interpolate(Vertices=ptsortitems_4.SortedPoints, Degree=number_slider_15, Periodic=False, KnotStyle=2)  # -> simplify(Curve), Length, Domain; disabled
colom_6 = CollisionOneMany(Collider=shatter_18, Obstacles=cir_6)  # -> Collision, Index

dispatch_16 = Dispatch(List=shatter_18, DispatchPattern=colom_6.Collision)  # -> ListA, ListB
geo_35 = Geometry(dispatch_16.ListA)

geo_36 = Geometry(geo_35)
tstat_3 = TreeStatistics(Tree=geo_36)  # -> Paths, Length, Count
division_5 = Division(A=tstat_3.Count, B="2")
split_13 = SplitList(List=tstat_3.Paths, Index=division_5)  # -> ListA, ListB
item_63 = ListItem(List=split_13.ListA, Index=-1, Wrap=True)
item_64 = ListItem(List=split_13.ListB, Index=-1, Wrap=True)
cull_i_17 = CullIndex(List=split_13.ListA, Indices=-1, Wrap=True)  # -> flatten(List)
cull_i_18 = CullIndex(List=split_13.ListB, Indices=-1, Wrap=True)  # -> flatten(List)
path_5 = DataPath(flatten([cull_i_17, cull_i_18]))
split_14 = SplitTree(Data=geo_36, Masks=flatten(path_5))  # -> Positive, Negative
split_15 = SplitTree(Data=geo_36, Masks=flatten("{?;0}"))  # -> Positive, Negative
unflatten_2 = UnflattenTree(Tree=split_15.Negative, Guide=split_14.Positive)
unflatten_3 = UnflattenTree(Tree=intcrv_4.Curve, Guide=split_14.Negative)
geo_37 = Geometry([split_14.Positive, unflatten_2])
path_mapper_16 = PathMapper(unflatten_2, source="{A;B}", target="{A}")
lng_13 = ListLength(List=path_mapper_16)
repeat = RepeatData(Data=intcrv_4.Curve, Length=lng_13)
unflatten_4 = UnflattenTree(Tree=repeat, Guide=unflatten_2)
ccx_10 = CurveCurve(CurveA=unflatten_4, CurveB=geo_37)  # -> Points, simplify(ParamsA), ParamsB
pshift_5 = ShiftPaths(Data=ccx_10.ParamsA, Offset=-1)
shatter_19 = Shatter(Curve=unflatten_4, Parameters=pshift_5)  # -> simplify(Segments)
lng_14 = ListLength(List=shatter_19)
python_3 = GhPythonScript(x=lng_14, y=shatter_19)  # -> out, a, b
# ---------- python_3: Python ----------
__author__ = "Admin"
__version__ = "2023.08.14"

import rhinoscriptsyntax as rs

if x == 3:
    a = y
elif x == 5:
    b = y
# ---------- end python_3 ----------
clean_15 = CleanTree(RemoveNulls=True, RemoveInvalid=True, RemoveEmpty=False, Tree=python_3.b)
clean_16 = CleanTree(RemoveNulls=True, RemoveInvalid=True, RemoveEmpty=False, Tree=python_3.a)
geo_38 = Geometry(split_14.Negative)
geo_39 = Geometry(unflatten_3)

unflatten_5 = UnflattenTree(Tree=intcrv_4.Curve, Guide=split_15.Positive)
join_14 = JoinCurves(Curves=[unflatten_5, split_15.Positive], Preserve=False)  # -> flatten(Curves)
num_5 = Number(lng_14)
equals_6 = Equality(FirstNumber=lng_14, SecondNumber=panel_49)  # -> Equality, Inequality; disabled
dispatch_17 = Dispatch(List=shatter_19, DispatchPattern=equals_6.Equality)  # -> ListA, ListB; disabled
clean_17 = CleanTree(RemoveNulls=True, RemoveInvalid=True, RemoveEmpty=False, Tree=dispatch_17.ListA)  # disabled
clean_18 = CleanTree(RemoveNulls=True, RemoveInvalid=True, RemoveEmpty=False, Tree=dispatch_17.ListB)  # disabled

dispatch_18 = Dispatch(List=clean_18, DispatchPattern=[True, False])  # -> ListA, ListB; disabled
geo_40 = Geometry(clean_17)  # disabled
panel_88 = Panel("1")  # disabled
geo_41 = Geometry(dispatch_18.ListB)  # disabled
cull_i_19 = CullIndex(List=geo_40, Indices=panel_88, Wrap=True)  # -> simplify(List); disabled
geo_42 = Geometry([geo_37, geo_41, cull_i_19])  # disabled
item_65 = ListItem(List=geo_42, Index=0, Wrap=True)  # -> Item, Item1, Item2, Item3; disabled
netsurf = NetworkSurface(CurvesU=[item_65.Item, item_65.Item1], CurvesV=[item_65.Item2, item_65.Item3], Continuity=3)  # disabled

dispatch_19 = Dispatch(List=clean_15, DispatchPattern=[True, False])  # -> ListA, ListB
geo_43 = Geometry(clean_16)
cull_i_20 = CullIndex(List=geo_43, Indices="1", Wrap=True)  # -> simplify(List)
geo_44 = Geometry(dispatch_19.ListB)
geo_45 = Geometry([geo_37, geo_44, cull_i_20])
item_66 = ListItem(List=geo_45, Index=0, Wrap=True)  # -> Item, Item1, Item2, Item3
netsurf_2 = NetworkSurface(CurvesU=[item_66.Item, item_66.Item1], CurvesV=[item_66.Item2, item_66.Item3], Continuity=1)  # disabled

# ----
# Creating surfaces
ccx_11 = CurveCurve(CurveA=geo_39, CurveB=geo_38)  # -> Points, ParamsA, ParamsB
shatter_20 = Shatter(Curve=geo_39, Parameters=ccx_11.ParamsA)
pshift_6 = ShiftPaths(Data=shatter_20, Offset=-1)
item_67 = ListItem(List=pshift_6, Index="1", Wrap=True)

edgesrf = EdgeSurface(CurveA=item_67, CurveB=geo_38)
edgesrf_2 = EdgeSurface(CurveA=item_66.Item, CurveB=item_66.Item1, CurveC=item_66.Item2, CurveD=item_66.Item3)
tbi = TreeBranchIndex(DataTree=netsurf, BranchIndex=number_slider_17)  # disabled
x_tremez_5 = Extremes(Curve=flatten(item_67), Plane=PlaneXY(0, 0, 0))  # -> Highest, Lowest
dam_13 = DataDam(DataA=edgesrf, DataB=edgesrf_2, BufferDelay=10000000, BufferMode=1)  # -> DataA, DataB
pt_13 = Point(x_tremez_5.Lowest)
foundation_point_arch_dam = RemoteSender(pt_13)
loft_4 = Loft(Curves=join_14, Options={Adjust=False, Closed=False, LoftEnds=0, LoftSimp=0, LoftType=5, Rebuild=10, Refit=0.01})
path_mapper_17 = PathMapper([dam_13.DataA, dam_13.DataB], source="{A;B}", target="{A}")
join_15 = BrepJoin(Breps=flatten(path_mapper_17))  # -> Breps, Closed
item_68 = ListItem(List=join_15.Breps, Index=1, Wrap=True)  # -> Item, Item1
arch_us_face = RemoteSender(item_68.Item1)
arch_us_face_2 = RemoteReceiver(arch_us_face)
mesh_20 = Mesh(arch_us_face_2)
filter_16 = StreamFilter(Gate=dam_type_9, Stream0=null, Stream1=mesh_20, Stream2=null, Stream3=mesh_20)
arch_us_face_3 = RemoteReceiver(arch_us_face)  # disabled
mesh_21 = Mesh(arch_us_face_3)  # disabled
filter_17 = StreamFilter(Gate=dam_type_16, Stream0=null_2, Stream1=mesh_21, Stream2=null_2, Stream3=mesh_21)  # disabled
arch_ds_face = RemoteSender(item_68.Item)
join_16 = BrepJoin(Breps=flatten([join_15.Breps, loft_4]))  # -> Breps, Closed
wires = BrepWireframe(Brep=join_16.Breps, Density=-1)  # disabled
geo_brep_archdam = RemoteSender(join_16.Breps)
mesh_22 = MeshBrep(Brep=join_16.Breps, Settings=jagged_5)
x_tremez_6 = Extremes(Curve=wires, Plane=PlaneXY(0, 0, 0))  # -> Highest, Lowest; disabled
volume_6 = MeshVolume(Mesh=mesh_22)  # -> Volume, Centroid
pdecon_9 = Deconstruct(Point=x_tremez_6.Lowest)  # -> XComponent, YComponent, ZComponent; disabled
geo_archdam = RemoteSender(mesh_22)
geo_archdam_2 = RemoteReceiver(geo_archdam)
mshclsd = IsMeshClosed(Mesh=geo_archdam_2)
panel_89 = Panel(mshclsd)
geo_archdam_3 = RemoteReceiver(geo_archdam)
geo_archdam_4 = RemoteReceiver(geo_archdam)  # disabled
archdam_volume = RemoteSender(volume_6.Volume)
sort_19 = SortList(Keys=pdecon_9.ZComponent, ValuesA=x_tremez_6.Lowest)  # -> Keys, ValuesA; disabled
item_69 = ListItem(List=sort_19.Keys, Index=0, Wrap=True)  # disabled
item_70 = ListItem(List=sort_19.ValuesA, Index=0, Wrap=True)  # disabled
point_foot_arch_dam = RemoteSender(item_70)  # disabled
h_foot_archdam = RemoteSender(item_69)  # disabled
h_foot_archdam_2 = RemoteReceiver(h_foot_archdam)  # disabled
foundation_point_arch_dam_2 = RemoteReceiver(foundation_point_arch_dam)
arch_us_face_4 = RemoteReceiver(arch_us_face)
archdam_volume_2 = RemoteReceiver(archdam_volume)
m3_to_hm3 = Expression(x=archdam_volume_2, Expression="x/1000000")
area = Area(Geometry=arch_us_face_4)  # -> Area, Centroid
sort_20 = SortList(Keys=foundation_point_arch_dam_2, ValuesA=foundation_point_arch_dam_2)  # -> Keys, ValuesA
expression_18 = Expression(S=area.Area, H=arch_dam_height_3, V=archdam_volume_2, Expression="(s²)/(H*V)")
item_71 = ListItem(List=sort_20.ValuesA, Index=0, Wrap=True)
pdecon_10 = Deconstruct(Point=item_71)  # -> XComponent, YComponent, ZComponent
addition_4 = Addition(A=offset_foundation_3, B=pdecon_10.ZComponent)
roundd_8 = RoundToDecimalPlace(NumberX=m3_to_hm3, DecimalPlace=Slider(2, range=0..10), RoundType=0)  # -> flatten(Rounded), Difference
roundd_9 = RoundToDecimalPlace(NumberX=expression_18, DecimalPlace=number_slider_18, RoundType=0)  # -> flatten(Rounded), Difference
roundd_10 = RoundToDecimalPlace(NumberX=addition_4, DecimalPlace=number_slider_18, RoundType=0)  # -> flatten(Rounded), Difference
roundd_11 = RoundToDecimalPlace(NumberX=pdecon_10.ZComponent, DecimalPlace=number_slider_18, RoundType=0)  # -> flatten(Rounded), Difference
roundd_12 = RoundToDecimalPlace(NumberX=area.Area, DecimalPlace=number_slider_18, RoundType=0)  # -> flatten(Rounded), Difference
panel_90 = Panel(roundd_9.Rounded)
panel_91 = Panel(roundd_8.Rounded)
merge_16 = Merge(
    Data1=dam_axis_name_5,
    Data2=dam_name_translation_5,
    Data3=roundd_10.Rounded,
    Data4=roundd_11.Rounded,
    Data5=normal_water_level_8,
    Data6=dam_level_4,
    Data7=roundd_3.Rounded,
    Data8=width_base_2,
    Data9=width_crest_3,
    Data10=width_0_45_2,
    Data11=roundd.Rounded,
    Data12=roundd_2.Rounded,
    Data13=roundd_4.Rounded,
    Data14=roundd_12.Rounded,
    Data15=roundd_8.Rounded,
    Data16=roundd_9.Rounded)
geo_archdam_5 = RemoteReceiver(geo_archdam)
panel_92 = Panel(merge_16)

# ----
# Text  Arch Dam
# Text water volume
# Text axis
# Text water level
# Text dam level
levels_at_water_height_2 = RemoteReceiver(levels_at_water_height)
levels_dam_height_2 = RemoteReceiver(levels_dam_height)
dam_type_23 = RemoteReceiver(dam_type_2)
gravity_volume_2 = RemoteReceiver(gravity_volume)
archdam_volume_3 = RemoteReceiver(archdam_volume)
embankment_volume_2 = RemoteReceiver(embankment_volume)
chord_dam_14 = RemoteReceiver(chord_dam)
point_crest_3 = RemoteReceiver(point_crest)
dam_type_24 = RemoteReceiver(dam_type_2)
dam_axis_name_9 = RemoteReceiver(dam_axis_name)
chord_dam_15 = RemoteReceiver(chord_dam)
midpt_5 = CurveMiddle(Curve=chord_dam_14)
font_size_2 = RemoteReceiver(font_size)
number_slider_44 = Slider(0.889, range=0..1)
number_slider_45 = Slider(59, range=0..100)
number_slider_46 = Slider(0.89, range=0..1)
filter_18 = StreamFilter(Gate=dam_type_24, Stream0=midpt_5, Stream1=point_crest_3, Stream2=midpt_5, Stream3=point_crest_3)
number_slider_47 = Slider(0.2, range=0..1)
number_slider_48 = Slider(40, range=0..100)
number_slider_49 = Slider(89, range=0..100)
panel_93 = Panel("Volume: {0:0,0} m3")
panel_94 = Panel("""Total capacity: {0:0,0.0} hm3
Useful capacity: {1:0,0.0} hm3
Dead capacity: {2:,0.00} hm3""")
number_slider_50 = Slider(44, range=0..100)
Z_18 = UnitZ(Factor=number_slider_45)
Z_19 = UnitZ(Factor=number_slider_48)
eval_13 = EvaluateCurve(Curve=reparameterize(chord_dam_15), Parameter=number_slider_47)  # -> Point, Tangent, Angle
Z_20 = UnitZ(Factor=number_slider_49)
move_20 = Move(Geometry=eval_13.Point, Motion=Z_20)  # -> Geometry, Transform
Z_21 = UnitZ(Factor=number_slider_50)
move_21 = Move(Geometry=filter_18, Motion=Z_21)  # -> Geometry, Transform
ln_12 = Line(StartPoint=eval_13.Point, EndPoint=move_20.Geometry)
ln_13 = Line(StartPoint=filter_18, EndPoint=move_21.Geometry)
number_slider_51 = Slider(214, range=0..500)
number_slider_52 = Slider(154, range=0..500)
number_slider_53 = Slider(192, range=0..500)
font_size_3 = RemoteReceiver(font_size)
font_size_4 = RemoteReceiver(font_size)
panel_95 = Panel("Crest level: {0:0,0} m")
text_dot = TextDot(Location=move_20.Geometry, PrimaryText=dam_axis_name_9, TextHeight=font_size_2)
leader_2 = RemoteSender(ln_12)
leader_3 = RemoteSender(ln_13)
panel_96 = Panel("Water level: {0:0,0} m")
font_size_5 = RemoteReceiver(font_size)
objfromgroup_11 = GetObjectsInGroup()
Z_22 = UnitZ(Factor=number_slider_53)
Z_23 = UnitZ(Factor=number_slider_52)
Z_24 = UnitZ(Factor=number_slider_51)

item_72 = ListItem(List=levels_dam_height_2, Index=0, Wrap=True)
item_73 = ListItem(List=levels_at_water_height_2, Index=0, Wrap=True)
lng_15 = ListLength(List=objfromgroup_11)
dup_11 = DuplicateData(Data=show_text, Number=lng_15, Order=True)
onoff_6 = EnableDisableObject(
    Objects=objfromgroup_11,
    Enabled=dup_11,
    AllObjects_Object=[is_dead_3, water_total_volume_3, water_total_geo_3, dispatch_24, dispatch_23, not_3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])

eval_14 = EvaluateCurve(Curve=reparameterize(item_72), Parameter=number_slider_44)  # -> Point, Tangent, Angle
eval_15 = EvaluateCurve(Curve=reparameterize(item_73), Parameter=number_slider_46)  # -> Point, Tangent, Angle
move_22 = Move(Geometry=eval_14.Point, Motion=Z_18)  # -> Geometry, Transform
move_23 = Move(Geometry=eval_15.Point, Motion=Z_19)  # -> Geometry, Transform
ln_14 = Line(StartPoint=eval_14.Point, EndPoint=move_22.Geometry)
ln_15 = Line(StartPoint=eval_15.Point, EndPoint=move_23.Geometry)
pdecon_11 = Deconstruct(Point=eval_14.Point)  # -> XComponent, YComponent, ZComponent
pdecon_12 = Deconstruct(Point=eval_15.Point)  # -> XComponent, YComponent, ZComponent
leader_4 = RemoteSender(ln_14)
leader_5 = RemoteSender(ln_15)
format_5 = Format(Format=panel_95, Culture=2055, Data0=pdecon_11.ZComponent)
format_6 = Format(Format=panel_96, Culture=2055, Data0=pdecon_12.ZComponent)
text_dot_2 = TextDot(Location=move_23.Geometry, PrimaryText=format_6, TextHeight=font_size_4)
text_dot_3 = TextDot(Location=move_22.Geometry, PrimaryText=format_5, TextHeight=font_size_3)

# ---- group: Connection between gravity and Arch Dam
geo_brep_archdam_2 = RemoteReceiver(geo_brep_archdam)
hybrid_normal_13 = RemoteReceiver(hybrid_normal)
usp_arch_crest_8 = RemoteReceiver(usp_arch_crest)
gate_7 = StreamGate(Stream=geo_brep_archdam_2, Gate=hybrid_normal_13)  # -> Target0, Target1
pframe = PerpFrame(Curve=reparameterize(usp_arch_crest_8), Parameter=Slider(0.06, range=0..0.1))
chord_dam_16 = RemoteReceiver(chord_dam)
sec_3 = BrepPlane(Brep=gate_7.Target1, Plane=pframe)  # -> Curves, Points
pframe_2 = PerpFrame(Curve=reparameterize(chord_dam_16), Parameter=number_slider_3)
split_16 = SplitBrep(Brep=gate_7.Target1, Cutter=sec_3.Curves)
sec_4 = BrepPlane(Brep=item_38, Plane=pframe_2)  # -> Curves, Points
center_11 = Center(Geometric=split_16, referenceAll=2)  # -> Center, Dimension
split_17 = SplitBrep(Brep=item_38, Cutter=sec_4.Curves)
sort_21 = SortList(Keys=center_11.Dimension, ValuesA=split_16)  # -> Keys, reverse(ValuesA)
center_12 = Center(Geometric=split_17, referenceAll=2)  # -> Center, Dimension
item_74 = ListItem(List=sort_21.ValuesA, Index=0, Wrap=True)
sort_22 = SortList(Keys=center_12.Dimension, ValuesA=split_17)  # -> Keys, reverse(ValuesA)
edges = BrepEdges(Brep=item_74)  # -> Naked, Interior, NonManifold
edges_2 = BrepEdges(Brep=item_38)  # -> Naked, Interior, NonManifold
item_75 = ListItem(List=sort_22.ValuesA, Index=0, Wrap=True)
edges_3 = BrepEdges(Brep=item_75)  # -> Naked, Interior, NonManifold
join_17 = JoinCurves(Curves=edges.Naked, Preserve=False)
join_18 = JoinCurves(Curves=edges_2.Naked, Preserve=False)
cap = CapHoles(Brep=item_74)
join_19 = JoinCurves(Curves=edges_3.Naked, Preserve=False)
flip_5 = FlipCurve(Curve=join_17, Guide=join_18)  # -> Curve, Flag
flip_6 = FlipCurve(Curve=join_19, Guide=join_18)  # -> Curve, Flag
explode_7 = Explode(Curve=flip_5.Curve, Recursive=True)  # -> Segments, Vertices
explode_8 = Explode(Curve=join_18, Recursive=True)  # -> Segments, Vertices
explode_9 = Explode(Curve=flip_6.Curve, Recursive=True)  # -> Segments, Vertices
cullpt = CullDuplicates(Points=reverse(explode_7.Vertices), Tolerance=0, CullMode=3)  # -> reverse(Points), Indices, Valence
cullpt_2 = CullDuplicates(Points=reverse(explode_8.Vertices), Tolerance=0, CullMode=3)  # -> reverse(Points), Indices, Valence
cullpt_3 = CullDuplicates(Points=reverse(explode_9.Vertices), Tolerance=0, CullMode=3)  # -> reverse(Points), Indices, Valence
shift = ShiftList(List=cullpt.Points, Shift=1, Wrap=True)
shift_2 = ShiftList(List=cullpt_2.Points, Shift=1, Wrap=True)
vec2pt_5 = Vector2Pt(PointA=cullpt.Points, PointB=shift, Unitize=False)  # -> Vector, Length
vec2pt_6 = Vector2Pt(PointA=cullpt_2.Points, PointB=shift_2, Unitize=False)  # -> Vector, Length
shift_3 = ShiftList(List=cullpt_3.Points, Shift=1, Wrap=True)
shift_4 = ShiftList(List=vec2pt_5.Vector, Shift=1, Wrap=True)
shift_5 = ShiftList(List=vec2pt_6.Vector, Shift=1, Wrap=True)
vec2pt_7 = Vector2Pt(PointA=cullpt_3.Points, PointB=shift_3, Unitize=False)  # -> Vector, Length
graft_3 = GraftTree(Tree=shift_4, IncludeEmptyLists=True, IncludeNullItems=True)
graft_4 = GraftTree(Tree=vec2pt_5.Vector, IncludeEmptyLists=True, IncludeNullItems=True)
graft_5 = GraftTree(Tree=shift_5, IncludeEmptyLists=True, IncludeNullItems=True)
graft_6 = GraftTree(Tree=vec2pt_6.Vector, IncludeEmptyLists=True, IncludeNullItems=True)
shift_6 = ShiftList(List=vec2pt_7.Vector, Shift=1, Wrap=True)
angle = Angle(VectorA=graft_4, VectorB=graft_3)  # -> simplify(flatten(Angle)), Reflex
angle_2 = Angle(VectorA=graft_6, VectorB=graft_5)  # -> simplify(flatten(Angle)), Reflex
graft_7 = GraftTree(Tree=shift_6, IncludeEmptyLists=True, IncludeNullItems=True)
graft_8 = GraftTree(Tree=vec2pt_7.Vector, IncludeEmptyLists=True, IncludeNullItems=True)
angle_3 = Angle(VectorA=graft_8, VectorB=graft_7)  # -> simplify(flatten(Angle)), Reflex
deg = Degrees(Radians=angle.Angle)
deg_2 = Degrees(Radians=angle_2.Angle)
deg_3 = Degrees(Radians=angle_3.Angle)
larger_6 = LargerThan(FirstNumber=deg, SecondNumber=Slider(50, range=0..100))  # -> LargerThan, OrEqualTo
larger_7 = LargerThan(FirstNumber=deg_2, SecondNumber=Slider(50, range=0..100))  # -> LargerThan, OrEqualTo
bool_6 = Boolean("True")
bool_7 = Boolean("True")
larger_8 = LargerThan(FirstNumber=deg_3, SecondNumber=Slider(50, range=0..100))  # -> LargerThan, OrEqualTo
mindex_4 = MemberIndex(Set=larger_6.LargerThan, Member=bool_6)  # -> Index, Count
mindex_5 = MemberIndex(Set=larger_7.LargerThan, Member=bool_7)  # -> Index, Count
bool_8 = Boolean("True")
mindex_6 = MemberIndex(Set=larger_8.LargerThan, Member=bool_8)  # -> Index, Count
item_76 = ListItem(List=mindex_4.Index, Index=0, Wrap=True)  # -> Item, Item1, Item2, Item3
item_77 = ListItem(List=mindex_5.Index, Index=0, Wrap=True)  # -> Item, Item1, Item2, Item3
expression_19 = Expression(x=item_76.Item, Expression="x+1")
expression_20 = Expression(x=item_76.Item1, Expression="x+1")
expression_21 = Expression(x=item_76.Item2, Expression="x+1")
expression_22 = Expression(x=item_77.Item, Expression="x+1")
expression_23 = Expression(x=item_77.Item1, Expression="x+1")
expression_24 = Expression(x=item_77.Item2, Expression="x+1")
item_78 = ListItem(List=mindex_6.Index, Index=0, Wrap=True)  # -> Item, Item1, Item2, Item3
dom_4 = ConstructDomain(DomainStart="0", DomainEnd=item_76.Item)
dom_5 = ConstructDomain(DomainStart=expression_19, DomainEnd=item_76.Item1)
dom_6 = ConstructDomain(DomainStart=expression_20, DomainEnd=item_76.Item2)
dom_7 = ConstructDomain(DomainStart=expression_21, DomainEnd=item_76.Item3)
dom_8 = ConstructDomain(DomainStart="0", DomainEnd=item_77.Item)
dom_9 = ConstructDomain(DomainStart=expression_22, DomainEnd=item_77.Item1)
dom_10 = ConstructDomain(DomainStart=expression_23, DomainEnd=item_77.Item2)
dom_11 = ConstructDomain(DomainStart=expression_24, DomainEnd=item_77.Item3)
expression_25 = Expression(x=item_78.Item, Expression="x+1")
expression_26 = Expression(x=item_78.Item1, Expression="x+1")
expression_27 = Expression(x=item_78.Item2, Expression="x+1")
subset = SubList(List=explode_7.Segments, Domain=dom_4, Wrap=True)  # -> List, Index
subset_2 = SubList(List=explode_7.Segments, Domain=dom_5, Wrap=True)  # -> List, Index
subset_3 = SubList(List=explode_7.Segments, Domain=dom_6, Wrap=True)  # -> List, Index
subset_4 = SubList(List=explode_7.Segments, Domain=dom_7, Wrap=True)  # -> List, Index
subset_5 = SubList(List=explode_8.Segments, Domain=dom_8, Wrap=True)  # -> List, Index
subset_6 = SubList(List=explode_8.Segments, Domain=dom_9, Wrap=True)  # -> List, Index
subset_7 = SubList(List=explode_8.Segments, Domain=dom_10, Wrap=True)  # -> List, Index
subset_8 = SubList(List=explode_8.Segments, Domain=dom_11, Wrap=True)  # -> List, Index
dom_12 = ConstructDomain(DomainStart="0", DomainEnd=item_78.Item)
dom_13 = ConstructDomain(DomainStart=expression_25, DomainEnd=item_78.Item1)
dom_14 = ConstructDomain(DomainStart=expression_26, DomainEnd=item_78.Item2)
dom_15 = ConstructDomain(DomainStart=expression_27, DomainEnd=item_78.Item3)
join_20 = JoinCurves(Curves=subset.List, Preserve=False)
join_21 = JoinCurves(Curves=subset_2.List, Preserve=False)
join_22 = JoinCurves(Curves=subset_3.List, Preserve=False)
join_23 = JoinCurves(Curves=subset_4.List, Preserve=False)
join_24 = JoinCurves(Curves=subset_8.List, Preserve=False)
join_25 = JoinCurves(Curves=subset_5.List, Preserve=False)
join_26 = JoinCurves(Curves=subset_7.List, Preserve=False)
join_27 = JoinCurves(Curves=subset_6.List, Preserve=False)
subset_9 = SubList(List=explode_9.Segments, Domain=dom_12, Wrap=True)  # -> List, Index; disabled
subset_10 = SubList(List=explode_9.Segments, Domain=dom_13, Wrap=True)  # -> List, Index; disabled
subset_11 = SubList(List=explode_9.Segments, Domain=dom_14, Wrap=True)  # -> List, Index
subset_12 = SubList(List=explode_9.Segments, Domain=dom_15, Wrap=True)  # -> List, Index; disabled
join_28 = JoinCurves(Curves=subset_9.List, Preserve=False)  # disabled
join_29 = JoinCurves(Curves=subset_10.List, Preserve=False)  # disabled
join_30 = JoinCurves(Curves=subset_11.List, Preserve=False)
join_31 = JoinCurves(Curves=subset_12.List, Preserve=False)  # disabled
loft_5 = Loft(Curves=flatten([join_20, join_25]), Options=loft_opt)
loft_6 = Loft(Curves=flatten([join_21, join_27]), Options=loft_opt)
loft_7 = Loft(Curves=flatten([join_22, join_26]), Options=loft_opt)
loft_8 = Loft(Curves=flatten([join_23, join_24]), Options=loft_opt)
loft_9 = Loft(Curves=flatten([join_21, join_30]), Options=loft_opt)
loft_10 = Loft(Curves=flatten([join_27, join_30]), Options=loft_opt)
join_32 = BrepJoin(Breps=flatten([loft_5, loft_6, loft_7, loft_8]))  # -> Breps, Closed
join_33 = BrepJoin(Breps=flatten([loft_6, loft_10, loft_9]))  # -> Breps, Closed
cap_2 = CapHoles(Brep=join_32.Breps)
cap_3 = CapHoles(Brep=join_33.Breps)
sunion_6 = SolidUnion(Breps=flatten([cap_2, cap_3]))
sunion_7 = SolidUnion(Breps=flatten([cap, sunion_6]))
sunion_8 = SolidUnion(Breps=flatten([sunion_7, capex_4.Brep]))  # disabled
mesh_23 = MeshBrep(
    Brep=sunion_8,
    Settings={GridMaxCount=0, GridMinCount=16, JaggedSeams=False, MaxEdgeLength=0, MinEdgeLength=0.0001, MinTolerance=0, Refine=True, RefineAngle=0, RelativeTolerance=0.65, SimplePlanes=True, Tolerance=0})  # disabled
mesh_terrain_7 = RemoteReceiver(mesh_terrain)
mjoin_8 = MeshJoin(Meshes=flatten(mesh_23))  # disabled
volume_7 = MeshVolume(Mesh=mesh_23)  # -> Volume, Centroid; disabled
geo_hybrid = RemoteSender(mjoin_8)  # disabled
volume_hybrid = RemoteSender(volume_7.Volume)  # disabled

# ----
geo_46 = Geometry(cap)
geo_47 = Geometry(sunion_6)
psrfclsd_2 = IsPolysurfaceClosed(Polysurface=geo_46)
psrfclsd_3 = IsPolysurfaceClosed(Polysurface=geo_47)
mesh_24 = MeshBrep(
    Brep=geo_47,
    Settings={GridMaxCount=0, GridMinCount=16, JaggedSeams=False, MaxEdgeLength=0, MinEdgeLength=0.0001, MinTolerance=0, Refine=True, RefineAngle=0, RelativeTolerance=0.65, SimplePlanes=True, Tolerance=0})
mesh_25 = MeshBrep(
    Brep=geo_46,
    Settings={GridMaxCount=0, GridMinCount=16, JaggedSeams=False, MaxEdgeLength=0, MinEdgeLength=0.0001, MinTolerance=0, Refine=True, RefineAngle=0, RelativeTolerance=0.65, SimplePlanes=True, Tolerance=0})
sunion_9 = SolidUnion(Breps=flatten([sunion_7, capex_4.Brep]))
sunion_10 = SolidUnion(Breps=flatten([sunion_7, geo_14]))  # disabled
bvol_2 = BoundaryVolume(Boundaries=sunion_7)  # disabled
wrap = ShrinkWrap(Geometry=flatten([mesh_25, mesh_24, mesh_17]), Offset=0, Smoothing=0, Optimization=10, FillHoles=True)
munion = MeshUnion(Meshes=flatten([mesh_25, mesh_24, mesh_17]))

# ---- group: Connection between gravity and Arch Dam (continued)
mesh_26 = MeshBrep(
    Brep=sunion_9,
    Settings={GridMaxCount=0, GridMinCount=16, JaggedSeams=False, MaxEdgeLength=0, MinEdgeLength=0.0001, MinTolerance=0, Refine=True, RefineAngle=0, RelativeTolerance=0.65, SimplePlanes=True, Tolerance=0})
mmx_4 = MeshMesh(MeshA=mesh_26, MeshB=mesh_terrain_7)

# ----
crv_5 = Curve(mmx_4)
curve_preview_7 = CustomCurvePreview(Curve=crv_5, Linetype=linetypes_3, Colour=swatch_7)  # disabled
sunion_11 = SolidUnion(Breps=flatten([bvol_2, bvol]))  # disabled
join_34 = BrepJoin(Breps=flatten([geo_46, geo_47, geo_13]))  # -> Breps, Closed
sunion_12 = SolidUnion(Breps=flatten([geo_47, geo_13]))
bvol_3 = BoundaryVolume(Boundaries=flatten([geo_47, geo_13]))
mshclsd_2 = IsMeshClosed(Mesh=munion)
volume_8 = MeshVolume(Mesh=mesh_26)  # -> Volume, Centroid
geo_hybrid_2 = RemoteSender(mesh_26)
geo_hybrid_3 = RemoteReceiver([geo_hybrid, geo_hybrid_2])
filter_19 = StreamFilter(Gate=dam_type_10, Stream0=geo_concretedam_2, Stream1=geo_archdam_3, Stream2=geo_embankmentdam_2, Stream3=geo_hybrid_3)
dam_14 = DataDam(
    DataWaterSectionMeshes=rebmsh_2,
    DataDamGeometry=filter_19,
    DataDamCollision=filter_16,
    BufferDelay=10000000,
    BufferMode=1)  # -> DataWaterSectionMeshes, DataDamGeometry, DataDamCollision
gate_8 = StreamGate(Stream=dam_14.DataWaterSectionMeshes, Gate=dam_type_11)  # -> Target0, Target1, Target2, Target3
gate_9 = StreamGate(Stream=dam_14.DataDamGeometry, Gate=dam_type_13)  # -> Target0, Target1, Target2, Target3
cullvertices = MeshCullUnusedVertices(Mesh=gate_9.Target1)
filter_20 = StreamFilter(Gate=dam_type_12, Stream1=gate_8.Target1, Stream2=gate_8.Target2, Stream3=gate_8.Target3)
filter_21 = StreamFilter(Gate=dam_type_12, Stream0=gate_9.Target0, Stream1=cullvertices, Stream2=gate_9.Target2, Stream3=gate_9.Target3)
mdif = MeshDifference(MeshesA=filter_20, MeshesB=filter_21)
disjoint_3 = DisjointMesh(Mesh=mdif)  # -> simplify(Meshes)
colom_7 = CollisionOneMany(Collider=disjoint_3, Obstacles=dam_14.DataDamCollision)  # -> Collision, Index
dispatch_20 = Dispatch(List=disjoint_3, DispatchPattern=colom_7.Collision)  # -> ListA, ListB
geo_48 = Geometry(dispatch_20.ListA)
rebmsh_7 = RebuildMesh(
    Mesh=geo_48,
    RebuildNormals=True,
    CullUnused=True,
    UnifyNormals=True,
    FlipNormals=True,
    IdenticalCombine=False,
    WeldVertices=0.1)
mshstats = MeshStatistics(Mesh=rebmsh_7)  # -> VertexCount, FaceCount, QuadFaceCount, TriangleFaceCount, ColorCount, PieceCount
clsmsh_15 = CloseMesh(Mesh=rebmsh_7, Quadrangulate=True)  # -> Closed, Amount, Openings, R
mshdisjn = IsMeshDisjoint(Mesh=rebmsh_7)  # -> Disjoint, Amount
volume_9 = Volume(Geometry=clsmsh_15.Closed)  # -> Volume, Centroid
mshclsd_3 = IsMeshClosed(Mesh=clsmsh_15.Closed)
gate_10 = StreamGate(Stream=clsmsh_15.Closed, Gate=dam_type_14)  # -> Target0, Target1, Target2, Target3
geo_49 = Geometry(simplify(gate_8.Target0))
panel_97 = Panel(volume_9.Volume)
panel_98 = Panel(mshclsd_3)
panel_99 = Panel(mshdisjn.Disjoint)
filter_22 = StreamFilter(Gate=dam_type_15, Stream0=geo_49, Stream1=gate_10.Target1, Stream2=gate_10.Target2, Stream3=gate_10.Target3)
flatten_3 = FlattenTree(Tree=filter_22, Path="{0}")

geo_50 = Geometry(simplify(graft(flatten_3)))
volume_10 = Volume(Geometry=geo_50)  # -> Volume, Centroid
m3_to_hm3_2 = Expression(x=volume_10.Volume, Expression="x/1000000")
roundd_13 = RoundToDecimalPlace(NumberX=m3_to_hm3_2, DecimalPlace=number_slider_35, RoundType=0)  # -> Rounded, Difference
dup_12 = DuplicateDataMatch(SourceDataTree=roundd_13.Rounded, SecondaryData1=dam_axis_name_7)  # -> SourceData, SecondaryData1
dup_13 = DuplicateDataMatch(SourceDataTree=roundd_13.Rounded, SecondaryData1=dam_name_translation_6)  # -> SourceData, SecondaryData1
dup_14 = DuplicateDataMatch(SourceDataTree=roundd_13.Rounded, SecondaryData1=normal_water_level_9)  # -> SourceData, SecondaryData1
merge_17 = Merge(Data1=dup_12.SecondaryData1, Data2=dup_13.SecondaryData1, Data3=dup_14.SecondaryData1, Data4=roundd_13.Rounded)
panel_100 = Panel(merge_17)

water_total_geo = RemoteSender(geo_50)
geo_hybrid_4 = RemoteReceiver([geo_hybrid, geo_hybrid_2])  # disabled
filter_23 = StreamFilter(Gate=dam_type_17, Stream0=geo_concretedam_3, Stream1=geo_archdam_4, Stream2=geo_embankmentdam_3, Stream3=geo_hybrid_4)  # disabled
water_total_volume = RemoteSender(roundd_13.Rounded)

dam_15 = DataDam(
    DataWaterSectionMeshes=filter_6,
    DataDamGeometry=filter_23,
    DataDamCollision=filter_17,
    BufferDelay=10000000,
    BufferMode=1)  # -> DataWaterSectionMeshes, DataDamGeometry, DataDamCollision; disabled

gate_11 = StreamGate(Stream=dam_15.DataWaterSectionMeshes, Gate=dam_type_18)  # -> Target0, Target1, Target2, Target3; disabled
gate_12 = StreamGate(Stream=dam_15.DataDamGeometry, Gate=dam_type_20)  # -> Target0, Target1, Target2, Target3; disabled
cullvertices_2 = MeshCullUnusedVertices(Mesh=gate_12.Target1)  # disabled
filter_24 = StreamFilter(Gate=dam_type_19, Stream1=gate_11.Target1, Stream2=gate_11.Target2, Stream3=gate_11.Target3)  # disabled
filter_25 = StreamFilter(Gate=dam_type_19, Stream0=gate_12.Target0, Stream1=cullvertices_2, Stream2=gate_12.Target2, Stream3=gate_12.Target3)  # disabled
mdif_2 = MeshDifference(MeshesA=filter_24, MeshesB=filter_25)  # disabled
disjoint_4 = DisjointMesh(Mesh=mdif_2)  # -> simplify(Meshes); disabled
colom_8 = CollisionOneMany(Collider=disjoint_4, Obstacles=dam_15.DataDamCollision)  # -> Collision, Index; disabled
dispatch_21 = Dispatch(List=disjoint_4, DispatchPattern=colom_8.Collision)  # -> ListA, ListB; disabled
values_water = RemoteSender(merge_17)
volume_11 = Volume(Geometry=disjoint_4)  # -> Volume, Centroid; disabled
panel_101 = Panel(disjoint_4)  # disabled
geo_51 = Geometry(dispatch_21.ListA)  # disabled
ma_2 = MassAddition(Input=flatten(volume_11.Volume))  # -> Result, PartialResults; disabled
subtraction_6 = Subtraction(A=ma.Result, B=ma_2.Result)  # disabled
rebmsh_8 = RebuildMesh(
    Mesh=geo_51,
    RebuildNormals=True,
    CullUnused=True,
    UnifyNormals=False,
    FlipNormals=False,
    IdenticalCombine=False,
    WeldVertices=1)  # disabled
rebmsh_9 = RebuildMesh(
    Mesh=geo_51,
    RebuildNormals=False,
    CullUnused=True,
    UnifyNormals=False,
    FlipNormals=False,
    IdenticalCombine=False,
    WeldVertices=0)  # disabled
clsmsh_16 = CloseMesh(Mesh=rebmsh_9, Quadrangulate=True)  # -> Closed, Amount, Openings, R; disabled
clsmsh_17 = CloseMesh(Mesh=rebmsh_8, Quadrangulate=True)  # -> Closed, Amount, Openings, R; disabled
geo_52 = Geometry(simplify(gate_11.Target0))  # disabled
panel_102 = Panel(dispatch_21.ListA)  # disabled
gate_13 = StreamGate(Stream=clsmsh_17.Closed, Gate=dam_type_21)  # -> Target0, Target1, Target2, Target3; disabled
volume_12 = Volume(Geometry=rebmsh_8)  # -> Volume, Centroid; disabled
panel_103 = Panel(volume_12.Volume)  # disabled
filter_26 = StreamFilter(Gate=dam_type_22, Stream0=geo_52, Stream1=gate_13.Target1, Stream2=gate_13.Target2, Stream3=gate_13.Target3)  # disabled
flatten_4 = FlattenTree(Tree=filter_26, Path="{0}")  # disabled
geo_hybrid_5 = RemoteReceiver([geo_hybrid, geo_hybrid_2])
filter_27 = StreamFilter(Gate=hybrid_normal_12, Stream0=geo_archdam_5, Stream1=geo_hybrid_5)
transform_3 = Transform(Geometry=filter_27, Transform=transform_origin_4)
geo_hybrid_6 = RemoteReceiver([geo_hybrid, geo_hybrid_2])

# ----
# Dam
dam_type_25 = RemoteReceiver(dam_type_2)
geo_archdam_6 = RemoteReceiver(geo_archdam)
geo_concretedam_4 = RemoteReceiver(geo_concretedam)
geo_embankmentdam_4 = RemoteReceiver(geo_embankmentdam)
filter_28 = StreamFilter(
    Gate=dam_type_25,
    Stream0=geo_concretedam_4,
    Stream1=flatten(geo_archdam_6),
    Stream2=geo_embankmentdam_4,
    Stream3=geo_hybrid_6)
swatch_10 = ColourSwatch(SwatchColor=RGB(207, 151, 68))
chord_dam_17 = RemoteReceiver(chord_dam)
curve_preview_8 = CustomCurvePreview(Curve=chord_dam_17, Linetype=<geometry referenced from the Rhino model>, Colour=swatch_10)  # disabled
preview_9 = CustomPreview(Geometry=filter_28, Material=swatch_10)
preview_10 = CustomPreview(Geometry=filter_28, Material=swatch_10)
preview_11 = CustomPreview(Geometry=filter_28, Material=swatch_10)
preview_12 = CustomPreview(Geometry=filter_28, Material=swatch_10)

# ----
# Levels
levels_at_water_height_3 = RemoteReceiver(levels_at_water_height)
levels_dam_height_3 = RemoteReceiver(levels_dam_height)
linetypes_6 = QueryModelLinetypes(Name="Section", AutoUpdateState=True)
curve_preview_9 = CustomCurvePreview(Curve=levels_dam_height_3, Linetype=linetypes_6, Colour=swatch_10)
curve_preview_10 = CustomCurvePreview(Curve=levels_at_water_height_3, Linetype=linetypes_6, Colour=ColourSwatch(SwatchColor=RGB(2, 102, 189)))

end_22 = EndPoints(Curve=levels_at_water_height_3)  # -> Start, End; disabled
end_23 = EndPoints(Curve=levels_dam_height_3)  # -> Start, End; disabled
linear_dimension = LinearDimension(PointA=end_22.Start, PointB=end_23.Start)  # -> LinearDimension, BaseLine, PointA, PointB; disabled
aligned_dimension = AlignedDimension(PointA=end_22.Start, PointB=end_23.Start)  # -> AlignedDimension, PointA, PointB, Offset, Plane; disabled
preview_13 = CustomPreview(Geometry=filter_28, Material=swatch_10)
preview_14 = CustomPreview(Geometry=filter_28, Material=swatch_10)
preview_15 = CustomPreview(Geometry=filter_28, Material=material_6)
volume_hybrid_2 = RemoteSender(volume_8.Volume)

geo_53 = Geometry(simplify(graft(flatten_4)))  # disabled
dup_15 = DuplicateDataMatch(SourceDataTree=filter_26, SecondaryData1=dam_12)  # -> SourceData, SecondaryData1; disabled
volume_13 = Volume(Geometry=geo_53)  # -> Volume, Centroid; disabled
debox = DeconstructBox(Box=geo_53)  # -> Plane, X, Y, Z; disabled
dedomain_2 = DeconstructDomain(Domain=debox.Z)  # -> Start, End; disabled
m3_to_hm3_3 = Expression(x=volume_13.Volume, Expression="x/1000000")  # disabled
roundd_14 = RoundToDecimalPlace(NumberX=m3_to_hm3_3, DecimalPlace=number_slider_40, RoundType=0)  # -> Rounded, Difference; disabled
dup_16 = DuplicateDataMatch(SourceDataTree=roundd_14.Rounded, SecondaryData1=dam_axis_name_8)  # -> SourceData, SecondaryData1; disabled
dup_17 = DuplicateDataMatch(SourceDataTree=roundd_14.Rounded, SecondaryData1=dam_name_translation_7)  # -> SourceData, SecondaryData1; disabled
dup_18 = DuplicateDataMatch(SourceDataTree=roundd_14.Rounded, SecondaryData1=normal_water_level_10)  # -> SourceData, SecondaryData1; disabled

water_total_geo_2 = RemoteSender(geo_53)  # disabled

# ---- group: Check - Volume final
volume_14 = Volume(Geometry=dispatch_21.ListB)  # -> Volume, Centroid; disabled
ma_3 = MassAddition(Input=flatten(volume_14.Volume))  # -> Result, PartialResults; disabled
ma_4 = MassAddition(Input=flatten(volume_13.Volume))  # -> Result, PartialResults; disabled
subtraction_7 = Subtraction(A=ma.Result, B=ma_3.Result, C=subtraction_6)  # disabled
volume_final = Panel(ma_4.Result)  # disabled
volume_test = Panel(subtraction_7)  # disabled

# ----
unflatten_6 = UnflattenTree(Tree=dup_15.SecondaryData1, Guide=geo_53)  # disabled
dispatch_22 = Dispatch(List=volume_13.Volume, DispatchPattern=dup_15.SecondaryData1)  # -> ListA, ListB; disabled
ma_5 = MassAddition(Input=flatten(dispatch_22.ListB))  # -> Result, PartialResults; disabled
ma_6 = MassAddition(Input=flatten(dispatch_22.ListA))  # -> Result, PartialResults; disabled
is_dead = RemoteSender(unflatten_6)  # disabled
rest_water_body_m3 = Panel(ma_5.Result)  # disabled
dead_storage_m3 = Panel(ma_6.Result)  # disabled
ma_7 = MassAddition(Input=flatten([ma_6.Result, ma_5.Result]))  # -> Result, PartialResults; disabled

# ---- group: Rounding to 0.1 (continued)
roundd_15 = RoundToDecimalPlace(NumberX=dedomain_2.Start, DecimalPlace=number_slider_39, RoundType=0)  # -> Rounded, Difference; disabled
roundd_16 = RoundToDecimalPlace(NumberX=dedomain_2.End, DecimalPlace=number_slider_39, RoundType=0)  # -> Rounded, Difference; disabled

# ----
expression_28 = Expression(x=ma_7.Result, Expression="Format(\"{0:0.0}\", x/1000000)")  # disabled
expression_29 = Expression(x=dead_storage_m3, Expression="Format(\"{0:0.0}\", x/1000000)")  # disabled
total_m3 = Panel(ma_7.Result)  # disabled
water_total_volume_2 = RemoteSender(roundd_14.Rounded)  # disabled
panel_104 = Panel([expression_28, expression_29, minimum_water_level_4])  # disabled

num_6 = Number(roundd_15.Rounded)  # disabled
num_7 = Number(roundd_16.Rounded)  # disabled
merge_18 = Merge(
    Data1=dup_16.SecondaryData1,
    Data2=dup_17.SecondaryData1,
    Data3=dup_18.SecondaryData1,
    Data4=num_6,
    Data5=num_7,
    Data6=roundd_14.Rounded,
    Data7=unflatten_6)  # disabled
panel_105 = Panel(merge_18)  # disabled

values_water_2 = RemoteSender(merge_18)  # disabled

water_total_volume_3 = RemoteReceiver([water_total_volume_2, water_total_volume])
is_dead_2 = RemoteReceiver(is_dead)
water_total_geo_3 = RemoteReceiver([water_total_geo_2, water_total_geo])
is_dead_3 = RemoteReceiver(is_dead)
volume_hybrid_3 = RemoteReceiver([volume_hybrid, volume_hybrid_2])
not_2 = GateNot(A=is_dead_2)
not_3 = GateNot(A=is_dead_3)
dispatch_23 = Dispatch(List=water_total_volume_3, DispatchPattern=not_2)  # -> ListA, ListB
filter_29 = StreamFilter(
    Gate=dam_type_23,
    Stream0=gravity_volume_2,
    Stream1=archdam_volume_3,
    Stream2=embankment_volume_2,
    Stream3=volume_hybrid_3)
dispatch_24 = Dispatch(List=water_total_geo_3, DispatchPattern=not_3)  # -> ListA, ListB
ma_8 = MassAddition(Input=flatten(dispatch_23.ListA))  # -> Result, PartialResults
ma_9 = MassAddition(Input=flatten(dispatch_23.ListB))  # -> Result, PartialResults
mesh_27 = Mesh(flatten(dispatch_24.ListA))
mesh_28 = Mesh(flatten(dispatch_24.ListB))
ma_10 = MassAddition(Input=flatten([ma_8.Result, ma_9.Result]))  # -> Result, PartialResults
item_79 = ListItem(List=flatten(mesh_27), Index=0, Wrap=True)
format_7 = Format(Format=panel_93, Culture=2055, Data0=filter_29)
center_13 = Center(Geometry=flatten(dispatch_24.ListA), forall=True)  # -> Center, Dimension
center_14 = Center(Geometry=mesh_28, forall=True)  # -> Center, Dimension
center_15 = Center(Geometry=item_79, forall=True)  # -> Center, Dimension
panel_106 = Panel(format_7)
format_8 = Format(Format=panel_94, Culture=2055, Data0=ma_10.Result, Data1=ma_8.Result, Data2=ma_9.Result)
item_80 = ListItem(List=format_8, Index=0, Wrap=True)  # -> Item, Item1, Item2
text_dot_4 = TextDot(Location=move_21.Geometry, PrimaryText=panel_106, TextHeight=font_size_5)
move_24 = Move(Geometry=center_13.Center, Motion=Z_22)  # -> Geometry, Transform
move_25 = Move(Geometry=center_15.Center, Motion=Z_23)  # -> Geometry, Transform
move_26 = Move(Geometry=center_14.Center, Motion=Z_24)  # -> Geometry, Transform
entwine_4 = Entwine(Branch00=item_80.Item, Branch01=item_80.Item1, FlattenInputs=True)
entwine_5 = Entwine(Branch00=move_24.Geometry, Branch01=move_25.Geometry, FlattenInputs=True)
ln_16 = Line(StartPoint=center_13.Center, EndPoint=move_24.Geometry)
ln_17 = Line(StartPoint=center_15.Center, EndPoint=move_25.Geometry)
ln_18 = Line(StartPoint=center_14.Center, EndPoint=move_26.Geometry)

values_water_3 = RemoteReceiver([values_water_2, values_water])
water_total_geo_4 = RemoteReceiver([water_total_geo_2, water_total_geo])
transform_4 = Transform(Geometry=water_total_geo_4, Transform=transform_origin_2)

dam_16 = DataDam(
    DataA=panel_52,
    DataB=panel_57,
    DataC=panel_51,
    DataD=values_water_3,
    DataE=transform_4,
    BufferDelay=10000000,
    BufferMode=0)  # -> DataA, DataB, DataC, DataD, DataE
dam_17 = DataDam(DataA=panel_53, DataE=panel_58, DataB=crv, DataC=item_19, DataD=dam_axis_name_6, BufferDelay=10000000, BufferMode=0)  # -> DataA, DataE, DataB, DataC, DataD
dam_18 = DataDam(DataA=panel_54, DataB=panel_59, DataC=panel_55, DataD=merge_16, DataE=transform_3, BufferDelay=10000000, BufferMode=0)  # -> DataA, DataB, DataC, DataD, DataE
objfromgroup_12 = GetObjectsInGroup()

output = DataOutput(
    A=dam_16.DataA,
    B=dam_16.DataB,
    C=dam_16.DataC,
    D=dam_16.DataD,
    E=dam_16.DataE,
    Destination="C:\Users\Admin\Documents\Github\EarlyStageDesign\JD\Skripts\ghData\Water_test_to_export.ghdata",
    RelativePath="C:\Users\Admin\Documents\Github\EarlyStageDesign\JD\Skripts\ghData\Water_test_to_export.ghdata|ghData\Water_test_to_export.ghdata")
output_2 = DataOutput(
    D=dam_17.DataA,
    E=dam_17.DataE,
    A=dam_17.DataB,
    C=dam_17.DataC,
    B=dam_17.DataD,
    Destination="C:\Users\Admin\Documents\Github\EarlyStageDesign\JD\Skripts\ghData\DamAxis.ghdata",
    RelativePath="C:\Users\Admin\Documents\Github\EarlyStageDesign\JD\Skripts\ghData\DamAxis.ghdata|ghData\DamAxis.ghdata")
output_3 = DataOutput(
    A=dam_18.DataA,
    B=dam_18.DataB,
    C=dam_18.DataC,
    D=dam_18.DataD,
    E=dam_18.DataE,
    Destination="C:\Users\Admin\Documents\Github\EarlyStageDesign\JD\Skripts\ghData\ArchDam_test_to_export.ghdata",
    RelativePath="C:\Users\Admin\Documents\Github\EarlyStageDesign\JD\Skripts\ghData\ArchDam_test_to_export.ghdata|ghData\ArchDam_test_to_export.ghdata")
lng_16 = ListLength(List=objfromgroup_12)
panel_107 = Panel(dam_17.DataD)
dup_19 = DuplicateData(Data=send_to_export, Number=lng_16, Order=True)
panel_108 = Panel(dam_17.DataC)
# Arch dam
# Water
water_total_geo_5 = RemoteReceiver([water_total_geo_2, water_total_geo])
is_dead_4 = RemoteReceiver(is_dead)
setobj_6 = SetObjectValue(ObjectToSet=objfromgroup_12, ValueToSet=dup_19)
not_4 = GateNot(A=is_dead_4)
dispatch_25 = Dispatch(List=water_total_geo_5, DispatchPattern=not_4)  # -> ListA, ListB

font_size_6 = RemoteReceiver(font_size)
text_dot_5 = TextDot(Location=move_26.Geometry, PrimaryText=item_80.Item2, TextHeight=font_size_6)
leader_6 = RemoteSender(ln_18)
preview_16 = CustomPreview(Geometry=dispatch_25.ListB, Material=material_3)
preview_17 = CustomPreview(Geometry=dispatch_25.ListB, Material=material_3)
preview_18 = CustomPreview(Geometry=dispatch_25.ListB, Material=material_3)
preview_19 = CustomPreview(Geometry=dispatch_25.ListB, Material=material_3)
objfromgroup_13 = GetObjectsInGroup()

font_size_7 = RemoteReceiver(font_size)
text_dot_6 = TextDot(Location=entwine_5, PrimaryText=entwine_4, TextHeight=font_size_7)
leader_7 = RemoteSender(ln_16)
leader_8 = RemoteSender(ln_17)
preview_20 = CustomPreview(Geometry=dispatch_25.ListA, Material=material_3)
preview_21 = CustomPreview(Geometry=dispatch_25.ListA, Material=material_3)
preview_22 = CustomPreview(Geometry=dispatch_25.ListA, Material=material_3)
preview_23 = CustomPreview(Geometry=dispatch_25.ListA, Material=material_3)
objfromgroup_14 = GetObjectsInGroup()

leader_9 = RemoteReceiver([leader_7, leader_8, leader_6, leader_3, leader_2, leader_5, leader_4])
curve_preview_11 = CustomCurvePreview(Curve=leader_9, Linetype=linetypes, Colour=ColourSwatch(SwatchColor=RGB(69, 69, 69)))
lng_17 = ListLength(List=objfromgroup_13)
lng_18 = ListLength(List=objfromgroup_14)
dup_20 = DuplicateData(Data=show_dead_capacity, Number=lng_17, Order=True)
dup_21 = DuplicateData(Data=show_useful_capacity, Number=lng_18, Order=True)
onoff_7 = EnableDisableObject(
    Objects=objfromgroup_13,
    Enabled=dup_20,
    AllObjects_Object=[preview_16, leader_6, font_size_6, text_dot_5, preview_17, preview_18, preview_19])
onoff_8 = EnableDisableObject(
    Objects=objfromgroup_14,
    Enabled=dup_21,
    AllObjects_Object=[preview_20, leader_7, leader_8, font_size_7, text_dot_6, preview_22, preview_23, preview_21])

# ==== cluster Cluster
relay = ClusterInput()
relay_2 = ClusterInput()
ptstrimcrv = PointsTrimCurve(Curve=relay_2, Points=relay, Flip=False)  # -> Trimmed, SubDomains, Intersected
dedomain = DeconstructDomain(Domain=ptstrimcrv.SubDomains)  # -> reverse(Start), End
item = ListItem(List=dedomain.Start, Index=0, Wrap=True)
item_2 = ListItem(List=dedomain.End, Index=0, Wrap=True)
shatter = Shatter(Curve=relay_2, Parameters=[item, item_2])
item_3 = ListItem(List=shatter, Index=1, Wrap=True)
i = ClusterOutput(item_3)
