# Grasshopper definition Dashboard_damConfiguration.gh (Grasshopper 1.0.7)
# plug-ins: Telepathy, UiPlus, MetaHopper

panel = Panel("""1836
1839
1842
1844""")
dam_configuration = Button()
panel_2 = Panel("""False
True
False""")
get_number = GetNumber(panel, AtLeast=1, AtMost=1, Maximum=1.797693135e+308, Minimum=-1.797693135e+308, TreeAccess=True)
get_boolean = GetBoolean(panel_2, AtLeast=1, AtMost=4, FalseValue="False", TreeAccess=False, TrueValue="True")
# Dam configuration
get_boolean_2 = GetBoolean(dam_configuration, AtLeast=1, AtMost=1, FalseValue="False", TreeAccess=False, TrueValue="True")
panel_3 = Panel("C:\Users\Admin\Gruner AG\Jumping dams [EXP] - General\03_Model\Example image.png")

panel_4 = Panel("""Concrete gravity dam
Arch dam
Embankment dam""")
# Dashboard structure
panel_5 = Panel("Type of Dam (m)")

panel_6 = Panel(get_boolean)
radio = UiRadio(Label=panel_4, State=panel_6, Group="Group 1")
label = UiLabel(Label=panel_5, Style=3)
dropdown_list = UiDropdownList(Values=get_number)
label_2 = UiLabel(Label="Water level (m)", Style=3)
image = UiImage(Bitmap=panel_3, Fitting=1)
label_3 = UiLabel(Label="Freeboard (m)", Style=3)
slider = UiSlider(Value=0.5, Bounds=Domain(0, 1), Increment=0.1)
label_4 = UiLabel(Label="Foundation depth (m)", Style=3)
button = UiButton(Label="Ok")
toggle = UiToggle(State=False)
slider_2 = UiSlider(Value=0.5, Bounds=Domain(0, 1), Increment=0.1)
toggle_2 = UiToggle(State="True")
merge = Merge(
    Data1=label,
    Data2=radio,
    Data3=label_2,
    Data4=dropdown_list,
    Data5=label_3,
    Data6=slider,
    Data7=label_4,
    Data8=slider_2,
    Data9=button,
    Data10=toggle,
    Data11=toggle_2)  # -> flatten(Result)
window = UiWindow(Elements=merge, Title="Dam Configuration", Owner=1, Scroll=True, Launch=get_boolean_2)
dropdown_list_2 = UiDropdownList(Element=dropdown_list, Values=get_number, Index=Slider(3, range=0..10))
resize = UiResize(Element=image, Width="200", Height="200")
get_values = UiValues(Element=dropdown_list_2)  # -> flatten(Values)
slider_3 = UiSlider(Element=slider, Label="m", Value="3", Bounds="0 To 5", Increment=".1")
button_2 = UiButton(Element=button, Label="Send changes")
slider_4 = UiSlider(Element=slider_2, Label="m", Value="10", Bounds="0 To 50", Increment=".1")
toggle_3 = UiToggle(Element=toggle, Label="Show direction river flow?", State=False)
toggle_4 = UiToggle(Element=toggle_2, Label="Visualize dimensions?", State=False)
item = ListItem(List=get_number, Index=get_values, Wrap=True)
get_values_2 = UiValues(Element=radio)  # -> flatten(Values)
get_values_3 = UiValues(Element=slider_3)  # -> flatten(Values)
get_values_4 = UiValues(Element=slider_4)  # -> flatten(Values)
get_values_5 = UiValues(Element=button_2)  # -> flatten(Values)
get_values_6 = UiValues(Element=toggle_3)  # -> flatten(Values)
get_values_7 = UiValues(Element=toggle_4)  # -> flatten(Values)
water_level_m_input_from_dashboard = Panel(item)
# Dashboard - fill in data and listen to outputs
dam_type_index = Panel("""0
1
2""")
dam_type = Panel(get_values_2)
freeboard_m_input_from_dashboard = Panel(get_values_3)
offset_foundation_m_input_from_dashboard = Panel(get_values_4)
panel_7 = Panel(get_values_6)
panel_8 = Panel(get_values_7)
panel_9 = Panel(get_values_5)
dispatch = Dispatch(List=dam_type_index, DispatchPattern=dam_type)  # -> ListA, ListB

# ---- group: RH_OUT:Dam Type Index
num = Number(dispatch.ListA)

# ---- group: RH_OUT:Water Level
num_2 = Number(water_level_m_input_from_dashboard)

# ----
viz_dimensions = RemoteSender(panel_8)
viz_direction_river = RemoteSender(panel_7)

# ---- group: RH_OUT:Freeboard
num_3 = Number(freeboard_m_input_from_dashboard)

# ---- group: RH_OUT:Offset Foundation
num_4 = Number(offset_foundation_m_input_from_dashboard)

# ---- group: RH_OUT:Send changes
num_5 = Number(panel_9)

# ----
dam = DataDam(
    DataA=dispatch.ListA,
    DataB=water_level_m_input_from_dashboard,
    DataC=freeboard_m_input_from_dashboard,
    DataD=offset_foundation_m_input_from_dashboard,
    BufferDelay=5000000,
    BufferMode=0)  # -> DataA, DataB, DataC, DataD
objfromgroup = GetObjectsInGroup()

dam_2 = DataDam(DataA=dispatch.ListA, BufferDelay=2500000, BufferMode=2)
dam_3 = DataDam(DataA=freeboard_m_input_from_dashboard, BufferDelay=10000000, BufferMode=0)  # disabled
dam_4 = DataDam(DataA=offset_foundation_m_input_from_dashboard, BufferDelay=10000000, BufferMode=0)  # disabled

lng = ListLength(List=objfromgroup)
dup = DuplicateData(Data=panel_9, Number=lng, Order=True)  # -> flatten(Data)

inpupt_offset_foundation_m = Panel(dam.DataD)
addition = Addition(A=dam.DataB, B=dam.DataC)
bool = Boolean(dup)
water_level = RemoteSender(dam.DataB)
dam_type_2 = RemoteSender(dam_2)
dam_level = RemoteSender(addition)
freeboard = RemoteSender(dam.DataC)
offset_foundation = RemoteSender(dam.DataD)
setobj = SetObjectValue(ObjectToSet=flatten(objfromgroup), ValueToSet=flatten(bool))
panel_10 = Panel(lng)
panel_11 = Panel(dup)
