# Grasshopper definition Gravity.gh (Grasshopper 1.0.7)
# plug-ins: Telepathy, Heteroptera, Pufferfish, MeshEdit Components

# vector
vector_waterflow = GetPoint(AtLeast=1, AtMost=1, Realtime=False, TreeAccess=True)
# number
width_crest = GetNumber(AtLeast=1, AtMost=1, Maximum=1.797693135e+308, Minimum=-1.797693135e+308, TreeAccess=True)
# surface
brep_terrain = GetGeometry(AtLeast=1, AtMost=1, DeleteInput=False, Filter=1073741832, TreeAccess=True)
# number
ds_ratio = GetNumber(AtLeast=1, AtMost=1, Maximum=1.797693135e+308, Minimum=-1.797693135e+308, TreeAccess=True)
# line
chord_dam = GetLine(AtLeast=1, AtMost=1, Realtime=False, TreeAccess=True)
midpt = CurveMiddle(Curve=chord_dam)
project = Project(Curve=chord_dam, Brep=brep_terrain, Direction=Vector(0, 0, 1))
end = EndPoints(Curve=chord_dam)  # -> Start, End

# ----
# GRAVITY DAM
# Top
# Concrete dam settings
# Final volume
midpt_2 = CurveMiddle(Curve=chord_dam)  # disabled
project_2 = Project(Curve=chord_dam, Brep=brep_terrain, Direction=Vector(0, 0, 1))  # disabled
end_2 = EndPoints(Curve=chord_dam)  # -> Start, End; disabled
x_tremez = Extremes(Curve=project_2, Plane=PlaneXY(0, 0, 0))  # -> Highest, Lowest; disabled
pdecon = Deconstruct(Point=x_tremez.Lowest)  # -> XComponent, YComponent, ZComponent; disabled
pdecon_2 = Deconstruct(Point=midpt_2)  # -> XComponent, YComponent, ZComponent; disabled
subtraction = Subtraction(A=pdecon_2.ZComponent, B=pdecon.ZComponent)  # disabled
multiplication = Multiplication(A=subtraction, B=1.5)  # disabled
panel = Panel("{0,0,-1}")  # disabled
line = LineSDL(Start=end_2.Start, Direction=panel, Length=multiplication)  # disabled
atan = ArcTangent(Value=ds_ratio)  # disabled
rotax = RotateAxis(Geometry=line, Angle=atan, Axis=chord_dam)  # -> Geometry, Transform; disabled
swp1 = Sweep1(Rail=chord_dam, Sections=line, Miter=1)  # -> flatten(Brep); disabled
swp1_2 = Sweep1(Rail=chord_dam, Sections=rotax.Geometry, Miter=1)  # -> flatten(Brep); disabled
entwine = Entwine(Branch00=swp1, Branch01=swp1_2, FlattenInputs=True)  # -> simplify(Result); disabled
bbx = BrepBrep(BrepA=entwine, BrepB=brep_terrain)  # -> Curves, Points; disabled
geo = Geometry(bbx.Curves)  # disabled
explode = Explode(Curve=geo, Recursive=False)  # -> Segments, Vertices; disabled
pline = PolyLine(Vertices=explode.Vertices, Closed=False)  # disabled
lng = ListLength(List=explode.Vertices)  # disabled
number_slider = Slider(0.5, range=0..1)  # disabled
smoothpline = SmoothPolyline(Polyline=pline, Strength=number_slider, Times=lng)  # disabled
srfsplit = SurfaceSplit(Surface=entwine, Curves=smoothpline)  # disabled
center = Center(Geometric=srfsplit, referenceAll=2)  # -> Center, Dimension; disabled
sort = SortList(Keys=center.Dimension, ValuesA=srfsplit)  # -> Keys, ValuesA; disabled
amp = Amplitude(Vector=vector_waterflow, Amplitude=width_crest)  # disabled
pt = Point(midpt_2)  # disabled
item = ListItem(List=sort.ValuesA, Index=0, Wrap=True)  # -> simplify(Item); disabled
loft = Loft(
    Curves=flatten(smoothpline),
    Options={Adjust=True, Closed=False, LoftEnds=0, LoftSimp=0, LoftType=5, Rebuild=10, Refit=0.01})  # disabled
simplify = SimplifyTree(Tree=smoothpline, Front=False)  # disabled
move = Move(Geometry=pt, Motion=amp)  # -> Geometry, Transform; disabled
panel_2 = Panel("{1}")  # disabled
join = BrepJoin(Breps=flatten([loft, item]))  # -> Breps, Closed; disabled
branch = TreeBranch(Tree=simplify, Path=panel_2, MaintainPaths=True)  # disabled
branch_2 = TreeBranch(Tree=item, Path=panel_2, MaintainPaths=True)  # disabled
panel_3 = Panel("0,0,-1")  # disabled
project_3 = ProjectPoint(Point=move.Geometry, Direction=panel_3, Geometry=flatten(branch_2))  # -> Point, Index; disabled
number_slider_2 = Slider(20, range=0..100)  # disabled
pline_2 = PolyLine(Vertices=flatten([pt, move.Geometry, project_3.Point]), Closed=True)  # disabled
move2pt = MoveToPoint(Geometry=pline_2, PointA=pt, PointB=end_2.Start)  # -> Moved, Vector, Transform; disabled
Z = UnitZ(Factor=number_slider_2)  # disabled
swp1_3 = Sweep1(Rail=chord_dam, Sections=move2pt.Moved, Miter=1)  # disabled
extr = Extrude(Base=branch, Direction=Z)  # disabled
split = SplitBrep(Brep=extr, Cutter=swp1_3)  # disabled
split_2 = SplitBrep(Brep=swp1_3, Cutter=extr)  # disabled
center_2 = Center(Geometric=split, referenceAll=2)  # -> Center, Dimension; disabled
center_3 = Center(Geometric=split_2, referenceAll=2)  # -> Center, Dimension; disabled
sort_2 = SortList(Keys=center_2.Dimension, ValuesA=split)  # -> Keys, reverse(ValuesA); disabled
sort_3 = SortList(Keys=center_3.Dimension, ValuesA=split_2)  # -> Keys, reverse(ValuesA); disabled
cull_i = CullIndex(List=sort_2.ValuesA, Indices=0, Wrap=True)  # disabled
item_2 = ListItem(List=sort_3.ValuesA, Index=0, Wrap=True)  # disabled
join_2 = BrepJoin(Breps=flatten([cull_i, item_2]))  # -> Breps, Closed; disabled
sunion = SolidUnion(Breps=[join.Breps, join_2.Breps])  # disabled
jagged = SettingsSpeed()  # disabled
mesh = MeshBrep(Brep=sunion, Settings=jagged)  # disabled

x_tremez_2 = Extremes(Curve=project, Plane=PlaneXY(0, 0, 0))  # -> Highest, Lowest
pdecon_3 = Deconstruct(Point=x_tremez_2.Lowest)  # -> XComponent, YComponent, ZComponent
pdecon_4 = Deconstruct(Point=midpt)  # -> XComponent, YComponent, ZComponent
subtraction_2 = Subtraction(A=pdecon_4.ZComponent, B=pdecon_3.ZComponent)
multiplication_2 = Multiplication(A=subtraction_2, B=1.5)
line_2 = LineSDL(Start=end.Start, Direction="{0,0,-1}", Length=multiplication_2)
atan_2 = ArcTangent(Value=ds_ratio)
rotax_2 = RotateAxis(Geometry=line_2, Angle=atan_2, Axis=chord_dam)  # -> Geometry, Transform
swp1_4 = Sweep1(Rail=chord_dam, Sections=line_2, Miter=1)  # -> flatten(Brep)
swp1_5 = Sweep1(Rail=chord_dam, Sections=rotax_2.Geometry, Miter=1)  # -> flatten(Brep)

# ---- group: RH_OUT:out
geo_2 = Geometry(swp1_5)
geo_3 = Geometry(swp1_4)

# ----
volume = MeshVolume(Mesh=mesh)  # -> Volume, Centroid; disabled
round = Round(Number=volume.Volume)  # -> Nearest, Floor, Ceiling; disabled

# ---- group: RH_OUT:Geo
# geometry
geo_4 = Geometry(mesh)  # disabled

# ---- group: RH_OUT:Volume
num = Number(round.Nearest)  # disabled

# ----
geo_concretedam = RemoteSender(geo_4)
volume_concretedam = RemoteSender(num)
