# Grasshopper definition Gravity_test2.gh (Grasshopper 1.0.7)

# surface
brep_terrain = GetGeometry(AtLeast=1, AtMost=1, DeleteInput=False, Filter=1073741864, TreeAccess=True)
# line
chord_dam = GetLine(AtLeast=1, AtMost=1, Realtime=False, TreeAccess=True)
midpt = CurveMiddle(Curve=chord_dam)
scale = Scale(Geometry=chord_dam, Center=midpt, Factor=Slider(2, range=0..10))  # -> Geometry, Transform

# ---- group: RH_OUT:out
geo = Geometry(brep_terrain)
geo_2 = Geometry(scale.Geometry)
