# Grasshopper definition base_.gh (Grasshopper 1.0.7)
# Copyright: © 2017-2018 Pierre Cuvilliers, Caitlin Mueller, Massachusetts Institute of Technology
# plug-ins: ProvingGround.Conduit, Telepathy, Pufferfish, LunchBox, Human, Heteroptera, Pancake, UiPlus, MetaHopper, EleFront

panel = Panel("C:\Users\cna\Gruner AG\Jumping dams [EXP] - General\03_Model\Example image.png")

# ----
# Dashboard structure
panel_2 = Panel("Type of Dam (m)")
panel_3 = Panel("""Concrete gravity dam
Arch dam
Embankment dam""")

# ----
# Energy Inputs
# Dashboard structure
# Dashboard - fill in data and listen to outputs
panel_4 = Panel("Ecological discharge [m3/s]")
label = UiLabel(Label=panel_4, Style=3)
slider = UiSlider(Value=0.5, Bounds=Domain(0, 1), Increment=0.1)
label_2 = UiLabel(Label="Inputs energy", Style=1)
label_3 = UiLabel(Label="Powerplant efficiency [%]", Style=3)
label_4 = UiLabel(Label="Head losses (%)", Style=3)
label_5 = UiLabel(Label="Discharge river (m3/s)*", Style=3)
label_6 = UiLabel(Label="Delta T*", Style=3)
label_7 = UiLabel(Label="*Input 12 Months separated with comma without spaces!", Style=4)
label_8 = UiLabel(Label="Design discharge [m3/s]", Style=3)
slider_2 = UiSlider(Value=0.5, Bounds=Domain(0, 1), Increment=0.1)
text_box = UiTextBox(Text="Click here to change text", Wrap=True)
text_box_2 = UiTextBox(Text="Click here to change text", Wrap=True)
slider_3 = UiSlider(Value=0.5, Bounds=Domain(0, 1), Increment=0.1)
slider_4 = UiSlider(Value=0.5, Bounds=Domain(0, 1), Increment=0.1)
merge = Merge(
    Data1=label_2,
    Data2=label_5,
    Data3=text_box,
    Data4=label_6,
    Data5=text_box_2,
    Data6=label_7,
    Data7=label_4,
    Data8=slider_3,
    Data9=label_8,
    Data10=slider_4,
    Data11=label,
    Data12=slider,
    Data13=label_3,
    Data14=slider_2)
wrap = UiWrapLayout(Elements=merge, Horizontal=False, Direction=0)
merge_2 = Merge(Data1=wrap)
panel_5 = Panel("""Inputs energy
Inputs Dam""")
tab = UiTabbedLayout(Elements=merge_2, Names=panel_5)
energy_inputs = Button()
panel_6 = Panel("Ex: 0.56,0.46,0.47,0.85,4.51,8.72,7.77,5.34,3.01,1.99,1.13,0.72")
window = UiWindow(Elements=merge_2, Title="Energy Inputs", Owner=1, Scroll=True, Launch=energy_inputs)
slider_5 = UiSlider(Element=slider, Label="m3/s", Value=".2", Bounds="0 To 5", Increment=".01")
slider_6 = UiSlider(Element=slider_2, Label="%", Value="88", Bounds="0 To 100", Increment=".1")
text_box_3 = UiTextBox(Element=text_box, Text=panel_6, Wrap=True)
text_box_4 = UiTextBox(Element=text_box_2, Text="Ex: 744,672,744,720,744,720,744,744,720,744,720,744", Wrap=True)
slider_7 = UiSlider(Element=slider_3, Label="%", Value="5", Bounds="0 To 10", Increment=0.1)
slider_8 = UiSlider(Element=slider_4, Label="m3/s", Value="5", Bounds="0 To 20", Increment=0.1)
get_values = UiValues(Element=text_box_4)  # -> flatten(Values)
get_values_2 = UiValues(Element=text_box_3)  # -> flatten(Values)
get_values_3 = UiValues(Element=slider_5)  # -> flatten(Values)
get_values_4 = UiValues(Element=slider_6)  # -> flatten(Values)
get_values_5 = UiValues(Element=slider_7)  # -> flatten(Values)
get_values_6 = UiValues(Element=slider_8)  # -> flatten(Values)
split = TextSplit(Text=get_values, Separators=" ")  # -> reverse(flatten(Result))
split_2 = TextSplit(Text=get_values_2, Separators=" ")  # -> reverse(flatten(Result))
item = ListItem(List=split, Index=0, Wrap=True)
item_2 = ListItem(List=split_2, Index=0, Wrap=True)
split_3 = TextSplit(Text=item, Separators=",")  # -> flatten(Result)
split_4 = TextSplit(Text=item_2, Separators=",")  # -> flatten(Result)
ecological_discharge_m3_s_input_from_das = Panel(get_values_3)  # "Ecological discharge [m3/s] - Input from Dashboard"
discharge_in_the_river_m3_s_input_from_d = Panel(split_4)  # "Discharge in the river [m3/s] - Input from Dashboard"
delta_t_input_from_dashboard = Panel(split_3)
powerplant_efficiency_input_from_dashboa = Panel(get_values_4)  # "Powerplant efficiency [%]- Input from Dashboard"
head_losses_input_from_dashboard = Panel(get_values_5)
design_discharge_m3_s_input_from_dashboa = Panel(get_values_6)  # "Design discharge [m3/s] - Input from Dashboard"
discharge_in_the_river_m3_s_madagascar = Panel("""77.73
84.37
67.49
45.11
24.17
16.78
13.85
11.21
8.05
8.89
18.47
39.28""")
i_energy_dir = RemoteSender(discharge_in_the_river_m3_s_input_from_d)
i_energy_dt = RemoteSender(delta_t_input_from_dashboard)
i_energy_design_discharge = RemoteSender(design_discharge_m3_s_input_from_dashboa)
i_energy_ecological_discharge = RemoteSender(ecological_discharge_m3_s_input_from_das)
i_energy_powerplant_efficiency = RemoteSender(powerplant_efficiency_input_from_dashboa)
i_energy_head_losses = RemoteSender(head_losses_input_from_dashboard)
discharge_in_the_river_m3_s_les_toules = Panel("""0.56
0.46
0.47
0.85
4.51
8.72
7.77
5.34
3.01
1.99
1.13
0.72""")

panel_7 = Panel("""True
False
False""")

# ----
# For python remote
# In conda cmd prompt:
# 
# conda activate C:\Users\cna\.conda\envs\rhinoremote
# 
# pip install <package> - for any missing package check the ouput to the right
# 
# For PIL -> pip install pillow
panel_8 = Panel("C:\Users\cna\Anaconda3\envs\rhinoremote")
panel_9 = Panel("""PIL
openpyxl""")
pythonremote = GHPythonRemote(location=panel_8, run=Toggle(True), modules=panel_9)  # -> out, linked_modules, rpy, import_statements
panel_10 = Panel(pythonremote.import_statements)
panel_11 = Panel(pythonremote.out)

radio = UiRadio(Label=panel_3, State=panel_7, Group="Group 1")
label_9 = UiLabel(Label=panel_2, Style=3)
label_10 = UiLabel(Label="Dam height (m)", Style=3)
scroll_integer = UiScrollInteger(SelectedInteger=0, Wrap=False)
image = UiImage(Bitmap=panel, Fitting=1)
label_11 = UiLabel(Label="Freeboard (m)", Style=3)
slider_9 = UiSlider(Value=0.5, Bounds=Domain(0, 1), Increment=0.1)
label_12 = UiLabel(Label="Foundation depth (m)", Style=3)
button = UiButton(Label="Ok")
toggle = UiToggle(State=False)
slider_10 = UiSlider(Value=0.5, Bounds=Domain(0, 1), Increment=0.1)
toggle_2 = UiToggle(State=False)
does_the_old_dam_exist_in_the_variant = BooleanToggle(False)

pipeline = GeometryPipeline(
    GroupByLayer=False,
    GroupByType=False,
    IncludeHidden=True,
    IncludeLocked=True,
    LayerFilter="Upstream",
    NameFilter="*",
    SublayerFiltering=True,
    TypeFilter=1)
pipeline_2 = GeometryPipeline(
    GroupByLayer=False,
    GroupByType=False,
    IncludeHidden=True,
    IncludeLocked=True,
    LayerFilter="Dam axis",
    NameFilter="*",
    SublayerFiltering=True,
    TypeFilter=4)
# Global settings
reference_points_ph = GeometryPipeline(
    GroupByLayer=False,
    GroupByType=False,
    IncludeHidden=True,
    IncludeLocked=True,
    LayerFilter="Power house",
    NameFilter="*",
    SublayerFiltering=True,
    TypeFilter=1)

# ----
# Slider dam line
slider_11 = Slider(0, range=0..6)
# _Automotions
slider_12 = Slider(0, range=0..10)
lng = ListLength(List=pipeline_2)
expression = Expression(x=lng, Expression="x-1")
c_script = CSharpScript(name="Dam_line", min=slider_12, max=expression, decimals=slider_11)  # -> out, A; inputs name: String, min: Double, max: Double, decimals: Int32
# ---------- c_script: C# ----------
    foreach (IGH_DocumentObject obj in owner.OnPingDocument().Objects )
    {
      Grasshopper.Kernel.Special.GH_NumberSlider slider = obj as Grasshopper.Kernel.Special.GH_NumberSlider;
      if (slider == null) { continue; }
      if (slider.NickName.Equals(name, StringComparison.OrdinalIgnoreCase))
      {
        double norm = slider.Slider.NormalizedValue;

        slider.Slider.Minimum = (decimal) min;
        slider.Slider.Maximum = (decimal) max;
        if (decimals <= 0)
        {
          slider.Slider.Type = Grasshopper.GUI.Base.GH_SliderAccuracy.Integer;
        }
        else
        {
          slider.Slider.Type = Grasshopper.GUI.Base.GH_SliderAccuracy.Float;
          slider.Slider.DecimalPlaces = decimals;
        }

        //Must disable events since we are modifying this thing during a solution.
        //This is actually illegal.
        slider.Slider.RaiseEvents = false;
        slider.Slider.NormalizedValue = norm;
        slider.Slider.RaiseEvents = true;
      }
    }
# ---------- end c_script ----------

pipeline_3 = GeometryPipeline(
    GroupByLayer=False,
    GroupByType=False,
    IncludeHidden=True,
    IncludeLocked=True,
    LayerFilter="River",
    NameFilter="*",
    SublayerFiltering=True,
    TypeFilter=4)

# ---- group: an old dam
brep = Brep(<brep referenced from the Rhino model>)

# ----
dam_line = Slider(0, range=0..4)
# For optimization: Make perpendicular
# sections on the river line to discover
# best placement for the Dams.
pt = Point(pipeline)
merge_3 = Merge(
    Data1=label_9,
    Data2=radio,
    Data3=label_10,
    Data4=scroll_integer,
    Data5=label_11,
    Data6=slider_9,
    Data7=label_12,
    Data8=slider_10,
    Data9=button,
    Data10=toggle,
    Data11=toggle_2,
    Data12=image)  # -> flatten(Result)
stack = UiStackLayout(Elements=merge_3, Horizontal=False)
item_3 = ListItem(List=pipeline_2, Index=dam_line, Wrap=True)
dam_axes_all = RemoteSender(pipeline_2)
dam_axis = RemoteSender(item_3)
dam_configuration = Button()
bill_of_quantities = Button()
window_2 = UiWindow(Elements=merge_3, Title="Dam Configuration", Owner=1, Scroll=True, Launch=dam_configuration)
resize = UiResize(Element=image, Width="200", Height="200")
scroll_integer_2 = UiScrollInteger(Element=scroll_integer, Label="Dam height", SelectedInteger="80", Wrap=False)
window_3 = UiWindow(Title="Bill of Quantities", Owner=1, Scroll=True, Launch=bill_of_quantities)
slider_13 = UiSlider(Element=slider_9, Label="m", Value="1.5", Bounds="0 To 5", Increment=".1")
button_2 = UiButton(Element=button, Label="Send changes")
slider_14 = UiSlider(Element=slider_10, Label="m", Value="10", Bounds="0 To 50", Increment=".1")
toggle_3 = UiToggle(Element=toggle, Label="Show direction river flow?", State=False)
toggle_4 = UiToggle(Element=toggle_2, Label="Visualize dimensions?", State=False)
get_values_7 = UiValues(Element=radio)  # -> flatten(Values)
get_values_8 = UiValues(Element=scroll_integer_2)  # -> flatten(Values)
get_values_9 = UiValues(Element=slider_13)  # -> flatten(Values)
get_values_10 = UiValues(Element=slider_14)  # -> flatten(Values)
get_values_11 = UiValues(Element=button_2)  # -> flatten(Values)
get_values_12 = UiValues(Element=toggle_3)  # -> flatten(Values)
get_values_13 = UiValues(Element=toggle_4)  # -> flatten(Values)
dam_type = Panel(get_values_7)
# Dashboard - fill in data and listen to outputs
dam_type_index = Panel("""0
1
2""")
spacesyntax = SpaceSyntax(Depth=3)  # -> NodeSpaceSyntax, ConnectionSpaceSyntax
dam_height_m_input_from_dashboard = Panel(get_values_8)
freeboard_m_input_from_dashboard = Panel(get_values_9)
offset_foundation_m_input_from_dashboard = Panel(get_values_10)
panel_12 = Panel(get_values_12)
panel_13 = Panel(get_values_13)
panel_14 = Panel(get_values_11)
panel_15 = Panel("INPUTS")
dispatch = Dispatch(List=dam_type_index, DispatchPattern=dam_type)  # -> ListA, ListB
panel_16 = Panel("PROCESS")
mesh = GeometryPipeline(
    GroupByLayer=False,
    GroupByType=False,
    IncludeHidden=True,
    IncludeLocked=True,
    LayerFilter="Terrain_mesh",
    NameFilter="*",
    SublayerFiltering=True,
    TypeFilter=32)
pipeline_4 = GeometryPipeline(
    GroupByLayer=False,
    GroupByType=False,
    IncludeHidden=True,
    IncludeLocked=True,
    LayerFilter="Levels",
    NameFilter="*",
    SublayerFiltering=True,
    TypeFilter=4)
mesh_2 = GeometryPipeline(
    GroupByLayer=False,
    GroupByType=False,
    IncludeHidden=True,
    IncludeLocked=True,
    LayerFilter="Terrain_brep",
    NameFilter="*",
    SublayerFiltering=True,
    TypeFilter=1073741848)
mesh_3 = GeometryPipeline(
    GroupByLayer=False,
    GroupByType=False,
    IncludeHidden=True,
    IncludeLocked=True,
    LayerFilter="Terrain_base",
    NameFilter="*",
    SublayerFiltering=True,
    TypeFilter=1073741848)
viz_direction_river = RemoteSender(panel_12)
viz_dimensions = RemoteSender(panel_13)
panel_18 = Panel("OUTPUTS")
geo = Geometry(pipeline_4)
panel_19 = Panel("VISUALIZATION")
geo_2 = Geometry(mesh_2)
mesh_terrain = RemoteSender(mesh)

objfromgroup = GetObjectsInGroup()
dam = DataDam(
    DataA=dispatch.ListA,
    DataB=dam_height_m_input_from_dashboard,
    DataC=freeboard_m_input_from_dashboard,
    DataD=offset_foundation_m_input_from_dashboard,
    BufferDelay=10000000,
    BufferMode=0)  # -> DataA, DataB, DataC, DataD

dam_2 = DataDam(DataA=dam_height_m_input_from_dashboard, BufferDelay=10000000, BufferMode=0)
dam_3 = DataDam(DataA=freeboard_m_input_from_dashboard, BufferDelay=10000000, BufferMode=0)
dam_4 = DataDam(DataA=offset_foundation_m_input_from_dashboard, BufferDelay=10000000, BufferMode=0)
geo_3 = Geometry(mesh_3)
panel_20 = Panel("CHECK")

lng_2 = ListLength(List=objfromgroup)
dup = DuplicateData(Data=panel_14, Number=lng_2, Order=True)

panel_21 = Panel(panel_14)
subtraction = Subtraction(A=dam.DataB, B=dam.DataC)
elevation_water = RemoteSender(subtraction)
offset_foundation = RemoteSender(dam.DataD)
dam_height = RemoteSender(dam.DataB)
dam_type_2 = RemoteSender(dam.DataA)
freeboard = RemoteSender(dam.DataC)
setobj = SetObjectValue(ObjectToSet=flatten(objfromgroup), ValueToSet=flatten(dup))
panel_22 = Panel(dup)
panel_23 = Panel("Cost rock fill foundation (CHF/m3)")  # disabled
panel_24 = Panel("Cost rock fill(CHF/m3)")  # disabled
label_13 = UiLabel(Label="Cost concrete foundation (CHF/m3)", Style=3)
grid_chart = UiGridChart(Titles=True)
label_14 = UiLabel(Label="Cost concrete(CHF/m3)", Style=3)
label_15 = UiLabel(Label=panel_23, Style=3)  # disabled
label_16 = UiLabel(Label=panel_24, Style=3)  # disabled
scroll_number = UiScrollNumber(Number=0, Wrap=False, Digits=3)
merge_4 = Merge(Data5=grid_chart)  # -> flatten(Result)
scroll_number_2 = UiScrollNumber(Number=0, Wrap=False, Digits=3)
scroll_number_3 = UiScrollNumber(Number=0, Wrap=False, Digits=3)
brep_terrain_base = RemoteSender(geo_3)
scroll_number_4 = UiScrollNumber(Number=0, Wrap=False, Digits=3)
brep_terrain = RemoteSender(geo_2)
lines_levels = RemoteSender(geo)
merge_5 = Merge(Data1=scroll_number_4, Data2=scroll_number_3, Data3=scroll_number, Data4=scroll_number_2, Data5=grid_chart)  # -> flatten(Result)
dam_configuration_2 = Button()
brep_terrain_2 = RemoteReceiver(brep_terrain)
dam_axis_2 = RemoteReceiver(dam_axis)
scroll_number_5 = UiScrollNumber(Element=scroll_number_4, Label="Cost concrete foundation (CHF/m3)", Number=0, Wrap=False, Digits=2, Bounds="0 To 1000")
scroll_number_6 = UiScrollNumber(Element=scroll_number_3, Label="Cost concrete (CHF/m3)", Number=0, Wrap=False, Digits=2, Bounds="0 To 1000")
scroll_number_7 = UiScrollNumber(Element=scroll_number, Label="Cost rock fill foundation (CHF/m3)", Number=0, Wrap=False, Digits=2, Bounds="0 To 1000")
window_4 = UiWindow(Elements=merge_5, Title="Costs", Owner=1, Scroll=True, Launch=dam_configuration_2)
scroll_number_8 = UiScrollNumber(Element=scroll_number_2, Label="Cost rock fill (CHF/m3)", Number=0, Wrap=False, Digits=2, Bounds="0 To 1000")

# ---- group: Topography contour lines
# This changes when the axis line calculate and recalculate the basics again
# Technical Memorandum No. EM36-86-68110: Obtain a print of the topography of the proposed dam site at a scale of 1”:100’ with
# 5 or 10-foot contour intervals.
panel_25 = Panel("10")
expression_2 = Expression(ft=panel_25, Expression="ft*0.3048")
panel_26 = Panel(expression_2)

# ----
get_values_14 = UiValues(Element=scroll_number_5)  # -> flatten(Values)
get_values_15 = UiValues(Element=scroll_number_6)  # -> flatten(Values)
get_values_16 = UiValues(Element=scroll_number_8)  # -> flatten(Values)
get_values_17 = UiValues(Element=scroll_number_7)  # -> flatten(Values)
project = Project(Curve=dam_axis_2, Brep=brep_terrain_2, Direction=Vector(0, 0, 1))
dam_axis_3 = RemoteReceiver(dam_axis)
merge_6 = Merge(Data1=get_values_14, Data2=get_values_15, Data3=get_values_17, Data4=get_values_16)
x_tremez = Extremes(Curve=project, Plane=PlaneXY(0, 0, 0))  # -> Highest, Lowest
avr = Average(Input=get_values_14)
dam_height_m_input_from_dashboard_2 = Panel(get_values_14)

# ---- group: Lowest point in the section
pt_2 = Point(x_tremez.Lowest)

# ---- group: Selecting dam height level
brep_terrain_base_2 = RemoteReceiver(brep_terrain_base)
dam_height_2 = RemoteReceiver(dam_height)
Z = UnitZ(Factor=dam_height_2)
move = Move(Geometry=pt_2, Motion=Z)  # -> Geometry, Transform
pln = Plane(move.Geometry)
project_2 = Project(Geometry=brep_terrain_base_2, Plane=pln)  # -> Geometry, Transform
bbx = BrepBrep(BrepA=brep_terrain_2, BrepB=project_2.Geometry)  # -> Curves, Points
geo_4 = Geometry(bbx.Curves)
txt = Text(geo_4)
mindex = MemberIndex(Set=txt, Member="Closed Planar Curve")  # -> Index, Count
cull_i = CullIndex(List=geo_4, Indices=mindex.Index, Wrap=True)
levels_at_dam_height = RemoteSender(cull_i)

# ----
dam_height_m_input_from_dashboard_3 = Panel(get_values_16)
dam_height_m_input_from_dashboard_4 = Panel(get_values_17)
dam_height_m_input_from_dashboard_5 = Panel(get_values_15)
list = ValueList({"Default", "JD_AngularCheck"}, selected="Default")
movetoplane = MoveToPlane(Geometry=dam_axis_3, Plane=pln, Above=True, Below=True)  # -> Geometry, Transform
srfsplit = SurfaceSplit(Surface=project_2.Geometry, Curves=movetoplane.Geometry)
lineardim = DefineLinearDimension(Point1=pt_2, Point2=move.Geometry, Offset=Slider(-3, range=-100..100), DimensionStyle=list)
dimensions_check = RemoteSender(lineardim)
movetoplane_2 = MoveToPlane(Geometry=dam_axis_2, Plane=pln, Above=True, Below=True)  # -> Geometry, Transform
dam_height_3 = RemoteReceiver(dam_height)
panel_27 = Panel("""Description
Volume (m3)
Specific costs (CHF/m3)
Total costs (CHF)""")
panel_28 = Panel("""Concrete foundation
Concrete top
Rockfill foundation
Rockfill top""")
lowest_point_dam_section = RemoteSender(pt_2)
projected_dam_control_line = RemoteSender(project)
lowest_point_dam_section_2 = RemoteReceiver(lowest_point_dam_section)
elevation_water_2 = RemoteReceiver(elevation_water)
brep_terrain_3 = RemoteReceiver(brep_terrain)
dam_crest_width = Slider(6, range=0..100)
# Concrete dam settings
width_crest = RemoteSender(dam_crest_width)
downstream_face_angle_ratio_1 = Slider(0.8, range=0..1)
brep_terrain_4 = RemoteReceiver(brep_terrain)
# CONCRETE DAM
width_crest_2 = RemoteReceiver(width_crest)
dam_height_4 = RemoteReceiver(dam_height)
offset_foundation_2 = RemoteReceiver(offset_foundation)
dam_type_3 = RemoteReceiver(dam_type_2)
# WATER
toggle_5 = BooleanToggle(False)
dam_type_4 = RemoteReceiver(dam_type_2)
brep_terrain_5 = RemoteReceiver(brep_terrain)
# Visualization
# Terrain
lines_levels_2 = RemoteReceiver(lines_levels)
swatch = ColourSwatch(SwatchColor=RGB(255, 174, 0))
viz_dimensions_2 = RemoteReceiver(viz_dimensions)
previewlw = CustomPreviewLineweights(Geometry=lines_levels_2, Shader=ColourSwatch(SwatchColor=RGB(107, 107, 107)), Absolute=False)

dam_axes_all_2 = RemoteReceiver(dam_axes_all)
# Visualization top
dam_axis_4 = RemoteReceiver(dam_axis)
Z_2 = UnitZ(Factor=Slider(5000, range=0..10000))
move_2 = Move(Geometry=dam_axes_all_2, Motion=Z_2)  # -> Geometry, Transform
move_3 = Move(Geometry=dam_axis_4, Motion=Z_2)  # -> Geometry, Transform
previewlw_2 = CustomPreviewLineweights(
    Geometry=move_3.Geometry,
    Shader=ColourSwatch(SwatchColor=RGB(47, 255, 0)),
    Thickness=Slider(4, range=0..10),
    Absolute=False)
previewlw_3 = CustomPreviewLineweights(
    Geometry=move_2.Geometry,
    Shader=ColourSwatch(SwatchColor=RGB(194, 194, 194)),
    Thickness=Slider(1, range=0..10),
    Absolute=False)

viz_direction_river_2 = RemoteReceiver(viz_direction_river)
list_2 = ValueList({"Concrete Dam": "1", "Arch Dam": "2", "Embankment Dam": "3"}, selected=["Concrete Dam", "Arch Dam", "Embankment Dam"])
brep_terrain_6 = RemoteReceiver(brep_terrain)
panel_29 = Panel(list_2)

# ---- group: Input (Abutement vectors direction - check)
list_3 = ValueList({"Original": 0, "Flipped": 1}, selected="Flipped")

# ----
list_4 = ValueList({"Default", "JD_AngularCheck"}, selected="JD_AngularCheck")
number_slider = Slider(57, range=0..100)
i_energy_head_losses_2 = RemoteReceiver(i_energy_head_losses)
i_energy_design_discharge_2 = RemoteReceiver(i_energy_design_discharge)
i_energy_ecological_discharge_2 = RemoteReceiver(i_energy_ecological_discharge)
i_energy_powerplant_efficiency_2 = RemoteReceiver(i_energy_powerplant_efficiency)

g_constant = Panel("9.81")

i_energy_dir_2 = RemoteReceiver(i_energy_dir)
freeboard_2 = RemoteReceiver(freeboard)
num = Number(i_energy_design_discharge_2)
num_2 = Number(i_energy_ecological_discharge_2)
num_3 = Number(i_energy_dir_2)

# ---- group: Is that correct?
division = Division(A=i_energy_powerplant_efficiency_2, B=100000)

# ----
lowest_point_dam_section_3 = RemoteReceiver(lowest_point_dam_section)  # disabled

# ---- group: Just a random amplitude
number_slider_2 = Slider(50, range=0..100)  # disabled

# ----
pt_3 = Point(lowest_point_dam_section_3)  # disabled
number_slider_3 = Slider(50, range=0..100)  # disabled
number_slider_4 = Slider(4, range=0..10)  # disabled
button_3 = Button()  # disabled
panel_30 = Panel("0")  # disabled
offset_foundation_3 = RemoteReceiver(offset_foundation)
lowest_point_dam_section_4 = RemoteReceiver(lowest_point_dam_section)
swatch_2 = ColourSwatch(SwatchColor=RGB(171, 236, 247))  # disabled
swatch_3 = ColourSwatch(SwatchColor=RGB(180, 214, 200))  # disabled

# ---- group: results / variants / change the number of your variant before sending to Excel!
list_5 = ValueList({"1", "2", "3", "4", "5"}, selected="1")

# ----
equals = Equality(FirstNumber=list_5, SecondNumber="1")  # -> Equality, Inequality

equals_2 = Equality(FirstNumber=list_5, SecondNumber="4")  # -> Equality, Inequality

equals_3 = Equality(FirstNumber=list_5, SecondNumber="5")  # -> Equality, Inequality

equals_4 = Equality(FirstNumber=list_5, SecondNumber="2")  # -> Equality, Inequality

equals_5 = Equality(FirstNumber=list_5, SecondNumber="3")  # -> Equality, Inequality

# ----
# Dam configuration
dam_axis_5 = RemoteReceiver(dam_axis)

powerhouse_pt = RemoteSender(reference_points_ph)
point_upstream = RemoteSender(pt)
line_river = RemoteSender(pipeline_3)

point_upstream_2 = RemoteReceiver(point_upstream)
crv_cp = CurveClosestPoint(Point=point_upstream_2, Curve=dam_axis_5)  # -> Point, Parameter, Distance
vec2pt = Vector2Pt(PointA=point_upstream_2, PointB=crv_cp.Point, Unitize=False)  # -> Vector, Length

vector_waterflow = RemoteSender(vec2pt.Vector)

# ---- group: Select water upstream side and put water level
point_upstream_3 = RemoteReceiver(point_upstream)
brep_cp = BrepClosestPoint(Point=point_upstream_3, Brep=srfsplit)  # -> Point, Normal, Distance
dist = Distance(PointA=point_upstream_3, PointB=brep_cp.Point)
sort = SortList(Keys=dist, ValuesA=srfsplit)  # -> Keys, ValuesA
item_4 = ListItem(List=sort.ValuesA, Index=0, Wrap=True)
project_3 = Project(Geometry=item_4, Plane=pt_2)  # -> Geometry, Transform

# ----
vector_waterflow_2 = RemoteReceiver(vector_waterflow)

# ----
# Pre-volume Water
Z_3 = UnitZ(Factor=elevation_water_2)
# Rough volume of water according to Dam height and position
extr = Extrude(Base=project_3.Geometry, Direction=Z_3)
move_4 = Move(Geometry=lowest_point_dam_section_2, Motion=Z_3)  # -> Geometry, Transform
split_5 = SplitBrep(Brep=extr, Cutter=brep_terrain_3)
pt_4 = Point(move_4.Geometry)
colom = CollisionOneMany(Collider=pt_4, Obstacles=split_5)  # -> Collision, Index
item_5 = ListItem(List=split_5, Index=colom.Index, Wrap=True)
geo_5 = Geometry(item_5)
split_6 = SplitBrep(Brep=brep_terrain_3, Cutter=geo_5)
item_6 = ListItem(List=split_6, Index=0, Wrap=True)  # -> Item, Item1, Item2
geo_6 = Geometry(item_6.Item1)
join = BrepJoin(Breps=flatten([geo_5, geo_6]))  # -> Breps, Closed

point_upstream_4 = RemoteReceiver(point_upstream)
brep_2 = Brep(join.Breps)

# ----
# See upstream point
vector_waterflow_3 = RemoteReceiver(vector_waterflow)  # disabled
point_upstream_5 = RemoteReceiver(point_upstream)  # disabled
objfromgroup_2 = GetObjectsInGroup()
move_5 = Move(Geometry=point_upstream_5, Motion=Z_2)  # -> Geometry, Transform; disabled
swatch_4 = ColourSwatch(SwatchColor=RGB(68, 57, 102))  # disabled
number_slider_5 = Slider(3, range=0..10)  # disabled
move_6 = Move(Geometry=point_upstream_5, Motion=Z_2)  # -> Geometry, Transform; disabled
number_slider_6 = Slider(227.5, range=0..1000)  # disabled
panel_31 = Panel("Upstream")  # disabled
vdisex = VectorDisplayEx(Point=move_6.Geometry, Vector=vector_waterflow_3, Colour=swatch_4, Width=number_slider_5)  # disabled
tag = TextTag3D(Location=move_5.Geometry, Text=panel_31, Size=number_slider_6, Colour=swatch_4, Justification=7)  # disabled

onoff = EnableDisableObject(
    Objects=objfromgroup_2,
    Enabled=viz_direction_river_2,
    AllObjects_Object=[point_upstream_5, vdisex, number_slider_5, vector_waterflow_3, swatch_4, panel_31, tag, number_slider_6, move_5, move_6])

dam_axis_6 = RemoteReceiver(dam_axis)  # disabled
line_river_2 = RemoteReceiver(line_river)  # disabled

powerhouse_pt_2 = RemoteReceiver(powerhouse_pt)
powerhouse_pt_3 = RemoteReceiver(powerhouse_pt)

# ---- group: defining a power house point from the distance from a dam
Z_4 = UnitZ(Factor=1)  # disabled
extr_2 = Extrude(Base=dam_axis_6, Direction=Z_4)  # disabled
split_7 = SplitWithBrep(Curve=line_river_2, Brep=extr_2)  # -> Curve, Points; disabled
point_upstream_6 = RemoteReceiver(point_upstream)  # disabled
end = EndPoints(Curve=split_7.Curve)  # -> Start, End; disabled
dist_2 = Distance(PointA=end.Start, PointB=point_upstream_6)  # disabled
rev = ReverseList(List=dist_2)  # disabled
item_7 = ListItem(List=rev, Index=0, Wrap=True)  # disabled
mindex_2 = MemberIndex(Set=dist_2, Member=item_7)  # -> Index, Count; disabled
mesh_terrain_2 = RemoteReceiver(mesh_terrain)  # disabled
toggle_6 = BooleanToggle(True)  # disabled
item_8 = ListItem(List=split_7.Curve, Index=mindex_2.Index, Wrap=True)  # disabled
eval = EvaluateLength(Curve=item_8, Normalized=toggle_6)  # -> Point, Tangent, Parameter; disabled

# ---- group: power house static point
pt_5 = Point(powerhouse_pt_2)

# ---- group: defining a power house point from the distance from a dam / Power_house_point
python = GhPythonScript(point=eval.Point, mesh=mesh_terrain_2)  # -> out, simplify(a); disabled
# ---------- python: Python ----------
__author__ = "cna"
__version__ = "2022.02.03"

import rhinoscriptsyntax as rs


#Project down...
a = rs.ProjectPointToMesh(point, mesh, (0,0,1))
# ---------- end python ----------

# ---- group: VIZ / house visualisation
number_slider_7 = Slider(20, range=0..100)
pdecon = Deconstruct(Point=python.a)  # -> XComponent, YComponent, ZComponent
addition = Addition(A=pdecon.XComponent, B=number_slider_7)
addition_2 = Addition(A=pdecon.YComponent, B=number_slider_7)
addition_3 = Addition(A=pdecon.ZComponent, B=number_slider_7)
pt_6 = ConstructPoint(XCoordinate=addition, YCoordinate=addition_2, ZCoordinate=addition_3)
box = Box2Pt(PointA=pt_6, PointB=python.a, Plane=PlaneXY(0, 0, 0))
preview = CustomPreview(Geometry=box, Material=ColourSwatch(SwatchColor=RGB(255, 242, 99)))

# ----
# AXIS LINE
levels_at_dam_height_2 = RemoteReceiver(levels_at_dam_height)
ccx = CurveCurve(CurveA=movetoplane_2.Geometry, CurveB=levels_at_dam_height_2)  # -> flatten(Points), ParamsA, ParamsB
pt_7 = Point(ccx.Points)

# ---- group: Finding the crest points
item_9 = ListItem(List=pt_7, Index=0, Wrap=True)  # -> Item, Item1

# ---- group: AXIS LINE
ln = Line(StartPoint=item_9.Item, EndPoint=item_9.Item1)

# ----
axis_line = RemoteSender(ln)

raxis_adjustments = Slider(15, range=3..15)
axis_line_2 = RemoteReceiver(axis_line)
axis_line_3 = RemoteReceiver(axis_line)

# ----
# 2. Determine radius according to L1
# Technical Memorandum No. EM36-86-68110: Determine Raxis= 0.6 L1 and round the value of Raxis up to the nearest 10 to 50 feet.
# This is the initial layout, so no need for decimal accuracy
len = Length(Curve=axis_line_3)
l1_m = Panel(len)
# ARCH DAM
panel_32 = Panel("10")
expression_3 = Expression(ft=[panel_32, "50"], Expression="ft*0.3048")
panel_33 = Panel(expression_3)
expression_4 = Expression(L1=l1_m, Expression="0.6*L1")
addition_4 = Addition(A=expression_4, B=raxis_adjustments)

axis_line_4 = RemoteReceiver(axis_line)

# ----
# 3. Create arch crest line
end_2 = EndPoints(Curve=axis_line_2)  # -> Start, End
cir = Circle(Plane=end_2.Start, Radius=addition_4)
cir_2 = Circle(Plane=end_2.End, Radius=addition_4)
movetoplane_3 = MoveToPlane(Geometry=point_upstream_4, Plane=end_2.End, Above=True, Below=True)  # -> Geometry, Transform
ccx_2 = CurveCurve(CurveA=cir, CurveB=cir_2)  # -> Points, ParamsA, ParamsB
dist_3 = Distance(PointA=ccx_2.Points, PointB=movetoplane_3.Geometry)
sort_2 = SortList(Keys=dist_3, ValuesA=ccx_2.Points)  # -> reverse(Keys), reverse(ValuesA)
item_10 = ListItem(List=sort_2.ValuesA, Index=0, Wrap=True)  # -> Item, Item1
circle = CircleCNR(Center=item_10.Item, Normal=Vector(0, 0, 1), Radius=addition_4)
ln_2 = Line(StartPoint=item_10.Item, EndPoint=item_10.Item1)
ccx_3 = CurveCurve(CurveA=axis_line_2, CurveB=circle)  # -> Points, ParamsA, ParamsB
shatter = Shatter(Curve=circle, Parameters=ccx_3.ParamsB)
colom_2 = CollisionOneMany(Collider=ln_2, Obstacles=shatter)  # -> Collision, Index
item_11 = ListItem(List=shatter, Index=colom_2.Index, Wrap=True)

geo_7 = Geometry(ccx_3.Points)

# ---- group: Axis arch Dam
# Technical Memorandum No. EM36-86-68110: This arc is the axis of the dam
# and is the upstream side of the crest
geo_8 = Geometry(item_11)

# ----
line_crest_archdam = RemoteSender(geo_8)
line_crest_archdam_2 = RemoteReceiver(line_crest_archdam)
# 1. Determine L1 with section line
axis_line_5 = RemoteReceiver(axis_line)
end_3 = EndPoints(Curve=axis_line_5)  # -> Start, End
dist_4 = Distance(PointA=end_3.Start, PointB=end_3.End)
line_crest_archdam_3 = RemoteReceiver(line_crest_archdam)
arch_l1 = RemoteSender(dist_4)

# ----
# Abutements angle check
# Technical Memorandum No. EM36-86-68110: The angle of incidence of the axis into the
# left and right abutments should be approximately equal to produce a geometrically
# symmetric dam in the canyon.
line_crest_archdam_4 = RemoteReceiver(line_crest_archdam)
levels_at_dam_height_3 = RemoteReceiver(levels_at_dam_height)

# ---- group: Vector abutements
crest_line = Geometry(line_crest_archdam_4)
end_4 = EndPoints(Curve=crest_line)  # -> Start, End
pt_8 = Point([end_4.Start, end_4.End])
crv_cp_2 = CurveClosestPoint(Point=pt_8, Curve=crest_line)  # -> Point, Parameter, Distance
eval_2 = EvaluateCurve(Curve=crest_line, Parameter=crv_cp_2.Parameter)  # -> simplify(graft(Point)), Tangent, Angle
dispatch_2 = Dispatch(List=eval_2.Tangent, DispatchPattern=[True, False])  # -> ListA, ListB
gate = StreamGate(Stream=dispatch_2.ListA, Gate=list_3)  # -> Target0, Target1
gate_2 = StreamGate(Stream=dispatch_2.ListB, Gate=list_3)  # -> Target0, Target1
neg = Negative(Value=gate_2.Target0)
neg_2 = Negative(Value=gate.Target1)
vec = Vector([gate.Target0, neg])
vec_2 = Vector([neg_2, gate_2.Target1])
amp = Amplitude(Vector=[vec, vec_2], Amplitude=Slider(47, range=0..100))  # -> simplify(graft(Vector))
vdisex_2 = VectorDisplayEx(Point=eval_2.Point, Vector=amp, Colour=RGB(0, 0, 0), Width=2)

# ----
axis_line_6 = RemoteReceiver(axis_line)
midpt = CurveMiddle(Curve=axis_line_6)
axis_line_7 = RemoteReceiver(axis_line)

# ---- group: dam middle point
pt_9 = Point(midpt)

# ---- group: distance in straight line (!) between the dam and the PH
midpt_2 = CurveMiddle(Curve=axis_line_7)
pln_2 = Plane(midpt_2)
project_4 = Project(Geometry=powerhouse_pt_3, Plane=pln_2)  # -> Geometry, Transform

# ---- group: distance in straight line (!) between the dam and the PH / L
dist_5 = Distance(PointA=midpt_2, PointB=project_4.Geometry)

# ----
axis_line_8 = RemoteReceiver(axis_line)

# ----
# Getting the correct vector of the vertical face with downstream direction
Z_5 = UnitZ(Factor=dam_height_3)
extr_3 = Extrude(Base=project_3.Geometry, Direction=Z_5)
debrep = DeconstructBrep(Brep=extr_3)  # -> Faces, Edges, Vertices
evalsrf = EvaluateSurface(Surface=reparameterize(debrep.Faces), Point="0.5,0.5")  # -> Point, Normal, UDirection, VDirection, Frame

# ---- group: Filtering which face goes downstream direction
txt_2 = Text(vector_waterflow_2)
txt_3 = Text(evalsrf.Normal)
fsim = FindSimilarMember(Data=txt_2, Set=txt_3)  # -> Hit, Index

# ---- group: Upstream side point
item_12 = ListItem(List=evalsrf.Point, Index=fsim.Index, Wrap=True)

# ----
item_13 = ListItem(List=evalsrf.Normal, Index=fsim.Index, Wrap=True)
vector_downstream = RemoteSender(item_13)

# ---- group: vector vertical face
number_slider_8 = Slider(378, range=0..1000)  # disabled
amp_2 = Amplitude(Vector=item_13, Amplitude=number_slider_8)  # disabled
vdisex_3 = VectorDisplayEx(Point=item_12, Vector=amp_2, Colour=RGB(0, 0, 0), Width=2)  # disabled

# ----
vector_downstream_2 = RemoteReceiver(vector_downstream)

# ----
# Top
# Top - A2 Volume
# Top - A1 Volume
panel_34 = Panel("2")
multiplication = Multiplication(A=dam_height_4, B=panel_34)
atan = ArcTangent(Value=downstream_face_angle_ratio_1)
end_5 = EndPoints(Curve=axis_line_4)  # -> Start, End
line = LineSDL(Start=end_5.Start, Direction="{0,0,-1}", Length=multiplication)
rotax = RotateAxis(Geometry=line, Angle=atan, Axis=axis_line_4)  # -> Geometry, Transform
pt_10 = Point(end_5.Start)
end_6 = EndPoints(Curve=rotax.Geometry)  # -> Start, End
end_7 = EndPoints(Curve=line)  # -> Start, End
amp_3 = Amplitude(Vector=vector_downstream_2, Amplitude=width_crest_2)
ln_3 = Line(StartPoint=end_7.End, EndPoint=end_6.End)
move_7 = Move(Geometry=pt_10, Motion=amp_3)  # -> Geometry, Transform
join_2 = JoinCurves(Curves=flatten([line, rotax.Geometry, ln_3]), Preserve=False)
swp1 = Sweep1(Rail=axis_line_4, Sections=join_2, Miter=1)
project_5 = ProjectPoint(Point=move_7.Geometry, Direction="0,0,-1", Geometry=join_2)  # -> Point, Index
cap = CapHoles(Brep=swp1)
pline = PolyLine(Vertices=flatten([pt_10, move_7.Geometry, project_5.Point]), Closed=True)
swp1_2 = Sweep1(Rail=axis_line_4, Sections=pline, Miter=1)
splitmul = SplitBrepMultiple(Brep=cap, Cutters=brep_terrain_4)
cap_2 = CapHoles(Brep=swp1_2)
item_14 = ListItem(List=splitmul, Index=0, Wrap=True)
split_8 = SplitBrep(Brep=brep_terrain_4, Cutter=item_14)
item_15 = ListItem(List=split_8, Index=0, Wrap=True)  # -> Item, Item1
geo_9 = Geometry(item_15.Item1)
join_3 = BrepJoin(Breps=flatten([item_14, geo_9]))  # -> Breps, Closed
top_concretedam = Geometry(join_3.Breps)

# ----
# Foundation
number_slider_9 = Slider(2, range=0..10)
division_2 = Division(A=offset_foundation_2, B=number_slider_9)
neg_3 = Negative(Value=division_2)
offcrv = OffsetCurve(Curve=geo_9, Plane=PlaneXY(0, 0, 0), Distance=neg_3, BothSides=0, Kinks=3, CapType=1)
disc = Discontinuity(Curve=offcrv, Level=1)  # -> Points, Parameters
shatter_2 = Shatter(Curve=offcrv, Parameters=disc.Parameters)
txt_4 = Text(shatter_2)
mindex_3 = MemberIndex(Set=txt_4, Member="Line-like Curve")  # -> Index, Count
cull_i_2 = CullIndex(List=shatter_2, Indices=mindex_3.Index, Wrap=True)
loft = Loft(Curves=cull_i_2, Options={Adjust=True, Closed=False, LoftEnds=0, LoftSimp=2, LoftType=0, Rebuild=10, Refit=0.01})
neg_4 = Negative(Value=offset_foundation_2)
Z_6 = UnitZ(Factor=neg_4)
extr_4 = Extrude(Base=loft, Direction=Z_6)
base_archdam = Geometry(extr_4)

geo_concretedam_top = RemoteSender(top_concretedam)

# ----
# Final volume
join_4 = BrepJoin(Breps=flatten([top_concretedam, base_archdam, cap_2]))  # -> Breps, Closed
sunion = SolidUnion(Breps=join_4.Breps)

geo_concretedam_base = RemoteSender(base_archdam)
geo_concretedam_top_2 = RemoteReceiver(geo_concretedam_top)
geo_concretedam_base_2 = RemoteReceiver(geo_concretedam_base)
geo_concretedam = RemoteSender(sunion)
geo_concretedam_2 = RemoteReceiver(geo_concretedam)
vector_downstream_3 = RemoteReceiver(vector_downstream)  # disabled
amp_4 = Amplitude(Vector=vector_downstream_3, Amplitude=number_slider_2)  # disabled
move_8 = Move(Geometry=pt_3, Motion=amp_4)  # -> Geometry, Transform; disabled
ln_4 = Line(StartPoint=pt_3, EndPoint=move_8.Geometry)  # disabled

# ---- group: View Plane - Check if the direction is correct
# SECTION CUT
crv = Curve(ln_4)  # disabled
number_slider_10 = Slider(-20, range=-21..-20)  # disabled
number_slider_11 = Slider(86, range=0..100)  # disabled
Z_7 = UnitZ(Factor=number_slider_10)  # disabled
move_9 = Move(Geometry=crv, Motion=Z_7)  # -> Geometry, Transform; disabled
Z_8 = UnitZ(Factor=number_slider_11)  # disabled
extr_5 = Extrude(Base=move_9.Geometry, Direction=Z_8)  # disabled
midpt_3 = CurveMiddle(Curve=crv)  # disabled
flip = Flip(Surface=extr_5)  # -> Surface, Result; disabled

# ----
offset = OffsetCurve(Curve=crv, Distance=number_slider_3, Corners=1)  # disabled
midpt_4 = CurveMiddle(Curve=offset)  # disabled
camera = CameraCrane(Location=midpt_4, Target=midpt_3, Perspective=panel_30, View=number_slider_4, Refresh=button_3)  # -> Camera, Target, Lens, Up, HorizontalViewAngle, VerticalViewAngle, ScreenRatio, Frame; disabled

panel_35 = Panel("0.5,0.5")  # disabled
evalsrf_2 = EvaluateSurface(Surface=reparameterize(flip.Surface), Point=panel_35)  # -> Point, Normal, UDirection, VDirection, Frame; disabled
number_slider_12 = Slider(28, range=0..100)  # disabled
amp_5 = Amplitude(Vector=evalsrf_2.Normal, Amplitude=number_slider_12)  # disabled
neg_5 = Negative(Value=amp_5)  # disabled
move_10 = Move(Geometry=crv, Motion=neg_5)  # -> Geometry, Transform; disabled
extr_6 = Extrude(Base=move_10.Geometry, Direction=Z_7)  # disabled
geo_aushub = RemoteReceiver()  # disabled
bbx_2 = BrepBrep(BrepA=geo_aushub, BrepB=extr_6)  # -> Curves, Points; disabled
rdiff = RegionDifference(CurvesA=extr_6, CurvesB=bbx_2.Curves)  # disabled
brep_3 = Brep(rdiff)  # disabled

# ---- group: VIZ
relay = Relay()
swatch_5 = ColourSwatch(SwatchColor=RGB(201, 201, 201))
medges = MeshEdges(Mesh=relay)  # -> NakedEdges, InteriorEdges, NonManifoldEdges
preview_2 = CustomPreview(Geometry=brep_terrain_5, Material=ColourSwatch(SwatchColor=RGBA(130, 117, 101, 0)))
preview_3 = CustomPreview(Geometry=medges.NakedEdges, Material=ColourSwatch(SwatchColor=RGB(0, 255, 85)))

# ----
# Viz dimensions
objfromgroup_3 = GetObjectsInGroup()
number_slider_13 = Slider(1, range=0..10)  # disabled
swatch_6 = ColourSwatch(SwatchColor=RGB(0, 0, 0))  # disabled

onoff_2 = EnableDisableObject(
    Objects=objfromgroup_3,
    Enabled=viz_dimensions_2,
    AllObjects_Object=[dimensions_check_3, previewlw_5, number_slider_13, swatch_6])

# ----
# 4. Figure L2
darc = DeconstructArc(Arc=line_crest_archdam_2)  # -> flatten(BasePlane), Radius, Angle

# ---- group: Centrifugal vector
pt_11 = Point(darc.BasePlane)

# ----
# Preliminary layout of concrete arch dams (USBR)
# Topographic deiminesions necessary to
# compute thicknesses, projections, and
# volume are:
# - structural height (H)
# - horizontal distances between abutments;
#      - including estimated excavation to sound rock at crest elevation (L1)
#      - and 15 % of H above base (L2)
# Definitions: H = structural height
# Tc = thickness at crest
# Tb = thickness at base
# T_0.45H = thickness of crown cantilever at 0.45H above base (T0.45H)
# USP = upstream projection
# DSP = downestream projection
# L1 = straight line distance at crest elevation between abutmenets assumed excavated to sound rock
# L2 = straight line distance, at 0.15H above base, between abutments assumed excavated to sound rock
# V = estimated volume of dam
# Formulas - conservative as compared with values computed more precisely (in feet)
# at crest:
# at  base
# at 0.45H
arch_l1_2 = RemoteReceiver(arch_l1)
arch_l1_current_m = Panel(arch_l1_2)
pctoftinlen = ToFeetInchLength(Quantity=arch_l1_current_m, Precision=64, LastSaveLocalization="neutral,N")
pcdeconfeetinch = DeconstructFeetInchLength(Quantity=pctoftinlen, LastSaveLocalization="neutral,N")  # -> flatten(AmountInFeet), FeetInteger, Inch, InchInteger, InchFractionNumerator, InchFractionDenominator, Error
l1_feet = Panel(pcdeconfeetinch.AmountInFeet)
structural_height_h_m = Slider(35, range=35..365)
l1_m_2 = Slider(35, range=35..1800)
l2_m = Slider(35, range=35..350)
expression_5 = Expression(L1=l1_feet, Expression="0.6*L1")
panel_36 = Panel("USPcrest = 0.0")
panel_37 = Panel("DSPcrest = Tc")
panel_38 = Panel(" 1 foot = 0.3048 m")

# ----
# Technical Memorandum No. EM36-86-68110: Select the lowest arch elevation starting at about 15% H. Then between 15% H and the crest, try to select 6 to 8 arches evenly spaced vertically and rounded to nearest contour
# elevation. Even spacing arches permit best evaluation of the ADSAS results.
# E. Goulas: According to the Engineer Manual [1], the dam is divided into 5 to 10 evenly spaced horizontal arches and their respective parabolas are computed. They should be spaced not less than 3.048 meters (10 feet) nor more than 30.48 meters (100 feet) apart. The lowest parabola should be 0.15H to 0.20H above the base.
# 5. Section points - based on the equations
# At Base
# At Crest:
# At 0.45H
panel_39 = Panel("0.45")
number_slider_14 = Slider(0.5, range=0..1)
neg_6 = Negative(Value=number_slider_14)
Z_9 = UnitZ(Factor=neg_6)
ext = ExtendCurve(Curve=line_crest_archdam_3, Type=1, Start=number_slider_14, End=number_slider_14)
move_11 = Move(Geometry=brep_terrain_6, Motion=Z_9)  # -> Geometry, Transform
flip_2 = FlipCurve(Curve=ext)  # -> Curve, Flag

# ---- group: Foundation
# 6. Foundation
# E. Goulas: A reasonable value for the excavation can be from 10 to 30 meters (good rock conditions with minor weathering and a canyon profile ideally suited to an arch dam) in the lateral direction
# Technical Memorandum No. EM36-86-68110: Determine the base elevation of the dam. This location is to sound rock and, if that distance is unknown, can be assumed to be about 25 feet below lowest contour in
# the river bed
panel_40 = Panel("25")
offset_foundation_4 = RemoteReceiver(offset_foundation)
expression_6 = Expression(ft=panel_40, Expression="ft*0.3048")
brep_terrain_7 = RemoteReceiver(brep_terrain)
panel_41 = Panel(expression_6)
brep_terrain_8 = RemoteReceiver(brep_terrain)
amp_6 = Amplitude(Vector="0,0,-1", Amplitude=offset_foundation_4)
move_12 = Move(Geometry=brep_terrain_8, Motion=amp_6)  # -> Geometry, Transform
brep_terrain_excavation_depth = RemoteSender(move_12.Geometry)
division_3 = Division(A=offset_foundation_4, B=Slider(2, range=0..10))
neg_7 = Negative(Value=division_3)
neg_8 = Negative(Value=offset_foundation_4)
Z_10 = UnitZ(Factor=neg_8)

# ----
brep_terrain_excavation_depth_2 = RemoteReceiver(brep_terrain_excavation_depth)
brep_terrain_excavation_depth_3 = RemoteReceiver(brep_terrain_excavation_depth)

# ---- group: Lowest point (Base - middle section)
project_6 = Project(Curve=line_crest_archdam_2, Brep=brep_terrain_excavation_depth_2, Direction=Vector(0, 0, 1))

# ----
x_tremez_2 = Extremes(Curve=project_6, Plane=PlaneXY(0, 0, 0))  # -> Highest, Lowest

# ---- group: Lowest point (Base - middle section) (continued)
pt_12 = Point(x_tremez_2.Lowest)

# ----
project_7 = Project(Geometry=pt_12, Plane=darc.BasePlane)  # -> Geometry, Transform
ln_5 = Line(StartPoint=pt_12, EndPoint=project_7.Geometry)
eval_3 = EvaluateCurve(Height=reparameterize(ln_5), Point_at_015H="0.15")  # -> Point, Tangent, Angle
len_2 = Length(Curve=ln_5)

# ---- group: Centrifugal vector (continued)
pt_13 = Point(project_7.Geometry)
vec2pt_2 = Vector2Pt(PointA=pt_13, PointB=pt_11, Unitize=False)  # -> Vector, Length

# ----
vec2pt_3 = Vector2Pt(PointA=pt_13, PointB=eval_3.Point, Unitize=False)  # -> Vector, Length
move_13 = Move(Geometry=line_crest_archdam_2, Motion=vec2pt_3.Vector)  # -> Geometry, Transform
bcx = BrepCurve(Brep=brep_terrain_excavation_depth_3, Curve=move_13.Geometry)  # -> Curves, flatten(Points)
crv_cp_3 = CurveClosestPoint(Point=bcx.Points, Curve=move_13.Geometry)  # -> Point, Parameter, Distance
shatter_3 = Shatter(Curve=move_13.Geometry, Parameters=crv_cp_3.Parameter)
colom_3 = CollisionOneMany(Collider=eval_3.Point, Obstacles=shatter_3)  # -> Collision, Index
item_16 = ListItem(List=shatter_3, Index=colom_3.Index, Wrap=True)
end_8 = EndPoints(Curve=item_16)  # -> Start, End
dist_6 = Distance(PointA=end_8.Start, PointB=end_8.End)

centrifugal_vector = RemoteSender(vec2pt_2.Vector)
arch_dam_height = RemoteSender(len_2)
arch_l2 = RemoteSender(dist_6)
centrifugal_vector_2 = RemoteReceiver(centrifugal_vector)

arch_dam_height_2 = RemoteReceiver(arch_dam_height)
arch_l2_2 = RemoteReceiver(arch_l2)
arch_l2_current_m = Panel(arch_l2_2)
meter = Panel(arch_dam_height_2)
pctoftinlen_2 = ToFeetInchLength(Quantity=arch_l2_current_m, Precision=64, LastSaveLocalization="neutral,N")
pctoftinlen_3 = ToFeetInchLength(Quantity=meter, Precision=64, LastSaveLocalization="neutral,N")
pcdeconfeetinch_2 = DeconstructFeetInchLength(Quantity=pctoftinlen_2, LastSaveLocalization="neutral,N")  # -> flatten(AmountInFeet), FeetInteger, Inch, InchInteger, InchFractionNumerator, InchFractionDenominator, Error
pcdeconfeetinch_3 = DeconstructFeetInchLength(Quantity=pctoftinlen_3, LastSaveLocalization="neutral,N")  # -> flatten(AmountInFeet), FeetInteger, Inch, InchInteger, InchFractionNumerator, InchFractionDenominator, Error
feet = Panel(pcdeconfeetinch_3.AmountInFeet)
l2_feet = Panel(pcdeconfeetinch_2.AmountInFeet)
expression_7 = Expression(H=feet, L1=l1_feet, L2=l2_feet, Expression="0.000002*(H²)*L2*(((H+0.8*L1)²)/(L1-L2))+0.0004*H*L1*(H+1.1*L1)")
expression_8 = Expression(H=feet, L1=l1_feet, Expression="0.01*(H + 1.2*L1)")
expression_9 = Expression(H=feet, L1=l1_feet, L2=l2_feet, Expression="(0.0012*H*L1*L2*((H/400)^(H/400)))^(⅓)")
expression_10 = Expression(Tb=expression_9, Expression="0.95*Tb")
expression_11 = Expression(Tb=expression_9, Expression="0.33*Tb")
expression_12 = Expression(Tb=expression_9, Expression="0.67*Tb")
expression_13 = Expression(ft=expression_8, Expression="ft*0.3048")
expression_14 = Expression(ft=expression_12, Expression="ft*0.3048")
expression_15 = Expression(ft=expression_11, Expression="ft*0.3048")
expression_16 = Expression(ft=expression_10, Expression="ft*0.3048")
arch_tc = RemoteSender(expression_13)
arch_usp_at_045h = RemoteSender(expression_16)
arch_usp_base = RemoteSender(expression_14)
arch_dsp_base = RemoteSender(expression_15)

arch_dsp_base_2 = RemoteReceiver(arch_dsp_base)
arch_usp_base_2 = RemoteReceiver(arch_usp_base)
arch_usp_at_045h_2 = RemoteReceiver(arch_usp_at_045h)
arch_tc_2 = RemoteReceiver(arch_tc)

eval_4 = EvaluateCurve(Height=reparameterize(ln_5), Point_at_015H=panel_39)  # -> Point, Tangent, Angle
neg_9 = Negative(Value=centrifugal_vector_2)
neg_10 = Negative(Value=centrifugal_vector_2)
amp_7 = Amplitude(Vector=centrifugal_vector_2, Amplitude=arch_tc_2)
amp_8 = Amplitude(Vector=neg_9, Amplitude=arch_usp_at_045h_2)
amp_9 = Amplitude(Vector=neg_10, Amplitude=arch_usp_base_2)
amp_10 = Amplitude(Vector=centrifugal_vector_2, Amplitude=arch_dsp_base_2)
move_14 = Move(Geometry=pt_12, Motion=amp_10)  # -> Geometry, Transform
move_15 = Move(Geometry=pt_12, Motion=amp_9)  # -> Geometry, Transform
move_16 = Move(Geometry=project_7.Geometry, Motion=amp_7)  # -> Geometry, Transform
move_17 = Move(Geometry=eval_4.Point, Motion=amp_8)  # -> Geometry, Transform
centrifugal_vector_3 = RemoteReceiver(centrifugal_vector)
pt_at_0_45h = Point(move_17.Geometry)
pt_at_crest = Point(project_7.Geometry)
pt_at_base = Point(move_15.Geometry)
pt_at_0_45h_2 = Point(eval_4.Point)
pt_at_crest_2 = Point(move_16.Geometry)
pt_at_base_2 = Point(move_14.Geometry)
arch_tc_3 = RemoteReceiver(arch_tc)
arc = Arc3Pt(PointA=pt_at_crest, PointB=pt_at_0_45h, PointC=pt_at_base)  # -> Arc, Plane, Radius
arc_2 = Arc3Pt(PointA=pt_at_crest_2, PointB=pt_at_0_45h_2, PointC=pt_at_base_2)  # -> Arc, Plane, Radius
ln_6 = Line(StartPoint=pt_at_crest_2, EndPoint=pt_at_crest)
ln_7 = Line(StartPoint=pt_at_base_2, EndPoint=pt_at_base)
division_4 = Division(A=arch_tc_3, B="2")
amp_11 = Amplitude(Vector=centrifugal_vector_3, Amplitude=division_4)
join_5 = JoinCurves(Curves=flatten([arc_2.Arc, ln_6, ln_7, arc.Arc]), Preserve=False)
neg_11 = Negative(Value=amp_11)
move_18 = Move(Geometry=join_5, Motion=neg_11)  # -> Geometry, Transform
brep_4 = Brep(move_18.Geometry)
swp1_3 = Sweep1(Rail=flip_2.Curve, Sections=brep_4, Miter=1)
swp1_4 = Sweep1(Rail=ext, Sections=brep_4, Miter=1)
brep_5 = Brep([swp1_4, swp1_3])
capex = CapHolesEx(Brep=brep_5)  # -> Brep, Caps, Solid
sunion_2 = SolidUnion(Breps=capex.Brep)
splitmul_2 = SplitBrepMultiple(Brep=sunion_2, Cutters=move_11.Geometry)

# ---- group: Foundation (continued)
bbx_3 = BrepBrep(BrepA=sunion_2, BrepB=brep_terrain_7)  # -> Curves, Points
offcrv_2 = OffsetCurve(Curve=bbx_3.Curves, Plane=PlaneXY(0, 0, 0), Distance=neg_7, BothSides=0, Kinks=0, CapType=1)
patch = Patch(Curves=offcrv_2, Spans=20, Flexibility=1, Trim=True)
extr_7 = Extrude(Base=patch, Direction=Z_10)
base_archdam_2 = Geometry(extr_7)

# ----
geo_archdam_base = RemoteSender(base_archdam_2)
geo_archdam_base_2 = RemoteReceiver(geo_archdam_base)
# Dam foundation
filter = StreamFilter(Gate=dam_type_4, Stream0=geo_concretedam_base_2, Stream1=geo_archdam_base_2)
volume = Volume(Geometry=filter, UseTasks=False)  # -> Volume, Centroid
round = Round(Number=volume.Volume)  # -> Nearest, Floor, Ceiling
dam_volume_base = RemoteSender(round.Nearest)
dam_volume_base_2 = RemoteReceiver(dam_volume_base)
preview_4 = CustomPreview(Geometry=filter, Material=ColourSwatch(SwatchColor=RGB(164, 161, 212)))

item_17 = ListItem(List=splitmul_2, Index=0, Wrap=True)

split_9 = SplitBrep(Brep=move_11.Geometry, Cutter=item_17)

item_18 = ListItem(List=split_9, Index=0, Wrap=True)  # -> Item, Item1

geo_10 = Geometry(item_18.Item1)

join_6 = BrepJoin(Breps=flatten([item_17, geo_10]))  # -> Breps, Closed

top_archdam = Geometry(join_6.Breps)

geo_archdam_top = RemoteSender(top_archdam)
geo_archdam_top_2 = RemoteReceiver(geo_archdam_top)
# Dam top
filter_2 = StreamFilter(Gate=dam_type_4, Stream0=geo_concretedam_top_2, Stream1=geo_archdam_top_2)
volume_2 = Volume(Geometry=filter_2, UseTasks=False)  # -> Volume, Centroid
round_2 = Round(Number=volume_2.Centroid)  # -> Nearest, Floor, Ceiling
dam_volume_top = RemoteSender(round_2.Nearest)
dam_volume_top_2 = RemoteReceiver(dam_volume_top)
merge_7 = Merge(Data1=flatten(dam_volume_base_2), Data2=flatten(dam_volume_top_2), Data3=flatten("0"), Data4=flatten("0"))
multiplication_2 = Multiplication(A=merge_7, B=merge_6)
entwine = Entwine(Branch00=panel_28, Branch01=merge_7, Branch02=merge_6, Branch03=multiplication_2, FlattenInputs=True)
data_series = UIDataSeries(Label=graft(panel_27), Data=entwine, Type=5)  # -> flatten(DataSeries)
grid_chart_2 = UiGridChart(Element=grid_chart, DataSeries=data_series, Titles=True)
preview_5 = CustomPreview(Geometry=filter_2, Material=ColourSwatch(SwatchColor=RGB(115, 109, 209)))
addition_5 = Addition(A=volume_2.Volume, B=volume.Volume)
dam_volume = RemoteSender(addition_5)
join_7 = BrepJoin(Breps=flatten([base_archdam_2, top_archdam]))  # -> Breps, Closed
sunion_3 = SolidUnion(Breps=join_7.Breps)
geo_archdam = RemoteSender(sunion_3)
geo_archdam_2 = RemoteReceiver(geo_archdam)
filter_3 = StreamFilter(Gate=dam_type_3, Stream0=geo_concretedam_2, Stream1=geo_archdam_2)
brep_6 = Brep(filter_3)
c_script_2 = CSharpScript(bListFrom=brep_2, flip=toggle_5, bListTo=brep_6)  # -> out, solidDifferenceBrepList; inputs bListFrom: list of Brep, flip: Boolean, bListTo: list of Brep
# ---------- c_script_2: C# ----------
    bListFrom = bListFrom.Where(x => x != null && x.IsValid && x.IsSolid).ToList();
    if(!bListFrom.Any()) return;

    bListTo = bListTo.Where(x => x != null && x.IsValid && x.IsSolid).ToList();
    if(!bListTo.Any()) return;
    double tol = RhinoDoc.ActiveDoc.ModelAbsoluteTolerance;

    List<Brep> bDiffList = new List<Brep>();
    Print(" ");
    Print("Working: {0} From against: {1} To breps", bListFrom.Count, bListTo.Count);
    Print(" ");

    for(int j = 0; j < bListFrom.Count;j++){
      Brep brep = bListFrom[j];
      if(flip)brep.Flip();
      for(int i = 0; i < bListTo.Count;i++){
        Brep b = bListTo[i];
        try{
          brep = Brep.CreateBooleanDifference(brep, b, tol)[0];
          Print("Diff at: {0}, {1} is OK", j, i);
        }
        catch{Print("Diff at: {0}, {1} failed (or breps are apart)", j, i);}
      }
      bDiffList.Add(brep);
    }
    solidDifferenceBrepList = bDiffList;

    Print(" ");
    for(int i = 0; i < bDiffList.Count;i++){
      Brep b = bDiffList[i];
      Print("Result at: {0} has: {1} faces", i, b.Faces.Count);
    }
# ---------- end c_script_2 ----------
volume_3 = Volume(Geometry=c_script_2.solidDifferenceBrepList)  # -> Volume, Centroid
nullrep = ReplaceNulls(Items=volume_3.Volume, Replacements=0)  # -> Items, Count
ma = MassAddition(Input=flatten(nullrep.Items))  # -> Result, PartialResults

# ---- group: VIZ (continued)
geo_11 = Geometry(c_script_2.solidDifferenceBrepList)
preview_6 = CustomPreview(Geometry=geo_11, Material=ColourSwatch(SwatchColor=RGBA(196, 213, 255, 194)))

# ----
panel_42 = Panel(ma.Result)
dam_volume_2 = RemoteReceiver(dam_volume)

# ---- group: results / data in right formatting
num_4 = Number(panel_42)
division_5 = Division(A=num_4, B=1000000)
roundd = RoundToDecimalPlace(NumberX=division_5, DecimalPlace=1, RoundType=0)  # -> Rounded, Difference

num_5 = Number(dam_volume_2)
division_6 = Division(A=num_5, B=1000000)
roundd_2 = RoundToDecimalPlace(NumberX=division_6, DecimalPlace=1, RoundType=0)  # -> Rounded, Difference

# ---- group: Level vector
geo_12 = Geometry(levels_at_dam_height_3)
pt_14 = Point(graft(pt_8))
number_slider_15 = Slider(75, range=0..100)
crv_cp_4 = CurveClosestPoint(Point=pt_14, Curve=geo_12)  # -> Point, simplify(Parameter), Distance
addition_6 = Addition(A=crv_cp_4.Parameter, B=number_slider_15)
subtraction_2 = Subtraction(A=crv_cp_4.Parameter, B=number_slider_15)
shatter_4 = Shatter(Curve=geo_12, Parameters=[addition_6, subtraction_2])
dispatch_3 = Dispatch(List=shatter_4, DispatchPattern=[True, False])  # -> ListA, ListB
level_at_parameter_75_to_75_from_dam_end = Geometry(dispatch_3.ListB)  # "Level at parameter -75 to +75 from dam endpoints"
end_9 = EndPoints(Curve=level_at_parameter_75_to_75_from_dam_end)  # -> simplify(Start), simplify(End)
pt_15 = Point(simplify(pt_14))
pt_16 = Point([end_9.Start, end_9.End, pt_15])
panel_43 = Panel("""2
2""")

# ---- group: Level vector / Average level line
fline = FitLine(Points=pt_16)

# ---- group: Level vector (continued)
midpt_5 = CurveMiddle(Curve=fline)
vec2pt_4 = Vector2Pt(PointA=midpt_5, PointB=pt_15, Unitize=False)  # -> Vector, Length

# ---- group: Level vector / Average level line aligned with crest
move_19 = Move(Geometry=fline, Motion=vec2pt_4.Vector)  # -> Geometry, Transform

# ---- group: Level vector (continued)
midpt_6 = CurveMiddle(Curve=move_19.Geometry)
end_10 = EndPoints(Curve=move_19.Geometry)  # -> Start, End
geo_13 = Geometry(end_10.Start)
vec2pt_5 = Vector2Pt(PointA=midpt_6, PointB=geo_13, Unitize=False)  # -> Vector, Length
dash = DashPattern(Curve=move_19.Geometry, Pattern=panel_43)  # -> Dashes, Gaps
amp_12 = Amplitude(Vector=vec2pt_5.Vector, Amplitude=Slider(47, range=0..100))
vdisex_4 = VectorDisplayEx(Point=midpt_6, Vector=amp_12, Colour=RGB(0, 0, 0), Width=2)
previewlw_4 = CustomPreviewLineweights(
    Geometry=dash.Dashes,
    Shader=ColourSwatch(SwatchColor=RGB(10, 166, 155)),
    Thickness=Slider(4, range=0..10),
    Absolute=False)

# ----
vec2pt_6 = Vector2Pt(PointA=midpt_6, PointB=end_10.End, Unitize=False)  # -> Vector, Length

# ---- group: Angle visualization
move_20 = Move(Geometry=eval_2.Point, Motion=amp)  # -> Geometry, Transform
angle = Angle(VectorA=vec2pt_6.Vector, VectorB=amp)  # -> Angle, Reflex
angle_2 = Angle(VectorA=vec2pt_5.Vector, VectorB=amp)  # -> Angle, Reflex
deg = Degrees(Radians=angle_2.Angle)
panel_44 = Panel(deg)

# ----
geo_14 = Geometry(end_10.End)
angulardim = DefineAngularDimension(Origin=midpt_6, Point1=geo_13, Point2=move_20.Geometry, Offset=number_slider, DimensionStyle=list_4)
angulardim_2 = DefineAngularDimension(Origin=midpt_6, Point1=move_20.Geometry, Point2=geo_14, Offset=number_slider, DimensionStyle=list_4)
deg_2 = Degrees(Radians=angle.Angle)
dimensions_check_2 = RemoteSender([angulardim_2, angulardim])

dimensions_check_3 = RemoteReceiver([dimensions_check_2, dimensions_check])  # disabled
previewlw_5 = CustomPreviewLineweights(Geometry=dimensions_check_3, Shader=swatch_6, Thickness=number_slider_13, Absolute=False)  # disabled

panel_45 = Panel(deg_2)

python_2 = GhPythonScript(river_discharge=num_3, eco_discharge=num_2, design_discharge=num)  # -> out, a; inputs river_discharge: list
# ---------- python_2: Python ----------
__author__ = "Kona"
__version__ = "2022.03.25"

import rhinoscriptsyntax as rs

e = eco_discharge
a1 = []

for i in range (len(river_discharge)):
    print i
    if float(river_discharge[i]) > e:
        print river_discharge[i],e,True
        result = float(river_discharge[i]) - e
        a1.append(result)
    else:
        a1.append("0")

d = design_discharge
a = []

for i in range (len(a1)):
    if float(a1[i]) > d:
        result = d
        a.append(result)
    else:
        a.append(a1[i])
# ---------- end python_2 ----------
discharge_used_m3_s = Panel(python_2.a)
i_energy_dt_2 = RemoteReceiver(i_energy_dt)

# ----
# ENERGY CALCULATION
pdecon_2 = Deconstruct(Point=pt_9)  # -> XComponent, YComponent, flatten(ZComponent)
pdecon_3 = Deconstruct(Point=pt_5)  # -> XComponent, YComponent, flatten(ZComponent)
round_3 = Round(Number=pdecon_2.ZComponent)  # -> Nearest, Floor, Ceiling
subtraction_3 = Subtraction(A=pdecon_2.ZComponent, B=freeboard_2)
round_4 = Round(Number=pdecon_3.ZComponent)  # -> Nearest, Floor, Ceiling
ph_elevation = RemoteSender(round_4.Nearest)
crest_elevation = RemoteSender(round_3.Nearest)

upstream_waterlevel = Panel(subtraction_3)
downstream_waterlevel = Panel(pdecon_3.ZComponent)

B = B(100)

division_7 = Division(A=i_energy_head_losses_2, B=B)
subtraction_4 = Subtraction(A=upstream_waterlevel, B=downstream_waterlevel)
subtraction_5 = Subtraction(A="1", B=division_7)
multiplication_3 = Multiplication(
    LevelDifference=subtraction_4,
    _1HeadLosses=subtraction_5,
    DesignDischarge=i_energy_design_discharge_2,
    GConstant=g_constant,
    PlantEfficiency=division)
roundd_3 = RoundToDecimalPlace(NumberX=multiplication_3, DecimalPlace=1, RoundType=0)  # -> Rounded, Difference
installed_capacity_mw = Panel(roundd_3.Rounded)

# ---- group: results / data in right formatting
num_6 = Number(installed_capacity_mw)
roundf = RoundToFactor(NumberX=num_6, Factor=1, RoundType=0)  # -> Rounded, Difference, MultiplierR, MultiplierX

# ----
gross_head_m = Panel(subtraction_4)
multiplication_4 = Multiplication(A=gross_head_m, B=subtraction_5)
net_head_m = Panel(multiplication_4)

multiplication_5 = Multiplication(DischargeUsed=discharge_used_m3_s, GConstant=g_constant, PlantEfficiency=division, NetHead=net_head_m)
generated_power_mw = Panel(multiplication_5)
multiplication_6 = Multiplication(A=generated_power_mw, B=i_energy_dt_2)
division_8 = Division(A=multiplication_6, B=1000)  # -> flatten(Result)
energy_production_gwh = Panel(division_8)
ma_2 = MassAddition(Input=energy_production_gwh)  # -> Result, PartialResults
roundd_4 = RoundToDecimalPlace(NumberX=ma_2.Result, DecimalPlace=1, RoundType=0)  # -> Rounded, Difference
energy_production_gwh_2 = Panel(roundd_4.Rounded)

python_3 = GhPythonScript(x=energy_production_gwh_2, y=installed_capacity_mw)  # -> out, a
# ---------- python_3: Python ----------
__author__ = "Kona"
__version__ = "2022.03.25"

import rhinoscriptsyntax as rs

a = round(((x*1000)/y/8760*100),1)
# ---------- end python_3 ----------
plant_factor = Panel(python_3.a)

# ---- group: results / data in right formatting
num_7 = Number(energy_production_gwh_2)
roundf_2 = RoundToFactor(NumberX=num_7, Factor=1, RoundType=0)  # -> Rounded, Difference, MultiplierR, MultiplierX

roundf_3 = RoundToFactor(NumberX=dist_5, Factor=100, RoundType=0)  # -> Rounded, Difference, MultiplierR, MultiplierX
round_5 = Round(Number=net_head_m)  # -> Nearest, Floor, Ceiling

len_3 = Length(Curve=axis_line_8)
num_8 = Number(len_3)
roundf_4 = RoundToFactor(NumberX=num_8, Factor=10, RoundType=0)  # -> Rounded, Difference, MultiplierR, MultiplierX
crest_elevation_2 = RemoteReceiver(crest_elevation)
ph_elevation_2 = RemoteReceiver(ph_elevation)
concat = Concatenate(FragmentA="1:", FragmentB=downstream_face_angle_ratio_1)
dam_height_5 = RemoteReceiver(dam_height)
width_crest_3 = RemoteReceiver(width_crest)
freeboard_3 = RemoteReceiver(freeboard)
panel_46 = Panel(concat)
num_9 = Number(plant_factor)
merge_8 = Merge(
    Data1=dam_height_5,
    Data2=freeboard_3,
    Data3=offset_foundation_3,
    Data4=width_crest_3,
    Data5=flatten(roundf_4.Rounded),
    Data6=panel_46,
    Data7=i_energy_head_losses_2,
    Data8=i_energy_design_discharge_2,
    Data9=i_energy_ecological_discharge_2,
    Data10=flatten(i_energy_powerplant_efficiency_2),
    Data11=flatten(roundf_3.Rounded),
    Data12=flatten(roundd.Rounded),
    Data13=flatten(roundd_2.Rounded),
    Data14=flatten(round_5.Nearest),
    Data15=flatten(crest_elevation_2),
    Data16=flatten(ph_elevation_2),
    Data17=flatten(roundf.Rounded),
    Data18=flatten(roundf_2.Rounded),
    Data19=flatten(num_9))  # -> graft(Result)

# ---- group: results / conduit
panel_47 = Panel("""Dam height = {1} m
Freeboard = {2}  m
Depth of foundation = {3} m
Crest width = {4} m
Crest length = {5} m
Downstream face slope = {6}
Head losses = {7} %
Design discharge = {8} m3/s
Ecological discharge = {9} m3/s
Plant efficiency = {10} %
Distance to the power house = {11} m
Volume water = {12} Mio m3
Volume dam = {13} Mio m3
Hn = {14} m
Crest elevation = {15} m asl
Power house elevation = {16} m asl
Installed capacity = {17} MW
Yearly production = {18} GWh
Plant Factor = {19} %""")
bounds = GetViewportBoundaryDimensions(Refresh=Button(), Origin=lowest_point_dam_section_4, Scale=0.25, xDim=1019, yDim=761)
grid_tiles = GridTiles(Boundary=bounds, Columns=5, Rows=Slider(3, range=0..10), InteriorPadding=0.02, ExteriorPadding=0.02, PaddingAxis=0)
format = Format(
    Format=panel_47,
    Culture=127,
    Data0=roundf_4.Rounded,
    Data1=dam_height_5,
    Data2=freeboard_3,
    Data3=offset_foundation_3,
    Data4=width_crest_3,
    Data5=roundf_4.Rounded,
    Data6=panel_46,
    Data7=i_energy_head_losses_2,
    Data8=i_energy_design_discharge_2,
    Data9=i_energy_ecological_discharge_2,
    Data10=i_energy_powerplant_efficiency_2,
    Data11=roundf_3.Rounded,
    Data12=roundd.Rounded,
    Data13=roundd_2.Rounded,
    Data14=round_5.Nearest,
    Data15=crest_elevation_2,
    Data16=ph_elevation_2,
    Data17=roundf.Rounded,
    Data18=roundf_2.Rounded,
    Data19=num_9)
item_19 = ListItem(List=grid_tiles, Index=0, Wrap=True)
Y = UnitY(Factor=Slider(100, range=0..100))
font = ConduitFont(
    Font="Arial",
    TextHeight=Slider(14, range=0..100),
    AdaptiveHeight=False,
    TextSpacing=1.15,
    Alignment=0,
    Bold=False,
    Italic=False,
    Color=RGB(0, 0, 0))
move_21 = Move(Geometry=item_19, Motion=Y)  # -> Geometry, Transform
rep = ReplaceText(Text=format, Find=",", Replace="'", RecursiveReplace=False)
hud_text = DrawText(Boundary=move_21.Geometry, Text=rep, TextOrdering=1, TextDistribution=0, OrientVertically=False, CustomFont=font)
hud = HeadsUpDisplayHUD(
    ShowHUD=Toggle(False),
    DrawingObjects=hud_text,
    DrawingBoundary=bounds,
    ConduitStyleSheet="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")

# ----
# Section
# Grundwasser
# Erdreich
number_slider_16 = Slider(4, range=0..10)  # disabled
num_10 = Number()  # disabled
swatch_7 = ColourSwatch(SwatchColor=RGB(214, 201, 180))  # disabled

number_slider_17 = Slider(-7.01, range=-50..10)  # disabled
pdecon_4 = Deconstruct(Point=evalsrf_2.Normal)  # -> XComponent, YComponent, ZComponent; disabled
pdecon_5 = Deconstruct(Point=midpt_3)  # -> XComponent, YComponent, ZComponent; disabled
toggle_7 = BooleanToggle(True)  # disabled
toggle_8 = BooleanToggle(True)  # disabled
number_slider_18 = Slider(0.5, range=0.5..100)  # disabled
c_script_3 = CSharpScript(polyList=flip.Surface)  # -> out, planeList; inputs polyList: list of Polyline; disabled
# ---------- c_script_3: C# ----------
    List<Plane> planes = new List<Plane>();
    foreach(Polyline poly in polyList){
      Plane plane = new Plane(poly.ElementAt(0), poly.ElementAt(1), poly.ElementAt(2));
      planes.Add(plane);
    }
    planeList = planes;
# ---------- end c_script_3 ----------
number_slider_19 = Slider(2.6, range=0.5..100)  # disabled
toggle_9 = BooleanToggle(True)  # disabled
c_script_4 = CSharpScript(
    enable=toggle_9,
    clipPlaneOrigin=[pdecon_5.XComponent, pdecon_5.YComponent, pdecon_5.ZComponent],
    clipPlaneDir=[pdecon_4.XComponent, pdecon_4.YComponent, pdecon_4.ZComponent],
    userPlanes=c_script_3.planeList,
    moveClipInZAxis=number_slider_17,
    flip=toggle_8,
    pageViews=toggle_7,
    index=number_slider_16,
    clipU=number_slider_18,
    clipV=number_slider_19)  # -> out, viewPicked, viewsInDocument, messageOfTheDay; inputs enable: Boolean, clipPlaneOrigin: list of Double, clipPlaneDir: list of Double, void4: list of Plane, useUserPlanes: Boolean, userPlanes: list of Plane, moveClipInZAxis: Double, flip: Boolean, pageViews: Boolean, index: Int32, clipU: Double, clipV: Double; disabled
# ---------- c_script_4: C# ----------
    //by The Lord of Darkness due to critical Vodka starvation issues

    Rhino.Display.RhinoView[] viewsList = RhinoDocument.Views.GetViewList(true, pageViews);

    if(index >= viewsList.Length) index = viewsList.Length - 1;
    List<string> availableViews = new List<string>();
    string viewP = "";

    for(int i = 0; i < viewsList.Length;i++){
      Rhino.Display.RhinoView rview = viewsList[i];
      availableViews.Add(rview.ActiveViewport.Name);
      if(i == index){
        rv = rview.ActiveViewport;
        viewP = rv.Name;
        viewPortID = rview.ActiveViewportID;
      }
    }
    viewsInDocument = availableViews; //>>out
    viewPicked = viewP;               //>>out

    int removed = 0;
    PurgeClipPlane(rv, ref removed);
    if(!enable){ Print("Clip(s): {0} removed", removed);return;}

    userPlanes = userPlanes.Where(x => x != Plane.Unset).ToList();
    if(useUserPlanes && userPlanes.Any()){
      for(int i = 0; i < userPlanes.Count;i++){
        Plane p = userPlanes[i];
        if(moveClipInZAxis != 0){
          Vector3d vz = p.ZAxis; vz.Unitize(); vz *= moveClipInZAxis;
          p.Translate(vz);
        }
        if(flip) p.Flip();        
        Guid id = doc.Objects.AddClippingPlane(p, clipU, clipV, viewPortID);
      }
      doc.Views.Redraw();
      Print("Clip(s): {0} active", userPlanes.Count);
    }
    else{
      Point3d orig = new Point3d(clipPlaneOrigin[0], clipPlaneOrigin[1], clipPlaneOrigin[2]);
      Plane plane = new Plane(orig, new Vector3d(clipPlaneDir[0], clipPlaneDir[1], clipPlaneDir[2]));
      if(moveClipInZAxis != 0){
        Vector3d vz = plane.ZAxis; vz.Unitize(); vz *= moveClipInZAxis;
        plane.Translate(vz);
      }
      if(flip)plane.Flip();
      Guid id = doc.Objects.AddClippingPlane(plane, clipU, clipV, viewPortID);
      Print("Clip:  active");
      if (id != Guid.Empty){  doc.Views.Redraw(); }
    }
# ---------- c_script_4: C# additional code ----------
  public Rhino.Display.RhinoViewport rv;
  public Guid viewPortID;

  public void PurgeClipPlane(Rhino.Display.RhinoViewport rv, ref int removed){
    ClippingPlaneObject[] clipObjects = RhinoDoc.ActiveDoc.Objects.FindClippingPlanesForViewport(rv);
    //.FindByObjectType(ObjectType.ClipPlane());
    // ClippingPlaneObject[] clipObjects = RhinoDoc.ActiveDoc.Objects.FindClippingPlanesForViewport(rv);
    //  if(clipObjects.Length < 1 || clipObjects == null)return;
    removed = clipObjects.Length;
    for(int i = 0; i < clipObjects.Length;i++){
      ClippingPlaneObject cpo = clipObjects[i];
      RhinoDoc.ActiveDoc.Objects.Purge(cpo);
    }
  }
# ---------- end c_script_4 ----------
panel_48 = Panel(c_script_4.viewPicked)  # disabled

Z_11 = UnitZ(Factor=num_10)  # disabled
move_22 = Move(Geometry=move_10.Geometry, Motion=Z_11)  # -> Geometry, Transform; disabled
srfsplit_2 = SurfaceSplit(Surface=brep_3, Curves=move_22.Geometry)  # disabled
pcen = PolygonCenter(Polyline=srfsplit_2)  # -> CenterV, CenterE, CenterA; disabled
pdecon_6 = Deconstruct(Point=pcen.CenterV)  # -> XComponent, YComponent, ZComponent; disabled
sort_3 = SortList(Keys=pdecon_6.ZComponent, ValuesA=srfsplit_2)  # -> Keys, ValuesA; disabled
panel_49 = Panel("1")  # disabled
split_10 = SplitList(List=sort_3.ValuesA, Index=panel_49)  # -> ListA, ListB; disabled

custom_preview_materials = CustomPreviewMaterials(Geometry=split_10.ListB, DiffuseColor=swatch_7, Transparency=0)  # disabled
custom_preview_materials_2 = CustomPreviewMaterials(Geometry=split_10.ListA, DiffuseColor=swatch_2, Transparency=0)  # disabled

# ----
# Texture option
hatchtable = HatchTable(Update=True)  # disabled
number_slider_20 = Slider(3, range=0..100)  # disabled
number_slider_21 = Slider(2, range=0..100)  # disabled
list_6 = ItemSelector(
    hatchtable,
    {"Solid", "Hatch1", "Hatch2", "Hatch3", "HatchDash", "Grid", "Grid60", "Plus", "Squares"}, selected="HatchDash")  # disabled
list_7 = ItemSelector(hatchtable, {"Solid", "Hatch1", "Hatch2", "Hatch3", "HatchDash", "Grid", "Grid60", "Plus", "Squares"}, selected="Grid")  # disabled
createhatch = CreateHatch(Bake=False, Curves=split_10.ListA, HatchPatternName=list_6, HatchScale=number_slider_20, HatchRotation=0)  # -> HatchGeometry, HatchObjects; disabled
createhatch_2 = CreateHatch(Bake=False, Curves=split_10.ListB, HatchPatternName=list_7, HatchScale=number_slider_21, HatchRotation=0)  # -> HatchGeometry, HatchObjects; disabled
swatch_8 = ColourSwatch(SwatchColor=RGB(58, 169, 189))  # disabled
number_slider_22 = Slider(0, range=0..10)  # disabled
swatch_9 = ColourSwatch(SwatchColor=RGB(168, 117, 35))  # disabled
number_slider_23 = Slider(0, range=0..10)  # disabled
previewlw_6 = CustomPreviewLineweights(Geometry=createhatch.HatchGeometry, Shader=swatch_8, Thickness=number_slider_22, Absolute=True)  # disabled
previewlw_7 = CustomPreviewLineweights(Geometry=createhatch_2.HatchGeometry, Shader=swatch_9, Thickness=number_slider_23, Absolute=True)  # disabled

# ---- group: Dimension
pdecon_7 = Deconstruct(Point=midpt_3)  # -> XComponent, YComponent, ZComponent; disabled
pt_17 = ConstructPoint(XCoordinate=pdecon_7.XComponent, YCoordinate=pdecon_7.YComponent, ZCoordinate=num_10)  # disabled
number_slider_24 = Slider(2, range=0..10)  # disabled
aligndim = AlignedDimension(Plane=extr_6, PointA=midpt_3, PointB=pt_17, Offset=1, Text="{0:0.00}", Size=number_slider_24)  # disabled

# ---- group: results
panel_50 = Panel("""Dam height [m]
Freeboard [m]
Depth of foundation [m]
Crest width [m]
Crest length [m]
Downstream face slope [-]
Head losses [%]
Design discharge [m3/s]
Ecological discharge [m3/s]
Plant efficiency [%]
Distance to the power house [m]
Volume water [Mio m3]
Volume dam [Mio m3]
Hn [m] 
Crest elevation [m asl]
Power house elevation [m asl]
Installed capacity [MW]
Yearly production [GWh]
Plant Factor [%]""")
panel_51 = Panel(merge_8)
toggle_10 = BooleanToggle(False)

# ---- group: results / variants / chooses correct variables
index = Panel("""0
4
14
11
12
10
13
16
17
18""")
data = Data(flatten(panel_51))
item_20 = ListItem(List=data, Index=index, Wrap=True)

# ----
lng_3 = ListLength(List=index)
series = Series(Start=0, Step=1, Count=lng_3)
null = NullPlaceholder()
ins = InsertItems(List=null, Item=null, Indices=series, Wrap=True)  # -> simplify(List)

# ---- group: results / variants
data_2 = Data(panel_50)
item_21 = ListItem(List=data_2, Index=index, Wrap=True)
panel_52 = Panel("VARIANT ")

# ---- group: results / variants / heading
merge_9 = Merge(Data1=panel_52, Data2=item_21)  # -> flatten(Result)

# ---- group: results / INPUT_values
index_2 = Panel("""1
2
3
5
6
7
8
9
15""")
data_3 = Data(flatten(panel_51))
data_4 = Data(panel_50)
item_22 = ListItem(List=data_4, Index=index_2, Wrap=True)
item_23 = ListItem(List=data_3, Index=index_2, Wrap=True)  # -> graft(Item)
headings = Panel(item_22)

# ---- group: results / variants
concat_2 = Concatenate(FragmentA="V ", FragmentB=list_5)
merge_10 = Merge(Data1=concat_2, Data2=item_20)  # -> flatten(Result)

# ----
merge_11 = Merge(Data1=concat_2, Data2=item_20)  # -> flatten(Result)
merge_12 = Merge(Data1=concat_2, Data2=item_20)  # -> flatten(Result)
merge_13 = Merge(Data1=concat_2, Data2=item_20)  # -> flatten(Result)
merge_14 = Merge(Data1=concat_2, Data2=item_20)  # -> flatten(Result)
filter_4 = StreamFilter(Gate=equals.Equality, Stream1=merge_10)
filter_5 = StreamFilter(Gate=equals_4.Equality, Stream1=merge_11)
filter_6 = StreamFilter(Gate=equals_5.Equality, Stream1=merge_12)
filter_7 = StreamFilter(Gate=equals_2.Equality, Stream1=merge_13)
filter_8 = StreamFilter(Gate=equals_3.Equality, Stream1=merge_14)

# ---- group: results / variants / allows to compare up to 5 Variants
entwine_2 = Entwine(
    Branch00=merge_9,
    Branch01=filter_4,
    Branch02=filter_5,
    Branch03=filter_6,
    Branch04=filter_7,
    Branch05=filter_8,
    FlattenInputs=True)

# ---- group: results / INPUT_tabelle
headers = Panel("""Month
Discharge in the river [m3/s]
Delta T [h] """)
panel_53 = Panel("""Jan
Feb
Mär
Apr
Mai
Jun
Jul
Aug
Sep
Okt
Nov
Dez""")
i_energy_dir_3 = RemoteReceiver(i_energy_dir)
i_energy_dt_3 = RemoteReceiver(i_energy_dt)
entwine_3 = Entwine(Branch00=panel_53, Branch01=i_energy_dir_3, Branch02=i_energy_dt_3, FlattenInputs=True)  # -> simplify(Result)
toggle_11 = BooleanToggle(False)
path = FilePath("C:\Users\KONA\Desktop\dam_input_values.xlsx")
panel_54 = Panel("INPUT_tabelle")

# ---- group: results / INPUT_values (continued)
excelwrite = ExcelWrite(
    WriteExcelData=Toggle(False),
    WorkbookPath=path,
    WorksheetName="INPUT_values",
    ColumnHeadings=headings,
    Data=item_23,
    ClearSheet=toggle_10)
panel_55 = Panel(excelwrite)

# ---- group: results (continued)
excelwrite_2 = ExcelWrite(
    WriteExcelData=toggle_11,
    WorkbookPath=path,
    WorksheetName=panel_54,
    ColumnHeadings=headers,
    Data=entwine_3,
    ClearSheet=toggle_10)

# ---- group: results / INPUT_tabelle (continued)
panel_56 = Panel(excelwrite_2)

# ---- group: results / variants (continued)
insert_data = GhPythonScript(
    run=Toggle(False),
    xlsx_filepath=path,
    xlsx_worksheet="RESULTS",
    data=entwine_2,
    rel_position_x="1",
    rel_position_y="1",
    variant_position=list_5)  # -> out, a; inputs run: Boolean, data: tree, rel_position_x: Int32, rel_position_y: Int32
# ---------- insert_data: Python ----------
__author__ = "KONA"
__version__ = "2022.04.14"

import rhinoscriptsyntax as rs
import scriptcontext as sc
import string
import ghpythonlib.treehelpers as th

a = th.tree_to_list(data)

openpyxl = sc.sticky['openpyxl']
PIL = sc.sticky['PIL']

if _run == True:
    #load workbook and worksheet
    workbook = openpyxl.load_workbook(filename=xlsx_filepath, read_only=False)
    worksheet = workbook[xlsx_worksheet]
    
    #write Data to column (at defined position)
    for list_count, list in enumerate(a):
        for count, data_item in enumerate(list):
            print list_count
            print count
            print data_item
            cellref = worksheet.cell(row = rel_position_y + list_count,column = rel_position_x + count)
            print (cellref)
            cellref.value = data_item
        list_count += variant_position
        
        workbook.save(xlsx_filepath)
    else:
        pass
# ---------- end insert_data ----------
panel_57 = Panel(insert_data.a)

# ==== cluster GHPythonRemote: Connects the Grasshopper Python component to an external Python instance.
python = PythonScript()  # -> gh_parent_doc_dir
# ---------- python: Python ----------
from os import path

gh_parent_doc_dir = path.abspath(path.dirname(ghenv.Component.OnPingDocument().Owner.OnPingDocument().FilePath))
# ---------- end python ----------
# GH to python remote example.
# Pierre Cuvilliers, 2017-2018
# Released under the MIT license
# github.com/pilcru/ghpythonremote
# Runs and connects to an external python engine, and
# assigns imported modules to scriptcontext.sticky variables.
# 
# Arguments:
#       code (str): Path to the GH_to_python_sticky.py code file.
#       location (str): Path to a python executable, or to a folder
#             containing `python.exe`, or the name of a conda-created
#             virtual environment prefixed by `conda://` (`conda://env_name`).
#             If empty, finds python from your windows %PATH%.
#       run (boolean): Creates the connection, and imports new
#             modules, when turned to True. Kills the connection,
#             and deletes the references to the imports, when turned
#             to False.
#       modules (str list): List of module names to import in the
#             remote python. They will be added to the
#             scriptcontext.sticky dictionary, allowing them to be
#             reused from other python components in the same
#             Grasshopper document. Submodules (for example
#             `numpy.linalg` have to be added explicitly to this list
#             to be available later.
#       log_level (str from ['NOTSET', 'DEBUG', 'INFO', 'WARNING', 'ERROR', 'CRITICAL']):
#             Logging level to use for the local IronPython and the
#             remote python instance.
#       working_dir (str): Working directory for the remote python
#             instance.
# 
# Returns:
#       out (str): Console output with DEBUG information.
#       linked_modules (str list): list of imported module names.
#       rpy (rpyc connection object): The object representing the
#             remote Python interpreter.
location = ClusterInput()  # location (str): Path to a python executable, or to a folder containing `python.exe`, or the name of a conda-created virtual environment prefixed by `conda://` (`conda://env_name`). If empty, finds python from your windows %PATH%.
run = ClusterInput()  # run (boolean): Creates the connection, and imports new modules, when turned to True. Kills the connection,and deletes the references to the imports, when turned to False.
modules = ClusterInput()  # modules (str list): List of module names to import in the remote python. They will be added to the scriptcontext.sticky dictionary, allowing them to be reused from other python components in the same Grasshopper document. Submodules (for example `numpy.linalg` have to be added explicitly to this list to be available later.
list = ValueList({"CRITICAL", "ERROR", "WARNING", "INFO", "DEBUG", "NOTSET"}, selected="DEBUG")
panel = Panel(python)
ghpythonremote = GHPythonRemote(location=location, run=run, modules=modules, log_level=list, working_dir=panel)  # -> out, linked_modules, rpy; inputs run: Boolean, modules: list
# ---------- ghpythonremote: Python ----------
import inspect
import logging
from os import path
import sys
from time import sleep

import scriptcontext

import ghpythonremote
from ghpythonremote.connectors import GrasshopperToPythonRemote

local_log_level = getattr(logging, log_level, logging.WARNING)
logger = logging.getLogger("ghpythonremote")
logger.setLevel(local_log_level)
ch = logging.StreamHandler()
ch.setLevel(local_log_level)
formatter = logging.Formatter("%(levelname)s: %(name)s:\n%(message)s")
ch.setFormatter(formatter)
logger.handlers = []
logger.addHandler(ch)
logger = logging.getLogger("ghpythonremote.GH_to_python")

ROOT = path.abspath(path.dirname(inspect.getfile(ghpythonremote)))
rpyc_server_py = path.join(ROOT, "pythonservice.py")

# Set connection to CLOSED if this is the first run
# and initialize set of linked modules
try:
    remote_python_status
except NameError:
    remote_python_status = "CLOSED"
    lkd_modules = set()

# Wait for connection to connect or terminate
timer = 0
while remote_python_status == "CONNECTING" or remote_python_status == "CLOSING":
    sleep(1)
    timer += 1
    if timer == 10:
        try:
            gh2py_manager.__exit__(*sys.exc_info())
        except Exception:
            pass
        remote_python_status = "CLOSED"
        lkd_modules = set()
        raise RuntimeError(
            "Connection left in an inconsistent state and not returning. Reset "
            "everything."
        )

if run:
    if not remote_python_status == "OPEN":
        remote_python_status = "CONNECTING"
        gh2py_manager = GrasshopperToPythonRemote(
            rpyc_server_py,
            location=location,
            timeout=10,
            port=None,
            log_level=log_level,
            working_dir=working_dir,
        )
        gh2py = gh2py_manager.__enter__()
        remote_python_status = "OPEN"

    # Stuff that we can reach
    rpymod = gh2py.py_remote_modules  # A getter function for a named python module
    rpy = gh2py.connection  # Represents the remote instance root object
    scriptcontext.sticky["rpy"] = rpy
    # Add modules
    for mod in modules:
        try:
            scriptcontext.sticky[mod] = rpymod(mod)
            lkd_modules.add(mod)
        except ImportError:
            gh2py_manager.__exit__(*sys.exc_info())
            raise

elif not remote_python_status == "CLOSED":
    remote_python_status = "CLOSING"
    # Remove linked modules
    for mod in lkd_modules:
        del scriptcontext.sticky[mod]
    del scriptcontext.sticky["rpy"]
    gh2py_manager.__exit__(*sys.exc_info())
    lkd_modules = set()
    remote_python_status = "CLOSED"

# Change variable name because ghpython resets outputs to None before each run
linked_modules = lkd_modules

logger.info("GH to python connection is {}".format(remote_python_status))
# ---------- end ghpythonremote ----------
out = ClusterOutput(ghpythonremote.out)  # Console output.
linked_modules = ClusterOutput(ghpythonremote.linked_modules)  # Names of modules that were successfully added to the scriptcontext.sticky dictionary.
rpy = ClusterOutput(ghpythonremote.rpy)  # The object representing the remote python instance
python_2 = PythonScript(module_names=ghpythonremote.linked_modules)  # -> import_statements; inputs module_names: list
# ---------- python_2: Python ----------
import_statements = ["import scriptcontext as sc"]
for module_name in module_names:
    import_statements.append("{0} = sc.sticky['{0}']".format(module_name))

if len(module_names) == 0:
    import_statements = []
# ---------- end python_2 ----------
import_statements = ClusterOutput(python_2)  # Useful import statements to use the imported modules in your scripts.
