# Grasshopper definition export.gh (Grasshopper 1.0.7)
# plug-ins: Heron

input = DataInput(
    Destination="C:\Users\Admin\Documents\Github\EarlyStageDesign\JD\Skripts\ghData\ArchDam_test_to_export.ghdata",
    RelativePath="C:\Users\Admin\Documents\Github\EarlyStageDesign\JD\Skripts\ghData\ArchDam_test_to_export.ghdata|ArchDam_test_to_export.ghdata",
    UpdateDelay=50000)  # -> A, B, C, D, E
input_2 = DataInput(
    Destination="C:\Users\Admin\Documents\Github\EarlyStageDesign\JD\Skripts\ghData\Water_test_to_export.ghdata",
    RelativePath="C:\Users\Admin\Documents\Github\EarlyStageDesign\JD\Skripts\ghData\Water_test_to_export.ghdata|Water_test_to_export.ghdata",
    UpdateDelay=50000)  # -> A, B, C, D, E
input_3 = DataInput(
    Destination="C:\Users\Admin\Documents\Github\EarlyStageDesign\JD\Skripts\ghData\DamAxis.ghdata",
    RelativePath="C:\Users\Admin\Documents\Github\EarlyStageDesign\JD\Skripts\ghData\DamAxis.ghdata|DamAxis.ghdata",
    UpdateDelay=50000)  # -> D, E, A, C, B

# ---- group: This didn't make a difference when exporting the values
txt = Text(graft(input.D))  # disabled
num = Number(graft(input.D))  # disabled
null = NullItem(Item=num)  # -> NullFlags, InvalidFlags, Description; disabled
dispatch = Dispatch(List=num, DispatchPattern=null.NullFlags)  # -> ListA, flatten(ListB); disabled
dispatch_2 = Dispatch(List=txt, DispatchPattern=null.NullFlags)  # -> flatten(ListA), ListB; disabled
merge = Merge(Data1=dispatch_2.ListA, Data2=dispatch.ListB)  # disabled
data = Data(flatten([dispatch_2.ListA, dispatch.ListB]))  # disabled

# ----
save = Button()
panel = Panel(input.A)
panel_2 = Panel(input_2.A)
srs = SetSpatialReferenceSystem(SRS="EPSG:2056")
crv = Curve(input_3.A)
panel_3 = Panel(input_2.B)
panel_4 = Panel(input_3.E)
panel_5 = Panel(input.B)
exportvector = ExportVector(
    VectorDataFilename=input.A,
    VectorDataFolder=input.B,
    Fields=input.C,
    Values=input.D,
    FeatureGeometry=input.E,
    Export=save,
    DriverExtension=".shp",
    DriverType="ESRI Shapefile")
exportvector_2 = ExportVector(
    VectorDataFilename=input_2.A,
    VectorDataFolder=input_2.B,
    Fields=input_2.C,
    Values=input_2.D,
    FeatureGeometry=input_2.E,
    Export=save,
    DriverExtension=".shp",
    DriverType="ESRI Shapefile")
exportvector_3 = ExportVector(
    VectorDataFilename=input_3.D,
    VectorDataFolder=input_3.E,
    Fields=input_3.C,
    Values=input_3.B,
    FeatureGeometry=crv,
    Export=save,
    DriverExtension=".shp",
    DriverType="ESRI Shapefile")
panel_6 = Panel(input_3.D)
panel_7 = Panel(exportvector)
panel_8 = Panel(exportvector_3)
panel_9 = Panel(exportvector_2)
panel_10 = Panel(merge)
