# Grasshopper definition setup.gh (Grasshopper 1.0.7)
# plug-ins: MeshEdit Components, EleFront

# Adjust the layer for
# where the geometry is
pipeline = GeometryPipeline(
    GroupByLayer=False,
    GroupByType=False,
    IncludeHidden=True,
    IncludeLocked=True,
    LayerFilter="Default",
    NameFilter="*",
    SublayerFiltering=True,
    TypeFilter=32)
mjoin = MeshJoin(Meshes=pipeline)
# Bake into "Terrain" layer
number_slider = Slider(10, range=0..10)
weldvertices = MeshWeldVertices(Mesh=mjoin, Tolerance=number_slider)  # -> RuntimeMessage, Mesh
height_of_the_levels = Slider(5, range=0..100)  # disabled

# ----
# TERRAIN
# This is done once you open the file with the available terrain, then save into the respective layers
# Lowest point in terrain
# Highest point in terrain
demesh = DeconstructMesh(Mesh=weldvertices.Mesh)  # -> Vertices, Faces, Colours, Normals; disabled
pdecon = Deconstruct(Point=demesh.Vertices)  # -> XComponent, YComponent, ZComponent; disabled
subdmesh = SubDFromMesh(Mesh=weldvertices.Mesh, Creases=1, Corners=1, Interpolate=False)  # disabled
sort = SortList(Keys=pdecon.ZComponent, ValuesA=demesh.Vertices)  # -> Keys, ValuesA; disabled
brep = Brep(subdmesh)  # disabled
item = ListItem(List=sort.ValuesA, Index=0, Wrap=True)  # disabled
item_2 = ListItem(List=reverse(sort.ValuesA), Index=0, Wrap=True)  # disabled
pdecon_2 = Deconstruct(Point=item)  # -> XComponent, YComponent, ZComponent; disabled
pdecon_3 = Deconstruct(Point=item_2)  # -> XComponent, YComponent, ZComponent; disabled
subtraction = Subtraction(A=pdecon_3.ZComponent, B=pdecon_2.ZComponent)  # disabled
pln = Plane(item)  # disabled
project = Project(Geometry=brep, Plane=pln)  # -> Geometry, Transform; disabled
fmerge = MergeFaces(Brep=project.Geometry)  # -> Breps, Before, After; disabled
integer_division = IntegerDivision(A=subtraction, B=height_of_the_levels)  # disabled
series = Series(Start=0, Step=height_of_the_levels, Count=integer_division)  # disabled
Z = UnitZ(Factor=series)  # disabled
move = Move(Geometry=fmerge.Breps, Motion=Z)  # -> Geometry, Transform; disabled
bbx = BrepBrep(BrepA=brep, BrepB=move.Geometry)  # -> Curves, Points; disabled

layer = DefineLayer()
bakelayer = BakeModifyLayer(Bake=False)
